# Grasshopper definition heathUI_0.1.1-dev-im.gh (Grasshopper 1.0.8)
# plug-ins: RhinoCodePluginGH, Heteroptera, Human UI, Pufferfish, Human, Spectacles.GrasshopperExporter, LadybugGrasshopper, eleFront, Wombat, froGH, Telepathy

panel = Panel("""LargeOffice
MediumOffice
SmallOffice
MidriseApartment
HighriseApartment
Retail
StripMall
PrimarySchool
SecondarySchool
SmallHotel
LargeHotel
Hospital
Outpatient
Laboratory
Warehouse
SuperMarket
FullServiceRestaurant
QuickServiceRestaurant
Courthouse
LargeDataCenterHighITE
LargeDataCenterLowITE
SmallDataCenterHighITE
SmallDataCenterLowITE""")
bldg_programs = RemoteSender(panel)

# ----
# Visualize module
panel_2 = Panel("""Program
Construction Set
Is Conditioned
People per Area [ppl/m2]
Area per Person [m2/ppl]
Lighting per Area [W/m2]
Electric Equipment per Area [W/m2]
Gas Equipment per Area [W/m2]
Hot Water per Area [L/h-m2]""")
panel_3 = Panel("""Display Name
Simulation Name (Identifier)
Boundary Condition
Has Parent
Parent
Azimuth
Altitude
Area
Perimeter
Face Type
Aperture Is Operable
Door Is Glass""")
panel_4 = Panel("""Construction
Materials
Thickness [m]
Density [kg/m2]
Heat Capacity [J/K-m2]
Construction R-Value [m2-K/W]
Construction U-Value [W/m2-K]
Construction U-Factor [W/m2-K]
Construction SHGC [Unshaded]
R-Factor [m2-K/W]
U-Factor [W/m2-K]
SHGC [Unshaded]""")
panel_5 = Panel("""Display Name
Simulation Name (Identifier)
Multiplier
Floor Area Excluded
Story
Volume
Gross Floor Area
Exposed Area
Exterior Wall Area
Exterior Aperture Area
Average Floor Elevation""")
toggle = CreateToggle(Default=False)
label = CreateLabel(LabelText="Run weather visualization", LabelSize=12, Justification=0)
checkbox = CreateCheckbox(Label="Sky dome", StartingValue=False)
checkbox_2 = CreateCheckbox(Label="Sky mask", StartingValue=False)
checkbox_3 = CreateCheckbox(Label="Wind rose", StartingValue=False)
checkbox_4 = CreateCheckbox(Label="Dry bulb temperature line chart", StartingValue=False)
checkbox_5 = CreateCheckbox(Label="Dry bulb temperature 2D chart", StartingValue=False)
checkbox_6 = CreateCheckbox(Label="Direct sun hours", StartingValue=False)
checkbox_7 = CreateCheckbox(Label="Incident radiation", StartingValue=False)
values = ValueListener(Elements=checkbox_3, SomeProperty=True)  # -> Values, Indices
values_2 = ValueListener(Elements=checkbox_2, SomeProperty=True)  # -> Values, Indices
values_3 = ValueListener(Elements=checkbox_4, SomeProperty=True)  # -> Values, Indices
values_4 = ValueListener(Elements=checkbox_5, SomeProperty=True)  # -> Values, Indices
values_5 = ValueListener(Elements=checkbox_6, SomeProperty=True)  # -> Values, Indices
values_6 = ValueListener(Elements=checkbox, SomeProperty=True)  # -> Values, Indices
values_7 = ValueListener(Elements=checkbox_7, SomeProperty=True)  # -> Values, Indices
values_8 = ValueListener(Elements=toggle, SomeProperty=True)  # -> Values, Indices
pulldown = CreatePulldownMenu(Label="Room attribute", ListItems=panel_5, showLabel=True)
checkbox_8 = CreateCheckbox(Label="Visualize", StartingValue=False)
pulldown_2 = CreatePulldownMenu(Label="Room energy attribute", ListItems=panel_2, showLabel=True)
checkbox_9 = CreateCheckbox(Label="Visualize", StartingValue=False)
label_2 = CreateLabel(LabelText="Attributes visualization", LabelSize=12, Justification=0)
checkbox_10 = CreateCheckbox(Label="Visualize", StartingValue=False)
pulldown_3 = CreatePulldownMenu(Label="Face attribute", ListItems=panel_3, showLabel=True)
pulldown_4 = CreatePulldownMenu(Label="Face energy attribute", ListItems=panel_4, showLabel=True)
checkbox_11 = CreateCheckbox(Label="Visualize", StartingValue=False)
dry_bulb_temperature_line_chart = RemoteSender(values_3.Values)
run_weather_visualisation = RemoteSender(values_8.Values)
direct_sun_hours = RemoteSender(values_5.Values)
incident_radiation = RemoteSender(values_7.Values)
sky_mask = RemoteSender(values_2.Values)
wind_rose = RemoteSender(values.Values)
dry_bulb_temperature_2d_chart = RemoteSender(values_4.Values)
sky_dome = RemoteSender(values_6.Values)
entwine = Entwine(Branch00=pulldown, Branch01=checkbox_8, FlattenInputs=True)  # -> flatten(Result)
entwine_2 = Entwine(Branch00=pulldown_2, Branch01=checkbox_9, FlattenInputs=True)  # -> flatten(Result)
entwine_3 = Entwine(Branch00=pulldown_3, Branch01=checkbox_10, FlattenInputs=True)  # -> flatten(Result)
entwine_4 = Entwine(Branch00=pulldown_4, Branch01=checkbox_11, FlattenInputs=True)  # -> flatten(Result)
stack = CreateStack(UIElements=entwine_2, Horizontal=True)
stack_2 = CreateStack(UIElements=entwine, Horizontal=True)
stack_3 = CreateStack(UIElements=entwine_3, Horizontal=True)
stack_4 = CreateStack(UIElements=entwine_4, Horizontal=True)
entwine_5 = Entwine(Branch00=label, Branch01=toggle, FlattenInputs=True)  # -> flatten(Result)
entwine_6 = Entwine(
    Branch00=checkbox,
    Branch01=checkbox_2,
    Branch02=checkbox_3,
    Branch03=checkbox_4,
    Branch04=checkbox_5,
    Branch05=checkbox_6,
    Branch06=checkbox_7,
    FlattenInputs=True)  # -> flatten(Result)
run_weather_visualisation_2 = RemoteReceiver(run_weather_visualisation)
stack_5 = CreateStack(UIElements=entwine_6, Horizontal=invert(True))
stack_6 = CreateStack(UIElements=entwine_5, Horizontal=True)
entwine_7 = Entwine(Branch00=label_2, Branch01=stack_2, Branch02=stack, Branch03=stack_3, Branch04=stack_4, FlattenInputs=True)  # -> flatten(Result)
entwine_8 = Entwine(Branch00=stack_6, Branch01=stack_5, FlattenInputs=True)  # -> flatten(Result)
hideshow = HideShowElement(ElementToHideShow=stack_5, Show=run_weather_visualisation_2, Collapse=True, Disable=False)
stack_7 = CreateStack(UIElements=entwine_7, Horizontal=invert(True))
adjustpos = AdjustElementPositioning(
    ElementsToAdjust=label_2,
    AbsolutePositioning=False,
    Width=Slider(145, range=0..300),
    Height=Slider(25, range=0..300),
    HorizontalAlignment=0)
adjustpos_2 = AdjustElementPositioning(ElementsToAdjust=pulldown, AbsolutePositioning=False, Width=Slider(335, range=0..400), HorizontalAlignment=0)
adjustpos_3 = AdjustElementPositioning(ElementsToAdjust=pulldown_2, AbsolutePositioning=False, Width=Slider(335, range=0..400), HorizontalAlignment=0)
stack_8 = CreateStack(UIElements=entwine_8, Horizontal=invert(True))
adjustpos_4 = AdjustElementPositioning(ElementsToAdjust=pulldown_3, AbsolutePositioning=False, Width=Slider(335, range=0..400), HorizontalAlignment=0)
adjustpos_5 = AdjustElementPositioning(ElementsToAdjust=pulldown_4, AbsolutePositioning=False, Width=Slider(335, range=0..400), HorizontalAlignment=0)
border = CreateBorder(
    UIElement=stack_7,
    BorderThickness=Slider(1, range=0..10),
    BorderColor=ColourSwatch(SwatchColor=RGB(217, 217, 217)),
    CornerRadius=Slider(2, range=0..10))
adjustpos_6 = AdjustElementPositioning(
    ElementsToAdjust=label,
    AbsolutePositioning=False,
    Width=Slider(145, range=0..300),
    Height=Slider(30, range=0..300),
    HorizontalAlignment=0)
border_2 = CreateBorder(
    UIElement=stack_8,
    BorderThickness=Slider(1, range=0..10),
    BorderColor=ColourSwatch(SwatchColor=RGB(217, 217, 217)),
    CornerRadius=Slider(2, range=0..10))
adjustpos_7 = AdjustElementPositioning(
    ElementsToAdjust=border_2,
    Margin="0, 0, 0, 0",
    AbsolutePositioning=False,
    Width=Slider(355, range=0..400),
    Height=Slider(200, range=0..300),
    HorizontalAlignment=0)
adjustpos_8 = AdjustElementPositioning(ElementsToAdjust=stack_5, Margin="10, 2, 0, 0", AbsolutePositioning=False)
adjustpos_9 = AdjustElementPositioning(
    ElementsToAdjust=border,
    Margin="10, 0, 0, 0",
    AbsolutePositioning=False,
    Width=Slider(435, range=0..1000),
    HorizontalAlignment=0)

panel_6 = Panel("""Full model
Walls
Roof
Floors
Ground
Windows
Doors
Context""")
pulldown_5 = CreatePulldownMenu(Label="Model component", ListItems=panel_6, showLabel=True)
checkbox_12 = CreateCheckbox(Label="Visualize", StartingValue=False)

# ----
# Assembly model
number_slider = Slider(0.1, range=0..0.1)
textbox = CreateTextBox(Label="Model name", DefaultText="My model", UpdateButton=invert(True), showLabel=True)
toggle_2 = CreateToggle(Default=False)
label_3 = CreateLabel(LabelText="Create model", LabelSize=12, Justification=0)
button = CreateButton(ButtonName="Create model", ButtonStyle=0)
toggle_3 = CreateToggle(Default=False)
label_4 = CreateLabel(LabelText="Generate windows using WWR", LabelSize=12, Justification=0)
slider = CreateSlider(
    Slider=Slider(0.5, range=0..1),
    SnapValue=number_slider,
    ShowBounds=False,
    ShowTicks=True,
    ShowTooltip=False,
    ShowValLabel=True,
    showLabel=False)
slider_2 = CreateSlider(
    Slider=Slider(0.3, range=0..1),
    SnapValue=Slider(0.1, range=0..0.1),
    ShowBounds=False,
    ShowTicks=True,
    ShowTooltip=False,
    ShowValLabel=True,
    showLabel=False)
slider_3 = CreateSlider(
    Slider=Slider(0.3, range=0..1),
    SnapValue=Slider(0.1, range=0..0.1),
    ShowBounds=False,
    ShowTicks=True,
    ShowTooltip=False,
    ShowValLabel=True,
    showLabel=False)
label_5 = CreateLabel(LabelText="Set wall thickness", LabelSize=12, Justification=0)
label_6 = CreateLabel(LabelText="Set roof thickness", LabelSize=12, Justification=0)
slider_4 = CreateSlider(
    Slider=Slider(50, range=0..100),
    SnapValue=Slider(5, range=0..10),
    ShowBounds=False,
    ShowTicks=True,
    ShowTooltip=False,
    ShowValLabel=True,
    showLabel=False)
slider_5 = CreateSlider(
    Slider=Slider(50, range=0..100),
    SnapValue=Slider(5, range=0..10),
    ShowBounds=False,
    ShowTicks=True,
    ShowTooltip=False,
    ShowValLabel=True,
    showLabel=False)
slider_6 = CreateSlider(
    Slider=Slider(0, range=0..10),
    SnapValue=Slider(1, range=0..1),
    ShowBounds=False,
    ShowTicks=True,
    ShowTooltip=False,
    ShowValLabel=True,
    showLabel=False)
label_7 = CreateLabel(LabelText="Louver depth", LabelSize=12, Justification=0)
label_8 = CreateLabel(LabelText="Distance between louvers", LabelSize=12, Justification=0)
label_9 = CreateLabel(LabelText="Number of louvers", LabelSize=12, Justification=0)
slider_7 = CreateSlider(
    Slider=Slider(50, range=0..100),
    SnapValue=Slider(5, range=0..10),
    ShowBounds=False,
    ShowTicks=True,
    ShowTooltip=False,
    ShowValLabel=True,
    showLabel=False)
label_10 = CreateLabel(LabelText="Louver angle", LabelSize=12, Justification=0)
entwine_9 = Entwine(Branch00=label_3, Branch01=toggle_2, FlattenInputs=True)  # -> flatten(Result)
values_9 = ValueListener(Elements=toggle_2, SomeProperty=True)  # -> Values, Indices
values_10 = ValueListener(Elements=textbox, SomeProperty=True)  # -> Values, Indices
values_11 = ValueListener(Elements=slider_2, SomeProperty=True)  # -> Values, Indices
values_12 = ValueListener(Elements=slider_3, SomeProperty=True)  # -> Values, Indices
values_13 = ValueListener(Elements=slider_6, SomeProperty=True)  # -> Values, Indices
values_14 = ValueListener(Elements=slider_5, SomeProperty=True)  # -> Values, Indices
values_15 = ValueListener(Elements=slider_4, SomeProperty=True)  # -> Values, Indices
values_16 = ValueListener(Elements=slider_7, SomeProperty=True)  # -> Values, Indices
panel_7 = Panel(values_10.Values)
model_name = RemoteSender(values_10.Values)
run_simulation = RemoteSender(values_9.Values)
panel_8 = Panel(values_9.Values)
entwine_10 = Entwine(Branch00=label_5, Branch01=slider_2, FlattenInputs=True)  # -> flatten(Result)
values_17 = ValueListener(Elements=toggle_3, SomeProperty=True)  # -> Values, Indices
entwine_11 = Entwine(Branch00=label_7, Branch01=slider_4, FlattenInputs=True)  # -> flatten(Result)
entwine_12 = Entwine(Branch00=label_8, Branch01=slider_5, FlattenInputs=True)  # -> flatten(Result)
entwine_13 = Entwine(Branch00=label_9, Branch01=slider_6, FlattenInputs=True)  # -> flatten(Result)
stack_9 = CreateStack(UIElements=entwine_9, Horizontal=True)
entwine_14 = Entwine(Branch00=label_10, Branch01=slider_7, FlattenInputs=True)  # -> flatten(Result)
values_18 = ValueListener(Elements=slider, SomeProperty=True)  # -> Values, Indices
entwine_15 = Entwine(Branch00=label_6, Branch01=slider_3, FlattenInputs=True)  # -> flatten(Result)
wall_thickness = RemoteSender(values_11.Values)
distance_between_louvers = RemoteSender(values_14.Values)
louver_depth = RemoteSender(values_15.Values)
roof_thickness = RemoteSender(values_12.Values)
louver_angle = RemoteSender(values_16.Values)
number_of_louvers = RemoteSender(values_13.Values)
entwine_16 = Entwine(Branch00=toggle_3, Branch01=slider, FlattenInputs=True)  # -> flatten(Result)
filter = StreamFilter(Gate=values_17.Values, Stream0="0", Stream1=values_18.Values)
stack_10 = CreateStack(UIElements=entwine_10, Horizontal=invert(True))
stack_11 = CreateStack(UIElements=entwine_11, Horizontal=invert(True))
stack_12 = CreateStack(UIElements=entwine_12, Horizontal=invert(True))
stack_13 = CreateStack(UIElements=entwine_13, Horizontal=invert(True))
stack_14 = CreateStack(UIElements=entwine_14, Horizontal=invert(True))
stack_15 = CreateStack(UIElements=entwine_15, Horizontal=invert(True))
number_of_louvers_2 = RemoteReceiver(number_of_louvers)
number_of_louvers_3 = RemoteReceiver(number_of_louvers)
number_of_louvers_4 = RemoteReceiver(number_of_louvers)
generate_wwr = RemoteSender(filter)
hideshow_2 = HideShowElement(ElementToHideShow=slider, Show=values_17.Values, Collapse=True, Disable=False)
stack_16 = CreateStack(UIElements=entwine_16, Horizontal=True)
hideshow_3 = HideShowElement(ElementToHideShow=stack_11, Show=number_of_louvers_2, Collapse=True, Disable=False)
hideshow_4 = HideShowElement(ElementToHideShow=stack_14, Show=number_of_louvers_4, Collapse=True, Disable=False)
hideshow_5 = HideShowElement(ElementToHideShow=stack_12, Show=number_of_louvers_3, Collapse=True, Disable=False)
entwine_17 = Entwine(Branch00=textbox, Branch01=stack_9, Branch02=pulldown_5, Branch03=checkbox_12, FlattenInputs=True)  # -> flatten(Result)
entwine_18 = Entwine(Branch00=label_4, Branch01=stack_16, FlattenInputs=True)  # -> flatten(Result)
entwine_19 = Entwine(Branch00=stack_10, Branch01=stack_15, FlattenInputs=True)  # -> flatten(Result)
entwine_20 = Entwine(Branch00=stack_13, Branch01=stack_11, Branch02=stack_12, Branch03=stack_14, FlattenInputs=True)  # -> flatten(Result)
stack_17 = CreateStack(UIElements=entwine_17, Horizontal=True)
adjustpos_10 = AdjustElementPositioning(
    ElementsToAdjust=textbox,
    AbsolutePositioning=False,
    Width=Slider(190, range=0..300),
    Height=Slider(30, range=0..300),
    HorizontalAlignment=0)
adjustpos_11 = AdjustElementPositioning(
    ElementsToAdjust=stack_9,
    Margin="20, 0, 0, 0",
    AbsolutePositioning=False,
    Width=Slider(170, range=0..500),
    Height=Slider(30, range=0..300),
    HorizontalAlignment=0)
stack_18 = CreateStack(UIElements=entwine_18, Horizontal=invert(True))
adjustpos_12 = AdjustElementPositioning(
    ElementsToAdjust=slider,
    Margin="20, 10, 0, 0",
    AbsolutePositioning=False,
    Width=Slider(90, range=0..300),
    Height=Slider(43, range=0..300),
    HorizontalAlignment=0,
    VerticalAlignment=2)
stack_19 = CreateStack(UIElements=entwine_19, Horizontal=True)
adjustpos_13 = AdjustElementPositioning(
    ElementsToAdjust=label_5,
    Margin="0, 20, 0, 0",
    AbsolutePositioning=False,
    Width=Slider(200, range=0..300),
    Height=Slider(25, range=0..300),
    HorizontalAlignment=0,
    VerticalAlignment=2)
adjustpos_14 = AdjustElementPositioning(
    ElementsToAdjust=slider_2,
    Margin="0, 0, 0, 0",
    AbsolutePositioning=False,
    Width=Slider(200, range=0..300),
    Height=Slider(25, range=0..300),
    HorizontalAlignment=0,
    VerticalAlignment=2)
adjustpos_15 = AdjustElementPositioning(
    ElementsToAdjust=label_6,
    Margin="0, 20, 0, 0",
    AbsolutePositioning=False,
    Width=Slider(200, range=0..300),
    Height=Slider(25, range=0..300),
    HorizontalAlignment=0,
    VerticalAlignment=2)
adjustpos_16 = AdjustElementPositioning(
    ElementsToAdjust=slider_3,
    Margin="0, 0, 0, 0",
    AbsolutePositioning=False,
    Width=Slider(200, range=0..300),
    Height=Slider(25, range=0..300),
    HorizontalAlignment=0,
    VerticalAlignment=2)
stack_20 = CreateStack(UIElements=entwine_20, Horizontal=True)

label_11 = CreateLabel(LabelText="Run simple energy simulations", LabelSize=12, Justification=0)
panel_9 = Panel("Energy simulation is running...")
values_19 = ValueListener(Elements=pulldown_5, SomeProperty=True)  # -> Values, Indices
values_20 = ValueListener(Elements=checkbox_12, SomeProperty=True)  # -> Values, Indices
visualise_honeybee_model_index = RemoteSender(values_19.Indices)
visualise_honeybee_model = RemoteSender(values_20.Values)
visualise_honeybee_model_2 = RemoteReceiver(visualise_honeybee_model)
tb = CreateTextBlock(TextSize=16, Justification=0)
values_21 = ValueListener(Elements=checkbox_9, SomeProperty=True)  # -> Values, Indices
values_22 = ValueListener(Elements=pulldown_2, SomeProperty=True)  # -> Values, Indices
values_23 = ValueListener(Elements=pulldown, SomeProperty=True)  # -> Values, Indices
values_24 = ValueListener(Elements=pulldown_3, SomeProperty=True)  # -> Values, Indices
values_25 = ValueListener(Elements=checkbox_8, SomeProperty=True)  # -> Values, Indices
values_26 = ValueListener(Elements=checkbox_10, SomeProperty=True)  # -> Values, Indices
values_27 = ValueListener(Elements=pulldown_4, SomeProperty=True)  # -> Values, Indices
values_28 = ValueListener(Elements=checkbox_11, SomeProperty=True)  # -> Values, Indices
room_energy_attribute_visualize = RemoteSender(values_21.Values)
room_energy_attribute_visualize_2 = RemoteReceiver(room_energy_attribute_visualize)
room_energy_attribute = RemoteSender(values_22.Values)
face_attribute = RemoteSender(values_24.Values)
room_attribute = RemoteSender(values_23.Values)
face_attribute_visualize = RemoteSender(values_26.Values)
face_attribute_visualize_2 = RemoteReceiver(face_attribute_visualize)
room_attribute_visualize = RemoteSender(values_25.Values)
room_attribute_visualize_2 = RemoteReceiver(room_attribute_visualize)
face_energy_attribute = RemoteSender(values_27.Values)
face_energy_attribute_visualize = RemoteSender(values_28.Values)
face_energy_attribute_visualize_2 = RemoteReceiver(face_energy_attribute_visualize)
hideshow_6 = HideShowElement(ElementToHideShow=checkbox_8, Show=True, Collapse=True, Disable=values_21.Values)
hideshow_7 = HideShowElement(ElementToHideShow=checkbox_9, Show=True, Collapse=True, Disable=values_25.Values)
hideshow_8 = HideShowElement(ElementToHideShow=checkbox_10, Show=True, Collapse=True, Disable=values_28.Values)
hideshow_9 = HideShowElement(ElementToHideShow=checkbox_11, Show=True, Collapse=True, Disable=values_26.Values)

refkv = ReferenceByKeyValue(Key="Type", Val="Room", lightweight=False)
refkv_2 = ReferenceByKeyValue(Key="Type", Val="Window", lightweight=False)
refkv_3 = ReferenceByKeyValue(Key="Type", Val="Adjacent", lightweight=False)
refkv_4 = ReferenceByKeyValue(Key="Type", Val="Context", lightweight=False)
rooms = RemoteSender(refkv)
windows = RemoteSender(refkv_2)
adjacent = RemoteSender(refkv_3)
context = RemoteSender(refkv_4)

# ----
# Wall and roof thickness
location = Data(stack_19)

# ----
# Model name and create model
location_2 = Data(stack_17)

# ----
# Generate using WWR
location_3 = Data(stack_18)

# ----
# Louvers
location_4 = Data()

# ----
# Location
location_5 = Data()

adjustpos_17 = AdjustElementPositioning(
    ElementsToAdjust=toggle,
    AbsolutePositioning=False,
    Width=Slider(85, range=0..300),
    Height=Slider(30, range=0..300),
    HorizontalAlignment=0)

# ----
# Create constructions or materials - buttons
location_6 = Data()

adjustpos_18 = AdjustElementPositioning(
    ElementsToAdjust=stack_8,
    AbsolutePositioning=False,
    Width=Slider(300, range=0..300),
    Height=Slider(300, range=0..300),
    HorizontalAlignment=0)
entwine_21 = Entwine(Branch00=location_2, Branch01=location, Branch02=location_3, Branch03=location_4, FlattenInputs=True)  # -> flatten(Result)

# ----
# Run weather visualization
location_7 = Data(border_2)

# ----
# Attributes visualization
location_8 = Data(border)

stack_21 = CreateStack(UIElements=entwine_21, Horizontal=invert(True))
entwine_22 = Entwine(Branch00=location_7, Branch01=location_8, FlattenInputs=True)  # -> flatten(Result)
stack_22 = CreateStack(UIElements=entwine_22, Horizontal=True)

# ----
# Select subset construction
location_9 = Data()

adjacent_geometry = Geometry(<brep referenced from the Rhino model>)

panel_10 = Panel("""1IN Stucco
5/8 in. Gypsum Board
5/8 in. Plywood
8IN Concrete HW
Acoustic Ceiling
Adiabatic Material
Asphalt Pavement
HW CONCRETE
Metal Surface""")
panel_11 = Panel("""Adiabatic Roof
Adiabatic Wall
Asphalt Pavement
Concrete Pavement
Dry Dust
Dry Sand""")
database_constructions = RemoteSender(panel_11)
database_materials = RemoteSender(panel_10)

# ---- group: Setup study case / Extension
rooms_2 = Geometry([<brep referenced from the Rhino model> x3])
windows_2 = Geometry([<brep referenced from the Rhino model> x114])
merge = Merge(Data1=rooms_2, Data2=windows_2)

# ---- group: Building occupancy and systems / Select program
bldgprograms = HBBuildingPrograms({"LargeOffice", "MediumOffice", "SmallOffice", "MidriseApartment", "HighriseApartment", "Retail", "StripMall", "PrimarySchool", "SecondarySchool", "SmallHotel", "LargeHotel", "Hospital", "Outpatient", "Laboratory", "Warehouse", "SuperMarket", "FullServiceRestaurant", "QuickServiceRestaurant", "Courthouse", "LargeDataCenterHighITE", "LargeDataCenterLowITE", "SmallDataCenterHighITE", "SmallDataCenterLowITE"}, selected="MediumOffice")
searchprog = HBSearchPrograms(bldg_prog=bldgprograms)  # -> room_prog; plug-in component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
list = ItemSelector(
    searchprog,
    {"2019::MediumOffice::Breakroom", "2019::MediumOffice::Classroom", "2019::MediumOffice::ClosedOffice", "2019::MediumOffice::Conference", "2019::MediumOffice::Corridor", "2019::MediumOffice::Dining", "2019::MediumOffice::Elec/MechRoom", "2019::MediumOffice::Lobby", "2019::MediumOffice::OpenOffice", "2019::MediumOffice::Restroom", "2019::MediumOffice::Stair", "2019::MediumOffice::Storage"}, selected="2019::MediumOffice::Breakroom")

# ----
# Create material
number_slider_2 = Slider(200, range=0..1000)
panel_12 = Panel("""Thickness
SHGC""")
panel_13 = Panel("""Specific heat
Transmittance""")
panel_14 = Panel("""Density
U-factor""")
panel_15 = Panel("""Opaque
Aperture""")
panel_16 = Panel("""Rough
Smooth""")
panel_17 = Panel("""1000
0.5""")
textbox_2 = CreateTextBox(Label="Name", UpdateButton=invert(True), showLabel=True)
pulldown_6 = CreatePulldownMenu(Label="Type", ListItems=panel_15, showLabel=True)
textbox_3 = CreateTextBox(DefaultText=number_slider_2, UpdateButton=invert(True), showLabel=False)
textbox_4 = CreateTextBox(DefaultText=Slider(200, range=0..1000), UpdateButton=invert(True), showLabel=False)
label_12 = CreateLabel(LabelText="Specific heat", LabelSize=12, Justification=0)
textbox_5 = CreateTextBox(DefaultText=Slider(200, range=0..1000), UpdateButton=invert(True), showLabel=False)
label_13 = CreateLabel(LabelText="Thickness", LabelSize=12, Justification=0)
textbox_6 = CreateTextBox(DefaultText=Slider(200, range=0..1000), UpdateButton=invert(True), showLabel=False)
button_2 = CreateButton(ButtonName="Create construction", ButtonStyle=0)
textbox_7 = CreateTextBox(DefaultText=Slider(200, range=0..1000), UpdateButton=invert(True), showLabel=False)
label_14 = CreateLabel(LabelText="Conductivity", LabelSize=12, Justification=0)
label_15 = CreateLabel(LabelText="Roughness", LabelSize=12, Justification=0)
label_16 = CreateLabel(LabelText="Density", LabelSize=12, Justification=0)
label_17 = CreateLabel(LabelText="Absorption", LabelSize=12, Justification=0)
pulldown_7 = CreatePulldownMenu(ListItems=panel_16, showLabel=False)
values_29 = ValueListener(Elements=textbox_2, SomeProperty=True)  # -> Values, Indices
values_30 = ValueListener(Elements=pulldown_6, SomeProperty=True)  # -> Values, Indices
values_31 = ValueListener(Elements=button_2, SomeProperty=True)  # -> Values, Indices
bool = Boolean(invert(values_30.Indices))
panel_18 = Panel(values_29.Values)
entwine_23 = Entwine(Branch00=label_17, Branch01=textbox_5, FlattenInputs=True)  # -> flatten(Result)
entwine_24 = Entwine(Branch00=label_15, Branch01=pulldown_7, FlattenInputs=True)  # -> flatten(Result)
entwine_25 = Entwine(Branch00=label_12, Branch01=textbox_4, FlattenInputs=True)  # -> flatten(Result)
entwine_26 = Entwine(Branch00=label_14, Branch01=textbox_7, FlattenInputs=True)  # -> flatten(Result)
entwine_27 = Entwine(Branch00=label_13, Branch01=textbox_3, FlattenInputs=True)  # -> flatten(Result)
opaque = RemoteSender(bool)
opaque_2 = RemoteReceiver(opaque)
opaque_3 = RemoteReceiver(opaque)
opaque_4 = RemoteReceiver(opaque)
opaque_5 = RemoteReceiver(opaque)
bool_2 = Boolean(invert(opaque_2))
bool_3 = Boolean(invert(opaque_3))
bool_4 = Boolean(invert(opaque_4))
bool_5 = Boolean(invert(opaque_5))
item = ListItem(List=panel_13, Index=bool_3, Wrap=True)
item_2 = ListItem(List=panel_12, Index=bool_2, Wrap=True)
item_3 = ListItem(List=panel_14, Index=bool_4, Wrap=True)
item_4 = ListItem(List=panel_17, Index=bool_5, Wrap=True)
setlabel = SetLabelContents(LabelToModify=label_12, NewLabelContents=item)
setlabel_2 = SetLabelContents(LabelToModify=label_13, NewLabelContents=item_2)
setlabel_3 = SetLabelContents(LabelToModify=label_16, NewLabelContents=item_3)
settextbox = SetTextBoxContents(TextBoxToModify=textbox_6, NewTextBoxContents=item_4)
panel_19 = Panel(bool)
entwine_28 = Entwine(Branch00=label_16, Branch01=textbox_6, FlattenInputs=True)  # -> flatten(Result)
opaque_6 = RemoteReceiver(opaque)
opaque_7 = RemoteReceiver(opaque)
opaque_8 = RemoteReceiver(opaque)
stack_23 = CreateStack(UIElements=entwine_24, Horizontal=True)
stack_24 = CreateStack(UIElements=entwine_23, Horizontal=True)
stack_25 = CreateStack(UIElements=entwine_25, Horizontal=True)
stack_26 = CreateStack(UIElements=entwine_26, Horizontal=True)
stack_27 = CreateStack(UIElements=entwine_27, Horizontal=True)
stack_28 = CreateStack(UIElements=entwine_28, Horizontal=True)
hideshow_10 = HideShowElement(ElementToHideShow=[textbox_7, label_14], Show=opaque_6, Collapse=True, Disable=False)
hideshow_11 = HideShowElement(ElementToHideShow=[pulldown_7, label_15], Show=opaque_7, Collapse=True, Disable=False)
hideshow_12 = HideShowElement(ElementToHideShow=[textbox_5, label_17], Show=opaque_8, Collapse=True, Disable=False)
adjustpos_19 = AdjustElementPositioning(
    ElementsToAdjust=label_16,
    AbsolutePositioning=False,
    Width=Slider(85, range=0..300),
    Height=Slider(26, range=0..300),
    HorizontalAlignment=0,
    VerticalAlignment=2)
adjustpos_20 = AdjustElementPositioning(
    ElementsToAdjust=textbox_6,
    AbsolutePositioning=False,
    Width=Slider(100, range=0..300),
    Height=Slider(26, range=0..300),
    HorizontalAlignment=0,
    VerticalAlignment=2)
adjustpos_21 = AdjustElementPositioning(
    ElementsToAdjust=label_13,
    AbsolutePositioning=False,
    Width=Slider(85, range=0..300),
    Height=Slider(26, range=0..300),
    HorizontalAlignment=0,
    VerticalAlignment=2)
adjustpos_22 = AdjustElementPositioning(
    ElementsToAdjust=textbox_3,
    AbsolutePositioning=False,
    Width=Slider(100, range=0..300),
    Height=Slider(26, range=0..300),
    HorizontalAlignment=0,
    VerticalAlignment=2)
adjustpos_23 = AdjustElementPositioning(
    ElementsToAdjust=textbox_2,
    AbsolutePositioning=False,
    Width=Slider(190, range=0..300),
    Height=Slider(30, range=0..300),
    HorizontalAlignment=0)
adjustpos_24 = AdjustElementPositioning(
    ElementsToAdjust=pulldown_6,
    AbsolutePositioning=False,
    Width=Slider(190, range=0..300),
    Height=Slider(35, range=0..300),
    HorizontalAlignment=0,
    VerticalAlignment=2)
adjustpos_25 = AdjustElementPositioning(
    ElementsToAdjust=label_12,
    AbsolutePositioning=False,
    Width=Slider(85, range=0..300),
    Height=Slider(26, range=0..300),
    HorizontalAlignment=0,
    VerticalAlignment=2)
adjustpos_26 = AdjustElementPositioning(
    ElementsToAdjust=label_14,
    AbsolutePositioning=False,
    Width=Slider(85, range=0..300),
    Height=Slider(26, range=0..300),
    HorizontalAlignment=0,
    VerticalAlignment=2)
adjustpos_27 = AdjustElementPositioning(
    ElementsToAdjust=textbox_4,
    AbsolutePositioning=False,
    Width=Slider(100, range=0..300),
    Height=Slider(26, range=0..300),
    HorizontalAlignment=0,
    VerticalAlignment=2)
adjustpos_28 = AdjustElementPositioning(
    ElementsToAdjust=textbox_7,
    AbsolutePositioning=False,
    Width=Slider(100, range=0..300),
    Height=Slider(26, range=0..300),
    HorizontalAlignment=0,
    VerticalAlignment=2)
entwine_29 = Entwine(
    Branch00=textbox_2,
    Branch01=pulldown_6,
    Branch02=stack_28,
    Branch03=stack_27,
    Branch04=stack_25,
    Branch05=stack_26,
    Branch06=stack_23,
    Branch07=stack_24,
    Branch08=button_2,
    FlattenInputs=True)  # -> flatten(Result)
adjustpos_29 = AdjustElementPositioning(
    ElementsToAdjust=label_15,
    AbsolutePositioning=False,
    Width=Slider(85, range=0..300),
    Height=Slider(26, range=0..300),
    HorizontalAlignment=0,
    VerticalAlignment=2)
adjustpos_30 = AdjustElementPositioning(
    ElementsToAdjust=pulldown_7,
    Margin="0, 0, 0, 0",
    AbsolutePositioning=False,
    Width=Slider(132, range=0..300),
    Height=Slider(34, range=0..300),
    HorizontalAlignment=0,
    VerticalAlignment=2)
adjustpos_31 = AdjustElementPositioning(
    ElementsToAdjust=label_17,
    AbsolutePositioning=False,
    Width=Slider(85, range=0..300),
    Height=Slider(26, range=0..300),
    HorizontalAlignment=0,
    VerticalAlignment=2)
adjustpos_32 = AdjustElementPositioning(
    ElementsToAdjust=textbox_5,
    AbsolutePositioning=False,
    Width=Slider(100, range=0..300),
    Height=Slider(26, range=0..300),
    HorizontalAlignment=0,
    VerticalAlignment=2)
adjustpos_33 = AdjustElementPositioning(
    ElementsToAdjust=button_2,
    Margin="5, 10, 0, 0",
    AbsolutePositioning=False,
    Width=Slider(126, range=0..300),
    Height=Slider(30, range=0..300),
    HorizontalAlignment=0,
    VerticalAlignment=2)

values_32 = ValueListener(Elements=textbox_5, SomeProperty=True)  # -> Values, Indices
values_33 = ValueListener(Elements=pulldown_7, SomeProperty=True)  # -> Values, Indices
values_34 = ValueListener(Elements=textbox_7, SomeProperty=True)  # -> Values, Indices
values_35 = ValueListener(Elements=textbox_3, SomeProperty=True)  # -> Values, Indices
values_36 = ValueListener(Elements=textbox_4, SomeProperty=True)  # -> Values, Indices
values_37 = ValueListener(Elements=textbox_6, SomeProperty=True)  # -> Values, Indices
material_name = RemoteSender(values_29.Values)
create_material_6 = RemoteSender(values_32.Values)
create_material_5 = RemoteSender(values_33.Values)
create_material = RemoteSender(values_31.Values)
create_material_4 = RemoteSender(values_34.Values)
create_material_2 = RemoteSender(values_35.Values)
create_material_3 = RemoteSender(values_36.Values)
create_material_1 = RemoteSender(values_37.Values)

# ---- group: Building occupancy and systems / Modify program
applyloadvals = HBApplyLoadValues(room_or_program=flatten(list))  # -> report, mod_obj; plug-in component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
applysetpointvals = HBApplySetpointValues(
    room_or_program=flatten(applyloadvals.mod_obj),
    cooling_setpt=Slider(27, range=0..100),
    heating_setpt=Slider(21, range=0..100))  # -> report, mod_obj; plug-in component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

# ----
deconstrprogram = HBDeconstructProgramType(program=list)  # -> people, lighting, electric_equip, gas_equip, hot_water, infiltration, ventilation, setpoint; plug-in component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
decnstrpeople = HBDeconstructPeople(people=deconstrprogram.people)  # -> name, ppl_per_area, occupancy_sch, activity_sch; plug-in component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
panel_20 = Panel(decnstrpeople.ppl_per_area)
deconstrsch = HBDeconstructSchedule(schedule=decnstrpeople.occupancy_sch)  # -> day_names, day_data, type_limit; plug-in component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
division = Division(A=Slider(1, range=0..1), B=panel_20)
xdata = LBDeconstructData(data=deconstrsch.day_data)  # -> header, values; plug-in component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
one_over_x = OneOverX(Value=panel_20)
panel_21 = Panel(division)
panel_22 = Panel(xdata.header)
panel_23 = Panel(xdata.values)

# ----
# Define construction
subset_construction_index = RemoteReceiver()
subset_construction_detail = RemoteReceiver()
create_construction_index = RemoteReceiver()
create_construction_type = RemoteReceiver()
create_material_type = RemoteReceiver()
panel_24 = Panel("""Exterior
Interior
Ground
Subface""")
panel_25 = Panel("""Opaque
Aperture""")
panel_26 = Panel("""Name
Materials
Thickness""")
opaque_9 = RemoteReceiver(opaque)
item_5 = ListItem(List=panel_24, Index=subset_construction_index, Wrap=True)
item_6 = ListItem(List=panel_25, Index=opaque_9, Wrap=True)
item_7 = ListItem(List=panel_26, Index=create_construction_index, Wrap=True)
panel_27 = Panel(subset_construction_detail)
panel_28 = Panel(create_construction_type)
panel_29 = Panel(item_7)
panel_30 = Panel(item_6)
panel_31 = Panel(create_material_type)
panel_32 = Panel(item_5)

distance_between_louvers_2 = RemoteReceiver(distance_between_louvers)
number_of_louvers_5 = RemoteReceiver(number_of_louvers)
louver_angle_2 = RemoteReceiver(louver_angle)
louver_depth_2 = RemoteReceiver(louver_depth)
run_simulation_2 = RemoteReceiver(run_simulation)
run_simulation_3 = RemoteReceiver(run_simulation)
run_simulation_4 = RemoteReceiver(run_simulation)
run_simulation_5 = RemoteReceiver(run_simulation)
bool_6 = Boolean(number_of_louvers_5)
gate = StreamGate(Stream="Type", Gate=run_simulation_2)  # -> Target0, Target1
gate_2 = StreamGate(Stream="Type", Gate=run_simulation_3)  # -> Target0, Target1
gate_3 = StreamGate(Stream="Type", Gate=run_simulation_4)  # -> Target0, Target1
gate_4 = StreamGate(Stream="Type", Gate=run_simulation_5)  # -> Target0, Target1
filter_2 = StreamFilter(Gate=bool_6, Stream0="0", Stream1=louver_angle_2)
filter_3 = StreamFilter(Gate=bool_6, Stream0="0", Stream1=distance_between_louvers_2)
filter_4 = StreamFilter(Gate=bool_6, Stream0="0", Stream1=louver_depth_2)
create_material_7 = RemoteReceiver(create_material)
refkv_5 = ReferenceByKeyValue(Key=gate.Target1, Val="Room", lightweight=False)
refkv_6 = ReferenceByKeyValue(Key=gate_2.Target1, Val="Adjacent", lightweight=False)
refkv_7 = ReferenceByKeyValue(Key=gate_3.Target1, Val="Window", lightweight=False)
refkv_8 = ReferenceByKeyValue(Key=gate_4.Target1, Val="Context", lightweight=False)

representative_room = Geometry(<brep referenced from the Rhino model>)
representative_room_window = Geometry(<brep referenced from the Rhino model>)
representative_room_adjacent = Geometry([<brep referenced from the Rhino model> x5])

number_slider_3 = Slider(0.3, range=0..1)
number_slider_4 = Slider(0.3, range=0..1)

# ---- group: Prepare for analysis
run_simulation_6 = RemoteReceiver(run_simulation)
falsestart = LBFalseStartToggle(False)

# ----
model_name_2 = RemoteReceiver(model_name)
generate_wwr_2 = RemoteReceiver(generate_wwr)
room = Geometry(refkv_6)
room_2 = Geometry(refkv_5)
room_3 = Geometry(refkv_8)
windows_3 = Geometry(refkv_7)
roof_thickness_2 = RemoteReceiver(roof_thickness)
wall_thickness_2 = RemoteReceiver(wall_thickness)
panel_33 = Panel(run_simulation_6)
f_fro = Froggle()
run_simulation_7 = RemoteReceiver(run_simulation)
generate_wwr_3 = RemoteReceiver(generate_wwr)

# ----
# Assemble Honeybee model
distance_between_louvers_3 = RemoteReceiver(distance_between_louvers)
generate_wwr_4 = RemoteReceiver(generate_wwr)
wall_thickness_3 = RemoteReceiver(wall_thickness)
model_name_3 = RemoteReceiver(model_name)
number_of_louvers_6 = RemoteReceiver(number_of_louvers)
louver_depth_3 = RemoteReceiver(louver_depth)
louver_angle_3 = RemoteReceiver(louver_angle)
int = Integer(generate_wwr_4)
int_2 = Integer(wall_thickness_3)
division_2 = Division(A=int, B=Slider(100, range=0..100))
division_3 = Division(A=int_2, B=Slider(100, range=0..100))
panel_34 = Panel(model_name_3)
panel_35 = Panel(division_3)
panel_36 = Panel(generate_wwr_3)

visualise_honeybee_model_index_2 = RemoteReceiver(visualise_honeybee_model_index)
panel_37 = Panel(number_of_louvers_6)
panel_38 = Panel(louver_depth_3)
panel_39 = Panel(distance_between_louvers_3)
panel_40 = Panel(louver_angle_3)
panel_41 = Panel(run_simulation_7)
visualise_honeybee_model_3 = RemoteReceiver(visualise_honeybee_model)
run_weather_visualisation_3 = RemoteReceiver(run_weather_visualisation)

# ----
# Visualize
incident_radiation_2 = RemoteReceiver(incident_radiation)
weather_visualisation = RemoteReceiver()
sun_hours = RemoteReceiver()

gate_5 = StreamGate(Stream="Type", Gate=run_weather_visualisation_3)  # -> Target0, Target1
room_attribute_visualize_3 = RemoteReceiver(room_attribute_visualize)
room_energy_attribute_2 = RemoteReceiver(room_energy_attribute)
face_attribute_visualize_3 = RemoteReceiver(face_attribute_visualize)
face_energy_attribute_2 = RemoteReceiver(face_energy_attribute)
refkv_9 = ReferenceByKeyValue(Key=gate_5.Target1, Val="Room", lightweight=False)
room_energy_attribute_visualize_3 = RemoteReceiver(room_energy_attribute_visualize)
face_energy_attribute_visualize_3 = RemoteReceiver(face_energy_attribute_visualize)
room_attribute_visualize_4 = RemoteReceiver(room_attribute_visualize)
face_attribute_visualize_4 = RemoteReceiver(face_attribute_visualize)
or = GateOr(A=room_attribute_visualize_4, B=room_energy_attribute_visualize_3)
or_2 = GateOr(A=face_attribute_visualize_4, B=face_energy_attribute_visualize_3)
spectacles_meshbasicmaterial = Spectacles_MeshBasicMaterial(Object_Opacity=1)
swatch = ColourSwatch(SwatchColor=RGB(84, 84, 84))
path = FilePath("C:\Users\sawen\OneDrive - Chalmers\ACE405\2024\Model\DesignExplorer\example\model.json")
falsestart_2 = LBFalseStartToggle(False)
falsestart_3 = LBFalseStartToggle(False)

# ----
# Meeting notes:
# - LCA is not updated
panel_42 = Panel("C:/Users/Isac/Desktop/Toivo_Chalmers/UI/matplotlib")
nextfile = NextAvailableFilename(Format="test_{000}.png", FolderPath=panel_42, Trigger=Toggle(False))

# ----
# Construction module
number_slider_5 = Slider(5, range=0..7)
database_constructions_2 = RemoteReceiver(database_constructions)
database_constructions_3 = RemoteReceiver(database_constructions)
database_constructions_4 = RemoteReceiver(database_constructions)
database_constructions_5 = RemoteReceiver(database_constructions)
database_constructions_6 = RemoteReceiver(database_constructions)
database_constructions_7 = RemoteReceiver(database_constructions)
panel_43 = Panel("""Very Hot
Hot
Warm
Mixed
Cool
Cold
Very Cold
Subarctic""")
database_constructions_8 = RemoteReceiver(database_constructions)
database_constructions_9 = RemoteReceiver(database_constructions)
panel_44 = Panel("""SteelFramed
WoodFramed
Mass
Metal Building""")
database_constructions_10 = RemoteReceiver(database_constructions)
database_constructions_11 = RemoteReceiver(database_constructions)
database_constructions_12 = RemoteReceiver(database_constructions)
database_constructions_13 = RemoteReceiver(database_constructions)
database_constructions_14 = RemoteReceiver(database_constructions)
database_constructions_15 = RemoteReceiver(database_constructions)
database_constructions_16 = RemoteReceiver(database_constructions)
database_constructions_17 = RemoteReceiver(database_constructions)
database_constructions_18 = RemoteReceiver(database_constructions)
database_constructions_19 = RemoteReceiver(database_constructions)
pulldown_8 = CreatePulldownMenu(ListItems=panel_43, SelectedIndex=number_slider_5, showLabel=True)
pulldown_9 = CreatePulldownMenu(ListItems=panel_44, SelectedIndex=Slider(1, range=0..3), showLabel=True)
label_18 = CreateLabel(LabelText="Select base construcion by climate", LabelSize=12, Justification=0)
label_19 = CreateLabel(LabelText="Select base construction by type", LabelSize=12, Justification=0)
true_button = CreateTrueOnlyButton(ButtonName="Create material", ButtonStyle=0)
true_button_2 = CreateTrueOnlyButton(ButtonName="Create construction", ButtonStyle=0)
pulldown_10 = CreatePulldownMenu(Label="Glass door", ListItems=database_constructions_5, showLabel=True)
pulldown_11 = CreatePulldownMenu(Label="Overhead door", ListItems=database_constructions_8, showLabel=True)
label_20 = CreateLabel(LabelText="Exterior", LabelSize=12, Justification=0)
pulldown_12 = CreatePulldownMenu(Label="Wall", ListItems=database_constructions_6, showLabel=True)
pulldown_13 = CreatePulldownMenu(Label="Roof", ListItems=database_constructions_2, showLabel=True)
pulldown_14 = CreatePulldownMenu(Label="Floor", ListItems=database_constructions_9, showLabel=True)
pulldown_15 = CreatePulldownMenu(Label="Exterior door", ListItems=database_constructions_11, showLabel=True)
label_21 = CreateLabel(LabelText="Ground", LabelSize=12, Justification=0)
pulldown_16 = CreatePulldownMenu(Label="Operable", ListItems=database_constructions_10, showLabel=True)
pulldown_17 = CreatePulldownMenu(Label="Skylight", ListItems=database_constructions_12, showLabel=True)
label_22 = CreateLabel(LabelText="Subface", LabelSize=12, Justification=0)
pulldown_18 = CreatePulldownMenu(Label="Wall", ListItems=database_constructions_7, showLabel=True)
pulldown_19 = CreatePulldownMenu(Label="Roof", ListItems=database_constructions_4, showLabel=True)
pulldown_20 = CreatePulldownMenu(Label="Floor", ListItems=database_constructions_3, showLabel=True)
pulldown_21 = CreatePulldownMenu(Label="Window", ListItems=database_constructions_16, showLabel=True)
pulldown_22 = CreatePulldownMenu(Label="Glass door", ListItems=database_constructions_14, showLabel=True)
pulldown_23 = CreatePulldownMenu(Label="Window", ListItems=database_constructions_15, showLabel=True)
pulldown_24 = CreatePulldownMenu(Label="Door", ListItems=database_constructions_13, showLabel=True)
label_23 = CreateLabel(LabelText="Select subset construction", LabelSize=12, Justification=0)
pulldown_25 = CreatePulldownMenu(Label="Floor", ListItems=database_constructions_18, showLabel=True)
pulldown_26 = CreatePulldownMenu(Label="Ceiling", ListItems=database_constructions_19, showLabel=True)
label_24 = CreateLabel(LabelText="Interior", LabelSize=12, Justification=0)
pulldown_27 = CreatePulldownMenu(Label="Wall", ListItems=database_constructions_17, showLabel=True)
values_38 = ValueListener(Elements=pulldown_14, SomeProperty=True)  # -> Values, Indices
values_39 = ValueListener(Elements=pulldown_10, SomeProperty=True)  # -> Values, Indices
values_40 = ValueListener(Elements=pulldown_11, SomeProperty=True)  # -> Values, Indices
values_41 = ValueListener(Elements=pulldown_23, SomeProperty=True)  # -> Values, Indices
values_42 = ValueListener(Elements=pulldown_22, SomeProperty=True)  # -> Values, Indices
values_43 = ValueListener(Elements=pulldown_13, SomeProperty=True)  # -> Values, Indices
values_44 = ValueListener(Elements=pulldown_19, SomeProperty=True)  # -> Values, Indices
values_45 = ValueListener(Elements=pulldown_20, SomeProperty=True)  # -> Values, Indices
values_46 = ValueListener(Elements=pulldown_15, SomeProperty=True)  # -> Values, Indices
values_47 = ValueListener(Elements=pulldown_18, SomeProperty=True)  # -> Values, Indices
values_48 = ValueListener(Elements=pulldown_17, SomeProperty=True)  # -> Values, Indices
values_49 = ValueListener(Elements=pulldown_16, SomeProperty=True)  # -> Values, Indices
values_50 = ValueListener(Elements=pulldown_12, SomeProperty=True)  # -> Values, Indices
values_51 = ValueListener(Elements=pulldown_21, SomeProperty=True)  # -> Values, Indices
values_52 = ValueListener(Elements=pulldown_26, SomeProperty=True)  # -> Values, Indices
values_53 = ValueListener(Elements=pulldown_24, SomeProperty=True)  # -> Values, Indices
values_54 = ValueListener(Elements=pulldown_27, SomeProperty=True)  # -> Values, Indices
values_55 = ValueListener(Elements=true_button, SomeProperty=True)  # -> Values, Indices
values_56 = ValueListener(Elements=pulldown_25, SomeProperty=True)  # -> Values, Indices
values_57 = ValueListener(Elements=true_button_2, SomeProperty=True)  # -> Values, Indices
values_58 = ValueListener(Elements=pulldown_8, SomeProperty=True)  # -> Values, Indices
values_59 = ValueListener(Elements=pulldown_9, SomeProperty=True)  # -> Values, Indices
subset_interior_window = RemoteSender(values_41.Values)
subset_subface_overhead_door = RemoteSender(values_40.Values)
subset_subface_glass_door = RemoteSender(values_39.Values)
subset_interior_glass_door = RemoteSender(values_42.Values)
subset_exterior_floor = RemoteSender(values_38.Values)
subset_subface_window = RemoteSender(values_51.Values)
subset_subface_exterior_door = RemoteSender(values_46.Values)
subset_subface_skylight = RemoteSender(values_48.Values)
subset_subface_operable = RemoteSender(values_49.Values)
subset_ground_floor = RemoteSender(values_45.Values)
subset_ground_roof = RemoteSender(values_44.Values)
subset_interior_ceiling = RemoteSender(values_52.Values)
subset_interior_door = RemoteSender(values_53.Values)
subset_exterior_roof = RemoteSender(values_43.Values)
subset_interior_wall = RemoteSender(values_54.Values)
subset_ground_wall = RemoteSender(values_47.Values)
subset_interior_floor = RemoteSender(values_56.Values)
subset_exterior_wall = RemoteSender(values_50.Values)
panel_45 = Panel(values_57.Values)
create_construction_window = RemoteSender(values_57.Values)
panel_46 = Panel(values_55.Values)
create_material_window = RemoteSender(values_55.Values)
entwine_30 = Entwine(Branch00=label_18, Branch01=pulldown_8, FlattenInputs=True)  # -> flatten(Result)
base_type = RemoteSender(values_59.Values)
entwine_31 = Entwine(Branch00=label_20, Branch01=pulldown_12, Branch02=pulldown_13, Branch03=pulldown_14, FlattenInputs=True)  # -> flatten(Result)
entwine_32 = Entwine(Branch00=label_21, Branch01=pulldown_18, Branch02=pulldown_19, Branch03=pulldown_20, FlattenInputs=True)  # -> flatten(Result)
entwine_33 = Entwine(Branch00=label_19, Branch01=pulldown_9, FlattenInputs=True)  # -> flatten(Result)
stack_29 = CreateStack(UIElements=entwine_30, Horizontal=invert(True))
stack_30 = CreateStack(UIElements=entwine_33, Horizontal=invert(True))
entwine_34 = Entwine(
    Branch00=label_22,
    Branch01=pulldown_21,
    Branch02=pulldown_17,
    Branch03=pulldown_16,
    Branch04=pulldown_15,
    Branch05=pulldown_11,
    Branch06=pulldown_10,
    FlattenInputs=True)  # -> flatten(Result)
entwine_35 = Entwine(
    Branch00=label_24,
    Branch01=pulldown_27,
    Branch02=pulldown_26,
    Branch03=pulldown_25,
    Branch04=pulldown_24,
    Branch05=pulldown_23,
    Branch06=pulldown_22,
    FlattenInputs=True)  # -> flatten(Result)
stack_31 = CreateStack(UIElements=entwine_31, Horizontal=invert(True))
stack_32 = CreateStack(UIElements=entwine_32, Horizontal=invert(True))
stack_33 = CreateStack(UIElements=entwine_35, Horizontal=invert(True))
adjustpos_34 = AdjustElementPositioning(ElementsToAdjust=label_18, AbsolutePositioning=False, Width=Slider(200, range=0..300), HorizontalAlignment=0)
adjustpos_35 = AdjustElementPositioning(ElementsToAdjust=pulldown_8, AbsolutePositioning=False, Width=Slider(150, range=0..300), HorizontalAlignment=0)
adjustpos_36 = AdjustElementPositioning(ElementsToAdjust=label_19, AbsolutePositioning=False, Width=Slider(200, range=0..300), HorizontalAlignment=0)
adjustpos_37 = AdjustElementPositioning(ElementsToAdjust=pulldown_9, AbsolutePositioning=False, Width=Slider(150, range=0..300), HorizontalAlignment=0)
adjustpos_38 = AdjustElementPositioning(
    ElementsToAdjust=true_button_2,
    Margin=Slider(8, range=0..10),
    AbsolutePositioning=False,
    Width=Slider(150, range=0..300),
    Height=Slider(45, range=0..300),
    HorizontalAlignment=0)
adjustpos_39 = AdjustElementPositioning(
    ElementsToAdjust=true_button,
    AbsolutePositioning=False,
    Width=Slider(150, range=0..300),
    Height=Slider(45, range=0..300),
    HorizontalAlignment=0)
stack_34 = CreateStack(UIElements=entwine_34, Horizontal=invert(True))
border_3 = CreateBorder(
    UIElement=stack_34,
    BorderThickness=Slider(1, range=0..10),
    BorderColor=ColourSwatch(SwatchColor=RGB(217, 217, 217)),
    CornerRadius=Slider(2, range=0..10))
adjustpos_40 = AdjustElementPositioning(
    ElementsToAdjust=label_22,
    AbsolutePositioning=False,
    Width=Slider(80, range=0..300),
    Height=Slider(25, range=0..300),
    HorizontalAlignment=0)
adjustpos_41 = AdjustElementPositioning(
    ElementsToAdjust=pulldown_21,
    AbsolutePositioning=False,
    Width=Slider(190, range=0..300),
    Height=Slider(35, range=0..300),
    HorizontalAlignment=0)
adjustpos_42 = AdjustElementPositioning(
    ElementsToAdjust=label_20,
    AbsolutePositioning=False,
    Width=Slider(80, range=0..300),
    Height=Slider(25, range=0..300),
    HorizontalAlignment=0)
adjustpos_43 = AdjustElementPositioning(
    ElementsToAdjust=pulldown_17,
    AbsolutePositioning=False,
    Width=Slider(190, range=0..300),
    Height=Slider(35, range=0..300),
    HorizontalAlignment=0)
adjustpos_44 = AdjustElementPositioning(
    ElementsToAdjust=pulldown_11,
    AbsolutePositioning=False,
    Width=Slider(190, range=0..300),
    Height=Slider(35, range=0..300),
    HorizontalAlignment=0)
adjustpos_45 = AdjustElementPositioning(
    ElementsToAdjust=pulldown_16,
    AbsolutePositioning=False,
    Width=Slider(190, range=0..300),
    Height=Slider(35, range=0..300),
    HorizontalAlignment=0)
adjustpos_46 = AdjustElementPositioning(
    ElementsToAdjust=pulldown_15,
    AbsolutePositioning=False,
    Width=Slider(190, range=0..300),
    Height=Slider(35, range=0..300),
    HorizontalAlignment=0)
adjustpos_47 = AdjustElementPositioning(
    ElementsToAdjust=pulldown_10,
    AbsolutePositioning=False,
    Width=Slider(190, range=0..300),
    Height=Slider(35, range=0..300),
    HorizontalAlignment=0)
border_4 = CreateBorder(
    UIElement=stack_31,
    BorderThickness=Slider(1, range=0..10),
    BorderColor=ColourSwatch(SwatchColor=RGB(217, 217, 217)),
    CornerRadius=Slider(2, range=0..10))
adjustpos_48 = AdjustElementPositioning(
    ElementsToAdjust=pulldown_12,
    AbsolutePositioning=False,
    Width=Slider(190, range=0..300),
    Height=Slider(35, range=0..300),
    HorizontalAlignment=0)
adjustpos_49 = AdjustElementPositioning(
    ElementsToAdjust=pulldown_13,
    AbsolutePositioning=False,
    Width=Slider(190, range=0..300),
    Height=Slider(35, range=0..300),
    HorizontalAlignment=0)
adjustpos_50 = AdjustElementPositioning(
    ElementsToAdjust=pulldown_14,
    AbsolutePositioning=False,
    Width=Slider(190, range=0..300),
    Height=Slider(35, range=0..300),
    HorizontalAlignment=0)
border_5 = CreateBorder(
    UIElement=stack_32,
    BorderThickness=Slider(1, range=0..10),
    BorderColor=ColourSwatch(SwatchColor=RGB(217, 217, 217)),
    CornerRadius=Slider(2, range=0..10))
adjustpos_51 = AdjustElementPositioning(
    ElementsToAdjust=label_21,
    AbsolutePositioning=False,
    Width=Slider(80, range=0..300),
    Height=Slider(25, range=0..300),
    HorizontalAlignment=0)
adjustpos_52 = AdjustElementPositioning(
    ElementsToAdjust=pulldown_18,
    AbsolutePositioning=False,
    Width=Slider(190, range=0..300),
    Height=Slider(35, range=0..300),
    HorizontalAlignment=0)
border_6 = CreateBorder(
    UIElement=stack_33,
    BorderThickness=Slider(1, range=0..10),
    BorderColor=ColourSwatch(SwatchColor=RGB(217, 217, 217)),
    CornerRadius=Slider(2, range=0..10))
adjustpos_53 = AdjustElementPositioning(
    ElementsToAdjust=label_24,
    AbsolutePositioning=False,
    Width=Slider(80, range=0..300),
    Height=Slider(25, range=0..300),
    HorizontalAlignment=0)
adjustpos_54 = AdjustElementPositioning(
    ElementsToAdjust=pulldown_27,
    AbsolutePositioning=False,
    Width=Slider(190, range=0..300),
    Height=Slider(35, range=0..300),
    HorizontalAlignment=0)
adjustpos_55 = AdjustElementPositioning(
    ElementsToAdjust=pulldown_19,
    AbsolutePositioning=False,
    Width=Slider(190, range=0..300),
    Height=Slider(35, range=0..300),
    HorizontalAlignment=0)
adjustpos_56 = AdjustElementPositioning(
    ElementsToAdjust=pulldown_26,
    AbsolutePositioning=False,
    Width=Slider(190, range=0..300),
    Height=Slider(35, range=0..300),
    HorizontalAlignment=0)
adjustpos_57 = AdjustElementPositioning(
    ElementsToAdjust=pulldown_23,
    AbsolutePositioning=False,
    Width=Slider(190, range=0..300),
    Height=Slider(35, range=0..300),
    HorizontalAlignment=0)
adjustpos_58 = AdjustElementPositioning(
    ElementsToAdjust=pulldown_25,
    AbsolutePositioning=False,
    Width=Slider(190, range=0..300),
    Height=Slider(35, range=0..300),
    HorizontalAlignment=0)
adjustpos_59 = AdjustElementPositioning(
    ElementsToAdjust=pulldown_24,
    AbsolutePositioning=False,
    Width=Slider(190, range=0..300),
    Height=Slider(35, range=0..300),
    HorizontalAlignment=0)
adjustpos_60 = AdjustElementPositioning(
    ElementsToAdjust=pulldown_20,
    AbsolutePositioning=False,
    Width=Slider(190, range=0..300),
    Height=Slider(35, range=0..300),
    HorizontalAlignment=0)
adjustpos_61 = AdjustElementPositioning(
    ElementsToAdjust=pulldown_22,
    AbsolutePositioning=False,
    Width=Slider(190, range=0..300),
    Height=Slider(35, range=0..300),
    HorizontalAlignment=0)
adjustpos_62 = AdjustElementPositioning(
    ElementsToAdjust=border_3,
    Margin="5, 0, 0, 0",
    AbsolutePositioning=False,
    Width=Slider(200, range=0..300),
    Height=Slider(285, range=0..300),
    HorizontalAlignment=0)
adjustpos_63 = AdjustElementPositioning(
    ElementsToAdjust=border_4,
    Margin="5, 0, 0, 0",
    AbsolutePositioning=False,
    Width=Slider(200, range=0..300),
    Height=Slider(155, range=0..300),
    HorizontalAlignment=0,
    VerticalAlignment=2)
adjustpos_64 = AdjustElementPositioning(
    ElementsToAdjust=border_5,
    Margin="5, 0, 0, 0",
    AbsolutePositioning=False,
    Width=Slider(200, range=0..300),
    Height=Slider(155, range=0..300),
    HorizontalAlignment=0,
    VerticalAlignment=2)
adjustpos_65 = AdjustElementPositioning(
    ElementsToAdjust=border_6,
    Margin="5, 0, 0, 0",
    AbsolutePositioning=False,
    Width=Slider(200, range=0..300),
    Height=Slider(285, range=0..300),
    HorizontalAlignment=0)

x_plus_one = XPlusOne(NumberX=values_58.Indices)
entwine_36 = Entwine(Branch00=stack_29, Branch01=stack_30, FlattenInputs=True)  # -> flatten(Result)
entwine_37 = Entwine(Branch00=true_button_2, Branch01=true_button, FlattenInputs=True)  # -> flatten(Result)

# ----
# Construction by climate and type
location_10 = Data(entwine_36)

entwine_38 = Entwine(Branch00=location_10, Branch01=location_6, FlattenInputs=True)  # -> flatten(Result)

base_climate = RemoteSender(x_plus_one)
stack_35 = CreateStack(UIElements=entwine_38, Horizontal=True)

entwine_39 = Entwine(Branch00=border_6, Branch01=border_3, Branch02=border_4, Branch03=border_5, FlattenInputs=True)  # -> flatten(Result)
stack_36 = CreateStack(UIElements=entwine_39, Horizontal=True)
entwine_40 = Entwine(Branch00=label_23, Branch01=stack_36, FlattenInputs=True)  # -> flatten(Result)
stack_37 = CreateStack(UIElements=entwine_40, Horizontal=invert(True))
base_climate_2 = RemoteReceiver(base_climate)
base_type_2 = RemoteReceiver(base_type)

# ---- group: Building occupancy and systems / Select construction set
bldgvintages = HBBuildingVintages({"ASHRAE 90.1 2019  |  IECC 2021": "2019", "ASHRAE 90.1 2016  |  IECC 2018": "2016", "ASHRAE 90.1 2013  |  IECC 2015": "2013", "ASHRAE 90.1 2010  |  IECC 2012": "2010", "ASHRAE 90.1 2007  |  IECC 2009": "2007", "ASHRAE 90.1 2004  |  IECC 2006": "2004", "1980-2004 (CBECS)": "1980_2004", "Pre-1980 (CBECS)": "pre_1980"}, selected="ASHRAE 90.1 2019  |  IECC 2021")
constructiontypes = HBConstructionTypes({"SteelFramed", "WoodFramed", "Mass", "Metal Building"}, selected="WoodFramed")
climatezones = HBClimateZones({"1 - Very Hot": "1", "2 - Hot": "2", "3 - Warm": "3", "4 - Mixed": "4", "5 - Cool": "5", "6 - Cold": "6", "7 - Very Cold": "7", "8 - Subarctic": "8"}, selected="8 - Subarctic")
constrsetclimate = HBConstructionSetByClimate(climate_zone=base_climate_2, vintage=bldgvintages, constr_type=base_type_2)  # -> constr_set; plug-in component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
panel_47 = Panel(constrsetclimate)

# ---- group: Building occupancy and systems
# Define program and construction
# # Define program and construction
# To be added...
# 
# ## Instructions
# To be added...
# 
# ## Inputs
# - ...
# 
# ## Outputs
# - ...
# 
# ## Interpretation
# To be added...
cluster = Cluster_4()
fly = BrimstoneFly()  # same code as fly
programval = ItemSelector(cluster, {"Small house", "Big house"}, selected="Small house")
python = GhPythonScript(program_name=programval)  # -> out, program
# ---------- python: Python ----------
"""Retrieves schedule data from a json file.
    Inspired by the 'HB Constant Schedule',  'HB People', 'HB ProgramType', ' HB Lighting', 'HB Equipment', 'HB Service Hot Water', HB Setpoint components (1.6.0)
    
    Inputs:
        program_name: The human-readable program name
    Output:
        program: HB program based on json data"""

import scriptcontext
import json
import brimstone
import os
import Grasshopper
import numbers

try:  # import the honeybee-energy dependencies
    from honeybee_energy.schedule.ruleset import ScheduleRuleset
    from honeybee_energy.load.people import People
    from honeybee_energy.load.lighting import Lighting
    from honeybee_energy.load.equipment import ElectricEquipment
    from honeybee_energy.load.hotwater import ServiceHotWater
    from honeybee_energy.load.setpoint import Setpoint
    from honeybee_energy.programtype import ProgramType
except ImportError as e:
    raise ImportError('\nFailed to import honeybee_energy:\n\t{}'.format(e))

def main(program_name):
    json_file_path = brimstone.globals.boverket_energy_schedules_path
    file_path = os.path.join(Grasshopper.Folders.UserObjectFolders[0], json_file_path)
    if not os.path.exists(file_path):
        raise Exception("Failed to open json file, it should reside in [UserComponents folder]/brimstone_data/")
    
    with open(file_path, 'r') as file:
        data = json.load(file)
        for key in data.keys():
            if data[key]["name"] == program_name:
                program_id = key
                break
    
    program_json_data = data.get(program_id, {})
    program_data = get_program_data(program_name, program_json_data)
    program = create_program_type(program_name, program_data)
    return program

def get_program_data(program_name, data):
    loads = {
        "people": ["occupancy_schedule", "activity_schedule"],
        "lighting": ["schedule"],
        "electric_equipment": ["schedule"],
        "service_hot_water": ["schedule"],
        "setpoint": ["heating_schedule", "cooling_schedule"],
    }
    program_data = {}
    for load in loads.keys():
        name = program_name + "_" + load
        schedules = {}
        for schedule_load in loads[load]:
            schedule_data = data.get(load, {}).get(schedule_load, [])
            schedule_name = name + "_" + schedule_load
            fn =\
                ScheduleRuleset.from_constant_value\
                if not isinstance(schedule_data, list) or len(schedule_data) == 1 else\
                ScheduleRuleset.from_daily_values
            schedules[schedule_load] = fn(schedule_name, schedule_data)
        
        load_data = None
        
        if load == "people":
            people_per_area = data.get(load, {}).get("people_per_area", 0)
            load_data = People(name, people_per_area, schedules["occupancy_schedule"], schedules["activity_schedule"])
        elif load == "lighting":
            lighting_per_area = data.get(load, {}).get("lighting_per_area", 0)
            # Using default values from HB Lighting component
            return_fract = 0.0
            radiant_fract = 0.32
            visible_fract = 0.25
            load_data = Lighting(name, lighting_per_area, schedules["schedule"],
                return_fract, radiant_fract, visible_fract)
        elif load == "electric_equipment":
            equip_per_area = data.get(load, {}).get("equip_per_area", 0)
            # Using default values from HB Equipment component
            return_fract = 0.0
            latent_fract = 0.0
            lost_fract = 0.0
            load_data = ElectricEquipment(name, equip_per_area, schedules["schedule"],
                return_fract, latent_fract, lost_fract)
        elif load == "service_hot_water":
            flow_per_area = data.get(load, {}).get("flow_per_area", 0)
            # Using default values from HB Service Hot Water component
            target_temp = 60
            sensible_fract = 0.2
            latent_fract = 0.05
            load_data = ServiceHotWater(name, flow_per_area, schedules["schedule"], target_temp,
                sensible_fract, latent_fract)
        elif load == "setpoint":
            load_data = Setpoint(name, schedules["heating_schedule"], schedules["cooling_schedule"])
        program_data[load] = load_data
    return program_data
    

def create_program_type(name, program_data):
    program = ProgramType(name)
    for key in program_data:
        if program_data[key] is not None:
           setattr(program, key, program_data[key])
    return program

if __name__ == "__main__":
    if not scriptcontext.sticky["brimstone_flying"]:
        raise Exception("The 'Brimstone - Fly' component needs to exist on the canvas")
    program = main(program_name)
# ---------- end python ----------
deconstrprogram_2 = HBDeconstructProgramType(program=python.program)  # -> people, lighting, electric_equip, gas_equip, hot_water, infiltration, ventilation, setpoint; plug-in component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
add_dynamic_shades = AddDynamicShades(base_construction_set=panel_47, setpoint=Slider(100, range=0..200))

# ----
# Create construction
panel_48 = Panel("gypsum")
number_slider_6 = Slider(0.3, range=0..1)
searchmats = HBSearchMaterials(keywords="insulation")  # -> opaque_mats, window_mats; plug-in component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
searchmats_2 = HBSearchMaterials(keywords="concrete")  # -> opaque_mats, window_mats; plug-in component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
searchmats_3 = HBSearchMaterials()  # -> opaque_mats, window_mats; plug-in component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
searchmats_4 = HBSearchMaterials(keywords="air")  # -> opaque_mats, window_mats; plug-in component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
searchmats_5 = HBSearchMaterials(keywords="plywood")  # -> opaque_mats, window_mats; plug-in component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
searchmats_6 = HBSearchMaterials(keywords=panel_48)  # -> opaque_mats, window_mats; plug-in component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
searchconstrs = HBSearchConstructions()  # -> opaque_constrs, window_constrs, shade_constrs; plug-in component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
searchconstrs_2 = HBSearchConstructions()  # -> opaque_constrs, window_constrs, shade_constrs; plug-in component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
list_2 = ItemSelector(
    searchmats.opaque_mats,
    {"AtticFloor Insulation", "Generic 25mm Insulation", "Generic 50mm Insulation", "I01 25mm insulation board", "I02 50mm insulation board", "IEAD NonRes Roof Insulation-1.76", "IEAD Roof Insulation R-3.47 IP", "Insulation 1m", "Mass NonRes Wall Insulation-0.43", "Mass Wall Insulation R-4.23 IP"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}, selected="AtticFloor Insulation")
list_3 = ItemSelector(
    searchmats_2.opaque_mats,
    {"100mm Normalweight concrete floor", "12 in. Normalweight Concrete Floor", "4 in. Normalweight Concrete Floor", "4 in. Normalweight Concrete Wall", "6 in. Heavyweight Concrete Roof", "6 in. Normalweight Concrete Floor", "8 in. Concrete Block Basement Wall", "8 in. Concrete Block Wall", "8 in. Normalweight Concrete Floor", "8 in. Normalweight Concrete Wall", "8IN CONCRETE HW RefBldg", "8IN Concrete HW", "Concrete Pavement", "Generic HW Concrete", "Generic LW Concrete", "HW CONCRETE", "HW CONCRETE 8 in", "M11 100mm lightweight concrete", "M15 200mm heavyweight concrete", "MAT-CC05 4 HW CONCRETE", "MAT-CC05 8 HW CONCRETE", "NACM_Concrete 4in_140lb/ft3"}, selected="100mm Normalweight concrete floor")
list_4 = ItemSelector(
    searchmats_6.opaque_mats,
    {"1/2 in. Gypsum Board", "1/2IN Gypsum", "5/8 in. Gypsum Board", "G01 13mm gypsum board", "G01a 19mm gypsum board", "Generic Gypsum Board", "Gypsum Board - 1/2 in. CBES", "Gypsum Or Plaster Board - 3/8 in.", "NACM_Gypsum Board 5/8in"}, selected="1/2 in. Gypsum Board")
list_5 = ItemSelector(
    searchmats_4.opaque_mats,
    {"F04 Wall air space resistance", "F05 Ceiling air space resistance", "Generic Ceiling Air Gap", "Generic Wall Air Gap", "Typical Air Wall"}, selected="F04 Wall air space resistance")
list_6 = ItemSelector(searchmats_5.opaque_mats, {"5/8 in. Plywood", "Plywood - 5/8 in. CBES"}, selected="5/8 in. Plywood")
number_slider_7 = Slider(0.3, range=0..1)
opaquemat = HBOpaqueMaterial(
    name="XPS insulation",
    thickness=number_slider_6,
    conductivity=Slider(0.036, range=0..0.1),
    density=Slider(28, range=0..100),
    spec_heat=Slider(1500, range=0..10000))  # -> mat; plug-in component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
glassmat = HBGlassMaterial()  # -> mat; plug-in component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
list_7 = ItemSelector(
    searchconstrs.window_constrs,
    {"ASHRAE 189.1-2009 ExtWindow ClimateZone 1", "ASHRAE 189.1-2009 ExtWindow ClimateZone 2", "ASHRAE 189.1-2009 ExtWindow ClimateZone 3", "ASHRAE 189.1-2009 ExtWindow ClimateZone 4-5", "ASHRAE 189.1-2009 ExtWindow ClimateZone 6", "ASHRAE 189.1-2009 ExtWindow ClimateZone 7-8"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}, selected="ASHRAE 189.1-2009 ExtWindow ClimateZone 1")
list_8 = ItemSelector(
    searchconstrs_2.window_constrs,
    {"ASHRAE 189.1-2009 ExtWindow ClimateZone 1", "ASHRAE 189.1-2009 ExtWindow ClimateZone 2", "ASHRAE 189.1-2009 ExtWindow ClimateZone 3", "ASHRAE 189.1-2009 ExtWindow ClimateZone 4-5", "ASHRAE 189.1-2009 ExtWindow ClimateZone 6", "ASHRAE 189.1-2009 ExtWindow ClimateZone 7-8"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}, selected="ASHRAE 189.1-2009 ExtWindow ClimateZone 1")
merge_2 = Merge(Data1=list_3, Data2=list_5, Data3=list_6, Data4=opaquemat, Data5=list_4)
merge_3 = Merge(
    Data1=Slider(0.1, range=0..1),
    Data2=Slider(0.11, range=0..1),
    Data3=Slider(0.016, range=0..0.1),
    Data4=number_slider_6,
    Data5=Slider(0.012, range=0..0.1))
interiorsubset = HBInteriorConstructionSubset()  # -> interior_set; plug-in component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
groundsubset = HBGroundConstructionSubset()  # -> ground_set; plug-in component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
cluster_2 = Cluster_5(materials=merge_2, construction_name="Construction 1", thicknesses=merge_3)
cluster_3 = Cluster_6(window_construction=list_8, gwp_a1_a3="2.5", gwp_a4="0.042", density_kg_m2="38.2")
decnstrconstr = HBDeconstructConstruction(constr=list_7)  # -> materials, layers, r_val_si, r_val_ip, u_fac_si, u_fac_ip, shgc, t_sol, t_vis; plug-in component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
data = Data(cluster_3)
panel_49 = Panel(decnstrconstr.u_fac_ip)
panel_50 = Panel(decnstrconstr.u_fac_si)
subfacesubset = HBSubfaceSubset(window=data)  # -> subface_set; plug-in component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
exteriorsubset = HBExteriorConstructionSubset(exterior_wall=cluster_2)  # -> exterior_set; plug-in component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
panel_51 = Panel(cluster_2)
constructionset = HBConstructionSet(base_constr_set=add_dynamic_shades, exterior_subset=exteriorsubset, subface_subset=subfacesubset)  # -> constr_set; plug-in component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
decnstrconstrset = HBDeconstructConstructionSet(constr_set=constructionset)  # -> exterior_wall, exterior_roof, exposed_floor, ground_wall, ground_roof, ground_floor, window, skylight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; plug-in component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
panel_52 = Panel(decnstrconstrset.exterior_wall)

# ----
# Create construction
create_material_window_2 = RemoteReceiver(create_material_window)
launchwin = LaunchWindow(
    Show=create_material_window_2,
    Name="Create material",
    Width=Slider(300, range=0..1000),
    Height=Slider(385, range=0..1000),
    ChildStatus=2,
    EnableHorizScroll=False)
accent_colors = ValueList({"Amber", "Blue", "Brown", "Cobalt", "Crimson", "Cyan", "Emerald", "Green", "Indigo", "Lime", "Magenta", "Mauve", "Olive", "Orange", "Pink", "Purple", "Red", "Sienna", "Steel", "Taupe", "Teal", "Violet", "Yellow"}, selected="Blue")
pt = ConstructPoint(XCoordinate=Slider(352, range=0..1000), YCoordinate=Slider(210, range=0..1000), ZCoordinate=0)
winprops = SetWindowProperties(
    Window=launchwin,
    StartingLocation=pt,
    Theme=0,
    AccentColor=accent_colors,
    ShowTitleBar=True,
    BackgroundColor=RGB(255, 255, 255),
    ScaleFactor=1)
addelems = AddElements(Window=launchwin, Elements=flatten(entwine_29), DoVLChecking=True)  # -> AddedElements, ElementNames

data_2 = Data(add_dynamic_shades)

# ----
# Program module
number_slider_8 = Slider(27, range=10..30)
bldg_programs_2 = RemoteReceiver(bldg_programs)
label_25 = CreateLabel(LabelText="Select building program", LabelSize=18, Justification=0)
pulldown_28 = CreatePulldownMenu(ListItems=bldg_programs_2, showLabel=True)
pulldown_29 = CreatePulldownMenu(showLabel=True)
slider_8 = CreateSlider(Slider=number_slider_8, ShowBounds=False, ShowTicks=True, ShowTooltip=False, ShowValLabel=True, showLabel=False)
label_26 = CreateLabel(LabelText="Select room program", LabelSize=18, Justification=0)
label_27 = CreateLabel(LabelText="Cooling setpoint", LabelSize=12, Justification=0)
slider_9 = CreateSlider(Slider=Slider(21, range=10..30), ShowBounds=False, ShowTicks=True, ShowTooltip=False, ShowValLabel=True, showLabel=False)
label_28 = CreateLabel(LabelText="Heating setpoint", LabelSize=12, Justification=0)
slider_10 = CreateSlider(Slider=Slider(3, range=0..20), ShowBounds=False, ShowTicks=True, ShowTooltip=True, ShowValLabel=True, showLabel=False)
label_29 = CreateLabel(LabelText="Occupancy", LabelSize=12, Justification=0)
bldg_programs_3 = RemoteReceiver(bldg_programs)
values_60 = ValueListener(Elements=pulldown_28, SomeProperty=True)  # -> Values, Indices
values_61 = ValueListener(Elements=slider_9, SomeProperty=True)  # -> Values, Indices
values_62 = ValueListener(Elements=slider_8, SomeProperty=True)  # -> Values, Indices
values_63 = ValueListener(Elements=slider_10, SomeProperty=True)  # -> Values, Indices
item_8 = ListItem(List=bldg_programs_3, Index=values_60.Indices, Wrap=True)
values_64 = ValueListener(Elements=pulldown_29, SomeProperty=True)  # -> Values, Indices
panel_53 = Panel(item_8)
selected_building = RemoteSender(item_8)
adjustpos_66 = AdjustElementPositioning(ElementsToAdjust=pulldown_28, AbsolutePositioning=False, Width=Slider(250, range=0..300), HorizontalAlignment=0)
adjustpos_67 = AdjustElementPositioning(ElementsToAdjust=pulldown_29, AbsolutePositioning=False, Width=Slider(250, range=0..300), HorizontalAlignment=0)
adjustpos_68 = AdjustElementPositioning(ElementsToAdjust=slider_10, AbsolutePositioning=False, Width=Slider(200, range=0..300), HorizontalAlignment=0)
adjustpos_69 = AdjustElementPositioning(ElementsToAdjust=slider_9, AbsolutePositioning=False, Width=Slider(200, range=0..300), HorizontalAlignment=0)
entwine_41 = Entwine(Branch00=label_25, Branch01=pulldown_28, FlattenInputs=True)  # -> flatten(Result)
entwine_42 = Entwine(Branch00=label_26, Branch01=pulldown_29, FlattenInputs=True)  # -> flatten(Result)
entwine_43 = Entwine(Branch00=label_27, Branch01=slider_8, FlattenInputs=True)  # -> flatten(Result)
adjustpos_70 = AdjustElementPositioning(ElementsToAdjust=slider_8, AbsolutePositioning=False, Width=Slider(200, range=0..300), HorizontalAlignment=0)
entwine_44 = Entwine(Branch00=label_28, Branch01=slider_9, FlattenInputs=True)  # -> flatten(Result)
entwine_45 = Entwine(Branch00=label_29, Branch01=slider_10, FlattenInputs=True)  # -> flatten(Result)

cooling_setpoint = RemoteSender(values_62.Values)
heating_setpoint = RemoteSender(values_61.Values)
occupancy = RemoteSender(values_63.Values)
selected_room = RemoteSender(values_64.Values)

# ----
# Select building program
location_11 = Data(entwine_41)

# ----
# Cooling setpoint
location_12 = Data(entwine_43)

# ----
# Occupancy
location_13 = Data(entwine_45)

# ----
# Select room program
location_14 = Data(entwine_42)

# ----
# Heating setpoint
location_15 = Data(entwine_44)

# ----
# Define program
bldgvintages_2 = HBBuildingVintages({"ASHRAE 90.1 2019  |  IECC 2021": "2019", "ASHRAE 90.1 2016  |  IECC 2018": "2016", "ASHRAE 90.1 2013  |  IECC 2015": "2013", "ASHRAE 90.1 2010  |  IECC 2012": "2010", "ASHRAE 90.1 2007  |  IECC 2009": "2007", "ASHRAE 90.1 2004  |  IECC 2006": "2004", "1980-2004 (CBECS)": "1980_2004", "Pre-1980 (CBECS)": "pre_1980"}, selected="ASHRAE 90.1 2019  |  IECC 2021")
selected_building_2 = RemoteReceiver(selected_building)
climate = RemoteReceiver()
constrsetclimate_2 = HBConstructionSetByClimate(climate_zone=climate, vintage=bldgvintages_2, constr_type=constructiontypes)  # -> constr_set; plug-in component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
searchprog_2 = HBSearchPrograms(bldg_prog=selected_building_2)  # -> room_prog; plug-in component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
room_programs = RemoteSender(searchprog_2)
selected_room_2 = RemoteReceiver(selected_room)
occupancy_2 = RemoteReceiver(occupancy)
applyloadvals_2 = HBApplyLoadValues(room_or_program=flatten(selected_room_2), people_per_floor=occupancy_2)  # -> report, mod_obj; plug-in component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
cooling_setpoint_2 = RemoteReceiver(cooling_setpoint)
heating_setpoint_2 = RemoteReceiver(heating_setpoint)
applysetpointvals_2 = HBApplySetpointValues(room_or_program=flatten(applyloadvals_2.mod_obj), cooling_setpt=cooling_setpoint_2, heating_setpt=heating_setpoint_2)  # -> report, mod_obj; plug-in component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
program = Data(applysetpointvals_2.mod_obj)

room_programs_2 = RemoteReceiver(room_programs)
setlist = SetListContents(ListToModify=pulldown_29, NewListContents=room_programs_2, SelectedIndex=Slider(0, range=0..1))

# ----
# Geometry module
panel_54 = Panel("""gbg
mumindalen
villa villekulla""")
panel_55 = Panel("Type")
panel_56 = Panel("""None
Room
Window
Adjacent
Context""")
panel_57 = Panel("""Room
Window
Adjacent
Context""")
label_30 = CreateLabel(LabelText="Assign type", LabelSize=18, Justification=0)
pulldown_30 = CreatePulldownMenu(ListItems=panel_56, showLabel=True)
button_3 = CreateButton(ButtonName="Select geometry", ButtonStyle=0)
button_4 = CreateButton(ButtonName="Save geometry", ButtonStyle=0)
values_65 = ValueListener(Elements=button_4, SomeProperty=True)  # -> Values, Indices
pulldown_31 = CreatePulldownMenu(ListItems=panel_54, showLabel=True)
label_31 = CreateLabel(LabelText="Set location", LabelSize=18, Justification=0)
checkbox_13 = CreateCheckbox(Label="Preview", StartingValue=False)
button_5 = CreateButton(ButtonName="Get climate data", ButtonStyle=0)
pulldown_32 = CreatePulldownMenu(ListItems=panel_57, showLabel=True)
label_32 = CreateLabel(LabelText="Preview", LabelSize=18, Justification=0)
values_66 = ValueListener(Elements=button_3, SomeProperty=True)  # -> Values, Indices
values_67 = ValueListener(Elements=pulldown_30, SomeProperty=True)  # -> Values, Indices
entwine_46 = Entwine(Branch00=pulldown_32, Branch01=checkbox_13, FlattenInputs=True)  # -> flatten(Result)
values_68 = ValueListener(Elements=pulldown_31, SomeProperty=True)  # -> Values, Indices
stack_38 = CreateStack(UIElements=entwine_46, Horizontal=True)
values_69 = ValueListener(Elements=pulldown_32, SomeProperty=True)  # -> Values, Indices
values_70 = ValueListener(Elements=checkbox_13, SomeProperty=True)  # -> Values, Indices
adjustpos_71 = AdjustElementPositioning(ElementsToAdjust=pulldown_30, AbsolutePositioning=False, Width=Slider(150, range=0..300), HorizontalAlignment=0)
adjustpos_72 = AdjustElementPositioning(ElementsToAdjust=button_4, AbsolutePositioning=False, Width=Slider(120, range=0..300), HorizontalAlignment=0)
adjustpos_73 = AdjustElementPositioning(ElementsToAdjust=pulldown_31, AbsolutePositioning=False, Width=Slider(150, range=0..300), HorizontalAlignment=0)
adjustpos_74 = AdjustElementPositioning(ElementsToAdjust=button_5, AbsolutePositioning=False, Width=Slider(120, range=0..300), HorizontalAlignment=0)
adjustpos_75 = AdjustElementPositioning(ElementsToAdjust=pulldown_32, AbsolutePositioning=False, Width=Slider(150, range=0..300), HorizontalAlignment=0)
entwine_47 = Entwine(Branch00=label_30, Branch01=button_3, Branch02=pulldown_30, Branch03=button_4, FlattenInputs=True)  # -> flatten(Result)
entwine_48 = Entwine(Branch00=label_31, Branch01=pulldown_31, Branch02=button_5, FlattenInputs=True)  # -> flatten(Result)
entwine_49 = Entwine(Branch00=label_32, Branch01=stack_38, FlattenInputs=True)  # -> flatten(Result)
adjustpos_76 = AdjustElementPositioning(ElementsToAdjust=button_3, AbsolutePositioning=False, Width=Slider(120, range=0..300), HorizontalAlignment=0)

freeze_gate = StreamFreezeGate(Data=values_65.Values, PassingSwitch=invert(values_65.Values))
presavegeometry = RemoteSender(values_65.Values)
presavegeometry_2 = RemoteReceiver(presavegeometry)
bool_7 = Boolean(invert(freeze_gate))
values_71 = ValueListener(Elements=button_5, SomeProperty=True)  # -> Values, Indices
geometrytype = RemoteSender(values_67.Values)
tap = TapBuffer(Reset=False, Incremental=True, Valve=bool_7, Hold=True)
location_16 = RemoteSender(values_68.Values)
getclimatedata = RemoteSender(values_71.Values)
dam = DataDam(DataA=tap, BufferDelay=2500000, BufferMode=2)
previewtype = RemoteSender(values_69.Values)
previewtype_2 = RemoteReceiver(previewtype)
previewtype_3 = RemoteReceiver(previewtype)
expression = Expression(x=previewtype_3, y="Context", Expression="x=y")
expression_2 = Expression(x=previewtype_2, y="Adjacent", Expression="x=y")
gate_6 = StreamGate(Stream=previewtype_3, Gate=expression)  # -> Target0, Target1
gate_7 = StreamGate(Stream=previewtype_2, Gate=expression_2)  # -> Target0, Target1
refkv_10 = ReferenceByKeyValue(Key="Type", Val=gate_6.Target1, lightweight=False)
refkv_11 = ReferenceByKeyValue(Key="Type", Val=gate_7.Target1, lightweight=False)
preview = RemoteSender(values_70.Values)
preview_2 = RemoteReceiver(preview)
preview_3 = RemoteReceiver(preview)
timeshift = TimeShifter(Data=dam, Capacity="1")
bool_8 = Boolean(dam)
gate_8 = StreamGate(Stream=refkv_10, Gate=preview_2)  # -> Target0, Target1
gate_9 = StreamGate(Stream=refkv_11, Gate=preview_3)  # -> Target0, Target1
filter_5 = StreamFilter(Gate=bool_8, Stream0="-1", Stream1=timeshift)
preview_4 = CustomPreview(Geometry=gate_8.Target1, Material=ColourSwatch(SwatchColor=RGBA(128, 125, 0, 75)))
preview_5 = CustomPreview(Geometry=gate_9.Target1, Material=ColourSwatch(SwatchColor=RGBA(0, 17, 128, 75)))
subtraction = Subtraction(A=tap, B=filter_5)
larger = LargerThan(FirstNumber=subtraction, SecondNumber="1")  # -> LargerThan, OrEqualTo
savegeometry = RemoteSender(larger.LargerThan)
savegeometry_2 = RemoteReceiver(savegeometry)
py3 = Python3Script(x=savegeometry_2)  # -> a
# ---------- py3: Python ----------
"""Grasshopper Script"""

import rhinoscriptsyntax as rs

if x:
    rs.Command("SelNone")
    a = True
# ---------- end py3 ----------
or_3 = GateOr(A=values_66.Values, B=py3)

selobj = ObjectsBySelection(Reset=invert(or_3), LiveMode=False)
lng = ListLength(List=selobj)
hideshow_13 = HideShowElement(ElementToHideShow=pulldown_30, Show=True, Collapse=True, Disable=invert(lng))
hideshow_14 = HideShowElement(ElementToHideShow=button_4, Show=True, Collapse=True, Disable=invert(lng))

panel_58 = Panel(selobj)
seletedgeometry = RemoteSender(selobj)
isseletedgeometry = RemoteSender(lng)

# ----
# Preview
preview_6 = Data(entwine_49)

# ----
# Assign type
assign_type = Data(entwine_47)

getclimatedata_2 = RemoteReceiver(getclimatedata)

# ---- group: Setup study case
# Import geometry
# Get climate data
rooms_3 = Geometry([<brep referenced from the Rhino model> x3])
windows_4 = Geometry([<brep referenced from the Rhino model> x65])
adjacent_geometry_2 = Geometry([<brep referenced from the Rhino model> x12])
# https://climate.onebuilding.org/WMO_Region_1_Africa/NGA_Nigeria/NGA_PL_Jos-Gowon.AP.651340_TMYx.zip
panel_59 = Panel("https://energyplus-weather.s3.amazonaws.com/europe_wmo_region_6/SWE/SWE_Goteborg.Landvetter.025260_IWEC/SWE_Goteborg.Landvetter.025260_IWEC.zip")
button_6 = Button()
epwmap = LBEPWmap(epw_map=getclimatedata_2)  # -> report; plug-in component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

# ---- group: Setup study case / Context
this_building = Geometry([<brep referenced from the Rhino model> x12])
other_buildings = Geometry([<brep referenced from the Rhino model> x105])
ground = Geometry(<mesh referenced from the Rhino model>)
merge_4 = Merge(Data1=ground, Data2=other_buildings, Data3=this_building, Data4=rooms_3)

# ----
panel_60 = Panel(getclimatedata_2)

# ---- group: Prepare for analysis
# Assemble Honeybee model
# # Assemble Honeybee model
# This cluster takes input geometry and geometric information and generates a valid Honeybee model which can be used in the following analysis steps.
# 
# ## Instructions
# Enter the relevant inputs to generate the Honeybee model. Windows can either be created using an input geometry or through auto-generation using a window-to-wall ratio.
# 
# ### Room geometry
# Each 3D Brep entered represents one room or thermal zone in the building with no air exchange between them. The Breps should be closed and 3D to generate valid rooms. The room geometries should represent the inner boundary of the external walls
# 
# ### Adjacent geometry
# Geometry of adjacent buildings represented by a surface where they contact the room geometry. Adiabatic boundary condition will be assumed at the contact surface.
# 
# ### Windows/apertures
# Windows can either be defined through a list of 2D surfaces which intersect with the room 3D geometries, or be auto-generated through the list of numeric outputs.
# 
# ### Wall/roof thicknesses
# Wall and roof thicknesses are supplied to generate a shading geometry representing the external surface thickness
# 
# ### Louvers
# If all related inputs are entered, shading louvers will be generated on each window according to the entered parameters.
# 
# ### Different directions
# All the above inputs will be the same for all rooms, however they can be optionally entered as a list which represents different values for different cardinal directions, in the order (N, E, S, W).
# 
# ## Inputs
# - `Model name` - text string representing the name of the analysis model
# - `Room geometry` - list of 3D closed Brep geometries representing each room/zone in the model
# - `Construction set` - text string representing the construction to be used for the rooms, can be retrieved using the HB Construction Set by Climate component
# - `Program` - Honeybee Program or list of which are applied to the rooms in the model. Can be defined using the HB Search Programs component
# - `Context geometry` - list of surrounding Brep geometries which shades the analysed Rooms
# - `Windows` - list of 2D Brep geometries which represent the openings in the building envelope. If not supplied, windows are instead generated through definition of window-to-wall ratios as defined below
# - `Skylights` - list of 2D Brep geometries which represent the openings in the building roof
# - `Window-to-wall ratio` - number representing the window-to-wall ratio on each exterior surface Used if no window geometries are supplied.
# - `Subdivide generated windows` - set to True if the window surface area should be divided into multiple windows on each exterior surface
# - `Window height` - number representing the target height of the auto-generated windows
# - `Sill height` - number representing how high the lower edge of the auto-generated windows should be from the room floor
# - `Horizontal separation` - number representing how far separated the auto-generated windows should be horizontally
# - `Vertical separation` - number representing if auto-generated windows should be split vertically and if so, what distance
# - `Wall thickness` - number representing the thickness of the exterior walls, used to generate shading geometry for windows
# - `Roof thickness` - number representing the thickness of the roof, used to generate shading geometry for skylights
# - `Louver depth` - number optionally representing the depth of louvers
# - `Number of louvers` - number optionally representing the amount of louvers on each window
# - `Distance between louvers ` - number optionally representing the distance between louvers on each window
# - `Louver angle` - number optionally representing if louvers should be tilted
# - `Vertical/horizontal louvers` - boolean, set to True if louvers should be vertical
# 
# ## Outputs
# - `Honeybee model` - valid Honeybee model for further analysis
# 
# ## Interpretation
# To be added...
deconstrprogram_3 = HBDeconstructProgramType(program=list)  # -> people, lighting, electric_equip, gas_equip, hot_water, infiltration, ventilation, setpoint; plug-in component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
number_slider_9 = Slider(0.3, range=0..1)
number_slider_10 = Slider(0.3, range=0..1)
decnstrpeople_2 = HBDeconstructPeople(people=deconstrprogram_3.people)  # -> name, ppl_per_area, occupancy_sch, activity_sch; plug-in component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
geo = Geometry(rooms_2)
geo_2 = Geometry()
geo_3 = Geometry(windows_2)
geo_4 = Geometry(merge_4)  # disabled
data_3 = Data(program)
data_4 = Data(constructionset)
geo_5 = Geometry(representative_room_adjacent)
deconstrsch_2 = HBDeconstructSchedule(schedule=decnstrpeople_2.occupancy_sch)  # -> day_names, day_data, type_limit; plug-in component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
panel_61 = Panel(" my model")
create_honeybee_model = CreateHoneybeeModel(
    model_name=model_name_2,
    room_geometry=room_2,
    adjacent_geometry=room,
    construction_set=data_2,
    program=data_3,
    context_geometry=room_3,
    windows=windows_3,
    skylights=geo_2,
    window_to_wall_ratio=generate_wwr_2,
    subdivide_generated_windows=Toggle(True),
    sill_height=Slider(0.3, range=0..1),
    wall_thickness=wall_thickness_2,
    roof_thickness=roof_thickness_2,
    louver_depth=filter_4,
    number_of_louvers=number_of_louvers_5,
    distance_between_louvers=filter_3,
    louver_angle=filter_2)  # -> model_2, errors
xdata_2 = LBDeconstructData(data=deconstrsch_2.day_data)  # -> header, values; plug-in component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
panel_62 = Panel(xdata_2.header)
panel_63 = Panel(create_honeybee_model.errors)
filter_6 = StreamFilter(Gate=run_simulation_6, Stream1=create_honeybee_model.model_2)
vizbytype = HBVisualizeByType(hb_objs=create_honeybee_model.model_2)  # -> walls, interior_walls, roofs, ceilings, exterior_floors, interior_floors, air_walls, apertures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; plug-in component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
vizbybc = HBVisualizeByBC(hb_objs=create_honeybee_model.model_2)  # -> outdoors, surface, ground, adiabatic, other, wire_frame; plug-in component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
deconstructmodel = HBDeconstructModel(model=filter_6)  # -> rooms, faces, apertures, doors, shades; plug-in component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
data_5 = Data(filter_6)

# ----
filter_7 = StreamFilter(
    Gate=visualise_honeybee_model_index_2,
    Stream0=[vizbytype.walls, vizbytype.interior_walls, vizbytype.roofs, vizbytype.ceilings, vizbytype.exterior_floors, vizbytype.interior_floors, vizbytype.air_walls, vizbytype.apertures, vizbytype.interior_apertures, vizbytype.outdoor_shades, vizbytype.indoor_shades],
    Stream1=[vizbytype.walls, vizbytype.interior_walls, vizbytype.air_walls],
    Stream2=vizbytype.roofs,
    Stream3=[vizbytype.ceilings, vizbytype.interior_floors],
    Stream4=vizbytype.exterior_floors,
    Stream5=[vizbytype.apertures, vizbytype.interior_apertures],
    Stream6=[vizbytype.doors, vizbytype.interior_doors],
    Stream7=[vizbytype.indoor_shades, vizbytype.outdoor_shades])
gate_10 = StreamGate(Stream=filter_7, Gate=visualise_honeybee_model_3)  # -> Target0, Target1
data_6 = Data(gate_10.Target1)

# ----
# Weather visualisation
room_energy_attribute_visualize_4 = RemoteReceiver(room_energy_attribute_visualize)
room_attribute_2 = RemoteReceiver(room_attribute)
face_energy_attribute_3 = RemoteReceiver(face_energy_attribute)
face_energy_attribute_visualize_4 = RemoteReceiver(face_energy_attribute_visualize)
room_energy_attribute_3 = RemoteReceiver(room_energy_attribute)
face_attribute_2 = RemoteReceiver(face_attribute)
roomenergyattr = HBRoomEnergyAttributes({"Program": "properties.energy.program_type.display_name", "Construction Set": "properties.energy.construction_set.display_name", "Is Conditioned": "properties.energy.is_conditioned", "People per Area [ppl/m2]": "properties.energy.people.people_per_area", "Area per Person [m2/ppl]": "properties.energy.people.area_per_person", "Lighting per Area [W/m2]": "properties.energy.lighting.watts_per_area"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}, selected="Program")
pt_2 = ConstructPoint(XCoordinate=Slider(21, range=0..100), YCoordinate=Slider(15, range=0..100), ZCoordinate=0)
faceenergyattr = HBFaceEnergyAttributes({"Construction": "properties.energy.construction.display_name", "Materials": "properties.energy.construction.layers", "Thickness [m]": "properties.energy.construction.thickness", "Density [kg/m2]": "properties.energy.construction.mass_area_density", "Heat Capacity [J/K-m2]": "properties.energy.construction.area_heat_capacity", "Construction R-Value [m2-K/W]": "properties.energy.construction.r_value", "Construction U-Value [W/m2-K]": "properties.energy.construction.u_value", "Construction U-Factor [W/m2-K]": "properties.energy.construction.u_factor", "Construction SHGC [Unshaded]": "properties.energy.construction.shgc", "R-Factor [m2-K/W]": "properties.energy.r_factor", "U-Factor [W/m2-K]": "properties.energy.u_factor", "SHGC [Unshaded]": "properties.energy.shgc", "Solar Transmitance [Unshaded]": "properties.energy.construction.solar_transmittance", "Visible Transmitance [Unshaded]": "properties.energy.construction.visible_transmittance", "Solar Reflectance [Outside]": "properties.energy.construction.outside_solar_reflectance", "Solar Reflectance [Inside]": "properties.energy.construction.inside_solar_reflectance", "Fraction Area Operable": "properties.energy.vent_opening.fraction_area_operable", "Fraction Height Operable": "properties.energy.vent_opening.fraction_height_operable", "Discharge Coefficient": "properties.energy.vent_opening.discharge_coefficient"}, selected="Construction SHGC [Unshaded]")
faceattr = HBFaceAttributes({"Display Name": "display_name", "Simulation Name (Identifier)": "identifier", "Boundary Condition": "boundary_condition", "Has Parent": "has_parent", "Parent": "parent", "Azimuth": "azimuth", "Altitude": "altitude", "Area": "area", "Perimeter": "perimeter", "Face Type": "type", "Aperture Is Operable": "is_operable", "Door Is Glass": "is_glass"}, selected="Face Type")
roomattr = HBRoomAttributes({"Display Name": "display_name", "Simulation Name (Identifier)": "identifier", "Multiplier": "multiplier", "Floor Area Excluded": "exclude_floor_area", "Story": "story", "Volume": "volume", "Gross Floor Area": "floor_area", "Exposed Area": "exposed_area", "Exterior Wall Area": "exterior_wall_area", "Exterior Aperture Area": "exterior_aperture_area", "Average Floor Elevation": "average_floor_height"}, selected="Exterior Aperture Area")
run_weather_visualisation_4 = RemoteReceiver(run_weather_visualisation)
falsestart_4 = LBFalseStartToggle(False)
falsestart_5 = LBFalseStartToggle(False)
falsestart_6 = LBFalseStartToggle(False)
pt_3 = Point(pt_2)
data_7 = Data(panel_59)
geo_6 = Geometry(geo_4)
geo_7 = Geometry(room_2)
data_8 = Data(data_5)
weather_visualisation_2 = WeatherVisualisation(
    _1=data_7,
    run_weather_visualisation=run_weather_visualisation_4,
    target_geometry_2=refkv_9,
    target_geometry=geo_6,
    run_direct_sun_hours_study=run_weather_visualisation_4,
    run_incident_radiation_study=run_weather_visualisation_4,
    sky_mask_centre_point=pt_3)  # -> sky_dome, sky_mask, wind_rose, dry_bulb_temperature_line_chart, dry_bulb_temperature_2d_chart, direct_sun_hours_2, incident_radiation
visualise_properties = VisualiseProperties(
    honeybee_model=data_8,
    room_attribute=room_attribute_2,
    number_of_decimals_room=Slider(4, range=0..10),
    face_attribute=face_attribute_2,
    number_of_decimals_face=Slider(4, range=0..10))  # -> visualised_room_attributes_2, visualised_face_attributes_2
data_9 = Data(visualise_properties.visualised_room_attributes_2)
data_10 = Data(visualise_properties.visualised_face_attributes_2)
dry_bulb_temperature_line_chart_2 = RemoteReceiver(dry_bulb_temperature_line_chart)
dry_bulb_temperature_2d_chart_2 = RemoteReceiver(dry_bulb_temperature_2d_chart)
incident_radiation_3 = RemoteReceiver(incident_radiation)
direct_sun_hours_2 = RemoteReceiver(direct_sun_hours)
sky_dome_2 = RemoteReceiver(sky_dome)
sky_mask_2 = RemoteReceiver(sky_mask)
wind_rose_2 = RemoteReceiver(wind_rose)
gate_11 = StreamGate(Stream=weather_visualisation_2.sky_dome, Gate=sky_dome_2)  # -> Target0, Target1
gate_12 = StreamGate(Stream=weather_visualisation_2.sky_mask, Gate=sky_mask_2)  # -> Target0, Target1
gate_13 = StreamGate(Stream=weather_visualisation_2.dry_bulb_temperature_line_chart, Gate=dry_bulb_temperature_line_chart_2)  # -> Target0, Target1
gate_14 = StreamGate(Stream=weather_visualisation_2.wind_rose, Gate=wind_rose_2)  # -> Target0, Target1
gate_15 = StreamGate(Stream=weather_visualisation_2.dry_bulb_temperature_2d_chart, Gate=dry_bulb_temperature_2d_chart_2)  # -> Target0, Target1
gate_16 = StreamGate(Stream=weather_visualisation_2.direct_sun_hours_2, Gate=direct_sun_hours_2)  # -> Target0, Target1
gate_17 = StreamGate(Stream=weather_visualisation_2.incident_radiation, Gate=incident_radiation_3)  # -> Target0, Target1
preview_7 = CustomPreview(Geometry=gate_11.Target1, Material=swatch)
preview_8 = CustomPreview(Geometry=gate_12.Target1, Material=swatch)
preview_9 = CustomPreview(Geometry=gate_13.Target1, Material=swatch)
preview_10 = CustomPreview(Geometry=gate_14.Target1, Material=swatch)
preview_11 = CustomPreview(Geometry=gate_15.Target1, Material=swatch)
preview_12 = CustomPreview(Geometry=gate_16.Target1, Material=swatch)
preview_13 = CustomPreview(Geometry=gate_17.Target1, Material=swatch)

# ----
# Analysis module
panel_64 = Panel("Simple energy simulations")
panel_65 = Panel("C:/Users/Isac/Desktop/Toivo_Chalmers/UI/matplotlib/test.png")
toggle_4 = CreateToggle(Default=False)
checkbox_14 = CreateCheckbox(Label="Visualize", StartingValue=False)
checkbox_15 = CreateCheckbox(Label="Heating balance (design day)", StartingValue=False)
checkbox_16 = CreateCheckbox(Label="Daily heating profile", StartingValue=False)
checkbox_17 = CreateCheckbox(Label="Cooling balance (design day)", StartingValue=False)
checkbox_18 = CreateCheckbox(Label="Daily cooling profile", StartingValue=False)
checkbox_19 = CreateCheckbox(Label="Annual energy balance", StartingValue=False)
f_ghfilepath = GHFilePathInfo()  # -> FileName, FilePath
values_72 = ValueListener(Elements=checkbox_15, SomeProperty=True)  # -> Values, Indices
values_73 = ValueListener(Elements=checkbox_19, SomeProperty=True)  # -> Values, Indices
values_74 = ValueListener(Elements=checkbox_18, SomeProperty=True)  # -> Values, Indices
values_75 = ValueListener(Elements=checkbox_16, SomeProperty=True)  # -> Values, Indices
values_76 = ValueListener(Elements=checkbox_17, SomeProperty=True)  # -> Values, Indices
nextfile_2 = NextAvailableFilename(Format="test_{000}.png", FolderPath="C:/Users/Isac/Desktop/Toivo_Chalmers/UI/matplotlib", Trigger=Toggle(False))
panel_66 = Panel(f_ghfilepath.FilePath)
annual_energy_balance_checkbox = RemoteSender(values_73.Values)
daily_cooling_profile_checkbox = RemoteSender(values_74.Values)
daily_heating_profile_checkbox = RemoteSender(values_75.Values)
values_77 = ValueListener(Elements=checkbox_14, SomeProperty=True)  # -> Values, Indices
cooling_balance_checkbox = RemoteSender(values_76.Values)
heating_balance_checkbox = RemoteSender(values_72.Values)
values_78 = ValueListener(Elements=toggle_4, SomeProperty=True)  # -> Values, Indices
py3_2 = Python3Script(x=panel_65)  # -> out, a
# ---------- py3_2: Python ----------
import matplotlib.pyplot as plt
import random as rd

fig, ax = plt.subplots()

counts = [rd.randint(0, 100), rd.randint(0, 100),
          rd.randint(0, 100), rd.randint(0, 100)]
fruits = ['apple', 'blueberry', 'cherry', 'orange']
bar_labels = ['red', 'blue', '_red', 'orange']
bar_colors = ['tab:red', 'tab:blue', 'tab:red', 'tab:orange']

ax.bar(fruits, counts, label=bar_labels, color=bar_colors)

ax.set_ylabel('fruit supply')
ax.set_title('Fruit supply by kind and color')
ax.legend(title='Fruit color')

plt.savefig(x)
a = x

#plt.show()
# ---------- end py3_2 ----------
py3_3 = Python3Script(x=nextfile_2)  # -> out, a; same code as py3_2
visualize_simple_energy_simulations = RemoteSender(values_77.Values)
pre_run_simple_energy_simulations = RemoteSender(values_78.Values)
pre_run_simple_energy_simulations_2 = RemoteReceiver(pre_run_simple_energy_simulations)
image = CreateImage(ImageSource=py3_2.a, ImageWidth=Slider(700, range=0..1000), ImageHeight=Slider(350, range=0..1000))
adjustpos_77 = AdjustElementPositioning(
    ElementsToAdjust=checkbox_14,
    Margin="15, 0, 0, 0",
    AbsolutePositioning=False,
    Width=Slider(435, range=0..1000),
    HorizontalAlignment=0)
setimg = SetImage(ImageToModify=image, NewImagePath=py3_3.a)
entwine_50 = Entwine(
    Branch00=checkbox_19,
    Branch01=checkbox_18,
    Branch02=checkbox_16,
    Branch03=checkbox_17,
    Branch04=checkbox_15,
    FlattenInputs=True)  # -> flatten(Result)

filter_8 = StreamFilter(Gate=pre_run_simple_energy_simulations_2, Stream0="Energy simulations can take a few minutes...", Stream1=panel_9)
expression_3 = Expression(x=filter_8, y=panel_9, Expression="x=y")
entwine_51 = Entwine(Branch00=label_11, Branch01=toggle_4, Branch02=checkbox_14, FlattenInputs=True)  # -> flatten(Result)
settextblock = SetTextBlockContents(TextBlockToModify=tb, NewTextBlockContents=filter_8)
dam_2 = DataDam(DataA=expression_3, BufferDelay=2500000, BufferMode=2)
stack_39 = CreateStack(UIElements=entwine_51, Horizontal=True)

# ----
# Run simple energy simulations
number_slider_11 = Slider(2, range=0..10)
entwine_52 = Entwine(Branch00=stack_39, Branch01=tb, Branch02=entwine_50, FlattenInputs=True)  # -> flatten(Result)
stack_40 = CreateStack(UIElements=entwine_52, Horizontal=invert(True))
border_7 = CreateBorder(
    UIElement=stack_40,
    BorderThickness=Slider(1, range=0..10),
    BorderColor=ColourSwatch(SwatchColor=RGB(217, 217, 217)),
    CornerRadius=number_slider_11)
adjustpos_78 = AdjustElementPositioning(ElementsToAdjust=border_7, AbsolutePositioning=False, Width=Slider(340, range=0..1000), HorizontalAlignment=0)
location_17 = Data(border_7)

# ----
# Heath window
number_slider_12 = Slider(850, range=0..1000)
panel_67 = Panel("C:\Users\Isac\Desktop\Toivo_Chalmers\UI\Icons\heath.jpg")
entwine_53 = Entwine(Branch00=stack_21, FlattenInputs=True)
entwine_54 = Entwine(Branch00=stack_35, Branch01=location_9, FlattenInputs=True)
entwine_55 = Entwine(Branch00=assign_type, Branch01=preview_6, Branch02=location_5, FlattenInputs=True)
entwine_56 = Entwine(
    Branch00=location_11,
    Branch01=location_14,
    Branch02=location_12,
    Branch03=location_15,
    Branch04=location_13,
    FlattenInputs=True)
entwine_57 = Entwine(Branch00=location_17, FlattenInputs=True)
entwine_58 = Entwine(Branch00=stack_22, FlattenInputs=True)
launchwin_2 = LaunchWindow(
    Show=Toggle(True),
    Name="Heath",
    Width=number_slider_12,
    Height=Slider(460, range=0..1000),
    ChildStatus=1,
    EnableHorizScroll=False)
accent_colors_2 = ValueList({"Amber", "Blue", "Brown", "Cobalt", "Crimson", "Cyan", "Emerald", "Green", "Indigo", "Lime", "Magenta", "Mauve", "Olive", "Orange", "Pink", "Purple", "Red", "Sienna", "Steel", "Taupe", "Teal", "Violet", "Yellow"}, selected="Blue")
panel_68 = Panel("""Geometry module
Program module
Construction module
Assembly module
Visualize module
Analysis module""")
pt_4 = ConstructPoint(XCoordinate=Slider(6, range=0..1000), YCoordinate=Slider(43, range=0..1000), ZCoordinate=0)
tabs = TabbedView(
    TabNames=panel_68,
    TabTextSize=Slider(12, range=0..100),
    Tab0=flatten(entwine_55),
    Tab1=flatten(entwine_56),
    Tab2=flatten(entwine_54),
    Tab3=flatten(entwine_53),
    Tab4=flatten(entwine_58),
    Tab5=flatten(entwine_57))
button_7 = CreateButton(ButtonName="Help!", ButtonStyle=0)
winprops_2 = SetWindowProperties(
    Window=launchwin_2,
    StartingLocation=pt_4,
    Theme=0,
    AccentColor=accent_colors_2,
    ShowTitleBar=True,
    BackgroundColor=RGB(255, 255, 255),
    ScaleFactor=1)
entwine_59 = Entwine(Branch00=tabs, Branch01=button_7, FlattenInputs=True)  # -> flatten(Result)
values_79 = ValueListener(Elements=button_7, SomeProperty=True)  # -> Values, Indices
adjustpos_79 = AdjustElementPositioning(
    ElementsToAdjust=button_7,
    Margin="0, 0, 0, 0",
    AbsolutePositioning=invert(False),
    Width=Slider(50, range=0..100),
    Height=Slider(30, range=0..100),
    HorizontalAlignment=2,
    VerticalAlignment=2)
stack_41 = CreateStack(UIElements=entwine_59, Horizontal=True)
addelems_2 = AddElements(Window=launchwin_2, Elements=flatten(stack_41), DoVLChecking=True)  # -> AddedElements, ElementNames

pre_run_simple_energy_simulations_3 = RemoteReceiver(pre_run_simple_energy_simulations)
annual_energy_balance_checkbox_2 = RemoteReceiver(annual_energy_balance_checkbox)
daily_heating_profile_checkbox_2 = RemoteReceiver(daily_heating_profile_checkbox)
daily_cooling_profile_checkbox_2 = RemoteReceiver(daily_cooling_profile_checkbox)
cooling_balance_checkbox_2 = RemoteReceiver(cooling_balance_checkbox)
heating_balance_checkbox_2 = RemoteReceiver(heating_balance_checkbox)

# ----
# Geometry module interface
constructiontype = RemoteReceiver()
previewtype_4 = RemoteReceiver(previewtype)
geometrytype_2 = RemoteReceiver(geometrytype)
previewtype_5 = RemoteReceiver(previewtype)
saveconstruction = RemoteReceiver()
seletedgeometry_2 = RemoteReceiver(seletedgeometry)
seletedgeometry_3 = RemoteReceiver(seletedgeometry)
seletedgeometry_4 = RemoteReceiver(seletedgeometry)
expression_4 = Expression(x=previewtype_4, y="Window", Expression="x=y")
expression_5 = Expression(x=previewtype_5, y="Room", Expression="x=y")
seletedgeometry_5 = RemoteReceiver(seletedgeometry)
ef_att = EleFrontAttributes(Keys="Type", Values=geometrytype_2)
ef_att_2 = EleFrontAttributes(Keys="Construction", Values=constructiontype)
preview_14 = RemoteReceiver(preview)
gate_18 = StreamGate(Stream=previewtype_4, Gate=expression_4)  # -> Target0, Target1
gate_19 = StreamGate(Stream=previewtype_5, Gate=expression_5)  # -> Target0, Target1
modratt = ModifyRhinoObjectAttributes(ReferencedObject=seletedgeometry_3, Attributes=ef_att_2, Activate=saveconstruction)
modratt_2 = ModifyRhinoObjectAttributes(ReferencedObject=seletedgeometry_2, Attributes=ef_att, Activate=presavegeometry_2)
gate_20 = StreamGate(Stream=seletedgeometry_4, Gate=preview_14)  # -> Target0, Target1
preview_15 = RemoteReceiver(preview)
refkv_12 = ReferenceByKeyValue(Key="Type", Val=gate_19.Target1, lightweight=False)
refkv_13 = ReferenceByKeyValue(Key="Type", Val=gate_18.Target1, lightweight=False)
wires = BrepWireframe(Brep=seletedgeometry_5, Density=Slider(6, range=0..10))
panel_69 = Panel(modratt_2)
panel_70 = Panel(modratt)
preview_16 = RemoteReceiver(preview)
preview_17 = RemoteReceiver(preview)
preview_18 = CustomPreview(Geometry=wires, Material=ColourSwatch(SwatchColor=RGB(255, 0, 0)))
preview_19 = CustomPreview(Geometry=gate_20.Target1, Material=ColourSwatch(SwatchColor=RGBA(8, 255, 0, 100)))
gate_21 = StreamGate(Stream=refkv_13, Gate=preview_16)  # -> Target0, Target1
gate_22 = StreamGate(Stream=refkv_12, Gate=preview_17)  # -> Target0, Target1
preview_20 = CustomPreview(Geometry=gate_21.Target1, Material=ColourSwatch(SwatchColor=RGBA(128, 0, 102, 75)))
preview_21 = CustomPreview(Geometry=gate_22.Target1, Material=ColourSwatch(SwatchColor=RGBA(4, 128, 0, 75)))

or_4 = GateOr(
    A=preview_15,
    B=room_attribute_visualize_2,
    C=room_energy_attribute_visualize_2,
    D=face_attribute_visualize_2,
    E=face_energy_attribute_visualize_2,
    F=visualise_honeybee_model_2)

filter_9 = StreamFilter(Gate=or_4, Stream0="Shaded", Stream1="Wireframe")
mod_viewport = ModifyViewport(DisplayMode=filter_9, AnimateRestore=False, RestoreFrames=10)

run_simple_energy_simulations = RemoteSender(dam_2)

run_simple_energy_simulations_2 = RemoteReceiver(run_simple_energy_simulations)
run_simple_energy_simulations_3 = RemoteReceiver(run_simple_energy_simulations)

hideshow_15 = HideShowElement(ElementToHideShow=checkbox_19, Show=run_simple_energy_simulations_2, Collapse=True, Disable=False)
hideshow_16 = HideShowElement(ElementToHideShow=checkbox_18, Show=run_simple_energy_simulations_2, Collapse=True, Disable=False)
hideshow_17 = HideShowElement(ElementToHideShow=checkbox_16, Show=run_simple_energy_simulations_2, Collapse=True, Disable=False)
hideshow_18 = HideShowElement(ElementToHideShow=checkbox_17, Show=run_simple_energy_simulations_2, Collapse=True, Disable=False)
hideshow_19 = HideShowElement(ElementToHideShow=checkbox_15, Show=run_simple_energy_simulations_2, Collapse=True, Disable=False)

# ----
# Simple energy simulations visualizations
panel_71 = Panel("C:/Users/Isac/Desktop/Toivo_Chalmers/UI/matplotlib")
pre_run_simple_energy_simulations_4 = RemoteReceiver(pre_run_simple_energy_simulations)
toggle_5 = BooleanToggle(True)
nextfile_3 = NextAvailableFilename(Format="Annual energy balance{000}.png", FolderPath=panel_71, Trigger=pre_run_simple_energy_simulations_4)

number_slider_13 = Slider(1, range=0..1)
neg = Negative(Value=number_slider_13)

panel_72 = Panel("total load EUI: {0} (kWh/m2)")
visualize_simple_energy_simulations_2 = RemoteReceiver(visualize_simple_energy_simulations)
format = Format(Format=panel_72, Culture=127, Data0=Slider(0, range=0..100))
nextfile_4 = NextAvailableFilename(Format="test_{000}.png", FolderPath="C:/Users/Isac/Desktop/Toivo_Chalmers/UI/matplotlib", Trigger=Toggle(True))
launchwin_3 = LaunchWindow(
    Show=visualize_simple_energy_simulations_2,
    Name="Simple energy simulations",
    Width=Slider(700, range=0..1000),
    Height=Slider(500, range=0..1000),
    ChildStatus=2,
    EnableHorizScroll=False)
py3_4 = Python3Script(x=nextfile_4)  # -> out, a; same code as py3_2
tb_2 = CreateTextBlock(Text=format, TextSize=16, Justification=0)
accent_colors_3 = ValueList({"Amber", "Blue", "Brown", "Cobalt", "Crimson", "Cyan", "Emerald", "Green", "Indigo", "Lime", "Magenta", "Mauve", "Olive", "Orange", "Pink", "Purple", "Red", "Sienna", "Steel", "Taupe", "Teal", "Violet", "Yellow"}, selected="Blue")
image_2 = CreateImage(ImageSource=py3_4.a, ImageWidth=Slider(700, range=0..1000), ImageHeight=Slider(350, range=0..1000))
pt_5 = ConstructPoint(XCoordinate=Slider(24, range=0..1000), YCoordinate=Slider(258, range=0..1000), ZCoordinate=0)
winprops_3 = SetWindowProperties(
    Window=launchwin_3,
    StartingLocation=pt_5,
    Theme=0,
    AccentColor=accent_colors_3,
    ShowTitleBar=True,
    BackgroundColor=RGB(255, 255, 255),
    ScaleFactor=1)
entwine_60 = Entwine(Branch00=tb_2, Branch01=image_2, FlattenInputs=True)  # -> flatten(Result)
addelems_3 = AddElements(Window=launchwin_3, Elements=flatten(entwine_60), DoVLChecking=True)  # -> AddedElements, ElementNames

# ----
# Create construction
number_slider_14 = Slider(200, range=0..1000)
database_materials_2 = RemoteReceiver(database_materials)
database_materials_3 = RemoteReceiver(database_materials)
database_materials_4 = RemoteReceiver(database_materials)
database_materials_5 = RemoteReceiver(database_materials)
database_materials_6 = RemoteReceiver(database_materials)
database_materials_7 = RemoteReceiver(database_materials)
textbox_8 = CreateTextBox(Label="Name", UpdateButton=invert(True), showLabel=True)
button_8 = CreateButton(ButtonName="Add", ButtonStyle=0)
button_9 = CreateButton(ButtonName="Remove", ButtonStyle=0)
textbox_9 = CreateTextBox(Label="Thickness", DefaultText=number_slider_14, UpdateButton=invert(True), showLabel=True)
pulldown_33 = CreatePulldownMenu(Label="Material", ListItems=database_materials_2, showLabel=True)
label_33 = CreateLabel(LabelText="Layer 1", LabelSize=12, Justification=0)
textbox_10 = CreateTextBox(Label="Thickness", DefaultText=Slider(200, range=0..1000), UpdateButton=invert(True), showLabel=True)
pulldown_34 = CreatePulldownMenu(Label="Material", ListItems=database_materials_3, showLabel=True)
label_34 = CreateLabel(LabelText="Layer 2", LabelSize=12, Justification=0)
textbox_11 = CreateTextBox(Label="Thickness", DefaultText=Slider(200, range=0..1000), UpdateButton=invert(True), showLabel=True)
pulldown_35 = CreatePulldownMenu(Label="Material", ListItems=database_materials_4, showLabel=True)
label_35 = CreateLabel(LabelText="Layer 3", LabelSize=12, Justification=0)
textbox_12 = CreateTextBox(Label="Thickness", DefaultText=Slider(200, range=0..1000), UpdateButton=invert(True), showLabel=True)
pulldown_36 = CreatePulldownMenu(Label="Material", ListItems=database_materials_5, showLabel=True)
label_36 = CreateLabel(LabelText="Layer 4", LabelSize=12, Justification=0)
textbox_13 = CreateTextBox(Label="Thickness", DefaultText=Slider(200, range=0..1000), UpdateButton=invert(True), showLabel=True)
pulldown_37 = CreatePulldownMenu(Label="Material", ListItems=database_materials_6, showLabel=True)
label_37 = CreateLabel(LabelText="Layer 5", LabelSize=12, Justification=0)
textbox_14 = CreateTextBox(Label="Thickness", DefaultText=Slider(200, range=0..1000), UpdateButton=invert(True), showLabel=True)
pulldown_38 = CreatePulldownMenu(Label="Material", ListItems=database_materials_7, showLabel=True)
label_38 = CreateLabel(LabelText="Layer 6", LabelSize=12, Justification=0)
button_10 = CreateButton(ButtonName="Create construction", ButtonStyle=0)
values_80 = ValueListener(Elements=button_8, SomeProperty=True)  # -> Values, Indices
values_81 = ValueListener(Elements=button_9, SomeProperty=True)  # -> Values, Indices
values_82 = ValueListener(Elements=textbox_8, SomeProperty=True)  # -> Values, Indices
values_83 = ValueListener(Elements=button_10, SomeProperty=True)  # -> Values, Indices
entwine_61 = Entwine(Branch00=pulldown_33, Branch01=textbox_9, FlattenInputs=True)  # -> flatten(Result)
add_layer = RemoteSender(values_80.Values)
remove_layer = RemoteSender(values_81.Values)
entwine_62 = Entwine(Branch00=pulldown_34, Branch01=textbox_10, FlattenInputs=True)  # -> flatten(Result)
panel_73 = Panel(values_82.Values)
entwine_63 = Entwine(Branch00=pulldown_35, Branch01=textbox_11, FlattenInputs=True)  # -> flatten(Result)
entwine_64 = Entwine(Branch00=pulldown_36, Branch01=textbox_12, FlattenInputs=True)  # -> flatten(Result)
entwine_65 = Entwine(Branch00=pulldown_37, Branch01=textbox_13, FlattenInputs=True)  # -> flatten(Result)
entwine_66 = Entwine(Branch00=pulldown_38, Branch01=textbox_14, FlattenInputs=True)  # -> flatten(Result)
stack_42 = CreateStack(UIElements=entwine_61, Horizontal=True)
stack_43 = CreateStack(UIElements=entwine_62, Horizontal=True)
stack_44 = CreateStack(UIElements=entwine_63, Horizontal=True)
stack_45 = CreateStack(UIElements=entwine_64, Horizontal=True)
stack_46 = CreateStack(UIElements=entwine_65, Horizontal=True)
stack_47 = CreateStack(UIElements=entwine_66, Horizontal=True)
entwine_67 = Entwine(Branch00=label_33, Branch01=stack_42, FlattenInputs=True)  # -> flatten(Result)
entwine_68 = Entwine(Branch00=textbox_8, Branch01=button_8, Branch02=button_9, FlattenInputs=True)  # -> flatten(Result)
entwine_69 = Entwine(Branch00=label_34, Branch01=stack_43, FlattenInputs=True)  # -> flatten(Result)
adjustpos_80 = AdjustElementPositioning(
    ElementsToAdjust=textbox_8,
    AbsolutePositioning=False,
    Width=Slider(190, range=0..300),
    Height=Slider(30, range=0..300),
    HorizontalAlignment=0)
entwine_70 = Entwine(Branch00=label_35, Branch01=stack_44, FlattenInputs=True)  # -> flatten(Result)
entwine_71 = Entwine(Branch00=label_37, Branch01=stack_46, FlattenInputs=True)  # -> flatten(Result)
entwine_72 = Entwine(Branch00=label_36, Branch01=stack_45, FlattenInputs=True)  # -> flatten(Result)
entwine_73 = Entwine(Branch00=label_38, Branch01=stack_47, FlattenInputs=True)  # -> flatten(Result)
stack_48 = CreateStack(UIElements=entwine_68, Horizontal=True)
adjustpos_81 = AdjustElementPositioning(
    ElementsToAdjust=label_33,
    AbsolutePositioning=False,
    Width=Slider(190, range=0..300),
    Height=Slider(25, range=0..300),
    HorizontalAlignment=0)
adjustpos_82 = AdjustElementPositioning(
    ElementsToAdjust=pulldown_33,
    AbsolutePositioning=False,
    Width=Slider(190, range=0..300),
    Height=Slider(35, range=0..300),
    HorizontalAlignment=0,
    VerticalAlignment=2)
adjustpos_83 = AdjustElementPositioning(
    ElementsToAdjust=textbox_9,
    Margin="5, 5, 0, 0",
    AbsolutePositioning=False,
    Width=Slider(90, range=0..300),
    Height=Slider(26, range=0..300),
    HorizontalAlignment=0,
    VerticalAlignment=2)
adjustpos_84 = AdjustElementPositioning(
    ElementsToAdjust=label_34,
    AbsolutePositioning=False,
    Width=Slider(190, range=0..300),
    Height=Slider(25, range=0..300),
    HorizontalAlignment=0)
adjustpos_85 = AdjustElementPositioning(
    ElementsToAdjust=pulldown_34,
    AbsolutePositioning=False,
    Width=Slider(190, range=0..300),
    Height=Slider(35, range=0..300),
    HorizontalAlignment=0,
    VerticalAlignment=2)
adjustpos_86 = AdjustElementPositioning(
    ElementsToAdjust=textbox_10,
    Margin="5, 5, 0, 0",
    AbsolutePositioning=False,
    Width=Slider(90, range=0..300),
    Height=Slider(26, range=0..300),
    HorizontalAlignment=0,
    VerticalAlignment=2)
adjustpos_87 = AdjustElementPositioning(
    ElementsToAdjust=label_35,
    AbsolutePositioning=False,
    Width=Slider(190, range=0..300),
    Height=Slider(25, range=0..300),
    HorizontalAlignment=0)
adjustpos_88 = AdjustElementPositioning(
    ElementsToAdjust=pulldown_35,
    AbsolutePositioning=False,
    Width=Slider(190, range=0..300),
    Height=Slider(35, range=0..300),
    HorizontalAlignment=0,
    VerticalAlignment=2)
adjustpos_89 = AdjustElementPositioning(
    ElementsToAdjust=textbox_11,
    Margin="5, 5, 0, 0",
    AbsolutePositioning=False,
    Width=Slider(90, range=0..300),
    Height=Slider(26, range=0..300),
    HorizontalAlignment=0,
    VerticalAlignment=2)
adjustpos_90 = AdjustElementPositioning(
    ElementsToAdjust=label_36,
    AbsolutePositioning=False,
    Width=Slider(190, range=0..300),
    Height=Slider(25, range=0..300),
    HorizontalAlignment=0)
adjustpos_91 = AdjustElementPositioning(
    ElementsToAdjust=pulldown_36,
    AbsolutePositioning=False,
    Width=Slider(190, range=0..300),
    Height=Slider(35, range=0..300),
    HorizontalAlignment=0,
    VerticalAlignment=2)
adjustpos_92 = AdjustElementPositioning(
    ElementsToAdjust=textbox_12,
    Margin="5, 5, 0, 0",
    AbsolutePositioning=False,
    Width=Slider(90, range=0..300),
    Height=Slider(26, range=0..300),
    HorizontalAlignment=0,
    VerticalAlignment=2)
adjustpos_93 = AdjustElementPositioning(
    ElementsToAdjust=label_37,
    AbsolutePositioning=False,
    Width=Slider(190, range=0..300),
    Height=Slider(25, range=0..300),
    HorizontalAlignment=0)
adjustpos_94 = AdjustElementPositioning(
    ElementsToAdjust=pulldown_37,
    AbsolutePositioning=False,
    Width=Slider(190, range=0..300),
    Height=Slider(35, range=0..300),
    HorizontalAlignment=0,
    VerticalAlignment=2)
adjustpos_95 = AdjustElementPositioning(
    ElementsToAdjust=textbox_13,
    Margin="5, 5, 0, 0",
    AbsolutePositioning=False,
    Width=Slider(90, range=0..300),
    Height=Slider(26, range=0..300),
    HorizontalAlignment=0,
    VerticalAlignment=2)
adjustpos_96 = AdjustElementPositioning(
    ElementsToAdjust=label_38,
    AbsolutePositioning=False,
    Width=Slider(190, range=0..300),
    Height=Slider(25, range=0..300),
    HorizontalAlignment=0)
adjustpos_97 = AdjustElementPositioning(
    ElementsToAdjust=pulldown_38,
    AbsolutePositioning=False,
    Width=Slider(190, range=0..300),
    Height=Slider(35, range=0..300),
    HorizontalAlignment=0,
    VerticalAlignment=2)
adjustpos_98 = AdjustElementPositioning(
    ElementsToAdjust=textbox_14,
    Margin="5, 5, 0, 0",
    AbsolutePositioning=False,
    Width=Slider(90, range=0..300),
    Height=Slider(26, range=0..300),
    HorizontalAlignment=0,
    VerticalAlignment=2)
adjustpos_99 = AdjustElementPositioning(
    ElementsToAdjust=button_10,
    Margin="5, 10, 0, 0",
    AbsolutePositioning=False,
    Width=Slider(126, range=0..300),
    Height=Slider(30, range=0..300),
    HorizontalAlignment=0,
    VerticalAlignment=2)

remove_layer_2 = RemoteReceiver(remove_layer)
add_layer_2 = RemoteReceiver(add_layer)
filter_10 = StreamFilter(Gate=add_layer_2, Stream1=number_slider_13)
filter_11 = StreamFilter(Gate=remove_layer_2, Stream1=neg)
rec = DataRecorder([filter_10, filter_11], DataLimit=-10, RecordData=True)
ma = MassAddition(Input=[Slider(1, range=0..1), rec])  # -> Result, PartialResults
subtraction_2 = Subtraction(A=Slider(6, range=0..10), B=ma.Result)
repeat = RepeatData(Data="True", Length=ma.Result)
repeat_2 = RepeatData(Data="False", Length=subtraction_2)
entwine_74 = Entwine(Branch00=repeat, Branch01=repeat_2, FlattenInputs=True)  # -> flatten(Result)
bang = ExplodeTree(Data=simplify(graft(entwine_74)))  # -> Branch0, Branch1, Branch2, Branch3, Branch4, Branch5
layer2 = RemoteSender(bang.Branch1)
layer3 = RemoteSender(bang.Branch2)
layer4 = RemoteSender(bang.Branch3)
layer6 = RemoteSender(bang.Branch5)
layer1 = RemoteSender(bang.Branch0)
layer5 = RemoteSender(bang.Branch4)

values_84 = ValueListener(Elements=pulldown_33, SomeProperty=True)  # -> Values, Indices
values_85 = ValueListener(Elements=textbox_9, SomeProperty=True)  # -> Values, Indices
values_86 = ValueListener(Elements=pulldown_34, SomeProperty=True)  # -> Values, Indices
values_87 = ValueListener(Elements=textbox_10, SomeProperty=True)  # -> Values, Indices
values_88 = ValueListener(Elements=pulldown_35, SomeProperty=True)  # -> Values, Indices
values_89 = ValueListener(Elements=textbox_11, SomeProperty=True)  # -> Values, Indices
values_90 = ValueListener(Elements=pulldown_36, SomeProperty=True)  # -> Values, Indices
values_91 = ValueListener(Elements=textbox_12, SomeProperty=True)  # -> Values, Indices
values_92 = ValueListener(Elements=pulldown_37, SomeProperty=True)  # -> Values, Indices
values_93 = ValueListener(Elements=textbox_13, SomeProperty=True)  # -> Values, Indices
values_94 = ValueListener(Elements=pulldown_38, SomeProperty=True)  # -> Values, Indices
values_95 = ValueListener(Elements=textbox_14, SomeProperty=True)  # -> Values, Indices
layer1_material = RemoteSender(values_84.Values)
layer1_thickness = RemoteSender(values_85.Values)
construction_name = RemoteSender(values_82.Values)
layer2_thickness = RemoteSender(values_87.Values)
layer2_material = RemoteSender(values_86.Values)
layer3_material = RemoteSender(values_88.Values)
layer3_thickness = RemoteSender(values_89.Values)
layer4_material = RemoteSender(values_90.Values)
layer4_thickness = RemoteSender(values_91.Values)
layer5_material = RemoteSender(values_92.Values)
layer5_thickness = RemoteSender(values_93.Values)
layer6_material = RemoteSender(values_94.Values)
layer6_thickness = RemoteSender(values_95.Values)
create_construction = RemoteSender(values_83.Values)

layer1_2 = RemoteReceiver(layer1)
layer2_2 = RemoteReceiver(layer2)
layer3_2 = RemoteReceiver(layer3)
layer4_2 = RemoteReceiver(layer4)
layer6_2 = RemoteReceiver(layer6)
layer5_2 = RemoteReceiver(layer5)
hideshow_20 = HideShowElement(ElementToHideShow=entwine_67, Show=layer1_2, Collapse=True, Disable=False)
hideshow_21 = HideShowElement(ElementToHideShow=entwine_69, Show=layer2_2, Collapse=True, Disable=False)
hideshow_22 = HideShowElement(ElementToHideShow=entwine_70, Show=layer3_2, Collapse=True, Disable=False)
hideshow_23 = HideShowElement(ElementToHideShow=entwine_72, Show=layer4_2, Collapse=True, Disable=False)
hideshow_24 = HideShowElement(ElementToHideShow=entwine_71, Show=layer5_2, Collapse=True, Disable=False)
hideshow_25 = HideShowElement(ElementToHideShow=entwine_73, Show=layer6_2, Collapse=True, Disable=False)

# ----
# Create construction
layer1_material_2 = RemoteReceiver(layer1_material)
layer2_material_2 = RemoteReceiver(layer2_material)
layer3_material_2 = RemoteReceiver(layer3_material)
layer4_material_2 = RemoteReceiver(layer4_material)
layer5_material_2 = RemoteReceiver(layer5_material)
layer6_material_2 = RemoteReceiver(layer6_material)
layer1_thickness_2 = RemoteReceiver(layer1_thickness)
layer2_thickness_2 = RemoteReceiver(layer2_thickness)
layer3_thickness_2 = RemoteReceiver(layer3_thickness)
layer4_thickness_2 = RemoteReceiver(layer4_thickness)
layer5_thickness_2 = RemoteReceiver(layer5_thickness)
layer6_thickness_2 = RemoteReceiver(layer6_thickness)
construction_name_2 = RemoteReceiver(construction_name)
merge_5 = Merge(
    Data1=layer1_material_2,
    Data2=layer2_material_2,
    Data3=layer3_material_2,
    Data4=layer4_material_2,
    Data5=layer5_material_2,
    Data6=layer6_material_2)
merge_6 = Merge(
    Data1=layer1_thickness_2,
    Data2=layer2_thickness_2,
    Data3=layer3_thickness_2,
    Data4=layer4_thickness_2,
    Data5=layer5_thickness_2,
    Data6=layer6_thickness_2)
panel_74 = Panel(construction_name_2)
cluster_4 = Cluster_5(materials=merge_5, construction_name=construction_name_2, thicknesses=merge_6)
create_construction_2 = RemoteReceiver(create_construction)
gate_23 = StreamGate(Stream=cluster_4, Gate=create_construction_2)  # -> Target0, Target1
created_construction = RemoteSender(gate_23.Target1)

entwine_75 = Entwine(
    Branch00=stack_48,
    Branch01=entwine_67,
    Branch02=entwine_69,
    Branch03=entwine_70,
    Branch04=entwine_72,
    Branch05=entwine_71,
    Branch06=entwine_73,
    Branch07=button_10,
    FlattenInputs=True)  # -> flatten(Result)

# ----
# Create construction
create_construction_window_2 = RemoteReceiver(create_construction_window)
launchwin_4 = LaunchWindow(
    Show=create_construction_window_2,
    Name="Create construction",
    Width=Slider(340, range=0..1000),
    Height=Slider(540, range=0..1000),
    ChildStatus=2,
    EnableHorizScroll=False)
accent_colors_4 = ValueList({"Amber", "Blue", "Brown", "Cobalt", "Crimson", "Cyan", "Emerald", "Green", "Indigo", "Lime", "Magenta", "Mauve", "Olive", "Orange", "Pink", "Purple", "Red", "Sienna", "Steel", "Taupe", "Teal", "Violet", "Yellow"}, selected="Blue")
pt_6 = ConstructPoint(XCoordinate=Slider(352, range=0..1000), YCoordinate=Slider(210, range=0..1000), ZCoordinate=0)
winprops_4 = SetWindowProperties(
    Window=launchwin_4,
    StartingLocation=pt_6,
    Theme=0,
    AccentColor=accent_colors_4,
    ShowTitleBar=True,
    BackgroundColor=RGB(255, 255, 255),
    ScaleFactor=1)
addelems_4 = AddElements(Window=launchwin_4, Elements=flatten(entwine_75), DoVLChecking=True)  # -> AddedElements, ElementNames

# ----
# Create material
create_material_2_2 = RemoteReceiver(create_material_2)
create_material_3_2 = RemoteReceiver(create_material_3)
create_material_1_2 = RemoteReceiver(create_material_1)
create_material_5_2 = RemoteReceiver(create_material_5)
create_material_4_2 = RemoteReceiver(create_material_4)
create_material_6_2 = RemoteReceiver(create_material_6)
material_name_2 = RemoteReceiver(material_name)
create_material_1_3 = RemoteReceiver(create_material_1)
create_material_2_3 = RemoteReceiver(create_material_2)
create_material_3_3 = RemoteReceiver(create_material_3)
material_name_3 = RemoteReceiver(material_name)
opaque_10 = RemoteReceiver(opaque)
opaquemat_2 = HBOpaqueMaterial(
    name=material_name_2,
    thickness=create_material_1_2,
    conductivity=create_material_2_2,
    density=create_material_3_2,
    spec_heat=create_material_4_2,
    roughness=create_material_5_2,
    therm_absp=create_material_6_2)  # -> mat; plug-in component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
windowmat = HBWindowMaterial(name=material_name_3, u_factor=create_material_1_3, shgc=create_material_2_3, t_vis=create_material_3_3)  # -> mat; plug-in component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
bool_9 = Boolean(invert(opaque_10))
filter_12 = StreamFilter(Gate=bool_9, Stream0=opaquemat_2, Stream1=windowmat)

gate_24 = StreamGate(Stream=filter_12, Gate=create_material_7)  # -> Target0, Target1

created_material = RemoteSender(gate_24.Target1)

# ---- group: Analyse context and model
# Weather visualisation
# # Weather visualisation
# This cluster visualises weather data from a .epw file including solar radiation and temperature, as applied to a target geometry
# 
# ## Instructions
# Enter all the inputs and visualise wind, sky view and temperature,  set `Run direct sun hours study` and `Run incident radiation study` to visualise solar radiation
# 
# ## Inputs
# - `EPW file URL` - the URL for a EPW file which describes the location
# - `Target Geometry` - geometry on which to apply irradiation study
# - `Context Geometry` - geometry which shades the target geometry
# - `Run direct sun hours study` - set to True to run the direct sun hours study
# - `Run incident radiation study` - set to True to run the incident radiation study
# - `Sky mask centre point` - point at which to generate sky mask
# 
# ## Outputs
# - `Sky dome` - mesh visualising the directions where solar radiation comes from during the year at the location
# - `Sky mask - mesh visualising what portions of the sky are visible at the specified point
# - `Wind rose` - mesh visualising wind directions and velocities during the year
# - `Dry bulb temperature line chart` - mesh visualising dry bulb temperature during the year
# - `Dry bulb temperature 2D chart` - mesh visualising dry bulb temperature for each hour of the year
# - `Direct sun hours` - mesh visualising the number of direct sun hours on the target geometry
# - `Incident radiation` - mesh visualising the incident radiation [kWh/m2] on the target geometry
# 
# ## Interpretation
# To be added...
# Visualise properties
# # Visualise properties
# This cluster visualises room and face attributes of a Honeybee model
# 
# ## Instructions
# Input the Honeybee model to be visualised and select room/face attributes using the HB Room Attributes/HB Room Energy Attibrutes/HB Face Attributes/HB Face Energy Attributes dropdown components. Adjust precision of the attributes using the `Number of decimals` inputs
# 
# ## Inputs
# - `Honeybee model` - Honeybee model to be visualised
# - `Room attribute` - Honeybee Room  or Room Energy attribute to visualise
# - `Number of decimals (room)` - Precision of room attribute output
# - `Face attribute` - Honeybee Face  or Face Energy attribute to visualise
# - `Number of decimals (face)` - Precision of face attribute output
# 
# ## Outputs
# - `Visualised room attributes` - mesh representing the selected room attribute
# - `Visualised face attributes` - mesh representing the selected face attribute
# 
# ## Interpretation
# To be added...
number_slider_15 = Slider(21, range=0..100)
roomenergyattr_2 = HBRoomEnergyAttributes({"Program": "properties.energy.program_type.display_name", "Construction Set": "properties.energy.construction_set.display_name", "Is Conditioned": "properties.energy.is_conditioned", "People per Area [ppl/m2]": "properties.energy.people.people_per_area", "Area per Person [m2/ppl]": "properties.energy.people.area_per_person", "Lighting per Area [W/m2]": "properties.energy.lighting.watts_per_area"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}, selected="Program")
faceenergyattr_2 = HBFaceEnergyAttributes({"Construction": "properties.energy.construction.display_name", "Materials": "properties.energy.construction.layers", "Thickness [m]": "properties.energy.construction.thickness", "Density [kg/m2]": "properties.energy.construction.mass_area_density", "Heat Capacity [J/K-m2]": "properties.energy.construction.area_heat_capacity", "Construction R-Value [m2-K/W]": "properties.energy.construction.r_value", "Construction U-Value [W/m2-K]": "properties.energy.construction.u_value", "Construction U-Factor [W/m2-K]": "properties.energy.construction.u_factor", "Construction SHGC [Unshaded]": "properties.energy.construction.shgc", "R-Factor [m2-K/W]": "properties.energy.r_factor", "U-Factor [W/m2-K]": "properties.energy.u_factor", "SHGC [Unshaded]": "properties.energy.shgc", "Solar Transmitance [Unshaded]": "properties.energy.construction.solar_transmittance", "Visible Transmitance [Unshaded]": "properties.energy.construction.visible_transmittance", "Solar Reflectance [Outside]": "properties.energy.construction.outside_solar_reflectance", "Solar Reflectance [Inside]": "properties.energy.construction.inside_solar_reflectance", "Fraction Area Operable": "properties.energy.vent_opening.fraction_area_operable", "Fraction Height Operable": "properties.energy.vent_opening.fraction_height_operable", "Discharge Coefficient": "properties.energy.vent_opening.discharge_coefficient"}, selected="Construction SHGC [Unshaded]")
roomattr_2 = HBRoomAttributes({"Display Name": "display_name", "Simulation Name (Identifier)": "identifier", "Multiplier": "multiplier", "Floor Area Excluded": "exclude_floor_area", "Story": "story", "Volume": "volume", "Gross Floor Area": "floor_area", "Exposed Area": "exposed_area", "Exterior Wall Area": "exterior_wall_area", "Exterior Aperture Area": "exterior_aperture_area", "Average Floor Elevation": "average_floor_height"}, selected="Exterior Aperture Area")
faceattr_2 = HBFaceAttributes({"Display Name": "display_name", "Simulation Name (Identifier)": "identifier", "Boundary Condition": "boundary_condition", "Has Parent": "has_parent", "Parent": "parent", "Azimuth": "azimuth", "Altitude": "altitude", "Area": "area", "Perimeter": "perimeter", "Face Type": "type", "Aperture Is Operable": "is_operable", "Door Is Glass": "is_glass"}, selected="Face Type")
pt_7 = ConstructPoint(XCoordinate=number_slider_15, YCoordinate=Slider(15, range=0..100), ZCoordinate=0)
room_attribute_3 = RemoteReceiver(room_attribute)
face_attribute_3 = RemoteReceiver(face_attribute)
falsestart_7 = LBFalseStartToggle(False)
falsestart_8 = LBFalseStartToggle(False)
falsestart_9 = LBFalseStartToggle(False)
pt_8 = Point(pt_7)
data_11 = Data(data_5)
geo_8 = Geometry(geo_4)
geo_9 = Geometry(room_2)
data_12 = Data(panel_59)
weather_visualisation_3 = WeatherVisualisation(
    _1=data_12,
    run_weather_visualisation=falsestart_9,
    target_geometry_2=geo_9,
    target_geometry=geo_8,
    run_direct_sun_hours_study=falsestart_8,
    run_incident_radiation_study=falsestart_7,
    sky_mask_centre_point=pt_8)  # -> sky_dome, sky_mask, wind_rose, dry_bulb_temperature_line_chart, dry_bulb_temperature_2d_chart, direct_sun_hours_2, incident_radiation
data_13 = Data(weather_visualisation_3.sky_dome)
data_14 = Data(weather_visualisation_3.sky_mask)
data_15 = Data(weather_visualisation_3.wind_rose)
data_16 = Data(weather_visualisation_3.dry_bulb_temperature_line_chart)
data_17 = Data(weather_visualisation_3.dry_bulb_temperature_2d_chart)
data_18 = Data(weather_visualisation_3.direct_sun_hours_2)
data_19 = Data(weather_visualisation_3.incident_radiation)

# ----
filter_13 = StreamFilter(Gate=room_attribute_visualize_3, Stream0=room_energy_attribute_2, Stream1=room_attribute_3)
filter_14 = StreamFilter(Gate=face_attribute_visualize_3, Stream0=face_energy_attribute_2, Stream1=face_attribute_3)
item_9 = ListItem(List=data_19, Index=0, Wrap=True)
spectacles_mesh = Spectacles_Mesh(Mesh=data_19, MeshMaterial=spectacles_meshbasicmaterial)
spectacles_meshcoloredvertices = Spectacles_MeshColoredVertices(Mesh=item_9)
spectacles_scenecompiler = Spectacles_SceneCompiler(Write=Toggle(False), FilePath=path, Elements=flatten(spectacles_meshcoloredvertices))

# ---- group: Analyse context and model (continued)
visualise_properties_2 = VisualiseProperties(
    honeybee_model=data_11,
    room_attribute=filter_13,
    number_of_decimals_room=Slider(4, range=0..10),
    face_attribute=filter_14,
    number_of_decimals_face=Slider(4, range=0..10))  # -> visualised_room_attributes_2, visualised_face_attributes_2

# ----
gate_25 = StreamGate(Stream=visualise_properties_2.visualised_room_attributes_2, Gate=or)  # -> Target0, Target1
gate_26 = StreamGate(Stream=visualise_properties_2.visualised_face_attributes_2, Gate=or_2)  # -> Target0, Target1

# ---- group: Analyse context and model (continued)
data_20 = Data(gate_25.Target1)
data_21 = Data(gate_26.Target1)

# ---- group: Analyse performance
# Simple energy simulations
# # Simple energy simulations
# Streamlined energy simulations which calculate energy balance across the year, and peak loads on the design day, for the input Honeybee rooms.
# 
# ## Instructions
# Enter all inputs and set `Run Energy Balance` or `Run Peak Loads`to True to investigate energy use for the specified Honeybee rooms considering the specified Honeybee shade objects. Adjust the y axis of output graphs using the `Graph max` input.
# 
# ## Inputs
# - `EPW file URL` - the URL for a EPW file which describes the location
# - `Honeybee rooms` - the Honeybee rooms which shall be analysed
# - `Shading objects` - Honeybee shade objects which block solar radiation toward the simulated rooms
# - `Run Energy Balance` - set to True to run the energy balance simulation
# - `Run Peak Loads` - set to True to run the peak loads simulation
# - `Graph max` - max value for the y axis of output graphs
# 
# ## Outputs
# - `Annual energy balance` - mesh visualising energy balance of each month of the year broken down into energy sources/sinks
# - `Daily cooling profile` - mesh visualising the cooling need during the design day (hottest day of the year)
# - `Daily heating profile` - mesh visualising the heating need during the design day (coldest day of the year)
# - `Cooling balance (design day)` - mesh visualising the cooling sources and sinks during the design day (hottest day of the year)
# - `Heating balance (design day)` - mesh visualising the heating sources and sinks during the design day (coldest day of the year)
# 
# ## Interpretation
# To be added...
# Detailed energy simulations
# # Detailed energy simulations
# This cluster simulates energy balance over a year and outputs the total energy use intensity (EUI), divided into end uses, and detailed graphs of the energy balance, peak cooling/heating, and cooling/heating load profiles
# 
# ## Instructions
# Enter all inputs and set `Run Energy Simulation` to true to run the energy simulation
# 
# ## Inputs
# - `EPW file URL` - the URL for a EPW file which describes the location
# - `Honeybee model` - the Honeybee model for analysis
# - `Run Energy Simulation` - set to True to run the energy simulation
# 
# ## Outputs
# - `Energy use intensity [kWh/m2a]` - A number representing the total energy use of the model
# - `Energy use intensity per end use [kWh/m2a]` - A list of values with the energy uses split into different end uses
# - `End uses` - A list of text strings representing the different end uses
# - `Annual hourly energy results` - various meshes representing different energy results over the hours of the year
# - `Monthly energy balance` - A monthly breakdown of the energy balance, with energy sources in the top and energy sinks in the bottom
# - `Peak cooling` - A number representing the peak cooling load in each zone
# - `Peak heating` - A number representing the peak heating load in each zone
# - `Cooling load profile` - A mesh representing the cooling load profile during the design day
# - `Heating load profile` - A mesh representing the heating load profile during the design day
# 
# ## Interpretation
# To be added...
# Daylight (Illuminance, DA and UDI)
# # Daylight (Illuminance, DA and UDI)
# This cluster simulates illuminance for a specified hour of the year and daylight autonomy (DA) and useful daylight illuminance (UDI) for the entire year across an analysis surface.
# 
# ## Instructions
# Enter all inputs and set `Run Illuminance` or `Run Annual Daylight Simulation`to True to investigate daylight. The illuminance study covers a specified time step whereas the annual daylight simulation covers the full year. The `grid size` and `detail level` inputs can be used to improve the fidelity of the simulation at the cost of simulation time. The study can take several minutes, depending on the grid size and detail level.
# 
# ## Inputs
# - `EPW file URL` - the URL for a EPW file which describes the location
# - `Honeybee model` - the Honeybee model for analysis
# - `Grid size` - the resolution of the analysis grid in metres
# - `Detail level (0-2)` - level of detail for the daylight simulation, the higher value, the higher detail and the slower the simulation
# - `Month (illuminance)` - month of the analysis period  for the illuminance simulation (1-12)
# - `Day (illuminance)` - date of the analysis period for the illuminance simulation (1-31)
# - `Hour (illuminance)` - hour of the analysis period for the illuminance simulation (0-23)
# - `Run Illuminance` - set to True to run the illuminance analysis for the specified timestep
# - `Run Annual Daylight Simulation` - set to True to run the full year daylight simulation
# 
# ## Outputs
# - `Illuminance [Lux]` - a mesh visualising the amount of incident radiation which hits the analysis surface at the specified timestep
# - `Spatial Daylight Autonomy [-]` - the mean SDA for the entire analysis surface
# - `Daylight autonomy [%]` - a mesh visualising the value of DA across the analysis surface
# - `UDI [%]` - a mesh visualising the value of Useful Daylight Illuminance across the analysis surface
# - `UDI <50 [%]` - a mesh visualising the percentage of time that the lower treshold of illuminance is not achieved across the analysis surface
# - `UDI >3000 [%]` - a mesh visualising the percentage of time that the upper treshold of illuminance is exceeded across the analysis surface
# 
# ## Interpretation
# To be added...
# Daylight Glare Probability (DGP)
# # Daylight Glare Probability
# This cluster calculates the DGP for a specific view.
# 
# ## Instructions
# Enter all inputs and set `Run Glare analysis`to True to investigate glare potential for the set viewport and time. For a simple model this simulation takes around 50-60s.
# 
# ## Inputs
# - `EPW file URL` - the URL for a EPW file which describes the location
# - `Honeybee model` - the Honeybee model for analysis
# - `Viewport name` - the string name of a viewport in the Rhino model which shall be analysed
# - `Month` - month of the analysis period (1-12)
# - `Day` - date of the analysis period (1-31)
# - `Hour` - hour of the analysis period (0-23)
# - `Run Glare analysis` - set to True to run the analysis
# 
# ## Outputs
# - `Daylight glare probability (DGP)` - a value for the probability of glare occuring in this view at this time [%]
# - `HDR image` - a HDR image which can be visualised using LB ImageViewer to show what areas cause glare
# - `HDR false color image` - a HDR image with modified colors to more clearly see causes of glare
# 
# ## Interpretation
# To be added...
# Life cycle assessment (LCA)
# # Life Cycle Assessment (LCA)
# This cluster calculates the embodied carbon for the input Honeybee model
# 
# ## Instructions
# Enter the inputs to calculate the GWP (Global Warming Potential), i.e. the embodied carbon, for the materials in the Honeybee model
# 
# ## Inputs
# - `Honeybee model` - the Honeybee model for analysis
# 
# ## Outputs
# - `Total GWP` - total GWP for the modules A1-A5.1 [kg CO2eq]
# - `GWP by element type` - GWP of each element type for the modules A1-A5.1 [kg CO2eq]
# - `Element types` - list of element types in the model
# 
# ## Interpretation
# To be added...
panel_75 = Panel("Perspective")
falsestart_10 = LBFalseStartToggle(False)
falsestart_11 = LBFalseStartToggle(False)
falsestart_12 = LBFalseStartToggle(False)
# https://energyplus-weather.s3.amazonaws.com/africa_wmo_region_1/LBY/LBY_Tripoli.620100_IWEC/LBY_Tripoli.620100_IWEC.zip
falsestart_13 = LBFalseStartToggle(False)
falsestart_14 = LBFalseStartToggle(False)
falsestart_15 = LBFalseStartToggle(False)
data_22 = Data(filter_6)
honeybee_model = Data(filter_6)
data_23 = Data(panel_59)
data_24 = Data(filter_6)
txt = Text(panel_75)
data_25 = Data(filter_6)
data_26 = Data(panel_59)
data_27 = Data(deconstructmodel.shades)
data_28 = Data(panel_59)
honeybee_rooms = Data(deconstructmodel.rooms)
data_29 = Data(panel_59)
cluster_5 = Cluster_3(honeybee_model=data_22)  # -> total_gwp_2, gwp_by_element_type_2, element_types_2
daylight_metrics = DaylightMetrics(
    epw_file_url=data_23,
    honeybee_model=honeybee_model,
    grid_size=Slider(1, range=0..10),
    detail_level_0_2=Slider(0, range=0..2),
    month_illuminance=Slider(6, range=1..12),
    day_illuminance=Slider(21, range=1..31),
    hour_illuminance=Slider(12, range=0..23),
    run_illuminance=falsestart_2,
    run_annual_daylight_simulation=falsestart_2)  # -> illuminance_lux_2, spatial_daylight_autonomy_2, daylight_autonomy_2, udi_2, udi_50_2, udi_3000_2
detailed_energy_simulations = DetailedEnergySimulations(epw_file_url=data_26, honeybee_model=data_24, run_energy_simulation=falsestart_13)  # -> energy_use_intensity_2, energy_use_intensity_per_end_use_2, end_uses_2, annual_hourly_energy_results_2, monthly_energy_balance_2, peak_cooling_2, peak_heating_2, cooling_load_profile_2, heating_load_profile_2
glare = Glare(
    epw_file_url_2=data_28,
    epw_file_url=data_25,
    viewport_name=txt,
    month=Slider(6, range=1..12),
    day=Slider(21, range=1..31),
    hour=Slider(12, range=0..23),
    run_glare_analysis=falsestart_12)  # -> daylight_glare_probability_dgp_2, hdr_image_2, hdr_false_color_image_2
simple_energy_simulations = SimpleEnergySimulations(
    epw_file_url=data_29,
    honeybee_rooms=honeybee_rooms,
    run_energy_balance=run_simple_energy_simulations_3,
    run_peak_loads=run_simple_energy_simulations_3,
    graph_max=Slider(3000, range=0..20000))  # -> annual_energy_balance_data_2, total_load_eui_2, annual_energy_balance_2, daily_cooling_profile_2, daily_heating_profile_2, cooling_balance_design_day_2, heating_balance_design_day_2
data_30 = Data(cluster_5.total_gwp_2)
data_31 = Data(cluster_5.gwp_by_element_type_2)
data_32 = Data(cluster_5.element_types_2)
data_33 = Data(daylight_metrics.illuminance_lux_2)
data_34 = Data(daylight_metrics.spatial_daylight_autonomy_2)
data_35 = Data(daylight_metrics.daylight_autonomy_2)
data_36 = Data(daylight_metrics.udi_2)
data_37 = Data(daylight_metrics.udi_50_2)
data_38 = Data(daylight_metrics.udi_3000_2)
data_39 = Data(detailed_energy_simulations.energy_use_intensity_2)
panel_76 = Panel(data_32)
data_40 = Data(detailed_energy_simulations.energy_use_intensity_per_end_use_2)
panel_77 = Panel(data_31)
data_41 = Data(detailed_energy_simulations.end_uses_2)
data_42 = Data(detailed_energy_simulations.annual_hourly_energy_results_2)
data_43 = Data(detailed_energy_simulations.monthly_energy_balance_2)
data_44 = Data(detailed_energy_simulations.peak_cooling_2)
data_45 = Data(detailed_energy_simulations.peak_heating_2)
data_46 = Data(detailed_energy_simulations.cooling_load_profile_2)
data_47 = Data(detailed_energy_simulations.heating_load_profile_2)
num = Number(falsestart_12)
num_2 = Number(glare.daylight_glare_probability_dgp_2)
num_3 = Number(falsestart_12)
imageviewer = LBImageViewer(ImagePath_=glare.hdr_false_color_image_2, _scale_=num, DisableClickable=False, SaveImgWithCoords=False, scale=0.5)  # -> ImagePath, Values, GIF
imageviewer_2 = LBImageViewer(ImagePath_=glare.hdr_image_2, _scale_=num_3, DisableClickable=False, SaveImgWithCoords=False, scale=0.5)  # -> ImagePath, Values, GIF

# ----
xdata_3 = LBDeconstructData(data=simple_energy_simulations.annual_energy_balance_data_2)  # -> header, values; plug-in component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
data_48 = Data(simple_energy_simulations.total_load_eui_2)
total_load_eui = RemoteSender(data_48)
annual_energy_balance_data_header = RemoteSender(xdata_3.header)
annual_energy_balance_data_values = RemoteSender(xdata_3.values)

annual_energy_balance_data_header_2 = RemoteReceiver(annual_energy_balance_data_header)
annual_energy_balance_data_values_2 = RemoteReceiver(annual_energy_balance_data_values)
split = TextSplit(Text=annual_energy_balance_data_header_2, Separators=":")
item_10 = ListItem(List=split, Index="-1", Wrap=True)
fragment = TextFragment(Text=item_10, Start="1")  # -> flatten(Fragment)
bang_2 = ExplodeTree(Data=annual_energy_balance_data_values_2)  # -> Branch0, Branch1, Branch2, Branch3, Branch4, Branch5, Branch6, Branch7, Branch8
panel_78 = Panel(item_10)
panel_79 = Panel(fragment)
py3_5 = Python3Script(
    file_location=nextfile_3,
    title="Energy Intensity (kWh/m2)",
    labels=fragment,
    heating=bang_2.Branch0,
    solar=bang_2.Branch1,
    people=bang_2.Branch2,
    infiltration=bang_2.Branch3,
    mechanical_ventilation=bang_2.Branch4,
    opaque_construction=bang_2.Branch5,
    window_construction=bang_2.Branch6,
    cooling=bang_2.Branch7,
    storage=bang_2.Branch8)  # -> out, a; inputs labels: list, heating: list, solar: list, people: list, infiltration: list, mechanical_ventilation: list, opaque_construction: list, window_construction: list, cooling: list, storage: list
# ---------- py3_5: Python ----------
import matplotlib.pyplot as plt
import random as rd
import numpy as np
import matplotlib.colors as colors


fig, ax = plt.subplots()

"""
counts = [rd.randint(0, 100), rd.randint(0, 100),
          rd.randint(0, 100), rd.randint(0, 100)]
fruits = ['apple', 'blueberry', 'cherry', 'orange']
bar_labels = ['red', 'blue', '_red', 'orange']
bar_colors = ['tab:red', 'tab:blue', 'tab:red', 'tab:orange']
"""

x = ["Jan", "Feb", "Mar", "Apr", "May", "Jun",
"Jul", "Aug", "Sep", "Oct", "Nov", "Dec"]
#y = [412, 423, 445, 342, 543, 346, 435, 453, 432, 545, 435, 234]

values = [heating, solar, people, infiltration, mechanical_ventilation,
opaque_construction, window_construction, cooling, storage]
#print(values)
bar_labels = ["Heating", "Solar", "People", "Infiltration", 
"Mechanical ventilation", "Opaque conduction", "Window conduction",
"Cooling", "Storage"]
bar_colors = ['tab:orange', 'tab:red', 'tab:blue', 'tab:olive',
'tab:brown', 'tab:green', 'tab:purple', 'tab:cyan', 'tab:brown']

colorList = list(colors.CSS4_COLORS)
colors = ['firebrick', 'orangered', 'orange', 'greenyellow', 'mediumspringgreen', 
'cyan', 'blue', 'darkblue', 'slategrey']

fig, ax = plt.subplots(figsize=(14, 6))

#ax.bar(x, y, label=bar_labels, color=bar_colors)
positive = np.zeros(len(x))
negative = np.zeros(len(x))

for i in range(len(values)):
    color = colors[i]
    if sum(values[i]) >= 0:
        ax.bar(x, values[i], label=bar_labels[i], color=colorList[colorList.index(color)],
        bottom=positive, align="edge")
        positive += values[i]
    elif sum(values[i]) < 0:
        ax.bar(x, values[i], label=bar_labels[i], color=colorList[colorList.index(color)],
        bottom=negative, align="edge")
        negative += values[i]

#ax.bar(x, y, label="storage", color=bar_colors)


ax.set_ylabel(title)
ax.set_title(title)

y_max, y_min = max(positive)*1.1, min(negative)*1.1
ax.set_ylim(y_min, y_max)

plt.subplots_adjust(right=0.8)

ax.legend(title="Energy intensity", bbox_to_anchor=(1.0, 1), loc='upper left')

plt.savefig(file_location)
a = file_location

#plt.show()
# ---------- end py3_5 ----------
panel_80 = Panel(py3_5.a)
panel_81 = Panel(annual_energy_balance_data_header_2)

total_load_eui_2 = RemoteReceiver(total_load_eui)
ma_2 = MassAddition(Input=total_load_eui_2)  # -> Result, PartialResults
round = Round(Number=ma_2.Result)  # -> Nearest, Floor, Ceiling
format_2 = Format(Format=panel_72, Culture=127, Data0=round.Nearest)
settextblock_2 = SetTextBlockContents(TextBlockToModify=tb_2, NewTextBlockContents=format_2)
setimg_2 = SetImage(ImageToModify=image_2, NewImagePath=py3_5.a)

panel_82 = Panel(data_40)
panel_83 = Panel(data_39)
panel_84 = Panel(data_44)
gate_27 = StreamGate(Stream=simple_energy_simulations.daily_cooling_profile_2, Gate=daily_cooling_profile_checkbox_2)  # -> Target0, Target1
gate_28 = StreamGate(Stream=simple_energy_simulations.daily_heating_profile_2, Gate=daily_heating_profile_checkbox_2)  # -> Target0, Target1
gate_29 = StreamGate(Stream=simple_energy_simulations.cooling_balance_design_day_2, Gate=cooling_balance_checkbox_2)  # -> Target0, Target1
gate_30 = StreamGate(Stream=simple_energy_simulations.heating_balance_design_day_2, Gate=heating_balance_checkbox_2)  # -> Target0, Target1
panel_85 = Panel(data_45)
gate_31 = StreamGate(Stream=simple_energy_simulations.annual_energy_balance_2, Gate=annual_energy_balance_checkbox_2)  # -> Target0, Target1

# ---- group: Analyse performance (continued)
data_49 = Data(gate_29.Target1)
data_50 = Data(gate_30.Target1)
data_51 = Data(gate_31.Target1)
data_52 = Data(gate_27.Target1)
data_53 = Data(gate_28.Target1)

# ----
panel_86 = Panel(data_41)

total_load_eui_3 = RemoteReceiver(total_load_eui)

item_11 = ListItem(List=total_load_eui_3, Index=0, Wrap=True)

null = NullItem(Item=item_11)  # -> NullFlags, InvalidFlags, Description
bool_10 = Boolean(invert(null.NullFlags))

and = GateAnd(A=pre_run_simple_energy_simulations_2, B=bool_10)
bool_11 = Boolean(invert(and))
hideshow_26 = HideShowElement(ElementToHideShow=tb, Show=bool_11, Collapse=and, Disable=False)

# ==== cluster WeatherVisualisation
target_geometry = ClusterInput()
run_direct_sun_hours_study = ClusterInput()
_1 = ClusterInput()
run_incident_radiation_study = ClusterInput()
run_weather_visualisation = ClusterInput()
target_geometry_2 = ClusterInput()
sky_mask_centre_point = ClusterInput()
run_weather_visualisation_2 = Boolean(run_weather_visualisation)
filter = StreamFilter(Gate=run_weather_visualisation_2, Stream1=_1)
epw_file_url = Data(filter)

# ---- group: Get weather data
downloadepw = LBDownloadWeather(weather_URL=epw_file_url)  # -> epw_file, stat_file, ddy_file; plug-in component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
falsestart = LBFalseStartToggle(False)
epwtoddy = LBEPWToDDY(weather_file=downloadepw.epw_file, write=falsestart)  # -> ddy_file; plug-in component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
importloc = LBImportLocation(epw_file=downloadepw.epw_file)  # -> location; plug-in component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
importstat = LBImportSTAT(stat_file=downloadepw.stat_file)  # -> location, ashrae_zone, koppen_zone, clear_dir_norm_rad, clear_diff_horiz_rad, ann_heat_dday_996, ann_heat_dday_990, ann_cool_dday_004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; plug-in component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
constrloc = LBConstructLocation(elevation=0)  # -> location; plug-in component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
importepw = LBImportEPW(epw_file=downloadepw.epw_file)  # -> location, dry_bulb_temperature, dew_point_temperature, relative_humidity, wind_speed, wind_direction, direct_normal_rad, diffuse_horizontal_rad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; plug-in component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
importddy = LBImportDDY(ddy_file=downloadepw.ddy_file)  # -> location, design_days; plug-in component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

# ----
panel = Panel(importloc)

# ---- group: Wind rose
analysisperiod = LBAnalysisPeriod(
    start_month=Slider(1, range=1..12),
    start_day=Slider(1, range=1..31),
    start_hour=Slider(0, range=0..23),
    end_month=Slider(12, range=1..12),
    end_day=Slider(31, range=1..31),
    end_hour=Slider(23, range=0..23))  # -> period, hoys, dates; plug-in component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
windrose = LBWindRose(data=importepw.wind_speed, wind_direction=importepw.wind_direction, show_calm=Toggle(True), period=analysisperiod.period)  # -> report, mesh, compass, orient_line, freq_line, windrose_line, legend, title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; plug-in component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

# ---- group: Sun path
analysisperiod_2 = LBAnalysisPeriod(
    start_month=Slider(1, range=1..12),
    start_day=Slider(1, range=1..31),
    start_hour=Slider(0, range=0..23),
    end_month=Slider(12, range=1..12),
    end_day=Slider(31, range=1..31),
    end_hour=Slider(23, range=0..23))  # -> period, hoys, dates; plug-in component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
panel_2 = Panel("a>24")
sunpath = LBSunPath(location=importloc, hoys=analysisperiod_2.hoys, scale=1, data=importepw.dry_bulb_temperature)  # -> report, vectors, altitudes, azimuths, hoys, sun_pts, analemma, daily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; plug-in component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
msphere = MeshSphere(Base=sunpath.sun_pts, Radius=Slider(3, range=0..10), UCount=10, VCount=20)

# ---- group: Graph data
timeop = LBTimeIntervalOperation(data=importepw.dry_bulb_temperature)  # -> daily, monthly, mon_per_hr; plug-in component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
legendpar = LBLegendParameters(
    min=Slider(-15, range=-15..30),
    max=Slider(25, range=0..100),
    num_decimals=Slider(0, range=0..100),
    larger_smaller=Toggle(True),
    vert_or_horiz=Toggle(False))  # -> leg_par; plug-in component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
monthlychart = LBMonthlyChart(data=timeop.daily)  # -> report, data_mesh, data_lines, col_lines, legend, borders, labels, y_title, title, vis_set; plug-in component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
hourlyplot = LBHourlyPlot(data=importepw.dry_bulb_temperature, z_dim=Slider(0, range=0..100), reverse_y=Toggle(True), legend_par=legendpar)  # -> report, mesh, legend, borders, labels, title, vis_set; plug-in component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

# ----
run_incident_radiation_study_2 = Boolean(run_incident_radiation_study)

# ---- group: Sky matrix and incident radiation
analysisperiod_3 = LBAnalysisPeriod(
    start_month=Slider(1, range=1..12),
    start_day=Slider(1, range=1..31),
    start_hour=Slider(0, range=0..23),
    end_month=Slider(12, range=1..12),
    end_day=Slider(31, range=1..31),
    end_hour=Slider(23, range=0..23))  # -> period, hoys, dates; plug-in component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
skymatrix = LBCumulativeSkyMatrix(
    location=importepw.location,
    direct_rad=importepw.direct_normal_rad,
    diffuse_rad=importepw.diffuse_horizontal_rad,
    hoys=analysisperiod_3.hoys,
    high_density=Toggle(False))  # -> report, sky_mtx; plug-in component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
context_geometry = Geometry(target_geometry)
target_geometry_3 = Geometry(target_geometry_2)
incidentradiation = LBIncidentRadiation(
    sky_mtx=skymatrix.sky_mtx,
    geometry=flatten(target_geometry_3),
    context=flatten(context_geometry),
    grid_size=Slider(1, range=0..1),
    offset_dist=Slider(0.1, range=0..0.1),
    run=run_incident_radiation_study_2)  # -> report, points, results, total, mesh, legend, title, int_mtx; plug-in component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
skydome = LBSkyDome(sky_mtx=skymatrix.sky_mtx)  # -> report, mesh, compass, legend, title, patch_vecs, patch_values, mesh_values, vis_set; plug-in component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

# ----
merge = Merge(
    Data1=windrose.mesh,
    Data2=windrose.compass,
    Data3=windrose.orient_line,
    Data4=windrose.freq_line,
    Data5=windrose.windrose_line,
    Data6=windrose.legend,
    Data7=windrose.title)
run_direct_sun_hours_study_2 = Boolean(run_direct_sun_hours_study)

# ---- group: Direct sun hours
toggle = BooleanToggle(True)
target_geometry_4 = Geometry(target_geometry_2)
context_geometry_2 = Geometry(target_geometry)
directsunhours = LBDirectSunHours(
    vectors=flatten(sunpath.vectors),
    geometry=flatten(target_geometry_4),
    context=flatten(context_geometry_2),
    grid_size=Slider(1, range=0..10),
    offset_dist=Slider(0.1, range=0..1),
    run=run_direct_sun_hours_study_2)  # -> report, points, results, mesh, legend, title, int_mtx; plug-in component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

# ---- group: Sky mask
sky_mask_centre_point_2 = Point(sky_mask_centre_point)
symask = LBSkyMask(
    context=context_geometry_2,
    density=Slider(3, range=0..10),
    center=sky_mask_centre_point_2,
    scale=Slider(0.1, range=0..1))  # -> report, context_mask, orient_mask, strategy_mask, sky_mask, context_view, orient_view, strategy_view, sky_view; plug-in component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

# ----
merge_2 = Merge(Data1=skydome.mesh, Data2=skydome.compass, Data3=skydome.legend, Data4=skydome.title)  # -> flatten(SkyDome)
merge_3 = Merge(
    Data1=monthlychart.data_mesh,
    Data2=monthlychart.legend,
    Data3=monthlychart.borders,
    Data4=monthlychart.labels,
    Data5=monthlychart.y_title,
    Data6=monthlychart.title)  # -> flatten(DryBulbTemperatureLineChart)
merge_4 = Merge(Data1=incidentradiation.mesh, Data2=incidentradiation.legend, Data3=incidentradiation.title)  # -> flatten(IncidentRadiation)
merge_5 = Merge(
    Data1=hourlyplot.mesh,
    Data2=hourlyplot.legend,
    Data3=hourlyplot.borders,
    Data4=hourlyplot.labels,
    Data5=hourlyplot.title)
sky_dome = ClusterOutput(merge_2)
wind_rose = ClusterOutput(merge)
dry_bulb_temperature_line_chart = ClusterOutput(merge_3)
dry_bulb_temperature_2d_chart = ClusterOutput(merge_5)
direct_sun_hours = Merge(Data1=directsunhours.mesh, Data2=directsunhours.legend, Data3=directsunhours.title)  # -> flatten(DirectSunHours)
direct_sun_hours_2 = ClusterOutput(direct_sun_hours)
incident_radiation = ClusterOutput(merge_4)
merge_6 = Merge(Data1=symask.context_mask, Data2=symask.sky_mask)
sky_mask = ClusterOutput(merge_6)

# ==== cluster Glare
run_glare_analysis = ClusterInput()
epw_file_url = ClusterInput()
viewport_name = ClusterInput()
epw_file_url_2 = ClusterInput()
month = ClusterInput()
day = ClusterInput()
hour = ClusterInput()
epw_file_url_3 = Data(epw_file_url)
run_glare_analysis_2 = Boolean(run_glare_analysis)
day_2 = Number(day)
hour_2 = Number(hour)
month_2 = Number(month)

# ---- group: Glare analysis
epw_file_url_4 = Data(epw_file_url_2)
viewport_name_2 = Data(viewport_name)
pt = ConstructPoint(XCoordinate=Slider(6, range=0..10), YCoordinate=Slider(5, range=0..10), ZCoordinate=Slider(2, range=0..10))
viewport = HBViewFromViewport(name=viewport_name_2, viewport=viewport_name_2, view_type=Slider(4, range=0..5))  # -> view; plug-in component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
pt_2 = ConstructPoint(XCoordinate=Slider(4, range=0..10), YCoordinate=Slider(4, range=0..10), ZCoordinate=Slider(1.6, range=0..10))
vec2pt = Vector2Pt(PointA=pt_2, PointB=pt, Unitize=False)  # -> Vector, Length
assigngridsviews = HBAssignGridsAndViews(model=epw_file_url_3, views=flatten(viewport))  # -> model; plug-in component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
view = HBView(position=pt_2, direction=vec2pt.Vector, view_type=Slider(4, range=0..5))  # -> view; plug-in component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
hoy = LBCalculateHOY(month=month_2, day=day_2, hour=hour_2)  # -> flatten(hoy), flatten(doy), flatten(date); plug-in component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

# ----
downloadepw = LBDownloadWeather(weather_URL=epw_file_url_4)  # -> epw_file, stat_file, ddy_file; plug-in component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

# ---- group: Glare analysis (continued)
importloc = LBImportLocation(epw_file=downloadepw.epw_file)  # -> location; plug-in component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
ciesky = HBCIEStandardSky(location=importloc, month=month_2, day=day_2, hour=hour_2, type=0)  # -> sky; plug-in component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
pitview = HBPointInTimeViewBased(model=assigngridsviews, sky=ciesky, run=run_glare_analysis_2)  # -> report, results; plug-in component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
glare = HBGlarePostprocess(hdr=pitview.results)  # -> DGP, category, glare_indices, check_hdr; plug-in component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
merge = Merge(Data1=hoy.date, Data2=glare.category, Data3=glare.DGP)
daylight_glare_probability_dgp = Data(glare.DGP)
join = TextJoin(Text=merge)
falsecolor = HBFalseColor(hdr=pitview.results, max=Slider(2300, range=0..10000), contour_lines=Toggle(True))  # -> hdr; plug-in component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
adjusthdr = HBAdjustHDR(hdr=pitview.results, adj_expos=Toggle(True), label=join)  # -> hdr; plug-in component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
hdr_image = Data(adjusthdr)
hdr_false_color_image = Data(falsecolor)

# ----
daylight_glare_probability_dgp_2 = ClusterOutput(daylight_glare_probability_dgp)
hdr_image_2 = ClusterOutput(hdr_image)
hdr_false_color_image_2 = ClusterOutput(hdr_false_color_image)

# ==== cluster DaylightMetrics
epw_file_url = ClusterInput()
epw_file_url_2 = Data(epw_file_url)
run_annual_daylight_simulation = ClusterInput()
run_illuminance = ClusterInput()
month_illuminance = ClusterInput()
day_illuminance = ClusterInput()
honeybee_model = ClusterInput()
hour_illuminance = ClusterInput()
detail_level_0_2 = ClusterInput()
grid_size = ClusterInput()
downloadepw = LBDownloadWeather(weather_URL=epw_file_url_2)  # -> epw_file, stat_file, ddy_file; plug-in component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
deconstructmodel = HBDeconstructModel(model=honeybee_model)  # -> rooms, faces, apertures, doors, shades; plug-in component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
decnstrobj = HBDeconstructObject(hb_obj=deconstructmodel.rooms)  # -> faces, apertures, doors, shades; plug-in component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
# Create analysis grid
vizquick = HBVisualizeQuick(hb_objs=decnstrobj.faces)  # -> geo; plug-in component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
detail_level_0_2_2 = Number(detail_level_0_2)
area = Area(Geometry=vizquick)  # -> Area, Centroid
pdecon = Deconstruct(Point=area.Centroid)  # -> XComponent, YComponent, ZComponent
sort = SortList(Keys=pdecon.ZComponent, ValuesA=vizquick)  # -> Keys, ValuesA
honeybee_model_2 = Data(honeybee_model)
grid_size_2 = Number(grid_size)

# ---- group: Set up sensor grids
srf = Surface(sort.ValuesA)
item = ListItem(List=srf, Index=Slider(0, range=0..5), Wrap=True)
flip = Flip(Surface=item)  # -> Surface, Result
# Alternatively create grid from surface
genpts = LBGeneratePointGrid(geometry=flip.Surface, grid_size=Slider(1, range=0..5), offset_dist=Slider(0.7, range=0..5))  # -> points, vectors, face_areas, mesh; plug-in component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
gridrooms = HBSensorGridFromRooms(rooms=honeybee_model_2, grid_size=grid_size_2, dist_floor=Slider(0.7, range=0..5))  # -> grid, points, mesh; plug-in component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
sensorgrid = HBSensorGrid(positions=genpts.points, directions=genpts.vectors, mesh=genpts.mesh)  # -> grid; plug-in component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
assigngridsviews = HBAssignGridsAndViews(model=honeybee_model_2, grids=flatten(gridrooms.grid))  # -> model; plug-in component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

# ----
grid_mesh = Data(gridrooms.mesh)
honeybee_model_3 = Data(assigngridsviews)
run_annual_daylight_simulation_2 = Boolean(run_annual_daylight_simulation)
detail_level_0_2_3 = Number(detail_level_0_2)
honeybee_model_4 = Data(honeybee_model_3)
run_illuminance_2 = Boolean(run_illuminance)

# ---- group: Simulate illuminance
importloc = LBImportLocation(epw_file=downloadepw.epw_file)  # -> location; plug-in component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
day_illuminance_2 = Number(day_illuminance)
hour_illuminance_2 = Number(hour_illuminance)
month_illuminance_2 = Number(month_illuminance)
radpar = HBRadianceParameter(recipe_type=Slider(0, range=0..2), detail_level=detail_level_0_2_3)  # -> rad_par; plug-in component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
ciesky = HBCIEStandardSky(location=importloc, month=month_illuminance_2, day=day_illuminance_2, hour=hour_illuminance_2, type=0)  # -> sky; plug-in component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
mjoin = MeshJoin(Meshes=grid_mesh)
legendpar = LBLegendParameters(max=Slider(2000, range=0..10000))  # -> leg_par; plug-in component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
pitgrid = HBPointInTimeGridBased(model=honeybee_model_3, sky=ciesky, radiance_par=radpar, run=run_illuminance_2)  # -> report, flatten(results); plug-in component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
heatmap = LBSpatialHeatmap(values=pitgrid.results, mesh=mjoin, legend_par=legendpar, legend_title="Lux", global_title="Illuminance")  # -> mesh, legend, title, colors, legend_par, vis_set; plug-in component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

# ----
cluster = Cluster()
merge = Merge(Data1=heatmap.mesh, Data2=heatmap.legend, Data3=heatmap.title)  # -> flatten(Result)
illuminance_lux = Data(merge)
X = UnitX(Factor=Slider(0, range=0..400))
illuminance_lux_2 = ClusterOutput(illuminance_lux)

# ---- group: Spatial climate based daylight
panel = Panel("-t 50 -lt 200 -ut 2000")
radpar_2 = HBRadianceParameter(recipe_type=Slider(2, range=0..2), detail_level=detail_level_0_2_2, additional_par="-ab 4")  # -> rad_par; plug-in component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
wea = HBWeaFromEPW(epw_file=downloadepw.epw_file)  # -> wea; plug-in component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
analysis_mesh = Mesh(grid_mesh)
annualdaylight = HBAnnualDaylight(
    model=honeybee_model_4,
    wea=wea,
    schedule="Generic Office Occupancy",
    radiance_par=radpar_2,
    run=run_annual_daylight_simulation_2)  # -> report, results, DA, cDA, UDI, UDI_low, UDI_up; plug-in component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
panel_2 = Panel(radpar_2)
mjoin_2 = MeshJoin(Meshes=analysis_mesh)
cluster_2 = Cluster()
cluster_3 = Cluster()
cluster_4 = Cluster()
heatmap_2 = LBSpatialHeatmap(values=flatten(annualdaylight.UDI_up), mesh=mjoin_2, legend_par=cluster_2, legend_title="UDI >3000 [%]")  # -> mesh, legend, title, colors, legend_par, vis_set; plug-in component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
heatmap_3 = LBSpatialHeatmap(values=flatten(annualdaylight.UDI_low), mesh=mjoin_2, legend_par=cluster_3, legend_title="UDI <50 [%]")  # -> mesh, legend, title, colors, legend_par, vis_set; plug-in component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
heatmap_4 = LBSpatialHeatmap(values=flatten(annualdaylight.UDI), mesh=mjoin_2, legend_par=cluster_4, legend_title="UDI [%]")  # -> mesh, legend, title, colors, legend_par, vis_set; plug-in component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
sda = HBSpatialDaylightAutonomy(DA=flatten(annualdaylight.DA), mesh=mjoin_2)  # -> report, sDA, pass_fail; plug-in component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
heatmap_5 = LBSpatialHeatmap(values=flatten(annualdaylight.DA), mesh=mjoin_2, legend_par=cluster, legend_title="Daylight autonomy [%]")  # -> mesh, legend, title, colors, legend_par, vis_set; plug-in component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
X_2 = UnitX(Factor=Slider(150, range=0..400))
X_3 = UnitX(Factor=Slider(100, range=0..400))
X_4 = UnitX(Factor=Slider(50, range=0..400))
panel_3 = Panel(sda.sDA)

# ---- group: Extract hourly data from annual results
facen = FaceNormals(Mesh=mjoin_2)  # -> Centers, Normals
pt = Point(facen.Centers)
flatten = FlattenTree(Tree=pt, Path="{0}")
item_2 = ListItem(List=flatten, Index=Slider(581, range=0..1000), Wrap=True)
number_slider = Slider(0.1, range=0..0.1)
annualtodata = HBAnnualResultsToData(results=annualdaylight.results, sel_pts=flatten(item_2), all_pts=pt)  # -> report, data; plug-in component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
legendpar_2 = LBLegendParameters(max=Slider(3000, range=0..3000))  # -> leg_par; plug-in component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
pt_2 = Point(Point(0, 35, 0))
multiplication = Multiplication(A=number_slider, B=4)
hourlyplot = LBHourlyPlot(data=annualtodata.data, base_pt=pt_2, x_dim=number_slider, y_dim=multiplication, legend_par=legendpar_2)  # -> report, mesh, legend, borders, labels, title, vis_set; plug-in component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
sph = Sphere(Base=item_2, Radius=Slider(1.2, range=0..5))
merge_2 = Merge(Data1=sph, Data2=hourlyplot.mesh, Data3=hourlyplot.legend, Data4=hourlyplot.labels)  # -> flatten(Result)

# ----
udi_50 = Data(flatten([heatmap_3.mesh, heatmap_3.legend, heatmap_3.title]))
udi_3000 = Data(flatten([heatmap_2.mesh, heatmap_2.legend, heatmap_2.title]))
udi = Data(flatten([heatmap_4.mesh, heatmap_4.legend, heatmap_4.title]))
daylight_autonomy = Data(flatten([heatmap_5.mesh, heatmap_5.legend, heatmap_5.title]))
move = Move(Geometry=daylight_autonomy, Motion=X)  # -> Geometry, Transform

# ---- group: Spatial climate based daylight (continued)
move_2 = Move(Geometry=udi_3000, Motion=X_2)  # -> Geometry, Transform
move_3 = Move(Geometry=udi_50, Motion=X_3)  # -> Geometry, Transform
move_4 = Move(Geometry=udi, Motion=X_4)  # -> Geometry, Transform
merge_3 = Merge(Data1=move.Geometry, Data2=move_4.Geometry, Data3=move_3.Geometry, Data4=move_2.Geometry)

# ----
spatial_daylight_autonomy = Data(sda.sDA)
hourly_results_in_one_point = Data(merge_2)
udi_3000_2 = ClusterOutput(udi_3000)
daylight_autonomy_2 = ClusterOutput(daylight_autonomy)
udi_2 = ClusterOutput(udi)
spatial_daylight_autonomy_2 = ClusterOutput(spatial_daylight_autonomy)
udi_50_2 = ClusterOutput(udi_50)
data = Data(merge_3)

# ==== cluster SimpleEnergySimulations
run_energy_balance = ClusterInput()
run_peak_loads = ClusterInput()
honeybee_rooms = ClusterInput()
shading_geometry = ClusterInput()
graph_max = ClusterInput()
epw_file_url = ClusterInput()
epw_file_url_2 = Data(epw_file_url)
graph_max_2 = Number(graph_max)
downloadepw = LBDownloadWeather(weather_URL=epw_file_url_2)  # -> epw_file, stat_file, ddy_file; plug-in component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
run_peak_loads_2 = Boolean(run_peak_loads)

# ---- group: Simple energy balance
data = Data(shading_geometry)
data_2 = Data(honeybee_rooms)
run_energy_balance_2 = Boolean(run_energy_balance)
annualloads = HBAnnualLoads(
    rooms=flatten(data_2),
    shades=data,
    epw_file=downloadepw.epw_file,
    run_bal=run_energy_balance_2,
    run=run_energy_balance_2)  # -> report, total_load, cooling, heating, lighting, equip, process, hot_water, balance; plug-in component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
panel = Panel(annualloads.total_load)
number_slider = Slider(50, range=0..100)
colrange = LBColorRange(index=Slider(19, range=0..100))  # -> colors; plug-in component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
neg = Negative(Value=number_slider)
legendpar = LBLegendParameters(min=neg, max=number_slider, colors=colrange)  # -> leg_par; plug-in component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
monthlychart = LBMonthlyChart(data=annualloads.balance, stack=Toggle(True), legend_par=legendpar)  # -> report, data_mesh, data_lines, col_lines, legend, borders, labels, y_title, title, vis_set; plug-in component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

# ----
colrange_2 = LBColorRange(index=Slider(0, range=0..26))  # -> colors; plug-in component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
colrange_3 = LBColorRange(index=Slider(26, range=0..26))  # -> colors; plug-in component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
honeybee_rooms_2 = Data(honeybee_rooms)
shading_geometry_2 = Data(shading_geometry)
total_load_eui = Data(annualloads.total_load)
total_load_eui_2 = ClusterOutput(total_load_eui)
panel_2 = Panel(annualloads.balance)
xdata = LBDeconstructData(data=annualloads.balance)  # -> header, values; plug-in component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
panel_3 = Panel(xdata.values)
annual_energy_balance_data = Data(annualloads.balance)
annual_energy_balance = Data(flatten([monthlychart.data_mesh, monthlychart.data_lines, monthlychart.col_lines, monthlychart.legend, monthlychart.borders, monthlychart.labels, monthlychart.y_title, monthlychart.title]))
annual_energy_balance_data_2 = ClusterOutput(annual_energy_balance_data)
annual_energy_balance_2 = ClusterOutput(annual_energy_balance)
panel_4 = Panel(annual_energy_balance)

# ---- group: Simle peak loads
neg_2 = Negative(Value=graph_max_2)
data_3 = Data(downloadepw.ddy_file)
legendpar_2 = LBLegendParameters(min=neg_2, max=graph_max_2)  # -> leg_par; plug-in component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
peakloads = HBPeakLoads(rooms=honeybee_rooms_2, shades=shading_geometry_2, ddy_file=data_3, run_bal=run_peak_loads_2, run=run_peak_loads_2)  # -> report, peak_cool, peak_heat, cooling, heating, cool_bal, heat_bal; plug-in component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
number_slider_2 = Slider(40, range=0..100)
toggle = BooleanToggle(True)
toggle_2 = BooleanToggle(True)
pt = Point(Point(0, 50, 0))
pt_2 = Point(Point(0, 50, 0))
toggle_3 = BooleanToggle(True)
toggle_4 = BooleanToggle(True)
monthlychart_2 = LBMonthlyChart(data=peakloads.heat_bal, x_dim=Slider(40, range=0..100), stack=toggle_2, time_marks=toggle_2, legend_par=legendpar_2)  # -> report, data_mesh, data_lines, col_lines, legend, borders, labels, y_title, title, vis_set; plug-in component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
monthlychart_3 = LBMonthlyChart(
    data=peakloads.cooling,
    base_pt=pt_2,
    x_dim=Slider(40, range=0..100),
    stack=toggle_3,
    time_marks=toggle_3,
    legend_par=legendpar_2)  # -> report, data_mesh, data_lines, col_lines, legend, borders, labels, y_title, title, vis_set; plug-in component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
daily_cooling_profile = Data(flatten([monthlychart_3.data_mesh, monthlychart_3.data_lines, monthlychart_3.col_lines, monthlychart_3.legend, monthlychart_3.borders, monthlychart_3.labels, monthlychart_3.y_title, monthlychart_3.title]))
heating_balance_design_day = Data(flatten([monthlychart_2.data_mesh, monthlychart_2.data_lines, monthlychart_2.col_lines, monthlychart_2.legend, monthlychart_2.borders, monthlychart_2.labels, monthlychart_2.y_title, monthlychart_2.title]))

# ----
cluster = Cluster_2(min=neg_2, max=graph_max_2, colors=colrange_2)
cluster_2 = Cluster_2(min=neg_2, max=graph_max_2, colors=colrange_3)
panel_5 = Panel(peakloads.cool_bal)

# ---- group: Simle peak loads (continued)
monthlychart_4 = LBMonthlyChart(
    data=peakloads.heating,
    base_pt=pt,
    x_dim=Slider(40, range=0..100),
    stack=toggle,
    time_marks=toggle,
    legend_par=cluster_2)  # -> report, data_mesh, data_lines, col_lines, legend, borders, labels, y_title, title, vis_set; plug-in component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
monthlychart_5 = LBMonthlyChart(data=peakloads.cool_bal, x_dim=Slider(1000, range=0..1000), stack=toggle_4, time_marks=toggle_4, legend_par=cluster)  # -> report, data_mesh, data_lines, col_lines, legend, borders, labels, y_title, title, vis_set; plug-in component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
daily_heating_profile = Data(flatten([monthlychart_4.data_mesh, monthlychart_4.data_lines, monthlychart_4.col_lines, monthlychart_4.legend, monthlychart_4.borders, monthlychart_4.labels, monthlychart_4.y_title, monthlychart_4.title]))
cooling_balance_design_day = Data(flatten([monthlychart_5.data_mesh, monthlychart_5.data_lines, monthlychart_5.col_lines, monthlychart_5.legend, monthlychart_5.borders, monthlychart_5.y_title, monthlychart_5.labels, monthlychart_5.title]))

# ----
data_4 = Data(monthlychart_2.legend)
data_5 = Data(monthlychart_5.data_mesh)
cooling_balance_design_day_2 = ClusterOutput(cooling_balance_design_day)
heating_balance_design_day_2 = ClusterOutput(heating_balance_design_day)
daily_heating_profile_2 = ClusterOutput(daily_heating_profile)
daily_cooling_profile_2 = ClusterOutput(daily_cooling_profile)
item = ListItem(List=monthlychart_5.data_mesh, Index=Slider(2, range=0..4), Wrap=True)
data_6 = Data(item)

# ==== cluster DetailedEnergySimulations

# ---- group: Request specific outputs
toggle = BooleanToggle(True)
simoutput = HBSimulationOutput(zone_energy_use=toggle, gains_and_losses=toggle, comfort_metrics=toggle, surface_energy_flow=toggle)  # -> report, sim_output; plug-in component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
simpar = HBSimulationParameter(output=simoutput.sim_output, timestep=6)  # -> sim_par; plug-in component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

# ----
epw_file_url = ClusterInput()
honeybee_model = ClusterInput()
run_energy_simulation = ClusterInput()
honeybee_model_2 = Data(honeybee_model)
epw_file_url_2 = Data(epw_file_url)
downloadepw = LBDownloadWeather(weather_URL=epw_file_url_2)  # -> epw_file, stat_file, ddy_file; plug-in component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

# ---- group: Simulate
honeybee_model_3 = Data(honeybee_model_2)
run_energy_simulation_2 = Boolean(run_energy_simulation)
modeltoosm = HBModelToOSM(
    model=honeybee_model_3,
    epw_file=downloadepw.epw_file,
    sim_par=simpar,
    write=run_energy_simulation_2,
    run=run_energy_simulation_2)  # -> report, jsons, osw, osm, idf, sql, zsz, rdd, html; plug-in component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
eui = HBEndUseIntensity(sql=modeltoosm.sql)  # -> eui, eui_end_use, end_uses, gross_floor; plug-in component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
panel = Panel(eui.eui)
panel_2 = Panel(eui.end_uses)
panel_3 = Panel(eui.eui_end_use)

# ---- group: Peak loads
readhvac = HBReadHVACSizing(sql=modeltoosm.sql)  # -> zone_names, zone_peak_cool, zone_peak_heat, comp_types, comp_properties, comp_values; plug-in component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
readzsz = HBReadZoneSizing(zsz=modeltoosm.zsz)  # -> cooling_load, heating_load; plug-in component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
toggle_2 = BooleanToggle(True)
toggle_3 = BooleanToggle(True)
panel_4 = Panel([readhvac.zone_peak_heat, readhvac.zone_peak_cool])
monthlychart = LBMonthlyChart(data=readzsz.heating_load, x_dim=Slider(40, range=0..100), stack=toggle_2, time_marks=toggle_2)  # -> report, data_mesh, data_lines, col_lines, legend, borders, labels, y_title, title, vis_set; plug-in component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
monthlychart_2 = LBMonthlyChart(data=readzsz.cooling_load, x_dim=Slider(40, range=0..100), stack=toggle_3, time_marks=toggle_3)  # -> report, data_mesh, data_lines, col_lines, legend, borders, labels, y_title, title, vis_set; plug-in component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
heating_load_profile = Data(flatten([monthlychart.data_mesh, monthlychart.data_lines, monthlychart.col_lines, monthlychart.legend, monthlychart.borders, monthlychart.labels, monthlychart.y_title, monthlychart.title]))
cooling_load_profile = Data(flatten([monthlychart_2.data_mesh, monthlychart_2.data_lines, monthlychart_2.col_lines, monthlychart_2.legend, monthlychart_2.borders, monthlychart_2.labels, monthlychart_2.y_title, monthlychart_2.title]))
peak_heating = Data(readhvac.zone_peak_heat)

# ---- group: Load previous model
falsestart = LBFalseStartToggle(False)
item = ListItem(List=modeltoosm.jsons, Index=0, Wrap=True)
loadobjects = HBLoadObjects(hb_file=item, load=falsestart)  # -> report, hb_objs; plug-in component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

# ---- group: extract and visualise data
roomenergyresult = HBReadRoomEnergyResult(sql=modeltoosm.sql)  # -> cooling, heating, lighting, electric_equip, gas_equip, process, hot_water, fan_electric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; plug-in component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
merge = Merge(
    Data1=roomenergyresult.heating,
    Data2=roomenergyresult.cooling,
    Data3=roomenergyresult.lighting,
    Data4=roomenergyresult.electric_equip,
    Data5=roomenergyresult.hot_water,
    Data6=roomenergyresult.people_gain,
    Data7=roomenergyresult.solar_gain)
hourlyplot = LBHourlyPlot(data=merge)  # -> report, mesh, legend, borders, labels, title, vis_set; plug-in component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
xdata = LBDeconstructData(data=roomenergyresult.cooling)  # -> header, values; plug-in component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

# ----
energy_use_intensity = Data(eui.eui)
energy_use_intensity_per_end_use = Data(eui.eui_end_use)
end_uses = Data(eui.end_uses)
peak_cooling = Data(readhvac.zone_peak_cool)
data = Data(honeybee_model_2)
number_slider = Slider(50, range=0..100)

# ---- group: Energy balance
faceresult = HBReadFaceResult(sql=modeltoosm.sql)  # -> face_indoor_temp, face_outdoor_temp, face_energy_flow; plug-in component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
loadbalance = HBThermalLoadBalance(
    rooms_model=flatten(data),
    cooling=roomenergyresult.cooling,
    heating=roomenergyresult.heating,
    lighting=roomenergyresult.lighting,
    electric_equip=roomenergyresult.electric_equip,
    hot_water=roomenergyresult.hot_water,
    people_gain=roomenergyresult.people_gain,
    solar_gain=roomenergyresult.solar_gain,
    infiltration_load=roomenergyresult.infiltration_load,
    mech_vent_load=roomenergyresult.mech_vent_load,
    face_energy_flow=faceresult.face_energy_flow)  # -> report, balance, balance_stor, norm_bal, norm_bal_stor; plug-in component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
timeop = LBTimeIntervalOperation(data=loadbalance.norm_bal_stor)  # -> daily, monthly, mon_per_hr; plug-in component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
colrange = LBColorRange(index=Slider(19, range=0..100))  # -> colors; plug-in component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
neg = Negative(Value=number_slider)
legendpar = LBLegendParameters(min=neg, max=number_slider, colors=colrange)  # -> leg_par; plug-in component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
monthlychart_3 = LBMonthlyChart(data=timeop.monthly, stack=Toggle(True), legend_par=legendpar)  # -> report, data_mesh, data_lines, col_lines, legend, borders, labels, y_title, title, vis_set; plug-in component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

# ----
monthly_energy_balance = Data(flatten([monthlychart_3.data_mesh, monthlychart_3.data_lines, monthlychart_3.col_lines, monthlychart_3.legend, monthlychart_3.borders, monthlychart_3.labels, monthlychart_3.y_title, monthlychart_3.title]))
annual_hourly_energy_results = Data(flatten([hourlyplot.mesh, hourlyplot.legend, hourlyplot.borders, hourlyplot.labels, hourlyplot.title]))
energy_use_intensity_2 = ClusterOutput(energy_use_intensity)
energy_use_intensity_per_end_use_2 = ClusterOutput(energy_use_intensity_per_end_use)
end_uses_2 = ClusterOutput(end_uses)
annual_hourly_energy_results_2 = ClusterOutput(annual_hourly_energy_results)
monthly_energy_balance_2 = ClusterOutput(monthly_energy_balance)
peak_heating_2 = ClusterOutput(peak_heating)
heating_load_profile_2 = ClusterOutput(heating_load_profile)
cooling_load_profile_2 = ClusterOutput(cooling_load_profile)
peak_cooling_2 = ClusterOutput(peak_cooling)

# ==== cluster CreateHoneybeeModel
subdivide_generated_windows = ClusterInput()
horizontal_separation = ClusterInput()
window_to_wall_ratio = ClusterInput()
vertical_separation = ClusterInput()
window_height = ClusterInput()
wall_thickness = ClusterInput()
roof_thickness = ClusterInput()
construction_set = ClusterInput()
sill_height = ClusterInput()
context_geometry = ClusterInput()
adjacent_geometry = ClusterInput()
room_geometry = ClusterInput()
louver_depth = ClusterInput()
program = ClusterInput()
model_name = ClusterInput()
number_of_louvers = ClusterInput()
distance_between_louvers = ClusterInput()
louver_angle = ClusterInput()
vertical_horizontal_louvers = ClusterInput()
skylights = ClusterInput()
windows = ClusterInput()
vertical_separation_2 = Number(vertical_separation)
horizontal_separation_2 = Number(horizontal_separation)
sill_height_2 = Number(sill_height)
window_height_2 = Number(window_height)
window_to_wall_ratio_2 = Number(window_to_wall_ratio)
subdivide_generated_windows_2 = Boolean(subdivide_generated_windows)
room_geometry_2 = Geometry(room_geometry)
adjacent_geometry_2 = Geometry(adjacent_geometry)
program_2 = Data(program)
skylights_2 = Geometry(skylights)
model_name_2 = Text(model_name)
windows_2 = Geometry(windows)
wall_thickness_2 = Number(wall_thickness)
roof_thickness_2 = Number(roof_thickness)
context_geometry_2 = Geometry(context_geometry)
intsolid = HBIntersectSolids(solids=room_geometry_2, run=Toggle(True))  # -> int_solids; plug-in component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
construction_set_2 = Data(construction_set)
program_3 = Data(program)
aperture = HBAperture(geo=skylights_2)  # -> report, apertures; plug-in component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
vertical_horizontal_louvers_2 = Boolean(vertical_horizontal_louvers)
louver_depth_2 = Number(louver_depth)
number_of_louvers_2 = Number(number_of_louvers)
louver_angle_2 = Number(louver_angle)
distance_between_louvers_2 = Number(distance_between_louvers)
bordershades = HBExtrudedBorderShades(hb_objs=flatten(aperture.apertures), depth=roof_thickness_2)  # -> report, hb_objs; plug-in component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

# ---- group: add shades and louvers
shade = HBShade(geo=context_geometry_2)  # -> report, shades; plug-in component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
roomsolid = HBRoomFromSolid(geo=flatten(intsolid), constr_set=construction_set_2, program=program_3, conditioned=True)  # -> report, rooms; plug-in component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
aperture_2 = HBAperture(geo=windows_2)  # -> report, apertures; plug-in component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
solveadj = HBSolveAdjacency(rooms=flatten(roomsolid.rooms), run=Toggle(True))  # -> report, adj_rooms; plug-in component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
panel = Panel(model_name_2)

# ----
python = GhPythonScript(list=shade.shades)  # -> out, list_checked; inputs list: list
# ---------- python: Python ----------
"""Outputs an empty list if all items in input list are null.
    Inputs:
        list: list to be checked for null
    Output:
        list_checked: outputs list if any items are not null, otherwise outputs an empty list"""

list_checked = [] if all(v is None for v in list) else list
# ---------- end python ----------
vizquick = HBVisualizeQuick(hb_objs=flatten(python.list_checked))  # -> geo; plug-in component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
guidesurface = HBPropertiesByGuideSurface(rooms=solveadj.adj_rooms, guide=adjacent_geometry_2, bc="Adiabatic")  # -> rooms; plug-in component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
aperturesbyratio = HBAperturesByRatio(
    hb_objs=flatten(guidesurface),
    ratio=window_to_wall_ratio_2,
    subdivide=subdivide_generated_windows_2,
    win_height=window_height_2,
    sill_height=sill_height_2,
    horiz_separ=horizontal_separation_2,
    vert_separ=vertical_separation_2)  # -> report, hb_objs; plug-in component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
decnstrobj = HBDeconstructObject(hb_obj=aperturesbyratio.hb_objs)  # -> faces, flatten(apertures), doors, shades; plug-in component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

# ---- group: If no window geometries are supplied, instead generate using WWR
null = NullItem(Item=aperture_2.apertures)  # -> NullFlags, InvalidFlags, Description
item = ListItem(List=null.NullFlags, Index=0, Wrap=True)
filter = StreamFilter(Gate=item, Stream0=aperture_2.apertures, Stream1=decnstrobj.apertures)

# ----
viznorm = HBVisualizeNormals(hb_objs=filter)  # -> points, vectors; plug-in component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
vdis = VectorDisplay(Anchor=viznorm.points, Vector=viznorm.vectors)

# ---- group: add shades and louvers (continued)
bordershades_2 = HBExtrudedBorderShades(hb_objs=flatten(filter), depth=wall_thickness_2)  # -> report, hb_objs; plug-in component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

# ----
louvershades = HBLouverShades(
    hb_objs=flatten(bordershades_2.hb_objs),
    depth=louver_depth_2,
    shade_count=number_of_louvers_2,
    dist_between=distance_between_louvers_2,
    angle=louver_angle_2,
    vertical=vertical_horizontal_louvers_2)  # -> report, hb_objs; plug-in component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

# ---- group: Bypass if no louvers were generated
null_2 = NullItem(Item=louvershades.hb_objs)  # -> NullFlags, InvalidFlags, Description
item_2 = ListItem(List=null_2.NullFlags, Index=0, Wrap=True)
filter_2 = StreamFilter(Gate=item_2, Stream0=louvershades.hb_objs, Stream1=bordershades_2.hb_objs)

# ---- group: If either skylights or windows are empty, filter them
merge = Merge(Data1=filter_2, Data2=bordershades.hb_objs)
null_3 = NullItem(Item=merge)  # -> NullFlags, InvalidFlags, Description
not = GateNot(A=null_3.NullFlags)
cull = CullPattern(List=merge, CullPattern=not)

# ---- group: add shades and louvers (continued)
addsubface = HBAddSubface(hb_obj=flatten(guidesurface), sub_faces=flatten(cull))  # -> hb_obj; plug-in component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
model = HBModel(rooms=flatten(addsubface), shades=flatten(python.list_checked), name=panel)  # -> report, model; plug-in component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

# ----
python_2 = GhPythonScript(model=model.model)  # -> out, model, errors
# ---------- python_2: Python ----------
"""Validates HB model
    Inputs:
        x: The x script variable
        y: The y script variable
    Output:
        a: The a output variable"""

errors = []

def main(model):
    if not validate_units(model):
        errors.append("Model unit in Rhino must be Meters.")
    if len(errors):
        return None
    return model

def validate_units(model):
    return model.units == "Meters"

if __name__ == "__main__":
    model = main(model)
# ---------- end python_2 ----------
vizbytype = HBVisualizeByType(hb_objs=model.model)  # -> walls, interior_walls, roofs, ceilings, exterior_floors, interior_floors, air_walls, apertures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; plug-in component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
model_2 = ClusterOutput(python_2.model)
errors = ClusterOutput(python_2.errors)

# ==== cluster VisualiseProperties
number_of_decimals_room = ClusterInput()
face_attribute = ClusterInput()
honeybee_model = ClusterInput()
number_of_decimals_face = ClusterInput()
room_attribute = ClusterInput()
face_attribute_2 = Text(face_attribute)
honeybee_model_2 = Data(honeybee_model)
room_attribute_2 = Text(room_attribute)
number_of_decimals_face_2 = Number(number_of_decimals_face)
legendpar = LBLegendParameters(num_decimals=number_of_decimals_face_2)  # -> leg_par; plug-in component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
number_of_decimals_room_2 = Number(number_of_decimals_room)
legendpar_2 = LBLegendParameters(num_decimals=number_of_decimals_room_2)  # -> leg_par; plug-in component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
colorfaceattr = HBColorFaceAttributes(hb_objs=flatten(honeybee_model_2), attribute=face_attribute_2, legend_par=legendpar)  # -> mesh, legend, wire_frame, values, colors, vis_set; plug-in component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
colorroomattr = HBColorRoomAttributes(rooms_model=flatten(honeybee_model_2), attribute=room_attribute_2, legend_par=legendpar_2)  # -> mesh, legend, wire_frame, values, colors, vis_set; plug-in component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
visualised_face_attributes = Data([colorfaceattr.mesh, colorfaceattr.legend, colorfaceattr.wire_frame])
visualised_room_attributes = Data([colorroomattr.mesh, colorroomattr.legend, colorroomattr.wire_frame])
visualised_face_attributes_2 = ClusterOutput(visualised_face_attributes)
visualised_room_attributes_2 = ClusterOutput(visualised_room_attributes)

# ==== cluster Cluster_3
honeybee_model = ClusterInput()
list = ValueList({"Swedish": "sv", "English": "en"}, selected="English")
# Get Klimatdatabas data
list_2 = ValueList({"File": "file", "API": "api"}, selected="API")
honeybee_model_2 = Data(honeybee_model)
get_categories = BrimstoneGetCategories(mode=list_2, language=list)  # -> out, json_data, categories, klimatdatabas_version
# ---------- get_categories: Python ----------
"""Gets Klimatdatabas from the Boverket API or a file, extracts json data, and resource category names
    Inputs:
        mode: api or file mode
        language: language of database to retrieve
        json_path: path to json file if file mode
    Output:
        json_data: json file as dictionary
        categories: Categories present in the database
        klimatdatabas_version: String representing the version of Klimatdatabas used"""

import scriptcontext
import brimstone
import Grasshopper
import os, io

ghenv.Component.Name = 'Brimstone - Get Categories'
ghenv.Component.NickName = 'Get Categories'
ver = brimstone.globals.version
ghenv.Component.Message = ver

import json

from System.Net import WebRequest
from System.IO import StreamReader
from System.Text import Encoding

def main(mode):    
    if mode == "file":
        json_file = brimstone.globals.kdb_json_path
        json_path = os.path.join(Grasshopper.Folders.UserObjectFolders[0], json_file)
        if not os.path.exists(json_path):
            raise Exception("Failed to open json file, it should reside in [UserComponents folder]/brimstone_data/")
        json_data = get_json_data_from_file(json_path)
    elif mode == "api":
        json_data = get_json_data_from_api()
    else:
        raise Exception("Mode {mode} not supported".format(mode = mode))
    
    categories = get_categories(json_data)
    version = json_data.get("Version") 
    
    return categories, json_data, version

def get_json_data_from_file(json_path):
    f = io.open(json_path, encoding='utf-8')
    json_data = json.load(f)
    return json_data
    
def get_json_data_from_api():
    version = "02.04.000"
    lng = language if language else "en"
    format = "json"

    url = "https://api.boverket.se/klimatdatabas/v2/get-all-resources/{version}/{language}/{format}".format(
        version=version, language=lng, format=format)
    
    request = WebRequest.Create(url)
    
    request.Method = "GET"
    request.Timeout = 5000
    #request.ContentType = "application/json"
    response = request.GetResponse()
    
    stream_reader = StreamReader(response.GetResponseStream())
    json_data = json.loads(stream_reader.ReadToEnd())
    return json_data
    
def get_categories(json_data):
    categories = []
    try:
        for metaCategory in json_data['Categories']:
            for cat in metaCategory["Children"]:
                categories.append(cat["Title"])
    except KeyError:
        raise Exception("Format of JSON data is not supported.")
    return categories

if __name__ == "__main__":
    if not scriptcontext.sticky["brimstone_flying"]:
        raise Exception("The 'Brimstone - Fly' component needs to exist on the canvas")
    categories, json_data, klimatdatabas_version = main(mode)
    json_data = [json_data] # need to put it in an array so GH understands it as a dictionary
# ---------- end get_categories ----------
calculate_honeybee_model = BrimstoneCalculateEmbodiedCarbonOfHoneybeeModel(hb_model=honeybee_model_2, kdb_json_data=get_categories.json_data)  # -> tot_emb_carbon, elements, el_emb_carbon
# ---------- calculate_honeybee_model: Python ----------
"""
Calculates embodied carbon for the elements of a Honeybee model if data is available
This component was inspired by the 'HB Color Face Attributes' component of Ladybug Tools 1.6.0

    Args:
        hb_model: Honeybee model for analysis
        kdb_json_data: Optional json data object for materials which do not include impact data

    Returns:
        tot_emb_carbon: total embodied carbon of model
        elements: element types in the model
        el_emb_carbon: embodied carbon for each element type in the model
"""

import scriptcontext
import brimstone
ghenv.Component.Message = brimstone.globals.version
import Grasshopper
import os
import csv, codecs
#print(brimstone.globals.kdb_json_path)
#print(brimstone.globals.hb_kdb_csv_path)

ghenv.Component.Name = 'Brimstone - Calculate Embodied Carbon of Honeybee Model'
ghenv.Component.NickName = 'Calculate Honeybee Model'

try:  # import the core honeybee dependencies
    from honeybee.model import Model
    from honeybee.properties import FaceProperties
    from honeybee.typing import clean_ep_string
except ImportError as e:
    raise ImportError('\nFailed to import honeybee:\n\t{}'.format(e))
    

# todo: magic string here - not good!
gwp_data_string = "Global Warming potential"
gwp_data_points = [
    "A1-A3 Conservative",
    "A4",
    "A5.1",
]

def main(hb_model):
    tot_emb_carbon = 0
    elements = []
    el_emb_carbon = []
    if not isinstance(hb_model, Model):
        raise Exception("hb_model input must be a valid honeybee model")
    faces = []
    apertures = []
    model_mats = []
    face_types = {}
    
    energy_properties = hb_model.properties.energy
    
    for material in energy_properties.materials:
        model_mats.append(material)
    for room in hb_model.rooms:
        faces.extend(room.faces)
        faces.extend(room.shades)
    faces.extend(hb_model.orphaned_faces)
    faces.extend(hb_model.orphaned_apertures)
    faces.extend(hb_model.orphaned_doors)
    faces.extend(hb_model.orphaned_shades)
    
    for face_obj in faces:
        if isinstance(face_obj.properties, FaceProperties):
            face_area = face_obj.area - face_obj.aperture_area
            face_type = face_obj.type
            
            face_impact = 0
            for lyr in face_obj.properties.energy.construction.layers:
                face_impact += get_face_impact(model_mats, lyr, face_area)
                """
                if lyr not in model_mats:
                    model_mats[lyr] = { area: face_area }
                else:
                    model_mats[lyr].area = model_mats[lyr].area + face_area
                """
                       
            if face_type not in face_types:
                face_types[face_type] = { "impact": face_impact }
            else:
                face_types[face_type]["impact"] += face_impact
                
            
            for aperture in face_obj.apertures:
                aperture_impact = get_aperture_impact(aperture)
                if "Aperture" not in face_types:
                    face_types["Aperture"] = { "impact": aperture_impact }
                else:
                    face_types["Aperture"]["impact"] += aperture_impact
    for face_type in face_types.items():
        face_impact = face_type[1]["impact"]
        tot_emb_carbon += face_impact
        elements.append(face_type[0])
        el_emb_carbon.append(face_impact)
    return tot_emb_carbon, elements, el_emb_carbon

def get_face_impact(materials, layer_name, face_area):
    for material in materials:
        if material.identifier == layer_name:
            abs_impact = 0
            if hasattr(material.properties, "gwp_a1_a3"):
                mp = material_properties
                
                impact = mp.gwp_a1_a3 + mp.gwp_a4 + mp.gwp_a5_1
                abs_impact = material.properties.density*impact
            else:
                abs_impact = get_face_impact_from_material_name(material.identifier)
            return material.thickness*abs_impact*face_area
    brimstone.utils.warn(ghenv, "The calculation may be faulty as material " + layer_name + " was not found among the energy materials in the model.")
    return 0

# Gets material impact data from a honeybee material by referencing names in .csv file
def get_face_impact_from_material_name(material_name):
    csv_data_file = brimstone.globals.hb_kdb_csv_path
    csv_data_file_path = os.path.join(Grasshopper.Folders.UserObjectFolders[0], csv_data_file)
    if not os.path.exists(csv_data_file_path):
        raise Exception("Failed to open csv file, it should reside in [UserComponents folder]/brimstone_data/")
    kdb_name = check_name_in_kdb(material_name)
    if not kdb_name:
        with open(csv_data_file_path, 'r') as csv_file:
            file_reader = csv.DictReader(csv_file, delimiter=",")
            for row in file_reader:
                if row["HB Name"] == material_name:
                    kdb_name = clean_ep_string(row["Klimatdatabas name"])
                    if not kdb_name or kdb_name == "missing":
                        brimstone.utils.warn(ghenv, "The calculation may be faulty as impact data is missing for some of the materials in the model: " + material_name)
                        return 0
                    break
    if not kdb_name:
        brimstone.utils.warn(ghenv, "The calculation may be faulty as material " + material_name + " could not be matched to any material in the brimstone material database.")
        return 0
    
    return get_impact_from_json_data(kdb_name)

def check_name_in_kdb(material_name):
    if not kdb_json_data:
        brimstone.utils.warn(ghenv, "The calculation may be faulty as kdb_json_data is missing")
    else: 
        for resource in kdb_json_data["Resources"]:
            if clean_ep_string(resource["Name"]) == material_name:
                return material_name
    return ""
    
# TODO: currently only works for KDB windows
def get_aperture_impact(aperture):
    if hasattr(aperture.properties.energy.construction.properties, "conv_value"):
        c = aperture.properties.energy.construction
        return (float(c.properties.gwp_a1_a3) + float(c.properties.gwp_a4))\
            * float(c.properties.conv_value) * aperture.area
    if not len(aperture.properties.energy.construction.layers) == 1:
        brimstone.utils.warn(ghenv, "The calculation may be faulty as only one layer window constructions can be calculated.")
        return 0
    
    window_material = aperture.properties.energy.construction.layers[0]
    return get_impact_from_json_data(window_material)*aperture.area

def get_impact_from_json_data(kdb_name):
    if not kdb_json_data:
        brimstone.utils.warn(ghenv, "The calculation may be faulty as kdb_json_data is missing")
        return 0
    for resource in kdb_json_data["Resources"]:
        if clean_ep_string(resource["Name"]) == kdb_name:
            conv = resource["Conversions"][0]["Value"]
            
            for data_item in resource["DataItems"]:
                if data_item["PropertyName"] == gwp_data_string:
                    abs_impact = 0
                    for data_pt in gwp_data_points:
                        for data_val_item in data_item["DataValueItems"]:
                            if data_val_item["DataModuleCode"] == data_pt:
                                abs_impact += data_val_item["Value"]
                    return abs_impact*conv
            brimstone.utils.warn(ghenv, "The calculation may be faulty as material " + kdb_name + " has no GWP data in kdb_json_data")
            return 0
    brimstone.utils.warn(ghenv, "The calculation may be faulty as material " + kdb_name + " was not found in kdb_json_data")
    return 0

if __name__ == "__main__":
    try:
        flying = scriptcontext.sticky["brimstone_flying"]
    except:
        raise Exception("The 'Brimstone - Fly' component needs to exist on the canvas")
    tot_emb_carbon, elements, el_emb_carbon = main(hb_model)
# ---------- end calculate_honeybee_model ----------
panel = Panel(get_categories.klimatdatabas_version)
total_gwp = Data(calculate_honeybee_model.tot_emb_carbon)
element_types = Data(calculate_honeybee_model.el_emb_carbon)
gwp_by_element_type = Data(calculate_honeybee_model.elements)
gwp_by_element_type_2 = ClusterOutput(gwp_by_element_type)
element_types_2 = ClusterOutput(element_types)
total_gwp_2 = ClusterOutput(total_gwp)

# ==== cluster Cluster_4
fly = BrimstoneFly()
# ---------- fly: Python ----------
"""This component sets up global information for Brimstone
    Inputs:
    Output:
        """

import Grasshopper
import sys
sys.path.append(Grasshopper.Folders.UserObjectFolders[0])

import brimstone
reload(brimstone)

import scriptcontext

ghenv.Component.Name = 'Brimstone - Fly!'
ghenv.Component.NickName = 'Fly!'

scriptcontext.sticky["brimstone_flying"] = 'true'
scriptcontext.sticky["brimstone_kdb_hb_json"] = 'brimstone_data/230721klimatdatabas_hb_materials.json' # json which adds honeybee material info to klimatdatabas materials
scriptcontext.sticky["brimstone_hb_kdb_csv"] = 'brimstone_data/230728_HBKlimatdatabas.csv' # csv file which translates honeybee material names to klimatdatabas material names
ghenv.Component.Message = brimstone.globals.version
# ---------- end fly ----------
python = GhPythonScript()  # -> out, program_names
# ---------- python: Python ----------
"""Gets energy schedules from a json file.
    Inputs:
        
    Output:
        program_names: List of human-readable program names"""

import scriptcontext
import json
import brimstone
import os
import Grasshopper
    

def main():
    program_names = []
    json_file_path = brimstone.globals.boverket_energy_schedules_path
    file_path = os.path.join(Grasshopper.Folders.UserObjectFolders[0], json_file_path)
    if not os.path.exists(file_path):
        raise Exception("Failed to open json file, it should reside in [UserComponents folder]/brimstone_data/")
    
    with open(file_path, 'r') as file:
        data = json.load(file)
    
    for key in data.keys():
        program_names.append(data[key]["name"])
    return program_names

if __name__ == "__main__":
    if not scriptcontext.sticky["brimstone_flying"]:
        raise Exception("The 'Brimstone - Fly' component needs to exist on the canvas")
    program_names = main()
# ---------- end python ----------
program_names = ClusterOutput(python.program_names)

# ==== cluster AddDynamicShades
base_construction_set = ClusterInput()
setpoint = ClusterInput()
base_construction_set_2 = Data(base_construction_set)
decnstrconstrset = HBDeconstructConstructionSet(constr_set=base_construction_set_2)  # -> exterior_wall, exterior_roof, exposed_floor, ground_wall, ground_roof, ground_floor, window, skylight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; plug-in component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
setpoint_2 = Data(setpoint)
shademat = HBShadeMaterial(thickness=Slider(0.01, range=0..0.01), transmittance=Slider(0.4, range=0..1))  # -> mat; plug-in component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
windowconstrshd = HBWindowConstructionShade(
    name="Simple Glazing Window",
    win_constr=decnstrconstrset.window,
    shd_material=shademat,
    shd_location="Exterior",
    control_type=Slider(1, range=0..8),
    setpoint=setpoint_2)  # -> constr; plug-in component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
subfacesubset = HBSubfaceSubset(window=windowconstrshd, operable=windowconstrshd)  # -> subface_set; plug-in component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
constructionset = HBConstructionSet(base_constr_set=base_construction_set_2, subface_subset=subfacesubset)  # -> constr_set; plug-in component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
construction_set = Data(constructionset)
construction_set_2 = ClusterOutput(construction_set)

# ==== cluster Cluster_5
materials = ClusterInput()
materials_2 = Data(materials)
opaqueconstr = HBOpaqueConstruction(materials=materials_2)  # -> constr; plug-in component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
thicknesses = ClusterInput()
decnstrconstr = HBDeconstructConstruction(constr=opaqueconstr)  # -> materials, layers, r_val_si, r_val_ip, u_fac_si, u_fac_ip, shgc, t_sol, t_vis; plug-in component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
thicknesses_2 = Number(thicknesses)
construction_name = ClusterInput()
modify_layer_thicknesses = BrimstoneModifyThicknessesOfHoneybeeMaterials(hb_materials=decnstrconstr.materials, thicknesses=thicknesses_2)  # -> mod_materials; inputs hb_materials: list, thicknesses: list
# ---------- modify_layer_thicknesses: Python ----------
"""
Calculates embodied carbon for the elements of a Honeybee model if data is available
This component was inspired by the 'HB Color Face Attributes' component of Ladybug Tools 1.6.0

    Args:
        hb_materials: List of Honeybee materials which should get new thickness
        thicknesses: List of new material thicknesses

    Returns:
        mod_materials: Modified Honeybee materials
"""

import scriptcontext
#import brimstone

ghenv.Component.Message = ""#brimstone.globals.version

ghenv.Component.Name = 'Brimstone - Modify thicknesses of Honeybee materials'
ghenv.Component.NickName = 'Modify layer thicknesses'

try:  # import the core honeybee dependencies
    from honeybee_energy.material.opaque import EnergyMaterial
    from honeybee_energy.material.opaque import EnergyMaterialNoMass
except ImportError as e:
    raise ImportError('\nFailed to import honeybee:\n\t{}'.format(e))

def main(hb_materials, thicknesses):
    mod_materials = []
    assert len(hb_materials) == len(thicknesses), "Materials and thickness list must be of the same length"
    for (i, material) in enumerate(hb_materials):
        if not isinstance(material, EnergyMaterial):
            if isinstance(material, EnergyMaterialNoMass):
                mod_material = material.duplicate()
                mod_materials.append(mod_material)
            else:
                raise Exception("All materials must be valid Honeybee Energy Materials or Energy Materials (No Mass)")
        else: # if material is EnergyMaterial
            mod_material = material.duplicate()
            mod_material.thickness = thicknesses[i]
            mod_materials.append(mod_material)
    return mod_materials

if __name__ == "__main__":
    try:
        pass#flying = scriptcontext.sticky["brimstone_flying"]
    except:
        raise Exception("The 'Brimstone - Fly' component needs to exist on the canvas")
    mod_materials = main(hb_materials, thicknesses)
# ---------- end modify_layer_thicknesses ----------
construction_name_2 = Text(construction_name)
opaqueconstr_2 = HBOpaqueConstruction(name=construction_name_2, materials=modify_layer_thicknesses)  # -> constr; plug-in component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
construction = Data(opaqueconstr_2)
construction_2 = ClusterOutput(construction)

# ==== cluster Cluster_6
window_construction = ClusterInput()
window_construction_2 = Data(window_construction)
fly = BrimstoneFly()
# ---------- fly: Python ----------
"""This component sets up global information for Brimstone
    Inputs:
    Output:
        """

import Grasshopper
import sys
sys.path.append(Grasshopper.Folders.UserObjectFolders[0])

import brimstone
reload(brimstone)

import scriptcontext

ghenv.Component.Name = 'Brimstone - Fly!'
ghenv.Component.NickName = 'Fly!'

scriptcontext.sticky["brimstone_flying"] = 'true'
ghenv.Component.Message = brimstone.globals.version
# ---------- end fly ----------
subfacesubset = HBSubfaceSubset(window=window_construction_2)  # -> subface_set; plug-in component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
panel = Panel(subfacesubset)
constructionset = HBConstructionSet(subface_subset=subfacesubset)  # -> constr_set; plug-in component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
density_kg_m2 = ClusterInput()
gwp_a1_a3 = ClusterInput()
gwp_a4 = ClusterInput()
decnstrconstrset = HBDeconstructConstructionSet(constr_set=constructionset)  # -> exterior_wall, exterior_roof, exposed_floor, ground_wall, ground_roof, ground_floor, window, skylight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; plug-in component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
density_kg_m2_2 = Data(density_kg_m2)
gwp_a4_2 = Data(gwp_a4)
gwp_a1_a3_2 = Data(gwp_a1_a3)
add_life_cycle_info_construction = BrimstoneAddLifeCycleInfoToHoneybeeConstruction(hb_construction=decnstrconstrset.window, gwp_a1_a3=gwp_a1_a3_2, gwp_a4=gwp_a4_2, density=density_kg_m2_2)  # -> mod_construction
# ---------- add_life_cycle_info_construction: Python ----------
"""
Adds GWP info to a Honeybee Construction

    Args:
        hb_construction: Honeybee Construction to be updated
        gwp_a1_a3: GWP (A1-A3) [kg CO2eq/m2]
        gwp_a4: GWP (A4) [kg CO2eq/m2]
        gwp_a5_1: GWP (A5.1) [kg CO2eq/m2]

    Returns:
        mod_construction: Updated Honeybee Construction
"""

import scriptcontext
import brimstone
ghenv.Component.Message = brimstone.globals.version
import Grasshopper

ghenv.Component.Name = 'Brimstone - Add Life Cycle Info to Honeybee Construction'
ghenv.Component.NickName = 'Add Life Cycle Info (Construction)'

try:  # import the core honeybee dependencies
    from honeybee_energy.construction.window import WindowConstruction
    from honeybee_energy.construction.opaque import OpaqueConstruction
except ImportError as e:
    raise ImportError('\nFailed to import honeybee:\n\t{}'.format(e))

def main(hb_construction, gwp_a1_a3, gwp_a4, density):
    if not isinstance(hb_construction, WindowConstruction)\
        and not isinstance(hb_construction, OpaqueConstruction):
        raise Exception("Currently only Window and Opaque constructions are supported")
    mod_construction = hb_construction.duplicate()
    mod_construction.properties.gwp_a1_a3 = gwp_a1_a3
    mod_construction.properties.gwp_a4 = gwp_a4
    mod_construction.properties.conv_value = density
    return mod_construction

if __name__ == "__main__":
    try:
        flying = scriptcontext.sticky["brimstone_flying"]
    except:
        raise Exception("The 'Brimstone - Fly' component needs to exist on the canvas")
    mod_construction = main(hb_construction, gwp_a1_a3, gwp_a4, density)
# ---------- end add_life_cycle_info_construction ----------
panel_2 = Panel(decnstrconstrset.window)
updated_construction = Data(add_life_cycle_info_construction)
panel_3 = Panel(add_life_cycle_info_construction)
updated_construction_2 = ClusterOutput(updated_construction)

# ==== cluster Cluster
legendpar = LBLegendParameters(min=Slider(0, range=0..100), max=Slider(100, range=0..100), num_decimals=Slider(0, range=0..100))  # -> leg_par; plug-in component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
leg_par = ClusterOutput(legendpar)

# ==== cluster Cluster_2
min = ClusterInput()
max = ClusterInput()
colors = ClusterInput()
legendpar = LBLegendParameters(min=min, max=max, colors=colors)  # -> leg_par; plug-in component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
leg_par = ClusterOutput(legendpar)
