# Grasshopper definition heathUI_0.5.0-dev.gh (Grasshopper 1.0.8)
# plug-ins: RhinoCodePluginGH, Heteroptera, treesloth01, Human UI, Human, LadybugGrasshopper, MetaHopper, eleFront, Wombat, Telepathy

# ----
# Click here
button = Button()
restart_heath = RemoteSender(button)

# ----
# CLICK BUTTON
# TO RESTART
# HEATH
number_slider = Slider(500, range=0..1000)
selobj = GetSelectedObjects()  # -> ComponentObjects, ParamObjects, OtherObjects
# Dev notes
# Sprint 3
# - Assign type changed to import geometry
# - Pre-window with link to github and mail
# - Attribute description changed to Heath geometry type
# - Wireframe mode for all modules with preview checkbox
# - Zoom button for locating visualisations
# - Heating setpoint is strictly lower than cooling setpoint
# - Added tooltips to construction modules and sliders
# - Preview in geometry module is updated when model is scaled
# - Preview is only active when its corresponding tab is active
# - The chackboxes in analysis module is changed to a pulldown menu
# - Preview all option is available is geometry tab
# - A legend is made to the preview in the geometry tab
# - Bug in the create model in assembly module is made, now the model components can be shown
# - The option to show all is added in the show model components
# - Ticks have been added to the sliders, along with the setting of appropriate ranges
# - Units have been added to the sliders
# - Python dependencies have been tested for the Grasshopper script
# - Crate window construction have been added to the construction module
# - Select window construction possibility, (from created windows) have been added to the construction module
# - Matplotlib bug is fixed so that it can display an arbitrary amount of features
# - Daylight simulation has been added to the analysis module
# - Detailed energy simulation have been added to the analysis module, (NOT YET)
# - The help button have been poplated
# - Handling if the simulation fails, with appropriate information provided, (NOT YET)
setscribble = SetScribbleProperties(Scribble=selobj.OtherObjects, ScribbleSize=number_slider)

panel = Panel("""None
Room
Window
Adjacent
Context
All""")
panel_2 = Panel("""Could not save geometry. 
It was not of the correct type.""")
listbox = CreateListBox(ListItems=panel, SelectedIndex=0, Height=100)
true_button = CreateTrueOnlyButton(ButtonName="?", ButtonStyle=2)
empty = EmptyObjectToEmptyBranch()
true_button_2 = CreateTrueOnlyButton(ButtonName="Construction database", ButtonStyle=0)
empty_2 = EmptyObjectToEmptyBranch()
label = CreateLabel(LabelText=panel_2, LabelSize=12, Justification=0)
true_button_3 = CreateTrueOnlyButton(ButtonName="Material database", ButtonStyle=0)

label_2 = CreateLabel(LabelText="Set location", LabelSize=12, Justification=0)

true_button_4 = CreateTrueOnlyButton(ButtonName="Window database", ButtonStyle=0)
empty_3 = EmptyObjectToEmptyBranch()
empty_4 = EmptyObjectToEmptyBranch()
empty_5 = EmptyObjectToEmptyBranch()
empty_6 = EmptyObjectToEmptyBranch()
empty_7 = EmptyObjectToEmptyBranch()
label_3 = CreateLabel(LabelText="Weather visualization", LabelSize=18, Justification=0)
empty_8 = EmptyObjectToEmptyBranch()
label_4 = CreateLabel(LabelText="Honeybee model", LabelSize=18, Justification=0)
slider = CreateSlider(
    Slider=Slider(50, range=0..100),
    SnapValue=Slider(5, range=0..10),
    ShowBounds=False,
    ShowTicks=True,
    ShowTooltip=False,
    ShowValLabel=True,
    showLabel=False)
slider_2 = CreateSlider(
    Slider=Slider(50, range=0..100),
    SnapValue=Slider(5, range=0..10),
    ShowBounds=False,
    ShowTicks=True,
    ShowTooltip=False,
    ShowValLabel=True,
    showLabel=False)
slider_3 = CreateSlider(
    Slider=Slider(1, range=0..10),
    SnapValue=Slider(1, range=0..1),
    ShowBounds=False,
    ShowTicks=True,
    ShowTooltip=False,
    ShowValLabel=True,
    showLabel=False)
label_5 = CreateLabel(LabelText="Louver depth", LabelSize=12, Justification=0)
label_6 = CreateLabel(LabelText="Distance between louvers", LabelSize=12, Justification=0)
label_7 = CreateLabel(LabelText="Number of louvers", LabelSize=12, Justification=0)
slider_4 = CreateSlider(
    Slider=Slider(50, range=0..100),
    SnapValue=Slider(5, range=0..10),
    ShowBounds=False,
    ShowTicks=True,
    ShowTooltip=False,
    ShowValLabel=True,
    showLabel=False)
label_8 = CreateLabel(LabelText="Louver angle", LabelSize=12, Justification=0)
toggle = CreateToggle(Default=False)
label_9 = CreateLabel(LabelText="Generate windows using WWR [%]", LabelSize=12, Justification=0)
slider_5 = CreateSlider(
    Slider=Slider(30, range=5..95),
    SnapValue=Slider(5, range=0..10),
    ShowBounds=False,
    ShowTicks=True,
    ShowTooltip=True,
    ShowValLabel=True,
    showLabel=False)
values = ValueListener(Elements=true_button, SomeProperty=True)  # -> Values, Indices
values_2 = ValueListener(Elements=true_button_2, SomeProperty=True)  # -> Values, Indices
button_2 = CreateButton(ButtonName="Get climate data", ButtonStyle=0)
values_3 = ValueListener(Elements=true_button_3, SomeProperty=True)  # -> Values, Indices
values_4 = ValueListener(Elements=true_button_4, SomeProperty=True)  # -> Values, Indices
number_slider_2 = Slider(29, range=0..300)
label_10 = CreateLabel(LabelText="Program settings", LabelSize=18, Justification=0)
info_save_geometry = RemoteSender(values.Values)
adjustelem = AdjustElementAppearance(
    ElementsToAdjust=true_button,
    Foreground=ColourSwatch(SwatchColor=RGB(0, 0, 0)),
    Background=ColourSwatch(SwatchColor=RGB(230, 230, 230)),
    FontSize=Slider(12, range=0..300))
open_construction_database = RemoteSender(values_2.Values)
panel_3 = Panel(values_2.Values)
open_material_database = RemoteSender(values_3.Values)
panel_4 = Panel(values_3.Values)
panel_5 = Panel(values_4.Values)
open_window_database = RemoteSender(values_4.Values)
values_5 = ValueListener(Elements=slider_3, SomeProperty=True)  # -> Values, Indices
values_6 = ValueListener(Elements=slider_2, SomeProperty=True)  # -> Values, Indices
values_7 = ValueListener(Elements=slider, SomeProperty=True)  # -> Values, Indices
values_8 = ValueListener(Elements=button_2, SomeProperty=True)  # -> Values, Indices
values_9 = ValueListener(Elements=slider_4, SomeProperty=True)  # -> Values, Indices
entwine = Entwine(Branch00=label_5, Branch01=slider, FlattenInputs=True)  # -> flatten(Result)
entwine_2 = Entwine(Branch00=label_6, Branch01=slider_2, FlattenInputs=True)  # -> flatten(Result)
entwine_3 = Entwine(Branch00=label_7, Branch01=slider_3, FlattenInputs=True)  # -> flatten(Result)
entwine_4 = Entwine(Branch00=label_8, Branch01=slider_4, FlattenInputs=True)  # -> flatten(Result)
adjustpos = AdjustElementPositioning(ElementsToAdjust=true_button, AbsolutePositioning=False, Width=number_slider_2, Height=number_slider_2)
values_10 = ValueListener(Elements=slider_5, SomeProperty=True)  # -> Values, Indices
tooltip = AttachTooltipToElement(ElementsToAttachTo=slider_5, TooltipContent="Doubleclick to input value", ShowDelay=500, Duration=2000)
distance_between_louvers = RemoteSender(values_6.Values)
values_11 = ValueListener(Elements=toggle, SomeProperty=True)  # -> Values, Indices
louver_depth = RemoteSender(values_7.Values)
louver_angle = RemoteSender(values_9.Values)
number_of_louvers = RemoteSender(values_5.Values)
getclimatedata = RemoteSender(values_8.Values)
stack = CreateStack(UIElements=entwine, Horizontal=invert(True))
stack_2 = CreateStack(UIElements=entwine_2, Horizontal=invert(True))
stack_3 = CreateStack(UIElements=entwine_3, Horizontal=invert(True))
stack_4 = CreateStack(UIElements=entwine_4, Horizontal=invert(True))
filter = StreamFilter(Gate=values_11.Values, Stream0="0", Stream1=values_10.Values)
entwine_5 = Entwine(Branch00=toggle, Branch01=slider_5, FlattenInputs=True)  # -> flatten(Result)
number_of_louvers_2 = RemoteReceiver(number_of_louvers)
number_of_louvers_3 = RemoteReceiver(number_of_louvers)
number_of_louvers_4 = RemoteReceiver(number_of_louvers)
division = Division(A=filter, B="100")
hideshow = HideShowElement(ElementToHideShow=slider_5, Show=values_11.Values, Collapse=invert(True), Disable=False)
stack_5 = CreateStack(UIElements=entwine_5, Horizontal=True)
generate_wwr = RemoteSender(division)
hideshow_2 = HideShowElement(ElementToHideShow=stack, Show=number_of_louvers_2, Collapse=True, Disable=False)
hideshow_3 = HideShowElement(ElementToHideShow=stack_4, Show=number_of_louvers_4, Collapse=True, Disable=False)
hideshow_4 = HideShowElement(ElementToHideShow=stack_2, Show=number_of_louvers_3, Collapse=True, Disable=False)
entwine_6 = Entwine(Branch00=stack_3, Branch01=stack, Branch02=stack_2, Branch03=stack_4, FlattenInputs=True)  # -> flatten(Result)
entwine_7 = Entwine(Branch00=label_9, Branch01=stack_5, FlattenInputs=True)  # -> flatten(Result)
stack_6 = CreateStack(UIElements=entwine_6, Horizontal=True)
entwine_8 = Entwine(Branch00=true_button_4, Branch01=true_button_3, Branch02=true_button_2, FlattenInputs=True)  # -> flatten(Result)
stack_7 = CreateStack(UIElements=entwine_7, Horizontal=invert(True))
adjustpos_2 = AdjustElementPositioning(ElementsToAdjust=label_9, Margin="0, 0, 0, 0", AbsolutePositioning=False, HorizontalAlignment=0, VerticalAlignment=2)
adjustpos_3 = AdjustElementPositioning(ElementsToAdjust=slider_5, Margin="20, 10, 0, 0", AbsolutePositioning=False, HorizontalAlignment=0, VerticalAlignment=2)
adjustelem_2 = AdjustElementAppearance(ElementsToAdjust=label, Foreground=ColourSwatch(SwatchColor=RGB(255, 0, 0)))

# ----
# Louvers
location = Data()

# ----
# Generate using WWR
location_2 = Data(stack_7)

# ----
# For testing
data = Data(["Heating", "Solar", "Service Hot Water", "Electric Equipment", "Lighting", "People", "Infiltration", "Mechanical Ventilation", "Opaque Conduction", "Window Conduction", "Cooling", "Storage"])
panel_6 = Panel(data)
data_2 = Data(Tree({0;0}: [0, 0, 0, 0, 0, 0, 0, 0, 0, 0, 0, 0], {0;1}: [0.1154636743, 0.2088814282, 0.4621754872, 0.6375773836, 0.7940293548, 0.7463955098, 0.7771035315, 0.6868606807, 0.5770758629, 0.3882011428, 0.1539180345, 0.1039965989], {0;2}: [0.2845266784, 0.2593931982, 0.3068475988, 0.3112341165, 0.3274388209, 0.3004628568, 0.2994641541, 0.2849765538, 0.2931936837, 0.2954218727, 0.2799234578, 0.2870384056], {0;3}: [3.26489514, 2.948937546, 3.26489514, 3.159575942, 3.26489514, 3.159575942, 3.26489514, 3.26489514, 3.159575942, 3.26489514, 3.159575942, 3.26489514], {0;4}: [0.4188465123, 0.3783129788, 0.4188465123, 0.4053353345, 0.4188465123, 0.4053353345, 0.4188465123, 0.4188465123, 0.4053353345, 0.4188465123, 0.4053353345, 0.4188465123], {0;5}: [145.0707, 131.0316, 145.0707, 140.391, 145.0707, 140.391, 145.0707, 145.0707, 140.391, 145.0707, 140.391, 145.0707], {0;6}: [-13.42394635, -12.17954569, -11.63497027, -9.703517743, -7.231149303, -5.714291235, -5.026111258, -5.365052955, -6.984852185, -8.612623152, -10.78235179, -12.63972442], {0;7}: [-127.6578232, -115.5253908, -130.3991254, -128.4476678, -136.7388039, -132.9998708, -138.3167409, -138.9867771, -132.4821465, -134.6450452, -126.8261408, -128.9392353], {0;8}: [-4.317090982, -3.828538366, -4.007361586, -3.591511594, -3.312717163, -3.049022121, -3.055337228, -3.177779608, -3.37671771, -3.733105664, -3.928085146, -4.22849013], {0;9}: [-1.904284325, -1.611011521, -1.522864461, -1.139056545, -0.6851745139, -0.4758042193, -0.339572292, -0.4501261671, -0.7765412269, -1.097827525, -1.460511454, -1.777338546], {0;10}: [-0.7767994186, -0.568607221, -0.5137867107, -0.7067512703, -0.665388473, -1.639501883, -1.948212559, -0.6954699949, -0.143473928, -0.2547466496, -0.4393643663, -0.5620924752], {0;11}: [-1.074487752, -1.11403151, -1.445356325, -1.316217828, -1.242676437, -1.124279386, -1.145035073, -1.051073081, -1.062449287, -1.094716512, -0.9532992481, -0.9985958205]))
panel_7 = Panel(data_2)
num = Number(panel_7)

getclimatedata_2 = RemoteReceiver(getclimatedata)
panel_8 = Panel(getclimatedata_2)

# ----
# Create construction
panel_9 = Panel("gypsum")
number_slider_3 = Slider(0.3, range=0..1)
searchmats = HBSearchMaterials(keywords="insulation")  # -> opaque_mats, window_mats; plug-in component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
searchmats_2 = HBSearchMaterials(keywords="concrete")  # -> opaque_mats, window_mats; plug-in component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
searchmats_3 = HBSearchMaterials()  # -> opaque_mats, window_mats; plug-in component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
searchmats_4 = HBSearchMaterials(keywords="air")  # -> opaque_mats, window_mats; plug-in component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
searchmats_5 = HBSearchMaterials(keywords="plywood")  # -> opaque_mats, window_mats; plug-in component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
searchmats_6 = HBSearchMaterials(keywords=panel_9)  # -> opaque_mats, window_mats; plug-in component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
searchconstrs = HBSearchConstructions()  # -> opaque_constrs, window_constrs, shade_constrs; plug-in component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
searchconstrs_2 = HBSearchConstructions()  # -> opaque_constrs, window_constrs, shade_constrs; plug-in component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
list = ItemSelector(
    searchmats.opaque_mats,
    {"AtticFloor Insulation", "Generic 25mm Insulation", "Generic 50mm Insulation", "I01 25mm insulation board", "I02 50mm insulation board", "IEAD NonRes Roof Insulation-1.76", "IEAD Roof Insulation R-3.47 IP", "Insulation 1m", "Mass NonRes Wall Insulation-0.43", "Mass Wall Insulation R-4.23 IP"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}, selected="AtticFloor Insulation")
list_2 = ItemSelector(
    searchmats_2.opaque_mats,
    {"100mm Normalweight concrete floor", "12 in. Normalweight Concrete Floor", "4 in. Normalweight Concrete Floor", "4 in. Normalweight Concrete Wall", "6 in. Heavyweight Concrete Roof", "6 in. Normalweight Concrete Floor", "8 in. Concrete Block Basement Wall", "8 in. Concrete Block Wall", "8 in. Normalweight Concrete Floor", "8 in. Normalweight Concrete Wall", "8IN CONCRETE HW RefBldg", "8IN Concrete HW", "Concrete Pavement", "Generic HW Concrete", "Generic LW Concrete", "HW CONCRETE", "HW CONCRETE 8 in", "M11 100mm lightweight concrete", "M15 200mm heavyweight concrete", "MAT-CC05 4 HW CONCRETE", "MAT-CC05 8 HW CONCRETE", "NACM_Concrete 4in_140lb/ft3"}, selected="100mm Normalweight concrete floor")
list_3 = ItemSelector(
    searchmats_6.opaque_mats,
    {"1/2 in. Gypsum Board", "1/2IN Gypsum", "5/8 in. Gypsum Board", "G01 13mm gypsum board", "G01a 19mm gypsum board", "Generic Gypsum Board", "Gypsum Board - 1/2 in. CBES", "Gypsum Or Plaster Board - 3/8 in.", "NACM_Gypsum Board 5/8in"}, selected="1/2 in. Gypsum Board")
list_4 = ItemSelector(
    searchmats_4.opaque_mats,
    {"F04 Wall air space resistance", "F05 Ceiling air space resistance", "Generic Ceiling Air Gap", "Generic Wall Air Gap", "Typical Air Wall"}, selected="F04 Wall air space resistance")
list_5 = ItemSelector(searchmats_5.opaque_mats, {"5/8 in. Plywood", "Plywood - 5/8 in. CBES"}, selected="5/8 in. Plywood")
number_slider_4 = Slider(0.3, range=0..1)
opaquemat = HBOpaqueMaterial(
    name="XPS insulation",
    thickness=number_slider_3,
    conductivity=Slider(0.036, range=0..0.1),
    density=Slider(28, range=0..100),
    spec_heat=Slider(1500, range=0..10000))  # -> mat; plug-in component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
list_6 = ItemSelector(
    searchconstrs.window_constrs,
    {"ASHRAE 189.1-2009 ExtWindow ClimateZone 1", "ASHRAE 189.1-2009 ExtWindow ClimateZone 2", "ASHRAE 189.1-2009 ExtWindow ClimateZone 3", "ASHRAE 189.1-2009 ExtWindow ClimateZone 4-5", "ASHRAE 189.1-2009 ExtWindow ClimateZone 6", "ASHRAE 189.1-2009 ExtWindow ClimateZone 7-8"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}, selected="U 0.17 SHGC 0.36 Simple Glazing Window")
list_7 = ItemSelector(
    searchconstrs_2.window_constrs,
    {"ASHRAE 189.1-2009 ExtWindow ClimateZone 1", "ASHRAE 189.1-2009 ExtWindow ClimateZone 2", "ASHRAE 189.1-2009 ExtWindow ClimateZone 3", "ASHRAE 189.1-2009 ExtWindow ClimateZone 4-5", "ASHRAE 189.1-2009 ExtWindow ClimateZone 6", "ASHRAE 189.1-2009 ExtWindow ClimateZone 7-8"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}, selected="ASHRAE 189.1-2009 ExtWindow ClimateZone 1")
merge = Merge(Data1=list_2, Data2=list_4, Data3=list_5, Data4=opaquemat, Data5=list_3)
merge_2 = Merge(
    Data1=Slider(0.1, range=0..1),
    Data2=Slider(0.11, range=0..1),
    Data3=Slider(0.016, range=0..0.1),
    Data4=number_slider_3,
    Data5=Slider(0.012, range=0..0.1))
interiorsubset = HBInteriorConstructionSubset()  # -> interior_set; plug-in component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
groundsubset = HBGroundConstructionSubset()  # -> ground_set; plug-in component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
cluster = Cluster(materials=merge, construction_name="Construction 1", thicknesses=merge_2)  # -> error_2, construction_2
bldgvintages = HBBuildingVintages({"ASHRAE 90.1 2019  |  IECC 2021": "2019", "ASHRAE 90.1 2016  |  IECC 2018": "2016", "ASHRAE 90.1 2013  |  IECC 2015": "2013", "ASHRAE 90.1 2010  |  IECC 2012": "2010", "ASHRAE 90.1 2007  |  IECC 2009": "2007", "ASHRAE 90.1 2004  |  IECC 2006": "2004", "1980-2004 (CBECS)": "1980_2004", "Pre-1980 (CBECS)": "pre_1980"}, selected="ASHRAE 90.1 2019  |  IECC 2021")
cluster_2 = Cluster_2(window_construction=list_7, gwp_a1_a3="2.5", gwp_a4="0.042", density_kg_m2="38.2")
decnstrconstr = HBDeconstructConstruction(constr=list_6)  # -> materials, layers, r_val_si, r_val_ip, u_fac_si, u_fac_ip, shgc, t_sol, t_vis; plug-in component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
constructiontypes = HBConstructionTypes({"SteelFramed", "WoodFramed", "Mass", "Metal Building"}, selected="WoodFramed")
climatezones = HBClimateZones({"1 - Very Hot": "1", "2 - Hot": "2", "3 - Warm": "3", "4 - Mixed": "4", "5 - Cool": "5", "6 - Cold": "6", "7 - Very Cold": "7", "8 - Subarctic": "8"}, selected="5 - Cool")
data_3 = Data(cluster_2)
panel_10 = Panel(decnstrconstr.u_fac_ip)
panel_11 = Panel(decnstrconstr.u_fac_si)
exteriorsubset = HBExteriorConstructionSubset(exterior_wall=cluster.construction_2)  # -> exterior_set; plug-in component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
subfacesubset = HBSubfaceSubset(window=data_3)  # -> subface_set; plug-in component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
panel_12 = Panel(cluster.construction_2)
constrsetclimate = HBConstructionSetByClimate(climate_zone=climatezones, vintage=bldgvintages, constr_type=constructiontypes)  # -> constr_set; plug-in component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
constructionset = HBConstructionSet(base_constr_set=constrsetclimate, exterior_subset=exteriorsubset, subface_subset=subfacesubset)  # -> constr_set; plug-in component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
decnstrconstrset = HBDeconstructConstructionSet(constr_set=constructionset)  # -> exterior_wall, exterior_roof, exposed_floor, ground_wall, ground_roof, ground_floor, window, skylight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; plug-in component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
panel_13 = Panel(decnstrconstrset.exterior_wall)

# ----
# Brimstone FLY!
fly = BrimstoneFly()
# ---------- fly: Python ----------
"""This component sets up global information for Brimstone
    Inputs:
    Output:
        """

import Grasshopper
import sys
sys.path.append(Grasshopper.Folders.UserObjectFolders[0])

import brimstone
reload(brimstone)

import scriptcontext

ghenv.Component.Name = 'Brimstone - Fly!'
ghenv.Component.NickName = 'Fly!'

scriptcontext.sticky["brimstone_flying"] = 'true'
scriptcontext.sticky["brimstone_kdb_hb_json"] = 'brimstone_data/230721klimatdatabas_hb_materials.json' # json which adds honeybee material info to klimatdatabas materials
scriptcontext.sticky["brimstone_hb_kdb_csv"] = 'brimstone_data/230728_HBKlimatdatabas.csv' # csv file which translates honeybee material names to klimatdatabas material names
ghenv.Component.Message = brimstone.globals.version
# ---------- end fly ----------

# ----
# Material database categories
material_database_categories = Panel("""Blocks and tiles
Building boards
Concrete
Insulation
Mineral materials
Paints and sealants
Solid woods
Steel and other metals
Waterproofing
Other""")
material_database_categories_2 = RemoteSender(material_database_categories)

number_slider_5 = Slider(20, range=0..100)
button_3 = CreateButton(ButtonName="Sync database", ButtonStyle=0)
button_4 = CreateButton(ButtonName="Save materials", ButtonStyle=0)
values_12 = ValueListener(Elements=button_3, SomeProperty=True)  # -> Values, Indices
values_13 = ValueListener(Elements=button_4, SomeProperty=True)  # -> Values, Indices
button_5 = CreateButton(ButtonName="Save constructions", ButtonStyle=0)
button_6 = CreateButton(ButtonName="Save windows", ButtonStyle=0)
freeze_gate = StreamFreezeGate(Data=values_12.Values, PassingSwitch=invert(values_12.Values))
freeze_gate_2 = StreamFreezeGate(Data=values_13.Values, PassingSwitch=invert(values_13.Values))
values_14 = ValueListener(Elements=button_5, SomeProperty=True)  # -> Values, Indices
values_15 = ValueListener(Elements=button_6, SomeProperty=True)  # -> Values, Indices
bool = Boolean(invert(freeze_gate))
freeze_gate_3 = StreamFreezeGate(Data=values_14.Values, PassingSwitch=invert(values_14.Values))
freeze_gate_4 = StreamFreezeGate(Data=values_15.Values, PassingSwitch=invert(values_15.Values))
bool_2 = Boolean(invert(freeze_gate_2))
tap = TapBuffer(Reset=False, Incremental=True, Valve=bool, Hold=True)
tap_2 = TapBuffer(Reset=False, Incremental=True, Valve=bool_2, Hold=True)
bool_3 = Boolean(invert(freeze_gate_3))
bool_4 = Boolean(invert(freeze_gate_4))
dam = DataDam(DataA=tap, BufferDelay=2500000, BufferMode=2)
dam_2 = DataDam(DataA=tap_2, BufferDelay=2500000, BufferMode=2)
tap_3 = TapBuffer(Reset=False, Incremental=True, Valve=bool_3, Hold=True)
tap_4 = TapBuffer(Reset=False, Incremental=True, Valve=bool_4, Hold=True)
equals = Equality(FirstNumber=tap, SecondNumber=dam)  # -> Equality, Inequality
equals_2 = Equality(FirstNumber=tap_2, SecondNumber=dam_2)  # -> Equality, Inequality
dam_3 = DataDam(DataA=tap_3, BufferDelay=2500000, BufferMode=2)
dam_4 = DataDam(DataA=tap_4, BufferDelay=2500000, BufferMode=2)
event = EventGate(Data=equals.Inequality)  # -> Data, IsNew
equals_3 = Equality(FirstNumber=tap_3, SecondNumber=dam_3)  # -> Equality, Inequality
equals_4 = Equality(FirstNumber=tap_4, SecondNumber=dam_4)  # -> Equality, Inequality

# ---- group: Launch
# Launch Heath
fly_2 = HeathFly()  # -> flying
# ---------- fly_2: Python ----------
# Copyright (c) 2024, Heath.
# You should have received a copy of the GNU Affero General Public License
# along with Heath; If not, see <http://www.gnu.org/licenses/>.
# 
# @license AGPL-3.0-or-later <https://spdx.org/licenses/AGPL-3.0-or-later>

import Grasshopper, scriptcontext
import os, sys, importlib

sys.path.append(Grasshopper.Folders.UserObjectFolders[0])

# make sure we can import ladybug tools
ladybug_tools_path = "ladybug_tools\\python\\Lib\\site-packages\\"
program_files_dir = os.path.dirname(f"{os.environ['ProgramFiles']}\\{ladybug_tools_path}")
if os.path.isdir(program_files_dir):
    sys.path.append(program_files_dir)
else:
    user_folder_dir = os.path.dirname(f"{os.path.expanduser('~')}\\{ladybug_tools_path}")
    if os.path.isdir(user_folder_dir):
        sys.path.append(user_folder_dir)
    else:
        raise Exception("Couldn't find Ladybug tools python module path")

try:
    import heath
    importlib.reload(heath)
except Exception as e:
    # hack to allow the module to reside in the repo
    sys.path.append(os.path.join(os.path.dirname(ghdoc.Path), '..\src'))
    import heath
    importlib.reload(heath)

ghenv.Component.Name = 'Heath - Fly!'
ghenv.Component.NickName = 'Fly!'

scriptcontext.sticky["heath_flying"] = 'true'
ghenv.Component.Message = heath.heath_globals.version

flying = True
# ---------- end fly_2 ----------
heath_flying = RemoteSender(fly_2)

# ----
heath_flying_2 = RemoteReceiver(heath_flying)
heath_flying_3 = RemoteReceiver(heath_flying)
heath_flying_4 = RemoteReceiver(heath_flying)
py3 = Python3Script(get=heath_flying_2)  # -> mpl_folder
# ---------- py3: Python ----------
"""Grasshopper Script"""
import heath

if __name__ == "__main__":
    if get:
        print(ghdoc)
        mpl_folder = heath.get_results_folder(ghdoc)
# ---------- end py3 ----------
py3_2 = Python3Script(get=heath_flying_3)  # -> mpl_folder; same code as py3
py3_3 = Python3Script(get=heath_flying_4)  # -> mpl_folder; same code as py3
filepicker = CreateFilePicker(ButtonLabelText="Save materials to file", DialogType=1, MustExist=True, Filter="Text file|*.txt", StartingPath=py3)
filepicker_2 = CreateFilePicker(ButtonLabelText="Save constructions to file", DialogType=1, MustExist=True, Filter="Text file|*.txt", StartingPath=py3_2)
filepicker_3 = CreateFilePicker(ButtonLabelText="Save windows to file", DialogType=1, MustExist=True, Filter="Text file|*.txt", StartingPath=py3_3)
values_16 = ValueListener(Elements=filepicker, SomeProperty=True)  # -> Values, Indices
values_17 = ValueListener(Elements=filepicker_2, SomeProperty=True)  # -> Values, Indices
bool_5 = Boolean(values_16.Values)
values_18 = ValueListener(Elements=filepicker_3, SomeProperty=True)  # -> Values, Indices
null = NullItem(Item=bool_5)  # -> NullFlags, InvalidFlags, Description
save_materials_file = RemoteSender(values_16.Values)
bool_6 = Boolean(values_17.Values)
bool_7 = Boolean(values_18.Values)
save_constructions_file = RemoteSender(values_17.Values)
null_2 = NullItem(Item=bool_6)  # -> NullFlags, InvalidFlags, Description
null_3 = NullItem(Item=bool_7)  # -> NullFlags, InvalidFlags, Description
save_windows_file = RemoteSender(values_18.Values)
hideshow_5 = HideShowElement(ElementToHideShow=button_4, Show=null.NullFlags, Collapse=True, Disable=False)
hideshow_6 = HideShowElement(ElementToHideShow=button_5, Show=null_2.NullFlags, Collapse=True, Disable=False)
hideshow_7 = HideShowElement(ElementToHideShow=button_6, Show=null_3.NullFlags, Collapse=True, Disable=False)
sync_window_database = RemoteSender(event.Data)
entwine_9 = Entwine(Branch00=filepicker, Branch01=button_4, FlattenInputs=True)  # -> flatten(Result)
entwine_10 = Entwine(Branch00=filepicker_2, Branch01=button_5, FlattenInputs=True)  # -> flatten(Result)
entwine_11 = Entwine(Branch00=filepicker_3, Branch01=button_6, FlattenInputs=True)  # -> flatten(Result)
stack_8 = CreateStack(UIElements=entwine_9, Horizontal=True)
stack_9 = CreateStack(UIElements=entwine_10, Horizontal=True)
adjustpos_4 = AdjustElementPositioning(ElementsToAdjust=button_4, AbsolutePositioning=False, Height=Slider(32, range=0..300), HorizontalAlignment=0)
adjustpos_5 = AdjustElementPositioning(ElementsToAdjust=button_5, AbsolutePositioning=False, Height=Slider(32, range=0..300), HorizontalAlignment=0)
adjustpos_6 = AdjustElementPositioning(
    ElementsToAdjust=filepicker_2,
    AbsolutePositioning=False,
    Width=Slider(180, range=0..300),
    Height=Slider(32, range=0..300),
    HorizontalAlignment=0)
adjustpos_7 = AdjustElementPositioning(
    ElementsToAdjust=filepicker,
    Margin="5, 20, 0, 0",
    AbsolutePositioning=False,
    Width=Slider(180, range=0..300),
    Height=Slider(32, range=0..300),
    HorizontalAlignment=0)
stack_10 = CreateStack(UIElements=entwine_11, Horizontal=True)
adjustpos_8 = AdjustElementPositioning(
    ElementsToAdjust=filepicker_3,
    AbsolutePositioning=False,
    Width=Slider(180, range=0..300),
    Height=Slider(32, range=0..300),
    HorizontalAlignment=0)
adjustpos_9 = AdjustElementPositioning(ElementsToAdjust=button_6, AbsolutePositioning=False, Height=Slider(32, range=0..300), HorizontalAlignment=0)

heath_flying_5 = RemoteReceiver(heath_flying)
heath_flying_6 = RemoteReceiver(heath_flying)
py3_4 = Python3Script(get=heath_flying_5)  # -> mpl_folder; same code as py3
py3_5 = Python3Script(get=heath_flying_6)  # -> mpl_folder; same code as py3
button_7 = CreateButton(ButtonName="Load state", ButtonStyle=0)
filepicker_4 = CreateFilePicker(ButtonLabelText="Pick state", DialogType=0, MustExist=True, Filter="Textdokument|*.txt", StartingPath=py3_4)
filepicker_5 = CreateFilePicker(ButtonLabelText="Save location", DialogType=1, MustExist=True, Filter="Textdokument|*.txt", StartingPath=py3_5)
button_8 = CreateButton(ButtonName="Save state", ButtonStyle=0)
true_button_5 = CreateTrueOnlyButton(ButtonName="Help!", ButtonStyle=0)
values_19 = ValueListener(Elements=true_button_5, SomeProperty=True)  # -> Values, Indices
values_20 = ValueListener(Elements=filepicker_5, SomeProperty=True)  # -> Values, Indices
values_21 = ValueListener(Elements=button_8, SomeProperty=True)  # -> Values, Indices
values_22 = ValueListener(Elements=filepicker_4, SomeProperty=True)  # -> Values, Indices
values_23 = ValueListener(Elements=button_7, SomeProperty=True)  # -> Values, Indices
help_button = RemoteSender(values_19.Values)
save_state = RemoteSender(values_21.Values)
save_location = RemoteSender(values_20.Values)
load_state_file = RemoteSender(values_22.Values)
load_state = RemoteSender(values_23.Values)
bool_8 = Boolean(values_20.Values)
bool_9 = Boolean(values_22.Values)
null_4 = NullItem(Item=bool_8)  # -> NullFlags, InvalidFlags, Description
null_5 = NullItem(Item=bool_9)  # -> NullFlags, InvalidFlags, Description
entwine_12 = Entwine(
    Branch00=true_button_5,
    Branch01=filepicker_5,
    Branch02=button_8,
    Branch03=filepicker_4,
    Branch04=button_7,
    FlattenInputs=True)  # -> flatten(Result)
hideshow_8 = HideShowElement(ElementToHideShow=button_8, Show=null_4.NullFlags, Collapse=True, Disable=False)
hideshow_9 = HideShowElement(ElementToHideShow=button_7, Show=null_5.NullFlags, Collapse=True, Disable=False)
stack_11 = CreateStack(UIElements=entwine_12, Horizontal=invert(True))
number_slider_6 = Slider(30, range=0..100)
number_slider_7 = Slider(50, range=0..100)
adjustpos_10 = AdjustElementPositioning(ElementsToAdjust=true_button_5, AbsolutePositioning=invert(False), HorizontalAlignment=1, VerticalAlignment=2)
adjustpos_11 = AdjustElementPositioning(
    ElementsToAdjust=filepicker_5,
    AbsolutePositioning=invert(False),
    Width=Slider(90, range=0..100),
    Height=Slider(32, range=0..100),
    HorizontalAlignment=1,
    VerticalAlignment=2)
adjustpos_12 = AdjustElementPositioning(
    ElementsToAdjust=filepicker_4,
    AbsolutePositioning=invert(False),
    Width=Slider(90, range=0..100),
    Height=Slider(32, range=0..100),
    HorizontalAlignment=1,
    VerticalAlignment=2)

# ----
# Basic material database
number_slider_8 = Slider(0.035, range=0.001..1)
basic_material_database_does_not_allow_c = Panel("""Expanded polystyrene
Mineral wool
Timber
Solid brick
Gypsum plasterboard
Medium density concrete
Ceramic and porcelain
Steel
Crystalline stone
Soil/sand/gravel""")  # "Basic material database, (does not allow comma)"
lng = ListLength(List=basic_material_database_does_not_allow_c)
entwine_13 = Entwine(
    Branch00=number_slider_8,
    Branch01=Slider(0.035, range=0.001..1),
    Branch02=Slider(0.13, range=0.001..1),
    Branch03=Slider(0.8, range=0.001..1),
    Branch04=Slider(0.21, range=0.001..1),
    Branch05=Slider(1.65, range=0.001..5),
    Branch06=Slider(1.3, range=0.001..5),
    Branch07=Slider(50, range=0.001..100),
    Branch08=Slider(3.5, range=0.001..5),
    Branch09=Slider(2, range=0.001..5),
    FlattenInputs=True)  # -> flatten(Result)
entwine_14 = Entwine(
    Branch00=Slider(30, range=1..10000),
    Branch01=Slider(100, range=1..10000),
    Branch02=Slider(500, range=1..10000),
    Branch03=Slider(1800, range=1..10000),
    Branch04=Slider(700, range=1..10000),
    Branch05=Slider(2200, range=1..10000),
    Branch06=Slider(2300, range=1..10000),
    Branch07=Slider(7800, range=1..10000),
    Branch08=Slider(2800, range=1..10000),
    Branch09=Slider(1950, range=1..10000),
    FlattenInputs=True)  # -> flatten(Result)
entwine_15 = Entwine(
    Branch00=Slider(1450, range=1..10000),
    Branch01=Slider(1030, range=1..10000),
    Branch02=Slider(1600, range=1..10000),
    Branch03=Slider(1000, range=1..10000),
    Branch04=Slider(1000, range=1..10000),
    Branch05=Slider(1000, range=1..10000),
    Branch06=Slider(840, range=1..10000),
    Branch07=Slider(450, range=1..10000),
    Branch08=Slider(1000, range=1..10000),
    Branch09=Slider(1050, range=1..10000),
    FlattenInputs=True)  # -> flatten(Result)
repeat = RepeatData(Data="inf", Length=lng)
material_database_categories_3 = RemoteReceiver(material_database_categories_2)
entwine_16 = Entwine(
    Branch00=Slider(3, range=1..9),
    Branch01=Slider(3, range=1..9),
    Branch02=Slider(6, range=1..9),
    Branch03=Slider(0, range=0..9),
    Branch04=Slider(1, range=1..9),
    Branch05=Slider(2, range=1..9),
    Branch06=Slider(0, range=0..9),
    Branch07=Slider(7, range=1..9),
    Branch08=Slider(4, range=1..9),
    Branch09=Slider(9, range=1..9),
    FlattenInputs=True)  # -> flatten(Result)
opaquemat_2 = HBOpaqueMaterial(
    name=basic_material_database_does_not_allow_c,
    thickness=repeat,
    conductivity=entwine_13,
    density=entwine_14,
    spec_heat=entwine_15)  # -> out, mat; plug-in component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
item = ListItem(List=material_database_categories_3, Index=entwine_16, Wrap=True)
objtostr = HBObjectToString(hb_obj=opaquemat_2.mat)  # -> hb_str; plug-in component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
concat = Concatenate(FragmentA=basic_material_database_does_not_allow_c, FragmentB=":", FragmentC=item)
lng_2 = ListLength(List=objtostr)
panel_14 = Panel(concat)
lng_3 = ListLength(List=concat)
bool_10 = Boolean(lng_2)
bool_11 = Boolean(lng_3)
getdocumentusertext = Python3Script(run=bool_10, key="Heath materials")  # -> json_string
# ---------- getdocumentusertext: Python ----------
import Rhino
import rhinoscriptsyntax as rs
import scriptcontext as sc

if run:
    sc.doc = Rhino.RhinoDoc.ActiveDoc

    json_string = rs.GetDocumentUserText(key)

    sc.doc = ghdoc
# ---------- end getdocumentusertext ----------
getdocumentusertext_2 = Python3Script(run=bool_11, key="Heath materials category")  # -> json_string; same code as getdocumentusertext
entwine_17 = Entwine(Branch00=objtostr, Branch01=getdocumentusertext, FlattenInputs=True)  # -> flatten(Result)
entwine_18 = Entwine(Branch00=concat, Branch01=getdocumentusertext_2, FlattenInputs=True)  # -> flatten(Result)
join = TextJoin(Text=entwine_17, Join="|")
join_2 = TextJoin(Text=entwine_18, Join="|")
setdocumentusertext = Python3Script(key="Heath materials", value=join)  # -> out, done
# ---------- setdocumentusertext: Python ----------
import Rhino
import rhinoscriptsyntax as rs
import scriptcontext as sc

def modify_value(value):
    sc.doc = Rhino.RhinoDoc.ActiveDoc

    return rs.SetDocumentUserText(key, value)

    sc.doc = ghdoc
    
if value:
    done = modify_value(value)
# ---------- end setdocumentusertext ----------
setdocumentusertext_2 = Python3Script(key="Heath materials category", value=join_2)  # -> out, done; same code as setdocumentusertext

# ----
# Transparent window
panel_15 = Panel("Import geometry")
pickbtn = CreateRhinoPickButton(
    ButtonName=panel_15,
    Prompt="Please select geometry...",
    AllowMultiple=invert(True),
    AllowNone=True,
    Type=2,
    ButtonStyle=0)
values_24 = ValueListener(Elements=pickbtn, SomeProperty=True)  # -> Values, Indices
launchxpwin = LaunchTransparentWindow(Show=Toggle(False), Name="Control Window", Width=370, Height=400, ChildStatus=1, EnableHorizScroll=False)
addelems = AddElements(Window=launchxpwin, Elements=flatten(pickbtn), DoVLChecking=True)  # -> AddedElements, ElementNames
panel_16 = Panel(values_24.Values)

toggle_2 = BooleanToggle(True)

# ----
# Modal UI locations
number_slider_9 = Slider(575, range=0..1000)
pt = ConstructPoint(XCoordinate=Slider(210, range=0..1000), YCoordinate=Slider(210, range=0..1000), ZCoordinate=0)
pt_2 = ConstructPoint(XCoordinate=Slider(65, range=0..1000), YCoordinate=Slider(210, range=0..1000), ZCoordinate=0)
pt_3 = ConstructPoint(XCoordinate=number_slider_9, YCoordinate=Slider(210, range=0..1000), ZCoordinate=0)
heath_window_location = RemoteSender(pt_2)
database_modal_location = RemoteSender(pt)
create_modal_location = RemoteSender(pt_3)

label_11 = CreateLabel(LabelText="[Innermost layer]", LabelSize=12, Justification=0)
label_12 = CreateLabel(LabelText="[Outermost layer]", LabelSize=12, Justification=0)
toggle_3 = BooleanToggle(True)
toggle_4 = BooleanToggle(True)

# ----
# Get Klimatdatabas data
list_8 = ValueList({"Swedish": "sv", "English": "en"}, selected="English")
list_9 = ValueList({"File": "file", "API": "api"}, selected="API")
get_categories = BrimstoneGetCategories(mode=list_9, language=list_8)  # -> out, json_data, categories, klimatdatabas_version
# ---------- get_categories: Python ----------
"""Gets Klimatdatabas from the Boverket API or a file, extracts json data, and resource category names
    Inputs:
        mode: api or file mode
        language: language of database to retrieve
        json_path: path to json file if file mode
    Output:
        json_data: json file as dictionary
        categories: Categories present in the database
        klimatdatabas_version: String representing the version of Klimatdatabas used"""

import scriptcontext
import brimstone
import Grasshopper
import os, io

ghenv.Component.Name = 'Brimstone - Get Categories'
ghenv.Component.NickName = 'Get Categories'
ver = brimstone.globals.version
ghenv.Component.Message = ver

import json

from System.Net import WebRequest
from System.IO import StreamReader
from System.Text import Encoding

def main(mode):    
    if mode == "file":
        json_file = brimstone.globals.kdb_json_path
        json_path = os.path.join(Grasshopper.Folders.UserObjectFolders[0], json_file)
        if not os.path.exists(json_path):
            raise Exception("Failed to open json file, it should reside in [UserComponents folder]/brimstone_data/")
        json_data = get_json_data_from_file(json_path)
    elif mode == "api":
        json_data = get_json_data_from_api()
    else:
        raise Exception("Mode {mode} not supported".format(mode = mode))
    
    categories = get_categories(json_data)
    version = json_data.get("Version") 
    
    return categories, json_data, version

def get_json_data_from_file(json_path):
    f = io.open(json_path, encoding='utf-8')
    json_data = json.load(f)
    return json_data
    
def get_json_data_from_api():
    version = "02.04.000"
    lng = language if language else "en"
    format = "json"

    url = "https://api.boverket.se/klimatdatabas/v2/get-all-resources/{version}/{language}/{format}".format(
        version=version, language=lng, format=format)
    
    request = WebRequest.Create(url)
    
    request.Method = "GET"
    request.Timeout = 5000
    #request.ContentType = "application/json"
    response = request.GetResponse()
    
    stream_reader = StreamReader(response.GetResponseStream())
    json_data = json.loads(stream_reader.ReadToEnd())
    return json_data
    
def get_categories(json_data):
    categories = []
    try:
        for metaCategory in json_data['Categories']:
            for cat in metaCategory["Children"]:
                categories.append(cat["Title"])
    except KeyError:
        raise Exception("Format of JSON data is not supported.")
    return categories

if __name__ == "__main__":
    if not scriptcontext.sticky["brimstone_flying"]:
        raise Exception("The 'Brimstone - Fly' component needs to exist on the canvas")
    categories, json_data, klimatdatabas_version = main(mode)
    json_data = [json_data] # need to put it in an array so GH understands it as a dictionary
# ---------- end get_categories ----------
list_10 = ItemSelector(
    get_categories.categories,
    {"Mineral materials", "Windows, doors and glass", "Paints and sealants", "Concrete", "Insulation", "Steel and other metals", "Blocks and tiles", "Building boards", "Waterproofing", "Solid woods", "Energy and fuel"}, selected="Mineral materials")
panel_17 = Panel(get_categories.klimatdatabas_version)

# ---- group: Request specific outputs
toggle_5 = BooleanToggle(True)
simoutput = HBSimulationOutput(zone_energy_use=toggle_5, gains_and_losses=toggle_5, comfort_metrics=toggle_5, surface_energy_flow=toggle_5)  # -> report, sim_output; plug-in component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
simpar = HBSimulationParameter(output=simoutput.sim_output, timestep=6)  # -> sim_par; plug-in component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

# ----
toggle_6 = BooleanToggle(True)

# ----
# Temporary data for developing UI
element_types = Data(["Aperture", "Grasshopper.Kernel.Types.GH_ObjectWrapper", "Grasshopper.Kernel.Types.GH_ObjectWrapper", "Grasshopper.Kernel.Types.GH_ObjectWrapper"])
gwp_by_element_type = Data(["50", "40", "75", "25"])
placeholder_data = Panel(element_types)
placeholder_data_2 = Panel(gwp_by_element_type)
ma = MassAddition(Input=placeholder_data_2)  # -> Result, PartialResults
total_gwp = Data(ma.Result)
lca_element_types = RemoteSender(placeholder_data)
lca_gwp_by_element_type = RemoteSender(placeholder_data_2)
lca_total_gwp = RemoteSender(total_gwp)

shading_geometry = Data()

# ----
# Create test model
building = Geometry([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])
adjacent_rooms_1 = Geometry([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])
ground = Geometry(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)
site = Geometry([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])
panel_18 = Panel("""Heath::Test model::Rooms
Heath::Test model::Windows
Heath::Test model::Adjacent
Heath::Test model::Context""")
adjacent_rooms_2 = Geometry([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])
entwine_19 = Entwine(Branch00="Room", Branch01="Window", Branch02="Adjacent", Branch03="Context", FlattenInputs=True)
merge_3 = Merge(Data1=ground, Data2=site, Data3=building, Data4=adjacent_rooms_1)
merge_4 = Merge(Data1=ground, Data2=site, Data3=building, Data4=adjacent_rooms_2)
lng_4 = ListLength(List=flatten(entwine_19))
ef_layer = EleFrontLayer(FullPath=panel_18)  # -> graft(Layer), FullPath, Hidden, Locked, DisplayColour, MaterialName, Linetype, PrintColour, PrintWidth
repeat_2 = RepeatData(Data="Heath geometry type", Length=lng_4)  # -> graft(Data)
ef_att = EleFrontAttributes(Keys=repeat_2, Values=entwine_19, Layer=ef_layer.Layer)  # -> Attributes, Keys, Values, Name, Layer, ColourSource, DisplayColour, MaterialSource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

# ----
# Model 1
windows1 = Geometry([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])
room1 = Geometry(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)
adjacent_1 = Geometry([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])
context_1 = Geometry(merge_3)

# ----
# Model 2
geo = Geometry(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)
adjacent_2 = Geometry([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])
geo_2 = Geometry([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])
context_2 = Geometry(merge_4)

entwine_20 = Entwine(Branch00=room1, Branch01=windows1, Branch02=adjacent_1, Branch03=context_1, FlattenInputs=True)
lng_5 = ListLength(List=entwine_20)
repeat_3 = RepeatData(Data=ef_att.Attributes, Length=lng_5)

# ----
# Database constructions
panel_19 = Panel("{0} (U-factor: {1})")

# ----
# Database windows
generic_u_value = Data(1.687787378)
generic_shgc = Data(0.4240807069)

# ----
# Database materials
panel_20 = Panel("{0} (conductivity: {1}, density: {2}, specific heat: {3})")

# ----
# Visualize module
panel_21 = Panel("""properties.energy.construction.display_name
properties.energy.construction.layers
properties.energy.construction.thickness
properties.energy.construction.mass_area_density
properties.energy.construction.area_heat_capacity
properties.energy.construction.r_value
properties.energy.construction.u_value
properties.energy.construction.u_factor
properties.energy.construction.shgc
properties.energy.r_factor
properties.energy.u_factor
properties.energy.shgc""")
panel_22 = Panel("""properties.energy.program_type.display_name
properties.energy.construction_set.display_name
properties.energy.is_conditioned
properties.energy.people.people_per_area
properties.energy.people.area_per_person
properties.energy.lighting.watts_per_area
properties.energy.electric_equipment.watts_per_area
properties.energy.gas_equipment.watts_per_area
properties.energy.service_hot_water.flow_per_area""")
panel_23 = Panel("""Sky dome
Sky mask
Wind rose
Dry bulb temperature line chart
Dry bulb temperature 2D chart
Direct sun hours
Incident radiation""")
panel_24 = Panel("""display_name
identifier
multiplier
exclude_floor_area
story
volume
floor_area
exposed_area
exterior_wall_area
exterior_aperture_area
average_floor_height""")
panel_25 = Panel("""display_name
identifier
boundary_condition
has_parent
parent
azimuth
altitude
area
perimeter
type
is_operable
is_glass""")
button_9 = CreateButton(ButtonName="Run weather visualization", ButtonStyle=0)
button_10 = CreateButton(ButtonName="Zoom", ButtonStyle=0)
button_11 = CreateButton(ButtonName="Bake", ButtonStyle=0)
values_25 = ValueListener(Elements=button_10, SomeProperty=True)  # -> Values, Indices
values_26 = ValueListener(Elements=button_11, SomeProperty=True)  # -> Values, Indices
values_27 = ValueListener(Elements=button_9, SomeProperty=True)  # -> Values, Indices
pulldown = CreatePulldownMenu(Label="Type", ListItems=panel_23, showLabel=True)
checkbox = CreateCheckbox(Label="Visualize", StartingValue=False)
panel_26 = Panel("""Program
Construction Set
Is Conditioned
People per Area [ppl/m2]
Area per Person [m2/ppl]
Lighting per Area [W/m2]
Electric Equipment per Area [W/m2]
Gas Equipment per Area [W/m2]
Hot Water per Area [L/h-m2]""")
panel_27 = Panel("""Display Name
Simulation Name (Identifier)
Boundary Condition
Has Parent
Parent
Azimuth
Altitude
Area
Perimeter
Face Type
Aperture Is Operable
Door Is Glass""")
panel_28 = Panel("""Construction
Materials
Thickness [m]
Density [kg/m2]
Heat Capacity [J/K-m2]
Construction R-Value [m2-K/W]
Construction U-Value [W/m2-K]
Construction U-Factor [W/m2-K]
Construction SHGC [Unshaded]
R-Factor [m2-K/W]
U-Factor [W/m2-K]
SHGC [Unshaded]""")
panel_29 = Panel("""Display Name
Simulation Name (Identifier)
Multiplier
Floor Area Excluded
Story
Volume
Gross Floor Area
Exposed Area
Exterior Wall Area
Exterior Aperture Area
Average Floor Elevation""")
zoom_weather_visualization = RemoteSender(values_25.Values)
freeze_gate_5 = StreamFreezeGate(Data=values_26.Values, PassingSwitch=invert(values_26.Values))
freeze_gate_6 = StreamFreezeGate(Data=values_27.Values, PassingSwitch=invert(values_27.Values))
values_28 = ValueListener(Elements=checkbox, SomeProperty=True)  # -> Values, Indices
values_29 = ValueListener(Elements=pulldown, SomeProperty=True)  # -> Values, Indices
bool_12 = Boolean(invert(freeze_gate_5))
bool_13 = Boolean(invert(freeze_gate_6))
entwine_21 = Entwine(Branch00=pulldown, Branch01=checkbox, FlattenInputs=True)  # -> flatten(Result)
weather_visualization_type = RemoteSender(values_29.Indices)
tap_5 = TapBuffer(Reset=False, Incremental=True, Valve=bool_12, Hold=True)
tap_6 = TapBuffer(Reset=False, Incremental=True, Valve=bool_13, Hold=True)
stack_12 = CreateStack(UIElements=entwine_21, Horizontal=True)
pulldown_2 = CreatePulldownMenu(Label="Room attribute", ListItems=panel_29, showLabel=True)
pulldown_3 = CreatePulldownMenu(Label="Room energy attribute", ListItems=panel_26, showLabel=True)
checkbox_2 = CreateCheckbox(Label="Visualize", StartingValue=False)
checkbox_3 = CreateCheckbox(Label="Visualize", StartingValue=False)
label_13 = CreateLabel(LabelText="Model visualization", LabelSize=18, Justification=0)
checkbox_4 = CreateCheckbox(Label="Visualize", StartingValue=False)
pulldown_4 = CreatePulldownMenu(Label="Face attribute", ListItems=panel_27, showLabel=True)
dam_5 = DataDam(DataA=tap_5, BufferDelay=2500000, BufferMode=2)
dam_6 = DataDam(DataA=tap_6, BufferDelay=2500000, BufferMode=2)
entwine_22 = Entwine(Branch00=button_9, Branch01=button_10, Branch02=button_11, FlattenInputs=True)  # -> flatten(Result)
pulldown_5 = CreatePulldownMenu(Label="Face energy attribute", ListItems=panel_28, showLabel=True)
checkbox_5 = CreateCheckbox(Label="Visualize", StartingValue=False)
equals_5 = Equality(FirstNumber=tap_6, SecondNumber=dam_6)  # -> Equality, Inequality
equals_6 = Equality(FirstNumber=tap_5, SecondNumber=dam_5)  # -> Equality, Inequality
values_30 = ValueListener(Elements=checkbox_3, SomeProperty=True)  # -> Values, Indices
values_31 = ValueListener(Elements=pulldown_3, SomeProperty=True)  # -> Values, Indices
entwine_23 = Entwine(Branch00=pulldown_2, Branch01=checkbox_2, FlattenInputs=True)  # -> flatten(Result)
entwine_24 = Entwine(Branch00=pulldown_3, Branch01=checkbox_3, FlattenInputs=True)  # -> flatten(Result)
values_32 = ValueListener(Elements=pulldown_2, SomeProperty=True)  # -> Values, Indices
values_33 = ValueListener(Elements=pulldown_4, SomeProperty=True)  # -> Values, Indices
values_34 = ValueListener(Elements=checkbox_2, SomeProperty=True)  # -> Values, Indices
values_35 = ValueListener(Elements=checkbox_4, SomeProperty=True)  # -> Values, Indices
entwine_25 = Entwine(Branch00=pulldown_4, Branch01=checkbox_4, FlattenInputs=True)  # -> flatten(Result)
values_36 = ValueListener(Elements=pulldown_5, SomeProperty=True)  # -> Values, Indices
entwine_26 = Entwine(Branch00=pulldown_5, Branch01=checkbox_5, FlattenInputs=True)  # -> flatten(Result)
values_37 = ValueListener(Elements=checkbox_5, SomeProperty=True)  # -> Values, Indices
stack_13 = CreateStack(UIElements=entwine_22, Horizontal=True)
item_2 = ListItem(List=panel_22, Index=values_31.Indices, Wrap=invert(True))
item_3 = ListItem(List=panel_24, Index=values_32.Indices, Wrap=invert(True))
stack_14 = CreateStack(UIElements=entwine_24, Horizontal=True)
item_4 = ListItem(List=panel_25, Index=values_33.Indices, Wrap=invert(True))
stack_15 = CreateStack(UIElements=entwine_23, Horizontal=True)
item_5 = ListItem(List=panel_21, Index=values_36.Indices, Wrap=invert(True))
stack_16 = CreateStack(UIElements=entwine_25, Horizontal=True)
stack_17 = CreateStack(UIElements=entwine_26, Horizontal=True)
room_energy_attribute = RemoteSender(item_2)
room_attribute = RemoteSender(item_3)
entwine_27 = Entwine(Branch00=stack_13, Branch01=stack_12, FlattenInputs=True)  # -> flatten(Result)
face_attribute = RemoteSender(item_4)
face_energy_attribute = RemoteSender(item_5)
stack_18 = CreateStack(UIElements=entwine_27, Horizontal=invert(True))
hideshow_10 = HideShowElement(ElementToHideShow=checkbox_2, Show=True, Collapse=True, Disable=values_30.Values)
hideshow_11 = HideShowElement(ElementToHideShow=checkbox_3, Show=True, Collapse=True, Disable=values_34.Values)
hideshow_12 = HideShowElement(ElementToHideShow=checkbox_4, Show=True, Collapse=True, Disable=values_37.Values)
hideshow_13 = HideShowElement(ElementToHideShow=checkbox_5, Show=True, Collapse=True, Disable=values_35.Values)
entwine_28 = Entwine(Branch00=label_13, Branch01=stack_15, Branch02=stack_14, Branch03=stack_16, Branch04=stack_17, FlattenInputs=True)  # -> flatten(Result)
border = CreateBorder(
    UIElement=stack_18,
    BorderThickness=Slider(1, range=0..10),
    BorderColor=ColourSwatch(SwatchColor=RGB(217, 217, 217)),
    CornerRadius=Slider(2, range=0..10))
adjustpos_13 = AdjustElementPositioning(ElementsToAdjust=stack_18, AbsolutePositioning=False, Width=Slider(300, range=0..300), HorizontalAlignment=0)
adjustpos_14 = AdjustElementPositioning(ElementsToAdjust=pulldown, Margin="5, 5, 0, 0", AbsolutePositioning=False, Width=Slider(215, range=0..400))
adjustpos_15 = AdjustElementPositioning(ElementsToAdjust=checkbox, Margin="5, 5, 0, 0", AbsolutePositioning=False)
stack_19 = CreateStack(UIElements=entwine_28, Horizontal=invert(True))
adjustpos_16 = AdjustElementPositioning(
    ElementsToAdjust=[pulldown_2, pulldown_3, pulldown_4, pulldown_5],
    AbsolutePositioning=False,
    Width=Slider(239, range=0..400),
    HorizontalAlignment=0)
adjustpos_17 = AdjustElementPositioning(ElementsToAdjust=border, AbsolutePositioning=False, HorizontalAlignment=0, VerticalAlignment=2)
border_2 = CreateBorder(
    UIElement=stack_19,
    BorderThickness=Slider(1, range=0..10),
    BorderColor=ColourSwatch(SwatchColor=RGB(217, 217, 217)),
    CornerRadius=Slider(2, range=0..10))
adjustpos_18 = AdjustElementPositioning(ElementsToAdjust=border_2, Margin="0, 0, 0, 10", AbsolutePositioning=False, HorizontalAlignment=0, VerticalAlignment=2)

adjustpos_19 = AdjustElementPositioning(ElementsToAdjust=[checkbox_2, checkbox_3, checkbox_4, checkbox_5], Margin="0, 0, 10, 0", AbsolutePositioning=False)
entwine_29 = Entwine(Branch00=label_13, Branch01=border_2, FlattenInputs=True)  # -> flatten(Result)
entwine_30 = Entwine(Branch00=label_3, Branch01=border, FlattenInputs=True)  # -> flatten(Result)

# ----
# Attributes visualization
location_3 = Data(entwine_29)

# ----
# Run weather visualization
location_4 = Data(entwine_30)

entwine_31 = Entwine(Branch00=location_3, Branch01=location_4, FlattenInputs=True)  # -> flatten(Result)
stack_20 = CreateStack(UIElements=entwine_31, Horizontal=invert(True))

# ----
# Geometry module
number_slider_10 = Slider(-20, range=-100..0)
panel_30 = Panel("""The document is currently in {0}.
Honeybee models require models in meters.""")
panel_31 = Panel("""Room
Window
Adjacent
Context
None""")
number_slider_11 = Slider(15, range=0..20)
number_slider_12 = Slider(15, range=0..20)
number_slider_13 = Slider(15, range=0..20)
number_slider_14 = Slider(15, range=0..20)
number_slider_15 = Slider(10, range=0..10)
number_slider_16 = Slider(10, range=0..10)
number_slider_17 = Slider(10, range=0..10)
number_slider_18 = Slider(10, range=0..10)
button_12 = CreateButton(ButtonName="Change document units", ButtonStyle=0)
tb = CreateTextBlock(TextSize=12, Justification=0)
label_14 = CreateLabel(LabelText="Import geometry", LabelSize=18, Justification=0)
label_15 = CreateLabel(LabelText="Preview geometry", LabelSize=18, Justification=0)
pulldown_6 = CreatePulldownMenu(Label="Geometry type", ListItems=panel_31, showLabel=True)
button_13 = CreateButton(ButtonName="Save geometry", ButtonStyle=0)
pt_4 = ConstructPoint(XCoordinate=Slider(10, range=0..10), YCoordinate=number_slider_10, ZCoordinate=0)
pt_5 = ConstructPoint(XCoordinate=Slider(10, range=0..10), YCoordinate=Slider(-20, range=-100..0), ZCoordinate=0)
pt_6 = ConstructPoint(XCoordinate=Slider(10, range=0..10), YCoordinate=Slider(-20, range=-100..0), ZCoordinate=0)
pt_7 = ConstructPoint(XCoordinate=Slider(10, range=0..10), YCoordinate=Slider(-20, range=-100..0), ZCoordinate=0)
button_14 = CreateButton(ButtonName="Create test model", ButtonStyle=0)
values_38 = ValueListener(Elements=listbox, SomeProperty=True)  # -> Values, Indices
rectangle = Rectangle(Plane=PlaneXY(0, 0, 0), XSize=number_slider_16, YSize=number_slider_16, Radius=0)  # -> Rectangle, Length
rectangle_2 = Rectangle(Plane=PlaneXY(0, 0, 0), XSize=number_slider_15, YSize=number_slider_15, Radius=0)  # -> Rectangle, Length
rectangle_3 = Rectangle(Plane=pt_4, XSize=number_slider_12, YSize=number_slider_12, Radius=0)  # -> Rectangle, Length
rectangle_4 = Rectangle(Plane=pt_5, XSize=number_slider_11, YSize=number_slider_11, Radius=0)  # -> Rectangle, Length
rectangle_5 = Rectangle(Plane=PlaneXY(0, 0, 0), XSize=number_slider_17, YSize=number_slider_17, Radius=0)  # -> Rectangle, Length
values_39 = ValueListener(Elements=button_12, SomeProperty=True)  # -> Values, Indices
rectangle_6 = Rectangle(Plane=pt_6, XSize=number_slider_13, YSize=number_slider_13, Radius=0)  # -> Rectangle, Length
rectangle_7 = Rectangle(Plane=PlaneXY(0, 0, 0), XSize=number_slider_18, YSize=number_slider_18, Radius=0)  # -> Rectangle, Length
rectangle_8 = Rectangle(Plane=pt_7, XSize=number_slider_14, YSize=number_slider_14, Radius=0)  # -> Rectangle, Length
values_40 = ValueListener(Elements=pulldown_6, SomeProperty=True)  # -> Values, Indices
values_41 = ValueListener(Elements=button_14, SomeProperty=True)  # -> Values, Indices
shapes = CreateShapes(Shapes=rectangle.Rectangle, StrokeColor=RGB(0, 0, 0), Scale=1, ClickMode=3)
shapes_2 = CreateShapes(Shapes=rectangle_2.Rectangle, StrokeColor=RGB(0, 0, 0), Scale=1, ClickMode=3)
shapes_3 = CreateShapes(Shapes=rectangle_5.Rectangle, StrokeColor=RGB(0, 0, 0), Scale=1, ClickMode=3)
shapes_4 = CreateShapes(Shapes=rectangle_7.Rectangle, StrokeColor=RGB(0, 0, 0), Scale=1, ClickMode=3)
previewtype = RemoteSender(values_38.Values)
change_document_units = RemoteSender(values_39.Values)
geometrytype_validate = RemoteSender(values_40.Indices)
geometrytype = RemoteSender(values_40.Values)
freeze_gate_7 = StreamFreezeGate(Data=values_41.Values, PassingSwitch=invert(values_41.Values))
bool_14 = Boolean(invert(freeze_gate_7))
setshapes = SetShapes(
    ShapeToModify=shapes,
    ShapeCurves=rectangle_3.Rectangle,
    FillColors=ColourSwatch(SwatchColor=RGBA(128, 0, 102, 75)),
    StrokeColors=ColourSwatch(SwatchColor=RGB(255, 255, 255)),
    Scale=1)
setshapes_2 = SetShapes(
    ShapeToModify=shapes_2,
    ShapeCurves=rectangle_4.Rectangle,
    FillColors=ColourSwatch(SwatchColor=RGBA(4, 128, 0, 75)),
    StrokeColors=ColourSwatch(SwatchColor=RGB(255, 255, 255)),
    Scale=1)
setshapes_3 = SetShapes(
    ShapeToModify=shapes_3,
    ShapeCurves=rectangle_6.Rectangle,
    FillColors=ColourSwatch(SwatchColor=RGBA(0, 17, 128, 75)),
    StrokeColors=ColourSwatch(SwatchColor=RGB(255, 255, 255)),
    Scale=1)
setshapes_4 = SetShapes(
    ShapeToModify=shapes_4,
    ShapeCurves=rectangle_8.Rectangle,
    FillColors=ColourSwatch(SwatchColor=RGBA(128, 125, 0, 75)),
    StrokeColors=ColourSwatch(SwatchColor=RGB(255, 255, 255)),
    Scale=1)
tap_7 = TapBuffer(Reset=False, Incremental=True, Valve=bool_14, Hold=True)
entwine_32 = Entwine(Branch00=tb, Branch01=button_12, FlattenInputs=True)  # -> flatten(Result)
dam_7 = DataDam(DataA=tap_7, BufferDelay=2500000, BufferMode=2)
stack_21 = CreateStack(UIElements=entwine_32, Horizontal=invert(True))
equals_7 = Equality(FirstNumber=tap_7, SecondNumber=dam_7)  # -> Equality, Inequality
adjustpos_20 = AdjustElementPositioning(ElementsToAdjust=button_14, Margin="10, 15, 0, 0", AbsolutePositioning=False)
adjustpos_21 = AdjustElementPositioning(
    ElementsToAdjust=listbox,
    AbsolutePositioning=False,
    Width=Slider(150, range=0..300),
    Height=Slider(150, range=0..300),
    HorizontalAlignment=0)
adjustpos_22 = AdjustElementPositioning(ElementsToAdjust=stack_21, Margin="5, 5, 0, 0", AbsolutePositioning=False, Width=Slider(160, range=0..800))
entwine_33 = Entwine(Branch00=shapes_2, Branch01=shapes, Branch02=shapes_3, Branch03=shapes_4, FlattenInputs=True)  # -> flatten(Result)
adjustpos_23 = AdjustElementPositioning(ElementsToAdjust=pulldown_6, AbsolutePositioning=False, Width=Slider(180, range=0..300), HorizontalAlignment=0)

values_42 = ValueListener(Elements=button_13, SomeProperty=True)  # -> Values, Indices
bool_15 = Boolean(values_38.Indices)
geometry_module_state_import_type = RemoteSender(values_40.Indices)
adjustelem_3 = AdjustElementAppearance(ElementsToAdjust=tb, Foreground=ColourSwatch(SwatchColor=RGB(0, 0, 0)))
freeze_gate_8 = StreamFreezeGate(Data=values_42.Values, PassingSwitch=invert(values_42.Values))
presavegeometry = RemoteSender(values_42.Values)

# ----
# Document units
doc_units = DocumentUnits()
change_document_units_2 = RemoteReceiver(change_document_units)
document_units = RemoteSender(doc_units)
gate = StreamGate(Stream="4", Gate=change_document_units_2)  # -> Target0, Target1
unit_warning = UnitWarning(UnitSystem=gate.Target1)

bool_16 = Boolean(invert(freeze_gate_8))
entwine_34 = Entwine(Branch00=button_13, Branch01=true_button, FlattenInputs=True)  # -> flatten(Result)
tap_8 = TapBuffer(Reset=False, Incremental=True, Valve=bool_16, Hold=True)
stack_22 = CreateStack(UIElements=entwine_34, Horizontal=True)
dam_8 = DataDam(DataA=tap_8, BufferDelay=2500000, BufferMode=2)
equals_8 = Equality(FirstNumber=tap_8, SecondNumber=dam_8)  # -> Equality, Inequality
entwine_35 = Entwine(Branch00=stack_22, Branch01=label, FlattenInputs=True)  # -> flatten(Result)
stack_23 = CreateStack(UIElements=entwine_33, Horizontal=invert(True))
adjustpos_24 = AdjustElementPositioning(ElementsToAdjust=button_12, AbsolutePositioning=False, Width=Slider(150, range=0..800), HorizontalAlignment=0)
border_3 = CreateBorder(
    UIElement=stack_21,
    BorderThickness=Slider(1, range=0..10),
    BorderColor=ColourSwatch(SwatchColor=RGB(255, 0, 0)),
    CornerRadius=Slider(1, range=0..10))
adjustpos_25 = AdjustElementPositioning(ElementsToAdjust=stack_23, Margin="0, 26, 5, 0", AbsolutePositioning=False, HorizontalAlignment=0)
adjustpos_26 = AdjustElementPositioning(
    ElementsToAdjust=[shapes_4, shapes_3, shapes, shapes_2],
    Margin="0, 0, 0, 4",
    AbsolutePositioning=False,
    HorizontalAlignment=0)

# ----
# Document unit warning text
location_5 = Data(border_3)

# ----
# Test model
location_6 = Data(button_14)

presavegeometry_2 = RemoteReceiver(presavegeometry)

# ----
# Save/restore states
load_state_file_2 = RemoteReceiver(load_state_file)
geometry_module_state_import_type_2 = RemoteReceiver(geometry_module_state_import_type)
load_state_2 = RemoteReceiver(load_state)
save_location_2 = RemoteReceiver(save_location)
save_state_2 = RemoteReceiver(save_state)
gate_2 = StreamGate(Stream=load_state_file_2, Gate=load_state_2)  # -> Target0, Target1
file = ReadFile(File=gate_2.Target0, PerLineParse=True)
writetxt = WriteToTextFile(Run=save_state_2, TextToWrite=geometry_module_state_import_type_2, FilePath=save_location_2, Append=False, NewOnly=False)
geometry_module_loaded_state_import_type = RemoteSender(file)

geometry_module_loaded_state_import_type_2 = RemoteReceiver(geometry_module_loaded_state_import_type)
setlist = SetListContents(ListToModify=pulldown_6, NewListContents=panel_31, SelectedIndex=geometry_module_loaded_state_import_type_2)

# ----
# Program module
panel_32 = Panel("""LargeOffice
MediumOffice
SmallOffice
MidriseApartment
HighriseApartment
Retail
StripMall
PrimarySchool
SecondarySchool
SmallHotel
LargeHotel
Hospital
Outpatient
Laboratory
Warehouse
SuperMarket
FullServiceRestaurant
QuickServiceRestaurant
Courthouse
LargeDataCenterHighITE
LargeDataCenterLowITE
SmallDataCenterHighITE
SmallDataCenterLowITE""")
cooling_setpoint_ºc = Slider(27, range=10..40)
heating_setpoint_ºc = Slider(21, range=10..40)
empty_9 = EmptyObjectToEmptyBranch()
label_16 = CreateLabel(LabelText="Select program", LabelSize=18, Justification=0)
pulldown_7 = CreatePulldownMenu(Label="Room type", ListItems=empty_9, showLabel=True)
pulldown_8 = CreatePulldownMenu(Label="Building type", ListItems=panel_32, SelectedIndex="3", showLabel=True)
slider_6 = CreateSlider(Slider=cooling_setpoint_ºc, ShowBounds=False, ShowTicks=True, ShowTooltip=True, ShowValLabel=True, showLabel=False)
label_17 = CreateLabel(LabelText="Cooling setpoint [ºC]", LabelSize=12, Justification=0)
slider_7 = CreateSlider(Slider=heating_setpoint_ºc, ShowBounds=False, ShowTicks=True, ShowTooltip=False, ShowValLabel=True, showLabel=False)
label_18 = CreateLabel(LabelText="Heating setpoint [ºC]", LabelSize=12, Justification=0)
label_19 = CreateLabel(LabelText="Occupancy [person]", LabelSize=12, Justification=0)
slider_8 = CreateSlider(Slider=Slider(3, range=0..20), ShowBounds=False, ShowTicks=True, ShowTooltip=True, ShowValLabel=True, showLabel=False)
values_43 = ValueListener(Elements=pulldown_8, SomeProperty=True)  # -> Values, Indices
values_44 = ValueListener(Elements=pulldown_7, SomeProperty=True)  # -> Values, Indices
values_45 = ValueListener(Elements=slider_7, SomeProperty=True)  # -> Values, Indices
values_46 = ValueListener(Elements=slider_6, SomeProperty=True)  # -> Values, Indices
tooltip_2 = AttachTooltipToElement(ElementsToAttachTo=slider_7, TooltipContent="Doubleclick to input value", ShowDelay=500, Duration=2000)
values_47 = ValueListener(Elements=slider_8, SomeProperty=True)  # -> Values, Indices
tooltip_3 = AttachTooltipToElement(ElementsToAttachTo=slider_8, TooltipContent="Doubleclick to input value", ShowDelay=500, Duration=2000)
tooltip_4 = AttachTooltipToElement(ElementsToAttachTo=slider_6, TooltipContent="Doubleclick to input value", ShowDelay=500, Duration=2000)
selected_building = RemoteSender(values_43.Values)
selected_room = RemoteSender(values_44.Values)
cooling_setpoint = RemoteSender(values_46.Values)
cooling_setpoint_2 = RemoteReceiver(cooling_setpoint)
subtraction = Subtraction(A=cooling_setpoint_2, B="1")
dom = ConstructDomain(DomainStart=Slider(10, range=0..100), DomainEnd=subtraction)
setslider = SetSlider(UISlider=slider_7, Range=dom)
heating_setpoint = RemoteSender(values_45.Values)
heating_setpoint_2 = RemoteReceiver(heating_setpoint)
addition = Addition(A=heating_setpoint_2, B="1")
dom_2 = ConstructDomain(DomainStart=addition, DomainEnd=Slider(40, range=0..100))
setslider_2 = SetSlider(UISlider=slider_6, Range=dom_2)
occupancy = RemoteSender(values_47.Values)
adjustpos_27 = AdjustElementPositioning(ElementsToAdjust=slider_8, AbsolutePositioning=False, Width=Slider(200, range=0..300), HorizontalAlignment=0)
adjustpos_28 = AdjustElementPositioning(ElementsToAdjust=slider_7, AbsolutePositioning=False, Width=Slider(200, range=0..300), HorizontalAlignment=0)
entwine_36 = Entwine(Branch00=label_16, Branch01=pulldown_8, FlattenInputs=True)  # -> flatten(Result)
entwine_37 = Entwine(Branch01=pulldown_7, FlattenInputs=True)  # -> flatten(Result)
adjustpos_29 = AdjustElementPositioning(ElementsToAdjust=pulldown_7, AbsolutePositioning=False, Width=Slider(250, range=0..300), HorizontalAlignment=0)
entwine_38 = Entwine(Branch00=label_10, Branch01=label_17, Branch02=slider_6, FlattenInputs=True)  # -> flatten(Result)
adjustpos_30 = AdjustElementPositioning(ElementsToAdjust=pulldown_8, AbsolutePositioning=False, Width=Slider(250, range=0..300), HorizontalAlignment=0)
adjustpos_31 = AdjustElementPositioning(ElementsToAdjust=slider_6, AbsolutePositioning=False, Width=Slider(200, range=0..300), HorizontalAlignment=0)
entwine_39 = Entwine(Branch00=label_18, Branch01=slider_7, FlattenInputs=True)  # -> flatten(Result)
entwine_40 = Entwine(Branch00=label_19, Branch01=slider_8, FlattenInputs=True)  # -> flatten(Result)

# ----
# Select building program
location_7 = Data(entwine_36)

# ----
# Select room program
location_8 = Data(entwine_37)

# ----
# Occupancy
location_9 = Data(entwine_40)

# ----
# Heating setpoint
location_10 = Data(entwine_39)

# ----
# Cooling setpoint
location_11 = Data(entwine_38)

# ----
# Define program
# Simplified Boverket data
number_slider_19 = Slider(6, range=0..10)
selected_building_2 = RemoteReceiver(selected_building)
merge_5 = Merge(Data1=Slider(0.8, range=0..10), Data2=Slider(1.2, range=0..10), Data3=Slider(0.8, range=0..10))
merge_6 = Merge(Data1=number_slider_19, Data2=Slider(12, range=0..100), Data3=Slider(6, range=0..10))
python = GhPythonScript(sublist_lengths=merge_6, values=merge_5)  # -> out, out_list; inputs sublist_lengths: list of Int32, values: list
# ---------- python: Python ----------
"""Creates one list from a list of sublist lengths and the value to put in each sublist
    Inputs:
        sublist_lengths: sublist_lengths
        values: value in each sublist
    Output:
        a: The a output variable"""

__author__ = "sawen"
__version__ = "2024.05.24"

import rhinoscriptsyntax as rs

if not (len(sublist_lengths) == len(values)):
    raise Exception("sublist lengths and values must be the same size")

out_list = []

for i in range(len(sublist_lengths)):
    for j in range(int(sublist_lengths[i])):
        out_list.append(values[i])
# ---------- end python ----------
searchprog = HBSearchPrograms(bldg_prog=selected_building_2)  # -> room_prog; plug-in component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
constantschedule = HBConstantSchedule(values=python.out_list, name="household_electricity")  # -> report, schedule, idf_text; plug-in component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
room_programs = RemoteSender(searchprog)
selected_room_2 = RemoteReceiver(selected_room)
occupancy_2 = RemoteReceiver(occupancy)
constantschedule_2 = HBConstantSchedule(values=Slider(1, range=0..1))  # -> report, schedule, idf_text; plug-in component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
constantschedule_3 = HBConstantSchedule(values=Slider(1, range=0..1))  # -> report, schedule, idf_text; plug-in component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
applyloadvals = HBApplyLoadValues(room_or_program=flatten(selected_room_2), people_per_floor=occupancy_2)  # -> report, mod_obj; plug-in component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
cooling_setpoint_3 = RemoteReceiver(cooling_setpoint)
heating_setpoint_3 = RemoteReceiver(heating_setpoint)
python_2 = GhPythonScript(power_density=Slider(2.6, range=0..10), schedule=constantschedule_2.schedule)  # -> out, hot_water
# ---------- python_2: Python ----------
__author__ = "sawen"
__version__ = "2024.05.24"

import rhinoscriptsyntax as rs
from honeybee_energy.load.hotwater import ServiceHotWater as shw

if not name:
    name = "Domestic Hot Water"
    

hot_water = shw.from_watts_per_area(name, power_density, schedule)
# ---------- end python_2 ----------
equipment = HBEquipment(watts_per_area=Slider(3.4, range=0..10), schedule=constantschedule_3.schedule, lost_fract=Slider(0.3, range=0..1))  # -> equip; plug-in component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
applysetpointvals = HBApplySetpointValues(room_or_program=flatten(applyloadvals.mod_obj), cooling_setpt=cooling_setpoint_3, heating_setpt=heating_setpoint_3)  # -> report, mod_obj; plug-in component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
program = Data(applysetpointvals.mod_obj)
programtype = HBProgramType(name="My program", base_program=program, electric_equip=equipment, hot_water=python_2.hot_water)  # -> program; plug-in component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

room_programs_2 = RemoteReceiver(room_programs)
setlist_2 = SetListContents(ListToModify=pulldown_7, NewListContents=room_programs_2, SelectedIndex="0")

# ----
# Assembly model
panel_33 = Panel("https://energyplus-weather.s3.amazonaws.com/europe_wmo_region_6/SWE/SWE_Goteborg.Landvetter.025260_IWEC/SWE_Goteborg.Landvetter.025260_IWEC.zip")
checkbox_6 = CreateCheckbox(Label="Doors", StartingValue=False)
checkbox_7 = CreateCheckbox(Label="Context", StartingValue=False)
checkbox_8 = CreateCheckbox(Label="Windows", StartingValue=False)
checkbox_9 = CreateCheckbox(Label="All", StartingValue=False)
checkbox_10 = CreateCheckbox(Label="Ground", StartingValue=False)
checkbox_11 = CreateCheckbox(Label="Floors", StartingValue=False)
label_20 = CreateLabel(LabelText="Show components", LabelSize=12, Justification=0)
checkbox_12 = CreateCheckbox(Label="Roof", StartingValue=False)
checkbox_13 = CreateCheckbox(Label="Walls", StartingValue=False)
textbox = CreateTextBox(Label="Model name", DefaultText="My model", UpdateButton=invert(True), showLabel=True)
slider_9 = CreateSlider(
    Slider=Slider(0.3, range=0.05..1),
    SnapValue=Slider(0.05, range=0..1),
    ShowBounds=False,
    ShowTicks=True,
    ShowTooltip=False,
    ShowValLabel=True,
    showLabel=False)
slider_10 = CreateSlider(
    Slider=Slider(0.3, range=0.05..1),
    SnapValue=Slider(0.05, range=0..1),
    ShowBounds=False,
    ShowTicks=True,
    ShowTooltip=True,
    ShowValLabel=True,
    showLabel=False)
label_21 = CreateLabel(LabelText="Set wall thickness [m]", LabelSize=12, Justification=0)
label_22 = CreateLabel(LabelText="Set roof thickness [m]", LabelSize=12, Justification=0)
button_15 = CreateButton(ButtonName="Create model", ButtonStyle=0)
values_48 = ValueListener(Elements=button_15, SomeProperty=True)  # -> Values, Indices
freeze_gate_9 = StreamFreezeGate(Data=values_48.Values, PassingSwitch=invert(values_48.Values))
freeze_gate_10 = StreamFreezeGate(Data=values_48.Values, PassingSwitch=values_48.Values)
button_16 = CreateButton(ButtonName="Bake model", ButtonStyle=0)
values_49 = ValueListener(Elements=button_16, SomeProperty=True)  # -> Values, Indices
values_50 = ValueListener(Elements=checkbox_6, SomeProperty=True)  # -> Values, Indices
values_51 = ValueListener(Elements=checkbox_7, SomeProperty=True)  # -> Values, Indices
values_52 = ValueListener(Elements=checkbox_8, SomeProperty=True)  # -> Values, Indices
values_53 = ValueListener(Elements=checkbox_9, SomeProperty=True)  # -> Values, Indices
values_54 = ValueListener(Elements=checkbox_10, SomeProperty=True)  # -> Values, Indices
values_55 = ValueListener(Elements=checkbox_11, SomeProperty=True)  # -> Values, Indices
values_56 = ValueListener(Elements=checkbox_12, SomeProperty=True)  # -> Values, Indices
values_57 = ValueListener(Elements=checkbox_13, SomeProperty=True)  # -> Values, Indices
freeze_gate_11 = StreamFreezeGate(Data=values_49.Values, PassingSwitch=invert(values_49.Values))
bool_17 = Boolean(invert(freeze_gate_9))
bool_18 = Boolean(invert(freeze_gate_11))
values_58 = ValueListener(Elements=textbox, SomeProperty=True)  # -> Values, Indices
tap_9 = TapBuffer(Reset=False, Incremental=True, Valve=bool_17, Hold=True)
values_59 = ValueListener(Elements=slider_9, SomeProperty=True)  # -> Values, Indices
values_60 = ValueListener(Elements=slider_10, SomeProperty=True)  # -> Values, Indices
tooltip_5 = AttachTooltipToElement(ElementsToAttachTo=slider_10, TooltipContent="Doubleclick to input value", ShowDelay=500, Duration=2000)
tooltip_6 = AttachTooltipToElement(ElementsToAttachTo=slider_9, TooltipContent="Doubleclick to input value", ShowDelay=500, Duration=2000)
tap_10 = TapBuffer(Reset=False, Incremental=True, Valve=bool_18, Hold=True)
dam_9 = DataDam(DataA=tap_9, BufferDelay=2500000, BufferMode=2)
entwine_41 = Entwine(Branch00=label_21, Branch01=slider_9, FlattenInputs=True)  # -> flatten(Result)
model_name = RemoteSender(values_58.Values)
panel_34 = Panel(values_58.Values)
entwine_42 = Entwine(Branch00=label_22, Branch01=slider_10, FlattenInputs=True)  # -> flatten(Result)
roof_thickness = RemoteSender(values_60.Values)
wall_thickness = RemoteSender(values_59.Values)
dam_10 = DataDam(DataA=tap_10, BufferDelay=2500000, BufferMode=2)
equals_9 = Equality(FirstNumber=tap_9, SecondNumber=dam_9)  # -> Equality, Inequality
equals_10 = Equality(FirstNumber=tap_10, SecondNumber=dam_10)  # -> Equality, Inequality
entwine_43 = Entwine(
    Branch00=label_20,
    Branch01=checkbox_9,
    Branch02=checkbox_13,
    Branch03=checkbox_12,
    Branch04=checkbox_11,
    Branch05=checkbox_10,
    Branch06=checkbox_8,
    Branch07=checkbox_6,
    Branch08=checkbox_7,
    FlattenInputs=True)  # -> flatten(Result)
entwine_44 = Entwine(Branch00=button_15, Branch01=button_16, FlattenInputs=True)  # -> flatten(Result)
stack_24 = CreateStack(UIElements=entwine_43, Horizontal=invert(True))
border_4 = CreateBorder(
    UIElement=stack_24,
    BorderThickness=Slider(1, range=0..10),
    BorderColor=ColourSwatch(SwatchColor=RGB(217, 217, 217)),
    CornerRadius=Slider(2, range=0..10))
adjustpos_32 = AdjustElementPositioning(
    ElementsToAdjust=textbox,
    Margin="0, 5, 0, 10",
    AbsolutePositioning=False,
    Width=Slider(210, range=0..300),
    Height=Slider(30, range=0..300),
    HorizontalAlignment=0)
adjustpos_33 = AdjustElementPositioning(
    ElementsToAdjust=[slider_9, slider_10],
    AbsolutePositioning=False,
    Width=Slider(200, range=0..300),
    Height=Slider(25, range=0..300),
    HorizontalAlignment=0,
    VerticalAlignment=2)
stack_25 = CreateStack(UIElements=entwine_44, Horizontal=True)
adjustpos_34 = AdjustElementPositioning(ElementsToAdjust=border_4, Margin="25, 5, 0, 0", AbsolutePositioning=False, HorizontalAlignment=0, VerticalAlignment=2)

textbox_2 = CreateTextBox(Label="Set location", DefaultText=panel_33, UpdateButton=True, showLabel=True)
values_61 = ValueListener(Elements=textbox_2, SomeProperty=True)  # -> Values, Indices
location_12 = RemoteSender(values_61.Values)
location_13 = RemoteReceiver(location_12)
format = Format(Format="Location: {0}", Culture=127, Data0=location_13)
setlabel = SetLabelContents(LabelToModify=label_2, NewLabelContents=format)
stack_26 = CreateStack(UIElements=entwine_42, Horizontal=invert(True))
stack_27 = CreateStack(UIElements=entwine_41, Horizontal=invert(True))
entwine_45 = Entwine(Branch00=textbox_2, Branch01=button_2, FlattenInputs=True)  # -> flatten(Result)
adjustpos_35 = AdjustElementPositioning(ElementsToAdjust=textbox_2, AbsolutePositioning=False, Width=Slider(200, range=0..1000), HorizontalAlignment=0)
stack_28 = CreateStack(UIElements=entwine_45, Horizontal=True)
adjustpos_36 = AdjustElementPositioning(ElementsToAdjust=stack_26, Margin="0, 0, 0, 0", AbsolutePositioning=False)
adjustpos_37 = AdjustElementPositioning(ElementsToAdjust=stack_27, Margin="0, 5, 0, 0", AbsolutePositioning=False)
entwine_46 = Entwine(Branch00=label_4, Branch01=textbox, FlattenInputs=True)  # -> flatten(Result)
entwine_47 = Entwine(Branch00=label_2, Branch01=stack_28, FlattenInputs=True)  # -> flatten(Result)
adjustpos_38 = AdjustElementPositioning(ElementsToAdjust=stack_28, AbsolutePositioning=False, Width=Slider(350, range=0..1000), HorizontalAlignment=0)
adjustpos_39 = AdjustElementPositioning(ElementsToAdjust=entwine_44, Margin="5, 10, 0, 0", AbsolutePositioning=False, HorizontalAlignment=0)

# ----
# Create model
create_model = Data(stack_25)

# ----
# Visualize model
location_14 = Data(border_4)

# ----
# Location
location_15 = Data(entwine_47)

# ----
# Model name
model_name_2 = Data(entwine_46)

# ---- group: Setup study case
# Get climate data
# https://energyplus-weather.s3.amazonaws.com/europe_wmo_region_6/SWE/SWE_Goteborg.Landvetter.025260_IWEC/SWE_Goteborg.Landvetter.025260_IWEC.zip
epwmap = LBEPWmap(epw_map=getclimatedata_2)  # -> report; plug-in component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
location_16 = RemoteReceiver(location_12)

# ----
document_units_2 = RemoteReceiver(document_units)
case = TextCase(Text=document_units_2, Culture=127)  # -> UpperCase, LowerCase
format_2 = Format(Format=panel_30, Culture=127, Data0=case.LowerCase)
settextblock = SetTextBlockContents(TextBlockToModify=tb, NewTextBlockContents=format_2)
document_units_3 = RemoteReceiver(document_units)
entwine_48 = Entwine(Branch00=stack_23, Branch01=listbox, FlattenInputs=True)  # -> flatten(Result)
entwine_49 = Entwine(Branch00=label_14, Branch01=pulldown_6, Branch02=entwine_35, FlattenInputs=True)  # -> flatten(Result)
stack_29 = CreateStack(UIElements=entwine_48, Horizontal=True)
expression = Expression(x=document_units_3, y="Meters", Expression="x=y")
entwine_50 = Entwine(Branch00=label_15, Branch01=stack_29, FlattenInputs=True)  # -> flatten(Result)
hideshow_14 = HideShowElement(ElementToHideShow=border_3, Show=invert(expression), Collapse=True, Disable=False)

stack_30 = CreateStack(UIElements=entwine_49, Horizontal=invert(True))

# ----
# Preview
preview = Data(entwine_50)

# ----
# Assign type
assign_type = Data(stack_30)

entwine_51 = Entwine(Branch00=assign_type, Branch01=location_5, FlattenInputs=True)  # -> flatten(Result)
stack_31 = CreateStack(UIElements=entwine_51, Horizontal=True)

# ----
# Construction module
number_slider_20 = Slider(5, range=0..7)
panel_35 = Panel("""Very Hot
Hot
Warm
Mixed
Cool
Cold
Very Cold
Subarctic""")
panel_36 = Panel("""SteelFramed
WoodFramed
Mass
Metal Building""")
pulldown_9 = CreatePulldownMenu(Label="By climate", ListItems=panel_35, SelectedIndex=number_slider_20, showLabel=True)
label_23 = CreateLabel(LabelText="Select base construction", LabelSize=18, Justification=0)
pulldown_10 = CreatePulldownMenu(Label="By type", ListItems=panel_36, SelectedIndex=Slider(1, range=0..3), showLabel=True)
pulldown_11 = CreatePulldownMenu(Label="Skylights", ListItems=empty_2, showLabel=True)
pulldown_12 = CreatePulldownMenu(Label="Windows", ListItems=empty, showLabel=True)
pulldown_13 = CreatePulldownMenu(Label="Exterior walls", ListItems=empty_4, showLabel=True)
pulldown_14 = CreatePulldownMenu(Label="Ground", ListItems=empty_3, showLabel=True)
pulldown_15 = CreatePulldownMenu(Label="Interior floors", ListItems=empty_7, showLabel=True)
pulldown_16 = CreatePulldownMenu(Label="Exterior floor", ListItems=empty_6, showLabel=True)
pulldown_17 = CreatePulldownMenu(Label="Exterior roof", ListItems=empty_5, showLabel=True)
pulldown_18 = CreatePulldownMenu(Label="Interior walls", ListItems=empty_8, showLabel=True)
values_62 = ValueListener(Elements=pulldown_10, SomeProperty=True)  # -> Values, Indices
values_63 = ValueListener(Elements=pulldown_11, SomeProperty=True)  # -> Values, Indices
values_64 = ValueListener(Elements=pulldown_12, SomeProperty=True)  # -> Values, Indices
values_65 = ValueListener(Elements=pulldown_18, SomeProperty=True)  # -> Values, Indices
values_66 = ValueListener(Elements=pulldown_15, SomeProperty=True)  # -> Values, Indices
values_67 = ValueListener(Elements=pulldown_16, SomeProperty=True)  # -> Values, Indices
values_68 = ValueListener(Elements=pulldown_14, SomeProperty=True)  # -> Values, Indices
values_69 = ValueListener(Elements=pulldown_9, SomeProperty=True)  # -> Values, Indices
values_70 = ValueListener(Elements=pulldown_17, SomeProperty=True)  # -> Values, Indices
values_71 = ValueListener(Elements=pulldown_13, SomeProperty=True)  # -> Values, Indices
base_type = RemoteSender(values_62.Values)
subset_subface_skylight = RemoteSender(values_63.Indices)
subset_interior_wall = RemoteSender(values_65.Indices)
subset_subface_window = RemoteSender(values_64.Indices)
subset_interior_floor = RemoteSender(values_66.Indices)
subset_exterior_floor = RemoteSender(values_67.Indices)
subset_ground_floor = RemoteSender(values_68.Indices)
addition_2 = Addition(A=values_69.Indices, B="1")
subset_exterior_roof = RemoteSender(values_70.Indices)
subset_exterior_wall = RemoteSender(values_71.Indices)
entwine_52 = Entwine(Branch00=pulldown_9, Branch01=pulldown_10, FlattenInputs=True)  # -> flatten(Result)
base_climate = RemoteSender(addition_2)
stack_32 = CreateStack(UIElements=entwine_52, Horizontal=True)
entwine_53 = Entwine(Branch00=label_23, Branch01=stack_32, FlattenInputs=True)  # -> flatten(Result)
adjustpos_40 = AdjustElementPositioning(ElementsToAdjust=pulldown_9, AbsolutePositioning=False, Width=Slider(160, range=0..300), HorizontalAlignment=0)
tooltip_7 = AttachTooltipToElement(ElementsToAttachTo=pulldown_9, TooltipContent="Select climate", ShowDelay=500, Duration=2000)
tooltip_8 = AttachTooltipToElement(ElementsToAttachTo=pulldown_10, TooltipContent="Select type of construction", ShowDelay=500, Duration=2000)
adjustpos_41 = AdjustElementPositioning(ElementsToAdjust=pulldown_10, AbsolutePositioning=False, Width=Slider(170, range=0..300), HorizontalAlignment=0)
adjustpos_42 = AdjustElementPositioning(
    ElementsToAdjust=[pulldown_15, pulldown_14, pulldown_16, pulldown_17, pulldown_18, pulldown_13],
    AbsolutePositioning=False,
    Width=Slider(300, range=0..300),
    HorizontalAlignment=0)

stack_33 = CreateStack(UIElements=entwine_53, Horizontal=invert(True))
adjustpos_43 = AdjustElementPositioning(
    ElementsToAdjust=[pulldown_12, pulldown_11],
    AbsolutePositioning=False,
    Width=Slider(300, range=0..300),
    HorizontalAlignment=0)

# ----
# Select subset construction
data_4 = Data(pulldown_13)
data_5 = Data(pulldown_12)
data_6 = Data(pulldown_11)
data_7 = Data(pulldown_18)
data_8 = Data(pulldown_17)
data_9 = Data(pulldown_15)
data_10 = Data(pulldown_16)
data_11 = Data(pulldown_14)
entwine_54 = Entwine(
    Branch00=data_5,
    Branch01=data_6,
    Branch02=data_4,
    Branch03=data_7,
    Branch04=data_8,
    Branch05=data_9,
    Branch06=data_10,
    Branch07=data_11,
    FlattenInputs=True)  # -> flatten(Result)
expander = CreateExpander(UIElements=entwine_54, Header="Select subset construction", Open="False")
location_17 = Data(expander)

# ----
# Construction by climate and type
number_slider_21 = Slider(2, range=0..10)
border_5 = CreateBorder(
    UIElement=stack_33,
    BorderThickness=Slider(1, range=0..10),
    BorderColor=ColourSwatch(SwatchColor=RGB(217, 217, 217)),
    CornerRadius=number_slider_21)
location_18 = Data(border_5)

entwine_55 = Entwine(Branch00=location_18, Branch01=entwine_8, FlattenInputs=True)  # -> flatten(Result)

# ---- group: Building occupancy and systems / Select construction set
bldgvintages_2 = HBBuildingVintages({"ASHRAE 90.1 2019  |  IECC 2021": "2019", "ASHRAE 90.1 2016  |  IECC 2018": "2016", "ASHRAE 90.1 2013  |  IECC 2015": "2013", "ASHRAE 90.1 2010  |  IECC 2012": "2010", "ASHRAE 90.1 2007  |  IECC 2009": "2007", "ASHRAE 90.1 2004  |  IECC 2006": "2004", "1980-2004 (CBECS)": "1980_2004", "Pre-1980 (CBECS)": "pre_1980"}, selected="ASHRAE 90.1 2019  |  IECC 2021")
base_climate_2 = RemoteReceiver(base_climate)
base_type_2 = RemoteReceiver(base_type)
constrsetclimate_2 = HBConstructionSetByClimate(climate_zone=base_climate_2, vintage=bldgvintages_2, constr_type=base_type_2)  # -> constr_set; plug-in component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
panel_37 = Panel(constrsetclimate_2)

# ----
# Analysis module
# Daylight simulation
# Glare probability
# LCA calculations
panel_38 = Panel("Simulations can take a few minutes...")
panel_39 = Panel("Spatial daylight autonomy: {0}%")
number_slider_22 = Slider(250, range=0..1000)
number_slider_23 = Slider(250, range=0..1000)
panel_40 = Panel("""Illuminance [Lux]
Daylight autonomy [%]
UDI [%]
UDI <50 [%]
UDI >3000 [%]
None""")
number_slider_24 = Slider(250, range=0..1000)
number_slider_25 = Slider(250, range=0..1000)
panel_41 = Panel("Daylight glare probability (DGP): {0}")
panel_42 = Panel("Operational GWP total: {0} kg CO2eq/year")
panel_43 = Panel("Total GWP: {0} kg CO2eq")
panel_44 = Panel("Create a model in the assembly module to get a LCA")
panel_45 = Panel("""Annual energy balance
Daily cooling profile
Daily heating profile
Cooling balance
Heating balance
None""")
lca_total_gwp_2 = RemoteReceiver(lca_total_gwp)
lca_total_gwp_3 = RemoteReceiver(lca_total_gwp)
panel_46 = Panel("""Annual energy balance
Daily cooling profile
Daily heating profile
Cooling balance
Heating balance
None""")
panel_47 = Panel("C:\Users\Isac\Desktop\Toivo_Chalmers\heath\Icons\butterfly_heath.png")
panel_48 = Panel("C:\Users\Isac\Desktop\Toivo_Chalmers\heath\Icons\butterfly_heath.png")
# Detailed energy simulation
number_slider_26 = Slider(2, range=0..10)
height = Slider(40, range=1..100)
width = Slider(5, range=1..100)
height_2 = Slider(40, range=1..100)
width_2 = Slider(5, range=1..100)
true_button_6 = CreateTrueOnlyButton(ButtonName="Visualize GWP by element", ButtonStyle=0)
tb_2 = CreateTextBlock(Text=panel_38, TextSize=16, Justification=0)
button_17 = CreateButton(ButtonName="Zoom", ButtonStyle=0)
expression_2 = Expression(x=lca_total_gwp_3, Expression="Round(x, 2)")
expression_3 = Expression(x=lca_total_gwp_2, Expression="Round(x, 2)")
button_18 = CreateButton(ButtonName="Run daylight simulation", ButtonStyle=0)
tb_3 = CreateTextBlock(Text="Simulations can take a few minutes...", TextSize=16, Justification=0)
button_19 = CreateButton(ButtonName="Zoom", ButtonStyle=0)
true_button_7 = CreateTrueOnlyButton(ButtonName="Pop-up window", ButtonStyle=0)
tb_4 = CreateTextBlock(Text="Simulations can take a few minutes...", TextSize=16, Justification=0)
button_20 = CreateButton(ButtonName="Run simple energy simulation", ButtonStyle=0)
button_21 = CreateButton(ButtonName="Calculate Glare probability", ButtonStyle=0)
tb_5 = CreateTextBlock(Text="Simulations can take a few minutes...", TextSize=16, Justification=0)
true_button_8 = CreateTrueOnlyButton(ButtonName="Pop-up window", ButtonStyle=0)
button_22 = CreateButton(ButtonName="Zoom", ButtonStyle=0)
button_23 = CreateButton(ButtonName="Run detailed energy simulation", ButtonStyle=0)
image = CreateImage(ImageSource=panel_47, ImageWidth=300)
pulldown_19 = CreatePulldownMenu(Label="Display", ListItems=panel_45, showLabel=True)
image_2 = CreateImage(ImageSource=panel_48, ImageWidth=300)
values_72 = ValueListener(Elements=true_button_6, SomeProperty=True)  # -> Values, Indices
label_24 = CreateLabel(LabelText="Display settings", LabelSize=12, Justification=0)
values_73 = ValueListener(Elements=button_17, SomeProperty=True)  # -> Values, Indices
slider_11 = CreateSlider(
    Slider=width,
    SnapValue=number_slider_26,
    ShowBounds=False,
    ShowTicks=True,
    ShowTooltip=False,
    ShowValLabel=False,
    showLabel=True)
slider_12 = CreateSlider(
    Slider=height,
    SnapValue=Slider(2, range=0..10),
    ShowBounds=False,
    ShowTicks=True,
    ShowTooltip=False,
    ShowValLabel=False,
    showLabel=True)
pulldown_20 = CreatePulldownMenu(Label="Display", ListItems=panel_46, showLabel=True)
label_25 = CreateLabel(LabelText="LCA", LabelSize=18, Justification=0)
pulldown_21 = CreatePulldownMenu(Label="Display", ListItems=panel_40, SelectedIndex="5", showLabel=True)
label_26 = CreateLabel(LabelText="Display settings", LabelSize=12, Justification=0)
slider_13 = CreateSlider(
    Slider=width_2,
    SnapValue=Slider(2, range=0..10),
    ShowBounds=False,
    ShowTicks=True,
    ShowTooltip=False,
    ShowValLabel=False,
    showLabel=True)
slider_14 = CreateSlider(
    Slider=height_2,
    SnapValue=Slider(2, range=0..10),
    ShowBounds=False,
    ShowTicks=True,
    ShowTooltip=False,
    ShowValLabel=False,
    showLabel=True)
label_27 = CreateLabel(LabelText=panel_39, LabelSize=12, Justification=0)
values_74 = ValueListener(Elements=button_18, SomeProperty=True)  # -> Values, Indices
values_75 = ValueListener(Elements=button_19, SomeProperty=True)  # -> Values, Indices
values_76 = ValueListener(Elements=true_button_7, SomeProperty=True)  # -> Values, Indices
label_28 = CreateLabel(LabelText=panel_44, LabelSize=12, Justification=0)
label_29 = CreateLabel(LabelText=panel_43, LabelSize=12, Justification=0)
label_30 = CreateLabel(LabelText=panel_42, LabelSize=12, Justification=0)
label_31 = CreateLabel(LabelText=panel_41, LabelSize=12, Justification=0)
values_77 = ValueListener(Elements=button_20, SomeProperty=True)  # -> Values, Indices
values_78 = ValueListener(Elements=button_22, SomeProperty=True)  # -> Values, Indices
values_79 = ValueListener(Elements=true_button_8, SomeProperty=True)  # -> Values, Indices
values_80 = ValueListener(Elements=button_21, SomeProperty=True)  # -> Values, Indices
values_81 = ValueListener(Elements=button_23, SomeProperty=True)  # -> Values, Indices
visualize_lca_gwp_by_element = RemoteSender(values_72.Values)
values_82 = ValueListener(Elements=pulldown_19, SomeProperty=True)  # -> Values, Indices
zoom_daylight_simulation = RemoteSender(values_73.Values)
zoom_simple_energy_simulation = RemoteSender(values_75.Values)
visualize_simple_energy_simulations = RemoteSender(values_76.Values)
freeze_gate_12 = StreamFreezeGate(Data=values_74.Values, PassingSwitch=invert(values_74.Values))
values_83 = ValueListener(Elements=pulldown_20, SomeProperty=True)  # -> Values, Indices
format_3 = Format(Format=panel_44, Culture=127, Data0=expression_2)
format_4 = Format(Format=panel_43, Culture=127, Data0=expression_3)
values_84 = ValueListener(Elements=pulldown_21, SomeProperty=True)  # -> Values, Indices
values_85 = ValueListener(Elements=slider_11, SomeProperty=True)  # -> Values, Indices
values_86 = ValueListener(Elements=slider_12, SomeProperty=True)  # -> Values, Indices
freeze_gate_13 = StreamFreezeGate(Data=values_77.Values, PassingSwitch=invert(values_77.Values))
entwine_56 = Entwine(Branch00=slider_12, Branch01=slider_11, FlattenInputs=True)  # -> flatten(Result)
zoom_detailed_energy_simulation = RemoteSender(values_78.Values)
visualize_detailed_energy_simulations = RemoteSender(values_79.Values)
values_87 = ValueListener(Elements=slider_13, SomeProperty=True)  # -> Values, Indices
values_88 = ValueListener(Elements=slider_14, SomeProperty=True)  # -> Values, Indices
pre_calculate_glare_probability = RemoteSender(values_80.Values)
pre_calculate_glare_probability_2 = RemoteReceiver(pre_calculate_glare_probability)
freeze_gate_14 = StreamFreezeGate(Data=pre_calculate_glare_probability_2, PassingSwitch=pre_calculate_glare_probability_2)
hasdata = DataExists(Data=freeze_gate_14)
filter_2 = StreamFilter(Gate=hasdata, Stream0="0", Stream1=freeze_gate_14)
entwine_57 = Entwine(Branch00=slider_14, Branch01=slider_13, FlattenInputs=True)  # -> flatten(Result)
pre_run_daylight_simulations = RemoteSender(values_74.Values)
pre_run_daylight_simulations_2 = RemoteReceiver(pre_run_daylight_simulations)
freeze_gate_15 = StreamFreezeGate(Data=pre_run_daylight_simulations_2, PassingSwitch=pre_run_daylight_simulations_2)
hasdata_2 = DataExists(Data=freeze_gate_15)
filter_3 = StreamFilter(Gate=hasdata_2, Stream0="0", Stream1=freeze_gate_15)
freeze_gate_16 = StreamFreezeGate(Data=values_80.Values, PassingSwitch=invert(values_80.Values))
pre_run_simple_energy_simulations = RemoteSender(values_77.Values)
pre_run_simple_energy_simulations_2 = RemoteReceiver(pre_run_simple_energy_simulations)
freeze_gate_17 = StreamFreezeGate(Data=pre_run_simple_energy_simulations_2, PassingSwitch=pre_run_simple_energy_simulations_2)
hasdata_3 = DataExists(Data=freeze_gate_17)
filter_4 = StreamFilter(Gate=hasdata_3, Stream0="0", Stream1=freeze_gate_17)
freeze_gate_18 = StreamFreezeGate(Data=values_81.Values, PassingSwitch=invert(values_81.Values))
pre_run_detailed_energy_simulations = RemoteSender(values_81.Values)
pre_run_detailed_energy_simulations_2 = RemoteReceiver(pre_run_detailed_energy_simulations)
freeze_gate_19 = StreamFreezeGate(Data=pre_run_detailed_energy_simulations_2, PassingSwitch=pre_run_detailed_energy_simulations_2)
hasdata_4 = DataExists(Data=freeze_gate_19)
filter_5 = StreamFilter(Gate=hasdata_4, Stream0="0", Stream1=freeze_gate_19)
simple_energy_simulation_type = RemoteSender(values_82.Indices)
setlabel_2 = SetLabelContents(LabelToModify=label_28, NewLabelContents=format_3)
setlabel_3 = SetLabelContents(LabelToModify=label_29, NewLabelContents=format_4)
detailed_energy_simulation_type = RemoteSender(values_83.Indices)
simple_energy_simulation_height = RemoteSender(values_86.Values)
simple_energy_simulation_width = RemoteSender(values_85.Values)
bool_19 = Boolean(invert(freeze_gate_12))
daylight_simulation_type = RemoteSender(values_84.Indices)
detailed_energy_simulation_width = RemoteSender(values_87.Values)
detailed_energy_simulation_height = RemoteSender(values_88.Values)
bool_20 = Boolean(invert(freeze_gate_13))
bool_21 = Boolean(invert(freeze_gate_16))
stack_34 = CreateStack(UIElements=entwine_56, Horizontal=True)
bool_22 = Boolean(invert(freeze_gate_18))
stack_35 = CreateStack(UIElements=entwine_57, Horizontal=True)
entwine_58 = Entwine(Branch00=label_24, Branch01=stack_34, FlattenInputs=True)  # -> flatten(Result)
entwine_59 = Entwine(Branch00=label_26, Branch01=stack_35, FlattenInputs=True)  # -> flatten(Result)
entwine_60 = Entwine(Branch00=button_18, Branch01=button_17, FlattenInputs=True)  # -> flatten(Result)
entwine_61 = Entwine(Branch00=button_20, Branch01=button_19, Branch02=true_button_7, FlattenInputs=True)  # -> flatten(Result)
tap_11 = TapBuffer(Reset=False, Incremental=True, Valve=bool_19, Hold=True)
tap_12 = TapBuffer(Reset=False, Incremental=True, Valve=bool_20, Hold=True)
entwine_62 = Entwine(Branch00=button_23, Branch01=button_22, Branch02=true_button_8, FlattenInputs=True)  # -> flatten(Result)
tap_13 = TapBuffer(Reset=False, Incremental=True, Valve=bool_21, Hold=True)
tap_14 = TapBuffer(Reset=False, Incremental=True, Valve=bool_22, Hold=True)
dam_11 = DataDam(DataA=tap_11, BufferDelay=2500000, BufferMode=2)
stack_36 = CreateStack(UIElements=entwine_58, Horizontal=invert(True))
dam_12 = DataDam(DataA=tap_12, BufferDelay=2500000, BufferMode=2)
stack_37 = CreateStack(UIElements=entwine_59, Horizontal=invert(True))
dam_13 = DataDam(DataA=tap_13, BufferDelay=2500000, BufferMode=2)
dam_14 = DataDam(DataA=tap_14, BufferDelay=2500000, BufferMode=2)
equals_11 = Equality(FirstNumber=tap_11, SecondNumber=dam_11)  # -> Equality, Inequality
equals_12 = Equality(FirstNumber=tap_12, SecondNumber=dam_12)  # -> Equality, Inequality
entwine_63 = Entwine(Branch00=pulldown_19, Branch01=stack_36, FlattenInputs=True)  # -> flatten(Result)
equals_13 = Equality(FirstNumber=tap_13, SecondNumber=dam_13)  # -> Equality, Inequality
equals_14 = Equality(FirstNumber=tap_14, SecondNumber=dam_14)  # -> Equality, Inequality
entwine_64 = Entwine(Branch00=pulldown_20, Branch01=stack_37, FlattenInputs=True)  # -> flatten(Result)
stack_38 = CreateStack(UIElements=entwine_60, Horizontal=True)
adjustpos_44 = AdjustElementPositioning(
    ElementsToAdjust=button_17,
    Margin="15, 0, 0, 0",
    AbsolutePositioning=False,
    Width=Slider(60, range=0..1000),
    Height=Slider(30, range=0..1000),
    HorizontalAlignment=0)
stack_39 = CreateStack(UIElements=entwine_61, Horizontal=True)
stack_40 = CreateStack(UIElements=entwine_63, Horizontal=True)
stack_41 = CreateStack(UIElements=entwine_64, Horizontal=True)
entwine_65 = Entwine(Branch00=image_2, Branch01=image, FlattenInputs=True)  # -> flatten(Result)
adjustpos_45 = AdjustElementPositioning(
    ElementsToAdjust=pulldown_19,
    AbsolutePositioning=False,
    Width=Slider(215, range=0..1000),
    Height=Slider(40, range=0..1000),
    HorizontalAlignment=0)
adjustpos_46 = AdjustElementPositioning(
    ElementsToAdjust=pulldown_20,
    AbsolutePositioning=False,
    Width=Slider(215, range=0..1000),
    Height=Slider(40, range=0..1000),
    HorizontalAlignment=0)
adjustpos_47 = AdjustElementPositioning(
    ElementsToAdjust=pulldown_21,
    AbsolutePositioning=False,
    Width=Slider(235, range=0..1000),
    Height=Slider(40, range=0..1000),
    HorizontalAlignment=0)
adjustpos_48 = AdjustElementPositioning(ElementsToAdjust=button_21, AbsolutePositioning=False, HorizontalAlignment=0)
adjustpos_49 = AdjustElementPositioning(
    ElementsToAdjust=button_19,
    Margin="15, 0, 0, 0",
    AbsolutePositioning=False,
    Width=Slider(60, range=0..1000),
    Height=Slider(30, range=0..1000),
    HorizontalAlignment=0)
adjustpos_50 = AdjustElementPositioning(
    ElementsToAdjust=true_button_7,
    Margin="15, 0, 0, 0",
    AbsolutePositioning=False,
    Width=Slider(110, range=0..1000),
    Height=Slider(30, range=0..1000),
    HorizontalAlignment=0)
adjustpos_51 = AdjustElementPositioning(
    ElementsToAdjust=true_button_8,
    Margin="15, 0, 0, 0",
    AbsolutePositioning=False,
    Width=Slider(110, range=0..1000),
    Height=Slider(30, range=0..1000),
    HorizontalAlignment=0)
stack_42 = CreateStack(UIElements=entwine_62, Horizontal=True)
adjustpos_52 = AdjustElementPositioning(
    ElementsToAdjust=button_22,
    Margin="15, 0, 0, 0",
    AbsolutePositioning=False,
    Width=Slider(60, range=0..1000),
    Height=Slider(30, range=0..1000),
    HorizontalAlignment=0)
expander_2 = CreateExpander(UIElements=entwine_65, Header="Images", Open=True)
adjustpos_53 = AdjustElementPositioning(ElementsToAdjust=true_button_6, AbsolutePositioning=False, HorizontalAlignment=0)

# ----
# Calculate LCA
entwine_66 = Entwine(Branch00=label_25, Branch01=label_28, Branch02=label_29, Branch03=label_30, Branch04=true_button_6, FlattenInputs=True)  # -> flatten(Result)
stack_43 = CreateStack(UIElements=entwine_66, Horizontal=invert(True))
number_slider_27 = Slider(650, range=0..1000)
border_6 = CreateBorder(
    UIElement=stack_43,
    BorderThickness=Slider(1, range=0..10),
    BorderColor=ColourSwatch(SwatchColor=RGB(217, 217, 217)),
    CornerRadius=Slider(2, range=0..10))
adjustpos_54 = AdjustElementPositioning(ElementsToAdjust=border_6, Margin="0, 10, 0, 0", AbsolutePositioning=False, HorizontalAlignment=0)
location_19 = Data(border_6)

# ----
# Run simple energy simulations
entwine_67 = Entwine(Branch00=stack_39, Branch01=tb_3, Branch02=stack_40, FlattenInputs=True)  # -> flatten(Result)
stack_44 = CreateStack(UIElements=entwine_67, Horizontal=invert(True))
number_slider_28 = Slider(650, range=0..1000)
border_7 = CreateBorder(
    UIElement=stack_44,
    BorderThickness=Slider(1, range=0..10),
    BorderColor=ColourSwatch(SwatchColor=RGB(217, 217, 217)),
    CornerRadius=Slider(2, range=0..10))
adjustpos_55 = AdjustElementPositioning(ElementsToAdjust=border_7, Margin="0, 0, 0, 0", AbsolutePositioning=False, HorizontalAlignment=0)
location_20 = Data(border_7)
# ----
# Run daylight simulations
entwine_68 = Entwine(Branch00=stack_38, Branch01=tb_2, Branch02=label_27, Branch03=pulldown_21, FlattenInputs=True)  # -> flatten(Result)
stack_45 = CreateStack(UIElements=entwine_68, Horizontal=invert(True))
number_slider_29 = Slider(650, range=0..1000)
border_8 = CreateBorder(
    UIElement=stack_45,
    BorderThickness=Slider(1, range=0..10),
    BorderColor=ColourSwatch(SwatchColor=RGB(217, 217, 217)),
    CornerRadius=Slider(2, range=0..10))
adjustpos_56 = AdjustElementPositioning(ElementsToAdjust=border_8, Margin="0, 10, 0, 0", AbsolutePositioning=False, HorizontalAlignment=0)
location_21 = Data(border_8)

# ----
# Run detailed energy simulations
entwine_69 = Entwine(Branch00=stack_42, Branch01=tb_4, Branch02=stack_41, FlattenInputs=True)  # -> flatten(Result)
stack_46 = CreateStack(UIElements=entwine_69, Horizontal=invert(True))
number_slider_30 = Slider(650, range=0..1000)
border_9 = CreateBorder(
    UIElement=stack_46,
    BorderThickness=Slider(1, range=0..10),
    BorderColor=ColourSwatch(SwatchColor=RGB(217, 217, 217)),
    CornerRadius=Slider(2, range=0..10))
adjustpos_57 = AdjustElementPositioning(ElementsToAdjust=border_9, Margin="0, 10, 0, 0", AbsolutePositioning=False, HorizontalAlignment=0)
location_22 = Data(border_9)

# ----
# Calculare glare probability
entwine_70 = Entwine(Branch00=button_21, Branch01=label_31, Branch02=expander_2, Branch03=tb_5, FlattenInputs=True)  # -> flatten(Result)
stack_47 = CreateStack(UIElements=entwine_70, Horizontal=invert(True))
number_slider_31 = Slider(650, range=0..1000)
border_10 = CreateBorder(
    UIElement=stack_47,
    BorderThickness=Slider(1, range=0..10),
    BorderColor=ColourSwatch(SwatchColor=RGB(217, 217, 217)),
    CornerRadius=Slider(2, range=0..10))
adjustpos_58 = AdjustElementPositioning(ElementsToAdjust=border_10, Margin="0, 10, 0, 0", AbsolutePositioning=False, HorizontalAlignment=0)
location_23 = Data(border_10)

daylight_simulation_type_2 = RemoteReceiver(daylight_simulation_type)
equals_15 = Equality(FirstNumber="5", SecondNumber=daylight_simulation_type_2)  # -> Equality, Inequality
simple_energy_simulation_height_2 = RemoteReceiver(simple_energy_simulation_height)
simple_energy_simulation_width_2 = RemoteReceiver(simple_energy_simulation_width)
simple_energy_simulation_height_3 = RemoteReceiver(simple_energy_simulation_height)
simple_energy_simulation_width_3 = RemoteReceiver(simple_energy_simulation_width)
simple_energy_simulation_height_4 = RemoteReceiver(simple_energy_simulation_height)
simple_energy_simulation_height_5 = RemoteReceiver(simple_energy_simulation_height)
simple_energy_simulation_width_4 = RemoteReceiver(simple_energy_simulation_width)
simple_energy_simulation_width_5 = RemoteReceiver(simple_energy_simulation_width)
simple_energy_simulation_height_6 = RemoteReceiver(simple_energy_simulation_height)
simple_energy_simulation_width_6 = RemoteReceiver(simple_energy_simulation_width)

entwine_71 = Entwine(Branch00=stack_27, Branch01=stack_26, FlattenInputs=True)  # -> flatten(Result)

# ----
# Wall and roof thickness
location_24 = Data(entwine_71)

entwine_72 = Entwine(Branch00=model_name_2, Branch01=location_24, FlattenInputs=True)  # -> flatten(Result)
stack_48 = CreateStack(UIElements=entwine_72, Horizontal=invert(True))
entwine_73 = Entwine(Branch00=stack_48, Branch01=location_14, FlattenInputs=True)  # -> flatten(Result)
stack_49 = CreateStack(UIElements=entwine_73, Horizontal=True)
entwine_74 = Entwine(
    Branch00=stack_49,
    Branch01=location_2,
    Branch02=location,
    Branch03=location_15,
    Branch04=create_model,
    FlattenInputs=True)  # -> flatten(Result)
stack_50 = CreateStack(UIElements=entwine_74, Horizontal=invert(True))

# ----
# Geometry module interface
document_units_4 = RemoteReceiver(document_units)
document_units_5 = RemoteReceiver(document_units)
document_units_6 = RemoteReceiver(document_units)
document_units_7 = RemoteReceiver(document_units)
previewtype_2 = RemoteReceiver(previewtype)
previewtype_3 = RemoteReceiver(previewtype)
previewtype_4 = RemoteReceiver(previewtype)
previewtype_5 = RemoteReceiver(previewtype)
constructiontype = RemoteReceiver()
geometrytype_2 = RemoteReceiver(geometrytype)
expression_4 = Expression(x=document_units_4, y="Meters", Expression="x=y")
saveconstruction = RemoteReceiver()
expression_5 = Expression(x=document_units_5, y="Meters", Expression="x=y")
expression_6 = Expression(x=previewtype_3, y="All", Expression="x=y")
expression_7 = Expression(x="Room", y=previewtype_3, Expression="x=y")
expression_8 = Expression(x=previewtype_2, y="All", Expression="x=y")
expression_9 = Expression(x=document_units_6, y="Meters", Expression="x=y")
expression_10 = Expression(x="Context", y=previewtype_2, Expression="x=y")
expression_11 = Expression(x=document_units_7, y="Meters", Expression="x=y")
expression_12 = Expression(x="Window", y=previewtype_5, Expression="x=y")
expression_13 = Expression(x=previewtype_5, y="All", Expression="x=y")
expression_14 = Expression(x="Adjacent", y=previewtype_4, Expression="x=y")
expression_15 = Expression(x=previewtype_4, y="All", Expression="x=y")
ef_att_2 = EleFrontAttributes(Keys="Heath geometry type", Values=geometrytype_2)
ef_att_3 = EleFrontAttributes(Keys="Construction", Values=constructiontype)
or = GateOr(A=expression_10, B=expression_8)
or_2 = GateOr(A=expression_7, B=expression_6)
or_3 = GateOr(A=expression_12, B=expression_13)
or_4 = GateOr(A=expression_14, B=expression_15)
gate_3 = StreamGate(Stream="Context", Gate=or)  # -> Target0, Target1
gate_4 = StreamGate(Stream="Adjacent", Gate=or_4)  # -> Target0, Target1
gate_5 = StreamGate(Stream="Room", Gate=or_2)  # -> Target0, Target1
gate_6 = StreamGate(Stream="Window", Gate=or_3)  # -> Target0, Target1
geometrytype_validate_2 = RemoteReceiver(geometrytype_validate)

# ----
# Duplicate construction warning
panel_49 = Panel("""Duplicate constructions have
been loaded.
The one previously
created have been selected.""")
tb_6 = CreateTextBlock(Text=panel_49, TextSize=12, Justification=0)
accent_colors = ValueList({"Amber", "Blue", "Brown", "Cobalt", "Crimson", "Cyan", "Emerald", "Green", "Indigo", "Lime", "Magenta", "Mauve", "Olive", "Orange", "Pink", "Purple", "Red", "Sienna", "Steel", "Taupe", "Teal", "Violet", "Yellow"}, selected="Blue")
pt_8 = ConstructPoint(XCoordinate=Slider(400, range=0..1000), YCoordinate=Slider(250, range=0..1000), ZCoordinate=0)
adjustelem_4 = AdjustElementAppearance(ElementsToAdjust=tb_6, Foreground=ColourSwatch(SwatchColor=RGB(0, 0, 0)))

# ----
# Recursion
panel_50 = Panel("LCA window status")
objbynn = GetObjectByNickname(NickName=panel_50)
lca_window_status = Python3Script()  # -> status
# ---------- lca_window_status: Python ----------
status = False
# ---------- end lca_window_status ----------

# ----
# LCA pop-up window
visualize_lca_gwp_by_element_2 = RemoteReceiver(visualize_lca_gwp_by_element)
rec = DataRecorder(visualize_lca_gwp_by_element_2, DataLimit=-2, RecordData=True)
ma_2 = MassAddition(Input=rec)  # -> Result, PartialResults
entwine_75 = Entwine(Branch00=ma_2.Result, Branch01=lca_window_status, FlattenInputs=True)
lca_gwp_by_element_type_2 = RemoteReceiver(lca_gwp_by_element_type)
rec_2 = DataRecorder(entwine_75, DataLimit=2, RecordData=True)
colrange = LBColorRange(index=Slider(19, range=0..100))  # -> colors; plug-in component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
item_6 = ListItem(List=rec_2, Index=0, Wrap=True)  # -> Item2, Item1, Item
txt = Text(colrange)
num_2 = Number(lca_gwp_by_element_type_2)
equals_16 = Equality(FirstNumber=item_6.Item2, SecondNumber=item_6.Item1)  # -> Equality, Inequality
pt_9 = Point(txt)
expression_16 = Expression(x=num_2, Expression="Round(x, 2)")
lca_element_types_2 = RemoteReceiver(lca_element_types)
division_2 = Division(A=pt_9, B="255")
bang = ExplodeTree(Data=equals_16.Inequality)  # -> Branch0, Branch1
len = TextLength(Text=division_2)
py3_6 = Python3Script(x=bang.Branch0, y=bang.Branch1)  # -> a
# ---------- py3_6: Python ----------
if x:
    a = True
elif y:
    a = False
else:
    a = False
# ---------- end py3_6 ----------
subtraction_2 = Subtraction(A=len, B=Slider(2, range=0..10))
event_2 = EventGate(Data=py3_6)  # -> Data, IsNew
fragment = TextFragment(Text=division_2, Start="1", Count=subtraction_2)
freeze_gate_20 = StreamFreezeGate(Data=py3_6, PassingSwitch=event_2.IsNew)
panel_51 = Panel("C:\Users\Isac\Desktop\Toivo_Chalmers\heath\Icons\butterfly_heath.png")
event_3 = EventGate(Data=freeze_gate_20)  # -> Data, IsNew
panel_52 = Panel(event_3.Data)
launchwin = LaunchWindow(
    Show=event_3.Data,
    Name="LCA visualisations",
    Width=Slider(1150, range=0..1200),
    Height=Slider(575, range=0..1000),
    ChildStatus=1,
    EnableHorizScroll=False)
image_3 = CreateImage(ImageSource=panel_51, ImageWidth=Slider(1100, range=0..1200), ImageHeight=Slider(500, range=0..1000))
accent_colors_2 = ValueList({"Amber", "Blue", "Brown", "Cobalt", "Crimson", "Cyan", "Emerald", "Green", "Indigo", "Lime", "Magenta", "Mauve", "Olive", "Orange", "Pink", "Purple", "Red", "Sienna", "Steel", "Taupe", "Teal", "Violet", "Yellow"}, selected="Blue")
winstat = WindowStatus(Window=launchwin)
pt_10 = ConstructPoint(XCoordinate=Slider(183, range=0..1000), YCoordinate=Slider(137, range=0..1000), ZCoordinate=0)
addelems_2 = AddElements(Window=launchwin, Elements=flatten(image_3), DoVLChecking=True)  # -> AddedElements, ElementNames
lca_status = RemoteSender(winstat)
winprops = SetWindowProperties(
    Window=launchwin,
    StartingLocation=pt_10,
    Theme=0,
    AccentColor=accent_colors_2,
    ShowTitleBar=True,
    BackgroundColor=RGB(255, 255, 255),
    ScaleFactor=1)

lca_status_2 = RemoteReceiver(lca_status)
expression_17 = Expression(x="Hidden", y=lca_status_2, Expression="x=y")
expire = ExpireObject(ObjectToExpire=objbynn, Expire=expression_17)

# ----
# Simple energy simulations pop-up window
number_slider_32 = Slider(19, range=0..100)
colrange_2 = LBColorRange(index=number_slider_32)  # -> colors; plug-in component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
split = SplitList(List=colrange_2, Index=Slider(7, range=0..10))  # -> ListA, ListB
entwine_76 = Entwine(Branch00=split.ListA, Branch01=ColourSwatch(SwatchColor=RGB(13, 207, 255)), Branch02=split.ListB, FlattenInputs=True)  # -> flatten(Result)
visualize_simple_energy_simulations_2 = RemoteReceiver(visualize_simple_energy_simulations)
rec_3 = DataRecorder(visualize_simple_energy_simulations_2, DataLimit=-2, RecordData=True)
ma_3 = MassAddition(Input=rec_3)  # -> Result, PartialResults
panel_53 = Panel("total load EUI: {0} (kWh/m2)")
format_5 = Format(Format=panel_53, Culture=127, Data0=Slider(0, range=0..100))
nextfile = NextAvailableFilename(Format="test_{000}.png", FolderPath="C:/Users/Isac/Desktop/Toivo_Chalmers/UI/matplotlib", Trigger=Toggle(True))
py3_7 = Python3Script(x=nextfile)  # -> out, a
# ---------- py3_7: Python ----------
# requirements: matplotlib

import matplotlib.pyplot as plt
import random as rd

fig, ax = plt.subplots()

counts = [rd.randint(0, 100), rd.randint(0, 100),
          rd.randint(0, 100), rd.randint(0, 100)]
fruits = ['apple', 'blueberry', 'cherry', 'orange']
bar_labels = ['red', 'blue', '_red', 'orange']
bar_colors = ['tab:red', 'tab:blue', 'tab:red', 'tab:orange']

ax.bar(fruits, counts, label=bar_labels, color=bar_colors)

ax.set_ylabel('fruit supply')
ax.set_title('Fruit supply by kind and color')
ax.legend(title='Fruit color')

plt.savefig(x)
a = x

#plt.show()
# ---------- end py3_7 ----------
tb_7 = CreateTextBlock(Text=format_5, TextSize=16, Justification=0)
image_4 = CreateImage(ImageSource=py3_7.a, ImageWidth=Slider(700, range=0..1000), ImageHeight=Slider(350, range=0..1000))
accent_colors_3 = ValueList({"Amber", "Blue", "Brown", "Cobalt", "Crimson", "Cyan", "Emerald", "Green", "Indigo", "Lime", "Magenta", "Mauve", "Olive", "Orange", "Pink", "Purple", "Red", "Sienna", "Steel", "Taupe", "Teal", "Violet", "Yellow"}, selected="Blue")
pt_11 = ConstructPoint(XCoordinate=Slider(24, range=0..1000), YCoordinate=Slider(258, range=0..1000), ZCoordinate=0)
entwine_77 = Entwine(Branch00=tb_7, Branch01=image_4, FlattenInputs=True)  # -> flatten(Result)

# ----
# Zoom detailed energy simulation
zoom_detailed_energy_simulation_2 = RemoteReceiver(zoom_detailed_energy_simulation)
panel_54 = Panel("Top")

# ----
# Zoom daylight simulation
zoom_daylight_simulation_2 = RemoteReceiver(zoom_daylight_simulation)
panel_55 = Panel(zoom_daylight_simulation_2)

# ----
# Zoom simple energy
zoom_simple_energy_simulation_2 = RemoteReceiver(zoom_simple_energy_simulation)
panel_56 = Panel(zoom_simple_energy_simulation_2)

# ----
# Should it really be computed every time a model is created?
panel_57 = Panel("LCA{000}.png")

# ----
# Recursion
panel_58 = Panel("Simple energy simulations")
objbynn_2 = GetObjectByNickname(NickName=panel_58)
simple_energy_simulations = Python3Script()  # -> status; same code as lca_window_status

entwine_78 = Entwine(Branch00=ma_3.Result, Branch01=simple_energy_simulations, FlattenInputs=True)
rec_4 = DataRecorder(entwine_78, DataLimit=2, RecordData=True)
item_7 = ListItem(List=rec_4, Index=0, Wrap=True)  # -> Item2, Item1, Item
equals_17 = Equality(FirstNumber=item_7.Item2, SecondNumber=item_7.Item1)  # -> Equality, Inequality
bang_2 = ExplodeTree(Data=equals_17.Inequality)  # -> Branch0, Branch1
py3_8 = Python3Script(x=bang_2.Branch0, y=bang_2.Branch1)  # -> a; same code as py3_6
event_4 = EventGate(Data=py3_8)  # -> Data, IsNew
freeze_gate_21 = StreamFreezeGate(Data=py3_8, PassingSwitch=event_4.IsNew)
event_5 = EventGate(Data=freeze_gate_21)  # -> Data, IsNew
panel_59 = Panel(event_5.Data)
launchwin_2 = LaunchWindow(
    Show=event_5.Data,
    Name="Simple energy simulations",
    Width=Slider(700, range=0..1000),
    Height=Slider(500, range=0..1000),
    ChildStatus=1,
    EnableHorizScroll=False)
winstat_2 = WindowStatus(Window=launchwin_2)
simple_energy_simulations_status = RemoteSender(winstat_2)
addelems_3 = AddElements(Window=launchwin_2, Elements=flatten(entwine_77), DoVLChecking=True)  # -> AddedElements, ElementNames
winprops_2 = SetWindowProperties(
    Window=launchwin_2,
    StartingLocation=pt_11,
    Theme=0,
    AccentColor=accent_colors_3,
    ShowTitleBar=True,
    BackgroundColor=RGB(255, 255, 255),
    ScaleFactor=1)

simple_energy_simulations_status_2 = RemoteReceiver(simple_energy_simulations_status)
expression_18 = Expression(x="Hidden", y=simple_energy_simulations_status_2, Expression="x=y")
expire_2 = ExpireObject(ObjectToExpire=objbynn_2, Expire=expression_18)

# ---- group: Building occupancy and systems
# Select window construction
subset_subface_skylight_2 = RemoteReceiver(subset_subface_skylight)
subset_subface_window_2 = RemoteReceiver(subset_subface_window)
subset_subface_window_3 = RemoteReceiver(subset_subface_window)
entwine_79 = Entwine(Branch00="Generic", Branch01=subset_subface_skylight_2, FlattenInputs=True)  # -> flatten(Result)
item_8 = ListItem(List=entwine_79, Index=subset_subface_window_2, Wrap=True)
expression_19 = Expression(x="Generic", y=item_8, Expression="x=y")
null_6 = NullObject()
null_7 = NullObject()
filter_6 = StreamFilter(Gate=expression_19, Stream0=item_8, Stream1=null_6)
windowconstr = HBWindowConstruction(materials=filter_6)  # -> constr; plug-in component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
cluster_3 = Cluster_2(window_construction=windowconstr, gwp_a1_a3="2.5", gwp_a4="0.042", density_kg_m2="38.2")

# ----
# Material database categories
material_database_categories_4 = RemoteReceiver(material_database_categories_2)

# ----
# Select exterior construction
subset_exterior_floor_2 = RemoteReceiver(subset_exterior_floor)
subset_exterior_roof_2 = RemoteReceiver(subset_exterior_roof)
subset_exterior_wall_2 = RemoteReceiver(subset_exterior_wall)
null_8 = NullObject()
null_9 = NullObject()
null_10 = NullObject()

# ----
# Select interior construction
subset_interior_floor_2 = RemoteReceiver(subset_interior_floor)
subset_interior_wall_2 = RemoteReceiver(subset_interior_wall)
null_11 = NullObject()
null_12 = NullObject()

# ----
# Select ground construction
subset_ground_floor_2 = RemoteReceiver(subset_ground_floor)
null_13 = NullObject()

# ----
# Recursion
panel_60 = Panel("Material database")
objbynn_3 = GetObjectByNickname(NickName=panel_60)
material_database = Python3Script()  # -> status; same code as lca_window_status

# ----
# Material database
number_slider_33 = Slider(10, range=0..100)
heath_flying_7 = RemoteReceiver(heath_flying)
material_database_categories_5 = RemoteReceiver(material_database_categories_2)
py3_9 = Python3Script(get=heath_flying_7)  # -> mpl_folder; same code as py3
repeat_4 = RepeatData(Data="X", Length=number_slider_33)  # -> graft(Data)
repeat_5 = RepeatData(Data="- ", Length=number_slider_33)  # -> graft(Data)
filepicker_6 = CreateFilePicker(ButtonLabelText="Load materials from file", DialogType=0, MustExist=True, Filter="Text file|*.txt", StartingPath=py3_9)
button_24 = CreateButton(ButtonName="Sync database", ButtonStyle=0)
button_25 = CreateButton(ButtonName="Load materials", ButtonStyle=0)
true_button_9 = CreateTrueOnlyButton(ButtonName="Create material", ButtonStyle=0)
label_32 = CreateLabel(LabelText=material_database_categories_5, LabelSize=18, Justification=0)
lng_6 = ListLength(List=label_32)
lng_7 = ListLength(List=label_32)
repeat_6 = RepeatData(Data=simplify(repeat_4), Length=lng_6)
repeat_7 = RepeatData(Data=simplify(repeat_5), Length=lng_6)
values_89 = ValueListener(Elements=button_24, SomeProperty=True)  # -> Values, Indices
values_90 = ValueListener(Elements=button_25, SomeProperty=True)  # -> Values, Indices
button_26 = CreateButton(ButtonName=repeat_6, ButtonStyle=3)
tb_8 = CreateTextBlock(Text=repeat_7, TextSize=12, Justification=0)
values_91 = ValueListener(Elements=filepicker_6, SomeProperty=True)  # -> Values, Indices
values_92 = ValueListener(Elements=true_button_9, SomeProperty=True)  # -> Values, Indices
freeze_gate_22 = StreamFreezeGate(Data=values_90.Values, PassingSwitch=invert(values_90.Values))
freeze_gate_23 = StreamFreezeGate(Data=values_89.Values, PassingSwitch=invert(values_89.Values))
values_93 = ValueListener(Elements=flatten(button_26), SomeProperty=True)  # -> flatten(Values), Indices
cull = CullPattern(List=values_93.Values, CullPattern=values_93.Values)  # -> flatten(List)
lng_8 = ListLength(List=cull)
filter_7 = StreamFilter(Gate=lng_8, Stream0="False", Stream1=cull)
freeze_gate_24 = StreamFreezeGate(Data=filter_7, PassingSwitch=invert(filter_7))
bool_23 = Boolean(values_91.Values)
bool_24 = Boolean(invert(freeze_gate_24))
create_material_modal = RemoteSender(values_92.Values)
null_14 = NullItem(Item=bool_23)  # -> NullFlags, InvalidFlags, Description
panel_61 = Panel(values_92.Values)
load_materials_file = RemoteSender(values_91.Values)
bool_25 = Boolean(invert(freeze_gate_22))
bool_26 = Boolean(invert(freeze_gate_23))
tap_15 = TapBuffer(Reset=False, Incremental=True, Valve=bool_24, Hold=True)
pre_material_database_remove_material = RemoteSender(values_93.Values)
tap_16 = TapBuffer(Reset=False, Incremental=True, Valve=bool_25, Hold=True)
tap_17 = TapBuffer(Reset=False, Incremental=True, Valve=bool_26, Hold=True)
dam_15 = DataDam(DataA=tap_15, BufferDelay=2500000, BufferMode=2)
dam_16 = DataDam(DataA=tap_16, BufferDelay=2500000, BufferMode=2)
suirify = Suirify(tb_8)
suirify_2 = Suirify(button_26)
dam_17 = DataDam(DataA=tap_17, BufferDelay=2500000, BufferMode=2)
hideshow_15 = HideShowElement(ElementToHideShow=button_25, Show=null_14.NullFlags, Collapse=True, Disable=False)
equals_18 = Equality(FirstNumber=tap_15, SecondNumber=dam_15)  # -> Equality, Inequality
entwine_80 = Entwine(Branch00=button_24, Branch01=true_button_9, FlattenInputs=True)  # -> flatten(Result)
merge_7 = Merge(Data1=graft(suirify), Data2=graft(suirify_2))
equals_19 = Equality(FirstNumber=tap_16, SecondNumber=dam_16)  # -> Equality, Inequality
equals_20 = Equality(FirstNumber=tap_17, SecondNumber=dam_17)  # -> Equality, Inequality
event_6 = EventGate(Data=equals_18.Inequality)  # -> Data, IsNew
stack_51 = CreateStack(UIElements=merge_7, Horizontal=True)
shfdep = ShiftToDepth(Tree=stack_51, Depth=Slider(1, range=0..100), shiftFromStart=False)
event_7 = EventGate(Data=equals_20.Inequality)  # -> Data, IsNew
stack_52 = CreateStack(UIElements=entwine_80, Horizontal=True)
material_database_remove_material = RemoteSender(event_6.Data)
sync_material_database = RemoteSender(event_7.Data)
shfdep_2 = ShiftToDepth(Tree=stack_51, Depth=Slider(1, range=0..100), shiftFromStart=False)
entwine_81 = Entwine(Branch00=filepicker_6, Branch01=button_25, FlattenInputs=True)  # -> flatten(Result)
merge_8 = Merge(Data1=simplify(graft(label_32)), Data2=shfdep_2)
stack_53 = CreateStack(UIElements=entwine_81, Horizontal=True)
adjustpos_59 = AdjustElementPositioning(ElementsToAdjust=button_25, AbsolutePositioning=False, Height=Slider(32, range=0..300), HorizontalAlignment=0)
adjustpos_60 = AdjustElementPositioning(
    ElementsToAdjust=filepicker_6,
    Margin="5, 10, 0, 0",
    AbsolutePositioning=False,
    Width=Slider(180, range=0..300),
    Height=Slider(32, range=0..300),
    HorizontalAlignment=0)
stack_54 = CreateStack(UIElements=merge_8, Horizontal=invert(True))
adjustpos_61 = AdjustElementPositioning(ElementsToAdjust=label_32, Margin="0, 10, 0, 0", AbsolutePositioning=False)
adjustpos_62 = AdjustElementPositioning(
    ElementsToAdjust=tb_8,
    Margin="0, 0, 10, 0",
    AbsolutePositioning=False,
    Width=Slider(275, range=0..300),
    Height=Slider(29, range=0..300),
    HorizontalAlignment=0,
    VerticalAlignment=1)
adjustpos_63 = AdjustElementPositioning(ElementsToAdjust=stack_51, Margin="5, 0, 0, 0", AbsolutePositioning=False, HorizontalAlignment=0)
adjustpos_64 = AdjustElementPositioning(
    ElementsToAdjust=button_26,
    AbsolutePositioning=False,
    Width=Slider(26, range=0..300),
    Height=Slider(26, range=0..300),
    HorizontalAlignment=1,
    VerticalAlignment=1)
adjustelem_5 = AdjustElementAppearance(ElementsToAdjust=button_26, Foreground=ColourSwatch(SwatchColor=RGB(255, 0, 0)), FontSize=Slider(12, range=0..50))

# ----
# Material database launch
open_material_database_2 = RemoteReceiver(open_material_database)
rec_5 = DataRecorder(open_material_database_2, DataLimit=-2, RecordData=True)
ma_4 = MassAddition(Input=rec_5)  # -> Result, PartialResults
entwine_82 = Entwine(Branch00=ma_4.Result, Branch01=material_database, FlattenInputs=True)
rec_6 = DataRecorder(entwine_82, DataLimit=2, RecordData=True)
item_9 = ListItem(List=rec_6, Index=0, Wrap=True)  # -> Item2, Item1, Item
equals_21 = Equality(FirstNumber=item_9.Item2, SecondNumber=item_9.Item1)  # -> Equality, Inequality
bang_3 = ExplodeTree(Data=equals_21.Inequality)  # -> Branch0, Branch1
py3_10 = Python3Script(x=bang_3.Branch0, y=bang_3.Branch1)  # -> a; same code as py3_6
event_8 = EventGate(Data=py3_10)  # -> Data, IsNew
freeze_gate_25 = StreamFreezeGate(Data=py3_10, PassingSwitch=event_8.IsNew)
event_9 = EventGate(Data=freeze_gate_25)  # -> Data, IsNew
panel_62 = Panel(event_9.Data)
entwine_83 = Entwine(Branch00=stack_52, Branch01=stack_54, Branch02=stack_8, Branch03=stack_53, FlattenInputs=True)  # -> flatten(Result)
accent_colors_4 = ValueList({"Amber", "Blue", "Brown", "Cobalt", "Crimson", "Cyan", "Emerald", "Green", "Indigo", "Lime", "Magenta", "Mauve", "Olive", "Orange", "Pink", "Purple", "Red", "Sienna", "Steel", "Taupe", "Teal", "Violet", "Yellow"}, selected="Blue")
database_modal_location_2 = RemoteReceiver(database_modal_location)
launchwin_3 = LaunchWindow(
    Show=event_9.Data,
    Name="Material database",
    Width=Slider(360, range=0..1000),
    Height=Slider(580, range=0..1000),
    ChildStatus=1,
    EnableHorizScroll=False)
winstat_3 = WindowStatus(Window=launchwin_3)
addelems_4 = AddElements(Window=launchwin_3, Elements=flatten(entwine_83), DoVLChecking=True)  # -> AddedElements, ElementNames
winprops_3 = SetWindowProperties(
    Window=launchwin_3,
    StartingLocation=database_modal_location_2,
    Theme=0,
    AccentColor=accent_colors_4,
    ShowTitleBar=True,
    BackgroundColor=RGB(255, 255, 255),
    ScaleFactor=1)
material_database_elements = RemoteSender(addelems_4.AddedElements)
material_database_status = RemoteSender(winstat_3)

material_database_status_2 = RemoteReceiver(material_database_status)
expression_20 = Expression(x="Hidden", y=material_database_status_2, Expression="x=y")
expire_3 = ExpireObject(ObjectToExpire=objbynn_3, Expire=expression_20)

material_database_status_3 = RemoteReceiver(material_database_status)
expression_21 = Expression(x="Normal", y=material_database_status_3, Expression="x=y")
and = GateAnd(A=equals_2.Inequality, B=expression_21)
event_10 = EventGate(Data=and)  # -> Data, IsNew
panel_63 = Panel(event_10.Data)
save_materials = RemoteSender(event_10.Data)

# ----
# Save materials
panel_64 = Panel("Heath materials category")
save_materials_2 = RemoteReceiver(save_materials)
getdocumentusertext_3 = Python3Script(run=save_materials_2, key=panel_64)  # -> json_string; same code as getdocumentusertext
getdocumentusertext_4 = Python3Script(run=save_materials_2, key="Heath materials")  # -> json_string; same code as getdocumentusertext
entwine_84 = Entwine(Branch00=getdocumentusertext_3, Branch01=getdocumentusertext_4, FlattenInputs=True)  # -> flatten(Result)
save_materials_file_2 = RemoteReceiver(save_materials_file)
join_3 = TextJoin(Text=entwine_84, Join="§")
writetxt_2 = WriteToTextFile(Run=save_materials_2, TextToWrite=join_3, FilePath=save_materials_file_2, Append=False, NewOnly=False)

# ----
# Recursion
panel_65 = Panel("Construction database")
objbynn_4 = GetObjectByNickname(NickName=panel_65)
construction_database = Python3Script()  # -> status; same code as lca_window_status

# ----
# Construction database
number_slider_34 = Slider(20, range=0..100)
heath_flying_8 = RemoteReceiver(heath_flying)
py3_11 = Python3Script(get=heath_flying_8)  # -> mpl_folder; same code as py3
repeat_8 = RepeatData(Data="- ", Length=number_slider_34)
repeat_9 = RepeatData(Data="X", Length=number_slider_34)
true_button_10 = CreateTrueOnlyButton(ButtonName="Create construction", ButtonStyle=0)
button_27 = CreateButton(ButtonName="Sync database", ButtonStyle=0)
label_33 = CreateLabel(LabelText="Constructions", LabelSize=18, Justification=0)
filepicker_7 = CreateFilePicker(
    ButtonLabelText="Load constructions from file",
    DialogType=0,
    MustExist=True,
    Filter="Text file|*.txt",
    StartingPath=py3_11)
values_94 = ValueListener(Elements=button_27, SomeProperty=True)  # -> Values, Indices
button_28 = CreateButton(ButtonName="Load constructions", ButtonStyle=0)
button_29 = CreateButton(ButtonName=repeat_9, ButtonStyle=3)
values_95 = ValueListener(Elements=true_button_10, SomeProperty=True)  # -> Values, Indices
tb_9 = CreateTextBlock(Text=repeat_8, TextSize=12, Justification=0)
values_96 = ValueListener(Elements=button_28, SomeProperty=True)  # -> Values, Indices
values_97 = ValueListener(Elements=filepicker_7, SomeProperty=True)  # -> Values, Indices
freeze_gate_26 = StreamFreezeGate(Data=values_94.Values, PassingSwitch=invert(values_94.Values))
values_98 = ValueListener(Elements=button_29, SomeProperty=True)  # -> flatten(Values), Indices
cull_2 = CullPattern(List=values_98.Values, CullPattern=values_98.Values)
lng_9 = ListLength(List=cull_2)
filter_8 = StreamFilter(Gate=lng_9, Stream0="False", Stream1=cull_2)
freeze_gate_27 = StreamFreezeGate(Data=filter_8, PassingSwitch=invert(filter_8))
bool_27 = Boolean(invert(freeze_gate_27))
freeze_gate_28 = StreamFreezeGate(Data=values_96.Values, PassingSwitch=invert(values_96.Values))
create_construction_modal = RemoteSender(values_95.Values)
panel_66 = Panel(values_95.Values)
bool_28 = Boolean(values_97.Values)
bool_29 = Boolean(invert(freeze_gate_26))
tap_18 = TapBuffer(Reset=False, Incremental=True, Valve=bool_27, Hold=True)
pre_construction_database_remove_constru = RemoteSender(values_98.Values)  # "pre_construction_database_remove_construction"
load_constructions_file = RemoteSender(values_97.Values)
null_15 = NullItem(Item=bool_28)  # -> NullFlags, InvalidFlags, Description
bool_30 = Boolean(invert(freeze_gate_28))
tap_19 = TapBuffer(Reset=False, Incremental=True, Valve=bool_29, Hold=True)
expander_3 = CreateExpander(UIElements=simplify(graft(tb_9)), Header=simplify(graft(repeat_8)), Open=invert(True))  # -> flatten(Expander)
dam_18 = DataDam(DataA=tap_18, BufferDelay=2500000, BufferMode=2)
tap_20 = TapBuffer(Reset=False, Incremental=True, Valve=bool_30, Hold=True)
dam_19 = DataDam(DataA=tap_19, BufferDelay=2500000, BufferMode=2)
equals_22 = Equality(FirstNumber=tap_18, SecondNumber=dam_18)  # -> Equality, Inequality
dam_20 = DataDam(DataA=tap_20, BufferDelay=2500000, BufferMode=2)
equals_23 = Equality(FirstNumber=tap_19, SecondNumber=dam_19)  # -> Equality, Inequality
event_11 = EventGate(Data=equals_22.Inequality)  # -> Data, IsNew
hideshow_16 = HideShowElement(ElementToHideShow=button_28, Show=null_15.NullFlags, Collapse=True, Disable=False)
suirify_3 = Suirify(expander_3)
suirify_4 = Suirify(button_29)
equals_24 = Equality(FirstNumber=tap_20, SecondNumber=dam_20)  # -> Equality, Inequality
event_12 = EventGate(Data=equals_23.Inequality)  # -> Data, IsNew
merge_9 = Merge(Data1=graft(suirify_3), Data2=graft(suirify_4))
construction_database_remove_constructio = RemoteSender(event_11.Data)  # "construction_database_remove_construction"
sync_construction_database = RemoteSender(event_12.Data)
entwine_85 = Entwine(Branch00=filepicker_7, Branch01=button_28, FlattenInputs=True)  # -> flatten(Result)
stack_55 = CreateStack(UIElements=merge_9, Horizontal=True)  # -> flatten(Stack)
entwine_86 = Entwine(Branch00=button_27, Branch01=true_button_10, FlattenInputs=True)  # -> flatten(Result)
stack_56 = CreateStack(UIElements=entwine_85, Horizontal=True)
adjustpos_65 = AdjustElementPositioning(ElementsToAdjust=button_28, AbsolutePositioning=False, Height=Slider(32, range=0..300), HorizontalAlignment=0)
adjustpos_66 = AdjustElementPositioning(
    ElementsToAdjust=filepicker_7,
    AbsolutePositioning=False,
    Width=Slider(180, range=0..300),
    Height=Slider(32, range=0..300),
    HorizontalAlignment=0)
stack_57 = CreateStack(UIElements=entwine_86, Horizontal=True)
adjustpos_67 = AdjustElementPositioning(ElementsToAdjust=stack_55, Margin="5, 0, 0, 0", AbsolutePositioning=False, HorizontalAlignment=0)
adjustpos_68 = AdjustElementPositioning(
    ElementsToAdjust=button_29,
    AbsolutePositioning=False,
    Width=Slider(26, range=0..300),
    Height=Slider(26, range=0..300),
    HorizontalAlignment=2,
    VerticalAlignment=1)
adjustelem_6 = AdjustElementAppearance(ElementsToAdjust=button_29, Foreground=ColourSwatch(SwatchColor=RGB(255, 0, 0)), FontSize=Slider(12, range=0..50))

# ----
# Construction database launch
open_construction_database_2 = RemoteReceiver(open_construction_database)
rec_7 = DataRecorder(open_construction_database_2, DataLimit=-2, RecordData=True)
ma_5 = MassAddition(Input=rec_7)  # -> Result, PartialResults
entwine_87 = Entwine(Branch00=ma_5.Result, Branch01=construction_database, FlattenInputs=True)
rec_8 = DataRecorder(entwine_87, DataLimit=2, RecordData=True)
item_10 = ListItem(List=rec_8, Index=0, Wrap=True)  # -> Item2, Item1, Item
equals_25 = Equality(FirstNumber=item_10.Item2, SecondNumber=item_10.Item1)  # -> Equality, Inequality
bang_4 = ExplodeTree(Data=equals_25.Inequality)  # -> Branch0, Branch1
py3_12 = Python3Script(x=bang_4.Branch0, y=bang_4.Branch1)  # -> a; same code as py3_6
event_13 = EventGate(Data=py3_12)  # -> Data, IsNew
freeze_gate_29 = StreamFreezeGate(Data=py3_12, PassingSwitch=event_13.IsNew)
event_14 = EventGate(Data=freeze_gate_29)  # -> Data, IsNew
database_modal_location_3 = RemoteReceiver(database_modal_location)
entwine_88 = Entwine(Branch00=stack_57, Branch01=label_33, Branch02=stack_55, Branch03=stack_9, Branch04=stack_56, FlattenInputs=True)  # -> flatten(Result)
panel_67 = Panel(event_14.Data)
accent_colors_5 = ValueList({"Amber", "Blue", "Brown", "Cobalt", "Crimson", "Cyan", "Emerald", "Green", "Indigo", "Lime", "Magenta", "Mauve", "Olive", "Orange", "Pink", "Purple", "Red", "Sienna", "Steel", "Taupe", "Teal", "Violet", "Yellow"}, selected="Blue")
launchwin_4 = LaunchWindow(
    Show=event_14.Data,
    Name="Construction database",
    Width=Slider(360, range=0..1000),
    Height=Slider(580, range=0..1000),
    ChildStatus=1,
    EnableHorizScroll=False)
winstat_4 = WindowStatus(Window=launchwin_4)
addelems_5 = AddElements(Window=launchwin_4, Elements=flatten(entwine_88), DoVLChecking=True)  # -> AddedElements, ElementNames
winprops_4 = SetWindowProperties(
    Window=launchwin_4,
    StartingLocation=database_modal_location_3,
    Theme=0,
    AccentColor=accent_colors_5,
    ShowTitleBar=True,
    BackgroundColor=RGB(255, 255, 255),
    ScaleFactor=1)
construction_database_status = RemoteSender(winstat_4)
construction_database_elements = RemoteSender(addelems_5.AddedElements)

construction_database_status_2 = RemoteReceiver(construction_database_status)
expression_22 = Expression(x="Hidden", y=construction_database_status_2, Expression="x=y")
expire_4 = ExpireObject(ObjectToExpire=objbynn_4, Expire=expression_22)

construction_database_status_3 = RemoteReceiver(construction_database_status)
expression_23 = Expression(x="Normal", y=construction_database_status_3, Expression="x=y")
and_2 = GateAnd(A=equals_3.Inequality, B=expression_23)
event_15 = EventGate(Data=and_2)  # -> Data, IsNew
save_constructions = RemoteSender(event_15.Data)
panel_68 = Panel(event_15.Data)
adjustpos_69 = AdjustElementPositioning(ElementsToAdjust=expander_3, Margin="0, 0, 0, 5", AbsolutePositioning=False, HorizontalAlignment=0)
panel_69 = Panel(winstat_4)

# ----
# Save constructions
save_constructions_2 = RemoteReceiver(save_constructions)
save_constructions_file_2 = RemoteReceiver(save_constructions_file)
getdocumentusertext_5 = Python3Script(run=save_constructions_2, key="Heath constructions")  # -> json_string; same code as getdocumentusertext
writetxt_3 = WriteToTextFile(
    Run=save_constructions_2,
    TextToWrite=getdocumentusertext_5,
    FilePath=save_constructions_file_2,
    Append=False,
    NewOnly=False)

# ----
# Heath launch window
restart_heath_2 = RemoteReceiver(restart_heath)
panel_70 = Panel("Heath provides a user interface for life cycle building performance assessment in the Rhino environment.")
gate_7 = StreamGate(Stream="Start", Gate=restart_heath_2)  # -> Target0, Target1
true_button_11 = CreateTrueOnlyButton(ButtonName="Github Heath", ButtonStyle=0)
true_button_12 = CreateTrueOnlyButton(ButtonName=gate_7.Target0, ButtonStyle=0)
tb_10 = CreateTextBlock(TextSize=16, Justification=1)
tb_11 = CreateTextBlock(TextSize=12, Justification=0)
values_99 = ValueListener(Elements=true_button_11, SomeProperty=True)  # -> Values, Indices
values_100 = ValueListener(Elements=true_button_12, SomeProperty=True)  # -> Values, Indices
settextblock_2 = SetTextBlockContents(TextBlockToModify=tb_10, NewTextBlockContents="Email: sawen@chalmers.se")
settextblock_3 = SetTextBlockContents(TextBlockToModify=tb_11, NewTextBlockContents=panel_70)
launch_heath = RemoteSender(values_100.Values)
github_heath = RemoteSender(values_99.Values)
accent_colors_6 = ValueList({"Amber", "Blue", "Brown", "Cobalt", "Crimson", "Cyan", "Emerald", "Green", "Indigo", "Lime", "Magenta", "Mauve", "Olive", "Orange", "Pink", "Purple", "Red", "Sienna", "Steel", "Taupe", "Teal", "Violet", "Yellow"}, selected="Blue")
pt_12 = ConstructPoint(XCoordinate=Slider(142, range=0..1000), YCoordinate=Slider(193, range=0..1000), ZCoordinate=0)
entwine_89 = Entwine(Branch00=tb_11, Branch01=true_button_11, Branch02=true_button_12, Branch03=tb_10, FlattenInputs=True)  # -> flatten(Result)
adjustpos_70 = AdjustElementPositioning(ElementsToAdjust=tb_11, AbsolutePositioning=False, Height=Slider(60, range=0..100))
adjustpos_71 = AdjustElementPositioning(ElementsToAdjust=tb_10, Margin="0, 8, 0, 0", AbsolutePositioning=False, Height=Slider(20, range=0..100))

# ----
# Heath github
panel_71 = Panel("https://github.com/sawenchalmers/heath")
github_heath_2 = RemoteReceiver(github_heath)
py3_13 = Python3Script(url=panel_71, launch=github_heath_2)
# ---------- py3_13: Python ----------
"""Grasshopper Script"""
import webbrowser as wb
if launch == True:
    wb.open(url, 2, True)
# ---------- end py3_13 ----------

# ----
# Window database
panel_72 = Panel("Create window")
heath_flying_9 = RemoteReceiver(heath_flying)
true_button_13 = CreateTrueOnlyButton(ButtonName=panel_72, ButtonStyle=0)
py3_14 = Python3Script(get=heath_flying_9)  # -> mpl_folder; same code as py3
values_101 = ValueListener(Elements=true_button_13, SomeProperty=True)  # -> Values, Indices
repeat_10 = RepeatData(Data="X", Length=number_slider_5)
filepicker_8 = CreateFilePicker(ButtonLabelText="Load windows from file", DialogType=0, MustExist=True, Filter="Text file|*.txt", StartingPath=py3_14)
button_30 = CreateButton(ButtonName="Load windows", ButtonStyle=0)
button_31 = CreateButton(ButtonName=repeat_10, ButtonStyle=3)
values_102 = ValueListener(Elements=button_30, SomeProperty=True)  # -> Values, Indices
create_window_modal = RemoteSender(values_101.Values)
label_34 = CreateLabel(LabelText="Windows", LabelSize=18, Justification=0)
panel_73 = Panel(values_101.Values)
values_103 = ValueListener(Elements=filepicker_8, SomeProperty=True)  # -> Values, Indices
freeze_gate_30 = StreamFreezeGate(Data=values_102.Values, PassingSwitch=invert(values_102.Values))
bool_31 = Boolean(values_103.Values)
null_16 = NullItem(Item=bool_31)  # -> NullFlags, InvalidFlags, Description
bool_32 = Boolean(invert(freeze_gate_30))
load_windows_file = RemoteSender(values_103.Values)
tap_21 = TapBuffer(Reset=False, Incremental=True, Valve=bool_32, Hold=True)
dam_21 = DataDam(DataA=tap_21, BufferDelay=2500000, BufferMode=2)
hideshow_17 = HideShowElement(ElementToHideShow=button_30, Show=null_16.NullFlags, Collapse=True, Disable=False)
equals_26 = Equality(FirstNumber=tap_21, SecondNumber=dam_21)  # -> Equality, Inequality
entwine_90 = Entwine(Branch00=filepicker_8, Branch01=button_30, FlattenInputs=True)  # -> flatten(Result)
stack_58 = CreateStack(UIElements=entwine_90, Horizontal=True)
adjustpos_72 = AdjustElementPositioning(
    ElementsToAdjust=filepicker_8,
    AbsolutePositioning=False,
    Width=Slider(180, range=0..300),
    Height=Slider(32, range=0..300),
    HorizontalAlignment=0)
adjustpos_73 = AdjustElementPositioning(ElementsToAdjust=button_30, AbsolutePositioning=False, Height=Slider(32, range=0..300), HorizontalAlignment=0)
adjustpos_74 = AdjustElementPositioning(
    ElementsToAdjust=button_31,
    AbsolutePositioning=False,
    Width=Slider(26, range=0..300),
    Height=Slider(26, range=0..300),
    HorizontalAlignment=1,
    VerticalAlignment=1)
adjustelem_7 = AdjustElementAppearance(ElementsToAdjust=button_31, Foreground=ColourSwatch(SwatchColor=RGB(255, 0, 0)), FontSize=Slider(12, range=0..50))

repeat_11 = RepeatData(Data="- ", Length=number_slider_5)
values_104 = ValueListener(Elements=button_31, SomeProperty=True)  # -> flatten(Values), Indices
cull_3 = CullPattern(List=values_104.Values, CullPattern=values_104.Values)
lng_10 = ListLength(List=cull_3)
filter_9 = StreamFilter(Gate=lng_10, Stream0="False", Stream1=cull_3)
freeze_gate_31 = StreamFreezeGate(Data=filter_9, PassingSwitch=invert(filter_9))
bool_33 = Boolean(invert(freeze_gate_31))
entwine_91 = Entwine(Branch00=button_3, Branch01=true_button_13, FlattenInputs=True)  # -> flatten(Result)
tap_22 = TapBuffer(Reset=False, Incremental=True, Valve=bool_33, Hold=True)
pre_window_database_remove_window = RemoteSender(values_104.Values)
dam_22 = DataDam(DataA=tap_22, BufferDelay=2500000, BufferMode=2)
stack_59 = CreateStack(UIElements=entwine_91, Horizontal=True)
equals_27 = Equality(FirstNumber=tap_22, SecondNumber=dam_22)  # -> Equality, Inequality
event_16 = EventGate(Data=equals_27.Inequality)  # -> Data, IsNew
suirify_5 = Suirify(button_31)
window_database_remove_window = RemoteSender(event_16.Data)

# ----
# Recursion
panel_74 = Panel("Heath main")
objbynn_5 = GetObjectByNickname(NickName=panel_74)
heath_main = Python3Script()  # -> status; same code as lca_window_status

# ----
# Heath window
launch_heath_2 = RemoteReceiver(launch_heath)
rec_9 = DataRecorder(launch_heath_2, DataLimit=-2, RecordData=True)
ma_6 = MassAddition(Input=rec_9)  # -> Result, PartialResults
entwine_92 = Entwine(Branch00=ma_6.Result, Branch01=heath_main, FlattenInputs=True)
rec_10 = DataRecorder(entwine_92, DataLimit=2, RecordData=True)
item_11 = ListItem(List=rec_10, Index=0, Wrap=True)  # -> Item2, Item1, Item
equals_28 = Equality(FirstNumber=item_11.Item2, SecondNumber=item_11.Item1)  # -> Equality, Inequality
bang_5 = ExplodeTree(Data=equals_28.Inequality)  # -> Branch0, Branch1
data_12 = Data(location_23)
data_13 = Data(location_19)
data_14 = Data(location_20)
data_15 = Data(location_22)
data_16 = Data(location_21)
panel_75 = Panel("C:\Users\Isac\Desktop\Toivo_Chalmers\heath\Icons\butterfly_smol.png")
entwine_93 = Entwine(Branch00=stack_50, FlattenInputs=True)
entwine_94 = Entwine(Branch00=entwine_55, Branch01=location_17, FlattenInputs=True)
entwine_95 = Entwine(Branch00=stack_31, Branch01=preview, Branch02=location_6, FlattenInputs=True)
entwine_96 = Entwine(
    Branch00=location_7,
    Branch01=location_8,
    Branch02=location_11,
    Branch03=location_10,
    Branch04=location_9,
    FlattenInputs=True)
entwine_97 = Entwine(Branch00=stack_20, FlattenInputs=True)
entwine_98 = Entwine(Branch00=data_14, Branch01=data_15, Branch02=data_16, Branch03=data_12, Branch04=data_13, FlattenInputs=True)
py3_15 = Python3Script(x=bang_5.Branch0, y=bang_5.Branch1)  # -> a; same code as py3_6
event_17 = EventGate(Data=py3_15)  # -> Data, IsNew
freeze_gate_32 = StreamFreezeGate(Data=py3_15, PassingSwitch=event_17.IsNew)
number_slider_35 = Slider(500, range=0..1000)
number_slider_36 = Slider(460, range=0..1000)
panel_76 = Panel("""Geometry module
Program module
Construction module
Assembly module
Visualize module
Analysis module""")
event_18 = EventGate(Data=freeze_gate_32)  # -> Data, IsNew
tabs = TabbedView(
    TabNames=panel_76,
    TabTextSize=Slider(12, range=0..100),
    Tab0=flatten(entwine_95),
    Tab1=flatten(entwine_96),
    Tab2=flatten(entwine_94),
    Tab3=flatten(entwine_93),
    Tab4=flatten(entwine_97),
    Tab5=flatten(entwine_98))
launchwin_5 = LaunchWindow(
    Show=event_18.Data,
    Name="Heath",
    Width=number_slider_35,
    Height=number_slider_36,
    ChildStatus=1,
    EnableHorizScroll=False)
launchxpwin_2 = LaunchTransparentWindow(
    Show=Toggle(False),
    Name="Heath",
    Width=number_slider_35,
    Height=number_slider_36,
    ChildStatus=1,
    EnableHorizScroll=False)
panel_77 = Panel(event_18.Data)
heath_is_active = RemoteSender(event_18.Data)
heath_window = RemoteSender(launchwin_5)
values_105 = ValueListener(Elements=tabs, SomeProperty=True)  # -> Values, Indices
adjustpos_75 = AdjustElementPositioning(ElementsToAdjust=tabs, AbsolutePositioning=False, Width=Slider(365, range=100..1500))
adjustpos_76 = AdjustElementPositioning(
    ElementsToAdjust=[entwine_95, entwine_96, entwine_94, entwine_93, entwine_97, entwine_98],
    Margin="0, 5, 0, 0",
    AbsolutePositioning=False,
    HorizontalAlignment=0,
    VerticalAlignment=2)
accent_colors_7 = ValueList({"Amber", "Blue", "Brown", "Cobalt", "Crimson", "Cyan", "Emerald", "Green", "Indigo", "Lime", "Magenta", "Mauve", "Olive", "Orange", "Pink", "Purple", "Red", "Sienna", "Steel", "Taupe", "Teal", "Violet", "Yellow"}, selected="Blue")
heath_window_location_2 = RemoteReceiver(heath_window_location)
subtraction_3 = Subtraction(A=number_slider_36, B=Slider(52, range=0..100))
current_tab = RemoteSender(values_105.Values)
current_tab_index = RemoteSender(values_105.Indices)
separator = CreateSeparator(Thickness=0.5, Horizontal=invert(True), Color=RGB(0, 0, 0), Height=subtraction_3)
winprops_5 = SetWindowProperties(
    Window=launchwin_5,
    StartingLocation=heath_window_location_2,
    Theme=0,
    AccentColor=accent_colors_7,
    ShowTitleBar=True,
    BackgroundColor=RGB(255, 255, 255),
    ScaleFactor=1)
entwine_99 = Entwine(Branch00=tabs, Branch01=separator, Branch02=stack_11, FlattenInputs=True)  # -> flatten(Result)
stack_60 = CreateStack(UIElements=entwine_99, Horizontal=True)
addelems_6 = AddElements(Window=launchwin_5, Elements=flatten(stack_60), DoVLChecking=True)  # -> AddedElements, ElementNames
winstat_5 = WindowStatus(Window=launchwin_5)
heath_status = RemoteSender(winstat_5)
heath_status_2 = RemoteReceiver(heath_status)
heath_elements = RemoteSender(addelems_6.AddedElements)

current_tab_2 = RemoteReceiver(current_tab)
expression_24 = Expression(x="Geometry module", y=current_tab_2, Expression="x=y")
and_3 = GateAnd(A=equals_8.Inequality, B=expression_24)
event_19 = EventGate(Data=and_3)  # -> Data, IsNew
savegeometry = RemoteSender(event_19.Data)
savegeometry_2 = RemoteReceiver(savegeometry)
savegeometry_3 = RemoteReceiver(savegeometry)
current_tab_3 = RemoteReceiver(current_tab)
expression_25 = Expression(x="Analysis module", y=current_tab_3, Expression="x=y")

heath_is_active_2 = RemoteReceiver(heath_is_active)
launchwin_6 = LaunchWindow(
    Show=invert(heath_is_active_2),
    Name="Heath",
    Width=Slider(275, range=0..1000),
    Height=Slider(220, range=0..1000),
    ChildStatus=1,
    EnableHorizScroll=False)
winprops_6 = SetWindowProperties(
    Window=launchwin_6,
    StartingLocation=pt_12,
    Theme=0,
    AccentColor=accent_colors_6,
    ShowTitleBar=True,
    BackgroundColor=RGB(255, 255, 255),
    ScaleFactor=1)
addelems_7 = AddElements(Window=launchwin_6, Elements=flatten(entwine_89), DoVLChecking=True)  # -> AddedElements, ElementNames
winstat_6 = WindowStatus(Window=launchwin_6)
heath_launch_status = RemoteSender(winstat_6)
heath_launch_elements = RemoteSender(addelems_7.AddedElements)

expression_26 = Expression(x="Hidden", y=heath_status_2, Expression="x=y")
expire_5 = ExpireObject(ObjectToExpire=objbynn_5, Expire=expression_26)

current_tab_4 = RemoteReceiver(current_tab)
expression_27 = Expression(x="Analysis module", y=current_tab_4, Expression="x=y")

current_tab_5 = RemoteReceiver(current_tab)
current_tab_6 = RemoteReceiver(current_tab)
current_tab_7 = RemoteReceiver(current_tab)
current_tab_8 = RemoteReceiver(current_tab)
current_tab_9 = RemoteReceiver(current_tab)
current_tab_10 = RemoteReceiver(current_tab)
expression_28 = Expression(x="Assembly module", y=current_tab_5, Expression="x=y")
expression_29 = Expression(x="Assembly module", y=current_tab_6, Expression="x=y")
expression_30 = Expression(x="Assembly module", y=current_tab_7, Expression="x=y")
expression_31 = Expression(x="Assembly module", y=current_tab_8, Expression="x=y")
current_tab_11 = RemoteReceiver(current_tab)
expression_32 = Expression(x="Assembly module", y=current_tab_9, Expression="x=y")
expression_33 = Expression(x="Assembly module", y=current_tab_10, Expression="x=y")
current_tab_12 = RemoteReceiver(current_tab)
expression_34 = Expression(x="Assembly module", y=current_tab_11, Expression="x=y")
expression_35 = Expression(x="Assembly module", y=current_tab_12, Expression="x=y")
and_4 = GateAnd(A=values_53.Values, B=expression_34)
current_tab_13 = RemoteReceiver(current_tab)
show_honeybee_all = RemoteSender(and_4)
show_honeybee_all_2 = RemoteReceiver(show_honeybee_all)
show_honeybee_all_3 = RemoteReceiver(show_honeybee_all)
show_honeybee_all_4 = RemoteReceiver(show_honeybee_all)
show_honeybee_all_5 = RemoteReceiver(show_honeybee_all)
show_honeybee_all_6 = RemoteReceiver(show_honeybee_all)
show_honeybee_all_7 = RemoteReceiver(show_honeybee_all)
show_honeybee_all_8 = RemoteReceiver(show_honeybee_all)
or_5 = GateOr(A=values_50.Values, B=show_honeybee_all_2)
or_6 = GateOr(A=values_51.Values, B=show_honeybee_all_3)
or_7 = GateOr(A=values_52.Values, B=show_honeybee_all_4)
or_8 = GateOr(A=values_54.Values, B=show_honeybee_all_5)
or_9 = GateOr(A=values_55.Values, B=show_honeybee_all_6)
or_10 = GateOr(A=values_56.Values, B=show_honeybee_all_7)
or_11 = GateOr(A=values_57.Values, B=show_honeybee_all_8)
and_5 = GateAnd(A=or_5, B=expression_28)
and_6 = GateAnd(A=or_6, B=expression_35)
and_7 = GateAnd(A=or_7, B=expression_29)
and_8 = GateAnd(A=or_8, B=expression_30)
and_9 = GateAnd(A=or_9, B=expression_31)
and_10 = GateAnd(A=or_10, B=expression_32)
and_11 = GateAnd(A=or_11, B=expression_33)
current_tab_14 = RemoteReceiver(current_tab)
expression_36 = Expression(x="Assembly module", y=current_tab_13, Expression="x=y")
show_honeybee_context = RemoteSender(and_6)
show_honeybee_ground = RemoteSender(and_8)
show_honeybee_floors = RemoteSender(and_9)
show_honeybee_walls = RemoteSender(and_11)
show_honeybee_windows = RemoteSender(and_7)
show_honeybee_roof = RemoteSender(and_10)
show_honeybee_doors = RemoteSender(and_5)
expression_37 = Expression(x="Assembly module", y=current_tab_14, Expression="x=y")
and_12 = GateAnd(A=equals_9.Inequality, B=expression_36)
and_13 = GateAnd(A=equals_10.Inequality, B=expression_37)
event_20 = EventGate(Data=and_12)  # -> Data, IsNew
event_21 = EventGate(Data=and_13)  # -> Data, IsNew
create_model_2 = RemoteSender(event_20.Data)
panel_78 = Panel(event_20.Data)
bake_model = RemoteSender(event_21.Data)

create_model_3 = RemoteReceiver(create_model_2)
freeze_gate_33 = StreamFreezeGate(Data=create_model_3, PassingSwitch=create_model_3)
py3_16 = Python3Script(get=freeze_gate_33)  # -> mpl_folder; same code as py3
nextfile_2 = NextAvailableFilename(Format=panel_57, FolderPath=py3_16, Trigger=create_model_3)

py3_17 = Python3Script(
    file_location=nextfile_2,
    y_label="GWP (kg CO2eq)",
    title="GWP by element type (kg CO2eq)",
    labels=lca_element_types_2,
    values=expression_16,
    colors=fragment)  # -> out, file_location_out; inputs labels: list, values: list, colors: list
# ---------- py3_17: Python ----------
# requirements: matplotlib
# requirements: numpy

import matplotlib.pyplot as plt
import numpy as np

fig, ax = plt.subplots()

for i in range(len(colors)):
    colors[i] = colors[i].split(',')
    colors[i] = tuple([float(j) for j in colors[i]])

fig, ax = plt.subplots(figsize=(14, 6))
ax.bar(labels, values, label=labels, color=colors, align="center")
bottom = 0
for i in range(len(labels)):
    ax.bar('total GWP', values[i], color=colors[i], bottom=bottom, align='center')
    bottom += values[i]

ax.set_ylim(0, sum(values)*1.1)
ax.set_ylabel(y_label)
ax.set_title(title)

plt.subplots_adjust(right=0.8)

ax.legend(title=title, bbox_to_anchor=(1.0, 1), loc='upper left', reverse=True)

plt.savefig(file_location)
file_location_out = file_location

#plt.show()
# ---------- end py3_17 ----------
setimg = SetImage(ImageToModify=image_3, NewImagePath=py3_17.file_location_out)

current_tab_15 = RemoteReceiver(current_tab)
expression_38 = Expression(x="Geometry module", y=current_tab_15, Expression="x=y")
and_14 = GateAnd(A=bool_15, B=expression_38)
preview_2 = RemoteSender(and_14)
heath_status_3 = RemoteReceiver(heath_status)
current_tab_16 = RemoteReceiver(current_tab)
expression_39 = Expression(x="Geometry module", y=current_tab_16, Expression="x=y")
expression_40 = Expression(x="Hidden", y=heath_status_3, Expression="x=y")
and_15 = GateAnd(A=equals_7.Inequality, B=expression_39, C=invert(expression_40))
event_22 = EventGate(Data=and_15)  # -> Data, IsNew
create_test_model = RemoteSender(event_22.Data)

create_test_model_2 = RemoteReceiver(create_test_model)
bake = BakeObjects(Geometry=entwine_20, Attributes=repeat_3, Bake=create_test_model_2, createGroups=False)  # -> Message, Ghosts

create_test_model_3 = RemoteReceiver(create_test_model)
create_test_model_4 = RemoteReceiver(create_test_model)
create_test_model_5 = RemoteReceiver(create_test_model)
create_test_model_6 = RemoteReceiver(create_test_model)

current_tab_17 = RemoteReceiver(current_tab)
expression_41 = Expression(x="Visualize module", y=current_tab_17, Expression="x=y")
and_16 = GateAnd(A=values_28.Values, B=expression_41)
current_tab_18 = RemoteReceiver(current_tab)
weather_visualization_show = RemoteSender(and_16)
current_tab_19 = RemoteReceiver(current_tab)
current_tab_20 = RemoteReceiver(current_tab)
current_tab_21 = RemoteReceiver(current_tab)
current_tab_22 = RemoteReceiver(current_tab)
current_tab_23 = RemoteReceiver(current_tab)
expression_42 = Expression(x="Visualize module", y=current_tab_18, Expression="x=y")
expression_43 = Expression(x="Visualize module", y=current_tab_20, Expression="x=y")
expression_44 = Expression(x="Visualize module", y=current_tab_19, Expression="x=y")
expression_45 = Expression(x="Visualize module", y=current_tab_21, Expression="x=y")
expression_46 = Expression(x="Visualize module", y=current_tab_22, Expression="x=y")
expression_47 = Expression(x="Visualize module", y=current_tab_23, Expression="x=y")
and_17 = GateAnd(A=equals_6.Inequality, B=expression_42)
and_18 = GateAnd(A=equals_5.Inequality, B=expression_43)
and_19 = GateAnd(A=values_30.Values, B=expression_44)
and_20 = GateAnd(A=values_35.Values, B=expression_45)
and_21 = GateAnd(A=values_34.Values, B=expression_46)
and_22 = GateAnd(A=values_37.Values, B=expression_47)
event_23 = EventGate(Data=and_17)  # -> Data, IsNew
event_24 = EventGate(Data=and_18)  # -> Data, IsNew
room_energy_attribute_visualize = RemoteSender(and_19)
face_attribute_visualize = RemoteSender(and_20)
room_attribute_visualize = RemoteSender(and_21)
face_energy_attribute_visualize = RemoteSender(and_22)
weather_visualisation_bake = RemoteSender(event_23.Data)
run_weather_visualisation = RemoteSender(event_24.Data)

run_weather_visualisation_2 = RemoteReceiver(run_weather_visualisation)

current_tab_24 = RemoteReceiver(current_tab)
current_tab_25 = RemoteReceiver(current_tab)
current_tab_26 = RemoteReceiver(current_tab)
current_tab_27 = RemoteReceiver(current_tab)
expression_48 = Expression(x="Analysis module", y=current_tab_24, Expression="x=y")
expression_49 = Expression(x="Analysis module", y=current_tab_25, Expression="x=y")
expression_50 = Expression(x="Analysis module", y=current_tab_26, Expression="x=y")
expression_51 = Expression(x="Analysis module", y=current_tab_27, Expression="x=y")
and_23 = GateAnd(A=equals_11.Inequality, B=expression_48)
and_24 = GateAnd(A=equals_12.Inequality, B=expression_49)
and_25 = GateAnd(A=equals_13.Inequality, B=expression_50)
and_26 = GateAnd(A=equals_14.Inequality, B=expression_51)
event_25 = EventGate(Data=and_23)  # -> Data, IsNew
event_26 = EventGate(Data=and_24)  # -> Data, IsNew
event_27 = EventGate(Data=and_25)  # -> Data, IsNew
event_28 = EventGate(Data=and_26)  # -> Data, IsNew
run_daylight_simulations = RemoteSender(event_25.Data)
run_simple_energy_simulations = RemoteSender(event_26.Data)
calculate_glare_probability = RemoteSender(event_27.Data)
run_detailed_energy_simulations = RemoteSender(event_28.Data)

run_detailed_energy_simulations_2 = RemoteReceiver(run_detailed_energy_simulations)
calculate_glare_probability_2 = RemoteReceiver(calculate_glare_probability)
run_glare_analysis = Boolean(calculate_glare_probability_2)
run_simple_energy_simulations_2 = RemoteReceiver(run_simple_energy_simulations)
panel_79 = Panel(run_simple_energy_simulations_2)

savegeometry_4 = RemoteReceiver(savegeometry)
savegeometry_5 = RemoteReceiver(savegeometry)
savegeometry_6 = RemoteReceiver(savegeometry)
preview_3 = RemoteReceiver(preview_2)
savegeometry_7 = RemoteReceiver(savegeometry)
savegeometry_8 = RemoteReceiver(savegeometry)
py3_18 = Python3Script(x=savegeometry_4)  # -> a
# ---------- py3_18: Python ----------
"""Grasshopper Script"""

import rhinoscriptsyntax as rs

if x:
    rs.Command("SelNone")
    a = True
# ---------- end py3_18 ----------
preview_4 = RemoteReceiver(preview_2)
preview_5 = RemoteReceiver(preview_2)
preview_6 = RemoteReceiver(preview_2)
or_12 = GateOr(A=Toggle(True), B=py3_18)
or_13 = GateOr(A=savegeometry_6, B=preview_4, C=expression_5, D=create_test_model_4)
or_14 = GateOr(A=savegeometry_5, B=preview_3, C=expression_4, D=create_test_model_3)
or_15 = GateOr(A=savegeometry_8, B=preview_6, C=expression_11, D=create_test_model_6)
or_16 = GateOr(A=savegeometry_7, B=preview_5, C=expression_9, D=create_test_model_5)
selobj_2 = ObjectsBySelection(Reset=or_12, LiveMode=True)
gate_8 = StreamGate(Stream="Heath geometry type", Gate=or_15)  # -> Target0, Target1
gate_9 = StreamGate(Stream="Heath geometry type", Gate=or_13)  # -> Target0, Target1
gate_10 = StreamGate(Stream="Heath geometry type", Gate=or_14)  # -> Target0, Target1
gate_11 = StreamGate(Stream="Heath geometry type", Gate=or_16)  # -> Target0, Target1
refkv = ReferenceByKeyValue(Key=gate_9.Target1, Val=gate_3.Target1, lightweight=False)
refkv_2 = ReferenceByKeyValue(Key=gate_10.Target1, Val=gate_5.Target1, lightweight=False)
refkv_3 = ReferenceByKeyValue(Key=gate_8.Target1, Val=gate_4.Target1, lightweight=False)
seletedgeometry = RemoteSender(selobj_2)
seletedgeometry_2 = RemoteReceiver(seletedgeometry)
seletedgeometry_3 = RemoteReceiver(seletedgeometry)
modratt = ModifyRhinoObjectAttributes(ReferencedObject=seletedgeometry_3, Attributes=ef_att_3, Activate=saveconstruction)
panel_80 = Panel(modratt)
refkv_4 = ReferenceByKeyValue(Key=gate_11.Target1, Val=gate_6.Target1, lightweight=False)
preview_7 = RemoteReceiver(preview_2)
preview_8 = RemoteReceiver(preview_2)
preview_9 = RemoteReceiver(preview_2)
preview_10 = RemoteReceiver(preview_2)
gate_12 = StreamGate(Stream=refkv, Gate=preview_7)  # -> Target0, Target1
gate_13 = StreamGate(Stream=refkv_3, Gate=preview_8)  # -> Target0, Target1
gate_14 = StreamGate(Stream=refkv_4, Gate=preview_9)  # -> Target0, Target1
gate_15 = StreamGate(Stream=refkv_2, Gate=preview_10)  # -> Target0, Target1
preview_11 = CustomPreview(Geometry=gate_12.Target1, Material=ColourSwatch(SwatchColor=RGBA(128, 125, 0, 75)))
preview_12 = CustomPreview(Geometry=gate_13.Target1, Material=ColourSwatch(SwatchColor=RGBA(0, 17, 128, 75)))
preview_13 = CustomPreview(Geometry=gate_14.Target1, Material=ColourSwatch(SwatchColor=RGBA(128, 0, 102, 75)))
preview_14 = CustomPreview(Geometry=gate_15.Target1, Material=ColourSwatch(SwatchColor=RGBA(4, 128, 0, 75)))
room_energy_attribute_visualize_2 = RemoteReceiver(room_energy_attribute_visualize)
face_energy_attribute_visualize_2 = RemoteReceiver(face_energy_attribute_visualize)
show_honeybee_windows_2 = RemoteReceiver(show_honeybee_windows)
room_attribute_visualize_2 = RemoteReceiver(room_attribute_visualize)
show_honeybee_ground_2 = RemoteReceiver(show_honeybee_ground)
show_honeybee_context_2 = RemoteReceiver(show_honeybee_context)
face_attribute_visualize_2 = RemoteReceiver(face_attribute_visualize)
show_honeybee_floors_2 = RemoteReceiver(show_honeybee_floors)
show_honeybee_doors_2 = RemoteReceiver(show_honeybee_doors)
show_honeybee_walls_2 = RemoteReceiver(show_honeybee_walls)
show_honeybee_roof_2 = RemoteReceiver(show_honeybee_roof)
preview_15 = RemoteReceiver(preview_2)

seletedgeometry_4 = RemoteReceiver(seletedgeometry)
lng_11 = ListLength(List=seletedgeometry_4)
bool_34 = Boolean(lng_11)
seletedgeometry_5 = RemoteReceiver(seletedgeometry)
filter_10 = StreamFilter(Gate=bool_34, Stream0=Slider(500, range=0..1000), Stream1=Slider(1000000, range=0..1000000))
filter_11 = StreamFilter(Gate=bool_34, Stream0="Select Rhino geometry to import", Stream1=" ")
lng_12 = ListLength(List=seletedgeometry_5)
hideshow_18 = HideShowElement(ElementToHideShow=button_13, Show=True, Collapse=True, Disable=invert(lng_12))
tooltip_9 = AttachTooltipToElement(ElementsToAttachTo=button_13, TooltipContent=filter_11, ShowDelay=filter_10, Duration=2000)

seletedgeometry_6 = RemoteReceiver(seletedgeometry)
lng_13 = ListLength(List=seletedgeometry_6)
freeze_gate_34 = StreamFreezeGate(Data=seletedgeometry_2, PassingSwitch=presavegeometry_2, Hold=False)
filtertype = FilterByType(ObjectType="Extrusion", Geometry=freeze_gate_34, invertFilter=False, returnNulls=False)  # -> ExcludedGeometry, IncludedGeometry
filtertype_2 = FilterByType(ObjectType="Brep", Geometry=freeze_gate_34, invertFilter=False, returnNulls=False)  # -> ExcludedGeometry, IncludedGeometry
filtertype_3 = FilterByType(ObjectType="Surface", Geometry=freeze_gate_34, invertFilter=False, returnNulls=False)  # -> ExcludedGeometry, IncludedGeometry
filtertype_4 = FilterByType(ObjectType="Mesh", Geometry=freeze_gate_34, invertFilter=False, returnNulls=False)  # -> ExcludedGeometry, IncludedGeometry
filtertype_5 = FilterByType(ObjectType="Polysurface", Geometry=freeze_gate_34, invertFilter=False, returnNulls=False)  # -> ExcludedGeometry, IncludedGeometry
py3_19 = Python3Script(Ps=[filtertype.IncludedGeometry, filtertype_2.IncludedGeometry, filtertype_5.IncludedGeometry])  # -> C; inputs Ps: Brep
# ---------- py3_19: Python ----------
if Ps:
    C = Ps.IsSolid
# ---------- end py3_19 ----------
lng_14 = ListLength(List=freeze_gate_34)

planar = IsPlanar(Surface=filtertype_3.IncludedGeometry, Interior=True)  # -> Planar, Plane
cull_4 = CullPattern(List=[filtertype.IncludedGeometry, filtertype_2.IncludedGeometry, filtertype_5.IncludedGeometry], CullPattern=py3_19)
cull_5 = CullPattern(List=filtertype_3.IncludedGeometry, CullPattern=planar.Planar)
filter_12 = StreamFilter(
    Gate=geometrytype_validate_2,
    Stream0=cull_4,
    Stream1=cull_5,
    Stream2=[filtertype_5.IncludedGeometry, filtertype_3.IncludedGeometry],
    Stream3=[filtertype_4.IncludedGeometry, filtertype_3.IncludedGeometry, filtertype_5.IncludedGeometry, filtertype.IncludedGeometry, filtertype_2.IncludedGeometry],
    Stream4=freeze_gate_34)  # -> flatten(Stream)

id = Guid(filter_12)
txt_2 = Text(id)
cset = CreateSet(List=txt_2)  # -> Set, Map
geo_3 = Geometry(cset.Set)
lng_15 = ListLength(List=geo_3)
equals_29 = Equality(FirstNumber=lng_14, SecondNumber=lng_15)  # -> Equality, Inequality
freeze_gate_35 = StreamFreezeGate(Data=equals_29.Equality, PassingSwitch=savegeometry_3)
hasdata_5 = DataExists(Data=freeze_gate_35)
filter_13 = StreamFilter(Gate=hasdata_5, Stream0="1", Stream1=freeze_gate_35)

modratt_2 = ModifyRhinoObjectAttributes(ReferencedObject=geo_3, Attributes=ef_att_2, Activate=savegeometry_2)
geometry_saved = RemoteSender(filter_13)

geometry_saved_2 = RemoteReceiver(geometry_saved)
nor = GateNor(A=geometry_saved_2, B=lng_13)
hideshow_19 = HideShowElement(ElementToHideShow=label, Show=nor, Collapse=True, Disable=False)
panel_81 = Panel(modratt_2)

heath_window_2 = RemoteReceiver(heath_window)

run_simple_energy_simulations_3 = RemoteReceiver(run_simple_energy_simulations)
py3_20 = Python3Script(get=run_simple_energy_simulations_3)  # -> mpl_folder; same code as py3
nextfile_3 = NextAvailableFilename(Format="Annual energy balance{000}.png", FolderPath=py3_20, Trigger=run_simple_energy_simulations_3)
panel_82 = Panel(nextfile_3)

# ----
# Recursion
panel_83 = Panel("Geometry info")
objbynn_6 = GetObjectByNickname(NickName=panel_83)
geometry_info = Python3Script()  # -> status; same code as lca_window_status

# ----
# Heath geometry info
info_save_geometry_2 = RemoteReceiver(info_save_geometry)
rec_11 = DataRecorder(info_save_geometry_2, DataLimit=-2, RecordData=True)
ma_7 = MassAddition(Input=rec_11)  # -> Result, PartialResults
entwine_100 = Entwine(Branch00=ma_7.Result, Branch01=geometry_info, FlattenInputs=True)
rec_12 = DataRecorder(entwine_100, DataLimit=2, RecordData=True)
item_12 = ListItem(List=rec_12, Index=0, Wrap=True)  # -> Item2, Item1, Item
equals_30 = Equality(FirstNumber=item_12.Item2, SecondNumber=item_12.Item1)  # -> Equality, Inequality
bang_6 = ExplodeTree(Data=equals_30.Inequality)  # -> Branch0, Branch1
py3_21 = Python3Script(x=bang_6.Branch0, y=bang_6.Branch1)  # -> a; same code as py3_6
event_29 = EventGate(Data=py3_21)  # -> Data, IsNew
freeze_gate_36 = StreamFreezeGate(Data=py3_21, PassingSwitch=event_29.IsNew)
panel_84 = Panel("""Import geometry which is 
used to create the 
honeybee model""")
event_30 = EventGate(Data=freeze_gate_36)  # -> Data, IsNew
label_35 = CreateLabel(LabelText=panel_84, LabelSize=12, Justification=0)
panel_85 = Panel(event_30.Data)
launchwin_7 = LaunchWindow(
    Show=event_30.Data,
    Name="Info",
    Width=Slider(180, range=0..500),
    Height=Slider(148, range=0..500),
    ChildStatus=1,
    EnableHorizScroll=False)
pt_13 = ConstructPoint(XCoordinate=Slider(183, range=0..1000), YCoordinate=Slider(183, range=0..1000), ZCoordinate=0)
addelems_8 = AddElements(Window=launchwin_7, Elements=flatten(label_35), DoVLChecking=True)  # -> AddedElements, ElementNames
winstat_7 = WindowStatus(Window=launchwin_7)
winprops_7 = SetWindowProperties(
    Window=launchwin_7,
    StartingLocation=pt_13,
    Theme=0,
    ShowTitleBar=True,
    BackgroundColor=RGB(255, 255, 255),
    ScaleFactor=1)
geometry_info_status = RemoteSender(winstat_7)

geometry_info_status_2 = RemoteReceiver(geometry_info_status)
expression_52 = Expression(x="Hidden", y=geometry_info_status_2, Expression="x=y")
expire_6 = ExpireObject(ObjectToExpire=objbynn_6, Expire=expression_52)

# ----
# Recursion
panel_86 = Panel("Heath help")
objbynn_7 = GetObjectByNickname(NickName=panel_86)
heath_help = Python3Script()  # -> status; same code as lca_window_status

# ----
# Heath help
help_button_2 = RemoteReceiver(help_button)
rec_13 = DataRecorder(help_button_2, DataLimit=-2, RecordData=True)
ma_8 = MassAddition(Input=rec_13)  # -> Result, PartialResults
entwine_101 = Entwine(Branch00=ma_8.Result, Branch01=heath_help, FlattenInputs=True)
rec_14 = DataRecorder(entwine_101, DataLimit=2, RecordData=True)
item_13 = ListItem(List=rec_14, Index=0, Wrap=True)  # -> Item2, Item1, Item
equals_31 = Equality(FirstNumber=item_13.Item2, SecondNumber=item_13.Item1)  # -> Equality, Inequality
bang_7 = ExplodeTree(Data=equals_31.Inequality)  # -> Branch0, Branch1
py3_22 = Python3Script(x=bang_7.Branch0, y=bang_7.Branch1)  # -> a; same code as py3_6
event_31 = EventGate(Data=py3_22)  # -> Data, IsNew
freeze_gate_37 = StreamFreezeGate(Data=py3_22, PassingSwitch=event_31.IsNew)
panel_87 = Panel("""1. Select the program for the building and room.

2. Use the sliders to set the cooling and heating setpoints.

3. Estimate how many persons will be in the room with the occupancy slider.""")
panel_88 = Panel("""1. Select base construction by climate and type of construction.

2. If required, create your own material or window. Materials can later be selected when creating custom constructions.

3. Constructions and windows make up the subset construction, which is used to modify the base construction.

4. Constructions can be loaded from a file, which contains all previously created constructions.""")
current_tab_index_2 = RemoteReceiver(current_tab_index)
panel_89 = Panel("""1. Select geometry in Rhino.

2. Select geometry type under the import geometry heading.

3. Click "Save geometry".

4. Verify the assigned geometry by pressing the "Preview" checkbox.""")
panel_90 = Panel("""1. Make sure the geometry have been imported and that the program and constructions are in place, before creating a honeybee model.

2. If the model has been created, the "Bake model" button will be enabled along with boxes that lets you visualize the model.

3. Set the wall thickness and roof thickness.

4. Switch the WWR (window-to-wall-ratio) on, if you want to generate windows automatically.""")
panel_91 = Panel("""1. Verify that the honeybee model is correct by selecting attributes and clicking the checkboxes in the "Attributes visualization" segment.

2. Click the "Run weather visualization" button. If the model is set up correctly the "Direct sun hours" and "Incident radiation" should be displayed on the model.""")
panel_92 = Panel("""1. Pick which simulation you want to run.

2. If the simulation failed a red text will show up, go back and review the honeybee model and settings.

3. Otherwise, navigate through the expanded segment to select appropriate displays of the results.

4. It is possible to transfer the results to Rhino by clicking "Bake", or to an image file by clicking "Pop-up window".""")
event_32 = EventGate(Data=freeze_gate_37)  # -> Data, IsNew
filter_14 = StreamFilter(
    Gate=current_tab_index_2,
    Stream0="Geometry module",
    Stream1="Program module",
    Stream2="Construction module",
    Stream3="Assembly module",
    Stream4="Visualize module",
    Stream5="Analysis module")
filter_15 = StreamFilter(
    Gate=current_tab_index_2,
    Stream0=panel_89,
    Stream1=panel_87,
    Stream2=panel_88,
    Stream3=panel_90,
    Stream4=panel_91,
    Stream5=panel_92)
panel_93 = Panel(event_32.Data)
label_36 = CreateLabel(LabelText="Geometry module", LabelSize=18, Justification=0)
tb_12 = CreateTextBlock(Text="Geometry module", TextSize=12, Justification=0)
launchwin_8 = LaunchWindow(
    Show=event_32.Data,
    Name="Help!",
    Width=Slider(350, range=0..500),
    Height=Slider(280, range=0..500),
    ChildStatus=1,
    EnableHorizScroll=False)
pt_14 = ConstructPoint(XCoordinate=Slider(325, range=0..1000), YCoordinate=Slider(165, range=0..1000), ZCoordinate=0)
settextblock_4 = SetTextBlockContents(TextBlockToModify=tb_12, NewTextBlockContents=filter_15)
setlabel_4 = SetLabelContents(LabelToModify=label_36, NewLabelContents=filter_14)
winprops_8 = SetWindowProperties(
    Window=launchwin_8,
    StartingLocation=pt_14,
    Theme=0,
    ShowTitleBar=True,
    BackgroundColor=RGB(255, 255, 255),
    ScaleFactor=1)
entwine_102 = Entwine(Branch00=label_36, Branch01=tb_12, FlattenInputs=True)  # -> flatten(Result)
addelems_9 = AddElements(Window=launchwin_8, Elements=flatten(entwine_102), DoVLChecking=True)  # -> AddedElements, ElementNames

winstat_8 = WindowStatus(Window=launchwin_8)
heath_help_status = RemoteSender(winstat_8)

heath_help_status_2 = RemoteReceiver(heath_help_status)
expression_53 = Expression(x="Hidden", y=heath_help_status_2, Expression="x=y")
expire_7 = ExpireObject(ObjectToExpire=objbynn_7, Expire=expression_53)

# ----
# Recursion
panel_94 = Panel("Material info")
objbynn_8 = GetObjectByNickname(NickName=panel_94)
material_info = Python3Script()  # -> status; same code as lca_window_status

# ----
# Recursion
panel_95 = Panel("Window database")
objbynn_9 = GetObjectByNickname(NickName=panel_95)
window_database = Python3Script()  # -> status; same code as lca_window_status

# ----
# Window database launch
open_window_database_2 = RemoteReceiver(open_window_database)
rec_15 = DataRecorder(open_window_database_2, DataLimit=-2, RecordData=True)
ma_9 = MassAddition(Input=rec_15)  # -> Result, PartialResults
entwine_103 = Entwine(Branch00=ma_9.Result, Branch01=window_database, FlattenInputs=True)
rec_16 = DataRecorder(entwine_103, DataLimit=2, RecordData=True)
item_14 = ListItem(List=rec_16, Index=0, Wrap=True)  # -> Item2, Item1, Item
equals_32 = Equality(FirstNumber=item_14.Item2, SecondNumber=item_14.Item1)  # -> Equality, Inequality
bang_8 = ExplodeTree(Data=equals_32.Inequality)  # -> Branch0, Branch1
py3_23 = Python3Script(x=bang_8.Branch0, y=bang_8.Branch1)  # -> a; same code as py3_6
event_33 = EventGate(Data=py3_23)  # -> Data, IsNew
freeze_gate_38 = StreamFreezeGate(Data=py3_23, PassingSwitch=event_33.IsNew)
event_34 = EventGate(Data=freeze_gate_38)  # -> Data, IsNew
panel_96 = Panel(event_34.Data)
database_modal_location_4 = RemoteReceiver(database_modal_location)
accent_colors_8 = ValueList({"Amber", "Blue", "Brown", "Cobalt", "Crimson", "Cyan", "Emerald", "Green", "Indigo", "Lime", "Magenta", "Mauve", "Olive", "Orange", "Pink", "Purple", "Red", "Sienna", "Steel", "Taupe", "Teal", "Violet", "Yellow"}, selected="Blue")
launchwin_9 = LaunchWindow(
    Show=event_34.Data,
    Name="Window database",
    Width=Slider(360, range=0..1000),
    Height=Slider(580, range=0..1000),
    ChildStatus=1,
    EnableHorizScroll=False)
winstat_9 = WindowStatus(Window=launchwin_9)
winprops_9 = SetWindowProperties(
    Window=launchwin_9,
    StartingLocation=database_modal_location_4,
    Theme=0,
    AccentColor=accent_colors_8,
    ShowTitleBar=True,
    BackgroundColor=RGB(255, 255, 255),
    ScaleFactor=1)
window_database_status = RemoteSender(winstat_9)

window_database_status_2 = RemoteReceiver(window_database_status)
expression_54 = Expression(x="Hidden", y=window_database_status_2, Expression="x=y")
expire_8 = ExpireObject(ObjectToExpire=objbynn_9, Expire=expression_54)

window_database_status_3 = RemoteReceiver(window_database_status)
expression_55 = Expression(x="Normal", y=window_database_status_3, Expression="x=y")
and_27 = GateAnd(A=equals_4.Inequality, B=expression_55)
event_35 = EventGate(Data=and_27)  # -> Data, IsNew
panel_97 = Panel(event_35.Data)
save_windows = RemoteSender(event_35.Data)

# ----
# Save windows
save_windows_2 = RemoteReceiver(save_windows)
save_windows_file_2 = RemoteReceiver(save_windows_file)
getdocumentusertext_6 = Python3Script(run=save_windows_2, key="Heath windows")  # -> json_string; same code as getdocumentusertext
writetxt_4 = WriteToTextFile(Run=save_windows_2, TextToWrite=getdocumentusertext_6, FilePath=save_windows_file_2, Append=False, NewOnly=False)

tb_13 = CreateTextBlock(Text=repeat_11, TextSize=12, Justification=0)
window_database_status_4 = RemoteReceiver(window_database_status)
expression_56 = Expression(x="Normal", y=window_database_status_4, Expression="x=y")
and_28 = GateAnd(A=equals_26.Inequality, B=expression_56)
event_36 = EventGate(Data=and_28)  # -> Data, IsNew
panel_98 = Panel(event_36.Data)
load_windows = RemoteSender(event_36.Data)
adjustpos_77 = AdjustElementPositioning(
    ElementsToAdjust=tb_13,
    Margin="0, 10, 0, 0",
    AbsolutePositioning=False,
    Width=Slider(275, range=0..300),
    Height=Slider(29, range=0..300),
    HorizontalAlignment=0,
    VerticalAlignment=1)

suirify_6 = Suirify(tb_13)

# ----
# Load windows
load_windows_file_2 = RemoteReceiver(load_windows_file)
load_windows_2 = RemoteReceiver(load_windows)
gate_16 = StreamGate(Stream=load_windows_file_2, Gate=load_windows_2)  # -> Target0, Target1
getdocumentusertext_7 = Python3Script(run=load_windows_2, key="Heath windows")  # -> json_string; same code as getdocumentusertext
file_2 = ReadFile(File=gate_16.Target1, PerLineParse=False)
entwine_104 = Entwine(Branch00=getdocumentusertext_7, Branch01=file_2, FlattenInputs=True)  # -> flatten(Result)
join_4 = TextJoin(Text=entwine_104, Join="|")
freeze_gate_39 = StreamFreezeGate(Data=join_4, PassingSwitch=load_windows_2, Freeze=False, Hold=False)

material_database_status_4 = RemoteReceiver(material_database_status)
expression_57 = Expression(x="Normal", y=material_database_status_4, Expression="x=y")
and_29 = GateAnd(A=equals_19.Inequality, B=expression_57)
event_37 = EventGate(Data=and_29)  # -> Data, IsNew
panel_99 = Panel(event_37.Data)
load_materials = RemoteSender(event_37.Data)

construction_database_status_4 = RemoteReceiver(construction_database_status)
expression_58 = Expression(x="Normal", y=construction_database_status_4, Expression="x=y")
and_30 = GateAnd(A=equals_24.Inequality, B=expression_58)
event_38 = EventGate(Data=and_30)  # -> Data, IsNew
load_constructions = RemoteSender(event_38.Data)
panel_100 = Panel(event_38.Data)

# ----
# Load constructions
load_constructions_2 = RemoteReceiver(load_constructions)
load_constructions_file_2 = RemoteReceiver(load_constructions_file)
gate_17 = StreamGate(Stream=load_constructions_file_2, Gate=load_constructions_2)  # -> Target0, Target1
getdocumentusertext_8 = Python3Script(run=load_constructions_2, key="Heath constructions")  # -> json_string; same code as getdocumentusertext
file_3 = ReadFile(File=gate_17.Target1, PerLineParse=False)
entwine_105 = Entwine(Branch00=getdocumentusertext_8, Branch01=file_3, FlattenInputs=True)  # -> flatten(Result)
join_5 = TextJoin(Text=entwine_105, Join="|")
freeze_gate_40 = StreamFreezeGate(Data=join_5, PassingSwitch=load_constructions_2, Freeze=False, Hold=False)

# ----
# Load constructions, (not sorted)
loaded_constructions_file = RemoteReceiver()  # disabled
load_constructions_3 = RemoteReceiver(load_constructions)  # disabled
loadobjects = HBLoadObjects(hb_file=loaded_constructions_file, load=load_constructions_3)  # -> report, hb_objs; disabled; plug-in component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
hold = HoldingGate(Data=loadobjects.hb_objs)  # disabled
panel_101 = Panel(hold)  # disabled
loaded_constructions = RemoteSender(hold)  # disabled

panel_102 = Panel(load_constructions_3)  # disabled

load_constructions_4 = RemoteReceiver(load_constructions)
freeze_gate_41 = StreamFreezeGate(Data=load_constructions_4, PassingSwitch=load_constructions_4)

# ---- group: Building occupancy and systems
# Define construction
# # Define program and construction
# To be added...
# 
# ## Instructions
# To be added...
# 
# ## Inputs
# - ...
# 
# ## Outputs
# - ...
# 
# ## Interpretation
# To be added...
number_slider_37 = Slider(100, range=0..200)

# ----
merge_10 = Merge(Data1=graft(suirify_6), Data2=graft(suirify_5))
stack_61 = CreateStack(UIElements=merge_10, Horizontal=True)  # -> flatten(Stack)

adjustpos_78 = AdjustElementPositioning(ElementsToAdjust=stack_61, Margin="5, 0, 0, 0", AbsolutePositioning=False, HorizontalAlignment=0)

entwine_106 = Entwine(Branch00=stack_59, Branch01=label_34, Branch02=stack_61, Branch03=stack_10, Branch04=stack_58, FlattenInputs=True)  # -> flatten(Result)
addelems_10 = AddElements(Window=launchwin_9, Elements=flatten(entwine_106), DoVLChecking=True)  # -> AddedElements, ElementNames
window_database_elements = RemoteSender(addelems_10.AddedElements)

# ----
# Heath material info
heath_flying_10 = RemoteReceiver(heath_flying)
panel_104 = Panel("C:\Users\Isac\Desktop\Toivo_Chalmers\heath\model\results\Building physics from physical principles to international standards, Marko Pinteric_page-0001.jpg")
number_slider_38 = Slider(560, range=0..1000)
panel_105 = Panel("\Building physics from physical principles to international standards, Marko Pinteric_page-0001.jpg")
py3_24 = Python3Script(get=heath_flying_10)  # -> mpl_folder; same code as py3
multiplication = Multiplication(A=Slider(1.15, range=0..10), B=number_slider_38)
number_slider_39 = Slider(500, range=0..1000)
concat_2 = Concatenate(FragmentA=py3_24, FragmentB=panel_105)
null_17 = NullItem(Item=concat_2)  # -> NullFlags, InvalidFlags, Description
pt_15 = ConstructPoint(XCoordinate=Slider(830, range=0..1000), YCoordinate=Slider(210, range=0..1000), ZCoordinate=0)
multiplication_2 = Multiplication(A=Slider(1.25, range=0..10), B=number_slider_39)
filter_16 = StreamFilter(Gate=null_17.NullFlags, Stream0=concat_2, Stream1=panel_104)
image_5 = CreateImage(ImageSource=filter_16, ImageWidth=multiplication_2, ImageHeight=number_slider_39)

# ---- group: Prepare for analysis
# Assemble Honeybee model
# # Assemble Honeybee model
# This cluster takes input geometry and geometric information and generates a valid Honeybee model which can be used in the following analysis steps.
# 
# ## Instructions
# Enter the relevant inputs to generate the Honeybee model. Windows can either be created using an input geometry or through auto-generation using a window-to-wall ratio.
# 
# ### Room geometry
# Each 3D Brep entered represents one room or thermal zone in the building with no air exchange between them. The Breps should be closed and 3D to generate valid rooms. The room geometries should represent the inner boundary of the external walls
# 
# ### Adjacent geometry
# Geometry of adjacent buildings represented by a surface where they contact the room geometry. Adiabatic boundary condition will be assumed at the contact surface.
# 
# ### Windows/apertures
# Windows can either be defined through a list of 2D surfaces which intersect with the room 3D geometries, or be auto-generated through the list of numeric outputs.
# 
# ### Wall/roof thicknesses
# Wall and roof thicknesses are supplied to generate a shading geometry representing the external surface thickness
# 
# ### Louvers
# If all related inputs are entered, shading louvers will be generated on each window according to the entered parameters.
# 
# ### Different directions
# All the above inputs will be the same for all rooms, however they can be optionally entered as a list which represents different values for different cardinal directions, in the order (N, E, S, W).
# 
# ## Inputs
# - `Model name` - text string representing the name of the analysis model
# - `Room geometry` - list of 3D closed Brep geometries representing each room/zone in the model
# - `Construction set` - text string representing the construction to be used for the rooms, can be retrieved using the HB Construction Set by Climate component
# - `Program` - Honeybee Program or list of which are applied to the rooms in the model. Can be defined using the HB Search Programs component
# - `Context geometry` - list of surrounding Brep geometries which shades the analysed Rooms
# - `Windows` - list of 2D Brep geometries which represent the openings in the building envelope. If not supplied, windows are instead generated through definition of window-to-wall ratios as defined below
# - `Skylights` - list of 2D Brep geometries which represent the openings in the building roof
# - `Window-to-wall ratio` - number representing the window-to-wall ratio on each exterior surface Used if no window geometries are supplied.
# - `Subdivide generated windows` - set to True if the window surface area should be divided into multiple windows on each exterior surface
# - `Window height` - number representing the target height of the auto-generated windows
# - `Sill height` - number representing how high the lower edge of the auto-generated windows should be from the room floor
# - `Horizontal separation` - number representing how far separated the auto-generated windows should be horizontally
# - `Vertical separation` - number representing if auto-generated windows should be split vertically and if so, what distance
# - `Wall thickness` - number representing the thickness of the exterior walls, used to generate shading geometry for windows
# - `Roof thickness` - number representing the thickness of the roof, used to generate shading geometry for skylights
# - `Louver depth` - number optionally representing the depth of louvers
# - `Number of louvers` - number optionally representing the amount of louvers on each window
# - `Distance between louvers ` - number optionally representing the distance between louvers on each window
# - `Louver angle` - number optionally representing if louvers should be tilted
# - `Vertical/horizontal louvers` - boolean, set to True if louvers should be vertical
# 
# ## Outputs
# - `Honeybee model` - valid Honeybee model for further analysis
# 
# ## Interpretation
# To be added...
savegeometry_9 = RemoteReceiver(savegeometry)
create_model_4 = RemoteReceiver(create_model_2)
savegeometry_10 = RemoteReceiver(savegeometry)
savegeometry_11 = RemoteReceiver(savegeometry)
create_model_5 = RemoteReceiver(create_model_2)
savegeometry_12 = RemoteReceiver(savegeometry)
create_model_6 = RemoteReceiver(create_model_2)
create_model_7 = RemoteReceiver(create_model_2)
distance_between_louvers_2 = RemoteReceiver(distance_between_louvers)
number_of_louvers_5 = RemoteReceiver(number_of_louvers)
louver_angle_2 = RemoteReceiver(louver_angle)
louver_depth_2 = RemoteReceiver(louver_depth)
or_17 = GateOr(A=savegeometry_9, B=create_model_4, C=Toggle(True))
or_18 = GateOr(A=savegeometry_10, B=create_model_5, C=Toggle(True))
or_19 = GateOr(A=savegeometry_11, B=create_model_6, C=Toggle(True))
or_20 = GateOr(A=savegeometry_12, B=create_model_7, C=Toggle(True))
bool_35 = Boolean(number_of_louvers_5)
gate_18 = StreamGate(Stream="Heath geometry type", Gate=or_17)  # -> Target0, Target1
gate_19 = StreamGate(Stream="Heath geometry type", Gate=or_18)  # -> Target0, Target1
gate_20 = StreamGate(Stream="Heath geometry type", Gate=or_19)  # -> Target0, Target1
gate_21 = StreamGate(Stream="Heath geometry type", Gate=or_20)  # -> Target0, Target1
filter_17 = StreamFilter(Gate=bool_35, Stream0="0", Stream1=louver_angle_2)
filter_18 = StreamFilter(Gate=bool_35, Stream0="0", Stream1=distance_between_louvers_2)
filter_19 = StreamFilter(Gate=bool_35, Stream0="0", Stream1=louver_depth_2)
refkv_5 = ReferenceByKeyValue(Key=gate_18.Target1, Val="Room", lightweight=False)
refkv_6 = ReferenceByKeyValue(Key=gate_19.Target1, Val="Adjacent", lightweight=False)
refkv_7 = ReferenceByKeyValue(Key=gate_20.Target1, Val="Context", lightweight=False, DisableAutoUpdate=True)
refkv_8 = ReferenceByKeyValue(Key=gate_21.Target1, Val="Window", lightweight=False)
generate_wwr_2 = RemoteReceiver(generate_wwr)
wall_thickness_2 = RemoteReceiver(wall_thickness)
roof_thickness_2 = RemoteReceiver(roof_thickness)
model_name_3 = RemoteReceiver(model_name)
create_model_8 = RemoteReceiver(create_model_2)
data_17 = Data(programtype)
adjacent = Geometry(refkv_6)
room = Geometry(refkv_5)
windows = Geometry(refkv_8)
context = Geometry(refkv_7)
number_slider_40 = Slider(0.3, range=0..1)
toggle_7 = BooleanToggle(True)
energy_system_name = Text()
show_honeybee_windows_3 = RemoteReceiver(show_honeybee_windows)
show_honeybee_context_3 = RemoteReceiver(show_honeybee_context)
show_honeybee_ground_3 = RemoteReceiver(show_honeybee_ground)
show_honeybee_doors_3 = RemoteReceiver(show_honeybee_doors)
show_honeybee_floors_3 = RemoteReceiver(show_honeybee_floors)
show_honeybee_walls_3 = RemoteReceiver(show_honeybee_walls)
show_honeybee_roof_3 = RemoteReceiver(show_honeybee_roof)

# ----
panel_106 = Panel(create_model_8)
multiplication_3 = Multiplication(A=filter_19, B="0.01")

# ----
# Create material tooltip
panel_107 = Panel(":")

# ----
# Create construction tooltip
panel_108 = Panel(":")

# ---- group: Prepare for analysis
vertical_separation = Number()
horizontal_separation = Number()
sill_height = Number(number_slider_40)
window_height = Number()
subdivide_generated_windows = Boolean(toggle_7)
louver_depth_3 = Number(multiplication_3)
number_of_louvers_6 = Number(number_of_louvers_5)
distance_between_louvers_3 = Number(filter_18)
vertical_horizontal_louvers = Boolean()
louver_angle_3 = Number(filter_17)

# ----
# Backend data inside layers
panel_109 = Panel("0, 0, 0")
path = DataPath(panel_109)
path_2 = DataPath("0, 0, 0")

# ----
# Create window tooltip
number_slider_41 = Slider(0, range=0..100)
dom_3 = ConstructDomain(DomainStart=number_slider_41, DomainEnd=Slider(12, range=0..100))
dom_4 = ConstructDomain(DomainStart=Slider(0, range=0..100), DomainEnd=Slider(1, range=0..100))

# ---- group: Prepare for analysis (continued)
py3_25 = Python3Script(
    depth=louver_depth_3,
    count=number_of_louvers_6,
    dist=distance_between_louvers_3,
    angle=louver_angle_3,
    direction=vertical_horizontal_louvers)  # -> out, louver_settings
# ---------- py3_25: Python ----------
"""Create louver Settings"""
from heath import LouverSettings

louver_settings = LouverSettings(depth, int(count), dist, angle, direction)
# ---------- end py3_25 ----------

# ----
# Backend visible layers
panel_110 = Panel("1")
neg = Negative(Value=panel_110)
starting_layers = Slider(1, range=0..6)

# ----
# Materials database
pre_material_database_remove_material_2 = RemoteReceiver(pre_material_database_remove_material)
cull_6 = CullPattern(List=pre_material_database_remove_material_2, CullPattern=pre_material_database_remove_material_2)
lng_16 = ListLength(List=cull_6)
filter_20 = StreamFilter(Gate=lng_16, Stream0="False", Stream1=cull_6)
freeze_gate_42 = StreamFreezeGate(Data=pre_material_database_remove_material_2, PassingSwitch=filter_20, Freeze=True, Hold=False)
material_database_remove_material_2 = RemoteReceiver(material_database_remove_material)
getdocumentusertext_9 = Python3Script(run=material_database_remove_material_2, key="Heath materials category")  # -> json_string; same code as getdocumentusertext
getdocumentusertext_10 = Python3Script(run=material_database_remove_material_2, key="Heath materials")  # -> json_string; same code as getdocumentusertext
split_2 = TextSplit(Text=getdocumentusertext_9, Separators="|")
split_3 = TextSplit(Text=getdocumentusertext_10, Separators="|")
strtoobj = HBStringToObject(hb_str=split_3)  # -> flatten(hb_obj); plug-in component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
decnstrmat = HBDeconstructMaterial(mat=strtoobj)  # -> values, attr_names, r_val_si, r_val_ip; plug-in component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
item_15 = ListItem(List=decnstrmat.values, Index=0, Wrap=True)  # -> flatten(Item)
lng_17 = ListLength(List=split_3)
larger = LargerThan(FirstNumber=lng_17, SecondNumber="1")  # -> LargerThan, OrEqualTo
bool_36 = Boolean("False")
bool_37 = Boolean(larger.LargerThan)
sync_material_database_2 = RemoteReceiver(sync_material_database)

# ----
# Create material
material_database_categories_6 = RemoteReceiver(material_database_categories_2)
panel_111 = Panel("""Rough
Smooth""")
textbox_3 = CreateTextBox(Label="Name", DefaultText="New material", UpdateButton=invert(True), showLabel=True)
textbox_4 = CreateTextBox(DefaultText=Slider(0.036, range=0..2), UpdateButton=invert(True), showLabel=False)
textbox_5 = CreateTextBox(DefaultText=Slider(200, range=0..1000), UpdateButton=invert(True), showLabel=False)
label_37 = CreateLabel(LabelText="Conductivity [W/m-K]", LabelSize=12, Justification=0)
pulldown_22 = CreatePulldownMenu(
    Label="Material category",
    ListItems=material_database_categories_6,
    SelectedIndex=Slider(3, range=0..10),
    showLabel=True)
textbox_6 = CreateTextBox(DefaultText=Slider(28, range=0..1000), UpdateButton=invert(True), showLabel=False)
true_button_14 = CreateTrueOnlyButton(ButtonName="?", ButtonStyle=2)
button_32 = CreateButton(ButtonName="Create material", ButtonStyle=0)
textbox_7 = CreateTextBox(DefaultText=Slider(1500, range=0..10000), UpdateButton=invert(True), showLabel=False)
label_38 = CreateLabel(LabelText="Roughness", LabelSize=12, Justification=0)
label_39 = CreateLabel(LabelText="Specific heat [J/kg-K]", LabelSize=12, Justification=0)
label_40 = CreateLabel(LabelText="Absorption", LabelSize=12, Justification=0)
pulldown_23 = CreatePulldownMenu(ListItems=panel_111, showLabel=False)
label_41 = CreateLabel(LabelText="Density [kg/m3]", LabelSize=12, Justification=0)
values_106 = ValueListener(Elements=textbox_3, SomeProperty=True)  # -> Values, Indices
values_107 = ValueListener(Elements=true_button_14, SomeProperty=True)  # -> Values, Indices
values_108 = ValueListener(Elements=textbox_4, SomeProperty=True)  # -> Values, Indices
values_109 = ValueListener(Elements=button_32, SomeProperty=True)  # -> Values, Indices
values_110 = ValueListener(Elements=pulldown_22, SomeProperty=True)  # -> Values, Indices
values_111 = ValueListener(Elements=pulldown_23, SomeProperty=True)  # -> Values, Indices
values_112 = ValueListener(Elements=textbox_5, SomeProperty=True)  # -> Values, Indices
values_113 = ValueListener(Elements=textbox_6, SomeProperty=True)  # -> Values, Indices
values_114 = ValueListener(Elements=textbox_7, SomeProperty=True)  # -> Values, Indices
create_material_conductivity = RemoteSender(values_108.Values)
info_create_material = RemoteSender(values_107.Values)
freeze_gate_43 = StreamFreezeGate(Data=values_109.Values, PassingSwitch=invert(values_109.Values))
create_material_category = RemoteSender(values_110.Values)
create_material_density = RemoteSender(values_113.Values)
create_material_sprecific_heat = RemoteSender(values_114.Values)
rep = ReplaceText(Text=values_106.Values, Find="å", Replace="a", RecursiveReplace=False)
entwine_107 = Entwine(Branch00=label_40, Branch01=textbox_5, FlattenInputs=True)  # -> flatten(Result)
entwine_108 = Entwine(Branch00=label_38, Branch01=pulldown_23, FlattenInputs=True)  # -> flatten(Result)
entwine_109 = Entwine(Branch00=label_37, Branch01=textbox_4, FlattenInputs=True)  # -> flatten(Result)
entwine_110 = Entwine(Branch00=label_39, Branch01=textbox_7, FlattenInputs=True)  # -> flatten(Result)
entwine_111 = Entwine(Branch00=label_41, Branch01=textbox_6, FlattenInputs=True)  # -> flatten(Result)
bool_38 = Boolean(invert(freeze_gate_43))
rep_2 = ReplaceText(Text=rep, Find="ä", Replace="ae", RecursiveReplace=False)
stack_62 = CreateStack(UIElements=entwine_109, Horizontal=True)
stack_63 = CreateStack(UIElements=entwine_110, Horizontal=True)
stack_64 = CreateStack(UIElements=entwine_111, Horizontal=True)
tap_23 = TapBuffer(Reset=False, Incremental=True, Valve=bool_38, Hold=True)
rep_3 = ReplaceText(Text=rep_2, Find="ö", Replace="o", RecursiveReplace=False)
create_material_modal_2 = RemoteReceiver(create_material_modal)
dam_23 = DataDam(DataA=tap_23, BufferDelay=2500000, BufferMode=2)
adjustelem_8 = AdjustElementAppearance(
    ElementsToAdjust=true_button_14,
    Foreground=ColourSwatch(SwatchColor=RGB(0, 0, 0)),
    Background=ColourSwatch(SwatchColor=RGB(230, 230, 230)),
    FontSize=Slider(12, range=0..300))
create_material_name = RemoteSender(rep_3)
equals_33 = Equality(FirstNumber=tap_23, SecondNumber=dam_23)  # -> Equality, Inequality
and_31 = GateAnd(A=equals_33.Inequality, B=create_material_modal_2)
number_slider_42 = Slider(29, range=0..300)
event_39 = EventGate(Data=and_31)  # -> Data, IsNew
entwine_112 = Entwine(Branch00=textbox_3, Branch01=true_button_14, FlattenInputs=True)  # -> flatten(Result)
create_material = RemoteSender(event_39.Data)
stack_65 = CreateStack(UIElements=entwine_112, Horizontal=True)
adjustpos_79 = AdjustElementPositioning(ElementsToAdjust=textbox_3, AbsolutePositioning=False, Width=Slider(185, range=0..300), HorizontalAlignment=0)
adjustpos_80 = AdjustElementPositioning(ElementsToAdjust=true_button_14, AbsolutePositioning=False, Width=number_slider_42, Height=number_slider_42)
adjustpos_81 = AdjustElementPositioning(
    ElementsToAdjust=pulldown_22,
    Margin="0, 10, 5, 0",
    AbsolutePositioning=False,
    Width=Slider(229, range=0..300),
    HorizontalAlignment=0)
adjustpos_82 = AdjustElementPositioning(
    ElementsToAdjust=[label_40, label_38, label_39, label_41, label_37],
    AbsolutePositioning=False,
    Width=Slider(150, range=0..300),
    HorizontalAlignment=0,
    VerticalAlignment=2)
adjustpos_83 = AdjustElementPositioning(
    ElementsToAdjust=[textbox_5, pulldown_23, textbox_7, textbox_6, textbox_4],
    AbsolutePositioning=False,
    Width=Slider(50, range=0..300),
    HorizontalAlignment=0,
    VerticalAlignment=2)
adjustpos_84 = AdjustElementPositioning(ElementsToAdjust=button_32, Margin="0, 10, 0, 0", AbsolutePositioning=False, HorizontalAlignment=1, VerticalAlignment=2)

info_create_material_2 = RemoteReceiver(info_create_material)
rec_17 = DataRecorder(info_create_material_2, DataLimit=-2, RecordData=True)
ma_10 = MassAddition(Input=rec_17)  # -> Result, PartialResults
entwine_113 = Entwine(Branch00=ma_10.Result, Branch01=material_info, FlattenInputs=True)
rec_18 = DataRecorder(entwine_113, DataLimit=2, RecordData=True)
item_16 = ListItem(List=rec_18, Index=0, Wrap=True)  # -> Item2, Item1, Item
equals_34 = Equality(FirstNumber=item_16.Item2, SecondNumber=item_16.Item1)  # -> Equality, Inequality
bang_9 = ExplodeTree(Data=equals_34.Inequality)  # -> Branch0, Branch1
py3_26 = Python3Script(x=bang_9.Branch0, y=bang_9.Branch1)  # -> a; same code as py3_6
event_40 = EventGate(Data=py3_26)  # -> Data, IsNew
freeze_gate_44 = StreamFreezeGate(Data=py3_26, PassingSwitch=event_40.IsNew)
event_41 = EventGate(Data=freeze_gate_44)  # -> Data, IsNew
panel_112 = Panel(event_41.Data)
launchwin_10 = LaunchWindow(
    Show=event_41.Data,
    Name="Common materials",
    Width=multiplication,
    Height=number_slider_38,
    ChildStatus=1,
    EnableHorizScroll=False)
winstat_10 = WindowStatus(Window=launchwin_10)
winprops_10 = SetWindowProperties(
    Window=launchwin_10,
    StartingLocation=pt_15,
    Theme=0,
    ShowTitleBar=True,
    BackgroundColor=RGB(255, 255, 255),
    ScaleFactor=1)
material_info_status = RemoteSender(winstat_10)
addelems_11 = AddElements(Window=launchwin_10, Elements=flatten(image_5), DoVLChecking=True)  # -> AddedElements, ElementNames

material_info_status_2 = RemoteReceiver(material_info_status)
expression_59 = Expression(x="Hidden", y=material_info_status_2, Expression="x=y")
expire_9 = ExpireObject(ObjectToExpire=objbynn_8, Expire=expression_59)

# ----
# Create material
create_material_sprecific_heat_2 = RemoteReceiver(create_material_sprecific_heat)
create_material_conductivity_2 = RemoteReceiver(create_material_conductivity)
create_material_density_2 = RemoteReceiver(create_material_density)
create_material_name_2 = RemoteReceiver(create_material_name)
opaquemat_3 = HBOpaqueMaterial(
    name=create_material_name_2,
    thickness="inf",
    conductivity=create_material_conductivity_2,
    density=create_material_density_2,
    spec_heat=create_material_sprecific_heat_2)  # -> out, mat; plug-in component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
create_material_error = RemoteSender(opaquemat_3.out)

# ----
# Roughness
stack_66 = CreateStack(UIElements=entwine_108, Horizontal=True)
data_18 = Data()

# ----
# Absorption
stack_67 = CreateStack(UIElements=entwine_107, Horizontal=True)
data_19 = Data()

create_material_error_2 = RemoteReceiver(create_material_error)
split_4 = TextSplit(Text=create_material_error_2, Separators=panel_107)
trim = TextTrim(Text=split_4, Start=True, End=True)
item_17 = ListItem(List=trim, Index=0, Wrap=True)  # -> Item, Item1
create_material_name_3 = RemoteReceiver(create_material_name)
lng_18 = ListLength(List=split_4)
len_2 = TextLength(Text=item_17.Item1)
larger_2 = LargerThan(FirstNumber=lng_18, SecondNumber="1")  # -> LargerThan, OrEqualTo
subtraction_4 = Subtraction(A=len_2, B=Slider(11, range=0..20))
fragment_2 = TextFragment(Text=item_17.Item1, Start="0", Count=subtraction_4)
filter_21 = StreamFilter(Gate=larger_2.LargerThan, Stream0=create_material_error_2, Stream1=fragment_2)

panel_113 = Panel(create_material_error_2)

# ----
# Create construction
panel_114 = Panel("""Layer 1
Layer 2
Layer 3
Layer 4
Layer 5
Layer 6""")
lng_19 = ListLength(List=panel_114)
textbox_8 = CreateTextBox(Label="Name", DefaultText="New construction", UpdateButton=invert(True), showLabel=True)
subtraction_5 = Subtraction(A=lng_19, B="1")
values_115 = ValueListener(Elements=textbox_8, SomeProperty=True)  # -> Values, Indices
empty_10 = EmptyObjectToEmptyBranch()
button_33 = CreateButton(ButtonName="+", ButtonStyle=3)
button_34 = CreateButton(ButtonName="Create construction", ButtonStyle=0)
repeat_12 = RepeatData(Data="Material", Length=lng_19)
label_42 = CreateLabel(LabelText=panel_114, LabelSize=18, Justification=0)
empty_11 = EmptyObjectToEmptyBranch()
repeat_13 = RepeatData(Data="X", Length=lng_19)
repeat_14 = RepeatData(Data="⇕", Length=subtraction_5)
repeat_15 = RepeatData(Data="Thickness [m]", Length=lng_19)
button_35 = CreateButton(ButtonName=repeat_13, ButtonStyle=3)
values_116 = ValueListener(Elements=button_33, SomeProperty=True)  # -> Values, Indices
values_117 = ValueListener(Elements=button_34, SomeProperty=True)  # -> Values, Indices
button_36 = CreateButton(ButtonName=repeat_14, ButtonStyle=3)
pulldown_24 = CreatePulldownMenu(Label=repeat_12, ListItems=empty_11, showLabel=True)
textbox_9 = CreateTextBox(Label=repeat_15, DefaultText=Slider(0.25, range=0.01..1), UpdateButton=invert(True), showLabel=True)
add_layer = RemoteSender(values_116.Values)
values_118 = ValueListener(Elements=button_35, SomeProperty=True)  # -> flatten(Values), Indices
cull_7 = CullPattern(List=values_118.Values, CullPattern=values_118.Values)
lng_20 = ListLength(List=cull_7)
filter_22 = StreamFilter(Gate=lng_20, Stream0="False", Stream1=cull_7)
values_119 = ValueListener(Elements=button_36, SomeProperty=True)  # -> flatten(Values), Indices
cull_8 = CullPattern(List=values_119.Values, CullPattern=values_119.Values)
lng_21 = ListLength(List=cull_8)
filter_23 = StreamFilter(Gate=lng_21, Stream0="False", Stream1=cull_8)
create_construction = RemoteSender(values_117.Values)
values_120 = ValueListener(Elements=pulldown_24, SomeProperty=True)  # -> Values, Indices
values_121 = ValueListener(Elements=textbox_9, SomeProperty=True)  # -> Values, Indices
freeze_gate_45 = StreamFreezeGate(Data=filter_23, PassingSwitch=invert(filter_23))
merge_11 = Merge(Data1=simplify(graft(label_42)), Data2=simplify(graft(button_35)))
merge_12 = Merge(Data1=simplify(graft(pulldown_24)), Data2=simplify(graft(textbox_9)))
freeze_gate_46 = StreamFreezeGate(Data=filter_22, PassingSwitch=invert(filter_22))
create_construction_materials = RemoteSender(values_120.Indices)
create_construction_thickness = RemoteSender(values_121.Values)
pre_switch_layer = RemoteSender(values_119.Values)
pre_remove_layer = RemoteSender(values_118.Values)
bool_39 = Boolean(invert(freeze_gate_45))
bool_40 = Boolean(invert(freeze_gate_46))
stack_68 = CreateStack(UIElements=merge_12, Horizontal=True)
stack_69 = CreateStack(UIElements=merge_11, Horizontal=True)
tap_24 = TapBuffer(Reset=False, Incremental=True, Valve=bool_39, Hold=True)
tap_25 = TapBuffer(Reset=False, Incremental=True, Valve=bool_40, Hold=True)
dam_24 = DataDam(DataA=tap_24, BufferDelay=2500000, BufferMode=2)
dam_25 = DataDam(DataA=tap_25, BufferDelay=2500000, BufferMode=2)
equals_35 = Equality(FirstNumber=tap_24, SecondNumber=dam_24)  # -> Equality, Inequality
equals_36 = Equality(FirstNumber=tap_25, SecondNumber=dam_25)  # -> Equality, Inequality
event_42 = EventGate(Data=equals_35.Inequality)  # -> Data, IsNew
event_43 = EventGate(Data=equals_36.Inequality)  # -> Data, IsNew
merge_13 = Merge(Data1=simplify(stack_69), Data2=simplify(stack_68), Data3=simplify(graft(button_36)))
entwine_114 = Entwine(Branch00=textbox_8, FlattenInputs=True)  # -> flatten(Result)
switch_layer = RemoteSender(event_42.Data)
adjustpos_85 = AdjustElementPositioning(
    ElementsToAdjust=textbox_8,
    Margin="0, 0, 0, 5",
    AbsolutePositioning=False,
    Width=Slider(190, range=0..300),
    HorizontalAlignment=0)
remove_layer = RemoteSender(event_43.Data)
adjustpos_86 = AdjustElementPositioning(
    ElementsToAdjust=pulldown_24,
    AbsolutePositioning=False,
    Width=Slider(190, range=0..300),
    HorizontalAlignment=0,
    VerticalAlignment=2)
adjustpos_87 = AdjustElementPositioning(
    ElementsToAdjust=textbox_9,
    Margin="0, 5, 0, 0",
    AbsolutePositioning=False,
    Width=Slider(120, range=0..300),
    HorizontalAlignment=0,
    VerticalAlignment=2)
adjustpos_88 = AdjustElementPositioning(
    ElementsToAdjust=button_33,
    Margin="10, 5, 0, 0",
    AbsolutePositioning=False,
    Width=Slider(32, range=0..300),
    Height=Slider(32, range=0..300),
    HorizontalAlignment=0)
adjustpos_89 = AdjustElementPositioning(
    ElementsToAdjust=button_36,
    Margin="5, 0, 0, 0",
    AbsolutePositioning=False,
    Width=Slider(26, range=0..300),
    Height=Slider(26, range=0..300),
    HorizontalAlignment=0,
    VerticalAlignment=2)
adjustelem_9 = AdjustElementAppearance(ElementsToAdjust=button_36, Foreground=ColourSwatch(SwatchColor=RGBA(38, 38, 38, 193)), FontSize=Slider(19, range=0..50))
adjustpos_90 = AdjustElementPositioning(
    ElementsToAdjust=button_35,
    AbsolutePositioning=False,
    Width=Slider(26, range=0..300),
    Height=Slider(26, range=0..300),
    HorizontalAlignment=0)
adjustelem_10 = AdjustElementAppearance(ElementsToAdjust=button_33, Foreground=ColourSwatch(SwatchColor=RGB(15, 178, 0)), FontSize=Slider(21, range=0..50))
adjustelem_11 = AdjustElementAppearance(ElementsToAdjust=button_35, Foreground=ColourSwatch(SwatchColor=RGB(255, 0, 0)), FontSize=Slider(12, range=0..50))
adjustpos_91 = AdjustElementPositioning(ElementsToAdjust=button_34, Margin="0, 10, 0, 0", AbsolutePositioning=False, HorizontalAlignment=1, VerticalAlignment=2)

pre_remove_layer_2 = RemoteReceiver(pre_remove_layer)
pre_switch_layer_2 = RemoteReceiver(pre_switch_layer)
create_construction_materials_2 = RemoteReceiver(flatten(create_construction_materials))
create_construction_thickness_2 = RemoteReceiver(flatten(create_construction_thickness))
cull_9 = CullPattern(List=pre_remove_layer_2, CullPattern=pre_remove_layer_2)
cull_10 = CullPattern(List=pre_switch_layer_2, CullPattern=pre_switch_layer_2)
add_layer_2 = RemoteReceiver(add_layer)
mindex = MemberIndex(Set=pre_remove_layer_2, Member=cull_9)  # -> Index, Count
mindex_2 = MemberIndex(Set=pre_switch_layer_2, Member=cull_10)  # -> Index, Count
py3_27 = Python3Script(
    add_layer=add_layer_2,
    remove_layer=mindex.Index,
    switch_layer=mindex_2.Index,
    materials=create_construction_materials_2,
    thickness=create_construction_thickness_2)  # -> out_materials, out_thickness; inputs materials: list, thickness: list
# ---------- py3_27: Python ----------
def add_layers():
    thickness.append(0.25)
    out_thickness = thickness
    
def remove_layers():
    materials.pop(remove_layer)
    thickness.pop(remove_layer)

def switch_layers():
    temp_materials = materials[switch_layer]
    materials[switch_layer] = materials[switch_layer+1]
    materials[switch_layer+1] = temp_materials

    temp_thickness = thickness[switch_layer]
    thickness[switch_layer] = thickness[switch_layer+1]
    thickness[switch_layer+1] = temp_thickness
    

if add_layer:
    add_layers()

elif remove_layer is not None:
    remove_layers()
    out_materials = materials
    out_thickness = thickness

elif switch_layer is not None:
    switch_layers()
    out_materials = materials
    out_thickness = thickness
else:
    out_materials = None
    out_thickness = None
# ---------- end py3_27 ----------
branch = TreeBranch(Tree=py3_27.out_thickness, Path=path, MaintainPaths=True)
branch_2 = TreeBranch(Tree=py3_27.out_materials, Path=path_2, MaintainPaths=True)
lng_22 = ListLength(List=branch_2)
lng_23 = ListLength(List=branch)
bool_41 = Boolean(lng_23)
bool_42 = Boolean(lng_22)
gate_22 = StreamGate(Stream=branch, Gate=bool_41)  # -> Target0, Target1
gate_23 = StreamGate(Stream=branch_2, Gate=bool_42)  # -> Target0, Target1
hold_2 = HoldingGate(Data=gate_22.Target1)
hold_3 = HoldingGate(Data=gate_23.Target1)
hasdata_6 = DataExists(Data=hold_2)
hasdata_7 = DataExists(Data=hold_3)
timeshift = TimeShifter(Data=hold_2, Capacity="1")
timeshift_2 = TimeShifter(Data=hold_3, Capacity="1")
bool_43 = Boolean(hasdata_6)
bool_44 = Boolean(hasdata_7)
remove_layer_2 = RemoteReceiver(remove_layer)
switch_layer_2 = RemoteReceiver(switch_layer)
filter_24 = StreamFilter(Gate=bool_43, Stream0=timeshift, Stream1=hold_2)
filter_25 = StreamFilter(Gate=bool_44, Stream0=timeshift_2, Stream1=hold_3)
entwine_115 = Entwine(Branch00=filter_25, Branch01=filter_24, FlattenInputs=True)
or_21 = GateOr(A=switch_layer_2, B=remove_layer_2)
gate_24 = StreamGate(Stream=entwine_115, Gate=or_21)  # -> Target0, Target1
bang_10 = ExplodeTree(Data=gate_24.Target1)  # -> Branch0, Branch1

remove_layer_3 = RemoteReceiver(flatten(remove_layer))
add_layer_3 = RemoteReceiver(add_layer)
gate_25 = StreamGate(Stream=panel_110, Gate=add_layer_3)  # -> Target0, Target1
gate_26 = StreamGate(Stream=neg, Gate=remove_layer_3)  # -> Target0, Target1
rec_19 = DataRecorder([gate_25.Target1, gate_26.Target1], DataLimit=-10, RecordData=True)
py3_28 = Python3Script(numbers=[starting_layers, rec_19], maximum_layers=Slider(6, range=0..10))  # -> visible_layers_arrows, visible_layers; inputs numbers: list of Int32, maximum_layers: Int32
# ---------- py3_28: Python ----------
current_sum = 0

for number in numbers:
    if (number == 1) and (current_sum >= maximum_layers):
        continue
    if (number == -1) and (current_sum <= 1):
        continue
    else:
        current_sum += number

visible_layers = [True]*current_sum
visible_layers.extend([False]*(maximum_layers-current_sum))
visible_layers_arrows = visible_layers[1:]
# ---------- end py3_28 ----------
visible_layers_arrows = RemoteSender(py3_28.visible_layers_arrows)
visible_layers = RemoteSender(simplify(graft(py3_28.visible_layers)))

rep_4 = ReplaceText(Text=values_115.Values, Find="å", Replace="a", RecursiveReplace=False)
rep_5 = ReplaceText(Text=rep_4, Find="ä", Replace="ae", RecursiveReplace=False)
rep_6 = ReplaceText(Text=rep_5, Find="ö", Replace="o", RecursiveReplace=False)

# ----
# Create construction
create_construction_materials_3 = RemoteReceiver(create_construction_materials)
create_construction_thickness_3 = RemoteReceiver(create_construction_thickness)
visible_layers_2 = RemoteReceiver(visible_layers)
repeat_16 = RepeatData(Data=create_construction_thickness_3, Length=visible_layers_2)  # -> flatten(Data)

# ----
# Create window
number_slider_43 = Slider(0.5, range=0..12)
textbox_10 = CreateTextBox(Label="Name", DefaultText="New window", UpdateButton=invert(True), showLabel=True)
button_37 = CreateButton(ButtonName="Create window", ButtonStyle=0)
textbox_11 = CreateTextBox(DefaultText=number_slider_43, UpdateButton=invert(True), showLabel=False)
label_43 = CreateLabel(LabelText="U-factor [W/m2-K]", LabelSize=12, Justification=0)
textbox_12 = CreateTextBox(DefaultText=Slider(0.3, range=0..1), UpdateButton=invert(True), showLabel=False)
label_44 = CreateLabel(LabelText="SHGC", LabelSize=12, Justification=0)
values_122 = ValueListener(Elements=textbox_10, SomeProperty=True)  # -> Values, Indices
values_123 = ValueListener(Elements=button_37, SomeProperty=True)  # -> Values, Indices
values_124 = ValueListener(Elements=textbox_11, SomeProperty=True)  # -> Values, Indices
values_125 = ValueListener(Elements=textbox_12, SomeProperty=True)  # -> Values, Indices
create_window_u_factor = RemoteSender(values_124.Values)
freeze_gate_47 = StreamFreezeGate(Data=values_123.Values, PassingSwitch=invert(values_123.Values))
create_window_shgc = RemoteSender(values_125.Values)
entwine_116 = Entwine(Branch00=label_43, Branch01=textbox_11, FlattenInputs=True)  # -> flatten(Result)
entwine_117 = Entwine(Branch00=label_44, Branch01=textbox_12, FlattenInputs=True)  # -> flatten(Result)
bool_45 = Boolean(invert(freeze_gate_47))
stack_70 = CreateStack(UIElements=entwine_116, Horizontal=True)
tap_26 = TapBuffer(Reset=False, Incremental=True, Valve=bool_45, Hold=True)
stack_71 = CreateStack(UIElements=entwine_117, Horizontal=True)
create_window_modal_2 = RemoteReceiver(create_window_modal)
dam_26 = DataDam(DataA=tap_26, BufferDelay=2500000, BufferMode=2)
equals_37 = Equality(FirstNumber=tap_26, SecondNumber=dam_26)  # -> Equality, Inequality
and_32 = GateAnd(A=equals_37.Inequality, B=create_window_modal_2)
event_44 = EventGate(Data=and_32)  # -> Data, IsNew
create_window = RemoteSender(event_44.Data)
adjustpos_92 = AdjustElementPositioning(ElementsToAdjust=textbox_10, AbsolutePositioning=False, Width=Slider(200, range=0..300), HorizontalAlignment=0)
adjustpos_93 = AdjustElementPositioning(
    ElementsToAdjust=[label_44, label_43],
    AbsolutePositioning=False,
    Width=Slider(150, range=0..300),
    HorizontalAlignment=0,
    VerticalAlignment=2)
adjustpos_94 = AdjustElementPositioning(
    ElementsToAdjust=[textbox_12, textbox_11],
    AbsolutePositioning=False,
    Width=Slider(50, range=0..300),
    HorizontalAlignment=0,
    VerticalAlignment=2)
adjustpos_95 = AdjustElementPositioning(ElementsToAdjust=button_37, Margin="0, 10, 0, 0", AbsolutePositioning=False, HorizontalAlignment=1, VerticalAlignment=2)

rep_7 = ReplaceText(Text=values_122.Values, Find="å", Replace="a", RecursiveReplace=False)
pre_create_window = RemoteSender(values_123.Values)
rep_8 = ReplaceText(Text=rep_7, Find="ä", Replace="ae", RecursiveReplace=False)
rep_9 = ReplaceText(Text=rep_8, Find="ö", Replace="o", RecursiveReplace=False)

create_window_u_factor_2 = RemoteReceiver(create_window_u_factor)
create_window_shgc_2 = RemoteReceiver(create_window_shgc)
inc = Includes(Value=create_window_shgc_2, Domain=dom_4)  # -> Includes, Deviation
inc_2 = Includes(Value=create_window_u_factor_2, Domain=dom_3)  # -> Includes, Deviation
gate_27 = StreamGate(Stream="U-factor has to to between 0 and 12", Gate=inc_2.Includes)  # -> Target0, Target1
gate_28 = StreamGate(Stream="SHGC has to to between 0 and 1", Gate=inc.Includes)  # -> Target0, Target1

# ----
# Constructions database
pre_construction_database_remove_constru_2 = RemoteReceiver(pre_construction_database_remove_constru)  # "pre_construction_database_remove_construction"
construction_database_remove_constructio_2 = RemoteReceiver(construction_database_remove_constructio)  # "construction_database_remove_construction"
cset_2 = CreateSet(List=pre_construction_database_remove_constru_2)  # -> Set, Map
getdocumentusertext_11 = Python3Script(run=construction_database_remove_constructio_2, key="Heath constructions")  # -> json_string; same code as getdocumentusertext
create_construction_2 = RemoteReceiver(create_construction)
cull_11 = CullPattern(List=cset_2.Set, CullPattern=cset_2.Set)
mindex_3 = MemberIndex(Set=pre_construction_database_remove_constru_2, Member=cull_11)  # -> Index, Count
split_5 = TextSplit(Text=getdocumentusertext_11, Separators="|")
hold_4 = HoldingGate(Data=mindex_3.Index)
cull_i = CullIndex(List=split_5, Indices=hold_4, Wrap=True)
getdocumentusertext_12 = Python3Script(run=create_construction_2, key="Heath constructions")  # -> json_string; same code as getdocumentusertext
join_6 = TextJoin(Text=cull_i, Join="|")
nulls_in_empty = NullsInEmptyBranches(DataWithEmptyBranches=join_6)
null_18 = NullItem(Item=nulls_in_empty)  # -> NullFlags, InvalidFlags, Description
bool_46 = Boolean("False")
sync_construction_database_2 = RemoteReceiver(sync_construction_database)
filter_26 = StreamFilter(Gate=null_18.NullFlags, Stream0=join_6, Stream1=bool_46)
freeze_gate_48 = StreamFreezeGate(Data=filter_26, PassingSwitch=construction_database_remove_constructio_2, Freeze=False, Hold=False)
loaded_constructions_2 = RemoteReceiver(loaded_constructions)
clean = CleanTree(RemoveNulls=True, RemoveInvalid=True, RemoveEmpty=False, Tree=loaded_constructions_2)

# ----
# Load materials
load_materials_file_2 = RemoteReceiver(load_materials_file)
load_materials_2 = RemoteReceiver(load_materials)
gate_29 = StreamGate(Stream=load_materials_file_2, Gate=load_materials_2)  # -> Target0, Target1
file_4 = ReadFile(File=gate_29.Target1, PerLineParse=False)
split_6 = TextSplit(Text=file_4, Separators="§")
item_18 = ListItem(List=split_6, Index=0, Wrap=True)  # -> Item, Item1

and_33 = GateAnd(A=setdocumentusertext_2.done, B=setdocumentusertext.done, C=load_materials_2)

getdocumentusertext_13 = Python3Script(run=and_33, key="Heath materials category")  # -> json_string; same code as getdocumentusertext
getdocumentusertext_14 = Python3Script(run=and_33, key="Heath materials")  # -> json_string; same code as getdocumentusertext
entwine_118 = Entwine(Branch00=getdocumentusertext_13, Branch01=item_18.Item, FlattenInputs=True)  # -> flatten(Result)
entwine_119 = Entwine(Branch00=getdocumentusertext_14, Branch01=item_18.Item1, FlattenInputs=True)  # -> flatten(Result)
join_7 = TextJoin(Text=entwine_118, Join="|")
join_8 = TextJoin(Text=entwine_119, Join="|")
freeze_gate_49 = StreamFreezeGate(Data=join_8, PassingSwitch=load_materials_2, Freeze=False, Hold=False)
freeze_gate_50 = StreamFreezeGate(Data=join_7, PassingSwitch=load_materials_2, Freeze=False, Hold=False)

settextbox = SetTextBoxContents(TextBoxToModify=textbox_9, NewTextBoxContents=bang_10.Branch1)
visible_layers_3 = RemoteReceiver(flatten(visible_layers))
visible_layers_arrows_2 = RemoteReceiver(visible_layers_arrows)
panel_115 = Panel(rep_6)
create_construction_name = RemoteSender(rep_6)
int = Integer(visible_layers_3)
ma_11 = MassAddition(Input=int)  # -> Result, PartialResults
hideshow_20 = HideShowElement(ElementToHideShow=button_36, Show=visible_layers_arrows_2, Collapse=True, Disable=False)
larger_3 = LargerThan(FirstNumber=ma_11.Result, SecondNumber="1")  # -> LargerThan, OrEqualTo
visible_layers_4 = RemoteReceiver(visible_layers)
filter_27 = StreamFilter(Gate=larger_3.LargerThan, Stream0=larger_3.LargerThan, Stream1=visible_layers_3)
hideshow_21 = HideShowElement(ElementToHideShow=stack_68, Show=visible_layers_4, Collapse=True, Disable=False)
hideshow_22 = HideShowElement(ElementToHideShow=label_42, Show=visible_layers_3, Collapse=True, Disable=False)
hideshow_23 = HideShowElement(ElementToHideShow=button_35, Show=filter_27, Collapse=True, Disable=False)

create_construction_name_2 = RemoteReceiver(create_construction_name)

create_construction_name_3 = RemoteReceiver(create_construction_name)

# ----
# Recursion
panel_116 = Panel("Construction modal")
create_construction_3 = RemoteReceiver(create_construction)
objbynn_10 = GetObjectByNickname(NickName=panel_116)
construction_modal = Python3Script()  # -> status; same code as lca_window_status

# ----
# Create construction launch
create_construction_modal_2 = RemoteReceiver(create_construction_modal)
rec_20 = DataRecorder(create_construction_modal_2, DataLimit=-2, RecordData=True)
ma_12 = MassAddition(Input=rec_20)  # -> Result, PartialResults
entwine_120 = Entwine(Branch00=ma_12.Result, Branch01=construction_modal, FlattenInputs=True)
rec_21 = DataRecorder(entwine_120, DataLimit=2, RecordData=True)
item_19 = ListItem(List=rec_21, Index=0, Wrap=True)  # -> Item2, Item1, Item
equals_38 = Equality(FirstNumber=item_19.Item2, SecondNumber=item_19.Item1)  # -> Equality, Inequality
bang_11 = ExplodeTree(Data=equals_38.Inequality)  # -> Branch0, Branch1
py3_29 = Python3Script(x=bang_11.Branch0, y=bang_11.Branch1)  # -> a; same code as py3_6
event_45 = EventGate(Data=py3_29)  # -> Data, IsNew
freeze_gate_51 = StreamFreezeGate(Data=py3_29, PassingSwitch=event_45.IsNew)
event_46 = EventGate(Data=freeze_gate_51)  # -> Data, IsNew
entwine_121 = Entwine(
    Branch00=entwine_114,
    Branch01=label_12,
    Branch02=merge_13,
    Branch03=label_11,
    Branch04=button_33,
    Branch05=button_34,
    FlattenInputs=True)  # -> flatten(Result)
launchwin_11 = LaunchWindow(
    Show=event_46.Data,
    Name="Create construction",
    Width=Slider(360, range=0..1000),
    Height=Slider(540, range=0..1000),
    ChildStatus=1,
    EnableHorizScroll=False)
panel_117 = Panel(event_46.Data)
accent_colors_9 = ValueList({"Amber", "Blue", "Brown", "Cobalt", "Crimson", "Cyan", "Emerald", "Green", "Indigo", "Lime", "Magenta", "Mauve", "Olive", "Orange", "Pink", "Purple", "Red", "Sienna", "Steel", "Taupe", "Teal", "Violet", "Yellow"}, selected="Blue")
create_modal_location_2 = RemoteReceiver(create_modal_location)
heath_window_3 = RemoteReceiver(heath_window)
addelems_12 = AddElements(Window=launchwin_11, Elements=flatten(entwine_121), DoVLChecking=True)  # -> AddedElements, ElementNames
winstat_11 = WindowStatus(Window=launchwin_11)
winprops_11 = SetWindowProperties(
    Window=launchwin_11,
    StartingLocation=create_modal_location_2,
    Theme=0,
    AccentColor=accent_colors_9,
    ShowTitleBar=True,
    BackgroundColor=RGB(255, 255, 255),
    ScaleFactor=1)
childwin = MakeChildWindow(ParentWindow=heath_window_3, ChildWindow=launchwin_11)
create_construction_modal_status = RemoteSender(winstat_11)
construction_elements = RemoteSender(addelems_12.AddedElements)

create_construction_modal_status_2 = RemoteReceiver(create_construction_modal_status)
expression_60 = Expression(x="Hidden", y=create_construction_modal_status_2, Expression="x=y")

or_22 = GateOr(A=expression_60, C=create_construction_3)

expire_10 = ExpireObject(ObjectToExpire=objbynn_10, Expire=or_22)

# ----
# Recursion
panel_118 = Panel("Window modal")
create_window_2 = RemoteReceiver(create_window)
objbynn_11 = GetObjectByNickname(NickName=panel_118)
window_modal = Python3Script()  # -> status; same code as lca_window_status

# ----
# Create window launch
create_window_modal_3 = RemoteReceiver(create_window_modal)
rec_22 = DataRecorder(create_window_modal_3, DataLimit=-2, RecordData=True)
ma_13 = MassAddition(Input=rec_22)  # -> Result, PartialResults
entwine_122 = Entwine(Branch00=ma_13.Result, Branch01=window_modal, FlattenInputs=True)
rec_23 = DataRecorder(entwine_122, DataLimit=2, RecordData=True)
item_20 = ListItem(List=rec_23, Index=0, Wrap=True)  # -> Item2, Item1, Item
equals_39 = Equality(FirstNumber=item_20.Item2, SecondNumber=item_20.Item1)  # -> Equality, Inequality
bang_12 = ExplodeTree(Data=equals_39.Inequality)  # -> Branch0, Branch1
py3_30 = Python3Script(x=bang_12.Branch0, y=bang_12.Branch1)  # -> a; same code as py3_6
event_47 = EventGate(Data=py3_30)  # -> Data, IsNew
freeze_gate_52 = StreamFreezeGate(Data=py3_30, PassingSwitch=event_47.IsNew)
event_48 = EventGate(Data=freeze_gate_52)  # -> Data, IsNew
panel_119 = Panel(event_48.Data)
entwine_123 = Entwine(Branch00=textbox_10, Branch01=stack_70, Branch02=stack_71, Branch03=button_37, FlattenInputs=True)  # -> flatten(Result)
launchwin_12 = LaunchWindow(
    Show=event_48.Data,
    Name="Create window",
    Width=Slider(235, range=0..1000),
    Height=Slider(200, range=0..1000),
    ChildStatus=1,
    EnableHorizScroll=False)
accent_colors_10 = ValueList({"Amber", "Blue", "Brown", "Cobalt", "Crimson", "Cyan", "Emerald", "Green", "Indigo", "Lime", "Magenta", "Mauve", "Olive", "Orange", "Pink", "Purple", "Red", "Sienna", "Steel", "Taupe", "Teal", "Violet", "Yellow"}, selected="Blue")
create_modal_location_3 = RemoteReceiver(create_modal_location)
winstat_12 = WindowStatus(Window=launchwin_12)
addelems_13 = AddElements(Window=launchwin_12, Elements=flatten(entwine_123), DoVLChecking=True)  # -> AddedElements, ElementNames
winprops_12 = SetWindowProperties(
    Window=launchwin_12,
    StartingLocation=create_modal_location_3,
    Theme=0,
    AccentColor=accent_colors_10,
    ShowTitleBar=True,
    BackgroundColor=RGB(255, 255, 255),
    ScaleFactor=1)
create_window_modal_status = RemoteSender(winstat_12)
window_elements = RemoteSender(addelems_13.AddedElements)

create_window_modal_status_2 = RemoteReceiver(create_window_modal_status)
expression_61 = Expression(x="Hidden", y=create_window_modal_status_2, Expression="x=y")
or_23 = GateOr(A=expression_61, C=create_window_2)
expire_11 = ExpireObject(ObjectToExpire=objbynn_11, Expire=or_23)

# ----
# Recursion
panel_120 = Panel("Material modal")
create_material_2 = RemoteReceiver(create_material)
objbynn_12 = GetObjectByNickname(NickName=panel_120)
material_modal = Python3Script()  # -> status; same code as lca_window_status

# ----
# Create material launch
create_material_modal_3 = RemoteReceiver(create_material_modal)
rec_24 = DataRecorder(create_material_modal_3, DataLimit=-2, RecordData=True)
ma_14 = MassAddition(Input=rec_24)  # -> Result, PartialResults
entwine_124 = Entwine(Branch00=ma_14.Result, Branch01=material_modal, FlattenInputs=True)
rec_25 = DataRecorder(entwine_124, DataLimit=2, RecordData=True)
item_21 = ListItem(List=rec_25, Index=0, Wrap=True)  # -> Item2, Item1, Item
equals_40 = Equality(FirstNumber=item_21.Item2, SecondNumber=item_21.Item1)  # -> Equality, Inequality
bang_13 = ExplodeTree(Data=equals_40.Inequality)  # -> Branch0, Branch1
py3_31 = Python3Script(x=bang_13.Branch0, y=bang_13.Branch1)  # -> a; same code as py3_6
event_49 = EventGate(Data=py3_31)  # -> Data, IsNew
freeze_gate_53 = StreamFreezeGate(Data=py3_31, PassingSwitch=event_49.IsNew)
event_50 = EventGate(Data=freeze_gate_53)  # -> Data, IsNew
entwine_125 = Entwine(
    Branch00=stack_65,
    Branch01=pulldown_22,
    Branch02=stack_62,
    Branch03=stack_64,
    Branch04=stack_63,
    Branch05=button_32,
    FlattenInputs=True)  # -> flatten(Result)
launchwin_13 = LaunchWindow(
    Show=event_50.Data,
    Name="Create material",
    Width=Slider(250, range=0..1000),
    Height=Slider(275, range=0..1000),
    ChildStatus=1,
    EnableHorizScroll=False)
panel_121 = Panel(event_50.Data)
accent_colors_11 = ValueList({"Amber", "Blue", "Brown", "Cobalt", "Crimson", "Cyan", "Emerald", "Green", "Indigo", "Lime", "Magenta", "Mauve", "Olive", "Orange", "Pink", "Purple", "Red", "Sienna", "Steel", "Taupe", "Teal", "Violet", "Yellow"}, selected="Blue")
create_modal_location_4 = RemoteReceiver(create_modal_location)
addelems_14 = AddElements(Window=launchwin_13, Elements=flatten(entwine_125), DoVLChecking=True)  # -> AddedElements, ElementNames
winprops_13 = SetWindowProperties(
    Window=launchwin_13,
    StartingLocation=create_modal_location_4,
    Theme=0,
    AccentColor=accent_colors_11,
    ShowTitleBar=True,
    BackgroundColor=RGB(255, 255, 255),
    ScaleFactor=1)
winstat_13 = WindowStatus(Window=launchwin_13)
create_material_modal_status = RemoteSender(winstat_13)
material_elements = RemoteSender(addelems_14.AddedElements)

create_material_modal_status_2 = RemoteReceiver(create_material_modal_status)
expression_62 = Expression(x="Hidden", y=create_material_modal_status_2, Expression="x=y")
or_24 = GateOr(A=expression_62, C=create_material_2)
expire_12 = ExpireObject(ObjectToExpire=objbynn_12, Expire=or_24)

create_window_name = RemoteSender(rep_9)
panel_122 = Panel(rep_9)

# ----
# Create window
create_window_u_factor_3 = RemoteReceiver(create_window_u_factor)
create_window_name_2 = RemoteReceiver(create_window_name)
create_window_shgc_3 = RemoteReceiver(create_window_shgc)
windowmat = HBWindowMaterial(name=create_window_name_2, u_factor=create_window_u_factor_3, shgc=create_window_shgc_3)  # -> out, mat; plug-in component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

# ----
# Windows database
pre_window_database_remove_window_2 = RemoteReceiver(pre_window_database_remove_window)
window_database_remove_window_2 = RemoteReceiver(window_database_remove_window)
cset_3 = CreateSet(List=pre_window_database_remove_window_2)  # -> Set, Map
getdocumentusertext_15 = Python3Script(run=window_database_remove_window_2, key="Heath windows")  # -> json_string; same code as getdocumentusertext
create_window_error = RemoteSender(windowmat.out)
cull_12 = CullPattern(List=cset_3.Set, CullPattern=cset_3.Set)
create_window_3 = RemoteReceiver(create_window)
mindex_4 = MemberIndex(Set=pre_window_database_remove_window_2, Member=cull_12)  # -> Index, Count
split_7 = TextSplit(Text=getdocumentusertext_15, Separators="|")
hold_5 = HoldingGate(Data=mindex_4.Index)
gate_30 = StreamGate(Stream=windowmat.mat, Gate=create_window_3)  # -> Target0, Target1
cull_i_2 = CullIndex(List=split_7, Indices=hold_5, Wrap=True)
getdocumentusertext_16 = Python3Script(run=create_window_3, key="Heath windows")  # -> json_string; same code as getdocumentusertext
objtostr_2 = HBObjectToString(hb_obj=gate_30.Target1)  # -> hb_str; plug-in component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
join_9 = TextJoin(Text=cull_i_2, Join="|")
nulls_in_empty_2 = NullsInEmptyBranches(DataWithEmptyBranches=join_9)
entwine_126 = Entwine(Branch00=getdocumentusertext_16, Branch01=objtostr_2, FlattenInputs=True)  # -> flatten(Result)
null_19 = NullItem(Item=nulls_in_empty_2)  # -> NullFlags, InvalidFlags, Description
bool_47 = Boolean("False")
freeze_gate_54 = StreamFreezeGate(Data=entwine_126, PassingSwitch=create_window_3, Freeze=False, Hold=False)
filter_28 = StreamFilter(Gate=null_19.NullFlags, Stream0=join_9, Stream1=bool_47)
sync_window_database_2 = RemoteReceiver(sync_window_database)
freeze_gate_55 = StreamFreezeGate(Data=filter_28, PassingSwitch=window_database_remove_window_2, Freeze=False, Hold=False)
join_10 = TextJoin(Text=freeze_gate_54, Join="|")
setdocumentusertext_3 = Python3Script(
    key="Heath windows",
    load_value=freeze_gate_39,
    remove_value=freeze_gate_55,
    add_value=join_10,
    update=sync_window_database_2)  # -> out, done
# ---------- setdocumentusertext_3: Python ----------
import Rhino
import rhinoscriptsyntax as rs
import scriptcontext as sc

def modify_value(value):
    sc.doc = Rhino.RhinoDoc.ActiveDoc

    return rs.SetDocumentUserText(key, value)

    sc.doc = ghdoc

if load_value:
    done = modify_value(load_value)

if add_value:
    done = modify_value(add_value)

if remove_value:
    done = modify_value(remove_value)
elif remove_value == False:
    done = modify_value(None)

if update:
    done = True
# ---------- end setdocumentusertext_3 ----------
getdocumentusertext_17 = Python3Script(run=setdocumentusertext_3.done, key="Heath windows")  # -> json_string
# ---------- getdocumentusertext_17: Python ----------
import Rhino
import rhinoscriptsyntax as rs
import scriptcontext as sc

if run:
    sc.doc = Rhino.RhinoDoc.ActiveDoc

    json_string = rs.GetDocumentUserText(key)
    if json_string == None:
        json_string = False

    sc.doc = ghdoc
# ---------- end getdocumentusertext_17 ----------
split_8 = TextSplit(Text=getdocumentusertext_17, Separators="|")
hold_6 = HoldingGate(Data=split_8)
strtoobj_2 = HBStringToObject(hb_str=hold_6)  # -> flatten(hb_obj); plug-in component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
ipy2 = IronPython2Script(windows=strtoobj_2)  # -> unique_windows; inputs windows: list
# ---------- ipy2: IronPython ----------
"""Grasshopper Script"""

unique_windows = []

for i in range(len(windows)):
    if windows[i] not in unique_windows:
        unique_windows.append(windows[i])
# ---------- end ipy2 ----------
clean_2 = CleanTree(RemoveNulls=True, RemoveInvalid=True, RemoveEmpty=False, Tree=ipy2)
created_windows_database = RemoteSender(clean_2)

created_windows_database_2 = RemoteReceiver(created_windows_database)
decnstrmat_2 = HBDeconstructMaterial(mat=created_windows_database_2)  # -> values, attr_names, r_val_si, r_val_ip; plug-in component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
item_22 = ListItem(List=decnstrmat_2.values, Index=0, Wrap=True)  # -> flatten(Item), Item1, Item2
entwine_127 = Entwine(Branch00=generic_shgc, Branch01=item_22.Item2, FlattenInputs=True)  # -> flatten(Result)
entwine_128 = Entwine(Branch00=generic_u_value, Branch01=item_22.Item1, FlattenInputs=True)  # -> flatten(Result)
clean_3 = CleanTree(RemoveNulls=True, RemoveInvalid=True, RemoveEmpty=False, Tree=item_22.Item)
clean_4 = CleanTree(RemoveNulls=True, RemoveInvalid=True, RemoveEmpty=False, Tree=entwine_128)
clean_5 = CleanTree(RemoveNulls=True, RemoveInvalid=True, RemoveEmpty=False, Tree=entwine_127)
num_3 = Number(clean_5)
entwine_129 = Entwine(Branch00="Generic", Branch01=clean_3, FlattenInputs=True)  # -> flatten(Result)
num_4 = Number(clean_4)
expression_63 = Expression(x=num_3, Expression="Round(x, 2)")
expression_64 = Expression(x=num_4, Expression="Round(x, 2)")
create_window_names = RemoteSender(entwine_129)
format_6 = Format(Format="{0} (U-factor: {1}, SHGC: {2})", Culture=127, Data0=entwine_129, Data1=expression_64, Data2=expression_63)
panel_123 = Panel(format_6)
create_window_full_names = RemoteSender(format_6)

# ---- group: Building occupancy and systems (continued)
created_windows_database_3 = RemoteReceiver(created_windows_database)
entwine_130 = Entwine(Branch00="Generic", Branch01=created_windows_database_3, FlattenInputs=True)  # -> flatten(Result)
item_23 = ListItem(List=entwine_130, Index=subset_subface_window_3, Wrap=True)
expression_65 = Expression(x="Generic", y=item_23, Expression="x=y")
filter_29 = StreamFilter(Gate=expression_65, Stream0=item_23, Stream1=null_7)
windowconstr_2 = HBWindowConstruction(materials=filter_29)  # -> constr; plug-in component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
cluster_4 = Cluster_2(window_construction=windowconstr_2, gwp_a1_a3="2.5", gwp_a4="0.042", density_kg_m2="38.2")
subfacesubset_2 = HBSubfaceSubset(window=cluster_4, skylight=cluster_3)  # -> subface_set; plug-in component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

# ----
create_window_full_names_2 = RemoteReceiver(create_window_full_names)
cull_i_3 = CullIndex(List=create_window_full_names_2, Indices="0", Wrap=invert(True))
concat_3 = Concatenate(FragmentA="- ", FragmentB=cull_i_3)

lng_24 = ListLength(List=cull_i_3)
settextblock_5 = SetTextBlockContents(TextBlockToModify=tb_13, NewTextBlockContents=concat_3)
py3_32 = Python3Script(current_windows=lng_24, maximum_windows=number_slider_5)  # -> status; inputs current_windows: Int32, maximum_windows: Int32
# ---------- py3_32: Python ----------
status = [True]*current_windows
status.extend([False]*(maximum_windows-current_windows))
# ---------- end py3_32 ----------
hideshow_24 = HideShowElement(ElementToHideShow=simplify(merge_10), Show=simplify(graft(py3_32)), Collapse=True, Disable=False)

create_window_names_2 = RemoteReceiver(create_window_names)
create_window_name_3 = RemoteReceiver(create_window_name)
create_window_error_2 = RemoteReceiver(create_window_error)
expression_66 = Expression(x=create_window_names_2, y=create_window_name_3, Expression="x=y")
len_3 = TextLength(Text=create_window_error_2)
cull_13 = CullPattern(List=expression_66, CullPattern=expression_66)
bool_48 = Boolean(len_3)
gate_31 = StreamGate(Stream="Window name contains no valid characters", Gate=bool_48)  # -> Target0, Target1
gate_32 = StreamGate(Stream="Window already exists", Gate=cull_13)  # -> Target0, Target1
entwine_131 = Entwine(
    Branch00=gate_27.Target0,
    Branch01=gate_28.Target0,
    Branch02=gate_31.Target1,
    Branch03=gate_32.Target1,
    FlattenInputs=True)  # -> flatten(Result)
item_24 = ListItem(List=entwine_131, Index=0, Wrap=True)
create_window_error_message = RemoteSender(item_24)

create_window_error_message_2 = RemoteReceiver(create_window_error_message)
null_20 = NullItem(Item=create_window_error_message_2)  # -> NullFlags, InvalidFlags, Description
filter_30 = StreamFilter(Gate=null_20.NullFlags, Stream0=create_window_error_message_2, Stream1=" ")
filter_31 = StreamFilter(Gate=null_20.NullFlags, Stream0=Slider(500, range=0..1000), Stream1=Slider(1000000, range=0..1000000))
hideshow_25 = HideShowElement(ElementToHideShow=button_37, Show=True, Collapse=True, Disable=invert(null_20.NullFlags))
tooltip_10 = AttachTooltipToElement(ElementsToAttachTo=button_37, TooltipContent=filter_30, ShowDelay=filter_31, Duration=2000)

panel_124 = Panel(clean_2)

setlist_3 = SetListContents(ListToModify=pulldown_12, NewListContents=format_6, SelectedIndex="0")
setlist_4 = SetListContents(ListToModify=pulldown_11, NewListContents=format_6, SelectedIndex="0")

# ----
# Material category
create_material_category_2 = RemoteReceiver(create_material_category)
create_material_name_4 = RemoteReceiver(create_material_name)
create_material_3 = RemoteReceiver(create_material)
concat_4 = Concatenate(FragmentA=create_material_name_4, FragmentB=":", FragmentC=create_material_category_2)
getdocumentusertext_18 = Python3Script(run=create_material_3, key="Heath materials category")  # -> json_string; same code as getdocumentusertext
gate_33 = StreamGate(Stream=concat_4, Gate=create_material_3)  # -> Target0, Target1
entwine_132 = Entwine(Branch00=getdocumentusertext_18, Branch01=gate_33.Target1, FlattenInputs=True)  # -> flatten(Result)
join_11 = TextJoin(Text=entwine_132, Join="|")
sync_material_database_3 = RemoteReceiver(sync_material_database)

create_material_4 = RemoteReceiver(create_material)
gate_34 = StreamGate(Stream=opaquemat_3.mat, Gate=create_material_4)  # -> Target0, Target1
getdocumentusertext_19 = Python3Script(run=create_material_4, key="Heath materials")  # -> json_string; same code as getdocumentusertext
objtostr_3 = HBObjectToString(hb_obj=gate_34.Target1)  # -> hb_str; plug-in component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
entwine_133 = Entwine(Branch00=getdocumentusertext_19, Branch01=objtostr_3, FlattenInputs=True)  # -> flatten(Result)
join_12 = TextJoin(Text=entwine_133, Join="|")
freeze_gate_56 = StreamFreezeGate(Data=join_12, PassingSwitch=create_material_4, Freeze=False, Hold=False)

# ----
# Bake model
panel_125 = Panel("""Heath::honeybee model::walls
Heath::honeybee model::roof
Heath::honeybee model::floors
Heath::honeybee model::ground
Heath::honeybee model::windows
Heath::honeybee model::doors
Heath::honeybee model::context""")
ef_layer_2 = EleFrontLayer(FullPath=panel_125)  # -> Layer, FullPath, Hidden, Locked, DisplayColour, MaterialName, Linetype, PrintColour, PrintWidth
ef_att_4 = EleFrontAttributes(Layer=ef_layer_2.Layer)  # -> graft(Attributes), Keys, Values, Name, Layer, ColourSource, DisplayColour, MaterialSource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
bake_model_2 = RemoteReceiver(bake_model)

# ----
# Save constructions, (triggered after creating)
heath_flying_11 = RemoteReceiver(heath_flying)  # disabled
py3_33 = Python3Script(get=heath_flying_11)  # -> mpl_folder; disabled; same code as py3
panel_126 = Panel("constructions")  # disabled
create_construction_4 = RemoteReceiver(create_construction)  # disabled
py3_34 = Python3Script(name=panel_126, folder=py3_33)  # -> file_name; disabled
# ---------- py3_34: Python ----------
import os

indentation = 0
while indentation < 100:
    path = folder + '\\' + name + ' ' + str(indentation) + '.json'
    if not os.path.exists(path):
        break
    indentation += 1
file_name = name + ' ' + str(indentation)
# ---------- end py3_34 ----------
panel_127 = Panel(py3_34)  # disabled

# ---- group: Analyse context and model
# Weather visualisation
# # Weather visualisation
# This cluster visualises weather data from a .epw file including solar radiation and temperature, as applied to a target geometry
# 
# ## Instructions
# Enter all the inputs and visualise wind, sky view and temperature,  set `Run direct sun hours study` and `Run incident radiation study` to visualise solar radiation
# 
# ## Inputs
# - `EPW file URL` - the URL for a EPW file which describes the location
# - `Target Geometry` - geometry on which to apply irradiation study
# - `Context Geometry` - geometry which shades the target geometry
# - `Run direct sun hours study` - set to True to run the direct sun hours study
# - `Run incident radiation study` - set to True to run the incident radiation study
# - `Sky mask centre point` - point at which to generate sky mask
# 
# ## Outputs
# - `Sky dome` - mesh visualising the directions where solar radiation comes from during the year at the location
# - `Sky mask - mesh visualising what portions of the sky are visible at the specified point
# - `Wind rose` - mesh visualising wind directions and velocities during the year
# - `Dry bulb temperature line chart` - mesh visualising dry bulb temperature during the year
# - `Dry bulb temperature 2D chart` - mesh visualising dry bulb temperature for each hour of the year
# - `Direct sun hours` - mesh visualising the number of direct sun hours on the target geometry
# - `Incident radiation` - mesh visualising the incident radiation [kWh/m2] on the target geometry
# 
# ## Interpretation
# To be added...
# Visualise properties
# # Visualise properties
# This cluster visualises room and face attributes of a Honeybee model
# 
# ## Instructions
# Input the Honeybee model to be visualised and select room/face attributes using the HB Room Attributes/HB Room Energy Attibrutes/HB Face Attributes/HB Face Energy Attributes dropdown components. Adjust precision of the attributes using the `Number of decimals` inputs
# 
# ## Inputs
# - `Honeybee model` - Honeybee model to be visualised
# - `Room attribute` - Honeybee Room  or Room Energy attribute to visualise
# - `Number of decimals (room)` - Precision of room attribute output
# - `Face attribute` - Honeybee Face  or Face Energy attribute to visualise
# - `Number of decimals (face)` - Precision of face attribute output
# 
# ## Outputs
# - `Visualised room attributes` - mesh representing the selected room attribute
# - `Visualised face attributes` - mesh representing the selected face attribute
# 
# ## Interpretation
# To be added...
run_weather_visualisation_3 = RemoteReceiver(run_weather_visualisation)
run_weather_visualisation_4 = RemoteReceiver(run_weather_visualisation)
gate_35 = StreamGate(Stream="Heath geometry type", Gate=run_weather_visualisation_3)  # -> Target0, Target1
gate_36 = StreamGate(Stream="Heath geometry type", Gate=run_weather_visualisation_4)  # -> Target0, Target1
roomenergyattr = HBRoomEnergyAttributes({"Program": "properties.energy.program_type.display_name", "Construction Set": "properties.energy.construction_set.display_name", "Is Conditioned": "properties.energy.is_conditioned", "People per Area [ppl/m2]": "properties.energy.people.people_per_area", "Area per Person [m2/ppl]": "properties.energy.people.area_per_person", "Lighting per Area [W/m2]": "properties.energy.lighting.watts_per_area"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}, selected="Program")
refkv_9 = ReferenceByKeyValue(Key=gate_35.Target1, Val="Room", lightweight=False)
refkv_10 = ReferenceByKeyValue(Key=gate_36.Target1, Val="Context", lightweight=False)
pt_16 = ConstructPoint(XCoordinate=Slider(21, range=0..100), YCoordinate=Slider(15, range=0..100), ZCoordinate=0)
faceenergyattr = HBFaceEnergyAttributes({"Construction": "properties.energy.construction.display_name", "Materials": "properties.energy.construction.layers", "Thickness [m]": "properties.energy.construction.thickness", "Density [kg/m2]": "properties.energy.construction.mass_area_density", "Heat Capacity [J/K-m2]": "properties.energy.construction.area_heat_capacity", "Construction R-Value [m2-K/W]": "properties.energy.construction.r_value", "Construction U-Value [W/m2-K]": "properties.energy.construction.u_value", "Construction U-Factor [W/m2-K]": "properties.energy.construction.u_factor", "Construction SHGC [Unshaded]": "properties.energy.construction.shgc", "R-Factor [m2-K/W]": "properties.energy.r_factor", "U-Factor [W/m2-K]": "properties.energy.u_factor", "SHGC [Unshaded]": "properties.energy.shgc", "Solar Transmitance [Unshaded]": "properties.energy.construction.solar_transmittance", "Visible Transmitance [Unshaded]": "properties.energy.construction.visible_transmittance", "Solar Reflectance [Outside]": "properties.energy.construction.outside_solar_reflectance", "Solar Reflectance [Inside]": "properties.energy.construction.inside_solar_reflectance", "Fraction Area Operable": "properties.energy.vent_opening.fraction_area_operable", "Fraction Height Operable": "properties.energy.vent_opening.fraction_height_operable", "Discharge Coefficient": "properties.energy.vent_opening.discharge_coefficient"}, selected="Construction SHGC [Unshaded]")
room_attribute_visualize_3 = RemoteReceiver(room_attribute_visualize)
room_energy_attribute_2 = RemoteReceiver(room_energy_attribute)
face_attribute_visualize_3 = RemoteReceiver(face_attribute_visualize)
face_energy_attribute_2 = RemoteReceiver(face_energy_attribute)
run_weather_visualisation_5 = RemoteReceiver(run_weather_visualisation)
roomattr = HBRoomAttributes({"Display Name": "display_name", "Simulation Name (Identifier)": "identifier", "Multiplier": "multiplier", "Floor Area Excluded": "exclude_floor_area", "Story": "story", "Volume": "volume", "Gross Floor Area": "floor_area", "Exposed Area": "exposed_area", "Exterior Wall Area": "exterior_wall_area", "Exterior Aperture Area": "exterior_aperture_area", "Average Floor Elevation": "average_floor_height"}, selected="Exterior Aperture Area")
faceattr = HBFaceAttributes({"Display Name": "display_name", "Simulation Name (Identifier)": "identifier", "Boundary Condition": "boundary_condition", "Has Parent": "has_parent", "Parent": "parent", "Azimuth": "azimuth", "Altitude": "altitude", "Area": "area", "Perimeter": "perimeter", "Face Type": "type", "Aperture Is Operable": "is_operable", "Door Is Glass": "is_glass"}, selected="Face Type")
room_attribute_2 = RemoteReceiver(room_attribute)
face_attribute_2 = RemoteReceiver(face_attribute)
pt_17 = Point(pt_16)
data_20 = Data(location_16)
filter_32 = StreamFilter(Gate=face_attribute_visualize_3, Stream0=face_energy_attribute_2, Stream1=face_attribute_2)
filter_33 = StreamFilter(Gate=room_attribute_visualize_3, Stream0=room_energy_attribute_2, Stream1=room_attribute_2)
weather_visualisation = WeatherVisualisation(
    _1=data_20,
    run_weather_visualisation=run_weather_visualisation_5,
    target_geometry_2=refkv_9,
    target_geometry=refkv_10,
    run_direct_sun_hours_study=run_weather_visualisation_5,
    run_incident_radiation_study=run_weather_visualisation_5,
    sky_mask_centre_point=pt_17)  # -> sky_dome, sky_mask, wind_rose, dry_bulb_temperature_line_chart, dry_bulb_temperature_2d_chart, direct_sun_hours_2, incident_radiation
room_energy_attribute_visualize_3 = RemoteReceiver(room_energy_attribute_visualize)
face_energy_attribute_visualize_3 = RemoteReceiver(face_energy_attribute_visualize)
room_attribute_visualize_4 = RemoteReceiver(room_attribute_visualize)
face_attribute_visualize_4 = RemoteReceiver(face_attribute_visualize)
weather_visualization_type_2 = RemoteReceiver(weather_visualization_type)
or_25 = GateOr(A=room_attribute_visualize_4, B=room_energy_attribute_visualize_3)
or_26 = GateOr(A=face_attribute_visualize_4, B=face_energy_attribute_visualize_3)
weather_visualization_show_2 = RemoteReceiver(weather_visualization_show)
weather_visualization_show_3 = RemoteReceiver(weather_visualization_show)
equals_41 = Equality(FirstNumber="3", SecondNumber=weather_visualization_type_2)  # -> Equality, Inequality
equals_42 = Equality(FirstNumber="4", SecondNumber=weather_visualization_type_2)  # -> Equality, Inequality
equals_43 = Equality(FirstNumber="5", SecondNumber=weather_visualization_type_2)  # -> Equality, Inequality
equals_44 = Equality(FirstNumber="6", SecondNumber=weather_visualization_type_2)  # -> Equality, Inequality
nor_2 = GateNor(A=equals_41.Equality, B=equals_42.Equality)
or_27 = GateOr(A=equals_43.Equality, B=equals_44.Equality)
and_34 = GateAnd(A=weather_visualization_show_3, B=or_27)
weather_visualisation_wireframe = RemoteSender(and_34)
weather_visualization_show_4 = RemoteReceiver(weather_visualization_show)
swatch = ColourSwatch(SwatchColor=RGB(84, 84, 84))
gate_37 = StreamGate(Stream=swatch, Gate=weather_visualization_show_4)  # -> Target0, Target1

# ----
entwine_134 = Entwine(
    Branch00=weather_visualisation.sky_dome,
    Branch01=weather_visualisation.sky_mask,
    Branch02=weather_visualisation.wind_rose,
    Branch03=weather_visualisation.dry_bulb_temperature_line_chart,
    Branch04=weather_visualisation.dry_bulb_temperature_2d_chart,
    Branch05=weather_visualisation.direct_sun_hours_2,
    Branch06=weather_visualisation.incident_radiation,
    FlattenInputs=True)
freeze_gate_57 = StreamFreezeGate(Data=entwine_134, PassingSwitch=run_weather_visualisation_2, Hold=True)
bang_14 = ExplodeTree(Data=freeze_gate_57)  # -> Branch0, Branch1, Branch2, Branch3, Branch4, Branch5, Branch6

weather_visualisation_wireframe_2 = RemoteReceiver(weather_visualisation_wireframe)

# ----
# Zoom weather visualization module
zoom_weather_visualization_2 = RemoteReceiver(zoom_weather_visualization)

# ---- group: Analyse context and model (continued)
null_21 = NullItem(Item=flatten(freeze_gate_57))  # -> NullFlags, InvalidFlags, Description
filter_34 = StreamFilter(
    Gate=weather_visualization_type_2,
    Stream0=bang_14.Branch0,
    Stream1=bang_14.Branch1,
    Stream2=bang_14.Branch2,
    Stream3=bang_14.Branch3,
    Stream4=bang_14.Branch4,
    Stream5=bang_14.Branch5,
    Stream6=bang_14.Branch6)
cull_14 = CullPattern(List=null_21.NullFlags, CullPattern=invert(null_21.NullFlags))
gate_38 = StreamGate(Stream=filter_34, Gate=weather_visualization_show_2)  # -> Target0, Target1
lng_25 = ListLength(List=cull_14)
gate_39 = StreamGate(Stream=gate_38.Target1, Gate=nor_2)  # -> Target0, Target1
weather_visualisation_exists = RemoteSender(lng_25)
mesh = Mesh([gate_39.Target1, gate_39.Target0])
sortbytype = SortObjectsByType(RhinoObjects=gate_39.Target0)  # -> Points, Curves, Surfaces, Breps, Meshes, TextObjects, HatchObjects, LightObjects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
bbox = BoundingBox(Content=mesh, Plane=PlaneXY(0, 0, 0), UnionBox=True)  # -> Box, Box_2
line = Line(sortbytype.Curves)
zoom_weather_visualization_bounding_box = RemoteSender(bbox.Box)
null_22 = NullItem(Item=line)  # -> NullFlags, InvalidFlags, Description
data_21 = Data([sortbytype.Other, sortbytype.Meshes])
sift = SiftPattern(List=sortbytype.Curves, SiftPattern=null_22.NullFlags)  # -> Output0, Output1
preview_16 = CustomPreview(Geometry=[sift.Output1, data_21], Material=swatch)
preview_17 = CustomPreview(Geometry=gate_39.Target1, Material=gate_37.Target1)

# ----
weather_visualisation_exists_2 = RemoteReceiver(weather_visualisation_exists)
weather_visualisation_exists_3 = RemoteReceiver(weather_visualisation_exists)
hideshow_26 = HideShowElement(ElementToHideShow=button_10, Show=True, Collapse=True, Disable=invert(weather_visualisation_exists_2))
hideshow_27 = HideShowElement(ElementToHideShow=button_11, Show=True, Collapse=True, Disable=invert(weather_visualisation_exists_2))
hideshow_28 = HideShowElement(ElementToHideShow=stack_12, Show=weather_visualisation_exists_3, Collapse=True, Disable=False)

zoom_weather_visualization_bounding_box_2 = RemoteReceiver(zoom_weather_visualization_bounding_box)
zbb = ZoomBoundingBox(Box=zoom_weather_visualization_bounding_box_2, Run=zoom_weather_visualization_2)

# ----
# Bake model
panel_128 = Panel("""Heath::weather::Sky dome
Heath::weather::Sky mask
Heath::weather::Wind rose
Heath::weather::Dry bulb temperature line chart
Heath::weather::Dry bulb temperature 2D chart
Heath::weather::Direct sun hours
Heath::weather::Incident radiation""")
merge_14 = Merge(Data1=sift.Output1, Data2=data_21, Data3=gate_39.Target1)
weather_visualization_type_3 = RemoteReceiver(weather_visualization_type)
item_25 = ListItem(List=panel_128, Index=weather_visualization_type_3, Wrap=True)
ef_layer_3 = EleFrontLayer(FullPath=item_25)  # -> Layer, FullPath, Hidden, Locked, DisplayColour, MaterialName, Linetype, PrintColour, PrintWidth
weather_visualisation_bake_2 = RemoteReceiver(weather_visualisation_bake)
ef_att_5 = EleFrontAttributes(Layer=ef_layer_3.Layer)  # -> Attributes, Keys, Values, Name, Layer, ColourSource, DisplayColour, MaterialSource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

clean_6 = CleanTree(RemoveNulls=True, RemoveInvalid=True, RemoveEmpty=False, Tree=merge_14)

lng_26 = ListLength(List=clean_6)
repeat_17 = RepeatData(Data=ef_att_5.Attributes, Length=lng_26)
bake_2 = BakeObjects(Geometry=clean_6, Attributes=repeat_17, Bake=weather_visualisation_bake_2, createGroups=False, preset="Moderate")  # -> Message, Ghosts

panel_129 = Panel(bake_2.Ghosts)

# ----
# Detailed energy simulations
# https://energyplus-weather.s3.amazonaws.com/africa_wmo_region_1/LBY/LBY_Tripoli.620100_IWEC/LBY_Tripoli.620100_IWEC.zip
# # Detailed energy simulations
# This cluster simulates energy balance over a year and outputs the total energy use intensity (EUI), divided into end uses, and detailed graphs of the energy balance, peak cooling/heating, and cooling/heating load profiles
# 
# ## Instructions
# Enter all inputs and set `Run Energy Simulation` to true to run the energy simulation
# 
# ## Inputs
# - `EPW file URL` - the URL for a EPW file which describes the location
# - `Honeybee model` - the Honeybee model for analysis
# - `Run Energy Simulation` - set to True to run the energy simulation
# 
# ## Outputs
# - `Energy use intensity [kWh/m2a]` - A number representing the total energy use of the model
# - `Energy use intensity per end use [kWh/m2a]` - A list of values with the energy uses split into different end uses
# - `End uses` - A list of text strings representing the different end uses
# - `Annual hourly energy results` - various meshes representing different energy results over the hours of the year
# - `Monthly energy balance` - A monthly breakdown of the energy balance, with energy sources in the top and energy sinks in the bottom
# - `Peak cooling` - A number representing the peak cooling load in each zone
# - `Peak heating` - A number representing the peak heating load in each zone
# - `Cooling load profile` - A mesh representing the cooling load profile during the design day
# - `Heating load profile` - A mesh representing the heating load profile during the design day
# 
# ## Interpretation
# To be added...
data_22 = Data(location_16)
epw_file_url = Data(data_22)
downloadepw = LBDownloadWeather(weather_URL=epw_file_url)  # -> epw_file, stat_file, ddy_file; plug-in component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
number_slider_44 = Slider(50, range=0..100)

# ---- group: Analyse performance
# Simple energy simulations
run_simple_energy_simulations_4 = RemoteReceiver(run_simple_energy_simulations)
data_23 = Data(location_16)
downloadepw_2 = LBDownloadWeather(weather_URL=data_23)  # -> epw_file, stat_file, ddy_file; plug-in component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
run_peak_loads = Boolean(run_simple_energy_simulations_4)
run_energy_balance = Boolean(run_simple_energy_simulations_4)
data_24 = Data()
colrange_3 = LBColorRange(index=Slider(0, range=0..26))  # -> colors; plug-in component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
colrange_4 = LBColorRange(index=Slider(26, range=0..26))  # -> colors; plug-in component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
number_slider_45 = Slider(760000, range=0..1000000)
neg_2 = Negative(Value=Slider(100000, range=0..100000))
pt_18 = ConstructPoint(XCoordinate=Slider(80, range=0..100), YCoordinate=Slider(5, range=0..100), ZCoordinate=0)
simple_energy_simulation_base_point = RemoteSender(pt_18)
simple_energy_simulation_base_point_2 = RemoteReceiver(simple_energy_simulation_base_point)
simple_energy_simulation_base_point_3 = RemoteReceiver(simple_energy_simulation_base_point)
simple_energy_simulation_base_point_4 = RemoteReceiver(simple_energy_simulation_base_point)
simple_energy_simulation_base_point_5 = RemoteReceiver(simple_energy_simulation_base_point)
simple_energy_simulation_base_point_6 = RemoteReceiver(simple_energy_simulation_base_point)

# ----
panel_130 = Panel(run_simple_energy_simulations_4)
data_25 = Data(downloadepw_2.ddy_file)

# ----
# Daylight Glare Probability (DGP)
# # Daylight Glare Probability
# This cluster calculates the DGP for a specific view.
# 
# ## Instructions
# Enter all inputs and set `Run Glare analysis`to True to investigate glare potential for the set viewport and time. For a simple model this simulation takes around 50-60s.
# 
# ## Inputs
# - `EPW file URL` - the URL for a EPW file which describes the location
# - `Honeybee model` - the Honeybee model for analysis
# - `Viewport name` - the string name of a viewport in the Rhino model which shall be analysed
# - `Month` - month of the analysis period (1-12)
# - `Day` - date of the analysis period (1-31)
# - `Hour` - hour of the analysis period (0-23)
# - `Run Glare analysis` - set to True to run the analysis
# 
# ## Outputs
# - `Daylight glare probability (DGP)` - a value for the probability of glare occuring in this view at this time [%]
# - `HDR image` - a HDR image which can be visualised using LB ImageViewer to show what areas cause glare
# - `HDR false color image` - a HDR image with modified colors to more clearly see causes of glare
# 
# ## Interpretation
# To be added...
number_slider_46 = Slider(6, range=1..12)
txt_3 = Text("Perspective")
data_26 = Data(location_16)
num_5 = Number(calculate_glare_probability_2)
num_6 = Number(calculate_glare_probability_2)

day = Number(Slider(21, range=1..31))
hour = Number(Slider(12, range=0..23))
month = Number(number_slider_46)

# ----
# Daylight (Illuminance, DA and UDI)
# Create analysis grid
# Alternatively create grid from surface
# # Daylight (Illuminance, DA and UDI)
# This cluster simulates illuminance for a specified hour of the year and daylight autonomy (DA) and useful daylight illuminance (UDI) for the entire year across an analysis surface.
# 
# ## Instructions
# Enter all inputs and set `Run Illuminance` or `Run Annual Daylight Simulation`to True to investigate daylight. The illuminance study covers a specified time step whereas the annual daylight simulation covers the full year. The `grid size` and `detail level` inputs can be used to improve the fidelity of the simulation at the cost of simulation time. The study can take several minutes, depending on the grid size and detail level.
# 
# ## Inputs
# - `EPW file URL` - the URL for a EPW file which describes the location
# - `Honeybee model` - the Honeybee model for analysis
# - `Grid size` - the resolution of the analysis grid in metres
# - `Detail level (0-2)` - level of detail for the daylight simulation, the higher value, the higher detail and the slower the simulation
# - `Month (illuminance)` - month of the analysis period  for the illuminance simulation (1-12)
# - `Day (illuminance)` - date of the analysis period for the illuminance simulation (1-31)
# - `Hour (illuminance)` - hour of the analysis period for the illuminance simulation (0-23)
# - `Run Illuminance` - set to True to run the illuminance analysis for the specified timestep
# - `Run Annual Daylight Simulation` - set to True to run the full year daylight simulation
# 
# ## Outputs
# - `Illuminance [Lux]` - a mesh visualising the amount of incident radiation which hits the analysis surface at the specified timestep
# - `Spatial Daylight Autonomy [-]` - the mean SDA for the entire analysis surface
# - `Daylight autonomy [%]` - a mesh visualising the value of DA across the analysis surface
# - `UDI [%]` - a mesh visualising the value of Useful Daylight Illuminance across the analysis surface
# - `UDI <50 [%]` - a mesh visualising the percentage of time that the lower treshold of illuminance is not achieved across the analysis surface
# - `UDI >3000 [%]` - a mesh visualising the percentage of time that the upper treshold of illuminance is exceeded across the analysis surface
# 
# ## Interpretation
# To be added...
number_slider_47 = Slider(12, range=0..23)
run_daylight_simulations_2 = RemoteReceiver(run_daylight_simulations)
number_slider_48 = Slider(0, range=0..2)
data_27 = Data(location_16)
epw_file_url_2 = Data(data_27)
downloadepw_3 = LBDownloadWeather(weather_URL=epw_file_url_2)  # -> epw_file, stat_file, ddy_file; plug-in component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
detail_level_0_2 = Number(number_slider_48)
grid_size = Number(Slider(1, range=0..10))
run_annual_daylight_simulation = Boolean(run_daylight_simulations_2)
detail_level_0_2_2 = Number(number_slider_48)
run_illuminance = Boolean(run_daylight_simulations_2)
cluster_5 = Cluster_6()
X = UnitX(Factor=Slider(0, range=0..400))

panel_131 = Panel(run_daylight_simulations_2)

# ----
# Revised LCA calculation
# # Life Cycle Assessment (LCA)
# This cluster calculates the embodied carbon for the input Honeybee model
# 
# ## Instructions
# Enter the inputs to calculate the GWP (Global Warming Potential), i.e. the embodied carbon, for the materials in the Honeybee model
# 
# ## Inputs
# - `Honeybee model` - the Honeybee model for analysis
# 
# ## Outputs
# - `Total GWP` - total GWP for the modules A1-A5.1 [kg CO2eq]
# - `GWP by element type` - GWP of each element type for the modules A1-A5.1 [kg CO2eq]
# - `Element types` - list of element types in the model
# 
# ## Interpretation
# To be added...
panel_132 = Panel("Energy and fuel")
get_resources = BrimstoneGetResources(json_data=get_categories.json_data, category=panel_132)  # -> out, json_data, resources
# ---------- get_resources: Python ----------
"""Extracts resource names from a Klimatdatabas json object
    Inputs:
        json_data: dictionary with json data
        category: readable name of category to extract resources from
    Output:
        resources: List of resources in category"""

import scriptcontext

import brimstone
ghenv.Component.Message = brimstone.globals.version

ghenv.Component.Name = 'Brimstone - Get Resources'
ghenv.Component.NickName = 'Get Resources'

def main(json_data, category):
    resources = get_resources(json_data, category)
    return resources
    
def get_resources(json_data, category):
    pred = lambda v: v["Text"] == category
    resources = []
    for resource in json_data["Resources"]:
        if len(filter(pred, resource["Categories"])) > 0:
            resources.append(resource["Name"])
    return resources

if __name__ == "__main__":
    if not scriptcontext.sticky["brimstone_flying"]:
        raise Exception("The 'Brimstone - Fly' component needs to exist on the canvas")
    print json_data
    resources = main(json_data, category)
    
    json_data = [json_data]
# ---------- end get_resources ----------
list_11 = ItemSelector(
    get_resources.resources,
    {"Electricity, Swedish mix", "Diesel, reduction obligation  (2021)": "Diesel, reduction obligation (2021)", "Diesel, fossil", "Petrol, reduction obligation  (2021)": "Petrol, reduction obligation (2021)", "Petrol, 100% fossil", "District heating, Swedish average", "HVO100", "Gasol", "Wood pellets", "E85 ethanol", "Biogas", "Fuel oil 1", "Fuel oil 2-5", "FAME100", "ED95"}, selected="Electricity, Swedish mix")
get_lca_data = BrimstoneGetLCAData(json_data=get_resources.json_data, resources="District heating, Swedish average")  # -> out, json_data, lca_data, indicators, values; inputs resources: list, addtl_indicators: list
#   port json_data: List of resources in category
# ---------- get_lca_data: Python ----------
"""Extracts LCA indicators and values from a Klimatdatabas json for a specific resource
    Inputs:
        json_data: dictionary with json data
        resources: list of readable names of resources
        addtl_indicators: list of additional keys to retrieve from resource
    Output:
        lca_data: list of dictionaries with LCA data for each resource
        indicators: list of indicators
        values: list of indicator values"""

import scriptcontext
import ghpythonlib.treehelpers as th
from collections import OrderedDict
import copy

import brimstone
ghenv.Component.Message = brimstone.globals.version

ghenv.Component.Name = 'Brimstone - Get LCA Data'
ghenv.Component.NickName = 'Get LCA Data'

# todo: magic string here - not good!
gwp_data_string = "Global Warming potential"

# keys: names in output dict, values: DataModuleCode in json db
gwp_data_entries = {
    "GWPA1A3Conservative": "A1-A3 Conservative",
    "GWPA1A3Typical": "A1-A3 Typical",
    "GWPA4": "A4",
    "GWPA5.1": "A5.1",
}

def main(json_data, resource, addtl_indicators):
    lca_data, indicators, values = [], [], []

    for i, resource in enumerate(resources):
        lca_data.append(get_lca_data(json_data, resource, addtl_indicators))
        resource_indicators, resource_values = get_indicator_values(lca_data[i], addtl_indicators)
        indicators.append(resource_indicators)
        values.append(resource_values)
    return lca_data, indicators, values
    
def get_lca_data(json_data, resource_name, addtl_indicators):
    resource_data = copy.deepcopy(
        find_obj_in_array(
            json_data["Resources"],
            "Name",
            resource_name
        )
    )
    
    if not resource_data:
        raise Exception(
            "Resource with name {resource_name} was not found in database."
            .format(resource_name = resource_name)
       )
    try:
        lca_data = extract_lca_data(resource_data, addtl_indicators)
    except KeyError:
        raise Exception("Format of JSON data is not supported.")
    return lca_data

def extract_lca_data(resource_data, addtl_indicators):
    lca_data = OrderedDict()
    resource_name = resource_data["Name"]
    
    lca_data["Name"] = resource_name
    
    if "Conversions" in resource_data:
        # can a resource have multiple conversions?
        lca_data["ConversionUnit"] = resource_data["Conversions"][0]["Unit"]
        lca_data["ConversionValue"] = resource_data["Conversions"][0]["Value"]
    
    if "InventoryUnit" in resource_data:
        lca_data["InventoryUnit"] = resource_data["InventoryUnit"]
    
    for data_prop in resource_data["DataItems"]:
        if data_prop["PropertyName"] == gwp_data_string:
            gwp_data = copy.deepcopy(data_prop)
            break
            
    if not gwp_data:
        raise Exception("GWP data not found for {resource_name}"
            .format(resource_name = resource_name))
    
    lca_data["GWPUnit"] = gwp_data["PropertyUnitCode"]
    for key in gwp_data_entries:
        value = find_obj_in_array(
            gwp_data["DataValueItems"],
            "DataModuleCode",
            gwp_data_entries[key]
        )
        if value is not None:
            lca_data[key] = value["Value"]
            
    for addtl_indicator in addtl_indicators:
        if addtl_indicator in resource_data:
            lca_data[addtl_indicator] = resource_data[addtl_indicator]
    
    return lca_data

def find_obj_in_array(array, key, value):
    return next((x for x in array if x[key] == value), None)

def get_indicator_values(lca_data, addtl_indicators):
    indicator_dict = OrderedDict([
        ("Name", "Name"),
        ("InventoryUnit", "Inventory unit"),
        ("ConversionUnit", "Conversion unit"),
        ("ConversionValue", "Conversion value"),
        ("GWPUnit", "GWP unit"),
        ("GWPA1A3Conservative", "GWP (A1-A3 Conservative)"),
        ("GWPA1A3Typical", "GWP (A1-A3 Typical)"),
        ("GWPA4", "GWP (A4)"),
        ("GWPA5.1", "GWP (A5.1)"),
    ])
    
    for addtl_indicator in addtl_indicators:
        indicator_dict[addtl_indicator] = addtl_indicator
    
    indicators, values = [], []
    
    for key, indicator_name in indicator_dict.items():
        indicator_value = lca_data[key] if key in lca_data else None
        if indicator_value:
            indicators.append(indicator_name)
            values.append(indicator_value)
    
    return indicators, values

if __name__ == "__main__":
    if not scriptcontext.sticky["brimstone_flying"]:
        raise Exception("The 'Brimstone - Fly' component needs to exist on the canvas")
    lca_data, indicators, values = main(json_data, resources, addtl_indicators)
    
    lca_data_treeable = []
    
    for resource_lca_data in lca_data:
        lca_data_treeable.append([resource_lca_data.keys(), resource_lca_data.values()])
    lca_data = th.list_to_tree(lca_data_treeable)
    indicators = th.list_to_tree(indicators)
    values = th.list_to_tree(values)
    json_data = [json_data]
# ---------- end get_lca_data ----------
energy_use_intensity_kwh_m2 = Data()
panel_133 = Panel("kg CO2eq")

# ---- group: Glare analysis
epw_file_url_3 = Data(data_26)
viewport_name = Data(txt_3)
pt_19 = ConstructPoint(XCoordinate=Slider(6, range=0..10), YCoordinate=Slider(5, range=0..10), ZCoordinate=Slider(2, range=0..10))
viewport = HBViewFromViewport(name=viewport_name, viewport=viewport_name, view_type=Slider(4, range=0..5))  # -> view; plug-in component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
pt_20 = ConstructPoint(XCoordinate=Slider(4, range=0..10), YCoordinate=Slider(4, range=0..10), ZCoordinate=Slider(1.6, range=0..10))
vec2pt = Vector2Pt(PointA=pt_20, PointB=pt_19, Unitize=False)  # -> Vector, Length
view = HBView(position=pt_20, direction=vec2pt.Vector, view_type=Slider(4, range=0..5))  # -> view; plug-in component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
hoy = LBCalculateHOY(month=month, day=day, hour=hour)  # -> flatten(hoy), flatten(doy), flatten(date); plug-in component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

# ----
downloadepw_4 = LBDownloadWeather(weather_URL=epw_file_url_3)  # -> epw_file, stat_file, ddy_file; plug-in component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

# ---- group: Glare analysis (continued)
importloc = LBImportLocation(epw_file=downloadepw_4.epw_file)  # -> location; plug-in component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
ciesky = HBCIEStandardSky(location=importloc, month=month, day=day, hour=hour, type=0)  # -> sky; plug-in component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

# ---- group: Simulate
run_energy_simulation = Boolean(run_detailed_energy_simulations_2)

# ----
lca_gwp_by_element_type_3 = RemoteReceiver(lca_gwp_by_element_type)
lca_element_types_3 = RemoteReceiver(lca_element_types)
lca_total_gwp_4 = RemoteReceiver(lca_total_gwp)

# ----
# Calculate operational emissions
list_12 = ValueList({"Conservative": "conservative", "Typical": "typical"}, selected="Conservative")
panel_136 = Panel("kg CO2eq/year")

# ---- group: Load previous model
falsestart = LBFalseStartToggle(False)

# ---- group: Peak loads
toggle_8 = BooleanToggle(True)
toggle_9 = BooleanToggle(True)

# ---- group: Analyse performance / Simple energy balance
colrange_5 = LBColorRange(index=Slider(19, range=0..100))  # -> colors; plug-in component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

# ---- group: Daylight Factor
# Daylight Factor [%]
number_slider_49 = Slider(0, range=0..2)
falsestart_2 = LBFalseStartToggle(False)
radpar = HBRadianceParameter(recipe_type=number_slider_49, detail_level=detail_level_0_2)  # -> rad_par; plug-in component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
run_daylight_factor = Data(falsestart_2)
cluster_6 = Cluster_6()

# ---- group: Analyse performance / Simple peak loads
toggle_10 = BooleanToggle(True)
toggle_11 = BooleanToggle(True)
toggle_12 = BooleanToggle(True)
toggle_13 = BooleanToggle(True)

# ---- group: Energy balance
colrange_6 = LBColorRange(index=Slider(19, range=0..100))  # -> colors; plug-in component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
neg_3 = Negative(Value=number_slider_44)
legendpar = LBLegendParameters(min=neg_3, max=number_slider_44, colors=colrange_6)  # -> leg_par; plug-in component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

# ---- group: Spatial climate based daylight
panel_137 = Panel("-t 50 -lt 200 -ut 2000")
radpar_2 = HBRadianceParameter(recipe_type=Slider(2, range=0..2), detail_level=detail_level_0_2, additional_par="-ab 4")  # -> rad_par; plug-in component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
wea = HBWeaFromEPW(epw_file=downloadepw_3.epw_file)  # -> wea; plug-in component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
panel_138 = Panel(radpar_2)
cluster_7 = Cluster_6()
cluster_8 = Cluster_6()
cluster_9 = Cluster_6()
X_2 = UnitX(Factor=Slider(150, range=0..400))
X_3 = UnitX(Factor=Slider(100, range=0..400))
X_4 = UnitX(Factor=Slider(50, range=0..400))

# ---- group: Simulate illuminance
importloc_2 = LBImportLocation(epw_file=downloadepw_3.epw_file)  # -> location; plug-in component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
day_illuminance = Number(Slider(21, range=1..31))
hour_illuminance = Number(number_slider_47)
month_illuminance = Number(Slider(6, range=1..12))
radpar_3 = HBRadianceParameter(recipe_type=Slider(0, range=0..2), detail_level=detail_level_0_2_2)  # -> rad_par; plug-in component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
ciesky_2 = HBCIEStandardSky(location=importloc_2, month=month_illuminance, day=day_illuminance, hour=hour_illuminance, type=0)  # -> sky; plug-in component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
legendpar_2 = LBLegendParameters(max=Slider(2000, range=0..10000))  # -> leg_par; plug-in component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

# ----
calculate_glare_probability_3 = RemoteReceiver(calculate_glare_probability)

simple_energy_simulation_type_2 = RemoteReceiver(simple_energy_simulation_type)
current_tab_28 = RemoteReceiver(current_tab)
expression_67 = Expression(x="Analysis module", y=current_tab_28, Expression="x=y")

# ---- group: Extract hourly data from annual results
number_slider_50 = Slider(0.1, range=0..0.1)
legendpar_3 = LBLegendParameters(max=Slider(3000, range=0..3000))  # -> leg_par; plug-in component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
multiplication_4 = Multiplication(A=number_slider_50, B=4)
pt_21 = Point(Point(0, 35, 0))

# ----
run_detailed_energy_simulations_3 = RemoteReceiver(run_detailed_energy_simulations)
detailed_energy_simulation_type_2 = RemoteReceiver(detailed_energy_simulation_type)
current_tab_29 = RemoteReceiver(current_tab)
expression_68 = Expression(x="Analysis module", y=current_tab_29, Expression="x=y")

run_daylight_simulations_3 = RemoteReceiver(run_daylight_simulations)
daylight_simulation_type_3 = RemoteReceiver(daylight_simulation_type)

all_constructions_database = RemoteReceiver(all_constructions_database_2)
decnstrconstr_2 = HBDeconstructConstruction(constr=all_constructions_database)  # -> name, materials, layers, r_val_si, r_val_ip, u_fac_si, u_fac_ip, shgc, t_sol, t_vis; plug-in component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
decnstrmat_3 = HBDeconstructMaterial(mat=decnstrconstr_2.materials)  # -> values, attr_names, r_val_si, r_val_ip; plug-in component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
expression_69 = Expression(x=decnstrconstr_2.u_fac_si, Expression="Round(x, 3)")
item_26 = ListItem(List=decnstrmat_3.values, Index=0, Wrap=True)  # -> Item, Item1
shiftm = ShiftMatch(GuideTree=decnstrconstr_2.materials, SecondaryData1=item_26.Item, SecondaryData2=item_26.Item1, shiftFromStart=False)  # -> GuideTree, SecondaryData1, SecondaryData2
format_7 = Format(Format=panel_19, Culture=127, Data0=decnstrconstr_2.name, Data1=expression_69)
null_23 = NullItem(Item=all_constructions_database)  # -> NullFlags, InvalidFlags, Description
format_8 = Format(Format="{0}, {1}m", Culture=127, Data0=shiftm.SecondaryData1, Data1=shiftm.SecondaryData2)
item_27 = ListItem(List=null_23.NullFlags, Index=0, Wrap=True)
tstat = TreeStatistics(Tree=format_8)  # -> Paths, Length, Count
tstat_2 = TreeStatistics(Tree=format_8)  # -> Paths, Length, Count
gate_40 = StreamGate(Stream=format_7, Gate=item_27)  # -> Target0, Target1
repeat_18 = RepeatData(Data="[Innermost]", Length=tstat_2.Count)
repeat_19 = RepeatData(Data="[Outermost]", Length=tstat.Count)
concat_5 = Concatenate(FragmentA="- ", FragmentB=format_8)
entwine_135 = Entwine(Branch00="Generic", Branch01=all_constructions_database, FlattenInputs=True)  # -> flatten(Result)
entwine_136 = Entwine(Branch00="Generic", Branch01=gate_40.Target0, FlattenInputs=True)  # -> flatten(Result)
clone = CloneStructure(List=repeat_18, Structure=tstat_2.Paths)
clone_2 = CloneStructure(List=repeat_19, Structure=tstat.Paths)
merge_15 = Merge(Data1=clone_2, Data2=concat_5, Data3=clone)
filter_35 = StreamFilter(Gate=item_27, Stream0=entwine_135, Stream1="Generic")
filter_36 = StreamFilter(Gate=item_27, Stream0=entwine_136, Stream1="Generic")
gate_41 = StreamGate(Stream=merge_15, Gate=item_27)  # -> Target0, Target1
custom_constructions = RemoteSender(gate_40.Target0)
custom_constructions_info = RemoteSender(gate_41.Target0)
all_constructions = RemoteSender(filter_35)

entwine_137 = Entwine(Branch00="Generic", Branch01=decnstrconstr_2.name, FlattenInputs=True)  # -> flatten(Result)
filter_37 = StreamFilter(Gate=item_27, Stream0=entwine_137, Stream1="Generic")
all_construction_display_names = RemoteSender(filter_36)

all_construction_display_names_2 = RemoteReceiver(all_construction_display_names)
setlist_5 = SetListContents(ListToModify=pulldown_13, NewListContents=all_construction_display_names_2, SelectedIndex="0")

setlist_6 = SetListContents(ListToModify=pulldown_17, NewListContents=all_construction_display_names_2, SelectedIndex="0")
setlist_7 = SetListContents(ListToModify=pulldown_15, NewListContents=all_construction_display_names_2, SelectedIndex="0")
setlist_8 = SetListContents(ListToModify=pulldown_14, NewListContents=all_construction_display_names_2, SelectedIndex="0")
setlist_9 = SetListContents(ListToModify=pulldown_16, NewListContents=all_construction_display_names_2, SelectedIndex="0")
setlist_10 = SetListContents(ListToModify=pulldown_18, NewListContents=all_construction_display_names_2, SelectedIndex="0")

all_constructions_2 = RemoteReceiver(all_constructions)
all_constructions_3 = RemoteReceiver(all_constructions)
all_constructions_4 = RemoteReceiver(all_constructions)
item_28 = ListItem(List=all_constructions_2, Index=subset_exterior_floor_2, Wrap=True)
item_29 = ListItem(List=all_constructions_3, Index=subset_exterior_wall_2, Wrap=True)
item_30 = ListItem(List=all_constructions_4, Index=subset_exterior_roof_2, Wrap=True)
expression_70 = Expression(x="Generic", y=item_28, Expression="x=y")
expression_71 = Expression(x="Generic", y=item_29, Expression="x=y")
expression_72 = Expression(x="Generic", y=item_30, Expression="x=y")
filter_38 = StreamFilter(Gate=expression_70, Stream0=item_28, Stream1=null_8)
filter_39 = StreamFilter(Gate=expression_71, Stream0=item_29, Stream1=null_9)
filter_40 = StreamFilter(Gate=expression_72, Stream0=item_30, Stream1=null_10)
exteriorsubset_2 = HBExteriorConstructionSubset(exterior_wall=filter_39, exterior_roof=filter_40, exposed_floor=filter_38)  # -> exterior_set; plug-in component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

all_constructions_5 = RemoteReceiver(all_constructions)
all_constructions_6 = RemoteReceiver(all_constructions)
item_31 = ListItem(List=all_constructions_5, Index=subset_interior_wall_2, Wrap=True)
item_32 = ListItem(List=all_constructions_6, Index=subset_interior_floor_2, Wrap=True)
expression_73 = Expression(x="Generic", y=item_31, Expression="x=y")
expression_74 = Expression(x="Generic", y=item_32, Expression="x=y")
filter_41 = StreamFilter(Gate=expression_73, Stream0=item_31, Stream1=null_11)
filter_42 = StreamFilter(Gate=expression_74, Stream0=item_32, Stream1=null_12)
interiorsubset_2 = HBInteriorConstructionSubset(interior_wall=filter_41, interior_floor=filter_42)  # -> interior_set; plug-in component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

all_constructions_7 = RemoteReceiver(all_constructions)
item_33 = ListItem(List=all_constructions_7, Index=subset_ground_floor_2, Wrap=True)
expression_75 = Expression(x="Generic", y=item_33, Expression="x=y")
filter_43 = StreamFilter(Gate=expression_75, Stream0=item_33, Stream1=null_13)
groundsubset_2 = HBGroundConstructionSubset(ground_floor=filter_43)  # -> ground_set; plug-in component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

custom_constructions_info_2 = RemoteReceiver(custom_constructions_info)
join_13 = TextJoin(Text=custom_constructions_info_2)  # -> flatten(Result)
lng_27 = ListLength(List=join_13)
py3_35 = Python3Script(current_windows=lng_27, maximum_windows=number_slider_34)  # -> status; inputs current_windows: Int32, maximum_windows: Int32; same code as py3_32
settextblock_6 = SetTextBlockContents(TextBlockToModify=tb_9, NewTextBlockContents=join_13)
custom_constructions_2 = RemoteReceiver(custom_constructions)
setexp = SetExpander(Expander=expander_3, Name=custom_constructions_2)
hideshow_29 = HideShowElement(ElementToHideShow=simplify(merge_9), Show=simplify(graft(py3_35)), Collapse=True, Disable=False)

constructionset_2 = HBConstructionSet(
    name="My construction",
    base_constr_set=panel_37,
    exterior_subset=exteriorsubset_2,
    ground_subset=groundsubset_2,
    interior_subset=interiorsubset_2,
    subface_subset=subfacesubset_2)  # -> constr_set; plug-in component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

# ---- group: Building occupancy and systems (continued)
add_dynamic_shades = AddDynamicShades(base_construction_set=constructionset_2, setpoint=number_slider_37)

# ----
decnstrconstrset_2 = HBDeconstructConstructionSet(constr_set=constructionset_2)  # -> exterior_wall, exterior_roof, exposed_floor, ground_wall, ground_roof, ground_floor, window, skylight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; plug-in component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
panel_139 = Panel(decnstrconstrset_2.exterior_wall)

all_construction_names = RemoteSender(filter_37)

all_construction_names_2 = RemoteReceiver(all_construction_names)

# ---- group: Prepare for analysis (continued)
data_28 = Data(add_dynamic_shades)
entwine_138 = Entwine(
    Branch00=room,
    Branch01=adjacent,
    Branch02=context,
    Branch03=windows,
    Branch04=data_17,
    Branch05=data_28,
    Branch06=model_name_3,
    Branch07=generate_wwr_2,
    Branch08=wall_thickness_2,
    Branch09=roof_thickness_2,
    FlattenInputs=True)
freeze_gate_58 = StreamFreezeGate(Data=entwine_138, PassingSwitch=create_model_8, Hold=True)
bang_15 = ExplodeTree(Data=freeze_gate_58)  # -> Branch0, Branch1, Branch2, Branch3, Branch4, Branch5, Branch6, Branch7, Branch8, Branch9
hasdata_8 = DataExists(Data=bang_15.Branch0)
model_rooms_exists = RemoteSender(hasdata_8)

# ----
construction = Data(bang_15.Branch5)
program_2 = Data(bang_15.Branch4)
model_name_4 = Data(bang_15.Branch6)
roof_thickness_3 = Data(bang_15.Branch9)
wall_thickness_3 = Data(bang_15.Branch8)
wwr = Data(bang_15.Branch7)

# ---- group: Prepare for analysis (continued)
window_to_wall_ratio = Number(wwr)
wall_thickness_4 = Number(wall_thickness_3)
context_geometry = Geometry(bang_15.Branch2)
windows_2 = Geometry(bang_15.Branch3)
adjacent_geometry = Geometry(bang_15.Branch1)
room_geometry = Geometry(bang_15.Branch0)
model_name_5 = Text(model_name_4)

python_3 = GhPythonScript(in_list=program_2)  # -> out_list; inputs in_list: list
# ---------- python_3: Python ----------
"""Converts lists of HB objects to dicts for use with Py3.
    Inputs:
        in_list: List of HB objects
    Output:
        out_list: List of Python dictionaries representing HB objects"""

__author__ = "sawen"
__version__ = "2024.07.09"

out_list = list([x.to_dict() for x in in_list])
# ---------- end python_3 ----------
python_4 = GhPythonScript(in_list=construction)  # -> out_list; inputs in_list: list; same code as python_3
py3_36 = Python3Script(
    window_wall_ratio=window_to_wall_ratio,
    window_height=window_height,
    sill_height=sill_height,
    horizontal_separation=horizontal_separation,
    wall_thickness=wall_thickness_4)  # -> out, window_settings
# ---------- py3_36: Python ----------
from heath import WindowSettings

"""Create Window Settings"""
window_settings = WindowSettings(window_wall_ratio, window_height, sill_height, horizontal_separation, wall_thickness)
# ---------- end py3_36 ----------

# ----
py3_37 = Python3Script(
    model_name=model_name_5,
    room_geo=room_geometry,
    construction_sets=python_4,
    programs=python_3,
    energy_systems=energy_system_name,
    adjacent_surfaces=adjacent_geometry,
    window_geo=windows_2,
    window_settings=py3_36.window_settings,
    louver_settings=py3_25.louver_settings,
    context_geo=context_geometry,
    jsonify=toggle_2)  # -> out, hb_model; inputs room_geo: list of Brep, construction_sets: list, programs: list, energy_systems: list, adjacent_surfaces: list of Brep, window_geo: list of Surface, context_geo: list of GeometryBase
# ---------- py3_37: Python ----------
# Copyright (c) 2024, Heath.
# You should have received a copy of the GNU Affero General Public License
# along with Heath; If not, see <http://www.gnu.org/licenses/>.
# 
# @license AGPL-3.0-or-later <https://spdx.org/licenses/AGPL-3.0-or-later>

"""Grasshopper Script"""
        
from heath import create_hb_model, heath_globals, utils

import Rhino.Geometry as rg
import IronPython
import importlib
import honeybee_energy

from honeybee.room import Room
cs = honeybee_energy.constructionset.ConstructionSet
pt = honeybee_energy.programtype.ProgramType 

import scriptcontext

def dictify(d):
    for key in d:
        if type(d[key]) == IronPython.Runtime.PythonDictionary:
            d[key] = dict(d[key])
            dictify(d[key])

if __name__ == "__main__":
    if not scriptcontext.sticky["heath_flying"]:
        raise Exception("Heath - fly component must exist on the canvas")
    ghenv.Component.Message = heath_globals.version

    # SUPER HACK because Py3 does not retain the Honeybee types
    # https://discourse.ladybug.tools/t/ladybug-honeybee-datatypes-are-converted-when-input-to-py3-component/28216
    construction_sets = [cs.from_dict(c) for c in construction_sets]
    p = programs[0]
    programs_patched = []
    for p in programs:
        # hack to fix py2-py3 conversion of dicts
        dictify(p)
        p = pt.from_dict(p)
        programs_patched.append(p)

    hb_model = create_hb_model(ghenv, list(room_geo), construction_sets, programs_patched, adjacent_surfaces, energy_systems, window_geo, window_settings, louver_settings, context_geo, model_name)

    if jsonify:
        hb_model = utils.jsonify(hb_model.to_dict())
# ---------- end py3_37 ----------
strtoobj_3 = HBStringToObject(hb_str=py3_37.hb_model)  # -> hb_obj; plug-in component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
filter_44 = StreamFilter(Gate=toggle_2, Stream0=py3_37.hb_model, Stream1=strtoobj_3)

# ---- group: Prepare for analysis (continued)
filter_45 = StreamFilter(Gate=create_model_8, Stream1=filter_44)
vizbytype = HBVisualizeByType(hb_objs=filter_44)  # -> walls, interior_walls, roofs, ceilings, exterior_floors, interior_floors, air_walls, apertures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; plug-in component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
hasdata_9 = DataExists(Data=filter_44)
hasdata_10 = DataExists(Data=filter_45)
honeybee_model_possible = RemoteSender(hasdata_9)
freeze_gate_59 = StreamFreezeGate(Data=filter_45, PassingSwitch=hasdata_10, Hold=True)
panel_140 = Panel(vizbytype.apertures)
data_29 = Data(vizbytype.outdoor_shades)
vizbytype_2 = HBVisualizeByType(hb_objs=freeze_gate_59)  # -> walls, interior_walls, roofs, ceilings, exterior_floors, interior_floors, air_walls, apertures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; plug-in component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
vizbybc = HBVisualizeByBC(hb_objs=freeze_gate_59)  # -> outdoors, surface, ground, adiabatic, other, wire_frame; disabled; plug-in component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
deconstructmodel = HBDeconstructModel(model=freeze_gate_59)  # -> rooms, faces, apertures, doors, shades; plug-in component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
hasdata_11 = DataExists(Data=freeze_gate_59)
honeybee_model_ready = RemoteSender(hasdata_11)
panel_141 = Panel(freeze_gate_59)
panel_142 = Panel(hasdata_11)
geoprop = HBGeometryProperties(rooms=deconstructmodel.rooms)  # -> ext_wall_area, ext_win_area, volume, floor_area, floor_ep_constr; plug-in component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
null_24 = NullItem(Item=[vizbytype_2.walls, vizbytype_2.interior_walls, vizbytype_2.roofs, vizbytype_2.ceilings, vizbytype_2.exterior_floors, vizbytype_2.interior_floors, vizbytype_2.air_walls, vizbytype_2.apertures, vizbytype_2.interior_apertures, vizbytype_2.doors, vizbytype_2.interior_doors, vizbytype_2.outdoor_shades, vizbytype_2.indoor_shades])  # -> NullFlags, InvalidFlags, Description
cull_15 = CullPattern(List=null_24.NullFlags, CullPattern=invert(null_24.NullFlags))
panel_143 = Panel(geoprop.floor_area)
gate_42 = StreamGate(Stream=[vizbytype_2.indoor_shades, vizbytype_2.outdoor_shades], Gate=show_honeybee_context_3)  # -> Target0, Target1
gate_43 = StreamGate(Stream=[vizbytype_2.apertures, vizbytype_2.interior_apertures], Gate=show_honeybee_windows_3)  # -> Target0, Target1
gate_44 = StreamGate(Stream=[vizbytype_2.doors, vizbytype_2.interior_doors], Gate=show_honeybee_doors_3)  # -> Target0, Target1
gate_45 = StreamGate(Stream=vizbytype_2.roofs, Gate=show_honeybee_roof_3)  # -> Target0, Target1
gate_46 = StreamGate(Stream=vizbytype_2.interior_floors, Gate=show_honeybee_floors_3)  # -> Target0, Target1
gate_47 = StreamGate(Stream=vizbytype_2.exterior_floors, Gate=show_honeybee_ground_3)  # -> Target0, Target1
gate_48 = StreamGate(Stream=[vizbytype_2.walls, vizbytype_2.interior_walls, vizbytype_2.air_walls], Gate=show_honeybee_walls_3)  # -> Target0, Target1
lng_28 = ListLength(List=cull_15)
honeybee_model_exists = RemoteSender(lng_28)
data_30 = Data(gate_44.Target1)
data_31 = Data(gate_45.Target1)
data_32 = Data(gate_43.Target1)
data_33 = Data(gate_42.Target1)
data_34 = Data(gate_48.Target1)
data_35 = Data(gate_46.Target1)
data_36 = Data(gate_47.Target1)

# ----
honeybee_model_exists_2 = RemoteReceiver(honeybee_model_exists)
and_35 = GateAnd(A=honeybee_model_exists_2, B=freeze_gate_10)
filter_46 = StreamFilter(Gate=and_35, Stream0="Create model", Stream1="Update model")
setbtn = SetButton(ButtonToModify=button_15, ButtonName=filter_46)
honeybee_model_exists_3 = RemoteReceiver(honeybee_model_exists)
honeybee_model_possible_2 = RemoteReceiver(honeybee_model_possible)
hideshow_30 = HideShowElement(ElementToHideShow=button_16, Show=True, Collapse=True, Disable=invert(honeybee_model_exists_3))
bool_49 = Boolean(honeybee_model_possible_2)
honeybee_model_exists_4 = RemoteReceiver(honeybee_model_exists)
filter_47 = StreamFilter(Gate=bool_49, Stream0=Slider(500, range=0..1000), Stream1=Slider(1000000, range=0..1000000))
filter_48 = StreamFilter(Gate=bool_49, Stream0="Import geometry before creating the model", Stream1=" ")
hideshow_31 = HideShowElement(ElementToHideShow=border_4, Show=honeybee_model_exists_4, Collapse=invert(True), Disable=False)
tooltip_11 = AttachTooltipToElement(ElementsToAttachTo=button_15, TooltipContent=filter_48, ShowDelay=filter_47, Duration=2000)

entwine_139 = Entwine(
    Branch00=data_34,
    Branch01=data_31,
    Branch02=data_35,
    Branch03=data_36,
    Branch04=data_32,
    Branch05=data_30,
    Branch06=data_33,
    FlattenInputs=True)
clean_7 = CleanTree(RemoveNulls=True, RemoveInvalid=True, RemoveEmpty=False, Tree=entwine_139)
lng_29 = ListLength(List=clean_7)
repeat_20 = RepeatData(Data=ef_att_4.Attributes, Length=lng_29)
bake_3 = BakeObjects(Geometry=clean_7, Attributes=repeat_20, Bake=bake_model_2, createGroups=False, preset="Moderate")  # -> Message, Ghosts

# ---- group: Analyse context and model (continued)
data_37 = Data(freeze_gate_59)
visualise_properties = VisualiseProperties(
    honeybee_model=data_37,
    room_attribute=filter_33,
    number_of_decimals_room=Slider(4, range=0..10),
    face_attribute=filter_32,
    number_of_decimals_face=Slider(4, range=0..10))  # -> visualised_room_attributes_2, visualised_face_attributes_2
gate_49 = StreamGate(Stream=visualise_properties.visualised_room_attributes_2, Gate=or_25)  # -> Target0, Target1
gate_50 = StreamGate(Stream=visualise_properties.visualised_face_attributes_2, Gate=or_26)  # -> Target0, Target1
data_38 = Data(gate_49.Target1)
data_39 = Data(gate_50.Target1)

# ----
epw_file_url_4 = Data(freeze_gate_59)

# ---- group: Glare analysis (continued)
assigngridsviews = HBAssignGridsAndViews(model=epw_file_url_4, views=flatten(viewport))  # -> model; plug-in component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
pitview = HBPointInTimeViewBased(model=assigngridsviews, sky=ciesky, run=run_glare_analysis)  # -> report, results; plug-in component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
glare = HBGlarePostprocess(hdr=pitview.results)  # -> DGP, category, glare_indices, check_hdr; plug-in component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
merge_16 = Merge(Data1=hoy.date, Data2=glare.category, Data3=glare.DGP)
daylight_glare_probability_dgp = Data(glare.DGP)
join_14 = TextJoin(Text=merge_16)
falsecolor = HBFalseColor(hdr=pitview.results, max=Slider(2300, range=0..10000), contour_lines=Toggle(True))  # -> hdr; plug-in component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
adjusthdr = HBAdjustHDR(hdr=pitview.results, adj_expos=Toggle(True), label=join_14)  # -> hdr; plug-in component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
hdr_false_color_image = Data(falsecolor)
hdr_image = Data(adjusthdr)

# ----
honeybee_model_ready_2 = RemoteReceiver(honeybee_model_ready)
# Simple energy simulation
honeybee_model_ready_3 = RemoteReceiver(honeybee_model_ready)
honeybee_model_ready_4 = RemoteReceiver(honeybee_model_ready)
honeybee_model_ready_5 = RemoteReceiver(honeybee_model_ready)
honeybee_model_ready_6 = RemoteReceiver(honeybee_model_ready)
honeybee_model_ready_7 = RemoteReceiver(honeybee_model_ready)
honeybee_model_ready_8 = RemoteReceiver(honeybee_model_ready)
filter_49 = StreamFilter(Gate=honeybee_model_ready_2, Stream0=Slider(500, range=0..1000), Stream1=Slider(1000000, range=0..1000000))
filter_50 = StreamFilter(Gate=honeybee_model_ready_2, Stream0="Create a model before running the simulation", Stream1=" ")
honeybee_model_ready_9 = RemoteReceiver(honeybee_model_ready)
filter_51 = StreamFilter(Gate=honeybee_model_ready_3, Stream0=Slider(500, range=0..1000), Stream1=Slider(1000000, range=0..1000000))
filter_52 = StreamFilter(Gate=honeybee_model_ready_3, Stream0="Create a model before running the simulation", Stream1=" ")
filter_53 = StreamFilter(Gate=honeybee_model_ready_4, Stream0=Slider(500, range=0..1000), Stream1=Slider(1000000, range=0..1000000))
filter_54 = StreamFilter(Gate=honeybee_model_ready_4, Stream0="Create a model before running the simulation", Stream1=" ")
filter_55 = StreamFilter(Gate=honeybee_model_ready_5, Stream0=Slider(500, range=0..1000), Stream1=Slider(1000000, range=0..1000000))
filter_56 = StreamFilter(Gate=honeybee_model_ready_5, Stream0="Create a model before running the simulation", Stream1=" ")
hideshow_32 = HideShowElement(ElementToHideShow=button_18, Show=True, Collapse=True, Disable=invert(honeybee_model_ready_6))
tooltip_12 = AttachTooltipToElement(ElementsToAttachTo=button_18, TooltipContent=filter_50, ShowDelay=filter_49, Duration=2000)
hideshow_33 = HideShowElement(ElementToHideShow=button_20, Show=True, Collapse=True, Disable=invert(honeybee_model_ready_7))
tooltip_13 = AttachTooltipToElement(ElementsToAttachTo=button_20, TooltipContent=filter_52, ShowDelay=filter_51, Duration=2000)
hideshow_34 = HideShowElement(ElementToHideShow=button_21, Show=True, Collapse=True, Disable=invert(honeybee_model_ready_8))
tooltip_14 = AttachTooltipToElement(ElementsToAttachTo=button_21, TooltipContent=filter_54, ShowDelay=filter_53, Duration=2000)
hideshow_35 = HideShowElement(ElementToHideShow=button_23, Show=True, Collapse=True, Disable=invert(honeybee_model_ready_9))
tooltip_15 = AttachTooltipToElement(ElementsToAttachTo=button_23, TooltipContent=filter_56, ShowDelay=filter_55, Duration=2000)

expression_76 = Expression(x=all_construction_names_2, y=create_construction_name_2, Expression="x=y")
cull_16 = CullPattern(List=expression_76, CullPattern=expression_76)
gate_51 = StreamGate(Stream="Material already exists", Gate=cull_16)  # -> Target0, Target1

data_40 = Data(freeze_gate_59)
honeybee_model = Data(data_40)
data_41 = Data(honeybee_model)

# ---- group: Simulate (continued)
modeltoosm = HBModelToOSM(
    model=honeybee_model,
    epw_file=downloadepw.epw_file,
    sim_par=simpar,
    write=run_energy_simulation,
    run=run_energy_simulation)  # -> report, jsons, osw, osm, idf, sql, zsz, rdd, html; plug-in component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
eui = HBEndUseIntensity(sql=modeltoosm.sql)  # -> eui, eui_end_use, end_uses, gross_floor; plug-in component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
panel_144 = Panel(eui.eui)
panel_145 = Panel(eui.end_uses)
panel_146 = Panel(eui.eui_end_use)

# ---- group: Peak loads (continued)
readhvac = HBReadHVACSizing(sql=modeltoosm.sql)  # -> zone_names, zone_peak_cool, zone_peak_heat, comp_types, comp_properties, comp_values; plug-in component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
readzsz = HBReadZoneSizing(zsz=modeltoosm.zsz)  # -> cooling_load, heating_load; plug-in component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
panel_147 = Panel([readhvac.zone_peak_heat, readhvac.zone_peak_cool])
monthlychart = LBMonthlyChart(data=readzsz.heating_load, x_dim=Slider(40, range=0..100), stack=toggle_8, time_marks=toggle_8)  # -> report, data_mesh, data_lines, col_lines, legend, borders, labels, y_title, title, vis_set; plug-in component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
monthlychart_2 = LBMonthlyChart(data=readzsz.cooling_load, x_dim=Slider(40, range=0..100), stack=toggle_9, time_marks=toggle_9)  # -> report, data_mesh, data_lines, col_lines, legend, borders, labels, y_title, title, vis_set; plug-in component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
heating_load_profile = Data(flatten([monthlychart.data_mesh, monthlychart.data_lines, monthlychart.col_lines, monthlychart.legend, monthlychart.borders, monthlychart.labels, monthlychart.y_title, monthlychart.title]))
cooling_load_profile = Data(flatten([monthlychart_2.data_mesh, monthlychart_2.data_lines, monthlychart_2.col_lines, monthlychart_2.legend, monthlychart_2.borders, monthlychart_2.labels, monthlychart_2.y_title, monthlychart_2.title]))
peak_cooling = Data(readhvac.zone_peak_cool)
zone_names = Data(readhvac.zone_names)
peak_heating = Data(readhvac.zone_peak_heat)

# ---- group: Load previous model (continued)
item_34 = ListItem(List=modeltoosm.jsons, Index=0, Wrap=True)
loadobjects_2 = HBLoadObjects(hb_file=item_34, load=falsestart)  # -> report, hb_objs; plug-in component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

# ---- group: extract and visualise data
roomenergyresult = HBReadRoomEnergyResult(sql=modeltoosm.sql)  # -> cooling, heating, lighting, electric_equip, gas_equip, process, hot_water, fan_electric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; plug-in component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
merge_17 = Merge(
    Data1=roomenergyresult.heating,
    Data2=roomenergyresult.cooling,
    Data3=roomenergyresult.lighting,
    Data4=roomenergyresult.electric_equip,
    Data5=roomenergyresult.hot_water,
    Data6=roomenergyresult.people_gain,
    Data7=roomenergyresult.solar_gain)
hourlyplot = LBHourlyPlot(data=merge_17)  # -> report, mesh, legend, borders, labels, title, vis_set; plug-in component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
xdata = LBDeconstructData(data=roomenergyresult.cooling)  # -> header, values; plug-in component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

# ---- group: Energy balance (continued)
faceresult = HBReadFaceResult(sql=modeltoosm.sql)  # -> face_indoor_temp, face_outdoor_temp, face_energy_flow; plug-in component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
loadbalance = HBThermalLoadBalance(
    rooms_model=flatten(data_41),
    cooling=roomenergyresult.cooling,
    heating=roomenergyresult.heating,
    lighting=roomenergyresult.lighting,
    electric_equip=roomenergyresult.electric_equip,
    hot_water=roomenergyresult.hot_water,
    people_gain=roomenergyresult.people_gain,
    solar_gain=roomenergyresult.solar_gain,
    infiltration_load=roomenergyresult.infiltration_load,
    mech_vent_load=roomenergyresult.mech_vent_load,
    face_energy_flow=faceresult.face_energy_flow)  # -> report, balance, balance_stor, norm_bal, norm_bal_stor; plug-in component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
timeop = LBTimeIntervalOperation(data=loadbalance.norm_bal_stor)  # -> daily, monthly, mon_per_hr; plug-in component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
monthlychart_3 = LBMonthlyChart(data=timeop.monthly, stack=Toggle(True), legend_par=legendpar)  # -> report, data_mesh, data_lines, col_lines, legend, borders, labels, y_title, title, vis_set; plug-in component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

# ----
energy_use_intensity = Data(eui.eui)
energy_use_intensity_per_end_use = Data(eui.eui_end_use)
end_uses = Data(eui.end_uses)
monthly_energy_balance = Data(flatten([monthlychart_3.data_mesh, monthlychart_3.data_lines, monthlychart_3.col_lines, monthlychart_3.legend, monthlychart_3.borders, monthlychart_3.labels, monthlychart_3.y_title, monthlychart_3.title]))
annual_hourly_energy_results = Data(flatten([hourlyplot.mesh, hourlyplot.legend, hourlyplot.borders, hourlyplot.labels, hourlyplot.title]))
cooling_load_profile_2 = Data(cooling_load_profile)
monthly_energy_balance_2 = Data(monthly_energy_balance)
energy_use_intensity_2 = Data(energy_use_intensity)
peak_cooling_2 = Data(peak_cooling)
heating_load_profile_2 = Data(heating_load_profile)
energy_use_intensity_per_end_use_2 = Data(energy_use_intensity_per_end_use)
end_uses_2 = Data(end_uses)
peak_heating_2 = Data(peak_heating)
annual_hourly_energy_results_2 = Data(annual_hourly_energy_results)
panel_148 = Panel(peak_cooling_2)
panel_149 = Panel(peak_heating_2)
panel_150 = Panel(energy_use_intensity_per_end_use_2)
panel_151 = Panel(energy_use_intensity_2)
panel_152 = Panel(end_uses_2)

peak_cooling_3 = Data(zone_names)

entwine_140 = Entwine(
    Branch00=annual_hourly_energy_results_2,
    Branch01=monthly_energy_balance_2,
    Branch02=energy_use_intensity_2,
    Branch03=energy_use_intensity_per_end_use_2,
    Branch04=end_uses_2,
    Branch05=peak_cooling_3,
    Branch06=peak_cooling_2,
    Branch07=peak_heating_2,
    Branch08=cooling_load_profile_2,
    Branch09=heating_load_profile_2,
    FlattenInputs=True)
freeze_gate_60 = StreamFreezeGate(Data=entwine_140, PassingSwitch=run_detailed_energy_simulations_3, Hold=True)
bang_16 = ExplodeTree(Data=freeze_gate_60)  # -> Branch0, Branch1, Branch2, Branch3, Branch4, Branch5, Branch6, Branch7, Branch8, Branch9
peak_heating_3 = Data(bang_16.Branch7)
peak_cooling_4 = Data(bang_16.Branch6)
annual_hourly_energy_results_3 = Data(bang_16.Branch0)
monthly_energy_balance_3 = Data(bang_16.Branch1)
cooling_load_profile_3 = Data(bang_16.Branch8)
heating_load_profile_3 = Data(bang_16.Branch9)
energy_use_intensity_per_end_use_3 = Data(bang_16.Branch3)
end_uses_3 = Data(bang_16.Branch4)
energy_use_intensity_3 = Data(bang_16.Branch2)
filter_57 = StreamFilter(
    Gate=detailed_energy_simulation_type_2,
    Stream0=annual_hourly_energy_results_3,
    Stream1=monthly_energy_balance_3,
    Stream2=cooling_load_profile_3,
    Stream3=heating_load_profile_3)
hasdata_12 = DataExists(Data=energy_use_intensity_3)
filter_58 = StreamFilter(Gate=hasdata_12, Stream0="False", Stream1=energy_use_intensity_3)
gate_52 = StreamGate(Stream=filter_57, Gate=expression_68)  # -> Target0, Target1
detailed_energy_data_exists = RemoteSender(filter_58)
data_42 = Data(gate_52.Target1)
bbox_2 = BoundingBox(Content=data_42, Plane=PlaneXY(0, 0, 0), UnionBox=True)  # -> Box, Box_2
zoom_detailed_energy_simulation_bounding = RemoteSender(bbox_2.Box)  # "zoom_detailed_energy_simulation_bounding_box"

detailed_energy_data_exists_2 = RemoteReceiver(detailed_energy_data_exists)

zoom_detailed_energy_simulation_bounding_2 = RemoteReceiver(zoom_detailed_energy_simulation_bounding)  # "zoom_detailed_energy_simulation_bounding_box"
zbb_2 = ZoomBoundingBox(Box=zoom_detailed_energy_simulation_bounding_2, Run=zoom_detailed_energy_simulation_2)

panel_153 = Panel(entwine_140)
zone_names_2 = Data(bang_16.Branch5)

detailed_energy_data_exists_3 = RemoteReceiver(detailed_energy_data_exists)
detailed_energy_data_exists_4 = RemoteReceiver(detailed_energy_data_exists)
or_28 = GateOr(A=detailed_energy_data_exists_3, B=filter_5)
rec_26 = DataRecorder(or_28, DataLimit=-10, RecordData=True)
hideshow_36 = HideShowElement(ElementToHideShow=true_button_8, Show=detailed_energy_data_exists_2, Collapse=True, Disable=False)
hideshow_37 = HideShowElement(ElementToHideShow=button_22, Show=detailed_energy_data_exists_4, Collapse=True, Disable=False)
ma_15 = MassAddition(Input=flatten(rec_26))  # -> Result, PartialResults
mod = Modulus(A=ma_15.Result, B=Slider(2, range=0..10))
bool_50 = Boolean(mod)
detailed_energy_data_exists_5 = RemoteReceiver(detailed_energy_data_exists)
detailed_energy_data_exists_6 = RemoteReceiver(detailed_energy_data_exists)
filter_59 = StreamFilter(Gate=bool_50, Stream0="Simulation failed...", Stream1="Daylight simulation is running...")
gate_53 = StreamGate(Stream=filter_59, Gate=freeze_gate_19)  # -> Target0, Target1
bool_51 = Boolean(invert(detailed_energy_data_exists_5))
hideshow_38 = HideShowElement(ElementToHideShow=stack_41, Show=detailed_energy_data_exists_6, Collapse=True, Disable=False)
settextblock_7 = SetTextBlockContents(TextBlockToModify=tb_4, NewTextBlockContents=gate_53.Target1)
hideshow_39 = HideShowElement(ElementToHideShow=tb_4, Show=bool_51, Collapse=detailed_energy_data_exists_5, Disable=False)

# ---- group: Analyse performance (continued)
honeybee_rooms = Data(deconstructmodel.rooms)
data_43 = Data(deconstructmodel.shades)
data_44 = Data(honeybee_rooms)
annualloads = HBAnnualLoads(
    rooms=flatten(data_44),
    shades=data_24,
    epw_file=downloadepw_2.epw_file,
    run_bal=run_energy_balance,
    run=run_energy_balance)  # -> report, total_load, cooling, heating, lighting, equip, process, hot_water, balance; plug-in component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
total_load_eui = Data(annualloads.total_load)
annual_energy_balance_data = Data(annualloads.balance)
panel_154 = Panel(annualloads.total_load)

# ----
# # Simple energy simulations
# Streamlined energy simulations which calculate energy balance across the year, and peak loads on the design day, for the input Honeybee rooms.
# 
# ## Instructions
# Enter all inputs and set `Run Energy Balance` or `Run Peak Loads`to True to investigate energy use for the specified Honeybee rooms considering the specified Honeybee shade objects. Adjust the y axis of output graphs using the `Graph max` input.
# 
# ## Inputs
# - `EPW file URL` - the URL for a EPW file which describes the location
# - `Honeybee rooms` - the Honeybee rooms which shall be analysed
# - `Shading objects` - Honeybee shade objects which block solar radiation toward the simulated rooms
# - `Run Energy Balance` - set to True to run the energy balance simulation
# - `Run Peak Loads` - set to True to run the peak loads simulation
# - `Graph max` - max value for the y axis of output graphs
# 
# ## Outputs
# - `Annual energy balance` - mesh visualising energy balance of each month of the year broken down into energy sources/sinks
# - `Daily cooling profile` - mesh visualising the cooling need during the design day (hottest day of the year)
# - `Daily heating profile` - mesh visualising the heating need during the design day (coldest day of the year)
# - `Cooling balance (design day)` - mesh visualising the cooling sources and sinks during the design day (hottest day of the year)
# - `Heating balance (design day)` - mesh visualising the heating sources and sinks during the design day (coldest day of the year)
# 
# ## Interpretation
# To be added...
panel_155 = Panel(annualloads.report)
honeybee_rooms_2 = Data(honeybee_rooms)
peakloads = HBPeakLoads(rooms=honeybee_rooms_2, shades=shading_geometry, ddy_file=data_25, run_bal=run_peak_loads, run=run_peak_loads)  # -> report, peak_cool, peak_heat, cooling, heating, cool_bal, heat_bal; plug-in component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
panel_156 = Panel(peakloads.report)
annual_energy_balance_data_2 = Data(peakloads.cooling)
annual_energy_balance_data_3 = Data(peakloads.cool_bal)
annual_energy_balance_data_4 = Data(peakloads.heating)
annual_energy_balance_data_5 = Data(peakloads.heat_bal)
entwine_141 = Entwine(
    Branch00=total_load_eui,
    Branch01=annual_energy_balance_data,
    Branch02=annual_energy_balance_data_2,
    Branch03=annual_energy_balance_data_4,
    Branch04=annual_energy_balance_data_3,
    Branch05=annual_energy_balance_data_5,
    FlattenInputs=True)
freeze_gate_61 = StreamFreezeGate(Data=entwine_141, PassingSwitch=run_simple_energy_simulations_2, Hold=True)
bang_17 = ExplodeTree(Data=freeze_gate_61)  # -> Branch0, Branch1, Branch2, Branch3, Branch4, Branch5

# ---- group: Analyse performance
xdata_2 = LBDeconstructData(data=bang_17.Branch2)  # -> header, values; plug-in component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
xdata_3 = LBDeconstructData(data=bang_17.Branch1)  # -> header, values; plug-in component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
xdata_4 = LBDeconstructData(data=bang_17.Branch3)  # -> header, values; plug-in component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
xdata_5 = LBDeconstructData(data=bang_17.Branch4)  # -> header, values; plug-in component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
xdata_6 = LBDeconstructData(data=bang_17.Branch5)  # -> header, values; plug-in component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
smaller = SmallerThan(FirstNumber=xdata_4.values, SecondNumber="0")  # -> SmallerThan, OrEqualTo
smaller_2 = SmallerThan(FirstNumber=xdata_2.values, SecondNumber="0")  # -> SmallerThan, OrEqualTo
smaller_3 = SmallerThan(FirstNumber=xdata_3.values, SecondNumber="0")  # -> SmallerThan, OrEqualTo
smaller_4 = SmallerThan(FirstNumber=xdata_5.values, SecondNumber="0")  # -> SmallerThan, OrEqualTo
smaller_5 = SmallerThan(FirstNumber=xdata_6.values, SecondNumber="0")  # -> SmallerThan, OrEqualTo
sift_2 = SiftPattern(List=xdata_4.values, SiftPattern=smaller.OrEqualTo)  # -> Output0, Output1
sift_3 = SiftPattern(List=xdata_3.values, SiftPattern=smaller_3.OrEqualTo)  # -> Output0, Output1
sift_4 = SiftPattern(List=xdata_2.values, SiftPattern=smaller_2.OrEqualTo)  # -> Output0, Output1
sift_5 = SiftPattern(List=xdata_5.values, SiftPattern=smaller_4.OrEqualTo)  # -> Output0, Output1
sift_6 = SiftPattern(List=xdata_6.values, SiftPattern=smaller_5.OrEqualTo)  # -> Output0, Output1
flip = FlipMatrix(Data=sift_4.Output0)
flip_2 = FlipMatrix(Data=sift_4.Output1)
flip_3 = FlipMatrix(Data=sift_2.Output0)
flip_4 = FlipMatrix(Data=sift_2.Output1)
flip_5 = FlipMatrix(Data=sift_6.Output0)
flip_6 = FlipMatrix(Data=sift_6.Output1)
flip_7 = FlipMatrix(Data=sift_3.Output0)
flip_8 = FlipMatrix(Data=sift_3.Output1)
flip_9 = FlipMatrix(Data=sift_5.Output0)
flip_10 = FlipMatrix(Data=sift_5.Output1)
ma_16 = MassAddition(Input=flip_2)  # -> Result, PartialResults
ma_17 = MassAddition(Input=flip_4)  # -> Result, PartialResults
ma_18 = MassAddition(Input=flip)  # -> Result, PartialResults
ma_19 = MassAddition(Input=flip_6)  # -> Result, PartialResults
ma_20 = MassAddition(Input=flip_8)  # -> Result, PartialResults
ma_21 = MassAddition(Input=flip_3)  # -> Result, PartialResults
ma_22 = MassAddition(Input=flip_10)  # -> Result, PartialResults
ma_23 = MassAddition(Input=flip_5)  # -> Result, PartialResults
ma_24 = MassAddition(Input=flip_7)  # -> Result, PartialResults
ma_25 = MassAddition(Input=flip_9)  # -> Result, PartialResults
extremes = MinMax(Number=flatten(ma_18.Result))  # -> Minimum, Maximum
extremes_2 = MinMax(Number=flatten(ma_16.Result))  # -> Minimum, Maximum
extremes_3 = MinMax(Number=flatten(ma_21.Result))  # -> Minimum, Maximum
extremes_4 = MinMax(Number=flatten(ma_17.Result))  # -> Minimum, Maximum
extremes_5 = MinMax(Number=flatten(ma_23.Result))  # -> Minimum, Maximum
extremes_6 = MinMax(Number=flatten(ma_24.Result))  # -> Minimum, Maximum
extremes_7 = MinMax(Number=flatten(ma_19.Result))  # -> Minimum, Maximum
extremes_8 = MinMax(Number=flatten(ma_20.Result))  # -> Minimum, Maximum
extremes_9 = MinMax(Number=flatten(ma_25.Result))  # -> Minimum, Maximum
extremes_10 = MinMax(Number=flatten(ma_22.Result))  # -> Minimum, Maximum
cooling_balance_min = RemoteSender(extremes_10.Minimum)
heating_balance_min = RemoteSender(extremes_7.Minimum)
daily_heating_profile_min = RemoteSender(extremes_4.Minimum)
cooling_balance_max = RemoteSender(extremes_9.Maximum)
daily_cooling_profile_max = RemoteSender(extremes.Maximum)
daily_cooling_profile_min = RemoteSender(extremes_2.Minimum)
heating_balance_max = RemoteSender(extremes_5.Maximum)
annual_energy_balance_max = RemoteSender(extremes_6.Maximum)
annual_energy_balance_min = RemoteSender(extremes_8.Minimum)
daily_heating_profile_max = RemoteSender(extremes_3.Maximum)

# ----
data_45 = Data(freeze_gate_59)
calculate_honeybee_model = BrimstoneCalculateEmbodiedCarbonOfHoneybeeModel(hb_model=data_45, kdb_json_data=get_categories.json_data)  # -> a, tot_emb_carbon, elements, el_emb_carbon
# ---------- calculate_honeybee_model: Python ----------
"""
Calculates embodied carbon for the elements of a Honeybee model if data is available
This component was inspired by the 'HB Color Face Attributes' component of Ladybug Tools 1.6.0

    Args:
        hb_model: Honeybee model for analysis
        kdb_json_data: Optional json data object for materials which do not include impact data

    Returns:
        tot_emb_carbon: total embodied carbon of model
        elements: element types in the model
        el_emb_carbon: embodied carbon for each element type in the model
"""

import scriptcontext
import brimstone
ghenv.Component.Message = brimstone.globals.version
import Grasshopper
import os
import csv, codecs

ghenv.Component.Name = 'Brimstone - Calculate Embodied Carbon of Honeybee Model'
ghenv.Component.NickName = 'Calculate Honeybee Model'

try:  # import the core honeybee dependencies
    from honeybee.model import Model
    from honeybee.properties import FaceProperties
    from honeybee.typing import clean_ep_string
except ImportError as e:
    raise ImportError('\nFailed to import honeybee:\n\t{}'.format(e))
    

# todo: magic string here - not good!
gwp_data_string = "Global Warming potential"
gwp_data_points = [
    "A1-A3 Conservative",
    "A4",
    "A5.1",
]

def main(hb_model):
    tot_emb_carbon = 0
    elements = []
    el_emb_carbon = []
    if not isinstance(hb_model, Model):
        raise Exception("hb_model input must be a valid honeybee model")
    faces = []
    apertures = []
    model_mats = []
    face_types = {}
    
    energy_properties = hb_model.properties.energy
    
    for material in energy_properties.materials:
        model_mats.append(material)
    for room in hb_model.rooms:
        faces.extend(room.faces)
        faces.extend(room.shades)
    faces.extend(hb_model.orphaned_faces)
    faces.extend(hb_model.orphaned_apertures)
    faces.extend(hb_model.orphaned_doors)
    faces.extend(hb_model.orphaned_shades)
    
    for face_obj in faces:
        if isinstance(face_obj.properties, FaceProperties):
            face_area = face_obj.area - face_obj.aperture_area
            face_type = face_obj.type
            
            face_impact = 0
            for lyr in face_obj.properties.energy.construction.layers:
                face_impact += get_face_impact(model_mats, lyr, face_area)
                """
                if lyr not in model_mats:
                    model_mats[lyr] = { area: face_area }
                else:
                    model_mats[lyr].area = model_mats[lyr].area + face_area
                """
                       
            if face_type not in face_types:
                face_types[face_type] = { "impact": face_impact }
            else:
                face_types[face_type]["impact"] += face_impact
                
            
            for aperture in face_obj.apertures:
                aperture_impact = get_aperture_impact(aperture)
                if "Aperture" not in face_types:
                    face_types["Aperture"] = { "impact": aperture_impact }
                else:
                    face_types["Aperture"]["impact"] += aperture_impact
    for face_type in face_types.items():
        face_impact = face_type[1]["impact"]
        tot_emb_carbon += face_impact
        elements.append(face_type[0])
        el_emb_carbon.append(face_impact)
    return tot_emb_carbon, elements, el_emb_carbon

def get_face_impact(materials, layer_name, face_area):
    for material in materials:
        if material.identifier == layer_name:
            abs_impact = 0
            gwp_data_keys = ["gwp_a1_a3", "gwp_a4", "gwp_a5_1"]
            if material.user_data and all(key in material.user_data.keys() for key in gwp_data_keys):
                impact = sum(float(material.user_data[key]) for key in gwp_data_keys)
                abs_impact = material.density*impact
            else:
                abs_impact = get_face_impact_from_material_name(material.identifier)
            return material.thickness*abs_impact*face_area
    brimstone.utils.warn(ghenv, "The calculation may be faulty as material " + layer_name + " was not found among the energy materials in the model.")
    return 0

# Gets material impact data from a honeybee material by referencing names in .csv file
def get_face_impact_from_material_name(material_name):
    csv_data_file = brimstone.globals.hb_kdb_csv_path
    csv_data_file_path = os.path.join(Grasshopper.Folders.UserObjectFolders[0], csv_data_file)
    if not os.path.exists(csv_data_file_path):
        raise Exception("Failed to open csv file, it should reside in [UserComponents folder]/brimstone_data/")
    kdb_name = check_name_in_kdb(material_name)
    if not kdb_name:
        with open(csv_data_file_path, 'r') as csv_file:
            file_reader = csv.DictReader(csv_file, delimiter=",")
            for row in file_reader:
                if row["HB Name"] == material_name:
                    kdb_name = clean_ep_string(row["Klimatdatabas name"])
                    if not kdb_name or kdb_name == "missing":
                        brimstone.utils.warn(ghenv, "The calculation may be faulty as impact data is missing for some of the materials in the model: " + material_name)
                        return 0
                    break
    if not kdb_name:
        brimstone.utils.warn(ghenv, "The calculation may be faulty as material " + material_name + " could not be matched to any material in the brimstone material database.")
        return 0
    
    return get_impact_from_json_data(kdb_name)

def check_name_in_kdb(material_name):
    if not kdb_json_data:
        brimstone.utils.warn(ghenv, "The calculation may be faulty as kdb_json_data is missing")
    else: 
        for resource in kdb_json_data["Resources"]:
            if clean_ep_string(resource["Name"]) == material_name:
                return material_name
    return ""
    
# TODO: currently only works for KDB windows
def get_aperture_impact(aperture):
    if hasattr(aperture.properties.energy.construction.properties, "conv_value"):
        c = aperture.properties.energy.construction
        return (float(c.properties.gwp_a1_a3) + float(c.properties.gwp_a4))\
            * float(c.properties.conv_value) * aperture.area
    if not len(aperture.properties.energy.construction.layers) == 1:
        brimstone.utils.warn(ghenv, "The calculation may be faulty as only one layer window constructions can be calculated.")
        return 0
    
    window_material = aperture.properties.energy.construction.layers[0]
    return get_impact_from_json_data(window_material)*aperture.area

def get_impact_from_json_data(kdb_name):
    if not kdb_json_data:
        brimstone.utils.warn(ghenv, "The calculation may be faulty as kdb_json_data is missing")
        return 0
    for resource in kdb_json_data["Resources"]:
        if clean_ep_string(resource["Name"]) == kdb_name:
            conv = resource["Conversions"][0]["Value"]
            
            for data_item in resource["DataItems"]:
                if data_item["PropertyName"] == gwp_data_string:
                    abs_impact = 0
                    for data_pt in gwp_data_points:
                        for data_val_item in data_item["DataValueItems"]:
                            if data_val_item["DataModuleCode"] == data_pt:
                                abs_impact += data_val_item["Value"]
                    return abs_impact*conv
            brimstone.utils.warn(ghenv, "The calculation may be faulty as material " + kdb_name + " has no GWP data in kdb_json_data")
            return 0
    brimstone.utils.warn(ghenv, "The calculation may be faulty as material " + kdb_name + " was not found in kdb_json_data")
    return 0

if __name__ == "__main__":
    try:
        flying = scriptcontext.sticky["brimstone_flying"]
    except:
        raise Exception("The 'Brimstone - Fly' component needs to exist on the canvas")
    tot_emb_carbon, elements, el_emb_carbon = main(hb_model)
# ---------- end calculate_honeybee_model ----------
total_gwp_2 = Data(calculate_honeybee_model.tot_emb_carbon)
panel_157 = Panel(total_gwp_2)
area_m2 = Data(geoprop.floor_area)

# ----
# Wrong names?
gwp_by_element_type_2 = Data(calculate_honeybee_model.elements)
element_types_2 = Data(calculate_honeybee_model.el_emb_carbon)

panel_158 = Panel(gwp_by_element_type_2)
panel_159 = Panel(element_types_2)

calculate_operational_emissions = BrimstoneCalculateOperationalEmissions(lca_data=get_lca_data.lca_data, eui=energy_use_intensity_kwh_m2, area=area_m2, mode=list_12)  # -> out, gwp_total; inputs lca_data: tree
# ---------- calculate_operational_emissions: Python ----------
"""Calculates operational emissions based on energy resource, EUI and floor area
    Inputs:
        lca_data: tree containing GWP information for the selected resource
        eui: energy use intensity of building in kWh/m2
        gfa: gross floor area of building
        mode: mode of GWP calculation ("typical" or "conservative")
        
    Output:
        gwp_total: total GWP for the selected space"""

import scriptcontext
import brimstone
reload(brimstone)
ghenv.Component.Message = brimstone.globals.version

ghenv.Component.Name = 'Brimstone - Calculate Operational Emissions'
ghenv.Component.NickName = 'Calculate Operational Emissions'

import rhinoscriptsyntax as rs
import ghpythonlib.treehelpers as th

from collections import OrderedDict

inv_unit_string = 'kWh'
gwp_unit_string = 'kg CO2 eq./kWh' # GWP

def main(lca_data, eui, area, mode):
    if not lca_data.BranchCount:
        brimstone.utils.warn(ghenv, "LCA data is missing")
        return
    if eui != 0 and not eui:
        brimstone.utils.warn(ghenv, "EUI is missing")
        return
    if area != 0 and not area:
        brimstone.utils.warn(ghenv, "Area is missing")
        return
    
    lca_data = th.tree_to_list(lca_data)
    lca_data = [OrderedDict(zip(l[0], l[1])) for l in lca_data]
    gwp_total =  []
    
    for resource_lca_data in lca_data:
        try:
            gwp_total.append(calculate_gwp_total(resource_lca_data, eui, area, mode))
        except KeyError as e:
            raise Exception("GWP value could not be calculated: {error}".format(error = e))
    
    return gwp_total
    
def calculate_gwp_total(lca_data, eui, area, mode):    
    inv_unit = lca_data["InventoryUnit"]
    
    if inv_unit != inv_unit_string:
        raise Exception("Wrong unit for calculation of operational energy")    
    
    gwp_unit = lca_data["GWPUnit"]
    if gwp_unit != gwp_unit_string:
        raise Exception("Wrong unit for GWP calculation")
    
    if mode == "conservative":
        gwp_a1_a3_str = "GWPA1A3Conservative"
    elif mode == "typical":
        gwp_a1_a3_str = "GWPA1A3Typical"
    else:
        raise Exception("Mode not recognised (must be conservative or typical)")
    
    gwp_impact = (
        float(lca_data[gwp_a1_a3_str])
    )
    
    gwp_total = (
        float(lca_data[gwp_a1_a3_str])
    ) * area * eui
        
    return gwp_total

if __name__ == "__main__":
    if not scriptcontext.sticky["brimstone_flying"]:
        raise Exception("The 'Brimstone - Fly' component needs to exist on the canvas")   
    gwp_total = main(lca_data, eui, area, mode)
    gwp_total = th.list_to_tree(gwp_total)
# ---------- end calculate_operational_emissions ----------
operational_gwp_total_kg_co2eq_year = Data(calculate_operational_emissions.gwp_total)
panel_160 = Panel(operational_gwp_total_kg_co2eq_year)
multiplication_5 = Multiplication(A=Slider(50, range=0..100), B=panel_160)
lca_operational_gwp_total = RemoteSender(multiplication_5)

panel_161 = Panel(operational_gwp_total_kg_co2eq_year)

lca_operational_gwp_total_2 = RemoteReceiver(lca_operational_gwp_total)
expression_77 = Expression(x=lca_operational_gwp_total_2, Expression="Round(x, 2)")
format_9 = Format(Format=panel_42, Culture=127, Data0=expression_77)
setlabel_5 = SetLabelContents(LabelToModify=label_30, NewLabelContents=format_9)

honeybee_model_2 = Data(freeze_gate_59)
deconstructmodel_2 = HBDeconstructModel(model=honeybee_model_2)  # -> rooms, faces, apertures, doors, shades; plug-in component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
decnstrobj = HBDeconstructObject(hb_obj=deconstructmodel_2.rooms)  # -> faces, apertures, doors, shades; plug-in component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
vizquick = HBVisualizeQuick(hb_objs=decnstrobj.faces)  # -> geo; plug-in component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
area = Area(Geometry=vizquick)  # -> Area, Centroid
pdecon = Deconstruct(Point=area.Centroid)  # -> XComponent, YComponent, ZComponent
sort = SortList(Keys=pdecon.ZComponent, ValuesA=vizquick)  # -> Keys, ValuesA
honeybee_model_3 = Data(honeybee_model_2)

# ---- group: Set up sensor grids
srf = Surface(sort.ValuesA)
item_35 = ListItem(List=srf, Index=Slider(0, range=0..5), Wrap=True)
flip_11 = Flip(Surface=item_35)  # -> Surface, Result
genpts = LBGeneratePointGrid(geometry=flip_11.Surface, grid_size=Slider(1, range=0..5), offset_dist=Slider(0.7, range=0..5))  # -> points, vectors, face_areas, mesh; plug-in component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
gridrooms = HBSensorGridFromRooms(rooms=honeybee_model_3, grid_size=grid_size, dist_floor=Slider(0.7, range=0..5))  # -> grid, points, mesh; plug-in component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
sensorgrid = HBSensorGrid(positions=genpts.points, directions=genpts.vectors, mesh=genpts.mesh)  # -> grid; plug-in component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
assigngridsviews_2 = HBAssignGridsAndViews(model=honeybee_model_3, grids=flatten(gridrooms.grid))  # -> model; plug-in component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

# ----
lca_operational_gwp_total_3 = RemoteReceiver(lca_operational_gwp_total)
entwine_142 = Entwine(
    Branch00=lca_element_types_3,
    Branch01=lca_gwp_by_element_type_3,
    Branch02=lca_total_gwp_4,
    Branch03=lca_operational_gwp_total_3,
    FlattenInputs=True)  # -> flatten(Result)
hasdata_13 = DataExists(Data=entwine_142)
filter_60 = StreamFilter(Gate=hasdata_13, Stream0="False", Stream1=entwine_142)
lng_30 = ListLength(List=filter_60)

# ----
# [Temporary]
honeybee_model_exists_5 = RemoteReceiver(honeybee_model_exists)
and_36 = GateAnd(A=honeybee_model_exists_5, B=lng_30)

lca_data_exists = RemoteSender(and_36)

lca_data_exists_2 = RemoteReceiver(lca_data_exists)
lca_data_exists_3 = RemoteReceiver(lca_data_exists)
hideshow_40 = HideShowElement(ElementToHideShow=label_28, Show=invert(lca_data_exists_3), Collapse=True, Disable=False)
hideshow_41 = HideShowElement(ElementToHideShow=[label_29, label_30, true_button_6], Show=lca_data_exists_2, Collapse=True, Disable=False)

# ---- group: Analyse performance (continued)
daily_heating_profile_max_2 = RemoteReceiver(daily_heating_profile_max)
daily_heating_profile_min_2 = RemoteReceiver(daily_heating_profile_min)
daily_cooling_profile_max_2 = RemoteReceiver(daily_cooling_profile_max)
daily_cooling_profile_min_2 = RemoteReceiver(daily_cooling_profile_min)
heating_balance_max_2 = RemoteReceiver(heating_balance_max)
heating_balance_min_2 = RemoteReceiver(heating_balance_min)
cooling_balance_max_2 = RemoteReceiver(cooling_balance_max)
cooling_balance_min_2 = RemoteReceiver(cooling_balance_min)
annual_energy_balance_max_2 = RemoteReceiver(annual_energy_balance_max)
annual_energy_balance_min_2 = RemoteReceiver(annual_energy_balance_min)

# ----
cluster_10 = Cluster_4(int=heating_balance_max_2)
cluster_11 = Cluster_5(x=daily_cooling_profile_min_2)
cluster_12 = Cluster_4(int=daily_cooling_profile_max_2)
cluster_13 = Cluster_4(int=cooling_balance_max_2)
cluster_14 = Cluster_5(x=heating_balance_min_2)
cluster_15 = Cluster_5(x=cooling_balance_min_2)
cluster_16 = Cluster_5(x=daily_heating_profile_min_2)
cluster_17 = Cluster_4(int=daily_heating_profile_max_2)
cluster_18 = Cluster_5(x=annual_energy_balance_min_2)
cluster_19 = Cluster_4(int=annual_energy_balance_max_2)

# ---- group: Analyse performance / Simple energy balance (continued)
legendpar_4 = LBLegendParameters(min=cluster_18, max=cluster_19, colors=colrange_5)  # -> leg_par; plug-in component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
monthlychart_4 = LBMonthlyChart(
    data=bang_17.Branch1,
    base_pt=simple_energy_simulation_base_point_2,
    x_dim=simple_energy_simulation_width_2,
    y_dim=simple_energy_simulation_height_2,
    stack=Toggle(True),
    legend_par=legendpar_4)  # -> report, data_mesh, data_lines, col_lines, legend, borders, labels, y_title, title, vis_set; plug-in component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

# ---- group: Analyse performance (continued)
legendpar_5 = LBLegendParameters(min=cluster_14, max=cluster_10)  # -> leg_par; plug-in component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
cluster_20 = Cluster_3(min=cluster_15, max=cluster_13, colors=colrange_3)
cluster_21 = Cluster_3(min=cluster_16, max=cluster_17, colors=colrange_4)
annual_energy_balance = Data(flatten([monthlychart_4.data_mesh, monthlychart_4.data_lines, monthlychart_4.col_lines, monthlychart_4.legend, monthlychart_4.borders, monthlychart_4.labels, monthlychart_4.y_title, monthlychart_4.title]))

# ---- group: Analyse performance / Simple peak loads (continued)
legendpar_6 = LBLegendParameters(min=cluster_11, max=cluster_12)  # -> leg_par; plug-in component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
monthlychart_5 = LBMonthlyChart(
    data=bang_17.Branch4,
    base_pt=simple_energy_simulation_base_point_4,
    x_dim=simple_energy_simulation_width_4,
    y_dim=simple_energy_simulation_height_4,
    stack=toggle_10,
    time_marks=toggle_10,
    legend_par=cluster_21)  # -> report, data_mesh, data_lines, col_lines, legend, borders, labels, y_title, title, vis_set; plug-in component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
monthlychart_6 = LBMonthlyChart(
    data=bang_17.Branch2,
    base_pt=simple_energy_simulation_base_point_3,
    x_dim=simple_energy_simulation_width_3,
    y_dim=simple_energy_simulation_height_3,
    stack=toggle_11,
    time_marks=toggle_11,
    legend_par=legendpar_6)  # -> report, data_mesh, data_lines, col_lines, legend, borders, labels, y_title, title, vis_set; plug-in component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
monthlychart_7 = LBMonthlyChart(
    data=bang_17.Branch4,
    base_pt=simple_energy_simulation_base_point_5,
    x_dim=simple_energy_simulation_width_5,
    y_dim=simple_energy_simulation_height_5,
    stack=toggle_12,
    time_marks=toggle_12,
    legend_par=cluster_20)  # -> report, data_mesh, data_lines, col_lines, legend, borders, labels, y_title, title, vis_set; plug-in component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
monthlychart_8 = LBMonthlyChart(
    data=bang_17.Branch5,
    base_pt=simple_energy_simulation_base_point_6,
    x_dim=simple_energy_simulation_width_6,
    y_dim=simple_energy_simulation_height_6,
    stack=toggle_13,
    time_marks=toggle_13,
    legend_par=legendpar_5)  # -> report, data_mesh, data_lines, col_lines, legend, borders, labels, y_title, title, vis_set; plug-in component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
daily_heating_profile = Data(flatten([monthlychart_5.data_mesh, monthlychart_5.data_lines, monthlychart_5.col_lines, monthlychart_5.legend, monthlychart_5.borders, monthlychart_5.labels, monthlychart_5.y_title, monthlychart_5.title]))
daily_cooling_profile = Data(flatten([monthlychart_6.data_mesh, monthlychart_6.data_lines, monthlychart_6.col_lines, monthlychart_6.legend, monthlychart_6.borders, monthlychart_6.labels, monthlychart_6.y_title, monthlychart_6.title]))
heating_balance_design_day = Data(flatten([monthlychart_8.data_mesh, monthlychart_8.data_lines, monthlychart_8.col_lines, monthlychart_8.legend, monthlychart_8.borders, monthlychart_8.labels, monthlychart_8.y_title, monthlychart_8.title]))
cooling_balance_design_day = Data(flatten([monthlychart_7.data_mesh, monthlychart_7.data_lines, monthlychart_7.col_lines, monthlychart_7.legend, monthlychart_7.borders, monthlychart_7.y_title, monthlychart_7.labels, monthlychart_7.title]))

# ----
panel_162 = Panel(legendpar_4)

data_46 = Data(flatten(bang_17.Branch1))
daily_cooling_profile_2 = Data(flatten(annual_energy_balance))
daily_cooling_profile_3 = Data(flatten(daily_cooling_profile))
daily_cooling_profile_4 = Data(flatten(daily_heating_profile))
daily_cooling_profile_5 = Data(flatten(cooling_balance_design_day))
daily_cooling_profile_6 = Data(flatten(heating_balance_design_day))
data_47 = Data(flatten(bang_17.Branch0))
xdata_7 = LBDeconstructData(data=data_46)  # -> header, values; plug-in component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
filter_61 = StreamFilter(
    Gate=simple_energy_simulation_type_2,
    Stream0=daily_cooling_profile_2,
    Stream1=daily_cooling_profile_3,
    Stream2=daily_cooling_profile_4,
    Stream3=daily_cooling_profile_5,
    Stream4=daily_cooling_profile_6)
item_36 = ListItem(List=data_47, Index=0, Wrap=True)
total_load_eui_2 = RemoteSender(data_47)
null_25 = NullItem(Item=item_36)  # -> NullFlags, InvalidFlags, Description
annual_energy_balance_data_header = RemoteSender(xdata_7.header)
annual_energy_balance_data_values = RemoteSender(xdata_7.values)
bool_52 = Boolean(invert(null_25.NullFlags))
sortbytype_2 = SortObjectsByType(RhinoObjects=filter_61)  # -> Points, Curves, Surfaces, Breps, Meshes, TextObjects, HatchObjects, LightObjects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
simple_energy_data_exists = RemoteSender(bool_52)
line_2 = Line(sortbytype_2.Curves)
bbox_3 = BoundingBox(Content=sortbytype_2.Meshes, Plane=PlaneXY(0, 0, 0), UnionBox=True)  # -> Box, Box_2
null_26 = NullItem(Item=line_2)  # -> NullFlags, InvalidFlags, Description
data_48 = Data([sortbytype_2.Other, sortbytype_2.Meshes])
sift_7 = SiftPattern(List=sortbytype_2.Curves, SiftPattern=null_26.NullFlags)  # -> Output0, Output1
gate_54 = StreamGate(Stream=bbox_3.Box, Gate=expression_67)  # -> Target0, Target1
preview_18 = CustomPreview(Geometry=sift_7.Output1, Material=ColourSwatch(SwatchColor=RGB(84, 84, 84)))
zoom_simple_energy_simulation_bounding_b = RemoteSender(gate_54.Target1)  # "zoom_simple_energy_simulation_bounding_box"

annual_energy_balance_data_header_2 = RemoteReceiver(annual_energy_balance_data_header)
annual_energy_balance_data_values_2 = RemoteReceiver(annual_energy_balance_data_values)
split_9 = TextSplit(Text=annual_energy_balance_data_header_2, Separators=":")
num_7 = Number(annual_energy_balance_data_values_2)
item_37 = ListItem(List=split_9, Index="-1", Wrap=True)
fragment_3 = TextFragment(Text=item_37, Start="1")  # -> flatten(Fragment)
panel_163 = Panel(fragment_3)
long = LongestList(ListA=fragment_3, ListB=entwine_76, PaddingMode=2)  # -> ListA, ListB
short = ShortestList(ListA=fragment_3, ListB=entwine_76, TrimMode=2)  # -> ListA, ListB
lng_31 = ListLength(List=fragment_3)
lng_32 = ListLength(List=long.ListA)
panel_164 = Panel(annual_energy_balance_data_header_2)
equals_45 = Equality(FirstNumber=lng_31, SecondNumber=lng_32)  # -> Equality, Inequality
filter_62 = StreamFilter(Gate=equals_45.Inequality, Stream0=long.ListB, Stream1=short.ListB)
txt_4 = Text(filter_62)
pt_22 = Point(txt_4)
division_3 = Division(A=pt_22, B="255")
len_4 = TextLength(Text=division_3)
subtraction_6 = Subtraction(A=len_4, B=Slider(2, range=0..10))
fragment_4 = TextFragment(Text=division_3, Start="1", Count=subtraction_6)
py3_38 = Python3Script(file_location=nextfile_3, title="Energy Intensity (kWh/m2)", labels=fragment_3, values=num_7, colors=fragment_4)  # -> out, a; inputs labels: list, values: tree, colors: list
# ---------- py3_38: Python ----------
# requirements: matplotlib
# requirements: numpy

import matplotlib.pyplot as plt
import random as rd
import numpy as np
import matplotlib.colors as mplcolors
import ghpythonlib.treehelpers as th


fig, ax = plt.subplots()

x = ["Jan", "Feb", "Mar", "Apr", "May", "Jun",
"Jul", "Aug", "Sep", "Oct", "Nov", "Dec"]

values = th.tree_to_list(values)

bar_labels = labels

for i in range(len(colors)):
    colors[i] = colors[i].split(',')
    colors[i] = [float(j) for j in colors[i]]
    colors[i] = tuple(colors[i])

fig, ax = plt.subplots(figsize=(14, 6))

positive = np.zeros(len(x))
negative = np.zeros(len(x))


for i in range(len(values)):
    color = colors[i]
    if sum(values[i]) >= 0:
        ax.bar(x, values[i], label=bar_labels[i], color=colors[i],
        bottom=positive, align="edge")
        positive += values[i]
    elif sum(values[i]) < 0:
        ax.bar(x, values[i], label=bar_labels[i], color=colors[i],
        bottom=negative, align="edge")
        negative += values[i]


ax.set_ylabel(title)
ax.set_title(title)

y_max, y_min = max(positive)*1.1, min(negative)*1.1
ax.set_ylim(y_min, y_max)

plt.subplots_adjust(right=0.8)

ax.legend(title="Energy intensity", bbox_to_anchor=(1.0, 1),
loc='upper left', reverse=True)

plt.savefig(file_location)
a = file_location

#plt.show()
# ---------- end py3_38 ----------
panel_165 = Panel(py3_38.a)
panel_166 = Panel(py3_38.out)
total_load_eui_3 = RemoteReceiver(total_load_eui_2)
ma_26 = MassAddition(Input=total_load_eui_3)  # -> Result, PartialResults
round = Round(Number=ma_26.Result)  # -> Nearest, Floor, Ceiling
format_10 = Format(Format=panel_53, Culture=127, Data0=round.Nearest)
settextblock_8 = SetTextBlockContents(TextBlockToModify=tb_7, NewTextBlockContents=format_10)
setimg_2 = SetImage(ImageToModify=image_4, NewImagePath=py3_38.a)

zoom_simple_energy_simulation_bounding_b_2 = RemoteReceiver(zoom_simple_energy_simulation_bounding_b)  # "zoom_simple_energy_simulation_bounding_box"
zbb_3 = ZoomBoundingBox(Box=zoom_simple_energy_simulation_bounding_b_2, Run=zoom_simple_energy_simulation_2)

simple_energy_data_exists_2 = RemoteReceiver(simple_energy_data_exists)
simple_energy_data_exists_3 = RemoteReceiver(simple_energy_data_exists)
simple_energy_data_exists_4 = RemoteReceiver(simple_energy_data_exists)
or_29 = GateOr(A=simple_energy_data_exists_2, B=filter_4)
rec_27 = DataRecorder(or_29, DataLimit=-10, RecordData=True)
hideshow_42 = HideShowElement(ElementToHideShow=true_button_7, Show=simple_energy_data_exists_3, Collapse=True, Disable=False)
hideshow_43 = HideShowElement(ElementToHideShow=button_19, Show=simple_energy_data_exists_4, Collapse=True, Disable=False)
ma_27 = MassAddition(Input=flatten(rec_27))  # -> Result, PartialResults
mod_2 = Modulus(A=ma_27.Result, B=Slider(2, range=0..10))
bool_53 = Boolean(mod_2)
simple_energy_data_exists_5 = RemoteReceiver(simple_energy_data_exists)
simple_energy_data_exists_6 = RemoteReceiver(simple_energy_data_exists)
filter_63 = StreamFilter(Gate=bool_53, Stream0="Simulation failed...", Stream1="Daylight simulation is running...")
gate_55 = StreamGate(Stream=filter_63, Gate=freeze_gate_17)  # -> Target0, Target1
bool_54 = Boolean(invert(simple_energy_data_exists_5))
hideshow_44 = HideShowElement(ElementToHideShow=stack_40, Show=simple_energy_data_exists_6, Collapse=True, Disable=False)
hideshow_45 = HideShowElement(ElementToHideShow=tb_3, Show=bool_54, Collapse=simple_energy_data_exists_5, Disable=False)
settextblock_9 = SetTextBlockContents(TextBlockToModify=tb_3, NewTextBlockContents=gate_55.Target1)

grid_mesh = Data(gridrooms.mesh)
honeybee_model_4 = Data(assigngridsviews_2)
honeybee_model_5 = Data(honeybee_model_4)

# ---- group: Daylight Factor (continued)
daylightfactor = HBDaylightFactor(model=honeybee_model_5, radiance_par=radpar, run=run_daylight_factor)  # -> report, results; plug-in component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
median = GhPythonScript(list=daylightfactor.results)  # -> out, median; inputs list: list
# ---------- median: Python ----------
"""Provides a scripting component.
    Inputs:
        list: list of numeric values to retrieve median
    Output:
        median: median value in list

__author__ = "sawen"
__version__ = "2024.06.14"
"""

import statistics

def main(list):
    return statistics.median(list)

if __name__ == "__main__":
    if list:
        median = main(list)
# ---------- end median ----------
heatmap = LBSpatialHeatmap(values=flatten(daylightfactor.results), legend_par=cluster_6, legend_title="Daylight Factor [%]")  # -> mesh, legend, title, colors, legend_par, vis_set; plug-in component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
daylight_factor = Data(flatten([heatmap.mesh, heatmap.legend, heatmap.title]))

# ---- group: Simulate illuminance (continued)
mjoin = MeshJoin(Meshes=grid_mesh)
pitgrid = HBPointInTimeGridBased(model=honeybee_model_4, sky=ciesky_2, radiance_par=radpar_3, run=run_illuminance)  # -> report, flatten(results); plug-in component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
heatmap_2 = LBSpatialHeatmap(values=pitgrid.results, mesh=mjoin, legend_par=legendpar_2, legend_title="Lux", global_title="Illuminance")  # -> mesh, legend, title, colors, legend_par, vis_set; plug-in component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

# ----
num_8 = Number(daylight_glare_probability_dgp)

data_49 = Data(num_8)
data_50 = Data(hdr_image)
data_51 = Data(hdr_false_color_image)
entwine_143 = Entwine(Branch00=data_49, Branch01=data_50, Branch02=data_51, FlattenInputs=True)
freeze_gate_62 = StreamFreezeGate(Data=entwine_143, PassingSwitch=calculate_glare_probability_3, Hold=True)
bang_18 = ExplodeTree(Data=freeze_gate_62)  # -> Branch0, Branch1, Branch2
hasdata_14 = DataExists(Data=bang_18.Branch0)
data_52 = Data(bang_18.Branch1)
data_53 = Data(bang_18.Branch2)
data_54 = Data(bang_18.Branch0)
glare_data_exists = RemoteSender(hasdata_14)
glare__hdr_false_color_image = RemoteSender(data_53)
glare__hdr_image = RemoteSender(data_52)
glare_daylight_probability = RemoteSender(data_54)

imageviewer = LBImageViewer(ImagePath_=data_52, _scale_="1", DisableClickable=False, SaveImgWithCoords=False, scale=1)  # -> ImagePath, Values, GIF
imageviewer_2 = LBImageViewer(ImagePath_=data_53, _scale_="1", DisableClickable=False, SaveImgWithCoords=False, scale=1)  # -> ImagePath, Values, GIF

panel_167 = Panel(imageviewer_2.Values)
panel_168 = Panel(imageviewer_2.GIF)
panel_169 = Panel(imageviewer_2.ImagePath)

glare_daylight_probability_2 = RemoteReceiver(glare_daylight_probability)
glare__hdr_false_color_image_2 = RemoteReceiver(glare__hdr_false_color_image)
glare__hdr_image_2 = RemoteReceiver(glare__hdr_image)
expression_78 = Expression(x=glare_daylight_probability_2, Expression="Round(x, 2)")
glare_data_exists_2 = RemoteReceiver(glare_data_exists)
py3_39 = Python3Script(hdr_file_path=glare__hdr_false_color_image_2)  # -> png_file_path
# ---------- py3_39: Python ----------
# requirements: pillow
# requirements: numpy

from PIL import Image
import numpy as np
import imageio.v2 as imageio

# Load the HDR image
hdr_image = imageio.imread(hdr_file_path)

height, width, channels = hdr_image.shape

hdr_image = hdr_image.reshape((height, width, channels))

# Step 2: Tone mapping (simple normalization)
hdr_min = hdr_image.min()
hdr_max = hdr_image.max()

ldr_image = (hdr_image - hdr_min) / (hdr_max - hdr_min) * 255.0
ldr_image = ldr_image.astype(np.uint8)

# Step 3: Convert numpy array to an image using Pillow
ldr_image_pil = Image.fromarray(ldr_image)

# Step 4: Save the image as a PNG or JPG
save_path = r"C:\Users\Isac\Desktop\Toivo_Chalmers\Heath local\png_image_false_color.png"
ldr_image_pil.save(save_path)  # or 'output_image.jpg'

png_file_path = save_path
# ---------- end py3_39 ----------
py3_40 = Python3Script(hdr_file_path=glare__hdr_image_2)  # -> png_file_path
# ---------- py3_40: Python ----------
# requirements: pillow
# requirements: numpy

from PIL import Image
import numpy as np
import imageio.v2 as imageio
import os

# Load the HDR image
hdr_image = imageio.imread(hdr_file_path)

height, width, channels = hdr_image.shape

hdr_image = hdr_image.reshape((height, width, channels))

# Step 2: Tone mapping (simple normalization)
hdr_min = hdr_image.min()
hdr_max = hdr_image.max()

ldr_image = (hdr_image - hdr_min) / (hdr_max - hdr_min) * 255.0
ldr_image = ldr_image.astype(np.uint8)

# Step 3: Convert numpy array to an image using Pillow
ldr_image_pil = Image.fromarray(ldr_image)

# Step 4: Save the image as a PNG or JPG
save_path = r"C:\Users\Isac\Desktop\Toivo_Chalmers\Heath local\png_image_original_color_.png"
if os.path.exists(save_path):
  os.remove(save_path) # one file at a time
ldr_image_pil.save(save_path)  # or 'output_image.jpg'

print("HDR image converted to PNG/JPG successfully.")

png_file_path = save_path
# ---------- end py3_40 ----------
format_11 = Format(Format=panel_41, Culture=127, Data0=expression_78)
or_30 = GateOr(A=glare_data_exists_2, B=filter_2)
setlabel_6 = SetLabelContents(LabelToModify=label_31, NewLabelContents=format_11)
rec_28 = DataRecorder(or_30, DataLimit=-10, RecordData=True)
setimg_3 = SetImage(ImageToModify=image, NewImagePath=py3_39)
setimg_4 = SetImage(ImageToModify=image_2, NewImagePath=py3_40)
panel_170 = Panel(py3_40)
ma_28 = MassAddition(Input=flatten(rec_28))  # -> Result, PartialResults
mod_3 = Modulus(A=ma_28.Result, B=Slider(2, range=0..10))
bool_55 = Boolean(mod_3)
glare_data_exists_3 = RemoteReceiver(glare_data_exists)
filter_64 = StreamFilter(Gate=bool_55, Stream0="Simulation failed...", Stream1="Daylight simulation is running...")
glare_data_exists_4 = RemoteReceiver(glare_data_exists)
gate_56 = StreamGate(Stream=filter_64, Gate=freeze_gate_14)  # -> Target0, Target1
bool_56 = Boolean(invert(glare_data_exists_3))
settextblock_10 = SetTextBlockContents(TextBlockToModify=tb_5, NewTextBlockContents=gate_56.Target1)
hideshow_46 = HideShowElement(ElementToHideShow=tb_5, Show=bool_56, Collapse=glare_data_exists_3, Disable=False)
hideshow_47 = HideShowElement(ElementToHideShow=[label_31, image_2, image, expander_2], Show=glare_data_exists_4, Collapse=True, Disable=False)

# ---- group: Spatial climate based daylight (continued)
analysis_mesh = Mesh(grid_mesh)
annualdaylight = HBAnnualDaylight(
    model=honeybee_model_5,
    wea=wea,
    schedule="Generic Office Occupancy",
    radiance_par=radpar_2,
    run=run_annual_daylight_simulation)  # -> report, results, DA, cDA, UDI, UDI_low, UDI_up; plug-in component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
mjoin_2 = MeshJoin(Meshes=analysis_mesh)
heatmap_3 = LBSpatialHeatmap(values=flatten(annualdaylight.UDI_up), mesh=mjoin_2, legend_par=cluster_7, legend_title="UDI >3000 [%]")  # -> mesh, legend, title, colors, legend_par, vis_set; plug-in component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
heatmap_4 = LBSpatialHeatmap(values=flatten(annualdaylight.UDI_low), mesh=mjoin_2, legend_par=cluster_8, legend_title="UDI <50 [%]")  # -> mesh, legend, title, colors, legend_par, vis_set; plug-in component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
heatmap_5 = LBSpatialHeatmap(values=flatten(annualdaylight.UDI), mesh=mjoin_2, legend_par=cluster_9, legend_title="UDI [%]")  # -> mesh, legend, title, colors, legend_par, vis_set; plug-in component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
sda = HBSpatialDaylightAutonomy(DA=flatten(annualdaylight.DA), mesh=mjoin_2)  # -> report, sDA, pass_fail; plug-in component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
heatmap_6 = LBSpatialHeatmap(values=flatten(annualdaylight.DA), mesh=mjoin_2, legend_par=cluster_5, legend_title="Daylight autonomy [%]")  # -> mesh, legend, title, colors, legend_par, vis_set; plug-in component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
panel_171 = Panel(sda.sDA)

# ---- group: Extract hourly data from annual results (continued)
facen = FaceNormals(Mesh=mjoin_2)  # -> Centers, Normals
pt_23 = Point(facen.Centers)
flatten = FlattenTree(Tree=pt_23, Path="{0}")
item_38 = ListItem(List=flatten, Index=Slider(581, range=0..1000), Wrap=True)
annualtodata = HBAnnualResultsToData(results=annualdaylight.results, sel_pts=flatten(item_38), all_pts=pt_23)  # -> report, data; plug-in component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
hourlyplot_2 = LBHourlyPlot(data=annualtodata.data, base_pt=pt_21, x_dim=number_slider_50, y_dim=multiplication_4, legend_par=legendpar_3)  # -> report, mesh, legend, borders, labels, title, vis_set; plug-in component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
sph = Sphere(Base=item_38, Radius=Slider(1.2, range=0..5))
merge_18 = Merge(Data1=sph, Data2=hourlyplot_2.mesh, Data3=hourlyplot_2.legend, Data4=hourlyplot_2.labels)  # -> flatten(Result)

# ----
merge_19 = Merge(Data1=heatmap_2.mesh, Data2=heatmap_2.legend, Data3=heatmap_2.title)  # -> flatten(Result)
illuminance_lux = Data(merge_19)
udi_50 = Data(flatten([heatmap_4.mesh, heatmap_4.legend, heatmap_4.title]))
udi_3000 = Data(flatten([heatmap_3.mesh, heatmap_3.legend, heatmap_3.title]))
udi = Data(flatten([heatmap_5.mesh, heatmap_5.legend, heatmap_5.title]))
daylight_autonomy = Data(flatten([heatmap_6.mesh, heatmap_6.legend, heatmap_6.title]))
move = Move(Geometry=daylight_autonomy, Motion=X)  # -> Geometry, Transform
hourly_results_in_one_point = Data(merge_18)
spatial_daylight_autonomy = Data(sda.sDA)

# ---- group: Spatial climate based daylight (continued)
move_2 = Move(Geometry=udi_3000, Motion=X_2)  # -> Geometry, Transform
move_3 = Move(Geometry=udi_50, Motion=X_3)  # -> Geometry, Transform
move_4 = Move(Geometry=udi, Motion=X_4)  # -> Geometry, Transform
merge_20 = Merge(Data1=move.Geometry, Data2=move_4.Geometry, Data3=move_3.Geometry, Data4=move_2.Geometry)

# ----
data_55 = Data(merge_20)

data_56 = Data(spatial_daylight_autonomy)
data_57 = Data(illuminance_lux)
data_58 = Data(daylight_autonomy)
data_59 = Data(udi)
data_60 = Data(udi_50)
data_61 = Data(udi_3000)
entwine_144 = Entwine(
    Branch00=data_56,
    Branch01=data_57,
    Branch02=data_58,
    Branch03=data_59,
    Branch04=data_60,
    Branch05=data_61,
    FlattenInputs=True)
freeze_gate_63 = StreamFreezeGate(Data=entwine_144, PassingSwitch=run_daylight_simulations_3, Hold=True)
bang_19 = ExplodeTree(Data=freeze_gate_63)  # -> Branch0, Branch1, Branch2, Branch3, Branch4, Branch5
null_27 = NullItem(Item=flatten(freeze_gate_63))  # -> NullFlags, InvalidFlags, Description
cull_17 = CullPattern(List=null_27.NullFlags, CullPattern=invert(null_27.NullFlags))
data_62 = Data(bang_19.Branch2)
data_63 = Data(bang_19.Branch3)
data_64 = Data(bang_19.Branch4)
data_65 = Data(bang_19.Branch0)
data_66 = Data(bang_19.Branch1)
data_67 = Data(bang_19.Branch5)
lng_33 = ListLength(List=cull_17)
filter_65 = StreamFilter(Gate=daylight_simulation_type_3, Stream0=data_66, Stream1=data_62, Stream2=data_63, Stream3=data_64, Stream4=data_67)

spatialdaylightautonomy = RemoteSender(data_65)
bool_57 = Boolean(data_65)
hasdata_15 = DataExists(Data=bool_57)
filter_66 = StreamFilter(Gate=hasdata_15, Stream0="False", Stream1=bool_57)
gate_57 = StreamGate(Stream=filter_65, Gate=expression_27)  # -> Target0, Target1

daylight_data_exists = RemoteSender(filter_66)
data_68 = Data(gate_57.Target1)
bbox_4 = BoundingBox(Content=data_68, Plane=PlaneXY(0, 0, 0), UnionBox=True)  # -> Box, Box_2
zoom_daylight_simulation_bounding_box = RemoteSender(bbox_4.Box)

spatialdaylightautonomy_2 = RemoteReceiver(spatialdaylightautonomy)
expression_79 = Expression(x=spatialdaylightautonomy_2, Expression="Round(x*100, 1)")
daylight_data_exists_2 = RemoteReceiver(daylight_data_exists)
format_12 = Format(Format=panel_39, Culture=127, Data0=expression_79)
daylight_data_exists_3 = RemoteReceiver(daylight_data_exists)
or_31 = GateOr(A=daylight_data_exists_2, B=filter_3)
setlabel_7 = SetLabelContents(LabelToModify=label_27, NewLabelContents=format_12)
rec_29 = DataRecorder(or_31, DataLimit=-10, RecordData=True)
hideshow_48 = HideShowElement(ElementToHideShow=button_17, Show=daylight_data_exists_3, Collapse=True, Disable=False)
ma_29 = MassAddition(Input=flatten(rec_29))  # -> Result, PartialResults
mod_4 = Modulus(A=ma_29.Result, B=Slider(2, range=0..10))
daylight_data_exists_4 = RemoteReceiver(daylight_data_exists)
bool_58 = Boolean(mod_4)
filter_67 = StreamFilter(Gate=bool_58, Stream0="Simulation failed...", Stream1="Daylight simulation is running...")
daylight_data_exists_5 = RemoteReceiver(daylight_data_exists)
daylight_data_exists_6 = RemoteReceiver(daylight_data_exists)
bool_59 = Boolean(invert(daylight_data_exists_4))
gate_58 = StreamGate(Stream=filter_67, Gate=freeze_gate_15)  # -> Target0, Target1
hideshow_49 = HideShowElement(ElementToHideShow=tb_2, Show=bool_59, Collapse=daylight_data_exists_4, Disable=False)
settextblock_11 = SetTextBlockContents(TextBlockToModify=tb_2, NewTextBlockContents=gate_58.Target1)
hideshow_50 = HideShowElement(ElementToHideShow=label_27, Show=daylight_data_exists_6, Collapse=True, Disable=False)
hideshow_51 = HideShowElement(ElementToHideShow=pulldown_21, Show=daylight_data_exists_5, Collapse=True, Disable=False)

zoom_daylight_simulation_bounding_box_2 = RemoteReceiver(zoom_daylight_simulation_bounding_box)
zbb_4 = ZoomBoundingBox(Box=zoom_daylight_simulation_bounding_box_2, Run=zoom_daylight_simulation_2)

daylight_data_exists_7 = RemoteReceiver(daylight_data_exists)
and_37 = GateAnd(A=equals_15.Inequality, B=daylight_data_exists_7, C=expression_25)

or_32 = GateOr(
    A=preview_15,
    B=room_attribute_visualize_2,
    C=room_energy_attribute_visualize_2,
    D=face_attribute_visualize_2,
    E=face_energy_attribute_visualize_2,
    F=show_honeybee_walls_2,
    G=show_honeybee_roof_2,
    H=show_honeybee_floors_2,
    I=show_honeybee_ground_2,
    J=show_honeybee_windows_2,
    K=show_honeybee_doors_2,
    L=show_honeybee_context_2,
    M=weather_visualisation_wireframe_2,
    N=and_37)
filter_68 = StreamFilter(Gate=or_32, Stream0="Shaded", Stream1="Wireframe")
mod_viewport = ModifyViewport(DisplayMode=filter_68, AnimateRestore=False, RestoreFrames=10)

created_materials_database = RemoteReceiver(created_materials_database_2)
decnstrmat_4 = HBDeconstructMaterial(mat=created_materials_database)  # -> values, attr_names, r_val_si, r_val_ip; plug-in component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
item_39 = ListItem(List=decnstrmat_4.values, Index=0, Wrap=True)  # -> flatten(Item), flatten(Item1), flatten(Item2), flatten(Item3), flatten(Item4)
clean_8 = CleanTree(RemoveNulls=True, RemoveInvalid=True, RemoveEmpty=False, Tree=item_39.Item)
clean_9 = CleanTree(RemoveNulls=True, RemoveInvalid=True, RemoveEmpty=False, Tree=item_39.Item2)
clean_10 = CleanTree(RemoveNulls=True, RemoveInvalid=True, RemoveEmpty=False, Tree=item_39.Item3)
clean_11 = CleanTree(RemoveNulls=True, RemoveInvalid=True, RemoveEmpty=False, Tree=item_39.Item4)
lng_34 = ListLength(List=clean_8)
num_9 = Number(clean_9)
create_material_names = RemoteSender(clean_8)
num_10 = Number(clean_10)
num_11 = Number(clean_11)
expression_80 = Expression(x=num_9, Expression="Round(x, 2)")
expression_81 = Expression(x=num_10, Expression="Round(x, 2)")
expression_82 = Expression(x=num_11, Expression="Round(x, 2)")
bool_60 = Boolean(lng_34)
gate_59 = StreamGate(Stream=panel_20, Gate=bool_60)  # -> Target0, Target1
format_13 = Format(Format=gate_59.Target1, Culture=127, Data0=clean_8, Data1=expression_80, Data2=expression_81, Data3=expression_82)
panel_172 = Panel(format_13)
database_materials = RemoteSender(format_13)

create_material_names_2 = RemoteReceiver(create_material_names)

create_material_names_3 = RemoteReceiver(create_material_names)
expression_83 = Expression(x=create_material_names_3, y=create_material_name_3, Expression="x=y")
cull_18 = CullPattern(List=expression_83, CullPattern=expression_83)
gate_60 = StreamGate(Stream="Material already exists", Gate=cull_18)  # -> Target0, Target1
entwine_145 = Entwine(Branch00=filter_21, Branch01=gate_60.Target1, FlattenInputs=True)  # -> flatten(Result)
item_40 = ListItem(List=entwine_145, Index=0, Wrap=True)
create_material_error_message = RemoteSender(item_40)

database_materials_2 = RemoteReceiver(database_materials)
tsort = SortText(Keys=database_materials_2, Culture=127)  # -> Keys, Values
panel_173 = Panel(database_materials_2)
panel_174 = Panel(tsort.Keys)

create_material_error_message_2 = RemoteReceiver(create_material_error_message)
null_28 = NullItem(Item=create_material_error_message_2)  # -> NullFlags, InvalidFlags, Description
filter_69 = StreamFilter(Gate=null_28.NullFlags, Stream0=create_material_error_message_2, Stream1=" ")
filter_70 = StreamFilter(Gate=null_28.NullFlags, Stream0=Slider(500, range=0..1000), Stream1=Slider(1000000, range=0..1000000))
hideshow_52 = HideShowElement(ElementToHideShow=button_32, Show=True, Collapse=True, Disable=invert(null_28.NullFlags))
tooltip_16 = AttachTooltipToElement(ElementsToAttachTo=button_32, TooltipContent=filter_69, ShowDelay=filter_70, Duration=Slider(5000, range=0..10000))

create_material_names_4 = RemoteReceiver(create_material_names)

database_materials_3 = RemoteReceiver(database_materials)

database_materials_4 = RemoteReceiver(database_materials)
hasdata_16 = DataExists(Data=database_materials_4)

lng_35 = ListLength(List=database_materials_4)
series = Series(Start=0, Step=1, Count=lng_35)
tsort_2 = SortText(Keys=database_materials_4, Values=series, Culture=127)  # -> Keys, Values
create_construction_materials_sorted = RemoteSender(tsort_2.Values)

create_construction_materials_sorted_2 = RemoteReceiver(create_construction_materials_sorted)

filter_71 = StreamFilter(Gate=hasdata_16, Stream0=empty_10, Stream1=tsort_2.Keys)
setlist_11 = SetListContents(ListToModify=pulldown_24, NewListContents=filter_71, SelectedIndex=bang_10.Branch0)

overlap_constructions = RemoteReceiver(overlap_constructions_2)
event_51 = EventGate(Data=overlap_constructions)  # -> Data, IsNew
and_38 = GateAnd(A=event_51.Data, B=freeze_gate_41)
launchwin_14 = LaunchWindow(
    Show=and_38,
    Name="Warning",
    Width=Slider(210, range=0..1000),
    Height=Slider(140, range=0..1000),
    ChildStatus=1,
    EnableHorizScroll=False)
winprops_14 = SetWindowProperties(
    Window=launchwin_14,
    StartingLocation=pt_8,
    Theme=0,
    AccentColor=accent_colors,
    ShowTitleBar=True,
    BackgroundColor=RGB(255, 255, 255),
    ScaleFactor=1)
addelems_15 = AddElements(Window=launchwin_14, Elements=flatten(tb_6), DoVLChecking=True)  # -> AddedElements, ElementNames
childwin_2 = MakeChildWindow(ParentWindow=heath_window_2, ChildWindow=launchwin_14)

materials_category = RemoteReceiver(materials_category_2)
item_41 = ListItem(List=materials_category, Index=0, Wrap=True)  # -> flatten(Item), flatten(Item1)

rep_10 = ReplaceText(Text=item_41.Item, Find=",", RecursiveReplace=False)

py3_41 = Python3Script(database_names=create_material_names_4, materials_names=rep_10, category_names=item_41.Item1)  # -> valid_materials, valid_categories; inputs database_names: list, materials_names: list, category_names: list
# ---------- py3_41: Python ----------
valid_materials = []
valid_categories = []

for i in range(len(materials_names)):
    if materials_names[i] in valid_materials:
        continue
    if materials_names[i] not in database_names:
        continue
    valid_materials.append(materials_names[i])
    valid_categories.append(category_names[i])
# ---------- end py3_41 ----------
mindex_5 = MemberIndex(Set=material_database_categories_4, Member=py3_41.valid_categories)  # -> flatten(Index), Count

sort_2 = SortList(Keys=mindex_5.Index, ValuesA=database_materials_3, ValuesB=create_material_names_2)  # -> Keys, ValuesA, ValuesB
create_material_names_sorted = RemoteSender(sort_2.ValuesB)

py3_42 = Python3Script(maximum_elements=lng_7, current_elements=mindex_5.Index, maximum_buttons=number_slider_33)  # -> status; inputs current_elements: list, maximum_buttons: Int32
# ---------- py3_42: Python ----------
from collections import Counter
import ghpythonlib.treehelpers as th

c = Counter(current_elements)
status = []

for i in range(maximum_elements):
    current_category = [True]*c[i]
    current_category.extend([False]*(maximum_buttons-c[i]))
    status.append(current_category)

status = th.list_to_tree(status)
# ---------- end py3_42 ----------
concat_6 = Concatenate(FragmentA="- ", FragmentB=sort_2.ValuesA)
hideshow_53 = HideShowElement(ElementToHideShow=simplify(shfdep), Show=simplify(py3_42), Collapse=True, Disable=False)

cull_19 = CullPattern(List=tb_8, CullPattern=py3_42)  # -> flatten(List)
material_database_hideshow = RemoteSender(py3_42)

settextblock_12 = SetTextBlockContents(TextBlockToModify=cull_19, NewTextBlockContents=concat_6)

material_database_hideshow_2 = RemoteReceiver(flatten(material_database_hideshow))
filter_72 = StreamFilter(Gate=lng_16, Stream0="False", Stream1=material_database_hideshow_2)
freeze_gate_64 = StreamFreezeGate(Data=filter_72, PassingSwitch=filter_20, Freeze=True, Hold=False)
cull_20 = CullPattern(List=freeze_gate_42, CullPattern=freeze_gate_64)
create_material_names_sorted_2 = RemoteReceiver(create_material_names_sorted)
cset_4 = CreateSet(List=cull_20)  # -> Set, Map
cull_21 = CullPattern(List=cset_4.Set, CullPattern=cset_4.Set)
mindex_6 = MemberIndex(Set=cull_20, Member=cull_21)  # -> Index, Count
freeze_gate_65 = StreamFreezeGate(Data=create_material_names_sorted_2, PassingSwitch=filter_20, Freeze=True, Hold=False)
hold_7 = HoldingGate(Data=mindex_6.Index)
item_42 = ListItem(List=freeze_gate_65, Index=hold_7, Wrap=True)

expression_84 = Expression(x=item_15, y=item_42, Expression="x≠y")

cull_22 = CullPattern(List=split_2, CullPattern=expression_84)
cull_23 = CullPattern(List=split_3, CullPattern=expression_84)
join_15 = TextJoin(Text=cull_22, Join="|")
join_16 = TextJoin(Text=cull_23, Join="|")
filter_73 = StreamFilter(Gate=bool_37, Stream0=bool_36, Stream1=join_15)
filter_74 = StreamFilter(Gate=bool_37, Stream0=bool_36, Stream1=join_16)
freeze_gate_66 = StreamFreezeGate(Data=filter_74, PassingSwitch=material_database_remove_material_2, Freeze=False, Hold=False)
freeze_gate_67 = StreamFreezeGate(Data=filter_73, PassingSwitch=material_database_remove_material_2, Freeze=False, Hold=False)
setdocumentusertext_4 = Python3Script(
    key="Heath materials",
    load_value=freeze_gate_49,
    remove_value=freeze_gate_66,
    add_value=freeze_gate_56,
    update=sync_material_database_2)  # -> out, done
# ---------- setdocumentusertext_4: Python ----------
import Rhino
import rhinoscriptsyntax as rs
import scriptcontext as sc

def modify_value(value):
    sc.doc = Rhino.RhinoDoc.ActiveDoc

    done = rs.SetDocumentUserText(key, value)
    return done

    sc.doc = ghdoc
    
if load_value:
    done = modify_value(load_value)

if add_value:
    print(1)
    done = modify_value(add_value)

if remove_value:
    done = modify_value(remove_value)
    print(1)
elif remove_value == False:
    done = modify_value(None)
    print(1)

if update:
    print(2)
    done = True
# ---------- end setdocumentusertext_4 ----------
null_29 = NullItem(Item=setdocumentusertext_4.done)  # -> NullFlags, InvalidFlags, Description
filter_75 = StreamFilter(Gate=null_29.NullFlags, Stream0=setdocumentusertext_4.done, Stream1="False")
event_52 = EventGate(Data=filter_75)  # -> Data, IsNew
getdocumentusertext_20 = Python3Script(run=event_52.Data, key="Heath materials")  # -> json_string; same code as getdocumentusertext_17
split_10 = TextSplit(Text=getdocumentusertext_20, Separators="|")
hold_8 = HoldingGate(Data=split_10)
strtoobj_4 = HBStringToObject(hb_str=hold_8)  # -> flatten(hb_obj); plug-in component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
ipy2_2 = IronPython2Script(materials=strtoobj_4)  # -> unique_materials; inputs materials: list
# ---------- ipy2_2: IronPython ----------
"""Grasshopper Script"""

unique_materials = []

for i in range(len(materials)):
    if materials[i] not in unique_materials:
        unique_materials.append(materials[i])
# ---------- end ipy2_2 ----------
clean_12 = CleanTree(RemoveNulls=True, RemoveInvalid=True, RemoveEmpty=False, Tree=ipy2_2)
created_materials_database_2 = RemoteSender(clean_12)

created_materials_database_3 = RemoteReceiver(created_materials_database_2)
item_43 = ListItem(List=created_materials_database_3, Index=create_construction_materials_sorted_2, Wrap=invert(True))
item_44 = ListItem(List=item_43, Index=create_construction_materials_3, Wrap=invert(True))
repeat_21 = RepeatData(Data=item_44, Length=visible_layers_2)  # -> flatten(Data)
cluster_22 = Cluster(materials=repeat_21, construction_name=create_construction_name_3, thicknesses=repeat_16)  # -> error_2, construction_2
create_construction_error = RemoteSender(cluster_22.error_2)

create_construction_error_2 = RemoteReceiver(create_construction_error)
panel_175 = Panel(create_construction_error_2)
split_11 = TextSplit(Text=create_construction_error_2, Separators=panel_108)
trim_2 = TextTrim(Text=split_11, Start=True, End=True)
item_45 = ListItem(List=trim_2, Index=0, Wrap=True)  # -> Item, Item1
lng_36 = ListLength(List=split_11)
len_5 = TextLength(Text=item_45.Item1)
larger_4 = LargerThan(FirstNumber=lng_36, SecondNumber="1")  # -> LargerThan, OrEqualTo
subtraction_7 = Subtraction(A=len_5, B=Slider(11, range=0..20))
fragment_5 = TextFragment(Text=item_45.Item1, Start="0", Count=subtraction_7)
filter_76 = StreamFilter(Gate=larger_4.LargerThan, Stream0=create_construction_error_2, Stream1=fragment_5)
entwine_146 = Entwine(Branch00=filter_76, Branch01=gate_51.Target1, FlattenInputs=True)  # -> flatten(Result)
panel_176 = Panel(filter_76)
item_46 = ListItem(List=entwine_146, Index=0, Wrap=True)
create_construction_error_message = RemoteSender(item_46)

create_construction_error_message_2 = RemoteReceiver(create_construction_error_message)
null_30 = NullItem(Item=create_construction_error_message_2)  # -> NullFlags, InvalidFlags, Description
filter_77 = StreamFilter(Gate=null_30.NullFlags, Stream0=create_construction_error_message_2, Stream1=" ")
filter_78 = StreamFilter(Gate=null_30.NullFlags, Stream0=Slider(500, range=0..1000), Stream1=Slider(1000000, range=0..1000000))
hideshow_54 = HideShowElement(ElementToHideShow=button_34, Show=True, Collapse=True, Disable=invert(null_30.NullFlags))
tooltip_17 = AttachTooltipToElement(ElementsToAttachTo=button_34, TooltipContent=filter_77, ShowDelay=filter_78, Duration=Slider(5000, range=0..10000))

gate_61 = StreamGate(Stream=cluster_22.construction_2, Gate=create_construction_2)  # -> Target0, Target1
objtostr_4 = HBObjectToString(hb_obj=gate_61.Target1)  # -> hb_str; plug-in component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
entwine_147 = Entwine(Branch00=getdocumentusertext_12, Branch01=objtostr_4, FlattenInputs=True)  # -> flatten(Result)
freeze_gate_68 = StreamFreezeGate(Data=entwine_147, PassingSwitch=create_construction_2, Freeze=False, Hold=False)
join_17 = TextJoin(Text=freeze_gate_68, Join="|")
setdocumentusertext_5 = Python3Script(
    key="Heath constructions",
    load_value=freeze_gate_40,
    remove_value=freeze_gate_48,
    add_value=join_17,
    update=sync_construction_database_2)  # -> out, done
# ---------- setdocumentusertext_5: Python ----------
import Rhino
import rhinoscriptsyntax as rs
import scriptcontext as sc

def modify_value(value):
    sc.doc = Rhino.RhinoDoc.ActiveDoc

    done = rs.SetDocumentUserText(key, value)
    return done

    sc.doc = ghdoc

if load_value:
    done = modify_value(load_value)

if add_value:
    done = modify_value(add_value)

if remove_value:
    done = modify_value(remove_value)
elif remove_value == False:
    done = modify_value(None)

if update:
    done = True
# ---------- end setdocumentusertext_5 ----------
getdocumentusertext_21 = Python3Script(run=setdocumentusertext_5.done, key="Heath constructions")  # -> json_string; same code as getdocumentusertext_17
split_12 = TextSplit(Text=getdocumentusertext_21, Separators="|")
hold_9 = HoldingGate(Data=split_12)
strtoobj_5 = HBStringToObject(hb_str=hold_9)  # -> flatten(hb_obj); plug-in component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
ipy2_3 = IronPython2Script(constructions=strtoobj_5)  # -> unique_constructions; inputs constructions: list
# ---------- ipy2_3: IronPython ----------
"""Grasshopper Script"""

unique_constructions = []

for i in range(len(constructions)):
    if constructions[i] not in unique_constructions:
        unique_constructions.append(constructions[i])
# ---------- end ipy2_3 ----------
clean_13 = CleanTree(RemoveNulls=True, RemoveInvalid=True, RemoveEmpty=False, Tree=ipy2_3)
created_constructions_database = RemoteSender(clean_13)
entwine_148 = Entwine(Branch00=clean_13, Branch01=clean, FlattenInputs=True)  # -> flatten(Result)
ipy2_4 = IronPython2Script(constructions=entwine_148)  # -> unique_constructions, overlap; inputs constructions: list
# ---------- ipy2_4: IronPython ----------
"""Grasshopper Script"""

unique_constructions = []
overlap = False

for i in range(len(constructions)):
    if constructions[i] not in unique_constructions:
        unique_constructions.append(constructions[i])
    else:
        overlap = True
# ---------- end ipy2_4 ----------
all_constructions_database_2 = RemoteSender(ipy2_4.unique_constructions)
overlap_constructions_2 = RemoteSender(ipy2_4.overlap)

panel_177 = Panel(strtoobj_5)
panel_178 = Panel(split_10)
panel_179 = Panel(entwine_148)
panel_180 = Panel(clean_12)

all_constructions_database_3 = RemoteReceiver(all_constructions_database_2)  # disabled
dumpobjects = HBDumpObjects(hb_objs=flatten(all_constructions_database_3), name=py3_34, folder=py3_33, dump=create_construction_4)  # -> report, hb_file; disabled; plug-in component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
panel_181 = Panel(dumpobjects.hb_file)  # disabled

setdocumentusertext_6 = Python3Script(
    key="Heath materials category",
    load_value=freeze_gate_50,
    remove_value=freeze_gate_67,
    add_value=join_11,
    update=sync_material_database_3)  # -> out, done; same code as setdocumentusertext_5

null_31 = NullItem(Item=setdocumentusertext_6.done)  # -> NullFlags, InvalidFlags, Description
filter_79 = StreamFilter(Gate=null_31.NullFlags, Stream0=setdocumentusertext_6.done, Stream1="False")
event_53 = EventGate(Data=filter_79)  # -> Data, IsNew

getdocumentusertext_22 = Python3Script(run=event_53.Data, key="Heath materials category")  # -> json_string; same code as getdocumentusertext_17
split_13 = TextSplit(Text=getdocumentusertext_22, Separators="|")
split_14 = TextSplit(Text=split_13, Separators=":")
hold_10 = HoldingGate(Data=split_14)
materials_category_2 = RemoteSender(hold_10)

panel_183 = Panel(hold_10)

# ==== cluster VisualiseProperties
number_of_decimals_room = ClusterInput()
face_attribute = ClusterInput()
honeybee_model = ClusterInput()
number_of_decimals_face = ClusterInput()
room_attribute = ClusterInput()
face_attribute_2 = Text(face_attribute)
honeybee_model_2 = Data(honeybee_model)
room_attribute_2 = Text(room_attribute)
number_of_decimals_face_2 = Number(number_of_decimals_face)
legendpar = LBLegendParameters(num_decimals=number_of_decimals_face_2)  # -> leg_par; plug-in component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
number_of_decimals_room_2 = Number(number_of_decimals_room)
legendpar_2 = LBLegendParameters(num_decimals=number_of_decimals_room_2)  # -> leg_par; plug-in component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
colorfaceattr = HBColorFaceAttributes(hb_objs=flatten(honeybee_model_2), attribute=face_attribute_2, legend_par=legendpar)  # -> mesh, legend, wire_frame, values, colors, vis_set; plug-in component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
colorroomattr = HBColorRoomAttributes(rooms_model=flatten(honeybee_model_2), attribute=room_attribute_2, legend_par=legendpar_2)  # -> mesh, legend, wire_frame, values, colors, vis_set; plug-in component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
visualised_face_attributes = Data([colorfaceattr.mesh, colorfaceattr.legend, colorfaceattr.wire_frame])
visualised_room_attributes = Data([colorroomattr.mesh, colorroomattr.legend, colorroomattr.wire_frame])
visualised_face_attributes_2 = ClusterOutput(visualised_face_attributes)
visualised_room_attributes_2 = ClusterOutput(visualised_room_attributes)

# ==== cluster AddDynamicShades
base_construction_set = ClusterInput()
setpoint = ClusterInput()
base_construction_set_2 = Data(base_construction_set)
decnstrconstrset = HBDeconstructConstructionSet(constr_set=base_construction_set_2)  # -> exterior_wall, exterior_roof, exposed_floor, ground_wall, ground_roof, ground_floor, window, skylight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; plug-in component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
setpoint_2 = Data(setpoint)
shademat = HBShadeMaterial(thickness=Slider(0.01, range=0..0.01), transmittance=Slider(0.4, range=0..1))  # -> mat; plug-in component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
windowconstrshd = HBWindowConstructionShade(
    name="Simple Glazing Window",
    win_constr=decnstrconstrset.window,
    shd_material=shademat,
    shd_location="Exterior",
    control_type=Slider(1, range=0..8),
    setpoint=setpoint_2)  # -> constr; plug-in component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
subfacesubset = HBSubfaceSubset(window=windowconstrshd, operable=windowconstrshd)  # -> subface_set; plug-in component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
constructionset = HBConstructionSet(base_constr_set=base_construction_set_2, subface_subset=subfacesubset)  # -> constr_set; plug-in component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
construction_set = Data(constructionset)
construction_set_2 = ClusterOutput(construction_set)

# ==== cluster Cluster
materials = ClusterInput()
materials_2 = Data(materials)
opaqueconstr = HBOpaqueConstruction(materials=materials_2)  # -> constr; plug-in component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
thicknesses = ClusterInput()
thicknesses_2 = Number(thicknesses)
decnstrconstr = HBDeconstructConstruction(constr=opaqueconstr)  # -> materials, layers, r_val_si, r_val_ip, u_fac_si, u_fac_ip, shgc, t_sol, t_vis; plug-in component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
nullrep = ReplaceNulls(Items=thicknesses_2, Replacements="0")  # -> Items, Count
construction_name = ClusterInput()
modify_layer_thicknesses = BrimstoneModifyThicknessesOfHoneybeeMaterials(hb_materials=decnstrconstr.materials, thicknesses=nullrep.Items)  # -> out, mod_materials; inputs hb_materials: list, thicknesses: list
# ---------- modify_layer_thicknesses: Python ----------
"""
Calculates embodied carbon for the elements of a Honeybee model if data is available
This component was inspired by the 'HB Color Face Attributes' component of Ladybug Tools 1.6.0

    Args:
        hb_materials: List of Honeybee materials which should get new thickness
        thicknesses: List of new material thicknesses

    Returns:
        mod_materials: Modified Honeybee materials
"""

import scriptcontext
#import brimstone

ghenv.Component.Message = ""#brimstone.globals.version

ghenv.Component.Name = 'Brimstone - Modify thicknesses of Honeybee materials'
ghenv.Component.NickName = 'Modify layer thicknesses'

try:  # import the core honeybee dependencies
    from honeybee_energy.material.opaque import EnergyMaterial
    from honeybee_energy.material.opaque import EnergyMaterialNoMass
except ImportError as e:
    raise ImportError('\nFailed to import honeybee:\n\t{}'.format(e))

def main(hb_materials, thicknesses):
    mod_materials = []
    assert len(hb_materials) == len(thicknesses), "Materials and thickness list must be of the same length"
    for (i, material) in enumerate(hb_materials):
        if not isinstance(material, EnergyMaterial):
            if isinstance(material, EnergyMaterialNoMass):
                mod_material = material.duplicate()
                mod_materials.append(mod_material)
            else:
                raise Exception("All materials must be valid Honeybee Energy Materials or Energy Materials (No Mass)")
        else: # if material is EnergyMaterial
            mod_material = material.duplicate()
            mod_material.thickness = thicknesses[i]
            mod_materials.append(mod_material)
    return mod_materials

if __name__ == "__main__":
    try:
        pass#flying = scriptcontext.sticky["brimstone_flying"]
    except:
        raise Exception("The 'Brimstone - Fly' component needs to exist on the canvas")
    mod_materials = main(hb_materials, thicknesses)
# ---------- end modify_layer_thicknesses ----------
construction_name_2 = Text(construction_name)
opaqueconstr_2 = HBOpaqueConstruction(name=construction_name_2, materials=modify_layer_thicknesses.mod_materials)  # -> constr; plug-in component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
error = Data(modify_layer_thicknesses.out)
error_2 = ClusterOutput(error)
construction = Data(opaqueconstr_2)
construction_2 = ClusterOutput(construction)

# ==== cluster Cluster_2
window_construction = ClusterInput()
window_construction_2 = Data(window_construction)
fly = BrimstoneFly()
# ---------- fly: Python ----------
"""This component sets up global information for Brimstone
    Inputs:
    Output:
        """

import Grasshopper
import sys
sys.path.append(Grasshopper.Folders.UserObjectFolders[0])

import brimstone
reload(brimstone)

import scriptcontext

ghenv.Component.Name = 'Brimstone - Fly!'
ghenv.Component.NickName = 'Fly!'

scriptcontext.sticky["brimstone_flying"] = 'true'
ghenv.Component.Message = brimstone.globals.version
# ---------- end fly ----------
subfacesubset = HBSubfaceSubset(window=window_construction_2)  # -> subface_set; plug-in component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
panel = Panel(subfacesubset)
constructionset = HBConstructionSet(subface_subset=subfacesubset)  # -> constr_set; plug-in component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
density_kg_m2 = ClusterInput()
gwp_a1_a3 = ClusterInput()
gwp_a4 = ClusterInput()
decnstrconstrset = HBDeconstructConstructionSet(constr_set=constructionset)  # -> exterior_wall, exterior_roof, exposed_floor, ground_wall, ground_roof, ground_floor, window, skylight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; plug-in component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
gwp_a1_a3_2 = Data(gwp_a1_a3)
gwp_a4_2 = Data(gwp_a4)
density_kg_m2_2 = Data(density_kg_m2)
add_life_cycle_info_construction = BrimstoneAddLifeCycleInfoToHoneybeeConstruction(hb_construction=decnstrconstrset.window, gwp_a1_a3=gwp_a1_a3_2, gwp_a4=gwp_a4_2, density=density_kg_m2_2)  # -> mod_construction
# ---------- add_life_cycle_info_construction: Python ----------
"""
Adds GWP info to a Honeybee Construction

    Args:
        hb_construction: Honeybee Construction to be updated
        gwp_a1_a3: GWP (A1-A3) [kg CO2eq/m2]
        gwp_a4: GWP (A4) [kg CO2eq/m2]
        gwp_a5_1: GWP (A5.1) [kg CO2eq/m2]

    Returns:
        mod_construction: Updated Honeybee Construction
"""

import scriptcontext
import brimstone
ghenv.Component.Message = brimstone.globals.version
import Grasshopper

ghenv.Component.Name = 'Brimstone - Add Life Cycle Info to Honeybee Construction'
ghenv.Component.NickName = 'Add Life Cycle Info (Construction)'

try:  # import the core honeybee dependencies
    from honeybee_energy.construction.window import WindowConstruction
    from honeybee_energy.construction.opaque import OpaqueConstruction
except ImportError as e:
    raise ImportError('\nFailed to import honeybee:\n\t{}'.format(e))

def main(hb_construction, gwp_a1_a3, gwp_a4, density):
    if not isinstance(hb_construction, WindowConstruction)\
        and not isinstance(hb_construction, OpaqueConstruction):
        raise Exception("Currently only Window and Opaque constructions are supported")
    mod_construction = hb_construction.duplicate()
    mod_construction.properties.gwp_a1_a3 = gwp_a1_a3
    mod_construction.properties.gwp_a4 = gwp_a4
    mod_construction.properties.conv_value = density
    return mod_construction

if __name__ == "__main__":
    try:
        flying = scriptcontext.sticky["brimstone_flying"]
    except:
        raise Exception("The 'Brimstone - Fly' component needs to exist on the canvas")
    mod_construction = main(hb_construction, gwp_a1_a3, gwp_a4, density)
# ---------- end add_life_cycle_info_construction ----------
panel_2 = Panel(decnstrconstrset.window)
updated_construction = Data(add_life_cycle_info_construction)
panel_3 = Panel(add_life_cycle_info_construction)
updated_construction_2 = ClusterOutput(updated_construction)

# ==== cluster WeatherVisualisation
target_geometry = ClusterInput()
run_direct_sun_hours_study = ClusterInput()
_1 = ClusterInput()
run_incident_radiation_study = ClusterInput()
run_weather_visualisation = ClusterInput()
target_geometry_2 = ClusterInput()
sky_mask_centre_point = ClusterInput()
run_weather_visualisation_2 = Boolean(run_weather_visualisation)
filter = StreamFilter(Gate=run_weather_visualisation_2, Stream1=_1)
epw_file_url = Data(filter)

# ---- group: Get weather data
downloadepw = LBDownloadWeather(weather_URL=epw_file_url)  # -> epw_file, stat_file, ddy_file; plug-in component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
falsestart = LBFalseStartToggle(False)
epwtoddy = LBEPWToDDY(weather_file=downloadepw.epw_file, write=falsestart)  # -> ddy_file; plug-in component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
importloc = LBImportLocation(epw_file=downloadepw.epw_file)  # -> location; plug-in component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
importstat = LBImportSTAT(stat_file=downloadepw.stat_file)  # -> location, ashrae_zone, koppen_zone, clear_dir_norm_rad, clear_diff_horiz_rad, ann_heat_dday_996, ann_heat_dday_990, ann_cool_dday_004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; plug-in component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
constrloc = LBConstructLocation(elevation=0)  # -> location; plug-in component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
importepw = LBImportEPW(epw_file=downloadepw.epw_file)  # -> location, dry_bulb_temperature, dew_point_temperature, relative_humidity, wind_speed, wind_direction, direct_normal_rad, diffuse_horizontal_rad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; plug-in component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
importddy = LBImportDDY(ddy_file=downloadepw.ddy_file)  # -> location, design_days; plug-in component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

# ----
panel = Panel(importloc)

# ---- group: Wind rose
analysisperiod = LBAnalysisPeriod(
    start_month=Slider(1, range=1..12),
    start_day=Slider(1, range=1..31),
    start_hour=Slider(0, range=0..23),
    end_month=Slider(12, range=1..12),
    end_day=Slider(31, range=1..31),
    end_hour=Slider(23, range=0..23))  # -> period, hoys, dates; plug-in component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
windrose = LBWindRose(data=importepw.wind_speed, wind_direction=importepw.wind_direction, show_calm=Toggle(True), period=analysisperiod.period)  # -> report, mesh, compass, orient_line, freq_line, windrose_line, legend, title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; plug-in component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

# ---- group: Sun path
analysisperiod_2 = LBAnalysisPeriod(
    start_month=Slider(1, range=1..12),
    start_day=Slider(1, range=1..31),
    start_hour=Slider(0, range=0..23),
    end_month=Slider(12, range=1..12),
    end_day=Slider(31, range=1..31),
    end_hour=Slider(23, range=0..23))  # -> period, hoys, dates; plug-in component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
panel_2 = Panel("a>24")
sunpath = LBSunPath(location=importloc, hoys=analysisperiod_2.hoys, scale=1, data=importepw.dry_bulb_temperature)  # -> report, vectors, altitudes, azimuths, hoys, sun_pts, analemma, daily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; plug-in component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
msphere = MeshSphere(Base=sunpath.sun_pts, Radius=Slider(3, range=0..10), UCount=10, VCount=20)

# ---- group: Graph data
timeop = LBTimeIntervalOperation(data=importepw.dry_bulb_temperature)  # -> daily, monthly, mon_per_hr; plug-in component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
legendpar = LBLegendParameters(
    min=Slider(-15, range=-15..30),
    max=Slider(25, range=0..100),
    num_decimals=Slider(0, range=0..100),
    larger_smaller=Toggle(True),
    vert_or_horiz=Toggle(False))  # -> leg_par; plug-in component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
monthlychart = LBMonthlyChart(data=timeop.daily)  # -> report, data_mesh, data_lines, col_lines, legend, borders, labels, y_title, title, vis_set; plug-in component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
hourlyplot = LBHourlyPlot(data=importepw.dry_bulb_temperature, z_dim=Slider(0, range=0..100), reverse_y=Toggle(True), legend_par=legendpar)  # -> report, mesh, legend, borders, labels, title, vis_set; plug-in component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

# ----
run_incident_radiation_study_2 = Boolean(run_incident_radiation_study)

# ---- group: Sky matrix and incident radiation
analysisperiod_3 = LBAnalysisPeriod(
    start_month=Slider(1, range=1..12),
    start_day=Slider(1, range=1..31),
    start_hour=Slider(0, range=0..23),
    end_month=Slider(12, range=1..12),
    end_day=Slider(31, range=1..31),
    end_hour=Slider(23, range=0..23))  # -> period, hoys, dates; plug-in component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
skymatrix = LBCumulativeSkyMatrix(
    location=importepw.location,
    direct_rad=importepw.direct_normal_rad,
    diffuse_rad=importepw.diffuse_horizontal_rad,
    hoys=analysisperiod_3.hoys,
    high_density=Toggle(False))  # -> report, sky_mtx; plug-in component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
context_geometry = Geometry(target_geometry)
target_geometry_3 = Geometry(target_geometry_2)
incidentradiation = LBIncidentRadiation(
    sky_mtx=skymatrix.sky_mtx,
    geometry=flatten(target_geometry_3),
    context=flatten(context_geometry),
    grid_size=Slider(1, range=0..1),
    offset_dist=Slider(0.1, range=0..0.1),
    run=run_incident_radiation_study_2)  # -> report, points, results, total, mesh, legend, title, int_mtx; plug-in component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
skydome = LBSkyDome(sky_mtx=skymatrix.sky_mtx)  # -> report, mesh, compass, legend, title, patch_vecs, patch_values, mesh_values, vis_set; plug-in component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

# ----
merge = Merge(
    Data1=windrose.mesh,
    Data2=windrose.compass,
    Data3=windrose.orient_line,
    Data4=windrose.freq_line,
    Data5=windrose.windrose_line,
    Data6=windrose.legend,
    Data7=windrose.title)
run_direct_sun_hours_study_2 = Boolean(run_direct_sun_hours_study)

# ---- group: Direct sun hours
toggle = BooleanToggle(True)
target_geometry_4 = Geometry(target_geometry_2)
context_geometry_2 = Geometry(target_geometry)
directsunhours = LBDirectSunHours(
    vectors=flatten(sunpath.vectors),
    geometry=flatten(target_geometry_4),
    context=flatten(context_geometry_2),
    grid_size=Slider(1, range=0..10),
    offset_dist=Slider(0.1, range=0..1),
    run=run_direct_sun_hours_study_2)  # -> report, points, results, mesh, legend, title, int_mtx; plug-in component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

# ---- group: Sky mask
sky_mask_centre_point_2 = Point(sky_mask_centre_point)
symask = LBSkyMask(
    context=context_geometry_2,
    density=Slider(3, range=0..10),
    center=sky_mask_centre_point_2,
    scale=Slider(0.1, range=0..1))  # -> report, context_mask, orient_mask, strategy_mask, sky_mask, context_view, orient_view, strategy_view, sky_view; plug-in component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

# ----
merge_2 = Merge(Data1=skydome.mesh, Data2=skydome.compass, Data3=skydome.legend, Data4=skydome.title)  # -> flatten(SkyDome)
merge_3 = Merge(
    Data1=monthlychart.data_mesh,
    Data2=monthlychart.legend,
    Data3=monthlychart.borders,
    Data4=monthlychart.labels,
    Data5=monthlychart.y_title,
    Data6=monthlychart.title)  # -> flatten(DryBulbTemperatureLineChart)
merge_4 = Merge(Data1=incidentradiation.mesh, Data2=incidentradiation.legend, Data3=incidentradiation.title)  # -> flatten(IncidentRadiation)
merge_5 = Merge(
    Data1=hourlyplot.mesh,
    Data2=hourlyplot.legend,
    Data3=hourlyplot.borders,
    Data4=hourlyplot.labels,
    Data5=hourlyplot.title)
sky_dome = ClusterOutput(merge_2)
wind_rose = ClusterOutput(merge)
dry_bulb_temperature_line_chart = ClusterOutput(merge_3)
dry_bulb_temperature_2d_chart = ClusterOutput(merge_5)
direct_sun_hours = Merge(Data1=directsunhours.mesh, Data2=directsunhours.legend, Data3=directsunhours.title)  # -> flatten(DirectSunHours)
direct_sun_hours_2 = ClusterOutput(direct_sun_hours)
incident_radiation = ClusterOutput(merge_4)
merge_6 = Merge(Data1=symask.context_mask, Data2=symask.sky_mask)
sky_mask = ClusterOutput(merge_6)

# ==== cluster Cluster_3
min = ClusterInput()
max = ClusterInput()
colors = ClusterInput()
legendpar = LBLegendParameters(min=min, max=max, colors=colors)  # -> leg_par; plug-in component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
leg_par = ClusterOutput(legendpar)

# ==== cluster Cluster_4
int = ClusterInput()
number_slider = Slider(2, range=0..10)
int_2 = Integer(int)
fragment = TextFragment(Text=int_2, Start="0", Count=number_slider)
fragment_2 = TextFragment(Text=int_2, Start=number_slider)
len = TextLength(Text=fragment_2)
addition = Addition(A=fragment, B="1")
equals = Equality(FirstNumber="0", SecondNumber=fragment)  # -> Equality, Inequality
filter = StreamFilter(Gate=equals.Equality, Stream0=addition, Stream1=fragment)
_10º = PowerOf10(Value=len)
multiplication = Multiplication(A=_10º, B=filter)
R = ClusterOutput(multiplication)

# ==== cluster Cluster_5
x = ClusterInput()
abs = Absolute(Value=x)
number_slider = Slider(2, range=0..10)
int = Integer(abs)
fragment = TextFragment(Text=int, Start="0", Count=number_slider)
fragment_2 = TextFragment(Text=int, Start=number_slider)
equals = Equality(FirstNumber="0", SecondNumber=fragment)  # -> Equality, Inequality
len = TextLength(Text=fragment_2)
addition = Addition(A=fragment, B="1")
filter = StreamFilter(Gate=equals.Equality, Stream0=addition, Stream1=fragment)
_10º = PowerOf10(Value=len)
multiplication = Multiplication(A=_10º, B=filter)
neg = Negative(Value=multiplication)
y = ClusterOutput(neg)

# ==== cluster Cluster_6
legendpar = LBLegendParameters(min=Slider(0, range=0..100), max=Slider(100, range=0..100), num_decimals=Slider(0, range=0..100))  # -> leg_par; plug-in component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
leg_par = ClusterOutput(legendpar)
