# Grasshopper definition heathUI_0.5.1-dev.gh (Grasshopper 1.0.8)
# plug-ins: RhinoCodePluginGH, Heteroptera, Human UI, Pufferfish, Human, LadybugGrasshopper, MetaHopper, eleFront, Wombat, Telepathy

# ----
# Click here
button = Button()
restart_heath = RemoteSender(button)

# ----
# Sends signal when recompute
panel = Panel("recompute")
button_2 = CreateButton(ButtonName=panel, ButtonStyle=0)
values = ValueListener(Elements=button_2, SomeProperty=True)  # -> Values, Indices
freeze_gate = StreamFreezeGate(Data=values.Values, PassingSwitch=invert(values.Values))
bool = Boolean(invert(freeze_gate))
tap = TapBuffer(Reset=False, Incremental=True, Valve=bool, Hold=True)
dam = DataDam(DataA=tap, BufferDelay=2500000, BufferMode=2)
equals = Equality(FirstNumber=tap, SecondNumber=dam)  # -> Equality, Inequality
event = EventGate(Data=equals.Inequality)  # -> Data, IsNew
recompute = RemoteSender(event.Data)

# ----
# CLICK BUTTON
# TO RESTART
# HEATH
number_slider = Slider(500, range=0..1000)
selobj = GetSelectedObjects()  # -> ComponentObjects, ParamObjects, OtherObjects
# Color codes
# UI module elements
# UI launch windows
# Front-end database
# Back-end database
setscribble = SetScribbleProperties(Scribble=selobj.OtherObjects, ScribbleSize=number_slider)

pulldown = CreatePulldownMenu(Label="Select simulation", showLabel=True)
values_2 = ValueListener(Elements=pulldown, SomeProperty=True)  # -> Values, Indices
current_selected_simulation = RemoteSender(values_2.Indices)
recompute_2 = RemoteReceiver(recompute)
recompute_3 = RemoteReceiver(recompute)
panel_2 = Panel("""False
True""")
panel_3 = Panel("""False
True""")
format = Format(
    Format="{0}, {1}, 0, {2}",
    Culture=127,
    Data0=Slider(5, range=-25..25),
    Data1=Slider(5, range=0..100),
    Data2=Slider(3, range=0..100))
adjustpos = AdjustElementPositioning(
    ElementsToAdjust=pulldown,
    Margin=format,
    AbsolutePositioning=False,
    Width=Slider(215, range=0..220),
    HorizontalAlignment=0,
    VerticalAlignment=2)

# ----
# Louvers
location = Data()

# ----
# Create construction
# For user to interact with
# Testing
# Needs work...
panel_4 = Panel("gypsum")
number_slider_2 = Slider(0.3, range=0..1)
searchmats = HBSearchMaterials(keywords="insulation")  # -> opaque_mats, window_mats; plug-in component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
searchmats_2 = HBSearchMaterials(keywords="concrete")  # -> opaque_mats, window_mats; plug-in component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
searchmats_3 = HBSearchMaterials()  # -> opaque_mats, window_mats; plug-in component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
searchmats_4 = HBSearchMaterials(keywords="air")  # -> opaque_mats, window_mats; plug-in component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
searchmats_5 = HBSearchMaterials(keywords="plywood")  # -> opaque_mats, window_mats; plug-in component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
searchmats_6 = HBSearchMaterials(keywords=panel_4)  # -> opaque_mats, window_mats; plug-in component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
searchconstrs = HBSearchConstructions()  # -> opaque_constrs, window_constrs, shade_constrs; plug-in component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
searchconstrs_2 = HBSearchConstructions()  # -> opaque_constrs, window_constrs, shade_constrs; plug-in component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
list = ItemSelector(
    searchmats.opaque_mats,
    {"AtticFloor Insulation", "Generic 25mm Insulation", "Generic 50mm Insulation", "I01 25mm insulation board", "I02 50mm insulation board", "IEAD NonRes Roof Insulation-1.76", "IEAD Roof Insulation R-3.47 IP", "Insulation 1m", "Mass NonRes Wall Insulation-0.43", "Mass Wall Insulation R-4.23 IP"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}, selected="AtticFloor Insulation")
list_2 = ItemSelector(
    searchmats_2.opaque_mats,
    {"100mm Normalweight concrete floor", "12 in. Normalweight Concrete Floor", "4 in. Normalweight Concrete Floor", "4 in. Normalweight Concrete Wall", "6 in. Heavyweight Concrete Roof", "6 in. Normalweight Concrete Floor", "8 in. Concrete Block Basement Wall", "8 in. Concrete Block Wall", "8 in. Normalweight Concrete Floor", "8 in. Normalweight Concrete Wall", "8IN CONCRETE HW RefBldg", "8IN Concrete HW", "Concrete Pavement", "Generic HW Concrete", "Generic LW Concrete", "HW CONCRETE", "HW CONCRETE 8 in", "M11 100mm lightweight concrete", "M15 200mm heavyweight concrete", "MAT-CC05 4 HW CONCRETE", "MAT-CC05 8 HW CONCRETE", "NACM_Concrete 4in_140lb/ft3"}, selected="100mm Normalweight concrete floor")
list_3 = ItemSelector(
    searchmats_6.opaque_mats,
    {"1/2 in. Gypsum Board", "1/2IN Gypsum", "5/8 in. Gypsum Board", "G01 13mm gypsum board", "G01a 19mm gypsum board", "Generic Gypsum Board", "Gypsum Board - 1/2 in. CBES", "Gypsum Or Plaster Board - 3/8 in.", "NACM_Gypsum Board 5/8in"}, selected="1/2 in. Gypsum Board")
list_4 = ItemSelector(
    searchmats_4.opaque_mats,
    {"F04 Wall air space resistance", "F05 Ceiling air space resistance", "Generic Ceiling Air Gap", "Generic Wall Air Gap", "Typical Air Wall"}, selected="F04 Wall air space resistance")
list_5 = ItemSelector(searchmats_5.opaque_mats, {"5/8 in. Plywood", "Plywood - 5/8 in. CBES"}, selected="5/8 in. Plywood")
number_slider_3 = Slider(0.3, range=0..1)
opaquemat = HBOpaqueMaterial(
    name="XPS insulation",
    thickness=number_slider_2,
    conductivity=Slider(0.036, range=0..0.1),
    density=Slider(28, range=0..100),
    spec_heat=Slider(1500, range=0..10000))  # -> mat; plug-in component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
list_6 = ItemSelector(
    searchconstrs.window_constrs,
    {"ASHRAE 189.1-2009 ExtWindow ClimateZone 1", "ASHRAE 189.1-2009 ExtWindow ClimateZone 2", "ASHRAE 189.1-2009 ExtWindow ClimateZone 3", "ASHRAE 189.1-2009 ExtWindow ClimateZone 4-5", "ASHRAE 189.1-2009 ExtWindow ClimateZone 6", "ASHRAE 189.1-2009 ExtWindow ClimateZone 7-8"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}, selected="U 0.17 SHGC 0.36 Simple Glazing Window")
list_7 = ItemSelector(
    searchconstrs_2.window_constrs,
    {"ASHRAE 189.1-2009 ExtWindow ClimateZone 1", "ASHRAE 189.1-2009 ExtWindow ClimateZone 2", "ASHRAE 189.1-2009 ExtWindow ClimateZone 3", "ASHRAE 189.1-2009 ExtWindow ClimateZone 4-5", "ASHRAE 189.1-2009 ExtWindow ClimateZone 6", "ASHRAE 189.1-2009 ExtWindow ClimateZone 7-8"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}, selected="ASHRAE 189.1-2009 ExtWindow ClimateZone 1")
merge = Merge(Data1=list_2, Data2=list_4, Data3=list_5, Data4=opaquemat, Data5=list_3)
merge_2 = Merge(
    Data1=Slider(0.1, range=0..1),
    Data2=Slider(0.11, range=0..1),
    Data3=Slider(0.016, range=0..0.1),
    Data4=number_slider_2,
    Data5=Slider(0.012, range=0..0.1))
interiorsubset = HBInteriorConstructionSubset()  # -> interior_set; plug-in component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
groundsubset = HBGroundConstructionSubset()  # -> ground_set; plug-in component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
cluster = Cluster(materials=merge, construction_name="Construction 1", thicknesses=merge_2)  # -> error_2, construction_2
bldgvintages = HBBuildingVintages({"ASHRAE 90.1 2019  |  IECC 2021": "2019", "ASHRAE 90.1 2016  |  IECC 2018": "2016", "ASHRAE 90.1 2013  |  IECC 2015": "2013", "ASHRAE 90.1 2010  |  IECC 2012": "2010", "ASHRAE 90.1 2007  |  IECC 2009": "2007", "ASHRAE 90.1 2004  |  IECC 2006": "2004", "1980-2004 (CBECS)": "1980_2004", "Pre-1980 (CBECS)": "pre_1980"}, selected="ASHRAE 90.1 2019  |  IECC 2021")
cluster_2 = Cluster_2(window_construction=list_7, gwp_a1_a3="2.5", gwp_a4="0.042", density_kg_m2="38.2")
decnstrconstr = HBDeconstructConstruction(constr=list_6)  # -> materials, layers, r_val_si, r_val_ip, u_fac_si, u_fac_ip, shgc, t_sol, t_vis; plug-in component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
constructiontypes = HBConstructionTypes({"SteelFramed", "WoodFramed", "Mass", "Metal Building"}, selected="WoodFramed")
climatezones = HBClimateZones({"1 - Very Hot": "1", "2 - Hot": "2", "3 - Warm": "3", "4 - Mixed": "4", "5 - Cool": "5", "6 - Cold": "6", "7 - Very Cold": "7", "8 - Subarctic": "8"}, selected="5 - Cool")
data = Data(cluster_2)
panel_5 = Panel(decnstrconstr.u_fac_ip)
panel_6 = Panel(decnstrconstr.u_fac_si)
exteriorsubset = HBExteriorConstructionSubset(exterior_wall=cluster.construction_2)  # -> exterior_set; plug-in component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
subfacesubset = HBSubfaceSubset(window=data)  # -> subface_set; plug-in component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
panel_7 = Panel(cluster.construction_2)
constrsetclimate = HBConstructionSetByClimate(climate_zone=climatezones, vintage=bldgvintages, constr_type=constructiontypes)  # -> constr_set; plug-in component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
constructionset = HBConstructionSet(base_constr_set=constrsetclimate, exterior_subset=exteriorsubset, subface_subset=subfacesubset)  # -> constr_set; plug-in component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
decnstrconstrset = HBDeconstructConstructionSet(constr_set=constructionset)  # -> exterior_wall, exterior_roof, exposed_floor, ground_wall, ground_roof, ground_floor, window, skylight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; plug-in component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
panel_8 = Panel(decnstrconstrset.exterior_wall)

# ----
# Brimstone FLY!
fly = BrimstoneFly()
# ---------- fly: Python ----------
"""This component sets up global information for Brimstone
    Inputs:
    Output:
        """

import Grasshopper
import sys
sys.path.append(Grasshopper.Folders.UserObjectFolders[0])

import brimstone
reload(brimstone)

import scriptcontext

ghenv.Component.Name = 'Brimstone - Fly!'
ghenv.Component.NickName = 'Fly!'

scriptcontext.sticky["brimstone_flying"] = 'true'
scriptcontext.sticky["brimstone_kdb_hb_json"] = 'brimstone_data/230721klimatdatabas_hb_materials.json' # json which adds honeybee material info to klimatdatabas materials
scriptcontext.sticky["brimstone_hb_kdb_csv"] = 'brimstone_data/230728_HBKlimatdatabas.csv' # csv file which translates honeybee material names to klimatdatabas material names
ghenv.Component.Message = brimstone.globals.version
# ---------- end fly ----------

# ----
# Simplified Boverket data
number_slider_4 = Slider(6, range=0..10)
merge_3 = Merge(Data1=Slider(0.8, range=0..10), Data2=Slider(1.2, range=0..10), Data3=Slider(0.8, range=0..10))
merge_4 = Merge(Data1=number_slider_4, Data2=Slider(12, range=0..100), Data3=Slider(6, range=0..10))
python = GhPythonScript(sublist_lengths=merge_4, values=merge_3)  # -> out, out_list; inputs sublist_lengths: list of Int32, values: list
# ---------- python: Python ----------
"""Creates one list from a list of sublist lengths and the value to put in each sublist
    Inputs:
        sublist_lengths: sublist_lengths
        values: value in each sublist
    Output:
        a: The a output variable"""

__author__ = "sawen"
__version__ = "2024.05.24"

import rhinoscriptsyntax as rs

if not (len(sublist_lengths) == len(values)):
    raise Exception("sublist lengths and values must be the same size")

out_list = []

for i in range(len(sublist_lengths)):
    for j in range(int(sublist_lengths[i])):
        out_list.append(values[i])
# ---------- end python ----------
constantschedule = HBConstantSchedule(values=python.out_list, name="household_electricity")  # -> report, schedule, idf_text; plug-in component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

# ----
# Heath UI global settings
accent_colors = ValueList({"Amber", "Blue", "Brown", "Cobalt", "Crimson", "Cyan", "Emerald", "Green", "Indigo", "Lime", "Magenta", "Mauve", "Olive", "Orange", "Pink", "Purple", "Red", "Sienna", "Steel", "Taupe", "Teal", "Violet", "Yellow"}, selected="Brown")
heath_accent_color = RemoteSender(accent_colors)

heath_accent_color_2 = RemoteReceiver(heath_accent_color)
invbool = InvertBoolean(Boolean=Button())  # -> Inverted, Number
bool_2 = Boolean("False")

# ----
# Transparent window
panel_9 = Panel("Import geometry")
pickbtn = CreateRhinoPickButton(
    ButtonName=panel_9,
    Prompt="Please select geometry...",
    AllowMultiple=invert(True),
    AllowNone=True,
    Type=2,
    ButtonStyle=0)
values_3 = ValueListener(Elements=pickbtn, SomeProperty=True)  # -> Values, Indices
launchxpwin = LaunchTransparentWindow(Show=Toggle(False), Name="Control Window", Width=370, Height=400, ChildStatus=1, EnableHorizScroll=False)
addelems = AddElements(Window=launchxpwin, Elements=flatten(pickbtn), DoVLChecking=True)  # -> AddedElements, ElementNames
panel_10 = Panel(values_3.Values)

heath_accent_color_3 = RemoteReceiver(heath_accent_color)
heath_accent_color_4 = RemoteReceiver(heath_accent_color)
heath_accent_color_5 = RemoteReceiver(heath_accent_color)
heath_accent_color_6 = RemoteReceiver(heath_accent_color)
heath_accent_color_7 = RemoteReceiver(heath_accent_color)
heath_accent_color_8 = RemoteReceiver(heath_accent_color)
heath_accent_color_9 = RemoteReceiver(heath_accent_color)
heatcool = HBHeatCoolHVACTemplates({"Baseboard electric": "ElectricBaseboard", "Baseboard gas boiler": "BoilerBaseboard", "Baseboard central air source heat pump": "ASHPBaseboard", "Baseboard district hot water": "DHWBaseboard", "Direct evap coolers with baseboard electric": "EvapCoolers_ElectricBaseboard", "Direct evap coolers with baseboard gas boiler": "EvapCoolers_BoilerBaseboard"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}, selected="Residential heat pump with no cooling": "ResidentialHPNoCool")
py3 = Python3Script(x=Slider(10, range=0..10), y=Slider(10, range=0..10))  # -> out, a; inputs x: Int32, y: Int32
# ---------- py3: Python ----------
import Rhino.Geometry as rg

pts = []

for i in range (0,x):
    for j in range (0,y):
        pts.append(rg.Point2d(i,j))

a = pts
# ---------- end py3 ----------

# ----
# Modal UI locations
number_slider_5 = Slider(845, range=0..1000)
pt = ConstructPoint(XCoordinate=Slider(460, range=0..1000), YCoordinate=Slider(210, range=0..1000), ZCoordinate=0)
pt_2 = ConstructPoint(XCoordinate=Slider(65, range=0..1000), YCoordinate=Slider(210, range=0..1000), ZCoordinate=0)
pt_3 = ConstructPoint(XCoordinate=number_slider_5, YCoordinate=Slider(210, range=0..1000), ZCoordinate=0)
heath_window_location = RemoteSender(pt_2)
database_modal_location = RemoteSender(pt)
create_modal_location = RemoteSender(pt_3)

windowconstr = HBWindowConstruction()  # -> constr; plug-in component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
empty = EmptyObjectToEmptyBranch()
heath_accent_color_10 = RemoteReceiver(heath_accent_color)
heath_accent_color_11 = RemoteReceiver(heath_accent_color)
heath_accent_color_12 = RemoteReceiver(heath_accent_color)
heath_accent_color_13 = RemoteReceiver(heath_accent_color)

# ----
# Get Klimatdatabas data
list_8 = ValueList({"Swedish": "sv", "English": "en"}, selected="English")
list_9 = ValueList({"File": "file", "API": "api"}, selected="API")
get_categories = BrimstoneGetCategories(mode=list_9, language=list_8)  # -> out, json_data, categories, klimatdatabas_version
# ---------- get_categories: Python ----------
"""Gets Klimatdatabas from the Boverket API or a file, extracts json data, and resource category names
    Inputs:
        mode: api or file mode
        language: language of database to retrieve
        json_path: path to json file if file mode
    Output:
        json_data: json file as dictionary
        categories: Categories present in the database
        klimatdatabas_version: String representing the version of Klimatdatabas used"""

import scriptcontext
import brimstone
import Grasshopper
import os, io

ghenv.Component.Name = 'Brimstone - Get Categories'
ghenv.Component.NickName = 'Get Categories'
ver = brimstone.globals.version
ghenv.Component.Message = ver

import json

from System.Net import WebRequest
from System.IO import StreamReader
from System.Text import Encoding

def main(mode):    
    if mode == "file":
        json_file = brimstone.globals.kdb_json_path
        json_path = os.path.join(Grasshopper.Folders.UserObjectFolders[0], json_file)
        if not os.path.exists(json_path):
            raise Exception("Failed to open json file, it should reside in [UserComponents folder]/brimstone_data/")
        json_data = get_json_data_from_file(json_path)
    elif mode == "api":
        json_data = get_json_data_from_api()
    else:
        raise Exception("Mode {mode} not supported".format(mode = mode))
    
    categories = get_categories(json_data)
    version = json_data.get("Version") 
    
    return categories, json_data, version

def get_json_data_from_file(json_path):
    f = io.open(json_path, encoding='utf-8')
    json_data = json.load(f)
    return json_data
    
def get_json_data_from_api():
    version = "02.04.000"
    lng = language if language else "en"
    format = "json"

    url = "https://api.boverket.se/klimatdatabas/v2/get-all-resources/{version}/{language}/{format}".format(
        version=version, language=lng, format=format)
    
    request = WebRequest.Create(url)
    
    request.Method = "GET"
    request.Timeout = 5000
    #request.ContentType = "application/json"
    response = request.GetResponse()
    
    stream_reader = StreamReader(response.GetResponseStream())
    json_data = json.loads(stream_reader.ReadToEnd())
    return json_data
    
def get_categories(json_data):
    categories = []
    try:
        for metaCategory in json_data['Categories']:
            for cat in metaCategory["Children"]:
                categories.append(cat["Title"])
    except KeyError:
        raise Exception("Format of JSON data is not supported.")
    return categories

if __name__ == "__main__":
    if not scriptcontext.sticky["brimstone_flying"]:
        raise Exception("The 'Brimstone - Fly' component needs to exist on the canvas")
    categories, json_data, klimatdatabas_version = main(mode)
    json_data = [json_data] # need to put it in an array so GH understands it as a dictionary
# ---------- end get_categories ----------
list_10 = ItemSelector(
    get_categories.categories,
    {"Mineral materials", "Windows, doors and glass", "Paints and sealants", "Concrete", "Insulation", "Steel and other metals", "Blocks and tiles", "Building boards", "Waterproofing", "Solid woods", "Energy and fuel"}, selected="Mineral materials")
panel_11 = Panel(get_categories.klimatdatabas_version)

# ---- group: Request specific outputs
toggle = BooleanToggle(True)
simoutput = HBSimulationOutput(zone_energy_use=toggle, gains_and_losses=toggle, comfort_metrics=toggle, surface_energy_flow=toggle)  # -> report, sim_output; plug-in component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
simpar = HBSimulationParameter(output=simoutput.sim_output, timestep=6)  # -> sim_par; plug-in component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

# ----
objbynn = GetObjectByNickname(NickName="PeakLoads")
objbynn_2 = GetObjectByNickname(NickName="AnnualLoads")
objbynn_3 = GetObjectByNickname(NickName="PITView")
current_selected_simulation_2 = RemoteReceiver(current_selected_simulation)
objbynn_4 = GetObjectByNickname(NickName="AnnualDaylight")

# ----
# Recursion
panel_12 = Panel("LCA window status")
objbynn_5 = GetObjectByNickname(NickName=panel_12)
lca_window_status = Python3Script()  # -> status
# ---------- lca_window_status: Python ----------
status = False
# ---------- end lca_window_status ----------

# ----
# LCA pop-up window
number_slider_6 = Slider(19, range=0..100)
colrange = LBColorRange(index=number_slider_6)  # -> colors; plug-in component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
txt = Text(colrange)
pt_4 = Point(txt)
division = Division(A=pt_4, B="255")
len = TextLength(Text=division)
subtraction = Subtraction(A=len, B=Slider(2, range=0..10))
fragment = TextFragment(Text=division, Start="1", Count=subtraction)
panel_13 = Panel("C:\Users\Isac\Desktop\Toivo_Chalmers\heath\Icons\butterfly_heath.png")
database_modal_location_2 = RemoteReceiver(database_modal_location)
image = CreateImage(ImageSource=panel_13, ImageWidth=Slider(1100, range=0..1200), ImageHeight=Slider(500, range=0..1000))
pdecon = Deconstruct(Point=database_modal_location_2)  # -> XComponent, YComponent, ZComponent
subtraction_2 = Subtraction(A=pdecon.XComponent, B=Slider(100, range=0..100))
pt_5 = ConstructPoint(XCoordinate=subtraction_2, YCoordinate=pdecon.YComponent, ZCoordinate=0)

# ----
# Database constructions
exterior_wall = Data(0.2670918015)
interior_wall = Data(2.116723713)
exterior_roof = Data(0.1170909002)
interior_floor = Data(1.155238836)
exterior_floor = Data(0.1475301828)
ground = Data(0.8527343676)
expression = Expression(x=ground, Expression="Round(x, 2)")
expression_2 = Expression(x=exterior_floor, Expression="Round(x, 2)")
expression_3 = Expression(x=exterior_roof, Expression="Round(x, 2)")
expression_4 = Expression(x=interior_floor, Expression="Round(x, 2)")
expression_5 = Expression(x=interior_wall, Expression="Round(x, 2)")
expression_6 = Expression(x=exterior_wall, Expression="Round(x, 2)")
format_2 = Format(Format="{0} (U-factor: {1})", Culture=127, Data0="Generic", Data1=expression)
format_3 = Format(Format="{0} (U-factor: {1})", Culture=127, Data0="Generic", Data1=expression_2)
format_4 = Format(Format="{0} (U-factor: {1})", Culture=127, Data0="Generic", Data1=expression_3)
format_5 = Format(Format="{0} (U-factor: {1})", Culture=127, Data0="Generic", Data1=expression_4)
format_6 = Format(Format="{0} (U-factor: {1})", Culture=127, Data0="Generic", Data1=expression_5)
format_7 = Format(Format="{0} (U-factor: {1})", Culture=127, Data0="Generic", Data1=expression_6)

# ----
# Geometry module interface
# Attribute modification
# Preview geometry
# Geometry visibility settings
panel_14 = Panel("Polysurface")
constructiontype = RemoteReceiver()
saveconstruction = RemoteReceiver()

# ----
# Database windows
generic_u_value = Data(1.687787378)
generic_shgc = Data(0.4240807069)

# ----
# Create test model
building = Geometry([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])
adjacent_rooms_1 = Geometry([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])
ground_2 = Geometry(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)
site = Geometry([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])
panel_15 = Panel("""Heath::Test model::Rooms
Heath::Test model::Windows
Heath::Test model::Adjacent
Heath::Test model::Context""")
entwine = Entwine(Branch00="Room", Branch01="Window", Branch02="Adjacent", Branch03="Context", FlattenInputs=True)
merge_5 = Merge(Data1=ground_2, Data2=site, Data3=building, Data4=adjacent_rooms_1)
lng = ListLength(List=flatten(entwine))
ef_layer = EleFrontLayer(FullPath=panel_15)  # -> graft(Layer), FullPath, Hidden, Locked, DisplayColour, MaterialName, Linetype, PrintColour, PrintWidth
repeat = RepeatData(Data="Heath geometry type", Length=lng)  # -> graft(Data)
windows1 = Geometry([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])
room1 = Geometry(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)
adjacent_1 = Geometry([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])
context_1 = Geometry(merge_5)
ef_att = EleFrontAttributes(Keys=repeat, Values=entwine, Layer=ef_layer.Layer)  # -> Attributes, Keys, Values, Name, Layer, ColourSource, DisplayColour, MaterialSource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
entwine_2 = Entwine(Branch00=room1, Branch01=windows1, Branch02=adjacent_1, Branch03=context_1, FlattenInputs=True)
lng_2 = ListLength(List=entwine_2)
repeat_2 = RepeatData(Data=ef_att.Attributes, Length=lng_2)

# ----
# Database materials
panel_16 = Panel("{0} (conductivity: {1}, density: {2}, specific heat: {3})")

# ---- group: Assembly model
panel_17 = Panel("https://energyplus-weather.s3.amazonaws.com/europe_wmo_region_6/SWE/SWE_Goteborg.Landvetter.025260_IWEC/SWE_Goteborg.Landvetter.025260_IWEC.zip")
button_3 = CreateButton(ButtonName="Create model", ButtonStyle=0)
button_4 = CreateButton(ButtonName="Bake model", ButtonStyle=0)
pulldown_2 = CreatePulldownMenu(Label="Select model", showLabel=True)
checkbox = CreateCheckbox(Label="Doors", StartingValue=False)
checkbox_2 = CreateCheckbox(Label="Context", StartingValue=False)
checkbox_3 = CreateCheckbox(Label="Windows", StartingValue=False)
toggle_2 = CreateToggle(Default=False)
label = CreateLabel(LabelText="Generate windows using WWR [%]", LabelSize=12, Justification=0)
checkbox_4 = CreateCheckbox(Label="All", StartingValue=False)
slider = CreateSlider(
    Slider=Slider(30, range=5..95),
    SnapValue=Slider(5, range=0..10),
    ShowBounds=False,
    ShowTicks=True,
    ShowTooltip=True,
    ShowValLabel=True,
    showLabel=False)
checkbox_5 = CreateCheckbox(Label="Ground", StartingValue=False)
checkbox_6 = CreateCheckbox(Label="Floors", StartingValue=False)
textbox = CreateTextBox(Label="Model name", DefaultText="My model", UpdateButton=invert(True), showLabel=True)
label_2 = CreateLabel(LabelText="Show components", LabelSize=12, Justification=0)
slider_2 = CreateSlider(
    Slider=Slider(50, range=0..100),
    SnapValue=Slider(5, range=0..10),
    ShowBounds=False,
    ShowTicks=True,
    ShowTooltip=False,
    ShowValLabel=True,
    showLabel=False)
slider_3 = CreateSlider(
    Slider=Slider(50, range=0..100),
    SnapValue=Slider(5, range=0..10),
    ShowBounds=False,
    ShowTicks=True,
    ShowTooltip=False,
    ShowValLabel=True,
    showLabel=False)
slider_4 = CreateSlider(
    Slider=Slider(1, range=0..10),
    SnapValue=Slider(1, range=0..1),
    ShowBounds=False,
    ShowTicks=True,
    ShowTooltip=False,
    ShowValLabel=True,
    showLabel=False)
checkbox_7 = CreateCheckbox(Label="Roof", StartingValue=False)
label_3 = CreateLabel(LabelText="Louver depth", LabelSize=12, Justification=0)
label_4 = CreateLabel(LabelText="Distance between louvers", LabelSize=12, Justification=0)
label_5 = CreateLabel(LabelText="Number of louvers", LabelSize=12, Justification=0)
checkbox_8 = CreateCheckbox(Label="Walls", StartingValue=False)
slider_5 = CreateSlider(
    Slider=Slider(50, range=0..100),
    SnapValue=Slider(5, range=0..10),
    ShowBounds=False,
    ShowTicks=True,
    ShowTooltip=False,
    ShowValLabel=True,
    showLabel=False)
label_6 = CreateLabel(LabelText="Louver angle", LabelSize=12, Justification=0)
label_7 = CreateLabel(LabelText="Set location", LabelSize=12, Justification=0)
label_8 = CreateLabel(LabelText="Honeybee model", LabelSize=18, Justification=0)
textbox_2 = CreateTextBox(Label="Set location", DefaultText=panel_17, UpdateButton=True, showLabel=True)
button_5 = CreateButton(ButtonName="Get climate data", ButtonStyle=0)
values_4 = ValueListener(Elements=button_3, SomeProperty=True)  # -> Values, Indices
values_5 = ValueListener(Elements=pulldown_2, SomeProperty=True)  # -> Values, Indices
values_6 = ValueListener(Elements=button_4, SomeProperty=True)  # -> Values, Indices
values_7 = ValueListener(Elements=checkbox, SomeProperty=True)  # -> Values, Indices
values_8 = ValueListener(Elements=checkbox_2, SomeProperty=True)  # -> Values, Indices
values_9 = ValueListener(Elements=checkbox_3, SomeProperty=True)  # -> Values, Indices
values_10 = ValueListener(Elements=checkbox_4, SomeProperty=True)  # -> Values, Indices
values_11 = ValueListener(Elements=checkbox_5, SomeProperty=True)  # -> Values, Indices
values_12 = ValueListener(Elements=checkbox_6, SomeProperty=True)  # -> Values, Indices
values_13 = ValueListener(Elements=checkbox_7, SomeProperty=True)  # -> Values, Indices
values_14 = ValueListener(Elements=checkbox_8, SomeProperty=True)  # -> Values, Indices
current_selected_model = RemoteSender(values_5.Indices)
values_15 = ValueListener(Elements=slider_4, SomeProperty=True)  # -> Values, Indices
values_16 = ValueListener(Elements=slider_3, SomeProperty=True)  # -> Values, Indices
values_17 = ValueListener(Elements=slider_2, SomeProperty=True)  # -> Values, Indices
values_18 = ValueListener(Elements=slider_5, SomeProperty=True)  # -> Values, Indices
values_19 = ValueListener(Elements=button_5, SomeProperty=True)  # -> Values, Indices
values_20 = ValueListener(Elements=slider, SomeProperty=True)  # -> Values, Indices
panel_18 = Panel("https://energyplus-weather.s3.amazonaws.com/europe_wmo_region_6/SWE/SWE_Goteborg.Landvetter.025260_IWEC/SWE_Goteborg.Landvetter.025260_IWEC.zip")
values_21 = ValueListener(Elements=textbox_2, SomeProperty=True)  # -> Values, Indices
downloadepw = LBDownloadWeather(weather_URL=values_21.Values)  # -> epw_file, stat_file, ddy_file; plug-in component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
importepw = LBImportEPW(epw_file=downloadepw.epw_file)  # -> location, dry_bulb_temperature, dew_point_temperature, relative_humidity, wind_speed, wind_direction, direct_normal_rad, diffuse_horizontal_rad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; plug-in component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
decnstrloc = LBDeconstructLocation(location=importepw.location)  # -> name, latitude, longitude, time_zone, elevation; plug-in component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
tooltip = AttachTooltipToElement(ElementsToAttachTo=slider, TooltipContent="Doubleclick to input value", ShowDelay=500, Duration=2000)
values_22 = ValueListener(Elements=textbox, SomeProperty=True)  # -> Values, Indices
entwine_3 = Entwine(Branch00=label_3, Branch01=slider_2, FlattenInputs=True)  # -> flatten(Result)
entwine_4 = Entwine(Branch00=label_4, Branch01=slider_3, FlattenInputs=True)  # -> flatten(Result)
entwine_5 = Entwine(Branch00=label_5, Branch01=slider_4, FlattenInputs=True)  # -> flatten(Result)
entwine_6 = Entwine(Branch00=label_6, Branch01=slider_5, FlattenInputs=True)  # -> flatten(Result)
values_23 = ValueListener(Elements=toggle_2, SomeProperty=True)  # -> Values, Indices
distance_between_louvers = RemoteSender(values_16.Values)
louver_depth = RemoteSender(values_17.Values)
louver_angle = RemoteSender(values_18.Values)
number_of_louvers = RemoteSender(values_15.Values)
getclimatedata = RemoteSender(values_19.Values)
model_name = RemoteSender(values_22.Values)
panel_19 = Panel(values_22.Values)
entwine_7 = Entwine(Branch00=toggle_2, Branch01=slider, FlattenInputs=True)  # -> flatten(Result)
filter = StreamFilter(Gate=values_23.Values, Stream0="0", Stream1=values_20.Values)
stack = CreateStack(UIElements=entwine_3, Horizontal=invert(True))
stack_2 = CreateStack(UIElements=entwine_4, Horizontal=invert(True))
stack_3 = CreateStack(UIElements=entwine_5, Horizontal=invert(True))
null = NullItem(Item=decnstrloc.name)  # -> NullFlags, InvalidFlags, Description
stack_4 = CreateStack(UIElements=entwine_6, Horizontal=invert(True))
number_of_louvers_2 = RemoteReceiver(number_of_louvers)
number_of_louvers_3 = RemoteReceiver(number_of_louvers)
number_of_louvers_4 = RemoteReceiver(number_of_louvers)
division_2 = Division(A=filter, B="100")
stack_5 = CreateStack(UIElements=entwine_7, Horizontal=invert(True))
filter_2 = StreamFilter(Gate=null.NullFlags, Stream0=decnstrloc.name, Stream1="Could not find location")
filter_3 = StreamFilter(Gate=null.NullFlags, Stream0=ColourSwatch(SwatchColor=RGB(0, 0, 0)), Stream1=ColourSwatch(SwatchColor=RGB(255, 0, 0)))
filter_4 = StreamFilter(Gate=null.NullFlags, Stream0=values_21.Values, Stream1=panel_18)
generate_wwr = RemoteSender(division_2)
hideshow = HideShowElement(ElementToHideShow=slider, Show=values_23.Values, Collapse=invert(True), Disable=False)
entwine_8 = Entwine(Branch00=textbox_2, Branch01=button_5, FlattenInputs=True)  # -> flatten(Result)
hideshow_2 = HideShowElement(ElementToHideShow=stack, Show=number_of_louvers_2, Collapse=True, Disable=False)
hideshow_3 = HideShowElement(ElementToHideShow=stack_4, Show=number_of_louvers_4, Collapse=True, Disable=False)
hideshow_4 = HideShowElement(ElementToHideShow=stack_2, Show=number_of_louvers_3, Collapse=True, Disable=False)
format_8 = Format(Format="{0}, {1}, 0, 0", Culture=127, Data0=Slider(5, range=-25..25), Data1=Slider(8, range=0..100))
format_9 = Format(Format="Location: {0}", Culture=127, Data0=filter_2)
location_2 = RemoteSender(filter_4)
adjustpos_2 = AdjustElementPositioning(ElementsToAdjust=textbox_2, AbsolutePositioning=False, Width=Slider(200, range=0..1000), HorizontalAlignment=0)
stack_6 = CreateStack(UIElements=entwine_8, Horizontal=invert(True))
entwine_9 = Entwine(Branch00=label, Branch01=stack_5, FlattenInputs=True)  # -> flatten(Result)
entwine_10 = Entwine(Branch00=stack_3, Branch01=stack, Branch02=stack_2, Branch03=stack_4, FlattenInputs=True)  # -> flatten(Result)
entwine_11 = Entwine(Branch00=button_3, Branch01=button_4, FlattenInputs=True)  # -> flatten(Result)
adjustelem = AdjustElementAppearance(ElementsToAdjust=label_7, Foreground=filter_3)
setlabel = SetLabelContents(LabelToModify=label_7, NewLabelContents=format_9)
entwine_12 = Entwine(
    Branch00=label_2,
    Branch01=checkbox_4,
    Branch02=checkbox_8,
    Branch03=checkbox_7,
    Branch04=checkbox_6,
    Branch05=checkbox_5,
    Branch06=checkbox_3,
    Branch07=checkbox,
    Branch08=checkbox_2,
    FlattenInputs=True)  # -> flatten(Result)
adjustpos_3 = AdjustElementPositioning(
    ElementsToAdjust=pulldown_2,
    Margin=format_8,
    AbsolutePositioning=False,
    Width=Slider(180, range=0..200),
    HorizontalAlignment=0,
    VerticalAlignment=2)
entwine_13 = Entwine(Branch00=label_8, Branch01=textbox, FlattenInputs=True)  # -> flatten(Result)
stack_7 = CreateStack(UIElements=entwine_9, Horizontal=invert(True))
stack_8 = CreateStack(UIElements=entwine_12, Horizontal=invert(True))
adjustpos_4 = AdjustElementPositioning(ElementsToAdjust=label, Margin="0, 5, 0, 0", AbsolutePositioning=False, HorizontalAlignment=0, VerticalAlignment=2)
adjustpos_5 = AdjustElementPositioning(ElementsToAdjust=slider, Margin="10, 5, 0, 0", AbsolutePositioning=False, HorizontalAlignment=0, VerticalAlignment=2)
stack_9 = CreateStack(UIElements=entwine_13, Horizontal=invert(True))
entwine_14 = Entwine(Branch00=label_7, Branch01=stack_6, FlattenInputs=True)  # -> flatten(Result)
adjustpos_6 = AdjustElementPositioning(ElementsToAdjust=label_7, Margin="0, 5, 0, 0", AbsolutePositioning=False, HorizontalAlignment=0)
adjustpos_7 = AdjustElementPositioning(
    ElementsToAdjust=textbox,
    Margin="0, 5, 0, 10",
    AbsolutePositioning=False,
    Width=Slider(210, range=0..300),
    Height=Slider(30, range=0..300),
    HorizontalAlignment=0)
border = CreateBorder(
    UIElement=stack_8,
    BorderThickness=Slider(1, range=0..10),
    BorderColor=ColourSwatch(SwatchColor=RGB(217, 217, 217)),
    CornerRadius=Slider(2, range=0..10))
adjustpos_8 = AdjustElementPositioning(ElementsToAdjust=stack_6, AbsolutePositioning=False, Width=Slider(210, range=0..1000), HorizontalAlignment=0)
adjustpos_9 = AdjustElementPositioning(ElementsToAdjust=entwine_11, Margin="5, 20, 0, 0", AbsolutePositioning=False, HorizontalAlignment=0)
stack_10 = CreateStack(UIElements=entwine_10, Horizontal=True)
stack_11 = CreateStack(UIElements=entwine_11, Horizontal=True)
adjustpos_10 = AdjustElementPositioning(ElementsToAdjust=border, Margin="25, 5, 0, 0", AbsolutePositioning=False, HorizontalAlignment=0, VerticalAlignment=2)

# ----
rec = DataRecorder(values_4.Values, DataLimit=-10, RecordData=True)
rec_2 = DataRecorder(values_6.Values, DataLimit=-10, RecordData=True)
int = Integer(rec)
int_2 = Integer(rec_2)
ma = MassAddition(Input=int)  # -> Result, PartialResults
ma_2 = MassAddition(Input=int_2)  # -> Result, PartialResults
event_2 = EventGate(Data=ma.Result)  # -> Data, IsNew
event_3 = EventGate(Data=ma_2.Result)  # -> Data, IsNew
dam_2 = DataDam(DataA=event_2.Data, BufferDelay=2500000, BufferMode=2)
dam_3 = DataDam(DataA=event_3.Data, BufferDelay=2500000, BufferMode=2)
equals_2 = Equality(FirstNumber=event_2.Data, SecondNumber=dam_2)  # -> Equality, Inequality
equals_3 = Equality(FirstNumber=event_3.Data, SecondNumber=dam_3)  # -> Equality, Inequality
adjustpos_11 = AdjustElementPositioning(
    ElementsToAdjust=button_5,
    Margin="5, 0, 0, 0",
    AbsolutePositioning=False,
    Width=Slider(200, range=0..1000),
    HorizontalAlignment=0)
event_4 = EventGate(Data=equals_2.Inequality)  # -> Data, IsNew
event_5 = EventGate(Data=equals_3.Inequality)  # -> Data, IsNew

# ----
# Visualize model
location_3 = Data(border)

# ----
# Location
location_4 = Data(entwine_14)

# ----
# Model name
model_name_2 = Data(stack_9)

# ----
# Generate using WWR
location_5 = Data(stack_7)

# ----
# Get climate data
# https://energyplus-weather.s3.amazonaws.com/europe_wmo_region_6/SWE/SWE_Goteborg.Landvetter.025260_IWEC/SWE_Goteborg.Landvetter.025260_IWEC.zip
getclimatedata_2 = RemoteReceiver(getclimatedata)
location_6 = RemoteReceiver(location_2)
panel_20 = Panel(getclimatedata_2)
epwmap = LBEPWmap(epw_map=getclimatedata_2)  # -> report; plug-in component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

current_selected_model_2 = RemoteReceiver(current_selected_model)
location_7 = RemoteReceiver(location_2)
location_8 = RemoteReceiver(location_2)
location_9 = RemoteReceiver(location_2)
location_10 = RemoteReceiver(location_2)
location_11 = RemoteReceiver(location_2)

# ---- group: Geometry module
panel_21 = Panel("""This document is currently in {0}.
Honeybee models require models in meters.""")
panel_22 = Panel("""None
Room
Window
Adjacent
Context
All""")
panel_23 = Panel("""Room
Window
Adjacent
Context
None""")
panel_24 = Panel("""Could not save geometry. 
It was not of the correct type.""")
number_slider_7 = Slider(15, range=0..20)
number_slider_8 = Slider(15, range=0..20)
number_slider_9 = Slider(15, range=0..20)
number_slider_10 = Slider(15, range=0..20)
number_slider_11 = Slider(10, range=0..10)
number_slider_12 = Slider(10, range=0..10)
number_slider_13 = Slider(10, range=0..10)
number_slider_14 = Slider(10, range=0..10)
button_6 = CreateButton(ButtonName="Change document units", ButtonStyle=0)
tb = CreateTextBlock(TextSize=12, Justification=0)
label_9 = CreateLabel(LabelText="Import geometry", LabelSize=18, Justification=0)
listbox = CreateListBox(ListItems=panel_22, SelectedIndex=0, Height=100)
label_10 = CreateLabel(LabelText="Preview geometry", LabelSize=18, Justification=0)
pulldown_3 = CreatePulldownMenu(Label="Geometry type", ListItems=panel_23, showLabel=True)
true_button = CreateTrueOnlyButton(ButtonName="?", ButtonStyle=2)
button_7 = CreateButton(ButtonName="Save geometry", ButtonStyle=0)
pt_6 = ConstructPoint(XCoordinate=Slider(10, range=0..10), YCoordinate=Slider(-20, range=-100..0), ZCoordinate=0)
pt_7 = ConstructPoint(XCoordinate=Slider(10, range=0..10), YCoordinate=Slider(-20, range=-100..0), ZCoordinate=0)
pt_8 = ConstructPoint(XCoordinate=Slider(10, range=0..10), YCoordinate=Slider(-20, range=-100..0), ZCoordinate=0)
pt_9 = ConstructPoint(XCoordinate=Slider(10, range=0..10), YCoordinate=Slider(-20, range=-100..0), ZCoordinate=0)
label_11 = CreateLabel(LabelText=panel_24, LabelSize=12, Justification=0)
button_8 = CreateButton(ButtonName="Create test model", ButtonStyle=0)
values_24 = ValueListener(Elements=listbox, SomeProperty=True)  # -> Values, Indices
rectangle = Rectangle(Plane=PlaneXY(0, 0, 0), XSize=number_slider_13, YSize=number_slider_13, Radius=0)  # -> Rectangle, Length
rectangle_2 = Rectangle(Plane=PlaneXY(0, 0, 0), XSize=number_slider_12, YSize=number_slider_12, Radius=0)  # -> Rectangle, Length
rectangle_3 = Rectangle(Plane=pt_6, XSize=number_slider_9, YSize=number_slider_9, Radius=0)  # -> Rectangle, Length
rectangle_4 = Rectangle(Plane=pt_7, XSize=number_slider_8, YSize=number_slider_8, Radius=0)  # -> Rectangle, Length
rectangle_5 = Rectangle(Plane=PlaneXY(0, 0, 0), XSize=number_slider_14, YSize=number_slider_14, Radius=0)  # -> Rectangle, Length
values_25 = ValueListener(Elements=button_6, SomeProperty=True)  # -> Values, Indices
rectangle_6 = Rectangle(Plane=pt_8, XSize=number_slider_10, YSize=number_slider_10, Radius=0)  # -> Rectangle, Length
rectangle_7 = Rectangle(Plane=PlaneXY(0, 0, 0), XSize=number_slider_11, YSize=number_slider_11, Radius=0)  # -> Rectangle, Length
rectangle_8 = Rectangle(Plane=pt_9, XSize=number_slider_7, YSize=number_slider_7, Radius=0)  # -> Rectangle, Length
values_26 = ValueListener(Elements=pulldown_3, SomeProperty=True)  # -> Values, Indices
values_27 = ValueListener(Elements=true_button, SomeProperty=True)  # -> Values, Indices
number_slider_15 = Slider(29, range=0..300)
values_28 = ValueListener(Elements=button_7, SomeProperty=True)  # -> Values, Indices
values_29 = ValueListener(Elements=button_8, SomeProperty=True)  # -> Values, Indices
shapes = CreateShapes(Shapes=rectangle.Rectangle, StrokeColor=RGB(0, 0, 0), Scale=1, ClickMode=3)
shapes_2 = CreateShapes(Shapes=rectangle_2.Rectangle, StrokeColor=RGB(0, 0, 0), Scale=1, ClickMode=3)
shapes_3 = CreateShapes(Shapes=rectangle_5.Rectangle, StrokeColor=RGB(0, 0, 0), Scale=1, ClickMode=3)
shapes_4 = CreateShapes(Shapes=rectangle_7.Rectangle, StrokeColor=RGB(0, 0, 0), Scale=1, ClickMode=3)
previewtype = RemoteSender(values_24.Values)
change_document_units = RemoteSender(values_25.Values)
bool_3 = Boolean(values_24.Indices)
geometrytype_validate = RemoteSender(values_26.Indices)
geometrytype = RemoteSender(values_26.Values)
geometry_module_state_import_type = RemoteSender(values_26.Indices)
adjustelem_2 = AdjustElementAppearance(ElementsToAdjust=tb, Foreground=ColourSwatch(SwatchColor=RGB(0, 0, 0)))
info_save_geometry = RemoteSender(values_27.Values)
adjustelem_3 = AdjustElementAppearance(
    ElementsToAdjust=true_button,
    Foreground=ColourSwatch(SwatchColor=RGB(0, 0, 0)),
    Background=ColourSwatch(SwatchColor=RGB(230, 230, 230)),
    FontSize=Slider(12, range=0..300))
freeze_gate_2 = StreamFreezeGate(Data=values_28.Values, PassingSwitch=invert(values_28.Values))
presavegeometry = RemoteSender(values_28.Values)
freeze_gate_3 = StreamFreezeGate(Data=values_29.Values, PassingSwitch=invert(values_29.Values))
bool_4 = Boolean(invert(freeze_gate_2))
adjustpos_12 = AdjustElementPositioning(ElementsToAdjust=true_button, AbsolutePositioning=False, Width=number_slider_15, Height=number_slider_15)
bool_5 = Boolean(invert(freeze_gate_3))
entwine_15 = Entwine(Branch00=button_7, Branch01=true_button, FlattenInputs=True)  # -> flatten(Result)
setshapes = SetShapes(
    ShapeToModify=shapes,
    ShapeCurves=rectangle_3.Rectangle,
    FillColors=ColourSwatch(SwatchColor=RGBA(128, 0, 102, 75)),
    StrokeColors=ColourSwatch(SwatchColor=RGB(255, 255, 255)),
    Scale=1)
setshapes_2 = SetShapes(
    ShapeToModify=shapes_2,
    ShapeCurves=rectangle_4.Rectangle,
    FillColors=ColourSwatch(SwatchColor=RGBA(4, 128, 0, 75)),
    StrokeColors=ColourSwatch(SwatchColor=RGB(255, 255, 255)),
    Scale=1)
setshapes_3 = SetShapes(
    ShapeToModify=shapes_3,
    ShapeCurves=rectangle_6.Rectangle,
    FillColors=ColourSwatch(SwatchColor=RGBA(0, 17, 128, 75)),
    StrokeColors=ColourSwatch(SwatchColor=RGB(255, 255, 255)),
    Scale=1)
setshapes_4 = SetShapes(
    ShapeToModify=shapes_4,
    ShapeCurves=rectangle_8.Rectangle,
    FillColors=ColourSwatch(SwatchColor=RGBA(128, 125, 0, 75)),
    StrokeColors=ColourSwatch(SwatchColor=RGB(255, 255, 255)),
    Scale=1)
tap_2 = TapBuffer(Reset=False, Incremental=True, Valve=bool_4, Hold=True)
tap_3 = TapBuffer(Reset=False, Incremental=True, Valve=bool_5, Hold=True)
entwine_16 = Entwine(Branch00=tb, Branch01=button_6, FlattenInputs=True)  # -> flatten(Result)
stack_12 = CreateStack(UIElements=entwine_15, Horizontal=True)
dam_4 = DataDam(DataA=tap_2, BufferDelay=2500000, BufferMode=2)
dam_5 = DataDam(DataA=tap_3, BufferDelay=2500000, BufferMode=2)
stack_13 = CreateStack(UIElements=entwine_16, Horizontal=invert(True))
equals_4 = Equality(FirstNumber=tap_2, SecondNumber=dam_4)  # -> Equality, Inequality
entwine_17 = Entwine(Branch00=stack_12, Branch01=label_11, FlattenInputs=True)  # -> flatten(Result)
equals_5 = Equality(FirstNumber=tap_3, SecondNumber=dam_5)  # -> Equality, Inequality
format_10 = Format(Format="{0}, {1}, 0, 0", Culture=127, Data0=Slider(5, range=0..25), Data1=Slider(25, range=0..50))
adjustpos_13 = AdjustElementPositioning(ElementsToAdjust=button_8, Margin=format_10, AbsolutePositioning=False)
adjustpos_14 = AdjustElementPositioning(
    ElementsToAdjust=listbox,
    AbsolutePositioning=False,
    Width=Slider(150, range=0..300),
    Height=Slider(150, range=0..300),
    HorizontalAlignment=0)
# FLY!
# Simulations
# Metahopper recursions
# Launch website
entwine_18 = Entwine(Branch00=label_9, Branch01=pulldown_3, Branch02=entwine_17, FlattenInputs=True)  # -> flatten(Result)
adjustpos_15 = AdjustElementPositioning(ElementsToAdjust=button_6, AbsolutePositioning=False, Width=Slider(150, range=0..800), HorizontalAlignment=0)
adjustpos_16 = AdjustElementPositioning(ElementsToAdjust=stack_13, Margin="5, 5, 0, 0", AbsolutePositioning=False, Width=Slider(160, range=0..800))
entwine_19 = Entwine(Branch00=shapes_2, Branch01=shapes, Branch02=shapes_3, Branch03=shapes_4, FlattenInputs=True)  # -> flatten(Result)
stack_14 = CreateStack(UIElements=entwine_19, Horizontal=invert(True))
entwine_20 = Entwine(Branch00=stack_14, Branch01=listbox, FlattenInputs=True)  # -> flatten(Result)
stack_15 = CreateStack(UIElements=entwine_20, Horizontal=True)
border_2 = CreateBorder(
    UIElement=stack_13,
    BorderThickness=Slider(1, range=0..10),
    BorderColor=ColourSwatch(SwatchColor=RGB(255, 0, 0)),
    CornerRadius=Slider(1, range=0..10))
stack_16 = CreateStack(UIElements=entwine_18, Horizontal=invert(True))
entwine_21 = Entwine(Branch00=label_10, Branch01=stack_15, FlattenInputs=True)  # -> flatten(Result)
adjustpos_17 = AdjustElementPositioning(ElementsToAdjust=pulldown_3, AbsolutePositioning=False, Width=Slider(180, range=0..300), HorizontalAlignment=0)
adjustelem_4 = AdjustElementAppearance(ElementsToAdjust=label_11, Foreground=ColourSwatch(SwatchColor=RGB(255, 0, 0)))
adjustpos_18 = AdjustElementPositioning(ElementsToAdjust=stack_14, Margin="0, 26, 5, 0", AbsolutePositioning=False, HorizontalAlignment=0)
adjustpos_19 = AdjustElementPositioning(
    ElementsToAdjust=[shapes_4, shapes_3, shapes, shapes_2],
    Margin="0, 0, 0, 4",
    AbsolutePositioning=False,
    HorizontalAlignment=0)

# Document units
doc_units = DocumentUnits()
change_document_units_2 = RemoteReceiver(change_document_units)
document_units = RemoteSender(doc_units)
gate = StreamGate(Stream="4", Gate=change_document_units_2)  # -> Target0, Target1
unit_warning = UnitWarning(UnitSystem=gate.Target1)

# ----
# Preview
preview = Data(entwine_21)

# ----
# Document unit warning text
location_12 = Data(border_2)

# ----
# Model visualization
# Model creation
# Zoom and bake geometry
# Geometry handling
# Assign type
assign_type = Data(stack_16)

# ----
# Test model
location_13 = Data(button_8)

entwine_22 = Entwine(Branch00=assign_type, Branch01=location_12, FlattenInputs=True)  # -> flatten(Result)
stack_17 = CreateStack(UIElements=entwine_22, Horizontal=True)

presavegeometry_2 = RemoteReceiver(presavegeometry)
document_units_2 = RemoteReceiver(document_units)
document_units_3 = RemoteReceiver(document_units)
document_units_4 = RemoteReceiver(document_units)
document_units_5 = RemoteReceiver(document_units)
previewtype_2 = RemoteReceiver(previewtype)
previewtype_3 = RemoteReceiver(previewtype)
previewtype_4 = RemoteReceiver(previewtype)
previewtype_5 = RemoteReceiver(previewtype)
expression_7 = Expression(x=document_units_2, y="Meters", Expression="x=y")
expression_8 = Expression(x=previewtype_3, y="All", Expression="x=y")
expression_9 = Expression(x=document_units_3, y="Meters", Expression="x=y")
expression_10 = Expression(x="Room", y=previewtype_3, Expression="x=y")
geometrytype_2 = RemoteReceiver(geometrytype)
expression_11 = Expression(x=document_units_4, y="Meters", Expression="x=y")
expression_12 = Expression(x=previewtype_2, y="All", Expression="x=y")
expression_13 = Expression(x=document_units_5, y="Meters", Expression="x=y")
expression_14 = Expression(x="Context", y=previewtype_2, Expression="x=y")
expression_15 = Expression(x="Window", y=previewtype_5, Expression="x=y")
expression_16 = Expression(x=previewtype_5, y="All", Expression="x=y")
expression_17 = Expression(x="Adjacent", y=previewtype_4, Expression="x=y")
expression_18 = Expression(x=previewtype_4, y="All", Expression="x=y")
or = GateOr(A=expression_14, B=expression_12)
or_2 = GateOr(A=expression_10, B=expression_8)
or_3 = GateOr(A=expression_15, B=expression_16)
or_4 = GateOr(A=expression_17, B=expression_18)
gate_2 = StreamGate(Stream="Adjacent", Gate=or_4)  # -> Target0, Target1
gate_3 = StreamGate(Stream="Context", Gate=or)  # -> Target0, Target1
gate_4 = StreamGate(Stream="Room", Gate=or_2)  # -> Target0, Target1
gate_5 = StreamGate(Stream="Window", Gate=or_3)  # -> Target0, Target1
geometrytype_validate_2 = RemoteReceiver(geometrytype_validate)

# ---- group: Visualize module
panel_25 = Panel("""properties.energy.construction.display_name
properties.energy.construction.layers
properties.energy.construction.thickness
properties.energy.construction.mass_area_density
properties.energy.construction.area_heat_capacity
properties.energy.construction.r_value
properties.energy.construction.u_value
properties.energy.construction.u_factor
properties.energy.construction.shgc
properties.energy.r_factor
properties.energy.u_factor
properties.energy.shgc""")
panel_26 = Panel("""properties.energy.program_type.display_name
properties.energy.construction_set.display_name
properties.energy.is_conditioned
properties.energy.people.people_per_area
properties.energy.people.area_per_person
properties.energy.lighting.watts_per_area
properties.energy.electric_equipment.watts_per_area
properties.energy.gas_equipment.watts_per_area
properties.energy.service_hot_water.flow_per_area""")
panel_27 = Panel("""Sky dome
Sky mask
Wind rose
Dry bulb temperature line chart
Dry bulb temperature 2D chart
Direct sun hours
Incident radiation""")
panel_28 = Panel("""display_name
identifier
multiplier
exclude_floor_area
story
volume
floor_area
exposed_area
exterior_wall_area
exterior_aperture_area
average_floor_height""")
panel_29 = Panel("""display_name
identifier
boundary_condition
has_parent
parent
azimuth
altitude
area
perimeter
type
is_operable
is_glass""")
button_9 = CreateButton(ButtonName="Run weather visualization", ButtonStyle=0)
button_10 = CreateButton(ButtonName="Zoom", ButtonStyle=0)
button_11 = CreateButton(ButtonName="Bake", ButtonStyle=0)
label_12 = CreateLabel(LabelText="Weather visualization", LabelSize=18, Justification=0)
values_30 = ValueListener(Elements=button_10, SomeProperty=True)  # -> Values, Indices
values_31 = ValueListener(Elements=button_11, SomeProperty=True)  # -> Values, Indices
values_32 = ValueListener(Elements=button_9, SomeProperty=True)  # -> Values, Indices
pulldown_4 = CreatePulldownMenu(Label="Display type", ListItems=panel_27, showLabel=True)
checkbox_9 = CreateCheckbox(Label="Visualize", StartingValue=False)
panel_30 = Panel("""Program
Construction Set
Is Conditioned
People per Area [ppl/m2]
Area per Person [m2/ppl]
Lighting per Area [W/m2]
Electric Equipment per Area [W/m2]
Gas Equipment per Area [W/m2]
Hot Water per Area [L/h-m2]""")
panel_31 = Panel("""Display Name
Simulation Name (Identifier)
Boundary Condition
Has Parent
Parent
Azimuth
Altitude
Area
Perimeter
Face Type
Aperture Is Operable
Door Is Glass""")
panel_32 = Panel("""Construction
Materials
Thickness [m]
Density [kg/m2]
Heat Capacity [J/K-m2]
Construction R-Value [m2-K/W]
Construction U-Value [W/m2-K]
Construction U-Factor [W/m2-K]
Construction SHGC [Unshaded]
R-Factor [m2-K/W]
U-Factor [W/m2-K]
SHGC [Unshaded]""")
panel_33 = Panel("""Display Name
Simulation Name (Identifier)
Multiplier
Floor Area Excluded
Story
Volume
Gross Floor Area
Exposed Area
Exterior Wall Area
Exterior Aperture Area
Average Floor Elevation""")
zoom_weather_visualization = RemoteSender(values_30.Values)
freeze_gate_4 = StreamFreezeGate(Data=values_31.Values, PassingSwitch=invert(values_31.Values))
freeze_gate_5 = StreamFreezeGate(Data=values_32.Values, PassingSwitch=invert(values_32.Values))
values_33 = ValueListener(Elements=checkbox_9, SomeProperty=True)  # -> Values, Indices
values_34 = ValueListener(Elements=pulldown_4, SomeProperty=True)  # -> Values, Indices
bool_6 = Boolean(invert(freeze_gate_4))
bool_7 = Boolean(invert(freeze_gate_5))
entwine_23 = Entwine(Branch00=pulldown_4, Branch01=checkbox_9, FlattenInputs=True)  # -> flatten(Result)
weather_visualization_type = RemoteSender(values_34.Indices)
tap_4 = TapBuffer(Reset=False, Incremental=True, Valve=bool_6, Hold=True)
tap_5 = TapBuffer(Reset=False, Incremental=True, Valve=bool_7, Hold=True)
stack_18 = CreateStack(UIElements=entwine_23, Horizontal=True)
pulldown_5 = CreatePulldownMenu(Label="Room attribute", ListItems=panel_33, showLabel=True)
pulldown_6 = CreatePulldownMenu(Label="Room energy attribute", ListItems=panel_30, showLabel=True)
checkbox_10 = CreateCheckbox(Label="Visualize", StartingValue=False)
checkbox_11 = CreateCheckbox(Label="Visualize", StartingValue=False)
label_13 = CreateLabel(LabelText="Model visualization", LabelSize=18, Justification=0)
checkbox_12 = CreateCheckbox(Label="Visualize", StartingValue=False)
pulldown_7 = CreatePulldownMenu(Label="Face attribute", ListItems=panel_31, showLabel=True)
dam_6 = DataDam(DataA=tap_4, BufferDelay=2500000, BufferMode=2)
dam_7 = DataDam(DataA=tap_5, BufferDelay=2500000, BufferMode=2)
entwine_24 = Entwine(Branch00=button_9, Branch01=button_10, Branch02=button_11, FlattenInputs=True)  # -> flatten(Result)
pulldown_8 = CreatePulldownMenu(Label="Face energy attribute", ListItems=panel_32, showLabel=True)
checkbox_13 = CreateCheckbox(Label="Visualize", StartingValue=False)
equals_6 = Equality(FirstNumber=tap_5, SecondNumber=dam_7)  # -> Equality, Inequality
equals_7 = Equality(FirstNumber=tap_4, SecondNumber=dam_6)  # -> Equality, Inequality
values_35 = ValueListener(Elements=checkbox_11, SomeProperty=True)  # -> Values, Indices
values_36 = ValueListener(Elements=pulldown_6, SomeProperty=True)  # -> Values, Indices
entwine_25 = Entwine(Branch00=pulldown_5, Branch01=checkbox_10, FlattenInputs=True)  # -> flatten(Result)
entwine_26 = Entwine(Branch00=pulldown_6, Branch01=checkbox_11, FlattenInputs=True)  # -> flatten(Result)
values_37 = ValueListener(Elements=pulldown_5, SomeProperty=True)  # -> Values, Indices
values_38 = ValueListener(Elements=pulldown_7, SomeProperty=True)  # -> Values, Indices
values_39 = ValueListener(Elements=checkbox_10, SomeProperty=True)  # -> Values, Indices
values_40 = ValueListener(Elements=checkbox_12, SomeProperty=True)  # -> Values, Indices
entwine_27 = Entwine(Branch00=pulldown_7, Branch01=checkbox_12, FlattenInputs=True)  # -> flatten(Result)
values_41 = ValueListener(Elements=pulldown_8, SomeProperty=True)  # -> Values, Indices
entwine_28 = Entwine(Branch00=pulldown_8, Branch01=checkbox_13, FlattenInputs=True)  # -> flatten(Result)
values_42 = ValueListener(Elements=checkbox_13, SomeProperty=True)  # -> Values, Indices
stack_19 = CreateStack(UIElements=entwine_24, Horizontal=True)
item = ListItem(List=panel_26, Index=values_36.Indices, Wrap=invert(True))
item_2 = ListItem(List=panel_28, Index=values_37.Indices, Wrap=invert(True))
stack_20 = CreateStack(UIElements=entwine_26, Horizontal=True)
item_3 = ListItem(List=panel_29, Index=values_38.Indices, Wrap=invert(True))
stack_21 = CreateStack(UIElements=entwine_25, Horizontal=True)
item_4 = ListItem(List=panel_25, Index=values_41.Indices, Wrap=invert(True))
stack_22 = CreateStack(UIElements=entwine_27, Horizontal=True)
stack_23 = CreateStack(UIElements=entwine_28, Horizontal=True)
room_energy_attribute = RemoteSender(item)
room_attribute = RemoteSender(item_2)
entwine_29 = Entwine(Branch00=stack_19, Branch01=stack_18, FlattenInputs=True)  # -> flatten(Result)
face_attribute = RemoteSender(item_3)
face_energy_attribute = RemoteSender(item_4)
stack_24 = CreateStack(UIElements=entwine_29, Horizontal=invert(True))
hideshow_5 = HideShowElement(ElementToHideShow=checkbox_10, Show=True, Collapse=True, Disable=values_35.Values)
hideshow_6 = HideShowElement(ElementToHideShow=checkbox_11, Show=True, Collapse=True, Disable=values_39.Values)
hideshow_7 = HideShowElement(ElementToHideShow=checkbox_12, Show=True, Collapse=True, Disable=values_42.Values)
hideshow_8 = HideShowElement(ElementToHideShow=checkbox_13, Show=True, Collapse=True, Disable=values_40.Values)
entwine_30 = Entwine(Branch00=label_13, Branch01=stack_21, Branch02=stack_20, Branch03=stack_22, Branch04=stack_23, FlattenInputs=True)  # -> flatten(Result)
border_3 = CreateBorder(
    UIElement=stack_24,
    BorderThickness=Slider(1, range=0..10),
    BorderColor=ColourSwatch(SwatchColor=RGB(217, 217, 217)),
    CornerRadius=Slider(2, range=0..10))
adjustpos_20 = AdjustElementPositioning(ElementsToAdjust=stack_24, AbsolutePositioning=False, Width=Slider(300, range=0..300), HorizontalAlignment=0)
adjustpos_21 = AdjustElementPositioning(ElementsToAdjust=pulldown_4, Margin="5, 5, 0, 0", AbsolutePositioning=False, Width=Slider(215, range=0..400))
adjustpos_22 = AdjustElementPositioning(ElementsToAdjust=checkbox_9, Margin="5, 5, 0, 0", AbsolutePositioning=False)
stack_25 = CreateStack(UIElements=entwine_30, Horizontal=invert(True))
adjustpos_23 = AdjustElementPositioning(
    ElementsToAdjust=[pulldown_5, pulldown_6, pulldown_7, pulldown_8],
    AbsolutePositioning=False,
    Width=Slider(239, range=0..400),
    HorizontalAlignment=0)
adjustpos_24 = AdjustElementPositioning(ElementsToAdjust=[checkbox_10, checkbox_11, checkbox_12, checkbox_13], Margin="0, 0, 10, 0", AbsolutePositioning=False)
adjustpos_25 = AdjustElementPositioning(ElementsToAdjust=border_3, AbsolutePositioning=False, HorizontalAlignment=0, VerticalAlignment=2)
border_4 = CreateBorder(
    UIElement=stack_25,
    BorderThickness=Slider(1, range=0..10),
    BorderColor=ColourSwatch(SwatchColor=RGB(217, 217, 217)),
    CornerRadius=Slider(2, range=0..10))
entwine_31 = Entwine(Branch00=label_13, Branch01=border_4, FlattenInputs=True)  # -> flatten(Result)
entwine_32 = Entwine(Branch00=label_12, Branch01=border_3, FlattenInputs=True)  # -> flatten(Result)
adjustpos_26 = AdjustElementPositioning(ElementsToAdjust=border_4, Margin="0, 0, 0, 10", AbsolutePositioning=False, HorizontalAlignment=0, VerticalAlignment=2)

# ----
# Run weather visualization
location_14 = Data(entwine_32)

# ----
# Attributes visualization
location_15 = Data(entwine_31)

# ---- group: Program module
panel_34 = Panel("""LargeOffice
MediumOffice
SmallOffice
MidriseApartment
HighriseApartment
Retail
StripMall
PrimarySchool
SecondarySchool
SmallHotel
LargeHotel
Hospital
Outpatient
Laboratory
Warehouse
SuperMarket
FullServiceRestaurant
QuickServiceRestaurant
Courthouse
LargeDataCenterHighITE
LargeDataCenterLowITE
SmallDataCenterHighITE
SmallDataCenterLowITE""")
cooling_setpoint_ºc = Slider(27, range=10..40)
heating_setpoint_ºc = Slider(21, range=10..40)
empty_2 = EmptyObjectToEmptyBranch()
pulldown_9 = CreatePulldownMenu(Label="Room type", ListItems=empty_2, showLabel=True)
label_14 = CreateLabel(LabelText="Select program", LabelSize=18, Justification=0)
label_15 = CreateLabel(LabelText="Program settings", LabelSize=18, Justification=0)
pulldown_10 = CreatePulldownMenu(Label="Building type", ListItems=panel_34, SelectedIndex="3", showLabel=True)
slider_6 = CreateSlider(Slider=cooling_setpoint_ºc, ShowBounds=False, ShowTicks=True, ShowTooltip=True, ShowValLabel=True, showLabel=False)
label_16 = CreateLabel(LabelText="Cooling setpoint [ºC]", LabelSize=12, Justification=0)
slider_7 = CreateSlider(Slider=heating_setpoint_ºc, ShowBounds=False, ShowTicks=True, ShowTooltip=False, ShowValLabel=True, showLabel=False)
label_17 = CreateLabel(LabelText="Heating setpoint [ºC]", LabelSize=12, Justification=0)
label_18 = CreateLabel(LabelText="Occupancy [persons/100 m2]", LabelSize=12, Justification=0)
slider_8 = CreateSlider(Slider=Slider(3, range=0..20), ShowBounds=False, ShowTicks=True, ShowTooltip=True, ShowValLabel=True, showLabel=False)
values_43 = ValueListener(Elements=pulldown_10, SomeProperty=True)  # -> Values, Indices
values_44 = ValueListener(Elements=pulldown_9, SomeProperty=True)  # -> Values, Indices
values_45 = ValueListener(Elements=slider_7, SomeProperty=True)  # -> Values, Indices
values_46 = ValueListener(Elements=slider_6, SomeProperty=True)  # -> Values, Indices
tooltip_2 = AttachTooltipToElement(ElementsToAttachTo=slider_7, TooltipContent="Doubleclick to input value", ShowDelay=500, Duration=2000)
values_47 = ValueListener(Elements=slider_8, SomeProperty=True)  # -> Values, Indices
tooltip_3 = AttachTooltipToElement(ElementsToAttachTo=slider_8, TooltipContent="Doubleclick to input value", ShowDelay=500, Duration=2000)
tooltip_4 = AttachTooltipToElement(ElementsToAttachTo=slider_6, TooltipContent="Doubleclick to input value", ShowDelay=500, Duration=2000)
selected_building = RemoteSender(values_43.Values)
selected_room = RemoteSender(values_44.Values)
cooling_setpoint = RemoteSender(values_46.Values)
cooling_setpoint_2 = RemoteReceiver(cooling_setpoint)
subtraction_3 = Subtraction(A=cooling_setpoint_2, B="1")
dom = ConstructDomain(DomainStart=Slider(10, range=0..100), DomainEnd=subtraction_3)
setslider = SetSlider(UISlider=slider_7, Range=dom)
heating_setpoint = RemoteSender(values_45.Values)
heating_setpoint_2 = RemoteReceiver(heating_setpoint)
addition = Addition(A=heating_setpoint_2, B="1")
dom_2 = ConstructDomain(DomainStart=addition, DomainEnd=Slider(40, range=0..100))
setslider_2 = SetSlider(UISlider=slider_6, Range=dom_2)
entwine_33 = Entwine(Branch00=label_16, Branch01=slider_6, FlattenInputs=True)  # -> flatten(Result)
entwine_34 = Entwine(Branch00=label_17, Branch01=slider_7, FlattenInputs=True)  # -> flatten(Result)
entwine_35 = Entwine(Branch00=label_18, Branch01=slider_8, FlattenInputs=True)  # -> flatten(Result)
number_slider_16 = Slider(300, range=0..350)
stack_26 = CreateStack(UIElements=entwine_34, Horizontal=invert(True))
stack_27 = CreateStack(UIElements=entwine_33, Horizontal=invert(True))
stack_28 = CreateStack(UIElements=entwine_35, Horizontal=invert(True))
format_11 = Format(Format="{0}, {1}, 0, 0", Culture=127, Data0=Slider(10, range=0..25), Data1=Slider(0, range=0..50))
entwine_36 = Entwine(Branch00=label_14, Branch01=pulldown_10, Branch02=pulldown_9, FlattenInputs=True)  # -> flatten(Result)
entwine_37 = Entwine(Branch00=label_15, Branch01=stack_27, Branch02=stack_26, Branch03=stack_28, FlattenInputs=True)  # -> flatten(Result)
adjustpos_27 = AdjustElementPositioning(ElementsToAdjust=pulldown_10, AbsolutePositioning=False, Width=number_slider_16, HorizontalAlignment=0)
adjustpos_28 = AdjustElementPositioning(ElementsToAdjust=pulldown_9, AbsolutePositioning=False, Width=number_slider_16, HorizontalAlignment=0)
adjustpos_29 = AdjustElementPositioning(
    ElementsToAdjust=[slider_8, slider_7, slider_6],
    Margin=format_11,
    AbsolutePositioning=False,
    Width=Slider(200, range=0..300),
    HorizontalAlignment=0)

# ----
division_3 = Division(A=values_47.Values, B="100")

# ----
# Select building and room program
location_16 = Data(entwine_36)

# ----
# Setpoints and occupancy
location_17 = Data(entwine_37)

# ---- group: Analysis module
# Energy simulation
# Detailed energy simulation
# Daylight simulation
# Glare probability
# LCA calculations
panel_35 = Panel("""Illuminance [Lux]
Daylight autonomy [%]
UDI [%]
UDI <50 [%]
UDI >3000 [%]
None""")
number_slider_17 = Slider(50, range=0..100)
panel_36 = Panel("Spatial daylight autonomy: {0}%")
panel_37 = Panel("""Annual energy balance
Daily cooling profile
Daily heating profile
Cooling balance
Heating balance
None""")
panel_38 = Panel("Daylight glare probability (DGP): {0} %")
panel_39 = Panel("""Annual energy balance
Daily cooling profile
Daily heating profile
Cooling balance
Heating balance
None""")
height = Slider(40, range=1..100)
width = Slider(5, range=1..100)
panel_40 = Panel("Total load EUI: {0} (kWh/m2)")
panel_41 = Panel("Total embodied GWP per area: {0} kg CO2eq/m2")
panel_42 = Panel("Total embodied GWP: {0} kg CO2eq")
panel_43 = Panel("Create a model in the assembly module to get a LCA")
panel_44 = Panel("Operational GWP total: {0} kg CO2eq/year")
width_2 = Slider(5, range=1..100)
height_2 = Slider(40, range=1..100)
panel_45 = Panel("Operational GWP total ({0} years): {1} kg CO2eq")
tb_2 = CreateTextBlock(TextSize=16, Justification=0)
button_12 = CreateButton(ButtonName="Bake", ButtonStyle=0)
button_13 = CreateButton(ButtonName="Zoom", ButtonStyle=0)
button_14 = CreateButton(ButtonName="Run energy simulation", ButtonStyle=0)
pulldown_11 = CreatePulldownMenu(Label="Display type", ListItems=panel_35, SelectedIndex="0", showLabel=True)
tb_3 = CreateTextBlock(Text="Simulations can take a few minutes...", TextSize=16, Justification=0)
tb_4 = CreateTextBlock(Text=panel_36, TextSize=16, Justification=0)
label_19 = CreateLabel(LabelText="Display settings", LabelSize=18, Justification=0)
tb_5 = CreateTextBlock(TextSize=16, Justification=0)
label_20 = CreateLabel(LabelText="Display settings", LabelSize=18, Justification=0)
tb_6 = CreateTextBlock(TextSize=16, Justification=0)
pulldown_12 = CreatePulldownMenu(Label="Display type", ListItems=panel_37, showLabel=True)
slider_9 = CreateSlider(
    Slider=width,
    SnapValue=Slider(2, range=0..10),
    ShowBounds=False,
    ShowTicks=True,
    ShowTooltip=False,
    ShowValLabel=False,
    showLabel=True)
true_button_2 = CreateTrueOnlyButton(ButtonName="Pop-up window", ButtonStyle=0)
slider_10 = CreateSlider(
    Slider=height,
    SnapValue=Slider(2, range=0..10),
    ShowBounds=False,
    ShowTicks=True,
    ShowTooltip=False,
    ShowValLabel=False,
    showLabel=True)
button_15 = CreateButton(ButtonName="Zoom", ButtonStyle=0)
button_16 = CreateButton(ButtonName="Run detailed energy simulation", ButtonStyle=0)
tb_7 = CreateTextBlock(Text="Simulations can take a few minutes...", TextSize=16, Justification=0)
tb_8 = CreateTextBlock(Text="Simulations can take a few minutes...", TextSize=16, Justification=0)
button_17 = CreateButton(ButtonName="Zoom", ButtonStyle=0)
button_18 = CreateButton(ButtonName="Run daylight simulation", ButtonStyle=0)
true_button_3 = CreateTrueOnlyButton(ButtonName="Visualize GWP by element", ButtonStyle=0)
tb_9 = CreateTextBlock(Text=panel_40, TextSize=16, Justification=0)
tb_10 = CreateTextBlock(TextSize=16, Justification=0)
tb_11 = CreateTextBlock(Text="Simulations can take a few minutes...", TextSize=16, Justification=0)
button_19 = CreateButton(ButtonName="Calculate Glare probability", ButtonStyle=0)
tb_12 = CreateTextBlock(Text=panel_38, TextSize=16, Justification=0)
pulldown_13 = CreatePulldownMenu(Label="Display", ListItems=panel_39, showLabel=True)
label_21 = CreateLabel(LabelText="Display settings", LabelSize=12, Justification=0)
slider_11 = CreateSlider(
    Slider=width_2,
    SnapValue=Slider(2, range=0..10),
    ShowBounds=False,
    ShowTicks=True,
    ShowTooltip=False,
    ShowValLabel=False,
    showLabel=True)
slider_12 = CreateSlider(
    Slider=height_2,
    SnapValue=Slider(2, range=0..10),
    ShowBounds=False,
    ShowTicks=True,
    ShowTooltip=False,
    ShowValLabel=False,
    showLabel=True)
values_48 = ValueListener(Elements=button_13, SomeProperty=True)  # -> Values, Indices
values_49 = ValueListener(Elements=button_12, SomeProperty=True)  # -> Values, Indices
values_50 = ValueListener(Elements=button_14, SomeProperty=True)  # -> Values, Indices
values_51 = ValueListener(Elements=button_15, SomeProperty=True)  # -> Values, Indices
values_52 = ValueListener(Elements=true_button_2, SomeProperty=True)  # -> Values, Indices
values_53 = ValueListener(Elements=button_17, SomeProperty=True)  # -> Values, Indices
label_22 = CreateLabel(LabelText="LCA", LabelSize=18, Justification=0)
values_54 = ValueListener(Elements=button_16, SomeProperty=True)  # -> Values, Indices
values_55 = ValueListener(Elements=true_button_3, SomeProperty=True)  # -> Values, Indices
values_56 = ValueListener(Elements=pulldown_11, SomeProperty=True)  # -> Values, Indices
values_57 = ValueListener(Elements=button_18, SomeProperty=True)  # -> Values, Indices
label_23 = CreateLabel(LabelText=panel_41, LabelSize=12, Justification=0)
label_24 = CreateLabel(LabelText=panel_43, LabelSize=12, Justification=0)
label_25 = CreateLabel(LabelText=panel_42, LabelSize=12, Justification=0)
values_58 = ValueListener(Elements=button_19, SomeProperty=True)  # -> Values, Indices
values_59 = ValueListener(Elements=pulldown_12, SomeProperty=True)  # -> Values, Indices
values_60 = ValueListener(Elements=slider_10, SomeProperty=True)  # -> Values, Indices
values_61 = ValueListener(Elements=slider_9, SomeProperty=True)  # -> Values, Indices
label_26 = CreateLabel(LabelText=panel_44, LabelSize=12, Justification=0)
values_62 = ValueListener(Elements=pulldown_13, SomeProperty=True)  # -> Values, Indices
zoom_simple_energy_simulation = RemoteSender(values_48.Values)
label_27 = CreateLabel(LabelText=panel_45, LabelSize=12, Justification=0)
bake_simple_energy_simulation = RemoteSender(values_49.Values)
zoom_detailed_energy_simulation = RemoteSender(values_51.Values)
values_63 = ValueListener(Elements=slider_11, SomeProperty=True)  # -> Values, Indices
visualize_detailed_energy_simulations = RemoteSender(values_52.Values)
freeze_gate_6 = StreamFreezeGate(Data=values_50.Values, PassingSwitch=invert(values_50.Values))
values_64 = ValueListener(Elements=slider_12, SomeProperty=True)  # -> Values, Indices
entwine_38 = Entwine(Branch00=slider_12, Branch01=slider_11, FlattenInputs=True)  # -> flatten(Result)
pre_run_simple_energy_simulations = RemoteSender(values_50.Values)
pre_run_simple_energy_simulations_2 = RemoteReceiver(pre_run_simple_energy_simulations)
freeze_gate_7 = StreamFreezeGate(Data=pre_run_simple_energy_simulations_2, PassingSwitch=pre_run_simple_energy_simulations_2)
hasdata = DataExists(Data=freeze_gate_7)
filter_5 = StreamFilter(Gate=hasdata, Stream0="0", Stream1=freeze_gate_7)
freeze_gate_8 = StreamFreezeGate(Data=values_54.Values, PassingSwitch=invert(values_54.Values))
zoom_daylight_simulation = RemoteSender(values_53.Values)
freeze_gate_9 = StreamFreezeGate(Data=values_57.Values, PassingSwitch=invert(values_57.Values))
pre_run_detailed_energy_simulations = RemoteSender(values_54.Values)
pre_run_detailed_energy_simulations_2 = RemoteReceiver(pre_run_detailed_energy_simulations)
freeze_gate_10 = StreamFreezeGate(Data=pre_run_detailed_energy_simulations_2, PassingSwitch=pre_run_detailed_energy_simulations_2)
hasdata_2 = DataExists(Data=freeze_gate_10)
filter_6 = StreamFilter(Gate=hasdata_2, Stream0="0", Stream1=freeze_gate_10)
pre_calculate_glare_probability = RemoteSender(values_58.Values)
pre_calculate_glare_probability_2 = RemoteReceiver(pre_calculate_glare_probability)
freeze_gate_11 = StreamFreezeGate(Data=pre_calculate_glare_probability_2, PassingSwitch=pre_calculate_glare_probability_2)
hasdata_3 = DataExists(Data=freeze_gate_11)
filter_7 = StreamFilter(Gate=hasdata_3, Stream0="0", Stream1=freeze_gate_11)
visualize_lca_gwp_by_element = RemoteSender(values_55.Values)
daylight_simulation_type = RemoteSender(values_56.Indices)
freeze_gate_12 = StreamFreezeGate(Data=values_58.Values, PassingSwitch=invert(values_58.Values))
simple_energy_simulation_type = RemoteSender(values_59.Indices)
pre_run_daylight_simulations = RemoteSender(values_57.Values)
pre_run_daylight_simulations_2 = RemoteReceiver(pre_run_daylight_simulations)
freeze_gate_13 = StreamFreezeGate(Data=pre_run_daylight_simulations_2, PassingSwitch=pre_run_daylight_simulations_2)
hasdata_4 = DataExists(Data=freeze_gate_13)
filter_8 = StreamFilter(Gate=hasdata_4, Stream0="0", Stream1=freeze_gate_13)
simple_energy_simulation_height = RemoteSender(values_60.Values)
simple_energy_simulation_width = RemoteSender(values_61.Values)
detailed_energy_simulation_type = RemoteSender(values_62.Indices)
detailed_energy_simulation_width = RemoteSender(values_63.Values)
detailed_energy_simulation_height = RemoteSender(values_64.Values)
bool_8 = Boolean(invert(freeze_gate_6))
bool_9 = Boolean(invert(freeze_gate_8))
stack_29 = CreateStack(UIElements=entwine_38, Horizontal=True)
bool_10 = Boolean(invert(freeze_gate_9))
entwine_39 = Entwine(Branch00=label_21, Branch01=stack_29, FlattenInputs=True)  # -> flatten(Result)
bool_11 = Boolean(invert(freeze_gate_12))
entwine_40 = Entwine(Branch00=slider_10, Branch01=slider_9, FlattenInputs=True)  # -> flatten(Result)
entwine_41 = Entwine(Branch00=button_14, Branch01=button_13, Branch02=button_12, FlattenInputs=True)  # -> flatten(Result)
entwine_42 = Entwine(Branch00=button_16, Branch01=button_15, Branch02=true_button_2, FlattenInputs=True)  # -> flatten(Result)
tap_6 = TapBuffer(Reset=False, Incremental=True, Valve=bool_8, Hold=True)
entwine_43 = Entwine(Branch00=button_18, Branch01=button_17, FlattenInputs=True)  # -> flatten(Result)
tap_7 = TapBuffer(Reset=False, Incremental=True, Valve=bool_9, Hold=True)
tap_8 = TapBuffer(Reset=False, Incremental=True, Valve=bool_10, Hold=True)
tap_9 = TapBuffer(Reset=False, Incremental=True, Valve=bool_11, Hold=True)
stack_30 = CreateStack(UIElements=entwine_39, Horizontal=invert(True))
dam_8 = DataDam(DataA=tap_6, BufferDelay=2500000, BufferMode=2)
dam_9 = DataDam(DataA=tap_7, BufferDelay=2500000, BufferMode=2)
dam_10 = DataDam(DataA=tap_8, BufferDelay=2500000, BufferMode=2)
dam_11 = DataDam(DataA=tap_9, BufferDelay=2500000, BufferMode=2)
entwine_44 = Entwine(Branch00=pulldown_12, Branch01=entwine_40, FlattenInputs=True)  # -> flatten(Result)
equals_8 = Equality(FirstNumber=tap_6, SecondNumber=dam_8)  # -> Equality, Inequality
equals_9 = Equality(FirstNumber=tap_7, SecondNumber=dam_9)  # -> Equality, Inequality
entwine_45 = Entwine(Branch00=pulldown_13, Branch01=stack_30, FlattenInputs=True)  # -> flatten(Result)
equals_10 = Equality(FirstNumber=tap_8, SecondNumber=dam_10)  # -> Equality, Inequality
equals_11 = Equality(FirstNumber=tap_9, SecondNumber=dam_11)  # -> Equality, Inequality
stack_31 = CreateStack(UIElements=entwine_41, Horizontal=True)
entwine_46 = Entwine(Branch00=label_19, Branch01=pulldown_11, FlattenInputs=True)  # -> flatten(Result)
stack_32 = CreateStack(UIElements=entwine_43, Horizontal=True)
adjustelem_5 = AdjustElementAppearance(ElementsToAdjust=tb_12, Foreground=ColourSwatch(SwatchColor=RGB(0, 0, 0)), FontSize=Slider(14, range=0..100))
stack_33 = CreateStack(UIElements=entwine_44, Horizontal=invert(True))
stack_34 = CreateStack(UIElements=entwine_45, Horizontal=True)
adjustelem_6 = AdjustElementAppearance(ElementsToAdjust=tb_4, Foreground=ColourSwatch(SwatchColor=RGB(0, 0, 0)), FontSize=Slider(14, range=0..100))
adjustelem_7 = AdjustElementAppearance(ElementsToAdjust=tb_9, Foreground=ColourSwatch(SwatchColor=RGB(0, 0, 0)), FontSize=Slider(14, range=0..100))
stack_35 = CreateStack(UIElements=entwine_46, Horizontal=invert(True))
entwine_47 = Entwine(Branch00=label_20, Branch01=stack_33, FlattenInputs=True)  # -> flatten(Result)
adjustpos_30 = AdjustElementPositioning(
    ElementsToAdjust=pulldown_13,
    AbsolutePositioning=False,
    Width=Slider(215, range=0..1000),
    Height=Slider(40, range=0..1000),
    HorizontalAlignment=0)
adjustpos_31 = AdjustElementPositioning(ElementsToAdjust=tb_2, Margin="10, 0, 0, 5", AbsolutePositioning=False, HorizontalAlignment=0)
entwine_48 = Entwine(Branch00=tb_4, Branch01=stack_35, FlattenInputs=True)  # -> flatten(Result)
adjustpos_32 = AdjustElementPositioning(ElementsToAdjust=tb_4, Margin="5, 10, 0, 5", AbsolutePositioning=False, HorizontalAlignment=0)
adjustpos_33 = AdjustElementPositioning(ElementsToAdjust=tb_5, Margin="10, 0, 0, 5", AbsolutePositioning=False, HorizontalAlignment=0)
adjustpos_34 = AdjustElementPositioning(ElementsToAdjust=[button_18, button_17], Margin="5, 5, 0, 0", AbsolutePositioning=False, HorizontalAlignment=0)
adjustpos_35 = AdjustElementPositioning(
    ElementsToAdjust=pulldown_12,
    AbsolutePositioning=False,
    Width=Slider(245, range=0..1000),
    Height=Slider(35, range=0..100),
    HorizontalAlignment=0)
adjustpos_36 = AdjustElementPositioning(
    ElementsToAdjust=[slider_10, slider_9],
    Margin="5, 5, 10, 0",
    AbsolutePositioning=False,
    Width=Slider(240, range=0..1000),
    HorizontalAlignment=0)
adjustpos_37 = AdjustElementPositioning(
    ElementsToAdjust=pulldown_11,
    AbsolutePositioning=False,
    Width=Slider(245, range=0..1000),
    Height=Slider(35, range=0..100),
    HorizontalAlignment=0)
adjustpos_38 = AdjustElementPositioning(ElementsToAdjust=tb_6, Margin="10, 0, 0, 5", AbsolutePositioning=False, HorizontalAlignment=0)
adjustpos_39 = AdjustElementPositioning(ElementsToAdjust=true_button_3, AbsolutePositioning=False, HorizontalAlignment=0)
adjustpos_40 = AdjustElementPositioning(ElementsToAdjust=button_19, AbsolutePositioning=False, HorizontalAlignment=0)
adjustpos_41 = AdjustElementPositioning(ElementsToAdjust=tb_9, Margin="5, 10, 0, 5", AbsolutePositioning=False, HorizontalAlignment=0)
adjustpos_42 = AdjustElementPositioning(ElementsToAdjust=tb_10, Margin="10, 0, 0, 5", AbsolutePositioning=False, HorizontalAlignment=0)
adjustpos_43 = AdjustElementPositioning(ElementsToAdjust=tb_12, Margin="5, 10, 5, 5", AbsolutePositioning=False, HorizontalAlignment=0)
adjustpos_44 = AdjustElementPositioning(
    ElementsToAdjust=true_button_2,
    Margin="15, 0, 0, 0",
    AbsolutePositioning=False,
    Width=Slider(110, range=0..1000),
    Height=Slider(30, range=0..1000),
    HorizontalAlignment=0)
stack_36 = CreateStack(UIElements=entwine_42, Horizontal=True)
adjustpos_45 = AdjustElementPositioning(
    ElementsToAdjust=button_15,
    Margin="15, 0, 0, 0",
    AbsolutePositioning=False,
    Width=Slider(60, range=0..1000),
    Height=Slider(30, range=0..1000),
    HorizontalAlignment=0)
adjustpos_46 = AdjustElementPositioning(
    ElementsToAdjust=[button_12, button_13, button_14],
    Margin="5, 5, 0, 0",
    AbsolutePositioning=False,
    HorizontalAlignment=0)
adjustpos_47 = AdjustElementPositioning(ElementsToAdjust=tb_8, Margin="5, 0, 0, 5", AbsolutePositioning=False, HorizontalAlignment=0)

# ----
adjustpos_48 = AdjustElementPositioning(ElementsToAdjust=tb_7, Margin="5, 0, 0, 5", AbsolutePositioning=False, HorizontalAlignment=0)
adjustpos_49 = AdjustElementPositioning(ElementsToAdjust=tb_11, Margin="5, 0, 0, 5", AbsolutePositioning=False, HorizontalAlignment=0)

# ----
# Run energy simulations
entwine_49 = Entwine(
    Branch00=stack_31,
    Branch01=tb_8,
    Branch02=tb_9,
    Branch03=entwine_47,
    Branch04=tb_5,
    Branch05=pulldown,
    FlattenInputs=True)  # -> flatten(Result)
stack_37 = CreateStack(UIElements=entwine_49, Horizontal=invert(True))
border_5 = CreateBorder(
    UIElement=stack_37,
    BorderThickness=Slider(1, range=0..10),
    BorderColor=ColourSwatch(SwatchColor=RGB(217, 217, 217)),
    CornerRadius=Slider(2, range=0..10))
adjustpos_50 = AdjustElementPositioning(ElementsToAdjust=stack_37, Margin="0, 0, 5, 0", AbsolutePositioning=False, HorizontalAlignment=0)
location_18 = Data(border_5)

# ----
# Calculare glare probability
entwine_50 = Entwine(Branch00=button_19, Branch01=tb_12, Branch02=tb_11, Branch03=tb_2, FlattenInputs=True)  # -> flatten(Result)
stack_38 = CreateStack(UIElements=entwine_50, Horizontal=invert(True))
number_slider_18 = Slider(650, range=0..1000)
border_6 = CreateBorder(
    UIElement=stack_38,
    BorderThickness=Slider(1, range=0..10),
    BorderColor=ColourSwatch(SwatchColor=RGB(217, 217, 217)),
    CornerRadius=Slider(2, range=0..10))
adjustpos_51 = AdjustElementPositioning(ElementsToAdjust=border_6, Margin="0, 5, 0, 0", AbsolutePositioning=False, HorizontalAlignment=0)
adjustpos_52 = AdjustElementPositioning(ElementsToAdjust=stack_38, Margin="0, 0, 5, 0", AbsolutePositioning=False, HorizontalAlignment=0)
location_19 = Data(border_6)

# ----
# Calculate LCA
entwine_51 = Entwine(
    Branch00=label_22,
    Branch01=label_24,
    Branch02=label_25,
    Branch03=label_23,
    Branch04=label_26,
    Branch05=label_27,
    Branch06=true_button_3,
    Branch07=tb_10,
    FlattenInputs=True)  # -> flatten(Result)
stack_39 = CreateStack(UIElements=entwine_51, Horizontal=invert(True))
border_7 = CreateBorder(
    UIElement=stack_39,
    BorderThickness=Slider(1, range=0..10),
    BorderColor=ColourSwatch(SwatchColor=RGB(217, 217, 217)),
    CornerRadius=Slider(2, range=0..10))
adjustpos_53 = AdjustElementPositioning(ElementsToAdjust=stack_39, Margin="0, 0, 5, 0", AbsolutePositioning=False, HorizontalAlignment=0)
adjustpos_54 = AdjustElementPositioning(ElementsToAdjust=border_7, Margin="0, 5, 0, 0", AbsolutePositioning=False, HorizontalAlignment=0)
location_20 = Data(border_7)

# ----
# Run detailed energy simulations
entwine_52 = Entwine(Branch00=stack_36, Branch01=tb_3, Branch02=stack_34, FlattenInputs=True)  # -> flatten(Result)
stack_40 = CreateStack(UIElements=entwine_52, Horizontal=invert(True))
number_slider_19 = Slider(650, range=0..1000)
border_8 = CreateBorder(
    UIElement=stack_40,
    BorderThickness=Slider(1, range=0..10),
    BorderColor=ColourSwatch(SwatchColor=RGB(217, 217, 217)),
    CornerRadius=Slider(2, range=0..10))
adjustpos_55 = AdjustElementPositioning(ElementsToAdjust=border_8, Margin="0, 5, 0, 0", AbsolutePositioning=False, HorizontalAlignment=0)
location_21 = Data()

# ----
# Run daylight simulations
entwine_53 = Entwine(Branch00=stack_32, Branch01=tb_7, Branch02=entwine_48, Branch03=tb_6, FlattenInputs=True)  # -> flatten(Result)
stack_41 = CreateStack(UIElements=entwine_53, Horizontal=invert(True))
number_slider_20 = Slider(650, range=0..1000)
border_9 = CreateBorder(
    UIElement=stack_41,
    BorderThickness=Slider(1, range=0..10),
    BorderColor=ColourSwatch(SwatchColor=RGB(217, 217, 217)),
    CornerRadius=Slider(2, range=0..10))
adjustpos_56 = AdjustElementPositioning(ElementsToAdjust=border_9, Margin="0, 5, 0, 0", AbsolutePositioning=False, HorizontalAlignment=0)
adjustpos_57 = AdjustElementPositioning(ElementsToAdjust=stack_41, Margin="0, 0, 5, 0", AbsolutePositioning=False, HorizontalAlignment=0)
location_22 = Data(border_9)

visualize_lca_gwp_by_element_2 = RemoteReceiver(visualize_lca_gwp_by_element)
rec_3 = DataRecorder(visualize_lca_gwp_by_element_2, DataLimit=-2, RecordData=True)
ma_3 = MassAddition(Input=rec_3)  # -> Result, PartialResults
entwine_54 = Entwine(Branch00=ma_3.Result, Branch01=lca_window_status, FlattenInputs=True)
rec_4 = DataRecorder(entwine_54, DataLimit=2, RecordData=True)
item_5 = ListItem(List=rec_4, Index=0, Wrap=True)  # -> Item2, Item1, Item
equals_12 = Equality(FirstNumber=item_5.Item2, SecondNumber=item_5.Item1)  # -> Equality, Inequality
bang = ExplodeTree(Data=equals_12.Inequality)  # -> Branch0, Branch1
py3_2 = Python3Script(x=bang.Branch0, y=bang.Branch1)  # -> a
# ---------- py3_2: Python ----------
if x:
    a = True
elif y:
    a = False
else:
    a = False
# ---------- end py3_2 ----------
event_6 = EventGate(Data=py3_2)  # -> Data, IsNew
freeze_gate_14 = StreamFreezeGate(Data=py3_2, PassingSwitch=event_6.IsNew)
event_7 = EventGate(Data=freeze_gate_14)  # -> Data, IsNew
panel_46 = Panel(event_7.Data)
launchwin = LaunchWindow(
    Show=event_7.Data,
    Name="LCA visualisations",
    Width=Slider(1150, range=0..1200),
    Height=Slider(575, range=0..1000),
    ChildStatus=1,
    EnableHorizScroll=False)
visualize_lca_gwp_by_element_3 = RemoteReceiver(visualize_lca_gwp_by_element)
winstat = WindowStatus(Window=launchwin)
addelems_2 = AddElements(Window=launchwin, Elements=flatten(image), DoVLChecking=True)  # -> AddedElements, ElementNames
py3_3 = Python3Script(window=launchwin, activate=visualize_lca_gwp_by_element_3)
# ---------- py3_3: Python ----------
import System

if activate and (str(window.WindowState) == "Minimized"):
    window.set_WindowState(System.Windows.WindowState(0))
# ---------- end py3_3 ----------
lca_status = RemoteSender(winstat)
winprops = SetWindowProperties(
    Window=launchwin,
    StartingLocation=pt_5,
    Theme=0,
    AccentColor=heath_accent_color_2,
    ShowTitleBar=True,
    BackgroundColor=RGB(255, 255, 255),
    ScaleFactor=1)

lca_status_2 = RemoteReceiver(lca_status)
expression_19 = Expression(x="Hidden", y=lca_status_2, Expression="x=y")
expire = ExpireObject(ObjectToExpire=objbynn_5, Expire=expression_19)

daylight_simulation_type_2 = RemoteReceiver(daylight_simulation_type)
equals_13 = Equality(FirstNumber="5", SecondNumber=daylight_simulation_type_2)  # -> Equality, Inequality

# ---- group: Construction module
panel_47 = Panel("""Very Hot
Hot
Warm
Mixed
Cool
Cold
Very Cold
Subarctic""")
panel_48 = Panel("""SteelFramed
WoodFramed
Mass
Metal Building""")
empty_3 = EmptyObjectToEmptyBranch()
empty_4 = EmptyObjectToEmptyBranch()
empty_5 = EmptyObjectToEmptyBranch()
empty_6 = EmptyObjectToEmptyBranch()
empty_7 = EmptyObjectToEmptyBranch()
empty_8 = EmptyObjectToEmptyBranch()
empty_9 = EmptyObjectToEmptyBranch()
empty_10 = EmptyObjectToEmptyBranch()
panel_49 = Panel("Construction database")
pulldown_14 = CreatePulldownMenu(Label="Skylights", ListItems=empty_4, showLabel=True)
pulldown_15 = CreatePulldownMenu(Label="Windows", ListItems=empty_3, showLabel=True)
pulldown_16 = CreatePulldownMenu(Label="Exterior walls", ListItems=empty_6, showLabel=True)
pulldown_17 = CreatePulldownMenu(Label="Ground", ListItems=empty_5, showLabel=True)
pulldown_18 = CreatePulldownMenu(Label="Interior floors", ListItems=empty_9, showLabel=True)
pulldown_19 = CreatePulldownMenu(Label="Exterior floor", ListItems=empty_8, showLabel=True)
pulldown_20 = CreatePulldownMenu(Label="Exterior roof", ListItems=empty_7, showLabel=True)
pulldown_21 = CreatePulldownMenu(Label="Interior walls", ListItems=empty_10, showLabel=True)
true_button_4 = CreateTrueOnlyButton(ButtonName="Window database", ButtonStyle=0)
button_20 = CreateButton(ButtonName="Material database", ButtonStyle=0)
label_28 = CreateLabel(LabelText="Databases", LabelSize=18, Justification=0)
pulldown_22 = CreatePulldownMenu(Label="By climate", ListItems=panel_47, SelectedIndex=Slider(5, range=0..7), showLabel=True)
label_29 = CreateLabel(LabelText="Select base construction", LabelSize=18, Justification=0)
pulldown_23 = CreatePulldownMenu(Label="By type", ListItems=panel_48, SelectedIndex=Slider(1, range=0..3), showLabel=True)
values_65 = ValueListener(Elements=pulldown_14, SomeProperty=True)  # -> Values, Indices
values_66 = ValueListener(Elements=pulldown_15, SomeProperty=True)  # -> Values, Indices
values_67 = ValueListener(Elements=pulldown_21, SomeProperty=True)  # -> Values, Indices
values_68 = ValueListener(Elements=pulldown_18, SomeProperty=True)  # -> Values, Indices
values_69 = ValueListener(Elements=pulldown_19, SomeProperty=True)  # -> Values, Indices
values_70 = ValueListener(Elements=pulldown_17, SomeProperty=True)  # -> Values, Indices
values_71 = ValueListener(Elements=true_button_4, SomeProperty=True)  # -> Values, Indices
values_72 = ValueListener(Elements=pulldown_20, SomeProperty=True)  # -> Values, Indices
values_73 = ValueListener(Elements=button_20, SomeProperty=True)  # -> Values, Indices
values_74 = ValueListener(Elements=pulldown_16, SomeProperty=True)  # -> Values, Indices
values_75 = ValueListener(Elements=pulldown_23, SomeProperty=True)  # -> Values, Indices
subset_subface_skylight = RemoteSender(values_65.Indices)
subset_interior_wall = RemoteSender(values_67.Indices)
subset_interior_floor = RemoteSender(values_68.Indices)
subset_exterior_floor = RemoteSender(values_69.Indices)
subset_ground_floor = RemoteSender(values_70.Indices)
subset_subface_window = RemoteSender(values_66.Indices)
values_76 = ValueListener(Elements=pulldown_22, SomeProperty=True)  # -> Values, Indices
subset_exterior_roof = RemoteSender(values_72.Indices)
subset_exterior_wall = RemoteSender(values_74.Indices)
panel_50 = Panel(values_71.Values)
open_window_database = RemoteSender(values_71.Values)
base_type = RemoteSender(values_75.Values)
load_material_database = RemoteSender(values_73.Values)
addition_2 = Addition(A=values_76.Indices, B="1")
entwine_55 = Entwine(Branch00=pulldown_22, Branch01=pulldown_23, FlattenInputs=True)  # -> flatten(Result)
base_climate = RemoteSender(addition_2)
stack_42 = CreateStack(UIElements=entwine_55, Horizontal=True)
entwine_56 = Entwine(Branch00=label_29, Branch01=stack_42, FlattenInputs=True)  # -> flatten(Result)
stack_43 = CreateStack(UIElements=entwine_56, Horizontal=invert(True))
tooltip_5 = AttachTooltipToElement(ElementsToAttachTo=pulldown_23, TooltipContent="Select type of construction", ShowDelay=500, Duration=2000)
adjustpos_58 = AdjustElementPositioning(ElementsToAdjust=pulldown_23, AbsolutePositioning=False, Width=Slider(170, range=0..300), HorizontalAlignment=0)
adjustpos_59 = AdjustElementPositioning(ElementsToAdjust=pulldown_22, AbsolutePositioning=False, Width=Slider(160, range=0..300), HorizontalAlignment=0)
tooltip_6 = AttachTooltipToElement(ElementsToAttachTo=pulldown_22, TooltipContent="Select climate", ShowDelay=500, Duration=2000)
adjustpos_60 = AdjustElementPositioning(
    ElementsToAdjust=[pulldown_18, pulldown_17, pulldown_19, pulldown_20, pulldown_21, pulldown_16],
    AbsolutePositioning=False,
    Width=Slider(300, range=0..300),
    HorizontalAlignment=0)
adjustpos_61 = AdjustElementPositioning(
    ElementsToAdjust=[pulldown_15, pulldown_14],
    AbsolutePositioning=False,
    Width=Slider(300, range=0..300),
    HorizontalAlignment=0)

# ----
button_21 = CreateButton(ButtonName=panel_49, ButtonStyle=0)
freeze_gate_15 = StreamFreezeGate(Data=values_73.Values, PassingSwitch=values_73.Values)
bool_12 = Boolean(invert(freeze_gate_15))
oilcan = OilCan(DataList=panel_3, Reset=recompute_3, Drop=values_73.Values, DropMode=3)
event_8 = EventGate(Data=oilcan)  # -> Data, IsNew
open_material_database = RemoteSender(event_8.Data)

# ----
# Select subset construction
data_2 = Data(pulldown_16)
data_3 = Data(pulldown_15)
data_4 = Data(pulldown_14)
data_5 = Data(pulldown_21)
data_6 = Data(pulldown_20)
data_7 = Data(pulldown_18)
data_8 = Data(pulldown_19)
data_9 = Data(pulldown_17)
entwine_57 = Entwine(
    Branch00=data_3,
    Branch01=data_4,
    Branch02=data_2,
    Branch03=data_5,
    Branch04=data_6,
    Branch05=data_7,
    Branch06=data_8,
    Branch07=data_9,
    FlattenInputs=True)  # -> flatten(Result)
expander = CreateExpander(UIElements=entwine_57, Header="Select subset constructions", Open="False")
adjustpos_62 = AdjustElementPositioning(ElementsToAdjust=expander, Margin="0, 10, 0, 0", AbsolutePositioning=False, Width=Slider(320, range=0..350))
location_23 = Data(expander)

# ----
# Construction by climate and type
location_24 = Data(stack_43)

bldgvintages_2 = HBBuildingVintages({"ASHRAE 90.1 2019  |  IECC 2021": "2019", "ASHRAE 90.1 2016  |  IECC 2018": "2016", "ASHRAE 90.1 2013  |  IECC 2015": "2013", "ASHRAE 90.1 2010  |  IECC 2012": "2010", "ASHRAE 90.1 2007  |  IECC 2009": "2007", "ASHRAE 90.1 2004  |  IECC 2006": "2004", "1980-2004 (CBECS)": "1980_2004", "Pre-1980 (CBECS)": "pre_1980"}, selected="ASHRAE 90.1 2019  |  IECC 2021")
base_climate_2 = RemoteReceiver(base_climate)
base_type_2 = RemoteReceiver(base_type)
constrsetclimate_2 = HBConstructionSetByClimate(climate_zone=base_climate_2, vintage=bldgvintages_2, constr_type=base_type_2)  # -> constr_set; plug-in component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
panel_51 = Panel(constrsetclimate_2)

# ---- group: Geometry module (continued)
document_units_6 = RemoteReceiver(document_units)
case = TextCase(Text=document_units_6, Culture=127)  # -> UpperCase, LowerCase
format_12 = Format(Format=panel_21, Culture=127, Data0=case.LowerCase)
settextblock = SetTextBlockContents(TextBlockToModify=tb, NewTextBlockContents=format_12)
document_units_7 = RemoteReceiver(document_units)
expression_20 = Expression(x=document_units_7, y="Meters", Expression="x=y")
hideshow_9 = HideShowElement(ElementToHideShow=border_2, Show=invert(expression_20), Collapse=True, Disable=False)

# ---- group: Construction module (continued)
values_77 = ValueListener(Elements=button_21, SomeProperty=True)  # -> Values, Indices
ping_open_material_database = RemoteSender(bool_12)
entwine_58 = Entwine(Branch00=label_28, Branch01=true_button_4, Branch02=button_20, Branch03=button_21, FlattenInputs=True)  # -> flatten(Result)

# ----
freeze_gate_16 = StreamFreezeGate(Data=values_77.Values, PassingSwitch=values_77.Values)
load_construction_database = RemoteSender(values_77.Values)
bool_13 = Boolean(invert(freeze_gate_16))
oilcan_2 = OilCan(DataList=panel_2, Reset=recompute_2, Drop=values_77.Values, DropMode=3)
ping_open_construction_database = RemoteSender(bool_13)
event_9 = EventGate(Data=oilcan_2)  # -> Data, IsNew
open_construction_database = RemoteSender(event_9.Data)

# ----
# Databases
location_25 = Data(entwine_58)

# ----
# Sync when opening the database and recompute
load_construction_database_2 = RemoteReceiver(load_construction_database)
load_material_database_2 = RemoteReceiver(load_material_database)
recompute_4 = RemoteReceiver(recompute)
panel_52 = Panel("""False
True""")
or_5 = GateOr(A=load_material_database_2, B=load_construction_database_2)
oilcan_3 = OilCan(DataList=panel_52, Reset=recompute_4, Drop=or_5, DropMode=3)
event_10 = EventGate(Data=oilcan_3)  # -> Data, IsNew
and = GateAnd(A=oilcan_3, B=event_10.IsNew)
null_2 = NullItem(Item=and)  # -> NullFlags, InvalidFlags, Description
filter_9 = StreamFilter(Gate=null_2.NullFlags, Stream0=and, Stream1="False")
event_11 = EventGate(Data=filter_9)  # -> Data, IsNew

# ---- group: Program module (continued)
occupancy = RemoteSender(division_3)

# ----
# Define program
selected_building_2 = RemoteReceiver(selected_building)
searchprog = HBSearchPrograms(bldg_prog=selected_building_2)  # -> room_prog; plug-in component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
room_programs = RemoteSender(searchprog)
selected_room_2 = RemoteReceiver(selected_room)
occupancy_2 = RemoteReceiver(occupancy)
applyloadvals = HBApplyLoadValues(
    room_or_program=flatten(selected_room_2),
    people_per_floor=occupancy_2,
    infilt_per_exterior=Slider(0.0001, range=0..0.001))  # -> report, mod_obj; plug-in component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
cooling_setpoint_3 = RemoteReceiver(cooling_setpoint)
heating_setpoint_3 = RemoteReceiver(heating_setpoint)
constantschedule_2 = HBConstantSchedule(values=Slider(1, range=0..1))  # -> report, schedule, idf_text; plug-in component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
constantschedule_3 = HBConstantSchedule(values=Slider(1, range=0..1))  # -> report, schedule, idf_text; plug-in component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
applysetpointvals = HBApplySetpointValues(room_or_program=flatten(applyloadvals.mod_obj), cooling_setpt=cooling_setpoint_3, heating_setpt=heating_setpoint_3)  # -> report, mod_obj; plug-in component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
python_2 = GhPythonScript(power_density=Slider(2.6, range=0..10), schedule=constantschedule_2.schedule)  # -> out, hot_water
# ---------- python_2: Python ----------
__author__ = "sawen"
__version__ = "2024.05.24"

import rhinoscriptsyntax as rs
from honeybee_energy.load.hotwater import ServiceHotWater as shw

if not name:
    name = "Domestic Hot Water"
    

hot_water = shw.from_watts_per_area(name, power_density, schedule)
# ---------- end python_2 ----------
equipment = HBEquipment(watts_per_area=Slider(3.4, range=0..10), schedule=constantschedule_3.schedule, lost_fract=Slider(0.3, range=0..1))  # -> equip; plug-in component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
programtype = HBProgramType(name="My program", base_program=applysetpointvals.mod_obj, electric_equip=equipment, hot_water=python_2.hot_water)  # -> program; plug-in component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

# ---- group: Program module (continued)
room_programs_2 = RemoteReceiver(room_programs)
setlist = SetListContents(ListToModify=pulldown_9, NewListContents=room_programs_2, SelectedIndex="0")

# ----
# Create model
entwine_59 = Entwine(Branch00=stack_11, Branch01=pulldown_2, FlattenInputs=True)  # -> flatten(Result)

stack_44 = CreateStack(UIElements=entwine_59, Horizontal=invert(True))

create_model = Data(stack_44)

entwine_60 = Entwine(Branch00=model_name_2, Branch01=location_5, Branch02=location_4, Branch03=create_model, FlattenInputs=True)  # -> flatten(Result)
stack_45 = CreateStack(UIElements=entwine_60, Horizontal=invert(True))

entwine_61 = Entwine(Branch00=stack_45, Branch01=location_3, FlattenInputs=True)  # -> flatten(Result)
stack_46 = CreateStack(UIElements=entwine_61, Horizontal=True)

# ----
# Select window construction
subset_subface_skylight_2 = RemoteReceiver(subset_subface_skylight)
subset_subface_window_2 = RemoteReceiver(subset_subface_window)
subset_subface_window_3 = RemoteReceiver(subset_subface_window)
entwine_62 = Entwine(Branch00="Generic", Branch01=subset_subface_skylight_2, FlattenInputs=True)  # -> flatten(Result)
item_6 = ListItem(List=entwine_62, Index=subset_subface_window_2, Wrap=True)
expression_21 = Expression(x="Generic", y=item_6, Expression="x=y")
null_3 = NullObject()
null_4 = NullObject()
filter_10 = StreamFilter(Gate=expression_21, Stream0=item_6, Stream1=null_3)
windowconstr_2 = HBWindowConstruction(materials=filter_10)  # -> constr; plug-in component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
cluster_3 = Cluster_2(window_construction=windowconstr_2, gwp_a1_a3="2.5", gwp_a4="0.042", density_kg_m2="38.2")

# ----
# Select exterior construction
subset_exterior_floor_2 = RemoteReceiver(subset_exterior_floor)
subset_exterior_roof_2 = RemoteReceiver(subset_exterior_roof)
subset_exterior_wall_2 = RemoteReceiver(subset_exterior_wall)
null_5 = NullObject()
null_6 = NullObject()
null_7 = NullObject()

# ----
# Select interior construction
subset_interior_floor_2 = RemoteReceiver(subset_interior_floor)
subset_interior_wall_2 = RemoteReceiver(subset_interior_wall)
null_8 = NullObject()
null_9 = NullObject()

# ----
# Select ground construction
subset_ground_floor_2 = RemoteReceiver(subset_ground_floor)
null_10 = NullObject()

# ----
# Material database categories
material_database_categories = Panel("""Blocks and tiles
Building boards
Concrete
Insulation
Mineral materials
Paints and sealants
Solid woods
Steel and other metals
Waterproofing
Other""")
material_database_categories_2 = RemoteSender(material_database_categories)
material_database_categories_3 = RemoteReceiver(material_database_categories_2)

# ----
# Basic material database
number_slider_21 = Slider(0.035, range=0.001..1)
basic_material_database_does_not_allow_c = Panel("""Expanded polystyrene
Mineral wool
Timber
Solid brick
Gypsum plasterboard
Medium density concrete
Ceramic and porcelain
Steel
Crystalline stone
Soil/sand/gravel""")  # "Basic material database, (does not allow comma)"
entwine_63 = Entwine(
    Branch00=Slider(0.035, range=0.001..1),
    Branch01=number_slider_21,
    Branch02=Slider(0.13, range=0.001..1),
    Branch03=Slider(0.8, range=0.001..1),
    Branch04=Slider(0.21, range=0.001..1),
    Branch05=Slider(1.65, range=0.001..5),
    Branch06=Slider(1.3, range=0.001..5),
    Branch07=Slider(50, range=0.001..100),
    Branch08=Slider(3.5, range=0.001..5),
    Branch09=Slider(2, range=0.001..5),
    FlattenInputs=True)  # -> flatten(Result)
entwine_64 = Entwine(
    Branch00=Slider(30, range=1..10000),
    Branch01=Slider(100, range=1..10000),
    Branch02=Slider(500, range=1..10000),
    Branch03=Slider(1800, range=1..10000),
    Branch04=Slider(700, range=1..10000),
    Branch05=Slider(2200, range=1..10000),
    Branch06=Slider(2300, range=1..10000),
    Branch07=Slider(7800, range=1..10000),
    Branch08=Slider(2800, range=1..10000),
    Branch09=Slider(1950, range=1..10000),
    FlattenInputs=True)  # -> flatten(Result)
entwine_65 = Entwine(
    Branch00=Slider(1450, range=1..10000),
    Branch01=Slider(1030, range=1..10000),
    Branch02=Slider(1600, range=1..10000),
    Branch03=Slider(1000, range=1..10000),
    Branch04=Slider(1000, range=1..10000),
    Branch05=Slider(1000, range=1..10000),
    Branch06=Slider(840, range=1..10000),
    Branch07=Slider(450, range=1..10000),
    Branch08=Slider(1000, range=1..10000),
    Branch09=Slider(1050, range=1..10000),
    FlattenInputs=True)  # -> flatten(Result)
entwine_66 = Entwine(
    Branch00=Slider(3, range=1..9),
    Branch01=Slider(3, range=1..9),
    Branch02=Slider(6, range=1..9),
    Branch03=Slider(0, range=0..9),
    Branch04=Slider(1, range=1..9),
    Branch05=Slider(2, range=1..9),
    Branch06=Slider(0, range=0..9),
    Branch07=Slider(7, range=1..9),
    Branch08=Slider(4, range=1..9),
    Branch09=Slider(9, range=1..9),
    FlattenInputs=True)  # -> flatten(Result)
material_database_categories_4 = RemoteReceiver(material_database_categories_2)
item_7 = ListItem(List=material_database_categories_4, Index=entwine_66, Wrap=True)
lng_3 = ListLength(List=basic_material_database_does_not_allow_c)
repeat_3 = RepeatData(Data="inf", Length=lng_3)
opaquemat_2 = HBOpaqueMaterial(
    name=basic_material_database_does_not_allow_c,
    thickness=repeat_3,
    conductivity=entwine_63,
    density=entwine_64,
    spec_heat=entwine_65,
    category=item_7)  # -> mat; plug-in component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
objtostr = HBObjectToString(hb_obj=opaquemat_2)  # -> hb_str; plug-in component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
lng_4 = ListLength(List=objtostr)
bool_14 = Boolean(lng_4)
getdocumentusertext = Python3Script(run=bool_14, key="Heath materials")  # -> json_string
# ---------- getdocumentusertext: Python ----------
import Rhino
import rhinoscriptsyntax as rs
import scriptcontext as sc

if run:
    sc.doc = Rhino.RhinoDoc.ActiveDoc

    json_string = rs.GetDocumentUserText(key)

    sc.doc = ghdoc
# ---------- end getdocumentusertext ----------
split = TextSplit(Text=getdocumentusertext, Separators="|")
strtoobj = HBStringToObject(hb_str=split)  # -> flatten(hb_obj); plug-in component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
decnstrmat = HBDeconstructMaterial(mat=strtoobj)  # -> values, attr_names, r_val_si, r_val_ip; plug-in component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
item_8 = ListItem(List=decnstrmat.values, Index=0, Wrap=True)  # -> flatten(Item)
mindex = MemberIndex(Set=item_8, Member=basic_material_database_does_not_allow_c)  # -> Index, Count
cull = CullPattern(List=objtostr, CullPattern=invert(mindex.Count))
entwine_67 = Entwine(Branch00=cull, Branch01=split, FlattenInputs=True)  # -> flatten(Result)
ipy2 = IronPython2Script(materials=entwine_67)  # -> unique_materials; inputs materials: list
# ---------- ipy2: IronPython ----------
"""Grasshopper Script"""

unique_materials = []

for i in range(len(materials)):
    if materials[i] not in unique_materials:
        unique_materials.append(materials[i])
# ---------- end ipy2 ----------
join = TextJoin(Text=ipy2, Join="|")
setdocumentusertext = Python3Script(key="Heath materials", value=join)
# ---------- setdocumentusertext: Python ----------
import Rhino
import rhinoscriptsyntax as rs
import scriptcontext as sc

def modify_value(value):
    sc.doc = Rhino.RhinoDoc.ActiveDoc

    test = rs.SetDocumentUserText(key, value)

    sc.doc = ghdoc
    
if value:
    done = modify_value(value)
# ---------- end setdocumentusertext ----------

# ----
# Heath launch window
number_slider_22 = Slider(142, range=0..1000)
number_slider_23 = Slider(275, range=0..1000)
number_slider_24 = Slider(220, range=0..1000)
heath_accent_color_14 = RemoteReceiver(heath_accent_color)
pt_10 = ConstructPoint(XCoordinate=number_slider_22, YCoordinate=Slider(193, range=0..1000), ZCoordinate=0)
restart_heath_2 = RemoteReceiver(restart_heath)
panel_53 = Panel("Heath provides a user interface for life cycle building performance assessment in the Rhino environment.")
gate_6 = StreamGate(Stream="Start", Gate=restart_heath_2)  # -> Target0, Target1
true_button_5 = CreateTrueOnlyButton(ButtonName="Github Heath", ButtonStyle=0)
true_button_6 = CreateTrueOnlyButton(ButtonName=gate_6.Target0, ButtonStyle=0)
tb_13 = CreateTextBlock(TextSize=16, Justification=1)
tb_14 = CreateTextBlock(TextSize=12, Justification=0)
values_78 = ValueListener(Elements=true_button_5, SomeProperty=True)  # -> Values, Indices
values_79 = ValueListener(Elements=true_button_6, SomeProperty=True)  # -> Values, Indices
settextblock_2 = SetTextBlockContents(TextBlockToModify=tb_13, NewTextBlockContents="Email: sawen@chalmers.se")
settextblock_3 = SetTextBlockContents(TextBlockToModify=tb_14, NewTextBlockContents=panel_53)
launch_heath = RemoteSender(values_79.Values)
github_heath = RemoteSender(values_78.Values)
entwine_68 = Entwine(Branch00=tb_14, Branch01=true_button_5, Branch02=true_button_6, Branch03=tb_13, FlattenInputs=True)  # -> flatten(Result)
adjustpos_63 = AdjustElementPositioning(ElementsToAdjust=tb_14, AbsolutePositioning=False, Height=Slider(60, range=0..100))
adjustpos_64 = AdjustElementPositioning(ElementsToAdjust=tb_13, Margin="0, 8, 0, 0", AbsolutePositioning=False, Height=Slider(20, range=0..100))

# ----
# Under development
# Global parameters
launch_heath_2 = RemoteReceiver(launch_heath)

# ----
# Heath FLY!
fly_2 = HeathFly(x=launch_heath_2)  # -> flying
# ---------- fly_2: Python ----------
# Copyright (c) 2024, Heath.
# You should have received a copy of the GNU Affero General Public License
# along with Heath; If not, see <http://www.gnu.org/licenses/>.
# 
# @license AGPL-3.0-or-later <https://spdx.org/licenses/AGPL-3.0-or-later>

import Grasshopper, scriptcontext
import os, sys, importlib

sys.path.append(Grasshopper.Folders.UserObjectFolders[0])

# make sure we can import ladybug tools
ladybug_tools_path = "ladybug_tools\\python\\Lib\\site-packages\\"
program_files_dir = os.path.dirname(f"{os.environ['ProgramFiles']}\\{ladybug_tools_path}")
if os.path.isdir(program_files_dir):
    sys.path.append(program_files_dir)
else:
    user_folder_dir = os.path.dirname(f"{os.path.expanduser('~')}\\{ladybug_tools_path}")
    if os.path.isdir(user_folder_dir):
        sys.path.append(user_folder_dir)
    else:
        raise Exception("Couldn't find Ladybug tools python module path")

try:
    import heath
    import heath_ui
    importlib.reload(heath)
    importlib.reload(heath_ui)
except Exception as e:
    # hack to allow the module to reside in the repo
    sys.path.append(os.path.join(os.path.dirname(ghdoc.Path), '..\src'))
    import heath
    import heath_ui
    importlib.reload(heath)
    importlib.reload(heath_ui)

ghenv.Component.Name = 'Heath - Fly!'
ghenv.Component.NickName = 'Fly!'

scriptcontext.sticky["heath_flying"] = 'true'
ghenv.Component.Message = heath.heath_globals.version

flying = True
# ---------- end fly_2 ----------
panel_54 = Panel(fly_2)
heath_flying = RemoteSender(fly_2)

py3_4 = Python3Script(
    show=bool_2,
    title="Heath",
    win_height=number_slider_24,
    win_width=number_slider_23,
    accent_color=heath_accent_color_14,
    location=pt_10,
    x=tb_14)  # -> out, win, gh_button_out; inputs show: Boolean, location: Point3d
# ---------- py3_4: Python ----------
import heath_ui
import scriptcontext as sc
from System import Guid
from System.Windows.Controls import TextBlock
from System.Windows import TextWrapping
from HumanUI import TrueOnlyButton, UIElement_Goo
from HumanUI.Components.UI_Elements import CreateButton_Component, buttonStyle


if __name__ == "__main__":
    win, status = heath_ui.heath_main_window(title, win_width, win_height, accent_color, location, show)
    tb = TextBlock()
    tb.Text = "Heath provides a user interface for life cycle building performance assessment in the Rhino environment."
    tb.TextWrapping = TextWrapping.Wrap
    win.AddElement(tb)

    gh_button_name = "Github Heath"
    gh_button = TrueOnlyButton()
    CreateButton_Component.SetupButton(gh_button_name, None, True, False, gh_button, buttonStyle.Default)
    win.AddElement(gh_button)

    gh_button_out = UIElement_Goo(gh_button, gh_button_name, Guid(), 0)
# ---------- end py3_4 ----------

# ----
# Heath github
panel_55 = Panel("https://github.com/sawenchalmers/heath")
github_heath_2 = RemoteReceiver(github_heath)
py3_5 = Python3Script(url=panel_55, launch=github_heath_2)
# ---------- py3_5: Python ----------
"""Grasshopper Script"""
import webbrowser as wb
if launch == True:
    wb.open(url, 2, True)
# ---------- end py3_5 ----------

# ----
# Save/restore states front-end
heath_flying_2 = RemoteReceiver(heath_flying)
heath_flying_3 = RemoteReceiver(heath_flying)
py3_6 = Python3Script(get=heath_flying_2)  # -> mpl_folder
# ---------- py3_6: Python ----------
"""Grasshopper Script"""
import heath

if __name__ == "__main__":
    if get:
        print(ghdoc)
        mpl_folder = heath.get_results_folder(ghdoc)
# ---------- end py3_6 ----------
py3_7 = Python3Script(get=heath_flying_3)  # -> mpl_folder; same code as py3_6
button_22 = CreateButton(ButtonName="Load state", ButtonStyle=0)
filepicker = CreateFilePicker(ButtonLabelText="Pick state", DialogType=0, MustExist=True, Filter="Textdokument|*.txt", StartingPath=py3_6)
filepicker_2 = CreateFilePicker(ButtonLabelText="Save location", DialogType=1, MustExist=True, Filter="Textdokument|*.txt", StartingPath=py3_7)
button_23 = CreateButton(ButtonName="Save state", ButtonStyle=0)
values_80 = ValueListener(Elements=filepicker_2, SomeProperty=True)  # -> Values, Indices
values_81 = ValueListener(Elements=button_23, SomeProperty=True)  # -> Values, Indices
values_82 = ValueListener(Elements=filepicker, SomeProperty=True)  # -> Values, Indices
values_83 = ValueListener(Elements=button_22, SomeProperty=True)  # -> Values, Indices
save_state = RemoteSender(values_81.Values)
save_location = RemoteSender(values_80.Values)
load_state_file = RemoteSender(values_82.Values)
load_state = RemoteSender(values_83.Values)
bool_15 = Boolean(values_80.Values)
bool_16 = Boolean(values_82.Values)
null_11 = NullItem(Item=bool_15)  # -> NullFlags, InvalidFlags, Description
null_12 = NullItem(Item=bool_16)  # -> NullFlags, InvalidFlags, Description
hideshow_10 = HideShowElement(ElementToHideShow=button_23, Show=null_11.NullFlags, Collapse=True, Disable=False)
hideshow_11 = HideShowElement(ElementToHideShow=button_22, Show=null_12.NullFlags, Collapse=True, Disable=False)
adjustpos_65 = AdjustElementPositioning(
    ElementsToAdjust=filepicker_2,
    AbsolutePositioning=invert(False),
    Width=Slider(90, range=0..100),
    Height=Slider(32, range=0..100),
    HorizontalAlignment=1,
    VerticalAlignment=2)
adjustpos_66 = AdjustElementPositioning(
    ElementsToAdjust=filepicker,
    AbsolutePositioning=invert(False),
    Width=Slider(90, range=0..100),
    Height=Slider(32, range=0..100),
    HorizontalAlignment=1,
    VerticalAlignment=2)

# ----
# Save/restore states back-end
load_state_file_2 = RemoteReceiver(load_state_file)
geometry_module_state_import_type_2 = RemoteReceiver(geometry_module_state_import_type)
load_state_2 = RemoteReceiver(load_state)
save_location_2 = RemoteReceiver(save_location)
save_state_2 = RemoteReceiver(save_state)
gate_7 = StreamGate(Stream=load_state_file_2, Gate=load_state_2)  # -> Target0, Target1
file = ReadFile(File=gate_7.Target0, PerLineParse=True)
writetxt = WriteToTextFile(Run=save_state_2, TextToWrite=geometry_module_state_import_type_2, FilePath=save_location_2, Append=False, NewOnly=False)
geometry_module_loaded_state_import_type = RemoteSender(file)

# ---- group: Geometry module (continued)
geometry_module_loaded_state_import_type_2 = RemoteReceiver(geometry_module_loaded_state_import_type)
setlist_2 = SetListContents(ListToModify=pulldown_3, NewListContents=panel_23, SelectedIndex=geometry_module_loaded_state_import_type_2)

# ----
# Material database launch
ping_open_material_database_2 = RemoteReceiver(ping_open_material_database)
open_material_database_2 = RemoteReceiver(open_material_database)
or_6 = GateOr(A=ping_open_material_database_2, B=open_material_database_2)
rec_5 = DataRecorder(or_6, DataLimit=-2, RecordData=True)
int_3 = Integer(rec_5)
ma_4 = MassAddition(Input=int_3)  # -> Result, PartialResults
database_modal_location_3 = RemoteReceiver(database_modal_location)
open_material_database_3 = RemoteReceiver(open_material_database)

# ----
# Construction database launch
ping_open_construction_database_2 = RemoteReceiver(ping_open_construction_database)
open_construction_database_2 = RemoteReceiver(open_construction_database)
or_7 = GateOr(A=ping_open_construction_database_2, B=open_construction_database_2)
rec_6 = DataRecorder(or_7, DataLimit=-2, RecordData=True)
int_4 = Integer(rec_6)
ma_5 = MassAddition(Input=int_4)  # -> Result, PartialResults
database_modal_location_4 = RemoteReceiver(database_modal_location)
open_construction_database_3 = RemoteReceiver(open_construction_database)

# ----
# Recursion
panel_56 = Panel("Material database")
objbynn_6 = GetObjectByNickname(NickName=panel_56)
material_database = Python3Script()  # -> status; same code as lca_window_status

# ----
# Recursion
panel_57 = Panel("Construction database")
objbynn_7 = GetObjectByNickname(NickName=panel_57)
construction_database = Python3Script()  # -> status; same code as lca_window_status

# ----
# Construction database
number_slider_25 = Slider(20, range=0..100)
heath_flying_4 = RemoteReceiver(heath_flying)
heath_flying_5 = RemoteReceiver(heath_flying)
py3_8 = Python3Script(get=heath_flying_4)  # -> mpl_folder; same code as py3_6
py3_9 = Python3Script(get=heath_flying_5)  # -> mpl_folder; same code as py3_6
repeat_4 = RepeatData(Data="🔍", Length=number_slider_25)
label_30 = CreateLabel(LabelText="Duplicate instances of constructions have been loaded", LabelSize=12, Justification=0)
repeat_5 = RepeatData(Data="- ", Length=number_slider_25)
repeat_6 = RepeatData(Data="X", Length=number_slider_25)
true_button_7 = CreateTrueOnlyButton(ButtonName="Create construction", ButtonStyle=0)
filepicker_3 = CreateFilePicker(ButtonLabelText="Save constructions to file", DialogType=1, MustExist=True, Filter="Text file|*.txt", StartingPath=py3_8)
button_24 = CreateButton(ButtonName="Save constructions", ButtonStyle=0)
filepicker_4 = CreateFilePicker(
    ButtonLabelText="Load constructions from file",
    DialogType=0,
    MustExist=True,
    Filter="Text file|*.txt",
    StartingPath=py3_9)
label_31 = CreateLabel(LabelText="Constructions", LabelSize=18, Justification=0)
button_25 = CreateButton(ButtonName="Load constructions", ButtonStyle=0)
true_button_8 = CreateTrueOnlyButton(ButtonName=repeat_4, ButtonStyle=3)
button_26 = CreateButton(ButtonName=repeat_6, ButtonStyle=3)
values_84 = ValueListener(Elements=button_24, SomeProperty=True)  # -> Values, Indices
values_85 = ValueListener(Elements=true_button_7, SomeProperty=True)  # -> Values, Indices
tb_15 = CreateTextBlock(Text=repeat_5, TextSize=12, Justification=0)
values_86 = ValueListener(Elements=button_25, SomeProperty=True)  # -> Values, Indices
values_87 = ValueListener(Elements=filepicker_3, SomeProperty=True)  # -> Values, Indices
values_88 = ValueListener(Elements=true_button_8, SomeProperty=True)  # -> flatten(Values), Indices
values_89 = ValueListener(Elements=filepicker_4, SomeProperty=True)  # -> Values, Indices
values_90 = ValueListener(Elements=button_26, SomeProperty=True)  # -> flatten(Values), Indices
cull_2 = CullPattern(List=values_90.Values, CullPattern=values_90.Values)
lng_5 = ListLength(List=cull_2)
filter_11 = StreamFilter(Gate=lng_5, Stream0="False", Stream1=cull_2)
freeze_gate_17 = StreamFreezeGate(Data=filter_11, PassingSwitch=invert(filter_11))
freeze_gate_18 = StreamFreezeGate(Data=values_84.Values, PassingSwitch=invert(values_84.Values))
freeze_gate_19 = StreamFreezeGate(Data=values_86.Values, PassingSwitch=invert(values_86.Values))
bool_17 = Boolean(invert(freeze_gate_17))
bool_18 = Boolean(values_87.Values)
bool_19 = Boolean(values_89.Values)
create_construction_modal = RemoteSender(values_85.Values)
cset = CreateSet(List=values_88.Values)  # -> Set, Map
panel_58 = Panel(values_85.Values)
tap_10 = TapBuffer(Reset=False, Incremental=True, Valve=bool_17, Hold=True)
null_13 = NullItem(Item=bool_18)  # -> NullFlags, InvalidFlags, Description
save_constructions_file = RemoteSender(values_87.Values)
load_constructions_file = RemoteSender(values_89.Values)
pre_construction_database_remove_constru = RemoteSender(values_90.Values)  # "pre_construction_database_remove_construction"
bool_20 = Boolean(invert(freeze_gate_18))
null_14 = NullItem(Item=bool_19)  # -> NullFlags, InvalidFlags, Description
bool_21 = Boolean(invert(freeze_gate_19))
cull_3 = CullPattern(List=cset.Set, CullPattern=cset.Set)
expander_2 = CreateExpander(UIElements=simplify(graft(tb_15)), Header=simplify(graft(repeat_5)), Open=invert(True))  # -> flatten(Expander)
dam_12 = DataDam(DataA=tap_10, BufferDelay=2500000, BufferMode=2)
tap_11 = TapBuffer(Reset=False, Incremental=True, Valve=bool_20, Hold=True)
tap_12 = TapBuffer(Reset=False, Incremental=True, Valve=bool_21, Hold=True)
mindex_2 = MemberIndex(Set=values_88.Values, Member=cull_3)  # -> Index, Count
equals_14 = Equality(FirstNumber=tap_10, SecondNumber=dam_12)  # -> Equality, Inequality
dam_13 = DataDam(DataA=tap_11, BufferDelay=2500000, BufferMode=2)
dam_14 = DataDam(DataA=tap_12, BufferDelay=2500000, BufferMode=2)
bool_22 = Boolean(mindex_2.Count)
hideshow_12 = HideShowElement(ElementToHideShow=button_24, Show=null_13.NullFlags, Collapse=True, Disable=False)
hideshow_13 = HideShowElement(ElementToHideShow=button_25, Show=null_14.NullFlags, Collapse=True, Disable=False)
event_12 = EventGate(Data=equals_14.Inequality)  # -> Data, IsNew
equals_15 = Equality(FirstNumber=tap_11, SecondNumber=dam_13)  # -> Equality, Inequality
equals_16 = Equality(FirstNumber=tap_12, SecondNumber=dam_14)  # -> Equality, Inequality
suirify = Suirify(true_button_8)
suirify_2 = Suirify(expander_2)
suirify_3 = Suirify(button_26)
pre_construction_database_visualize_cons = RemoteSender(mindex_2.Index)  # "pre_construction_database_visualize_construction"
construction_database_visualize_construc = RemoteSender(bool_22)  # "construction_database_visualize_construction"
construction_database_remove_constructio = RemoteSender(event_12.Data)  # "construction_database_remove_construction"
merge_6 = Merge(Data1=graft(suirify_2), Data2=graft(suirify_3), Data3=graft(suirify))
number_slider_26 = Slider(26, range=0..300)
entwine_69 = Entwine(Branch00=filepicker_3, Branch01=button_24, FlattenInputs=True)  # -> flatten(Result)
entwine_70 = Entwine(Branch00=filepicker_4, Branch01=button_25, FlattenInputs=True)  # -> flatten(Result)
stack_47 = CreateStack(UIElements=merge_6, Horizontal=True)  # -> flatten(Stack)
adjustelem_8 = AdjustElementAppearance(ElementsToAdjust=label_30, Foreground=ColourSwatch(SwatchColor=RGB(255, 0, 0)))
stack_48 = CreateStack(UIElements=entwine_69, Horizontal=True)
adjustpos_67 = AdjustElementPositioning(ElementsToAdjust=button_24, AbsolutePositioning=False, Height=Slider(32, range=0..300), HorizontalAlignment=0)
adjustpos_68 = AdjustElementPositioning(
    ElementsToAdjust=filepicker_3,
    AbsolutePositioning=False,
    Width=Slider(180, range=0..300),
    Height=Slider(32, range=0..300),
    HorizontalAlignment=0)
stack_49 = CreateStack(UIElements=entwine_70, Horizontal=True)
adjustpos_69 = AdjustElementPositioning(ElementsToAdjust=button_25, AbsolutePositioning=False, Height=Slider(32, range=0..300), HorizontalAlignment=0)
adjustpos_70 = AdjustElementPositioning(
    ElementsToAdjust=filepicker_4,
    AbsolutePositioning=False,
    Width=Slider(180, range=0..300),
    Height=Slider(32, range=0..300),
    HorizontalAlignment=0)
adjustpos_71 = AdjustElementPositioning(
    ElementsToAdjust=true_button_8,
    AbsolutePositioning=False,
    Width=number_slider_26,
    Height=number_slider_26,
    HorizontalAlignment=2,
    VerticalAlignment=1)
adjustelem_9 = AdjustElementAppearance(
    ElementsToAdjust=true_button_8,
    Foreground=ColourSwatch(SwatchColor=RGBA(0, 0, 0, 205)),
    Background=ColourSwatch(SwatchColor=RGBA(245, 245, 245, 205)),
    FontSize=Slider(18, range=0..50))
adjustpos_72 = AdjustElementPositioning(
    ElementsToAdjust=button_26,
    AbsolutePositioning=False,
    Width=Slider(26, range=0..300),
    Height=Slider(26, range=0..300),
    HorizontalAlignment=2,
    VerticalAlignment=1)
adjustelem_10 = AdjustElementAppearance(ElementsToAdjust=button_26, Foreground=ColourSwatch(SwatchColor=RGB(255, 0, 0)), FontSize=Slider(12, range=0..50))
adjustpos_73 = AdjustElementPositioning(ElementsToAdjust=true_button_7, AbsolutePositioning=False, HorizontalAlignment=0)
adjustpos_74 = AdjustElementPositioning(ElementsToAdjust=stack_47, Margin="5, 0, 0, 0", AbsolutePositioning=False, HorizontalAlignment=0)
adjustpos_75 = AdjustElementPositioning(
    ElementsToAdjust=expander_2,
    Margin="0, 0, 0, 5",
    AbsolutePositioning=False,
    Width=Slider(285, range=100..500),
    HorizontalAlignment=0)

entwine_71 = Entwine(Branch00=ma_5.Result, Branch01=construction_database, FlattenInputs=True)
rec_7 = DataRecorder(entwine_71, DataLimit=2, RecordData=True)
item_9 = ListItem(List=rec_7, Index=0, Wrap=True)  # -> Item2, Item1, Item
equals_17 = Equality(FirstNumber=item_9.Item2, SecondNumber=item_9.Item1)  # -> Equality, Inequality
bang_2 = ExplodeTree(Data=equals_17.Inequality)  # -> Branch0, Branch1
py3_10 = Python3Script(x=bang_2.Branch0, y=bang_2.Branch1)  # -> a; same code as py3_2
event_13 = EventGate(Data=py3_10)  # -> Data, IsNew
freeze_gate_20 = StreamFreezeGate(Data=py3_10, PassingSwitch=event_13.IsNew)
event_14 = EventGate(Data=freeze_gate_20)  # -> Data, IsNew
entwine_72 = Entwine(
    Branch00=true_button_7,
    Branch01=label_31,
    Branch02=stack_47,
    Branch03=label_30,
    Branch04=stack_48,
    Branch05=stack_49,
    FlattenInputs=True)  # -> flatten(Result)
panel_59 = Panel(event_14.Data)
launchwin_2 = LaunchWindow(
    Show=event_14.Data,
    Name="Construction database",
    Width=Slider(380, range=0..1000),
    Height=Slider(580, range=0..1000),
    ChildStatus=1,
    EnableHorizScroll=False)
winprops_2 = SetWindowProperties(
    Window=launchwin_2,
    StartingLocation=database_modal_location_4,
    Theme=0,
    AccentColor=heath_accent_color_4,
    ShowTitleBar=True,
    BackgroundColor=RGB(255, 255, 255),
    ScaleFactor=1)
winstat_2 = WindowStatus(Window=launchwin_2)
addelems_3 = AddElements(Window=launchwin_2, Elements=flatten(entwine_72), DoVLChecking=True)  # -> AddedElements, ElementNames
py3_11 = Python3Script(window=launchwin_2, activate=open_construction_database_3)  # same code as py3_3
panel_60 = Panel(winstat_2)
construction_database_status = RemoteSender(winstat_2)
construction_database_elements = RemoteSender(addelems_3.AddedElements)

construction_database_status_2 = RemoteReceiver(construction_database_status)
expression_22 = Expression(x="Hidden", y=construction_database_status_2, Expression="x=y")
expire_2 = ExpireObject(ObjectToExpire=objbynn_7, Expire=expression_22)

# ----
# Remove constructions
pre_construction_database_remove_constru_2 = RemoteReceiver(pre_construction_database_remove_constru)  # "pre_construction_database_remove_construction"
construction_database_remove_constructio_2 = RemoteReceiver(construction_database_remove_constructio)  # "construction_database_remove_construction"
cset_2 = CreateSet(List=pre_construction_database_remove_constru_2)  # -> Set, Map
getdocumentusertext_2 = Python3Script(run=construction_database_remove_constructio_2, key="Heath constructions")  # -> json_string; same code as getdocumentusertext
cull_4 = CullPattern(List=cset_2.Set, CullPattern=cset_2.Set)
mindex_3 = MemberIndex(Set=pre_construction_database_remove_constru_2, Member=cull_4)  # -> Index, Count
split_2 = TextSplit(Text=getdocumentusertext_2, Separators="|")
hold = HoldingGate(Data=mindex_3.Index)
cull_i = CullIndex(List=split_2, Indices=hold, Wrap=True)
join_2 = TextJoin(Text=cull_i, Join="|")
nulls_in_empty = NullsInEmptyBranches(DataWithEmptyBranches=join_2)
null_15 = NullItem(Item=nulls_in_empty)  # -> NullFlags, InvalidFlags, Description
bool_23 = Boolean("False")
filter_12 = StreamFilter(Gate=null_15.NullFlags, Stream0=join_2, Stream1=bool_23)
freeze_gate_21 = StreamFreezeGate(Data=filter_12, PassingSwitch=construction_database_remove_constructio_2, Freeze=False, Hold=False)

# ----
# Window database
panel_61 = Panel("Duplicate instances of windows have been loaded")
number_slider_27 = Slider(20, range=0..100)
heath_flying_6 = RemoteReceiver(heath_flying)
heath_flying_7 = RemoteReceiver(heath_flying)
true_button_9 = CreateTrueOnlyButton(ButtonName="Create window", ButtonStyle=0)
py3_12 = Python3Script(get=heath_flying_6)  # -> mpl_folder; same code as py3_6
label_32 = CreateLabel(LabelText=panel_61, LabelSize=12, Justification=0)
py3_13 = Python3Script(get=heath_flying_7)  # -> mpl_folder; same code as py3_6
values_91 = ValueListener(Elements=true_button_9, SomeProperty=True)  # -> Values, Indices
repeat_7 = RepeatData(Data="X", Length=number_slider_27)
repeat_8 = RepeatData(Data="- ", Length=number_slider_27)
filepicker_5 = CreateFilePicker(ButtonLabelText="Save windows to file", DialogType=1, MustExist=True, Filter="Text file|*.txt", StartingPath=py3_12)
button_27 = CreateButton(ButtonName="Save windows", ButtonStyle=0)
filepicker_6 = CreateFilePicker(ButtonLabelText="Load windows from file", DialogType=0, MustExist=True, Filter="Text file|*.txt", StartingPath=py3_13)
button_28 = CreateButton(ButtonName="Load windows", ButtonStyle=0)
button_29 = CreateButton(ButtonName=repeat_7, ButtonStyle=3)
create_window_modal = RemoteSender(values_91.Values)
tb_16 = CreateTextBlock(Text=repeat_8, TextSize=12, Justification=0)
values_92 = ValueListener(Elements=button_27, SomeProperty=True)  # -> Values, Indices
label_33 = CreateLabel(LabelText="Windows", LabelSize=18, Justification=0)
panel_62 = Panel(values_91.Values)
values_93 = ValueListener(Elements=button_28, SomeProperty=True)  # -> Values, Indices
values_94 = ValueListener(Elements=filepicker_5, SomeProperty=True)  # -> Values, Indices
values_95 = ValueListener(Elements=filepicker_6, SomeProperty=True)  # -> Values, Indices
values_96 = ValueListener(Elements=button_29, SomeProperty=True)  # -> flatten(Values), Indices
cull_5 = CullPattern(List=values_96.Values, CullPattern=values_96.Values)
lng_6 = ListLength(List=cull_5)
filter_13 = StreamFilter(Gate=lng_6, Stream0="False", Stream1=cull_5)
freeze_gate_22 = StreamFreezeGate(Data=filter_13, PassingSwitch=invert(filter_13))
freeze_gate_23 = StreamFreezeGate(Data=values_92.Values, PassingSwitch=invert(values_92.Values))
freeze_gate_24 = StreamFreezeGate(Data=values_93.Values, PassingSwitch=invert(values_93.Values))
bool_24 = Boolean(invert(freeze_gate_22))
bool_25 = Boolean(values_94.Values)
bool_26 = Boolean(values_95.Values)
null_16 = NullItem(Item=bool_25)  # -> NullFlags, InvalidFlags, Description
bool_27 = Boolean(invert(freeze_gate_23))
save_windows_file = RemoteSender(values_94.Values)
null_17 = NullItem(Item=bool_26)  # -> NullFlags, InvalidFlags, Description
bool_28 = Boolean(invert(freeze_gate_24))
load_windows_file = RemoteSender(values_95.Values)
tap_13 = TapBuffer(Reset=False, Incremental=True, Valve=bool_24, Hold=True)
pre_window_database_remove_window = RemoteSender(values_96.Values)
tap_14 = TapBuffer(Reset=False, Incremental=True, Valve=bool_27, Hold=True)
tap_15 = TapBuffer(Reset=False, Incremental=True, Valve=bool_28, Hold=True)
dam_15 = DataDam(DataA=tap_13, BufferDelay=2500000, BufferMode=2)
dam_16 = DataDam(DataA=tap_14, BufferDelay=2500000, BufferMode=2)
dam_17 = DataDam(DataA=tap_15, BufferDelay=2500000, BufferMode=2)
equals_18 = Equality(FirstNumber=tap_13, SecondNumber=dam_15)  # -> Equality, Inequality
adjustelem_11 = AdjustElementAppearance(ElementsToAdjust=label_32, Foreground=ColourSwatch(SwatchColor=RGB(255, 0, 0)))
hideshow_14 = HideShowElement(ElementToHideShow=button_27, Show=null_16.NullFlags, Collapse=True, Disable=False)
hideshow_15 = HideShowElement(ElementToHideShow=button_28, Show=null_17.NullFlags, Collapse=True, Disable=False)
equals_19 = Equality(FirstNumber=tap_14, SecondNumber=dam_16)  # -> Equality, Inequality
equals_20 = Equality(FirstNumber=tap_15, SecondNumber=dam_17)  # -> Equality, Inequality
event_15 = EventGate(Data=equals_18.Inequality)  # -> Data, IsNew
suirify_4 = Suirify(tb_16)
suirify_5 = Suirify(button_29)
merge_7 = Merge(Data1=graft(suirify_4), Data2=graft(suirify_5))
window_database_remove_window = RemoteSender(event_15.Data)
entwine_73 = Entwine(Branch00=filepicker_5, Branch01=button_27, FlattenInputs=True)  # -> flatten(Result)
entwine_74 = Entwine(Branch00=filepicker_6, Branch01=button_28, FlattenInputs=True)  # -> flatten(Result)
stack_50 = CreateStack(UIElements=merge_7, Horizontal=True)  # -> flatten(Stack)
adjustpos_76 = AdjustElementPositioning(
    ElementsToAdjust=filepicker_5,
    AbsolutePositioning=False,
    Width=Slider(180, range=0..300),
    Height=Slider(32, range=0..300),
    HorizontalAlignment=0)
adjustpos_77 = AdjustElementPositioning(ElementsToAdjust=button_27, AbsolutePositioning=False, Height=Slider(32, range=0..300), HorizontalAlignment=0)
stack_51 = CreateStack(UIElements=entwine_73, Horizontal=True)
stack_52 = CreateStack(UIElements=entwine_74, Horizontal=True)
adjustpos_78 = AdjustElementPositioning(
    ElementsToAdjust=filepicker_6,
    AbsolutePositioning=False,
    Width=Slider(180, range=0..300),
    Height=Slider(32, range=0..300),
    HorizontalAlignment=0)
adjustpos_79 = AdjustElementPositioning(ElementsToAdjust=button_28, AbsolutePositioning=False, Height=Slider(32, range=0..300), HorizontalAlignment=0)
adjustpos_80 = AdjustElementPositioning(ElementsToAdjust=label_33, Margin="0, 0, 0, -10", AbsolutePositioning=False)
adjustpos_81 = AdjustElementPositioning(ElementsToAdjust=true_button_9, AbsolutePositioning=False, HorizontalAlignment=0)
adjustpos_82 = AdjustElementPositioning(
    ElementsToAdjust=tb_16,
    Margin="0, 10, 0, 0",
    AbsolutePositioning=False,
    Width=Slider(300, range=0..300),
    Height=Slider(29, range=0..300),
    HorizontalAlignment=0,
    VerticalAlignment=1)
adjustpos_83 = AdjustElementPositioning(ElementsToAdjust=stack_50, Margin="5, 0, 0, 0", AbsolutePositioning=False, HorizontalAlignment=0)
adjustpos_84 = AdjustElementPositioning(
    ElementsToAdjust=button_29,
    Margin="5, 0, 0, 0",
    AbsolutePositioning=False,
    Width=Slider(26, range=0..300),
    Height=Slider(26, range=0..300),
    HorizontalAlignment=1,
    VerticalAlignment=1)
adjustelem_12 = AdjustElementAppearance(ElementsToAdjust=button_29, Foreground=ColourSwatch(SwatchColor=RGB(255, 0, 0)), FontSize=Slider(12, range=0..50))

# ----
# Remove window
pre_window_database_remove_window_2 = RemoteReceiver(pre_window_database_remove_window)
window_database_remove_window_2 = RemoteReceiver(window_database_remove_window)
cset_3 = CreateSet(List=pre_window_database_remove_window_2)  # -> Set, Map
getdocumentusertext_3 = Python3Script(run=window_database_remove_window_2, key="Heath windows")  # -> json_string; same code as getdocumentusertext
cull_6 = CullPattern(List=cset_3.Set, CullPattern=cset_3.Set)
mindex_4 = MemberIndex(Set=pre_window_database_remove_window_2, Member=cull_6)  # -> Index, Count
split_3 = TextSplit(Text=getdocumentusertext_3, Separators="|")
hold_2 = HoldingGate(Data=mindex_4.Index)
cull_i_2 = CullIndex(List=split_3, Indices=hold_2, Wrap=True)
join_3 = TextJoin(Text=cull_i_2, Join="|")
nulls_in_empty_2 = NullsInEmptyBranches(DataWithEmptyBranches=join_3)
null_18 = NullItem(Item=nulls_in_empty_2)  # -> NullFlags, InvalidFlags, Description
bool_29 = Boolean("False")
filter_14 = StreamFilter(Gate=null_18.NullFlags, Stream0=join_3, Stream1=bool_29)
freeze_gate_25 = StreamFreezeGate(Data=filter_14, PassingSwitch=window_database_remove_window_2, Freeze=False, Hold=False)

# ----
# Material database
# Material database categories
number_slider_28 = Slider(10, range=0..100)
heath_flying_8 = RemoteReceiver(heath_flying)
heath_flying_9 = RemoteReceiver(heath_flying)
material_database_categories_5 = RemoteReceiver(material_database_categories_2)
py3_14 = Python3Script(get=heath_flying_8)  # -> mpl_folder; same code as py3_6
py3_15 = Python3Script(get=heath_flying_9)  # -> mpl_folder; same code as py3_6
repeat_9 = RepeatData(Data="X", Length=number_slider_28)  # -> graft(Data)
repeat_10 = RepeatData(Data="- ", Length=number_slider_28)  # -> graft(Data)
label_34 = CreateLabel(LabelText="Duplicate instances of materials have been loaded", LabelSize=12, Justification=0)
filepicker_7 = CreateFilePicker(ButtonLabelText="Save materials to file", DialogType=1, MustExist=True, Filter="Text file|*.txt", StartingPath=py3_14)
button_30 = CreateButton(ButtonName="Save materials", ButtonStyle=0)
filepicker_8 = CreateFilePicker(ButtonLabelText="Load materials from file", DialogType=0, MustExist=True, Filter="Text file|*.txt", StartingPath=py3_15)
button_31 = CreateButton(ButtonName="Load materials", ButtonStyle=0)
true_button_10 = CreateTrueOnlyButton(ButtonName="Create material", ButtonStyle=0)
label_35 = CreateLabel(LabelText=material_database_categories_5, LabelSize=18, Justification=0)
lng_7 = ListLength(List=label_35)
lng_8 = ListLength(List=label_35)
repeat_11 = RepeatData(Data=simplify(repeat_9), Length=lng_7)
repeat_12 = RepeatData(Data=simplify(repeat_10), Length=lng_7)
values_97 = ValueListener(Elements=button_30, SomeProperty=True)  # -> Values, Indices
values_98 = ValueListener(Elements=button_31, SomeProperty=True)  # -> Values, Indices
values_99 = ValueListener(Elements=filepicker_7, SomeProperty=True)  # -> Values, Indices
button_32 = CreateButton(ButtonName=repeat_11, ButtonStyle=3)
tb_17 = CreateTextBlock(Text=repeat_12, TextSize=12, Justification=0)
values_100 = ValueListener(Elements=filepicker_8, SomeProperty=True)  # -> Values, Indices
values_101 = ValueListener(Elements=true_button_10, SomeProperty=True)  # -> Values, Indices
freeze_gate_26 = StreamFreezeGate(Data=values_97.Values, PassingSwitch=invert(values_97.Values))
freeze_gate_27 = StreamFreezeGate(Data=values_98.Values, PassingSwitch=invert(values_98.Values))
bool_30 = Boolean(values_99.Values)
values_102 = ValueListener(Elements=flatten(button_32), SomeProperty=True)  # -> flatten(Values), Indices
cull_7 = CullPattern(List=values_102.Values, CullPattern=values_102.Values)  # -> flatten(List)
lng_9 = ListLength(List=cull_7)
filter_15 = StreamFilter(Gate=lng_9, Stream0="False", Stream1=cull_7)
freeze_gate_28 = StreamFreezeGate(Data=filter_15, PassingSwitch=invert(filter_15))
bool_31 = Boolean(values_100.Values)
bool_32 = Boolean(invert(freeze_gate_28))
null_19 = NullItem(Item=bool_30)  # -> NullFlags, InvalidFlags, Description
save_materials_file = RemoteSender(values_99.Values)
bool_33 = Boolean(invert(freeze_gate_26))
null_20 = NullItem(Item=bool_31)  # -> NullFlags, InvalidFlags, Description
create_material_modal = RemoteSender(values_101.Values)
panel_63 = Panel(values_101.Values)
load_materials_file = RemoteSender(values_100.Values)
bool_34 = Boolean(invert(freeze_gate_27))
tap_16 = TapBuffer(Reset=False, Incremental=True, Valve=bool_32, Hold=True)
pre_material_database_remove_material = RemoteSender(values_102.Values)
tap_17 = TapBuffer(Reset=False, Incremental=True, Valve=bool_33, Hold=True)
tap_18 = TapBuffer(Reset=False, Incremental=True, Valve=bool_34, Hold=True)
dam_18 = DataDam(DataA=tap_16, BufferDelay=2500000, BufferMode=2)
dam_19 = DataDam(DataA=tap_17, BufferDelay=2500000, BufferMode=2)
adjustelem_13 = AdjustElementAppearance(ElementsToAdjust=label_34, Foreground=ColourSwatch(SwatchColor=RGB(255, 0, 0)))
hideshow_16 = HideShowElement(ElementToHideShow=button_30, Show=null_19.NullFlags, Collapse=True, Disable=False)
dam_20 = DataDam(DataA=tap_18, BufferDelay=2500000, BufferMode=2)
suirify_6 = Suirify(tb_17)
suirify_7 = Suirify(button_32)
hideshow_17 = HideShowElement(ElementToHideShow=button_31, Show=null_20.NullFlags, Collapse=True, Disable=False)
equals_21 = Equality(FirstNumber=tap_16, SecondNumber=dam_18)  # -> Equality, Inequality
equals_22 = Equality(FirstNumber=tap_17, SecondNumber=dam_19)  # -> Equality, Inequality
merge_8 = Merge(Data1=graft(suirify_6), Data2=graft(suirify_7))
equals_23 = Equality(FirstNumber=tap_18, SecondNumber=dam_20)  # -> Equality, Inequality
event_16 = EventGate(Data=equals_21.Inequality)  # -> Data, IsNew
stack_53 = CreateStack(UIElements=merge_8, Horizontal=True)
material_database_remove_material = RemoteSender(event_16.Data)
shfdep = ShiftToDepth(Tree=stack_53, Depth=Slider(1, range=0..100), shiftFromStart=False)
entwine_75 = Entwine(Branch00=filepicker_8, Branch01=button_31, FlattenInputs=True)  # -> flatten(Result)
merge_9 = Merge(Data1=simplify(graft(label_35)), Data2=shfdep)
entwine_76 = Entwine(Branch00=filepicker_7, Branch01=button_30, FlattenInputs=True)  # -> flatten(Result)
stack_54 = CreateStack(UIElements=entwine_75, Horizontal=True)
adjustpos_85 = AdjustElementPositioning(
    ElementsToAdjust=filepicker_7,
    AbsolutePositioning=False,
    Width=Slider(180, range=0..300),
    Height=Slider(32, range=0..300),
    HorizontalAlignment=0)
stack_55 = CreateStack(UIElements=entwine_76, Horizontal=True)
stack_56 = CreateStack(UIElements=merge_9, Horizontal=invert(True))  # -> flatten(Stack)
adjustpos_86 = AdjustElementPositioning(ElementsToAdjust=stack_55, Margin="5, 20, 0, 0", AbsolutePositioning=False, HorizontalAlignment=0)
adjustpos_87 = AdjustElementPositioning(ElementsToAdjust=button_30, AbsolutePositioning=False, Height=Slider(32, range=0..300), HorizontalAlignment=0)
adjustpos_88 = AdjustElementPositioning(ElementsToAdjust=stack_54, Margin="5, 10, 0, 0", AbsolutePositioning=False, HorizontalAlignment=0)
adjustpos_89 = AdjustElementPositioning(
    ElementsToAdjust=filepicker_8,
    AbsolutePositioning=False,
    Width=Slider(180, range=0..300),
    Height=Slider(32, range=0..300),
    HorizontalAlignment=0)
adjustpos_90 = AdjustElementPositioning(ElementsToAdjust=button_31, AbsolutePositioning=False, Height=Slider(32, range=0..300), HorizontalAlignment=0)
adjustpos_91 = AdjustElementPositioning(ElementsToAdjust=true_button_10, AbsolutePositioning=False, HorizontalAlignment=0)
adjustpos_92 = AdjustElementPositioning(ElementsToAdjust=label_35, Margin="0, 5, 0, 0", AbsolutePositioning=False)
adjustpos_93 = AdjustElementPositioning(
    ElementsToAdjust=tb_17,
    Margin="0, 0, 0, 10",
    AbsolutePositioning=False,
    Width=Slider(300, range=0..500),
    Height=Slider(29, range=0..300),
    HorizontalAlignment=0,
    VerticalAlignment=1)
adjustpos_94 = AdjustElementPositioning(ElementsToAdjust=stack_53, Margin="5, 0, 0, 0", AbsolutePositioning=False, HorizontalAlignment=0)
adjustpos_95 = AdjustElementPositioning(
    ElementsToAdjust=button_32,
    Margin="5, 0, 0, 10",
    AbsolutePositioning=False,
    Width=Slider(26, range=0..300),
    Height=Slider(26, range=0..300),
    HorizontalAlignment=1,
    VerticalAlignment=1)
adjustelem_14 = AdjustElementAppearance(ElementsToAdjust=button_32, Foreground=ColourSwatch(SwatchColor=RGB(255, 0, 0)), FontSize=Slider(12, range=0..50))

entwine_77 = Entwine(Branch00=ma_4.Result, Branch01=material_database, FlattenInputs=True)
rec_8 = DataRecorder(entwine_77, DataLimit=2, RecordData=True)
item_10 = ListItem(List=rec_8, Index=0, Wrap=True)  # -> Item2, Item1, Item
equals_24 = Equality(FirstNumber=item_10.Item2, SecondNumber=item_10.Item1)  # -> Equality, Inequality
bang_3 = ExplodeTree(Data=equals_24.Inequality)  # -> Branch0, Branch1
py3_16 = Python3Script(x=bang_3.Branch0, y=bang_3.Branch1)  # -> a; same code as py3_2
event_17 = EventGate(Data=py3_16)  # -> Data, IsNew
freeze_gate_29 = StreamFreezeGate(Data=py3_16, PassingSwitch=event_17.IsNew)
event_18 = EventGate(Data=freeze_gate_29)  # -> Data, IsNew
panel_64 = Panel(event_18.Data)
entwine_78 = Entwine(Branch00=true_button_10, Branch01=stack_56, Branch02=label_34, Branch03=stack_55, Branch04=stack_54, FlattenInputs=True)  # -> flatten(Result)
launchwin_3 = LaunchWindow(
    Show=event_18.Data,
    Name="Material database",
    Width=Slider(380, range=0..1000),
    Height=Slider(580, range=0..1000),
    ChildStatus=1,
    EnableHorizScroll=False)
winprops_3 = SetWindowProperties(
    Window=launchwin_3,
    StartingLocation=database_modal_location_3,
    Theme=0,
    AccentColor=heath_accent_color_3,
    ShowTitleBar=True,
    BackgroundColor=RGB(255, 255, 255),
    ScaleFactor=1)
winstat_3 = WindowStatus(Window=launchwin_3)
addelems_4 = AddElements(Window=launchwin_3, Elements=flatten(entwine_78), DoVLChecking=True)  # -> AddedElements, ElementNames
py3_17 = Python3Script(window=launchwin_3, activate=open_material_database_3)  # same code as py3_3
material_database_elements = RemoteSender(addelems_4.AddedElements)
material_database_status = RemoteSender(winstat_3)

material_database_status_2 = RemoteReceiver(material_database_status)
expression_23 = Expression(x="Hidden", y=material_database_status_2, Expression="x=y")
expire_3 = ExpireObject(ObjectToExpire=objbynn_6, Expire=expression_23)

# ----
# Recursion
panel_65 = Panel("Heath help")
objbynn_8 = GetObjectByNickname(NickName=panel_65)
heath_help = Python3Script()  # -> status; same code as lca_window_status

# ----
# Recursion
panel_66 = Panel("Geometry info")
objbynn_9 = GetObjectByNickname(NickName=panel_66)
geometry_info = Python3Script()  # -> status; same code as lca_window_status

# ----
# Heath geometry info
info_save_geometry_2 = RemoteReceiver(info_save_geometry)
rec_9 = DataRecorder(info_save_geometry_2, DataLimit=-2, RecordData=True)
ma_6 = MassAddition(Input=rec_9)  # -> Result, PartialResults
entwine_79 = Entwine(Branch00=ma_6.Result, Branch01=geometry_info, FlattenInputs=True)
rec_10 = DataRecorder(entwine_79, DataLimit=2, RecordData=True)
item_11 = ListItem(List=rec_10, Index=0, Wrap=True)  # -> Item2, Item1, Item
equals_25 = Equality(FirstNumber=item_11.Item2, SecondNumber=item_11.Item1)  # -> Equality, Inequality
bang_4 = ExplodeTree(Data=equals_25.Inequality)  # -> Branch0, Branch1
py3_18 = Python3Script(x=bang_4.Branch0, y=bang_4.Branch1)  # -> a; same code as py3_2
event_19 = EventGate(Data=py3_18)  # -> Data, IsNew
freeze_gate_30 = StreamFreezeGate(Data=py3_18, PassingSwitch=event_19.IsNew)
panel_67 = Panel("""Import geometry which is 
used to create the 
honeybee model""")
event_20 = EventGate(Data=freeze_gate_30)  # -> Data, IsNew
label_36 = CreateLabel(LabelText=panel_67, LabelSize=12, Justification=0)
panel_68 = Panel(event_20.Data)
launchwin_4 = LaunchWindow(
    Show=event_20.Data,
    Name="Info",
    Width=Slider(180, range=0..500),
    Height=Slider(148, range=0..500),
    ChildStatus=1,
    EnableHorizScroll=False)
pt_11 = ConstructPoint(XCoordinate=Slider(240, range=0..1000), YCoordinate=Slider(410, range=0..1000), ZCoordinate=0)
info_save_geometry_3 = RemoteReceiver(info_save_geometry)
winstat_4 = WindowStatus(Window=launchwin_4)
winprops_4 = SetWindowProperties(
    Window=launchwin_4,
    StartingLocation=pt_11,
    Theme=0,
    AccentColor=heath_accent_color_7,
    ShowTitleBar=True,
    BackgroundColor=RGB(255, 255, 255),
    ScaleFactor=1)
addelems_5 = AddElements(Window=launchwin_4, Elements=flatten(label_36), DoVLChecking=True)  # -> AddedElements, ElementNames
geometry_info_status = RemoteSender(winstat_4)
py3_19 = Python3Script(window=launchwin_4, activate=info_save_geometry_3)  # same code as py3_3

geometry_info_status_2 = RemoteReceiver(geometry_info_status)
expression_24 = Expression(x="Hidden", y=geometry_info_status_2, Expression="x=y")
expire_4 = ExpireObject(ObjectToExpire=objbynn_9, Expire=expression_24)

# ----
# Recursion
panel_69 = Panel("Material info")
objbynn_10 = GetObjectByNickname(NickName=panel_69)
material_info = Python3Script()  # -> status; same code as lca_window_status

# ----
# Recursion
panel_70 = Panel("Heath main")
objbynn_11 = GetObjectByNickname(NickName=panel_70)
heath_main = Python3Script()  # -> status; same code as lca_window_status

# ----
# Heath window
launch_heath_3 = RemoteReceiver(launch_heath)
rec_11 = DataRecorder(launch_heath_3, DataLimit=-2, RecordData=True)
ma_7 = MassAddition(Input=rec_11)  # -> Result, PartialResults
entwine_80 = Entwine(Branch00=ma_7.Result, Branch01=heath_main, FlattenInputs=True)
rec_12 = DataRecorder(entwine_80, DataLimit=2, RecordData=True)
item_12 = ListItem(List=rec_12, Index=0, Wrap=True)  # -> Item2, Item1, Item
equals_26 = Equality(FirstNumber=item_12.Item2, SecondNumber=item_12.Item1)  # -> Equality, Inequality
bang_5 = ExplodeTree(Data=equals_26.Inequality)  # -> Branch0, Branch1
data_10 = Data(location_20)
data_11 = Data(location_19)
data_12 = Data(location_22)
data_13 = Data(location_18)
data_14 = Data(location_21)
entwine_81 = Entwine(Branch00=stack_46, FlattenInputs=True)  # -> flatten(Result)
entwine_82 = Entwine(Branch00=location_24, Branch01=location_25, Branch02=location_23, FlattenInputs=True)  # -> flatten(Result)
entwine_83 = Entwine(Branch00=stack_17, Branch01=preview, Branch02=location_13, FlattenInputs=True)  # -> flatten(Result)
entwine_84 = Entwine(Branch00=location_15, Branch01=location_14, FlattenInputs=True)  # -> flatten(Result)
entwine_85 = Entwine(Branch00=location_16, Branch01=location_17, FlattenInputs=True)  # -> flatten(Result)
entwine_86 = Entwine(Branch00=data_13, Branch01=data_14, Branch02=data_12, Branch03=data_11, Branch04=data_10, FlattenInputs=True)  # -> flatten(Result)
py3_20 = Python3Script(x=bang_5.Branch0, y=bang_5.Branch1)  # -> a; same code as py3_2
event_21 = EventGate(Data=py3_20)  # -> Data, IsNew
stack_57 = CreateStack(UIElements=entwine_81, Horizontal=invert(True))
stack_58 = CreateStack(UIElements=entwine_84, Horizontal=invert(True))
freeze_gate_31 = StreamFreezeGate(Data=py3_20, PassingSwitch=event_21.IsNew)
panel_71 = Panel("""Geometry module
Program module
Construction module
Assembly module
Visualize module
Analysis module""")
event_22 = EventGate(Data=freeze_gate_31)  # -> Data, IsNew
tabs = TabbedView(
    TabNames=panel_71,
    TabTextSize=Slider(13, range=0..100),
    Tab0=flatten(entwine_83),
    Tab1=flatten(entwine_85),
    Tab2=flatten(entwine_82),
    Tab3=flatten(stack_57),
    Tab4=flatten(stack_58),
    Tab5=flatten(entwine_86))
launchwin_5 = LaunchWindow(
    Show=event_22.Data,
    Name="Heath",
    Width=Slider(390, range=0..1000),
    Height=Slider(520, range=0..1000),
    ChildStatus=1,
    EnableHorizScroll=False)
panel_72 = Panel(event_22.Data)
heath_is_active = RemoteSender(event_22.Data)
heath_window = RemoteSender(launchwin_5)
values_103 = ValueListener(Elements=tabs, SomeProperty=True)  # -> Values, Indices
adjustpos_96 = AdjustElementPositioning(ElementsToAdjust=tabs, AbsolutePositioning=False, Width=Slider(365, range=100..1500))
adjustpos_97 = AdjustElementPositioning(
    ElementsToAdjust=[entwine_83, entwine_85, entwine_82, stack_57, stack_58, entwine_86],
    Margin="0, 5, 0, 0",
    AbsolutePositioning=False,
    HorizontalAlignment=0,
    VerticalAlignment=2)
heath_window_location_2 = RemoteReceiver(heath_window_location)
current_tab = RemoteSender(values_103.Values)
current_tab_index = RemoteSender(values_103.Indices)
winprops_5 = SetWindowProperties(
    Window=launchwin_5,
    StartingLocation=heath_window_location_2,
    Theme=0,
    AccentColor=heath_accent_color_9,
    ShowTitleBar=True,
    BackgroundColor=RGB(255, 255, 255),
    ScaleFactor=1)
panel_73 = Panel("C:\Users\Isac\Desktop\Toivo_Chalmers\heath\Icons\butterfly_heath_short.png")
launch_heath_4 = RemoteReceiver(launch_heath)
image_2 = CreateImage(ImageSource=panel_73, ImageWidth=Slider(30, range=0..100), ImageHeight=Slider(19, range=0..100))
true_button_11 = CreateTrueOnlyButton(ButtonName="Help!", ButtonStyle=0)
py3_21 = Python3Script(window=launchwin_5, activate=launch_heath_4)  # same code as py3_3
winstat_5 = WindowStatus(Window=launchwin_5)
entwine_87 = Entwine(Branch00=image_2, Branch01=true_button_11, FlattenInputs=True)  # -> flatten(Result)
values_104 = ValueListener(Elements=true_button_11, SomeProperty=True)  # -> Values, Indices
heath_status = RemoteSender(winstat_5)
help_button = RemoteSender(values_104.Values)
stack_59 = CreateStack(UIElements=entwine_87, Horizontal=True)
stack_60 = CreateStack(UIElements=tabs, Horizontal=True)
entwine_88 = Entwine(Branch00=stack_59, Branch01=stack_60, FlattenInputs=True)  # -> flatten(Result)
addelems_6 = AddElements(Window=launchwin_5, Elements=flatten(entwine_88), DoVLChecking=True)  # -> AddedElements, ElementNames
heath_elements = RemoteSender(addelems_6.AddedElements)
format_13 = Format(Format="{0}, {1}, {2}, {3}", Culture=127, Data0=Slider(265, range=100..300))
adjustpos_98 = AdjustElementPositioning(
    ElementsToAdjust=true_button_11,
    Margin=format_13,
    AbsolutePositioning=invert(False),
    HorizontalAlignment=2,
    VerticalAlignment=2)

current_tab_2 = RemoteReceiver(current_tab)
current_tab_3 = RemoteReceiver(current_tab)
expression_25 = Expression(x="Assembly module", y=current_tab_2, Expression="x=y")
expression_26 = Expression(x="Assembly module", y=current_tab_3, Expression="x=y")
and_2 = GateAnd(A=event_4.Data, B=expression_25)
and_3 = GateAnd(A=event_5.Data, B=expression_26)
create_model_2 = RemoteSender(and_2)

heath_status_2 = RemoteReceiver(heath_status)
expression_27 = Expression(x="Hidden", y=heath_status_2, Expression="x=y")
expire_5 = ExpireObject(ObjectToExpire=objbynn_11, Expire=expression_27)

# ----
# Heath help
help_button_2 = RemoteReceiver(help_button)
rec_13 = DataRecorder(help_button_2, DataLimit=-2, RecordData=True)
ma_8 = MassAddition(Input=rec_13)  # -> Result, PartialResults
entwine_89 = Entwine(Branch00=ma_8.Result, Branch01=heath_help, FlattenInputs=True)
rec_14 = DataRecorder(entwine_89, DataLimit=2, RecordData=True)
item_13 = ListItem(List=rec_14, Index=0, Wrap=True)  # -> Item2, Item1, Item
equals_27 = Equality(FirstNumber=item_13.Item2, SecondNumber=item_13.Item1)  # -> Equality, Inequality
bang_6 = ExplodeTree(Data=equals_27.Inequality)  # -> Branch0, Branch1
py3_22 = Python3Script(x=bang_6.Branch0, y=bang_6.Branch1)  # -> a; same code as py3_2
event_23 = EventGate(Data=py3_22)  # -> Data, IsNew
freeze_gate_32 = StreamFreezeGate(Data=py3_22, PassingSwitch=event_23.IsNew)
panel_74 = Panel("""1. Select geometry in Rhino.

2. Select geometry type under the import geometry heading.

3. Click "Save geometry".

4. Verify the assigned geometry by pressing the "Preview" checkbox.""")
panel_75 = Panel("""1. Select the program for the building and room.

2. Use the sliders to set the cooling and heating setpoints.

3. Estimate how many persons will be in the room with the occupancy slider.""")
panel_76 = Panel("""1. Select base construction by climate and type of construction.

2. If required, create your own material or window. Materials can later be selected when creating custom constructions.

3. Constructions and windows make up the subset construction, which is used to modify the base construction.

4. Constructions can be loaded from a file, which contains all previously created constructions.""")
current_tab_index_2 = RemoteReceiver(current_tab_index)
panel_77 = Panel("""1. Make sure the geometry have been imported and that the program and constructions are in place, before creating a honeybee model.

2. If the model has been created, the "Bake model" button will be enabled along with boxes that lets you visualize the model.

3. Set the wall thickness and roof thickness.

4. Switch the WWR (window-to-wall-ratio) on, if you want to generate windows automatically.""")
panel_78 = Panel("""1. Verify that the honeybee model is correct by selecting attributes and clicking the checkboxes in the "Attributes visualization" segment.

2. Click the "Run weather visualization" button. If the model is set up correctly the "Direct sun hours" and "Incident radiation" should be displayed on the model.""")
panel_79 = Panel("""1. Pick which simulation you want to run.

2. If the simulation failed a red text will show up, go back and review the honeybee model and settings.

3. Otherwise, navigate through the expanded segment to select appropriate displays of the results.

4. It is possible to transfer the results to Rhino by clicking "Bake", or to an image file by clicking "Pop-up window".""")
heath_window_location_3 = RemoteReceiver(heath_window_location)
event_24 = EventGate(Data=freeze_gate_32)  # -> Data, IsNew
filter_16 = StreamFilter(
    Gate=current_tab_index_2,
    Stream0="Geometry module",
    Stream1="Program module",
    Stream2="Construction module",
    Stream3="Assembly module",
    Stream4="Visualize module",
    Stream5="Analysis module")
filter_17 = StreamFilter(
    Gate=current_tab_index_2,
    Stream0=panel_74,
    Stream1=panel_75,
    Stream2=panel_76,
    Stream3=panel_77,
    Stream4=panel_78,
    Stream5=panel_79)
label_37 = CreateLabel(LabelText="Geometry module", LabelSize=18, Justification=0)
panel_80 = Panel(event_24.Data)
tb_18 = CreateTextBlock(Text="Geometry module", TextSize=12, Justification=0)
launchwin_6 = LaunchWindow(
    Show=event_24.Data,
    Name="Help!",
    Width=Slider(350, range=0..500),
    Height=Slider(290, range=0..500),
    ChildStatus=1,
    EnableHorizScroll=False)
pdecon_2 = Deconstruct(Point=heath_window_location_3)  # -> XComponent, YComponent, ZComponent
pt_12 = ConstructPoint(XCoordinate=Slider(460, range=0..1000), YCoordinate=pdecon_2.YComponent, ZCoordinate=0)
settextblock_4 = SetTextBlockContents(TextBlockToModify=tb_18, NewTextBlockContents=filter_17)
setlabel_2 = SetLabelContents(LabelToModify=label_37, NewLabelContents=filter_16)
winprops_6 = SetWindowProperties(
    Window=launchwin_6,
    StartingLocation=pt_12,
    Theme=0,
    AccentColor=heath_accent_color_8,
    ShowTitleBar=True,
    BackgroundColor=RGB(255, 255, 255),
    ScaleFactor=1)
entwine_90 = Entwine(Branch00=label_37, Branch01=tb_18, FlattenInputs=True)  # -> flatten(Result)
winstat_6 = WindowStatus(Window=launchwin_6)
help_button_3 = RemoteReceiver(help_button)
heath_help_status = RemoteSender(winstat_6)
addelems_7 = AddElements(Window=launchwin_6, Elements=flatten(entwine_90), DoVLChecking=True)  # -> AddedElements, ElementNames
py3_23 = Python3Script(window=launchwin_6, activate=help_button_3)  # same code as py3_3

heath_help_status_2 = RemoteReceiver(heath_help_status)
expression_28 = Expression(x="Hidden", y=heath_help_status_2, Expression="x=y")
expire_6 = ExpireObject(ObjectToExpire=objbynn_8, Expire=expression_28)

create_model_3 = RemoteReceiver(create_model_2)
freeze_gate_33 = StreamFreezeGate(Data=create_model_3, PassingSwitch=create_model_3)
py3_24 = Python3Script(get=freeze_gate_33)  # -> mpl_folder; same code as py3_6
nextfile = NextAvailableFilename(Format="LCA{000}.png", FolderPath=py3_24, Trigger=create_model_3)

current_tab_4 = RemoteReceiver(current_tab)
expression_29 = Expression(x="Analysis module", y=current_tab_4, Expression="x=y")

# ---- group: Assembly model (continued)
current_tab_5 = RemoteReceiver(current_tab)
current_tab_6 = RemoteReceiver(current_tab)
current_tab_7 = RemoteReceiver(current_tab)
current_tab_8 = RemoteReceiver(current_tab)
current_tab_9 = RemoteReceiver(current_tab)
current_tab_10 = RemoteReceiver(current_tab)
expression_30 = Expression(x="Assembly module", y=current_tab_5, Expression="x=y")
expression_31 = Expression(x="Assembly module", y=current_tab_6, Expression="x=y")
expression_32 = Expression(x="Assembly module", y=current_tab_7, Expression="x=y")
expression_33 = Expression(x="Assembly module", y=current_tab_8, Expression="x=y")
current_tab_11 = RemoteReceiver(current_tab)
expression_34 = Expression(x="Assembly module", y=current_tab_9, Expression="x=y")
expression_35 = Expression(x="Assembly module", y=current_tab_10, Expression="x=y")
current_tab_12 = RemoteReceiver(current_tab)
expression_36 = Expression(x="Assembly module", y=current_tab_11, Expression="x=y")
expression_37 = Expression(x="Assembly module", y=current_tab_12, Expression="x=y")
and_4 = GateAnd(A=values_10.Values, B=expression_36)
show_honeybee_all = RemoteSender(and_4)
show_honeybee_all_2 = RemoteReceiver(show_honeybee_all)
show_honeybee_all_3 = RemoteReceiver(show_honeybee_all)
show_honeybee_all_4 = RemoteReceiver(show_honeybee_all)
show_honeybee_all_5 = RemoteReceiver(show_honeybee_all)
show_honeybee_all_6 = RemoteReceiver(show_honeybee_all)
show_honeybee_all_7 = RemoteReceiver(show_honeybee_all)
show_honeybee_all_8 = RemoteReceiver(show_honeybee_all)
or_8 = GateOr(A=values_7.Values, B=show_honeybee_all_3)
or_9 = GateOr(A=values_8.Values, B=show_honeybee_all_2)
or_10 = GateOr(A=values_9.Values, B=show_honeybee_all_4)
or_11 = GateOr(A=values_11.Values, B=show_honeybee_all_5)
or_12 = GateOr(A=values_12.Values, B=show_honeybee_all_6)
or_13 = GateOr(A=values_13.Values, B=show_honeybee_all_7)
or_14 = GateOr(A=values_14.Values, B=show_honeybee_all_8)
and_5 = GateAnd(A=or_8, B=expression_30)
and_6 = GateAnd(A=or_9, B=expression_37)
and_7 = GateAnd(A=or_10, B=expression_31)
and_8 = GateAnd(A=or_11, B=expression_32)
and_9 = GateAnd(A=or_12, B=expression_33)
and_10 = GateAnd(A=or_13, B=expression_34)
and_11 = GateAnd(A=or_14, B=expression_35)
show_honeybee_context = RemoteSender(and_6)
show_honeybee_ground = RemoteSender(and_8)
show_honeybee_floors = RemoteSender(and_9)
show_honeybee_walls = RemoteSender(and_11)
show_honeybee_windows = RemoteSender(and_7)
show_honeybee_roof = RemoteSender(and_10)
show_honeybee_doors = RemoteSender(and_5)
bake_model = RemoteSender(and_3)

# ----
show_honeybee_windows_2 = RemoteReceiver(show_honeybee_windows)
show_honeybee_context_2 = RemoteReceiver(show_honeybee_context)
show_honeybee_ground_2 = RemoteReceiver(show_honeybee_ground)
show_honeybee_floors_2 = RemoteReceiver(show_honeybee_floors)
show_honeybee_doors_2 = RemoteReceiver(show_honeybee_doors)
show_honeybee_walls_2 = RemoteReceiver(show_honeybee_walls)
show_honeybee_roof_2 = RemoteReceiver(show_honeybee_roof)

# ---- group: Geometry module (continued)
current_tab_13 = RemoteReceiver(current_tab)
expression_38 = Expression(x="Geometry module", y=current_tab_13, Expression="x=y")
and_12 = GateAnd(A=bool_3, B=expression_38)
preview_2 = RemoteSender(and_12)
current_tab_14 = RemoteReceiver(current_tab)
heath_status_3 = RemoteReceiver(heath_status)
current_tab_15 = RemoteReceiver(current_tab)
expression_39 = Expression(x="Geometry module", y=current_tab_14, Expression="x=y")
expression_40 = Expression(x="Geometry module", y=current_tab_15, Expression="x=y")
expression_41 = Expression(x="Hidden", y=heath_status_3, Expression="x=y")
and_13 = GateAnd(A=equals_4.Inequality, B=expression_39)
and_14 = GateAnd(A=equals_5.Inequality, B=expression_40, C=invert(expression_41))
event_25 = EventGate(Data=and_13)  # -> Data, IsNew
event_26 = EventGate(Data=and_14)  # -> Data, IsNew
savegeometry = RemoteSender(event_25.Data)
create_test_model = RemoteSender(event_26.Data)

# ----
create_test_model_2 = RemoteReceiver(create_test_model)
bake = BakeObjects(Geometry=entwine_2, Attributes=repeat_2, Bake=create_test_model_2, createGroups=False)  # -> Message, Ghosts

savegeometry_2 = RemoteReceiver(savegeometry)
create_test_model_3 = RemoteReceiver(create_test_model)
savegeometry_3 = RemoteReceiver(savegeometry)
create_test_model_4 = RemoteReceiver(create_test_model)
create_test_model_5 = RemoteReceiver(create_test_model)
create_test_model_6 = RemoteReceiver(create_test_model)
savegeometry_4 = RemoteReceiver(savegeometry)
preview_3 = RemoteReceiver(preview_2)
savegeometry_5 = RemoteReceiver(savegeometry)
savegeometry_6 = RemoteReceiver(savegeometry)
py3_25 = Python3Script(x=savegeometry_2)  # -> a
# ---------- py3_25: Python ----------
"""Grasshopper Script"""

import rhinoscriptsyntax as rs

if x:
    rs.Command("SelNone")
    a = True
# ---------- end py3_25 ----------
preview_4 = RemoteReceiver(preview_2)
preview_5 = RemoteReceiver(preview_2)
preview_6 = RemoteReceiver(preview_2)
savegeometry_7 = RemoteReceiver(savegeometry)
or_15 = GateOr(A=Toggle(True), B=py3_25)
or_16 = GateOr(A=savegeometry_3, B=preview_3, C=expression_7, D=create_test_model_3)
or_17 = GateOr(A=savegeometry_4, B=preview_4, C=expression_9, D=create_test_model_4)
or_18 = GateOr(A=savegeometry_6, B=preview_6, C=expression_13, D=create_test_model_5)
or_19 = GateOr(A=savegeometry_5, B=preview_5, C=expression_11, D=create_test_model_6)
preview_7 = RemoteReceiver(preview_2)
selobj_2 = ObjectsBySelection(Reset=or_15, LiveMode=True)
gate_8 = StreamGate(Stream="Heath geometry type", Gate=or_18)  # -> Target0, Target1
gate_9 = StreamGate(Stream="Heath geometry type", Gate=or_16)  # -> Target0, Target1
gate_10 = StreamGate(Stream="Heath geometry type", Gate=or_17)  # -> Target0, Target1
gate_11 = StreamGate(Stream="Heath geometry type", Gate=or_19)  # -> Target0, Target1
refkv = ReferenceByKeyValue(Key=gate_9.Target1, Val=gate_4.Target1, lightweight=False)
refkv_2 = ReferenceByKeyValue(Key=gate_8.Target1, Val=gate_2.Target1, lightweight=False)
refkv_3 = ReferenceByKeyValue(Key=gate_10.Target1, Val=gate_3.Target1, lightweight=False)
refkv_4 = ReferenceByKeyValue(Key=gate_11.Target1, Val=gate_5.Target1, lightweight=False)
seletedgeometry = RemoteSender(selobj_2)
seletedgeometry_2 = RemoteReceiver(seletedgeometry)
freeze_gate_34 = StreamFreezeGate(Data=seletedgeometry_2, PassingSwitch=presavegeometry_2, Hold=False)
seletedgeometry_3 = RemoteReceiver(seletedgeometry)
detatt = DetachAttributes(Geometry=seletedgeometry_3)  # -> Geometry, Attributes
filtertype = FilterByType(ObjectType="Extrusion", Geometry=freeze_gate_34, invertFilter=False, returnNulls=False)  # -> ExcludedGeometry, IncludedGeometry
filtertype_2 = FilterByType(ObjectType="Brep", Geometry=freeze_gate_34, invertFilter=False, returnNulls=False)  # -> ExcludedGeometry, IncludedGeometry
filtertype_3 = FilterByType(ObjectType="Surface", Geometry=freeze_gate_34, invertFilter=False, returnNulls=False)  # -> ExcludedGeometry, IncludedGeometry
filtertype_4 = FilterByType(ObjectType="Mesh", Geometry=freeze_gate_34, invertFilter=False, returnNulls=False)  # -> ExcludedGeometry, IncludedGeometry
filtertype_5 = FilterByType(ObjectType=panel_14, Geometry=freeze_gate_34, invertFilter=False, returnNulls=False)  # -> ExcludedGeometry, IncludedGeometry
ef_att_2 = EleFrontAttributes(Attributes=detatt.Attributes, Keys="Construction", Values=constructiontype)
modratt = ModifyRhinoObjectAttributes(ReferencedObject=seletedgeometry_3, Attributes=ef_att_2, Activate=saveconstruction)
planar = IsPlanar(Surface=filtertype_3.IncludedGeometry, Interior=True)  # -> Planar, Plane
ispolysurfaceclosed = Python3Script(Ps=[filtertype.IncludedGeometry, filtertype_2.IncludedGeometry, filtertype_5.IncludedGeometry])  # -> C; inputs Ps: Brep
# ---------- ispolysurfaceclosed: Python ----------
if Ps:
    C = Ps.IsSolid
# ---------- end ispolysurfaceclosed ----------
id = Guid(refkv_4)
panel_81 = Panel(modratt)
lng_10 = ListLength(List=freeze_gate_34)
preview_8 = RemoteReceiver(preview_2)
preview_9 = RemoteReceiver(preview_2)
preview_10 = RemoteReceiver(preview_2)
preview_11 = RemoteReceiver(preview_2)
cull_8 = CullPattern(
    List=[filtertype.IncludedGeometry, filtertype_2.IncludedGeometry, filtertype_5.IncludedGeometry],
    CullPattern=ispolysurfaceclosed)
cull_9 = CullPattern(List=filtertype_3.IncludedGeometry, CullPattern=planar.Planar)
py3_26 = Python3Script(x=id)  # -> out, a; inputs x: list
# ---------- py3_26: Python ----------
import Rhino.Geometry as rg
import rhinoscriptsyntax as rs
import scriptcontext as sc
import Rhino

a = []
sc.doc = Rhino.RhinoDoc.ActiveDoc
for g in x:
    print(g)
    obj = sc.doc.Objects.Find(g)
    index = obj.Attributes.LayerIndex
    layer = sc.doc.Layers[index]
    if(layer.IsVisible):
        a.append(g)
sc.doc = ghdoc
# ---------- end py3_26 ----------
savegeometry_8 = RemoteReceiver(savegeometry)
gate_12 = StreamGate(Stream=refkv_2, Gate=preview_8)  # -> Target0, Target1
gate_13 = StreamGate(Stream=refkv_3, Gate=preview_9)  # -> Target0, Target1
gate_14 = StreamGate(Stream=refkv, Gate=preview_11)  # -> Target0, Target1
windows = Geometry(py3_26.a)
gate_15 = StreamGate(Stream=windows, Gate=preview_10)  # -> Target0, Target1
filter_18 = StreamFilter(
    Gate=geometrytype_validate_2,
    Stream0=cull_8,
    Stream1=cull_9,
    Stream2=[filtertype_5.IncludedGeometry, filtertype_3.IncludedGeometry],
    Stream3=[filtertype_4.IncludedGeometry, filtertype_3.IncludedGeometry, filtertype_5.IncludedGeometry, filtertype.IncludedGeometry, filtertype_2.IncludedGeometry],
    Stream4=freeze_gate_34)  # -> flatten(Stream)
id_2 = Guid(filter_18)
txt_2 = Text(id_2)
cset_4 = CreateSet(List=txt_2)  # -> Set, Map
geo = Geometry(cset_4.Set)
detatt_2 = DetachAttributes(Geometry=geo)  # -> Geometry, Attributes
ef_att_3 = EleFrontAttributes(Attributes=detatt_2.Attributes, Keys="Heath geometry type", Values=geometrytype_2)
modratt_2 = ModifyRhinoObjectAttributes(ReferencedObject=geo, Attributes=ef_att_3, Activate=savegeometry_7)
panel_82 = Panel(modratt_2)
lng_11 = ListLength(List=geo)
equals_28 = Equality(FirstNumber=lng_10, SecondNumber=lng_11)  # -> Equality, Inequality
freeze_gate_35 = StreamFreezeGate(Data=equals_28.Equality, PassingSwitch=savegeometry_8)
preview_12 = CustomPreview(Geometry=gate_12.Target1, Material=ColourSwatch(SwatchColor=RGBA(0, 17, 128, 75)))
preview_13 = CustomPreview(Geometry=gate_13.Target1, Material=ColourSwatch(SwatchColor=RGBA(128, 125, 0, 75)))
preview_14 = CustomPreview(Geometry=gate_15.Target1, Material=ColourSwatch(SwatchColor=RGBA(128, 0, 102, 75)))
preview_15 = CustomPreview(Geometry=gate_14.Target1, Material=ColourSwatch(SwatchColor=RGBA(4, 128, 0, 75)))
hasdata_5 = DataExists(Data=freeze_gate_35)
filter_19 = StreamFilter(Gate=hasdata_5, Stream0="1", Stream1=freeze_gate_35)
geometry_saved = RemoteSender(filter_19)

# ---- group: Geometry module (continued)
seletedgeometry_4 = RemoteReceiver(seletedgeometry)
seletedgeometry_5 = RemoteReceiver(seletedgeometry)
lng_12 = ListLength(List=seletedgeometry_4)
geometry_saved_2 = RemoteReceiver(geometry_saved)
bool_35 = Boolean(lng_12)
seletedgeometry_6 = RemoteReceiver(seletedgeometry)
lng_13 = ListLength(List=seletedgeometry_5)
filter_20 = StreamFilter(Gate=bool_35, Stream0=Slider(500, range=0..1000), Stream1=Slider(1000000, range=0..1000000))
filter_21 = StreamFilter(Gate=bool_35, Stream0="Select Rhino geometry to import", Stream1=" ")
nor = GateNor(A=geometry_saved_2, B=lng_13)
lng_14 = ListLength(List=seletedgeometry_6)
hideshow_18 = HideShowElement(ElementToHideShow=button_7, Show=True, Collapse=True, Disable=invert(lng_14))
tooltip_7 = AttachTooltipToElement(ElementsToAttachTo=button_7, TooltipContent=filter_21, ShowDelay=filter_20, Duration=2000)
hideshow_19 = HideShowElement(ElementToHideShow=label_11, Show=nor, Collapse=True, Disable=False)

# ---- group: Visualize module (continued)
current_tab_16 = RemoteReceiver(current_tab)
expression_42 = Expression(x="Visualize module", y=current_tab_16, Expression="x=y")
and_15 = GateAnd(A=values_33.Values, B=expression_42)
current_tab_17 = RemoteReceiver(current_tab)
current_tab_18 = RemoteReceiver(current_tab)
weather_visualization_show = RemoteSender(and_15)
current_tab_19 = RemoteReceiver(current_tab)
current_tab_20 = RemoteReceiver(current_tab)
current_tab_21 = RemoteReceiver(current_tab)
current_tab_22 = RemoteReceiver(current_tab)
expression_43 = Expression(x="Visualize module", y=current_tab_18, Expression="x=y")
expression_44 = Expression(x="Visualize module", y=current_tab_17, Expression="x=y")
expression_45 = Expression(x="Visualize module", y=current_tab_19, Expression="x=y")
expression_46 = Expression(x="Visualize module", y=current_tab_20, Expression="x=y")
expression_47 = Expression(x="Visualize module", y=current_tab_21, Expression="x=y")
expression_48 = Expression(x="Visualize module", y=current_tab_22, Expression="x=y")
and_16 = GateAnd(A=equals_7.Inequality, B=expression_43)
and_17 = GateAnd(A=equals_6.Inequality, B=expression_44)
and_18 = GateAnd(A=values_35.Values, B=expression_45)
and_19 = GateAnd(A=values_40.Values, B=expression_46)
and_20 = GateAnd(A=values_39.Values, B=expression_47)
and_21 = GateAnd(A=values_42.Values, B=expression_48)
event_27 = EventGate(Data=and_16)  # -> Data, IsNew
event_28 = EventGate(Data=and_17)  # -> Data, IsNew
room_energy_attribute_visualize = RemoteSender(and_18)
face_attribute_visualize = RemoteSender(and_19)
room_attribute_visualize = RemoteSender(and_20)
face_energy_attribute_visualize = RemoteSender(and_21)
weather_visualisation_bake = RemoteSender(event_27.Data)
run_weather_visualisation = RemoteSender(event_28.Data)

# ----
room_energy_attribute_visualize_2 = RemoteReceiver(room_energy_attribute_visualize)
face_energy_attribute_visualize_2 = RemoteReceiver(face_energy_attribute_visualize)
room_attribute_visualize_2 = RemoteReceiver(room_attribute_visualize)
face_attribute_visualize_2 = RemoteReceiver(face_attribute_visualize)

# ---- group: Analysis module (continued)
current_tab_23 = RemoteReceiver(current_tab)
current_tab_24 = RemoteReceiver(current_tab)
current_tab_25 = RemoteReceiver(current_tab)
current_tab_26 = RemoteReceiver(current_tab)
expression_49 = Expression(x="Analysis module", y=current_tab_23, Expression="x=y")
expression_50 = Expression(x="Analysis module", y=current_tab_24, Expression="x=y")
expression_51 = Expression(x="Analysis module", y=current_tab_25, Expression="x=y")
expression_52 = Expression(x="Analysis module", y=current_tab_26, Expression="x=y")
and_22 = GateAnd(A=equals_8.Inequality, B=expression_49)
and_23 = GateAnd(A=equals_9.Inequality, B=expression_50)
and_24 = GateAnd(A=equals_10.Inequality, B=expression_51)
and_25 = GateAnd(A=equals_11.Inequality, B=expression_52)
event_29 = EventGate(Data=and_22)  # -> Data, IsNew
event_30 = EventGate(Data=and_23)  # -> Data, IsNew
event_31 = EventGate(Data=and_24)  # -> Data, IsNew
event_32 = EventGate(Data=and_25)  # -> Data, IsNew
run_simple_energy_simulations = RemoteSender(event_29.Data)
run_detailed_energy_simulations = RemoteSender(event_30.Data)
run_daylight_simulations = RemoteSender(event_31.Data)
calculate_glare_probability = RemoteSender(event_32.Data)

# ----
heath_is_active_2 = RemoteReceiver(heath_is_active)

launchwin_7 = LaunchWindow(
    Show=invert(heath_is_active_2),
    Name="Heath",
    Width=number_slider_23,
    Height=number_slider_24,
    ChildStatus=0,
    EnableHorizScroll=False)
winprops_7 = SetWindowProperties(Window=launchwin_7, StartingLocation=pt_10, AccentColor=heath_accent_color_14, ShowTitleBar=True, ScaleFactor=1)

addelems_8 = AddElements(Window=launchwin_7, Elements=flatten(entwine_68), DoVLChecking=True)  # -> AddedElements, ElementNames
winstat_7 = WindowStatus(Window=launchwin_7)
heath_launch_status = RemoteSender(winstat_7)
heath_launch_elements = RemoteSender(addelems_8.AddedElements)

# ----
# Define construction
# # Define program and construction
# To be added...
# 
# ## Instructions
# To be added...
# 
# ## Inputs
# - ...
# 
# ## Outputs
# - ...
# 
# ## Interpretation
# To be added...
panel_83 = Panel("My construction")

# ----
# Recursion
panel_84 = Panel("Window database")
objbynn_12 = GetObjectByNickname(NickName=panel_84)
window_database = Python3Script()  # -> status; same code as lca_window_status

# ----
# Window database launch
open_window_database_2 = RemoteReceiver(open_window_database)
rec_15 = DataRecorder(open_window_database_2, DataLimit=-2, RecordData=True)
entwine_91 = Entwine(
    Branch00=true_button_9,
    Branch01=label_33,
    Branch02=stack_50,
    Branch03=label_32,
    Branch04=stack_51,
    Branch05=stack_52,
    FlattenInputs=True)  # -> flatten(Result)
database_modal_location_5 = RemoteReceiver(database_modal_location)
open_window_database_3 = RemoteReceiver(open_window_database)

int_5 = Integer(rec_15)

ma_9 = MassAddition(Input=int_5)  # -> Result, PartialResults
entwine_92 = Entwine(Branch00=ma_9.Result, Branch01=window_database, FlattenInputs=True)
rec_16 = DataRecorder(entwine_92, DataLimit=2, RecordData=True)
item_14 = ListItem(List=rec_16, Index=0, Wrap=True)  # -> Item2, Item1, Item
equals_29 = Equality(FirstNumber=item_14.Item2, SecondNumber=item_14.Item1)  # -> Equality, Inequality
bang_7 = ExplodeTree(Data=equals_29.Inequality)  # -> Branch0, Branch1
py3_27 = Python3Script(x=bang_7.Branch0, y=bang_7.Branch1)  # -> a; same code as py3_2
event_33 = EventGate(Data=py3_27)  # -> Data, IsNew
freeze_gate_36 = StreamFreezeGate(Data=py3_27, PassingSwitch=event_33.IsNew)
event_34 = EventGate(Data=freeze_gate_36)  # -> Data, IsNew
panel_85 = Panel(event_34.Data)
launchwin_8 = LaunchWindow(
    Show=event_34.Data,
    Name="Window database",
    Width=Slider(380, range=0..1000),
    Height=Slider(580, range=0..1000),
    ChildStatus=1,
    EnableHorizScroll=False)
winprops_8 = SetWindowProperties(
    Window=launchwin_8,
    StartingLocation=database_modal_location_5,
    Theme=0,
    AccentColor=heath_accent_color_5,
    ShowTitleBar=True,
    BackgroundColor=RGB(255, 255, 255),
    ScaleFactor=1)
winstat_8 = WindowStatus(Window=launchwin_8)
addelems_9 = AddElements(Window=launchwin_8, Elements=flatten(entwine_91), DoVLChecking=True)  # -> AddedElements, ElementNames
py3_28 = Python3Script(window=launchwin_8, activate=open_window_database_3)  # same code as py3_3
window_database_status = RemoteSender(winstat_8)
window_database_elements = RemoteSender(addelems_9.AddedElements)

window_database_status_2 = RemoteReceiver(window_database_status)
expression_53 = Expression(x="Hidden", y=window_database_status_2, Expression="x=y")
expire_7 = ExpireObject(ObjectToExpire=objbynn_12, Expire=expression_53)

construction_database_status_3 = RemoteReceiver(construction_database_status)
construction_database_status_4 = RemoteReceiver(construction_database_status)
expression_54 = Expression(x="Normal", y=construction_database_status_3, Expression="x=y")
expression_55 = Expression(x="Normal", y=construction_database_status_4, Expression="x=y")
and_26 = GateAnd(A=equals_15.Inequality, B=expression_54)
and_27 = GateAnd(A=equals_16.Inequality, B=expression_55)
event_35 = EventGate(Data=and_26)  # -> Data, IsNew
event_36 = EventGate(Data=and_27)  # -> Data, IsNew
save_constructions = RemoteSender(event_35.Data)
panel_86 = Panel(event_35.Data)
load_constructions = RemoteSender(event_36.Data)
panel_87 = Panel(event_36.Data)

# ----
# Load constructions
load_constructions_2 = RemoteReceiver(load_constructions)
load_constructions_file_2 = RemoteReceiver(load_constructions_file)
gate_16 = StreamGate(Stream=load_constructions_file_2, Gate=load_constructions_2)  # -> Target0, Target1
getdocumentusertext_4 = Python3Script(run=load_constructions_2, key="Heath constructions")  # -> json_string; same code as getdocumentusertext
file_2 = ReadFile(File=gate_16.Target1, PerLineParse=False)
split_4 = TextSplit(Text=file_2, Separators="|")  # -> flatten(Result)
entwine_93 = Entwine(Branch00=getdocumentusertext_4, Branch01=file_2, FlattenInputs=True)  # -> flatten(Result)
strtoobj_2 = HBStringToObject(hb_str=split_4)  # -> hb_obj; plug-in component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
null_21 = NullItem(Item=strtoobj_2)  # -> NullFlags, InvalidFlags, Description
item_15 = ListItem(List=null_21.NullFlags, Index=0, Wrap=True)
filter_22 = StreamFilter(Gate=item_15, Stream0=entwine_93)
join_4 = TextJoin(Text=filter_22, Join="|")
freeze_gate_37 = StreamFreezeGate(Data=join_4, PassingSwitch=load_constructions_2, Freeze=False, Hold=False)

# ----
# Save constructions
save_constructions_2 = RemoteReceiver(save_constructions)
getdocumentusertext_5 = Python3Script(run=save_constructions_2, key="Heath constructions")  # -> json_string; same code as getdocumentusertext
null_22 = NullItem(Item=getdocumentusertext_5)  # -> NullFlags, InvalidFlags, Description
save_constructions_file_2 = RemoteReceiver(save_constructions_file)
bool_36 = Boolean(invert(null_22.NullFlags))
filter_23 = StreamFilter(Gate=null_22.NullFlags, Stream0=save_constructions_2, Stream1=bool_36)
writetxt_2 = WriteToTextFile(Run=filter_23, TextToWrite=getdocumentusertext_5, FilePath=save_constructions_file_2, Append=False, NewOnly=False)

material_database_status_3 = RemoteReceiver(material_database_status)
material_database_status_4 = RemoteReceiver(material_database_status)
expression_56 = Expression(x="Normal", y=material_database_status_3, Expression="x=y")
expression_57 = Expression(x="Normal", y=material_database_status_4, Expression="x=y")
and_28 = GateAnd(A=equals_22.Inequality, B=expression_56)
and_29 = GateAnd(A=equals_23.Inequality, B=expression_57)
event_37 = EventGate(Data=and_28)  # -> Data, IsNew
event_38 = EventGate(Data=and_29)  # -> Data, IsNew
panel_88 = Panel(event_37.Data)
save_materials = RemoteSender(event_37.Data)
panel_89 = Panel(event_38.Data)
load_materials = RemoteSender(event_38.Data)

# ----
# Save materials
panel_90 = Panel("Heath materials")
save_materials_2 = RemoteReceiver(save_materials)
getdocumentusertext_6 = Python3Script(run=save_materials_2, key=panel_90)  # -> json_string; same code as getdocumentusertext
null_23 = NullItem(Item=getdocumentusertext_6)  # -> NullFlags, InvalidFlags, Description
bool_37 = Boolean(invert(null_23.NullFlags))
save_materials_file_2 = RemoteReceiver(save_materials_file)
filter_24 = StreamFilter(Gate=null_23.NullFlags, Stream0=save_materials_2, Stream1=bool_37)
writetxt_3 = WriteToTextFile(Run=filter_24, TextToWrite=getdocumentusertext_6, FilePath=save_materials_file_2, Append=False, NewOnly=False)

# ----
# Load materials
load_materials_file_2 = RemoteReceiver(load_materials_file)
load_materials_2 = RemoteReceiver(load_materials)
gate_17 = StreamGate(Stream=load_materials_file_2, Gate=load_materials_2)  # -> Target0, Target1
getdocumentusertext_7 = Python3Script(run=load_materials_2, key="Heath materials")  # -> json_string; same code as getdocumentusertext
file_3 = ReadFile(File=gate_17.Target1, PerLineParse=False)
entwine_94 = Entwine(Branch00=getdocumentusertext_7, Branch01=file_3, FlattenInputs=True)  # -> flatten(Result)
split_5 = TextSplit(Text=file_3, Separators="|")  # -> flatten(Result)
strtoobj_3 = HBStringToObject(hb_str=split_5)  # -> hb_obj; plug-in component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
null_24 = NullItem(Item=strtoobj_3)  # -> NullFlags, InvalidFlags, Description
item_16 = ListItem(List=null_24.NullFlags, Index=0, Wrap=True)
filter_25 = StreamFilter(Gate=item_16, Stream0=entwine_94)
join_5 = TextJoin(Text=filter_25, Join="|")
freeze_gate_38 = StreamFreezeGate(Data=join_5, PassingSwitch=load_materials_2, Freeze=False, Hold=False)

window_database_status_3 = RemoteReceiver(window_database_status)
window_database_status_4 = RemoteReceiver(window_database_status)
expression_58 = Expression(x="Normal", y=window_database_status_3, Expression="x=y")
expression_59 = Expression(x="Normal", y=window_database_status_4, Expression="x=y")
and_30 = GateAnd(A=equals_19.Inequality, B=expression_58)
and_31 = GateAnd(A=equals_20.Inequality, B=expression_59)
event_39 = EventGate(Data=and_30)  # -> Data, IsNew
event_40 = EventGate(Data=and_31)  # -> Data, IsNew
panel_91 = Panel(event_39.Data)
save_windows = RemoteSender(event_39.Data)
panel_92 = Panel(event_40.Data)
load_windows = RemoteSender(event_40.Data)

# ----
# Load windows
load_windows_file_2 = RemoteReceiver(load_windows_file)
load_windows_2 = RemoteReceiver(load_windows)
gate_18 = StreamGate(Stream=load_windows_file_2, Gate=load_windows_2)  # -> Target0, Target1
getdocumentusertext_8 = Python3Script(run=load_windows_2, key="Heath windows")  # -> json_string; same code as getdocumentusertext
file_4 = ReadFile(File=gate_18.Target1, PerLineParse=False)
entwine_95 = Entwine(Branch00=getdocumentusertext_8, Branch01=file_4, FlattenInputs=True)  # -> flatten(Result)
split_6 = TextSplit(Text=file_4, Separators="|")  # -> flatten(Result)
strtoobj_4 = HBStringToObject(hb_str=split_6)  # -> hb_obj; plug-in component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
null_25 = NullItem(Item=strtoobj_4)  # -> NullFlags, InvalidFlags, Description
item_17 = ListItem(List=null_25.NullFlags, Index=0, Wrap=True)
filter_26 = StreamFilter(Gate=item_17, Stream0=entwine_95)
join_6 = TextJoin(Text=filter_26, Join="|")
freeze_gate_39 = StreamFreezeGate(Data=join_6, PassingSwitch=load_windows_2, Freeze=False, Hold=False)

# ----
# Save windows
save_windows_2 = RemoteReceiver(save_windows)
getdocumentusertext_9 = Python3Script(run=save_windows_2, key="Heath windows")  # -> json_string; same code as getdocumentusertext
null_26 = NullItem(Item=getdocumentusertext_9)  # -> NullFlags, InvalidFlags, Description
bool_38 = Boolean(invert(null_26.NullFlags))
save_windows_file_2 = RemoteReceiver(save_windows_file)
filter_27 = StreamFilter(Gate=null_26.NullFlags, Stream0=save_windows_2, Stream1=bool_38)
writetxt_4 = WriteToTextFile(Run=filter_27, TextToWrite=getdocumentusertext_9, FilePath=save_windows_file_2, Append=False, NewOnly=False)

# ----
# Heath material info
panel_93 = Panel("C:\Users\Isac\Desktop\Toivo_Chalmers\heath\model\results\Building physics from physical principles to international standards, Marko Pinteric_page-0001.jpg")
heath_flying_10 = RemoteReceiver(heath_flying)
number_slider_29 = Slider(560, range=0..1000)
panel_94 = Panel("\Building physics from physical principles to international standards, Marko Pinteric_page-0001.jpg")
py3_29 = Python3Script(get=heath_flying_10)  # -> mpl_folder; same code as py3_6
multiplication = Multiplication(A=Slider(1.15, range=0..10), B=number_slider_29)
number_slider_30 = Slider(500, range=0..1000)
concat = Concatenate(FragmentA=py3_29, FragmentB=panel_94)
create_modal_location_2 = RemoteReceiver(create_modal_location)
null_27 = NullItem(Item=concat)  # -> NullFlags, InvalidFlags, Description
multiplication_2 = Multiplication(A=Slider(1.25, range=0..10), B=number_slider_30)
filter_28 = StreamFilter(Gate=null_27.NullFlags, Stream0=concat, Stream1=panel_93)
image_3 = CreateImage(ImageSource=filter_28, ImageWidth=multiplication_2, ImageHeight=number_slider_30)

# ----
# Assemble Honeybee model
# # Assemble Honeybee model
# This cluster takes input geometry and geometric information and generates a valid Honeybee model which can be used in the following analysis steps.
# 
# ## Instructions
# Enter the relevant inputs to generate the Honeybee model. Windows can either be created using an input geometry or through auto-generation using a window-to-wall ratio.
# 
# ### Room geometry
# Each 3D Brep entered represents one room or thermal zone in the building with no air exchange between them. The Breps should be closed and 3D to generate valid rooms. The room geometries should represent the inner boundary of the external walls
# 
# ### Adjacent geometry
# Geometry of adjacent buildings represented by a surface where they contact the room geometry. Adiabatic boundary condition will be assumed at the contact surface.
# 
# ### Windows/apertures
# Windows can either be defined through a list of 2D surfaces which intersect with the room 3D geometries, or be auto-generated through the list of numeric outputs.
# 
# ### Wall/roof thicknesses
# Wall and roof thicknesses are supplied to generate a shading geometry representing the external surface thickness
# 
# ### Louvers
# If all related inputs are entered, shading louvers will be generated on each window according to the entered parameters.
# 
# ### Different directions
# All the above inputs will be the same for all rooms, however they can be optionally entered as a list which represents different values for different cardinal directions, in the order (N, E, S, W).
# 
# ## Inputs
# - `Model name` - text string representing the name of the analysis model
# - `Room geometry` - list of 3D closed Brep geometries representing each room/zone in the model
# - `Construction set` - text string representing the construction to be used for the rooms, can be retrieved using the HB Construction Set by Climate component
# - `Program` - Honeybee Program or list of which are applied to the rooms in the model. Can be defined using the HB Search Programs component
# - `Context geometry` - list of surrounding Brep geometries which shades the analysed Rooms
# - `Windows` - list of 2D Brep geometries which represent the openings in the building envelope. If not supplied, windows are instead generated through definition of window-to-wall ratios as defined below
# - `Skylights` - list of 2D Brep geometries which represent the openings in the building roof
# - `Window-to-wall ratio` - number representing the window-to-wall ratio on each exterior surface Used if no window geometries are supplied.
# - `Subdivide generated windows` - set to True if the window surface area should be divided into multiple windows on each exterior surface
# - `Window height` - number representing the target height of the auto-generated windows
# - `Sill height` - number representing how high the lower edge of the auto-generated windows should be from the room floor
# - `Horizontal separation` - number representing how far separated the auto-generated windows should be horizontally
# - `Vertical separation` - number representing if auto-generated windows should be split vertically and if so, what distance
# - `Wall thickness` - number representing the thickness of the exterior walls, used to generate shading geometry for windows
# - `Roof thickness` - number representing the thickness of the roof, used to generate shading geometry for skylights
# - `Louver depth` - number optionally representing the depth of louvers
# - `Number of louvers` - number optionally representing the amount of louvers on each window
# - `Distance between louvers ` - number optionally representing the distance between louvers on each window
# - `Louver angle` - number optionally representing if louvers should be tilted
# - `Vertical/horizontal louvers` - boolean, set to True if louvers should be vertical
# 
# ## Outputs
# - `Honeybee model` - valid Honeybee model for further analysis
# 
# ## Interpretation
# To be added...
savegeometry_9 = RemoteReceiver(savegeometry)
create_model_4 = RemoteReceiver(create_model_2)
savegeometry_10 = RemoteReceiver(savegeometry)
savegeometry_11 = RemoteReceiver(savegeometry)
create_model_5 = RemoteReceiver(create_model_2)
savegeometry_12 = RemoteReceiver(savegeometry)
create_model_6 = RemoteReceiver(create_model_2)
create_model_7 = RemoteReceiver(create_model_2)
or_20 = GateOr(A=savegeometry_9, B=create_model_4, C=Toggle(True))
or_21 = GateOr(A=savegeometry_10, B=create_model_5, C=Toggle(True))
or_22 = GateOr(A=savegeometry_11, B=create_model_6, C=Toggle(True))
or_23 = GateOr(A=savegeometry_12, B=create_model_7, C=Toggle(True))
gate_19 = StreamGate(Stream="Heath geometry type", Gate=or_20)  # -> Target0, Target1
gate_20 = StreamGate(Stream="Heath geometry type", Gate=or_21)  # -> Target0, Target1
gate_21 = StreamGate(Stream="Heath geometry type", Gate=or_22)  # -> Target0, Target1
gate_22 = StreamGate(Stream="Heath geometry type", Gate=or_23)  # -> Target0, Target1
refkv_5 = ReferenceByKeyValue(Key=gate_19.Target1, Val="Room", lightweight=False)
refkv_6 = ReferenceByKeyValue(Key=gate_20.Target1, Val="Adjacent", lightweight=False)
refkv_7 = ReferenceByKeyValue(Key=gate_21.Target1, Val="Context", lightweight=False, DisableAutoUpdate=True)
refkv_8 = ReferenceByKeyValue(Key=gate_22.Target1, Val="Window", lightweight=False)
distance_between_louvers_2 = RemoteReceiver(distance_between_louvers)
number_of_louvers_5 = RemoteReceiver(number_of_louvers)
generate_wwr_2 = RemoteReceiver(generate_wwr)
model_name_3 = RemoteReceiver(model_name)
create_model_8 = RemoteReceiver(create_model_2)
data_15 = Data(programtype)
louver_angle_2 = RemoteReceiver(louver_angle)
louver_depth_2 = RemoteReceiver(louver_depth)
adjacent = Geometry(refkv_6)
room = Geometry(refkv_5)
windows_2 = Geometry(refkv_8)
context = Geometry(refkv_7)
panel_95 = Panel(create_model_8)
bool_39 = Boolean(number_of_louvers_5)
filter_29 = StreamFilter(Gate=bool_39, Stream0="0", Stream1=louver_depth_2)
filter_30 = StreamFilter(Gate=bool_39, Stream0="0", Stream1=distance_between_louvers_2)
filter_31 = StreamFilter(Gate=bool_39, Stream0="0", Stream1=louver_angle_2)
multiplication_3 = Multiplication(A=filter_29, B="0.01")
louver_angle_3 = Number(filter_31)
vertical_horizontal_louvers = Boolean()
subdivide_generated_windows = Boolean(Toggle(True))
window_height = Number()
sill_height = Number(Slider(0.3, range=0..1))
horizontal_separation = Number()
vertical_separation = Number()
louver_depth_3 = Number(multiplication_3)
number_of_louvers_6 = Number(number_of_louvers_5)
distance_between_louvers_3 = Number(filter_30)
py3_30 = Python3Script(
    depth=louver_depth_3,
    count=number_of_louvers_6,
    dist=distance_between_louvers_3,
    angle=louver_angle_3,
    direction=vertical_horizontal_louvers)  # -> out, louver_settings
# ---------- py3_30: Python ----------
"""Create louver Settings"""
from heath import LouverSettings

louver_settings = LouverSettings(depth, int(count), dist, angle, direction)
# ---------- end py3_30 ----------
toggle_3 = BooleanToggle(True)
show_honeybee_windows_3 = RemoteReceiver(show_honeybee_windows)
show_honeybee_context_3 = RemoteReceiver(show_honeybee_context)
show_honeybee_ground_3 = RemoteReceiver(show_honeybee_ground)
show_honeybee_doors_3 = RemoteReceiver(show_honeybee_doors)
show_honeybee_floors_3 = RemoteReceiver(show_honeybee_floors)
show_honeybee_walls_3 = RemoteReceiver(show_honeybee_walls)
show_honeybee_roof_3 = RemoteReceiver(show_honeybee_roof)

id_3 = Guid(windows_2)
py3_31 = Python3Script(x=id_3)  # -> out, a; inputs x: list; same code as py3_26
windows_3 = Geometry(py3_31.a)

# ----
# Create material tooltip
panel_96 = Panel(":")

# ----
# Create construction tooltip
panel_97 = Panel(":")

# ----
# Backend data inside layers
panel_98 = Panel("0, 0, 0")
path = DataPath(panel_98)
path_2 = DataPath("0, 0, 0")

# ----
# Create window tooltip
number_slider_31 = Slider(0, range=0..100)
dom_3 = ConstructDomain(DomainStart=number_slider_31, DomainEnd=Slider(12, range=0..100))
dom_4 = ConstructDomain(DomainStart=Slider(0, range=0..100), DomainEnd=Slider(1, range=0..100))

# ----
# Remove material
pre_material_database_remove_material_2 = RemoteReceiver(pre_material_database_remove_material)
cull_10 = CullPattern(List=pre_material_database_remove_material_2, CullPattern=pre_material_database_remove_material_2)
lng_15 = ListLength(List=cull_10)
filter_32 = StreamFilter(Gate=lng_15, Stream0="False", Stream1=cull_10)
freeze_gate_40 = StreamFreezeGate(Data=pre_material_database_remove_material_2, PassingSwitch=filter_32, Freeze=True, Hold=False)
material_database_remove_material_2 = RemoteReceiver(material_database_remove_material)
getdocumentusertext_10 = Python3Script(run=material_database_remove_material_2, key="Heath materials")  # -> json_string; same code as getdocumentusertext
split_7 = TextSplit(Text=getdocumentusertext_10, Separators="|")
strtoobj_5 = HBStringToObject(hb_str=split_7)  # -> flatten(hb_obj); plug-in component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
decnstrmat_2 = HBDeconstructMaterial(mat=strtoobj_5)  # -> values, attr_names, r_val_si, r_val_ip; plug-in component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
item_18 = ListItem(List=decnstrmat_2.values, Index=0, Wrap=True)  # -> flatten(Item)
cset_5 = CreateSet(List=item_18)  # -> Set, Map
lng_16 = ListLength(List=cset_5.Set)
larger = LargerThan(FirstNumber=lng_16, SecondNumber="1")  # -> LargerThan, OrEqualTo
bool_40 = Boolean(larger.LargerThan)

# ----
# Backend visible layers
panel_99 = Panel("1")
neg = Negative(Value=panel_99)
starting_layers = Slider(1, range=0..6)

# ----
# Create construction
panel_100 = Panel("""Layer 1
Layer 2
Layer 3
Layer 4
Layer 5
Layer 6""")
textbox_3 = CreateTextBox(Label="Name", DefaultText="New construction", UpdateButton=invert(True), showLabel=True)
lng_17 = ListLength(List=panel_100)
values_105 = ValueListener(Elements=textbox_3, SomeProperty=True)  # -> Values, Indices
empty_11 = EmptyObjectToEmptyBranch()
label_38 = CreateLabel(LabelText="[Innermost layer]", LabelSize=12, Justification=0)
button_33 = CreateButton(ButtonName="+", ButtonStyle=3)
button_34 = CreateButton(ButtonName="Create construction", ButtonStyle=0)
label_39 = CreateLabel(LabelText="[Outermost layer]", LabelSize=12, Justification=0)
label_40 = CreateLabel(LabelText=panel_100, LabelSize=18, Justification=0)
empty_12 = EmptyObjectToEmptyBranch()
construction_maximum_layer_limit = RemoteSender(lng_17)
construction_maximum_layer_limit_2 = RemoteReceiver(construction_maximum_layer_limit)
subtraction_4 = Subtraction(A=construction_maximum_layer_limit_2, B="1")
repeat_13 = RepeatData(Data="Material", Length=construction_maximum_layer_limit_2)
repeat_14 = RepeatData(Data="X", Length=construction_maximum_layer_limit_2)
repeat_15 = RepeatData(Data="⇕", Length=subtraction_4)
repeat_16 = RepeatData(Data="Thickness [m]", Length=construction_maximum_layer_limit_2)
create_construction_name = RemoteSender(values_105.Values)
panel_101 = Panel(values_105.Values)
button_35 = CreateButton(ButtonName=repeat_14, ButtonStyle=3)
values_106 = ValueListener(Elements=button_33, SomeProperty=True)  # -> Values, Indices
values_107 = ValueListener(Elements=button_34, SomeProperty=True)  # -> Values, Indices
button_36 = CreateButton(ButtonName=repeat_15, ButtonStyle=3)
pulldown_24 = CreatePulldownMenu(Label=repeat_13, ListItems=empty_12, showLabel=True)
textbox_4 = CreateTextBox(Label=repeat_16, DefaultText=Slider(0.25, range=0.01..1), UpdateButton=invert(True), showLabel=True)
add_layer = RemoteSender(values_106.Values)
values_108 = ValueListener(Elements=button_35, SomeProperty=True)  # -> flatten(Values), Indices
cull_11 = CullPattern(List=values_108.Values, CullPattern=values_108.Values)
lng_18 = ListLength(List=cull_11)
filter_33 = StreamFilter(Gate=lng_18, Stream0="False", Stream1=cull_11)
create_construction = RemoteSender(values_107.Values)
values_109 = ValueListener(Elements=button_36, SomeProperty=True)  # -> flatten(Values), Indices
cull_12 = CullPattern(List=values_109.Values, CullPattern=values_109.Values)
lng_19 = ListLength(List=cull_12)
filter_34 = StreamFilter(Gate=lng_19, Stream0="False", Stream1=cull_12)
values_110 = ValueListener(Elements=pulldown_24, SomeProperty=True)  # -> Values, Indices
values_111 = ValueListener(Elements=textbox_4, SomeProperty=True)  # -> Values, Indices
freeze_gate_41 = StreamFreezeGate(Data=filter_34, PassingSwitch=invert(filter_34))
merge_10 = Merge(Data1=simplify(graft(label_40)), Data2=simplify(graft(button_35)))
merge_11 = Merge(Data1=simplify(graft(pulldown_24)), Data2=simplify(graft(textbox_4)))
freeze_gate_42 = StreamFreezeGate(Data=filter_33, PassingSwitch=invert(filter_33))
create_construction_materials = RemoteSender(values_110.Indices)
create_construction_thickness = RemoteSender(values_111.Values)
pre_switch_layer = RemoteSender(values_109.Values)
pre_remove_layer = RemoteSender(values_108.Values)
bool_41 = Boolean(invert(freeze_gate_41))
bool_42 = Boolean(invert(freeze_gate_42))
stack_61 = CreateStack(UIElements=merge_11, Horizontal=True)
stack_62 = CreateStack(UIElements=merge_10, Horizontal=True)
tap_19 = TapBuffer(Reset=False, Incremental=True, Valve=bool_41, Hold=True)
tap_20 = TapBuffer(Reset=False, Incremental=True, Valve=bool_42, Hold=True)
dam_21 = DataDam(DataA=tap_19, BufferDelay=2500000, BufferMode=2)
dam_22 = DataDam(DataA=tap_20, BufferDelay=2500000, BufferMode=2)
equals_30 = Equality(FirstNumber=tap_19, SecondNumber=dam_21)  # -> Equality, Inequality
equals_31 = Equality(FirstNumber=tap_20, SecondNumber=dam_22)  # -> Equality, Inequality
event_41 = EventGate(Data=equals_30.Inequality)  # -> Data, IsNew
event_42 = EventGate(Data=equals_31.Inequality)  # -> Data, IsNew
merge_12 = Merge(Data1=simplify(stack_62), Data2=simplify(stack_61), Data3=simplify(graft(button_36)))
entwine_96 = Entwine(Branch00=textbox_3, FlattenInputs=True)  # -> flatten(Result)
switch_layer = RemoteSender(event_41.Data)
adjustpos_99 = AdjustElementPositioning(
    ElementsToAdjust=textbox_3,
    Margin="0, 0, 0, 5",
    AbsolutePositioning=False,
    Width=Slider(190, range=0..300),
    HorizontalAlignment=0)
remove_layer = RemoteSender(event_42.Data)
adjustpos_100 = AdjustElementPositioning(
    ElementsToAdjust=pulldown_24,
    AbsolutePositioning=False,
    Width=Slider(190, range=0..300),
    HorizontalAlignment=0,
    VerticalAlignment=2)
adjustpos_101 = AdjustElementPositioning(
    ElementsToAdjust=textbox_4,
    Margin="0, 5, 0, 0",
    AbsolutePositioning=False,
    Width=Slider(120, range=0..300),
    HorizontalAlignment=0,
    VerticalAlignment=2)
adjustpos_102 = AdjustElementPositioning(
    ElementsToAdjust=button_33,
    Margin="10, 5, 0, 0",
    AbsolutePositioning=False,
    Width=Slider(32, range=0..300),
    Height=Slider(32, range=0..300),
    HorizontalAlignment=0)
adjustpos_103 = AdjustElementPositioning(
    ElementsToAdjust=button_36,
    Margin="5, 0, 0, 0",
    AbsolutePositioning=False,
    Width=Slider(26, range=0..300),
    Height=Slider(26, range=0..300),
    HorizontalAlignment=0,
    VerticalAlignment=2)
adjustelem_15 = AdjustElementAppearance(ElementsToAdjust=button_36, Foreground=ColourSwatch(SwatchColor=RGBA(38, 38, 38, 193)), FontSize=Slider(19, range=0..50))
adjustpos_104 = AdjustElementPositioning(
    ElementsToAdjust=button_35,
    AbsolutePositioning=False,
    Width=Slider(26, range=0..300),
    Height=Slider(26, range=0..300),
    HorizontalAlignment=0)
adjustelem_16 = AdjustElementAppearance(ElementsToAdjust=button_33, Foreground=ColourSwatch(SwatchColor=RGB(15, 178, 0)), FontSize=Slider(21, range=0..50))
adjustelem_17 = AdjustElementAppearance(ElementsToAdjust=button_35, Foreground=ColourSwatch(SwatchColor=RGB(255, 0, 0)), FontSize=Slider(12, range=0..50))
adjustpos_105 = AdjustElementPositioning(ElementsToAdjust=button_34, Margin="0, 10, 0, 0", AbsolutePositioning=False, HorizontalAlignment=1, VerticalAlignment=2)

pre_remove_layer_2 = RemoteReceiver(pre_remove_layer)
pre_switch_layer_2 = RemoteReceiver(pre_switch_layer)
create_construction_materials_2 = RemoteReceiver(flatten(create_construction_materials))
create_construction_thickness_2 = RemoteReceiver(flatten(create_construction_thickness))
cull_13 = CullPattern(List=pre_remove_layer_2, CullPattern=pre_remove_layer_2)
cull_14 = CullPattern(List=pre_switch_layer_2, CullPattern=pre_switch_layer_2)
add_layer_2 = RemoteReceiver(add_layer)
mindex_5 = MemberIndex(Set=pre_remove_layer_2, Member=cull_13)  # -> Index, Count
mindex_6 = MemberIndex(Set=pre_switch_layer_2, Member=cull_14)  # -> Index, Count
py3_32 = Python3Script(
    add_layer=add_layer_2,
    remove_layer=mindex_5.Index,
    switch_layer=mindex_6.Index,
    materials=create_construction_materials_2,
    thickness=create_construction_thickness_2)  # -> out_materials, out_thickness; inputs materials: list, thickness: list
# ---------- py3_32: Python ----------
def add_layers():
    thickness.append(0.25)
    out_thickness = thickness
    
def remove_layers():
    materials.pop(remove_layer)
    thickness.pop(remove_layer)

def switch_layers():
    temp_materials = materials[switch_layer]
    materials[switch_layer] = materials[switch_layer+1]
    materials[switch_layer+1] = temp_materials

    temp_thickness = thickness[switch_layer]
    thickness[switch_layer] = thickness[switch_layer+1]
    thickness[switch_layer+1] = temp_thickness
    

if add_layer:
    add_layers()

elif remove_layer is not None:
    remove_layers()
    out_materials = materials
    out_thickness = thickness

elif switch_layer is not None:
    switch_layers()
    out_materials = materials
    out_thickness = thickness
else:
    out_materials = None
    out_thickness = None
# ---------- end py3_32 ----------
branch = TreeBranch(Tree=py3_32.out_thickness, Path=path, MaintainPaths=True)
branch_2 = TreeBranch(Tree=py3_32.out_materials, Path=path_2, MaintainPaths=True)
lng_20 = ListLength(List=branch_2)
lng_21 = ListLength(List=branch)
bool_43 = Boolean(lng_21)
bool_44 = Boolean(lng_20)
gate_23 = StreamGate(Stream=branch, Gate=bool_43)  # -> Target0, Target1
gate_24 = StreamGate(Stream=branch_2, Gate=bool_44)  # -> Target0, Target1
hold_3 = HoldingGate(Data=gate_23.Target1)
hold_4 = HoldingGate(Data=gate_24.Target1)
hasdata_6 = DataExists(Data=hold_3)
hasdata_7 = DataExists(Data=hold_4)
timeshift = TimeShifter(Data=hold_3, Capacity="1")
timeshift_2 = TimeShifter(Data=hold_4, Capacity="1")
bool_45 = Boolean(hasdata_6)
bool_46 = Boolean(hasdata_7)
remove_layer_2 = RemoteReceiver(remove_layer)
switch_layer_2 = RemoteReceiver(switch_layer)
filter_35 = StreamFilter(Gate=bool_45, Stream0=timeshift, Stream1=hold_3)
filter_36 = StreamFilter(Gate=bool_46, Stream0=timeshift_2, Stream1=hold_4)
entwine_97 = Entwine(Branch00=filter_36, Branch01=filter_35, FlattenInputs=True)
or_24 = GateOr(A=switch_layer_2, B=remove_layer_2)
gate_25 = StreamGate(Stream=entwine_97, Gate=or_24)  # -> Target0, Target1
bang_8 = ExplodeTree(Data=gate_25.Target1)  # -> Branch0, Branch1

remove_layer_3 = RemoteReceiver(flatten(remove_layer))
add_layer_3 = RemoteReceiver(add_layer)
construction_maximum_layer_limit_3 = RemoteReceiver(construction_maximum_layer_limit)
gate_26 = StreamGate(Stream=panel_99, Gate=add_layer_3)  # -> Target0, Target1
gate_27 = StreamGate(Stream=neg, Gate=remove_layer_3)  # -> Target0, Target1
rec_17 = DataRecorder([gate_26.Target1, gate_27.Target1], DataLimit=-10, RecordData=True)
py3_33 = Python3Script(numbers=[starting_layers, rec_17], maximum_layers=construction_maximum_layer_limit_3)  # -> visible_layers_arrows, visible_layers; inputs numbers: list of Int32, maximum_layers: Int32
# ---------- py3_33: Python ----------
current_sum = 0

for number in numbers:
    if (number == 1) and (current_sum >= maximum_layers):
        continue
    if (number == -1) and (current_sum <= 1):
        continue
    else:
        current_sum += number

visible_layers = [True]*current_sum
visible_layers.extend([False]*(maximum_layers-current_sum))
visible_layers_arrows = visible_layers[1:]
# ---------- end py3_33 ----------
visible_layers_arrows = RemoteSender(py3_33.visible_layers_arrows)
visible_layers = RemoteSender(simplify(graft(py3_33.visible_layers)))

create_construction_name_2 = RemoteReceiver(create_construction_name)
create_construction_name_3 = RemoteReceiver(create_construction_name)
py3_34 = Python3Script(name=create_construction_name_3)  # -> not_valid; inputs name: String
# ---------- py3_34: Python ----------
if 'å' in name:
    not_valid = True
elif 'ä' in name:
    not_valid = True
elif 'ö' in name:
    not_valid = True
else:
    not_valid = False
# ---------- end py3_34 ----------
gate_28 = StreamGate(Stream="'å', 'ä' and 'ö' are not allowed", Gate=py3_34)  # -> Target0, Target1

# ----
# Add construction
create_construction_materials_3 = RemoteReceiver(create_construction_materials)
create_construction_thickness_3 = RemoteReceiver(create_construction_thickness)
visible_layers_2 = RemoteReceiver(visible_layers)
create_construction_name_4 = RemoteReceiver(create_construction_name)
repeat_17 = RepeatData(Data=create_construction_thickness_3, Length=visible_layers_2)  # -> flatten(Data)
create_construction_2 = RemoteReceiver(create_construction)
getdocumentusertext_11 = Python3Script(run=create_construction_2, key="Heath constructions")  # -> json_string; same code as getdocumentusertext

# ----
# Create material
material_database_categories_6 = RemoteReceiver(material_database_categories_2)
panel_102 = Panel("""Rough
Smooth""")
textbox_5 = CreateTextBox(Label="Name", DefaultText="New material", UpdateButton=invert(True), showLabel=True)
textbox_6 = CreateTextBox(DefaultText=Slider(0.036, range=0..2), UpdateButton=invert(True), showLabel=False)
textbox_7 = CreateTextBox(DefaultText=Slider(200, range=0..1000), UpdateButton=invert(True), showLabel=False)
label_41 = CreateLabel(LabelText="Conductivity [W/m-K]", LabelSize=12, Justification=0)
pulldown_25 = CreatePulldownMenu(
    Label="Material category",
    ListItems=material_database_categories_6,
    SelectedIndex=Slider(3, range=0..10),
    showLabel=True)
textbox_8 = CreateTextBox(DefaultText=Slider(28, range=0..1000), UpdateButton=invert(True), showLabel=False)
true_button_12 = CreateTrueOnlyButton(ButtonName="?", ButtonStyle=2)
button_37 = CreateButton(ButtonName="Create material", ButtonStyle=0)
textbox_9 = CreateTextBox(DefaultText=Slider(1500, range=0..10000), UpdateButton=invert(True), showLabel=False)
label_42 = CreateLabel(LabelText="Roughness", LabelSize=12, Justification=0)
label_43 = CreateLabel(LabelText="Specific heat [J/kg-K]", LabelSize=12, Justification=0)
label_44 = CreateLabel(LabelText="Absorption", LabelSize=12, Justification=0)
pulldown_26 = CreatePulldownMenu(ListItems=panel_102, showLabel=False)
label_45 = CreateLabel(LabelText="Density [kg/m3]", LabelSize=12, Justification=0)
values_112 = ValueListener(Elements=textbox_5, SomeProperty=True)  # -> Values, Indices
values_113 = ValueListener(Elements=true_button_12, SomeProperty=True)  # -> Values, Indices
values_114 = ValueListener(Elements=textbox_6, SomeProperty=True)  # -> Values, Indices
values_115 = ValueListener(Elements=button_37, SomeProperty=True)  # -> Values, Indices
values_116 = ValueListener(Elements=pulldown_25, SomeProperty=True)  # -> Values, Indices
values_117 = ValueListener(Elements=pulldown_26, SomeProperty=True)  # -> Values, Indices
values_118 = ValueListener(Elements=textbox_7, SomeProperty=True)  # -> Values, Indices
values_119 = ValueListener(Elements=textbox_8, SomeProperty=True)  # -> Values, Indices
values_120 = ValueListener(Elements=textbox_9, SomeProperty=True)  # -> Values, Indices
create_material_name = RemoteSender(values_112.Values)
create_material_conductivity = RemoteSender(values_114.Values)
info_create_material = RemoteSender(values_113.Values)
freeze_gate_43 = StreamFreezeGate(Data=values_115.Values, PassingSwitch=invert(values_115.Values))
create_material_category = RemoteSender(values_116.Values)
create_material_density = RemoteSender(values_119.Values)
create_material_sprecific_heat = RemoteSender(values_120.Values)
entwine_98 = Entwine(Branch00=label_44, Branch01=textbox_7, FlattenInputs=True)  # -> flatten(Result)
entwine_99 = Entwine(Branch00=label_42, Branch01=pulldown_26, FlattenInputs=True)  # -> flatten(Result)
entwine_100 = Entwine(Branch00=label_41, Branch01=textbox_6, FlattenInputs=True)  # -> flatten(Result)
entwine_101 = Entwine(Branch00=label_43, Branch01=textbox_9, FlattenInputs=True)  # -> flatten(Result)
entwine_102 = Entwine(Branch00=label_45, Branch01=textbox_8, FlattenInputs=True)  # -> flatten(Result)
bool_47 = Boolean(invert(freeze_gate_43))
stack_63 = CreateStack(UIElements=entwine_100, Horizontal=True)
stack_64 = CreateStack(UIElements=entwine_101, Horizontal=True)
stack_65 = CreateStack(UIElements=entwine_102, Horizontal=True)
tap_21 = TapBuffer(Reset=False, Incremental=True, Valve=bool_47, Hold=True)
create_material_modal_2 = RemoteReceiver(create_material_modal)
dam_23 = DataDam(DataA=tap_21, BufferDelay=2500000, BufferMode=2)
adjustelem_18 = AdjustElementAppearance(
    ElementsToAdjust=true_button_12,
    Foreground=ColourSwatch(SwatchColor=RGB(0, 0, 0)),
    Background=ColourSwatch(SwatchColor=RGB(230, 230, 230)),
    FontSize=Slider(12, range=0..300))
equals_32 = Equality(FirstNumber=tap_21, SecondNumber=dam_23)  # -> Equality, Inequality
and_32 = GateAnd(A=equals_32.Inequality, B=create_material_modal_2)
number_slider_32 = Slider(29, range=0..300)
event_43 = EventGate(Data=and_32)  # -> Data, IsNew
entwine_103 = Entwine(Branch00=textbox_5, Branch01=true_button_12, FlattenInputs=True)  # -> flatten(Result)
create_material = RemoteSender(event_43.Data)
stack_66 = CreateStack(UIElements=entwine_103, Horizontal=True)
adjustpos_106 = AdjustElementPositioning(ElementsToAdjust=textbox_5, AbsolutePositioning=False, Width=Slider(185, range=0..300), HorizontalAlignment=0)
adjustpos_107 = AdjustElementPositioning(ElementsToAdjust=true_button_12, AbsolutePositioning=False, Width=number_slider_32, Height=number_slider_32)
adjustpos_108 = AdjustElementPositioning(
    ElementsToAdjust=pulldown_25,
    Margin="0, 10, 5, 0",
    AbsolutePositioning=False,
    Width=Slider(229, range=0..300),
    HorizontalAlignment=0)
adjustpos_109 = AdjustElementPositioning(
    ElementsToAdjust=[label_44, label_42, label_43, label_45, label_41],
    AbsolutePositioning=False,
    Width=Slider(150, range=0..300),
    HorizontalAlignment=0,
    VerticalAlignment=2)
adjustpos_110 = AdjustElementPositioning(
    ElementsToAdjust=[textbox_7, pulldown_26, textbox_9, textbox_8, textbox_6],
    AbsolutePositioning=False,
    Width=Slider(50, range=0..300),
    HorizontalAlignment=0,
    VerticalAlignment=2)
adjustpos_111 = AdjustElementPositioning(ElementsToAdjust=button_37, Margin="0, 10, 0, 0", AbsolutePositioning=False, HorizontalAlignment=1, VerticalAlignment=2)

info_create_material_2 = RemoteReceiver(info_create_material)
rec_18 = DataRecorder(info_create_material_2, DataLimit=-2, RecordData=True)
ma_10 = MassAddition(Input=rec_18)  # -> Result, PartialResults
entwine_104 = Entwine(Branch00=ma_10.Result, Branch01=material_info, FlattenInputs=True)
rec_19 = DataRecorder(entwine_104, DataLimit=2, RecordData=True)
item_19 = ListItem(List=rec_19, Index=0, Wrap=True)  # -> Item2, Item1, Item
equals_33 = Equality(FirstNumber=item_19.Item2, SecondNumber=item_19.Item1)  # -> Equality, Inequality
bang_9 = ExplodeTree(Data=equals_33.Inequality)  # -> Branch0, Branch1
py3_35 = Python3Script(x=bang_9.Branch0, y=bang_9.Branch1)  # -> a; same code as py3_2
event_44 = EventGate(Data=py3_35)  # -> Data, IsNew
freeze_gate_44 = StreamFreezeGate(Data=py3_35, PassingSwitch=event_44.IsNew)
event_45 = EventGate(Data=freeze_gate_44)  # -> Data, IsNew
panel_103 = Panel(event_45.Data)
launchwin_9 = LaunchWindow(
    Show=event_45.Data,
    Name="Common materials",
    Width=multiplication,
    Height=number_slider_29,
    ChildStatus=1,
    EnableHorizScroll=False)
info_create_material_3 = RemoteReceiver(info_create_material)
winstat_9 = WindowStatus(Window=launchwin_9)
winprops_9 = SetWindowProperties(
    Window=launchwin_9,
    StartingLocation=create_modal_location_2,
    Theme=0,
    AccentColor=heath_accent_color_6,
    ShowTitleBar=True,
    BackgroundColor=RGB(255, 255, 255),
    ScaleFactor=1)
material_info_status = RemoteSender(winstat_9)
py3_36 = Python3Script(window=launchwin_9, activate=info_create_material_3)  # same code as py3_3
addelems_10 = AddElements(Window=launchwin_9, Elements=flatten(image_3), DoVLChecking=True)  # -> AddedElements, ElementNames

material_info_status_2 = RemoteReceiver(material_info_status)
expression_60 = Expression(x="Hidden", y=material_info_status_2, Expression="x=y")
expire_8 = ExpireObject(ObjectToExpire=objbynn_10, Expire=expression_60)

# ----
# Add material
create_material_sprecific_heat_2 = RemoteReceiver(create_material_sprecific_heat)
create_material_conductivity_2 = RemoteReceiver(create_material_conductivity)
create_material_category_2 = RemoteReceiver(create_material_category)
create_material_density_2 = RemoteReceiver(create_material_density)
create_material_name_2 = RemoteReceiver(create_material_name)
opaquemat_3 = HBOpaqueMaterial(
    name=create_material_name_2,
    thickness="inf",
    conductivity=create_material_conductivity_2,
    density=create_material_density_2,
    spec_heat=create_material_sprecific_heat_2,
    category=create_material_category_2)  # -> out, mat; plug-in component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
create_material_error = RemoteSender(opaquemat_3.out)
create_material_2 = RemoteReceiver(create_material)
gate_29 = StreamGate(Stream=opaquemat_3.mat, Gate=create_material_2)  # -> Target0, Target1
getdocumentusertext_12 = Python3Script(run=create_material_2, key="Heath materials")  # -> json_string; same code as getdocumentusertext
objtostr_2 = HBObjectToString(hb_obj=gate_29.Target1)  # -> hb_str; plug-in component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
entwine_105 = Entwine(Branch00=getdocumentusertext_12, Branch01=objtostr_2, FlattenInputs=True)  # -> flatten(Result)
join_7 = TextJoin(Text=entwine_105, Join="|")
freeze_gate_45 = StreamFreezeGate(Data=join_7, PassingSwitch=create_material_2, Freeze=False, Hold=False)

# ----
# Roughness
stack_67 = CreateStack(UIElements=entwine_99, Horizontal=True)
data_16 = Data(stack_67)

# ----
# Absorption
stack_68 = CreateStack(UIElements=entwine_98, Horizontal=True)
data_17 = Data(stack_68)

create_material_error_2 = RemoteReceiver(create_material_error)
panel_104 = Panel(create_material_error_2)
split_8 = TextSplit(Text=create_material_error_2, Separators=panel_96)
trim = TextTrim(Text=split_8, Start=True, End=True)
item_20 = ListItem(List=trim, Index=0, Wrap=True)  # -> Item, Item1
create_material_name_3 = RemoteReceiver(create_material_name)
create_material_name_4 = RemoteReceiver(create_material_name)
lng_22 = ListLength(List=split_8)
len_2 = TextLength(Text=item_20.Item1)
larger_2 = LargerThan(FirstNumber=lng_22, SecondNumber="1")  # -> LargerThan, OrEqualTo
subtraction_5 = Subtraction(A=len_2, B=Slider(11, range=0..20))
py3_37 = Python3Script(name=create_material_name_4)  # -> not_valid; inputs name: String; same code as py3_34
fragment_2 = TextFragment(Text=item_20.Item1, Start="0", Count=subtraction_5)
gate_30 = StreamGate(Stream="'å', 'ä' and 'ö' are not allowed", Gate=py3_37)  # -> Target0, Target1
filter_37 = StreamFilter(Gate=larger_2.LargerThan, Stream0=create_material_error_2, Stream1=fragment_2)

# ----
# Create window
number_slider_33 = Slider(0.5, range=0..12)
button_38 = CreateButton(ButtonName="Create window", ButtonStyle=0)
textbox_10 = CreateTextBox(Label="Name", DefaultText="New window", UpdateButton=invert(True), showLabel=True)
textbox_11 = CreateTextBox(DefaultText=number_slider_33, UpdateButton=invert(True), showLabel=False)
label_46 = CreateLabel(LabelText="U-factor [W/m2-K]", LabelSize=12, Justification=0)
textbox_12 = CreateTextBox(DefaultText=Slider(0.3, range=0..1), UpdateButton=invert(True), showLabel=False)
label_47 = CreateLabel(LabelText="SHGC", LabelSize=12, Justification=0)
values_121 = ValueListener(Elements=textbox_10, SomeProperty=True)  # -> Values, Indices
values_122 = ValueListener(Elements=button_38, SomeProperty=True)  # -> Values, Indices
values_123 = ValueListener(Elements=textbox_11, SomeProperty=True)  # -> Values, Indices
values_124 = ValueListener(Elements=textbox_12, SomeProperty=True)  # -> Values, Indices
pre_create_window = RemoteSender(values_122.Values)
create_window_u_factor = RemoteSender(values_123.Values)
freeze_gate_46 = StreamFreezeGate(Data=values_122.Values, PassingSwitch=invert(values_122.Values))
create_window_shgc = RemoteSender(values_124.Values)
create_window_name = RemoteSender(values_121.Values)
panel_105 = Panel(values_121.Values)
entwine_106 = Entwine(Branch00=label_46, Branch01=textbox_11, FlattenInputs=True)  # -> flatten(Result)
entwine_107 = Entwine(Branch00=label_47, Branch01=textbox_12, FlattenInputs=True)  # -> flatten(Result)
bool_48 = Boolean(invert(freeze_gate_46))
stack_69 = CreateStack(UIElements=entwine_106, Horizontal=True)
tap_22 = TapBuffer(Reset=False, Incremental=True, Valve=bool_48, Hold=True)
stack_70 = CreateStack(UIElements=entwine_107, Horizontal=True)
create_window_modal_2 = RemoteReceiver(create_window_modal)
dam_24 = DataDam(DataA=tap_22, BufferDelay=2500000, BufferMode=2)
equals_34 = Equality(FirstNumber=tap_22, SecondNumber=dam_24)  # -> Equality, Inequality
and_33 = GateAnd(A=equals_34.Inequality, B=create_window_modal_2)
event_46 = EventGate(Data=and_33)  # -> Data, IsNew
create_window = RemoteSender(event_46.Data)
adjustpos_112 = AdjustElementPositioning(ElementsToAdjust=textbox_10, AbsolutePositioning=False, Width=Slider(200, range=0..300), HorizontalAlignment=0)
adjustpos_113 = AdjustElementPositioning(
    ElementsToAdjust=[label_47, label_46],
    AbsolutePositioning=False,
    Width=Slider(150, range=0..300),
    HorizontalAlignment=0,
    VerticalAlignment=2)
adjustpos_114 = AdjustElementPositioning(
    ElementsToAdjust=[textbox_12, textbox_11],
    AbsolutePositioning=False,
    Width=Slider(50, range=0..300),
    HorizontalAlignment=0,
    VerticalAlignment=2)
adjustpos_115 = AdjustElementPositioning(ElementsToAdjust=button_38, Margin="0, 10, 0, 0", AbsolutePositioning=False, HorizontalAlignment=1, VerticalAlignment=2)

# ----
# Add window
create_window_u_factor_2 = RemoteReceiver(create_window_u_factor)
create_window_name_2 = RemoteReceiver(create_window_name)
create_window_shgc_2 = RemoteReceiver(create_window_shgc)
windowmat = HBWindowMaterial(name=create_window_name_2, u_factor=create_window_u_factor_2, shgc=create_window_shgc_2)  # -> out, mat; plug-in component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
create_window_error = RemoteSender(windowmat.out)
create_window_2 = RemoteReceiver(create_window)
gate_31 = StreamGate(Stream=windowmat.mat, Gate=create_window_2)  # -> Target0, Target1
getdocumentusertext_13 = Python3Script(run=create_window_2, key="Heath windows")  # -> json_string; same code as getdocumentusertext
objtostr_3 = HBObjectToString(hb_obj=gate_31.Target1)  # -> hb_str; plug-in component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
entwine_108 = Entwine(Branch00=getdocumentusertext_13, Branch01=objtostr_3, FlattenInputs=True)  # -> flatten(Result)
freeze_gate_47 = StreamFreezeGate(Data=entwine_108, PassingSwitch=create_window_2, Freeze=False, Hold=False)
join_8 = TextJoin(Text=freeze_gate_47, Join="|")

# ----
# Windows database
panel_106 = Panel("Heath windows")
setdocumentusertext_2 = Python3Script(key=panel_106, load_value=freeze_gate_39, remove_value=freeze_gate_25, add_value=join_8)  # -> done
# ---------- setdocumentusertext_2: Python ----------
import Rhino
import rhinoscriptsyntax as rs
import scriptcontext as sc

def modify_value(value):
    sc.doc = Rhino.RhinoDoc.ActiveDoc

    return rs.SetDocumentUserText(key, value)

    sc.doc = ghdoc

if load_value:
    done = modify_value(load_value)

if add_value:
    done = modify_value(add_value)

if remove_value:
    done = modify_value(remove_value)
if remove_value == False:
    done = modify_value(None)
# ---------- end setdocumentusertext_2 ----------
getdocumentusertext_14 = Python3Script(run=setdocumentusertext_2, key="Heath windows")  # -> json_string
# ---------- getdocumentusertext_14: Python ----------
import Rhino
import rhinoscriptsyntax as rs
import scriptcontext as sc

if run:
    sc.doc = Rhino.RhinoDoc.ActiveDoc

    json_string = rs.GetDocumentUserText(key)
    if json_string == None:
        json_string = False

    sc.doc = ghdoc
# ---------- end getdocumentusertext_14 ----------
split_9 = TextSplit(Text=getdocumentusertext_14, Separators="|")
hold_5 = HoldingGate(Data=split_9)
strtoobj_6 = HBStringToObject(hb_str=hold_5)  # -> flatten(hb_obj); plug-in component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
ipy2_2 = IronPython2Script(windows=strtoobj_6)  # -> unique_windows; inputs windows: list
# ---------- ipy2_2: IronPython ----------
"""Grasshopper Script"""

unique_windows = []

for i in range(len(windows)):
    if windows[i] not in unique_windows:
        unique_windows.append(windows[i])
# ---------- end ipy2_2 ----------
clean = CleanTree(RemoveNulls=True, RemoveInvalid=True, RemoveEmpty=False, Tree=ipy2_2)
lng_23 = ListLength(List=ipy2_2)
lng_24 = ListLength(List=strtoobj_6)
smaller = SmallerThan(FirstNumber=lng_23, SecondNumber=lng_24)  # -> SmallerThan, OrEqualTo
created_windows_database = RemoteSender(clean)
hasdata_8 = DataExists(Data=smaller.SmallerThan)
filter_38 = StreamFilter(Gate=hasdata_8, Stream0="False", Stream1=smaller.SmallerThan)
overlap_windows = RemoteSender(filter_38)

created_windows_database_2 = RemoteReceiver(created_windows_database)
decnstrmat_3 = HBDeconstructMaterial(mat=created_windows_database_2)  # -> values, attr_names, r_val_si, r_val_ip; plug-in component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
item_21 = ListItem(List=decnstrmat_3.values, Index=0, Wrap=True)  # -> flatten(Item), Item1, Item2
entwine_109 = Entwine(Branch00=generic_shgc, Branch01=item_21.Item2, FlattenInputs=True)  # -> flatten(Result)
entwine_110 = Entwine(Branch00=generic_u_value, Branch01=item_21.Item1, FlattenInputs=True)  # -> flatten(Result)
clean_2 = CleanTree(RemoveNulls=True, RemoveInvalid=True, RemoveEmpty=False, Tree=item_21.Item)
clean_3 = CleanTree(RemoveNulls=True, RemoveInvalid=True, RemoveEmpty=False, Tree=entwine_110)
clean_4 = CleanTree(RemoveNulls=True, RemoveInvalid=True, RemoveEmpty=False, Tree=entwine_109)
num = Number(clean_4)
entwine_111 = Entwine(Branch00="Generic", Branch01=clean_2, FlattenInputs=True)  # -> flatten(Result)
num_2 = Number(clean_3)
expression_61 = Expression(x=num, Expression="Round(x, 2)")
expression_62 = Expression(x=num_2, Expression="Round(x, 2)")
create_window_names = RemoteSender(entwine_111)
format_14 = Format(Format="{0} (U-factor: {1}, SHGC: {2})", Culture=127, Data0=entwine_111, Data1=expression_62, Data2=expression_61)
panel_107 = Panel(format_14)
create_window_full_names = RemoteSender(format_14)

created_windows_database_3 = RemoteReceiver(created_windows_database)
entwine_112 = Entwine(Branch00="Generic", Branch01=created_windows_database_3, FlattenInputs=True)  # -> flatten(Result)
item_22 = ListItem(List=entwine_112, Index=subset_subface_window_3, Wrap=True)
expression_63 = Expression(x="Generic", y=item_22, Expression="x=y")
filter_39 = StreamFilter(Gate=expression_63, Stream0=item_22, Stream1=null_4)
windowconstr_3 = HBWindowConstruction(materials=filter_39)  # -> constr; plug-in component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
cluster_4 = Cluster_2(window_construction=windowconstr_3, gwp_a1_a3="2.5", gwp_a4="0.042", density_kg_m2="38.2")
subfacesubset_2 = HBSubfaceSubset(window=cluster_4, skylight=cluster_3)  # -> subface_set; plug-in component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

create_window_full_names_2 = RemoteReceiver(create_window_full_names)
cull_i_3 = CullIndex(List=create_window_full_names_2, Indices="0", Wrap=invert(True))
concat_2 = Concatenate(FragmentA="- ", FragmentB=cull_i_3)
lng_25 = ListLength(List=cull_i_3)
settextblock_5 = SetTextBlockContents(TextBlockToModify=tb_16, NewTextBlockContents=concat_2)
py3_38 = Python3Script(current_windows=lng_25, maximum_windows=number_slider_27)  # -> status; inputs current_windows: Int32, maximum_windows: Int32
# ---------- py3_38: Python ----------
status = [True]*current_windows
status.extend([False]*(maximum_windows-current_windows))
# ---------- end py3_38 ----------
overlap_windows_2 = RemoteReceiver(overlap_windows)
hideshow_20 = HideShowElement(ElementToHideShow=label_32, Show=overlap_windows_2, Collapse=True, Disable=False)
hideshow_21 = HideShowElement(ElementToHideShow=simplify(merge_7), Show=simplify(graft(py3_38)), Collapse=True, Disable=False)

create_window_names_2 = RemoteReceiver(create_window_names)
create_window_name_3 = RemoteReceiver(create_window_name)
create_window_error_2 = RemoteReceiver(create_window_error)
create_window_u_factor_3 = RemoteReceiver(create_window_u_factor)
create_window_shgc_3 = RemoteReceiver(create_window_shgc)
create_window_name_4 = RemoteReceiver(create_window_name)
expression_64 = Expression(x=create_window_names_2, y=create_window_name_3, Expression="x=y")
len_3 = TextLength(Text=create_window_error_2)
py3_39 = Python3Script(name=create_window_name_4)  # -> not_valid; inputs name: String; same code as py3_34
inc = Includes(Value=create_window_shgc_3, Domain=dom_4)  # -> Includes, Deviation
inc_2 = Includes(Value=create_window_u_factor_3, Domain=dom_3)  # -> Includes, Deviation
cull_15 = CullPattern(List=expression_64, CullPattern=expression_64)
bool_49 = Boolean(len_3)
gate_32 = StreamGate(Stream="U-factor has to to between 0 and 12", Gate=inc_2.Includes)  # -> Target0, Target1
gate_33 = StreamGate(Stream="Window name contains no valid characters", Gate=bool_49)  # -> Target0, Target1
gate_34 = StreamGate(Stream="Window already exists", Gate=cull_15)  # -> Target0, Target1
gate_35 = StreamGate(Stream="'å', 'ä' and 'ö' are not allowed", Gate=py3_39)  # -> Target0, Target1
gate_36 = StreamGate(Stream="SHGC has to to between 0 and 1", Gate=inc.Includes)  # -> Target0, Target1
entwine_113 = Entwine(
    Branch00=gate_32.Target0,
    Branch01=gate_36.Target0,
    Branch02=gate_33.Target1,
    Branch03=gate_34.Target1,
    Branch04=gate_35.Target1,
    FlattenInputs=True)  # -> flatten(Result)
panel_108 = Panel(entwine_113)
item_23 = ListItem(List=entwine_113, Index=0, Wrap=True)
create_window_error_message = RemoteSender(item_23)

create_window_error_message_2 = RemoteReceiver(create_window_error_message)
null_28 = NullItem(Item=create_window_error_message_2)  # -> NullFlags, InvalidFlags, Description
filter_40 = StreamFilter(Gate=null_28.NullFlags, Stream0=create_window_error_message_2, Stream1=" ")
filter_41 = StreamFilter(Gate=null_28.NullFlags, Stream0=Slider(500, range=0..1000), Stream1=Slider(1000000, range=0..1000000))
hideshow_22 = HideShowElement(ElementToHideShow=button_38, Show=True, Collapse=True, Disable=invert(null_28.NullFlags))
tooltip_8 = AttachTooltipToElement(ElementsToAttachTo=button_38, TooltipContent=filter_40, ShowDelay=filter_41, Duration=2000)

panel_109 = Panel(hold_5)
panel_110 = Panel(split_9)
panel_111 = Panel(clean)

# ---- group: Construction module (continued)
setlist_3 = SetListContents(ListToModify=pulldown_15, NewListContents=format_14, SelectedIndex="0")
setlist_4 = SetListContents(ListToModify=pulldown_14, NewListContents=format_14, SelectedIndex="0")

# ----
# Construction inspection
pre_construction_database_visualize_cons_2 = RemoteReceiver(pre_construction_database_visualize_cons)  # "pre_construction_database_visualize_construction"
path_3 = DataPath(pre_construction_database_visualize_cons_2)
construction_maximum_layer_limit_4 = RemoteReceiver(construction_maximum_layer_limit)
construction_maximum_layer_limit_5 = RemoteReceiver(construction_maximum_layer_limit)
construction_maximum_layer_limit_6 = RemoteReceiver(construction_maximum_layer_limit)
panel_112 = Panel("Construction thickness: {0}")
repeat_18 = RepeatData(Data="0 m", Length=construction_maximum_layer_limit_4)
repeat_19 = RepeatData(Data="Material", Length=construction_maximum_layer_limit_5)
repeat_20 = RepeatData(Data=" ", Length=construction_maximum_layer_limit_6)
tb_19 = CreateTextBlock(Text=repeat_18, TextSize=12, Justification=1)
label_48 = CreateLabel(LabelText="Construction inspection", LabelSize=18, Justification=1)
label_49 = CreateLabel(LabelText="🌳", LabelSize=18, Justification=1)
label_50 = CreateLabel(LabelText="🏠", LabelSize=18, Justification=1)
label_51 = CreateLabel(LabelText=panel_112, LabelSize=18, Justification=1)
tb_20 = CreateTextBlock(Text=repeat_19, TextSize=16, Justification=Slider(1, range=0..10))
tb_21 = CreateTextBlock(Text=repeat_20, TextSize=16, Justification=Slider(1, range=0..10))
construction_maximum_layer_limit_7 = RemoteReceiver(construction_maximum_layer_limit)
settextblock_6 = SetTextBlockContents(TextBlockToModify=tb_21, NewTextBlockContents=" ")
suirify_8 = Suirify(tb_19)
suirify_9 = Suirify(tb_20)
merge_13 = Merge(Data1=graft(suirify_9), Data2=graft(suirify_8))
stack_71 = CreateStack(UIElements=merge_13, Horizontal=True)  # -> flatten(Stack)
material_database_categories_7 = RemoteReceiver(material_database_categories_2)
suirify_10 = Suirify(tb_21)
suirify_11 = Suirify(stack_71)
merge_14 = Merge(Data1=graft(suirify_10), Data2=graft(suirify_11))
number_slider_34 = Slider(250, range=0..1000)
entwine_114 = Entwine(
    Branch00=ColourSwatch(SwatchColor=RGB(204, 102, 51)),
    Branch01=ColourSwatch(SwatchColor=RGB(153, 102, 51)),
    Branch02=ColourSwatch(SwatchColor=RGB(128, 128, 128)),
    Branch03=ColourSwatch(SwatchColor=RGB(255, 204, 102)),
    Branch04=ColourSwatch(SwatchColor=RGB(102, 102, 153)),
    Branch05=ColourSwatch(SwatchColor=RGB(255, 153, 51)),
    Branch06=ColourSwatch(SwatchColor=RGB(102, 51, 0)),
    Branch07=ColourSwatch(SwatchColor=RGB(77, 77, 77)),
    Branch08=ColourSwatch(SwatchColor=RGB(0, 102, 204)),
    Branch09=ColourSwatch(SwatchColor=RGB(153, 153, 153)),
    FlattenInputs=True)  # -> flatten(Result)
stack_72 = CreateStack(UIElements=merge_14, Horizontal=invert(True))  # -> flatten(Stack)
entwine_115 = Entwine(Branch00=label_48, Branch01=label_51, Branch02=label_49, Branch03=stack_72, Branch04=label_50, FlattenInputs=True)  # -> flatten(Result)
swatch = ColourSwatch(SwatchColor=RGB(0, 0, 0))
adjustpos_116 = AdjustElementPositioning(ElementsToAdjust=tb_19, Margin="8, 0, 0, 0", AbsolutePositioning=False, HorizontalAlignment=0)
adjustpos_117 = AdjustElementPositioning(ElementsToAdjust=stack_72, Margin="53, 0, 0, 0", AbsolutePositioning=False, HorizontalAlignment=0)

settextbox = SetTextBoxContents(TextBoxToModify=textbox_4, NewTextBoxContents=bang_8.Branch1)
visible_layers_3 = RemoteReceiver(flatten(visible_layers))
visible_layers_arrows_2 = RemoteReceiver(visible_layers_arrows)
int_6 = Integer(visible_layers_3)
ma_11 = MassAddition(Input=int_6)  # -> Result, PartialResults
hideshow_23 = HideShowElement(ElementToHideShow=button_36, Show=visible_layers_arrows_2, Collapse=True, Disable=False)
larger_3 = LargerThan(FirstNumber=ma_11.Result, SecondNumber="1")  # -> LargerThan, OrEqualTo
visible_layers_4 = RemoteReceiver(visible_layers)
filter_42 = StreamFilter(Gate=larger_3.LargerThan, Stream0=larger_3.LargerThan, Stream1=visible_layers_3)
hideshow_24 = HideShowElement(ElementToHideShow=stack_61, Show=visible_layers_4, Collapse=True, Disable=False)
hideshow_25 = HideShowElement(ElementToHideShow=label_40, Show=visible_layers_3, Collapse=True, Disable=False)
hideshow_26 = HideShowElement(ElementToHideShow=button_35, Show=filter_42, Collapse=True, Disable=False)

# ----
# Recursion
panel_113 = Panel("Construction visualization")
objbynn_13 = GetObjectByNickname(NickName=panel_113)
construction_visualization = Python3Script()  # -> status; same code as lca_window_status

# ----
# Construction inspection launch
construction_database_visualize_construc_2 = RemoteReceiver(construction_database_visualize_construc)  # "construction_database_visualize_construction"
rec_20 = DataRecorder(construction_database_visualize_construc_2, DataLimit=-2, RecordData=True)
ma_12 = MassAddition(Input=rec_20)  # -> Result, PartialResults
entwine_116 = Entwine(Branch00=ma_12.Result, Branch01=construction_visualization, FlattenInputs=True)
rec_21 = DataRecorder(entwine_116, DataLimit=2, RecordData=True)
item_24 = ListItem(List=rec_21, Index=0, Wrap=True)  # -> Item2, Item1, Item
equals_35 = Equality(FirstNumber=item_24.Item2, SecondNumber=item_24.Item1)  # -> Equality, Inequality
bang_10 = ExplodeTree(Data=equals_35.Inequality)  # -> Branch0, Branch1
py3_40 = Python3Script(x=bang_10.Branch0, y=bang_10.Branch1)  # -> a; same code as py3_2
event_47 = EventGate(Data=py3_40)  # -> Data, IsNew
freeze_gate_48 = StreamFreezeGate(Data=py3_40, PassingSwitch=event_47.IsNew)
event_48 = EventGate(Data=freeze_gate_48)  # -> Data, IsNew
panel_114 = Panel(event_48.Data)
construction_database_visualize_construc_3 = RemoteReceiver(construction_database_visualize_construc)  # "construction_database_visualize_construction"
create_modal_location_3 = RemoteReceiver(create_modal_location)
launchwin_10 = LaunchWindow(
    Show=event_48.Data,
    Name="Construction inspection",
    Width=Slider(380, range=0..1000),
    Height=Slider(580, range=0..1000),
    ChildStatus=1,
    EnableHorizScroll=False)
winprops_10 = SetWindowProperties(
    Window=launchwin_10,
    StartingLocation=create_modal_location_3,
    Theme=0,
    AccentColor=heath_accent_color_10,
    ShowTitleBar=True,
    BackgroundColor=RGB(255, 255, 255),
    ScaleFactor=1)
winstat_10 = WindowStatus(Window=launchwin_10)
addelems_11 = AddElements(Window=launchwin_10, Elements=flatten(entwine_115), DoVLChecking=True)  # -> AddedElements, ElementNames
py3_41 = Python3Script(window=launchwin_10, activate=construction_database_visualize_construc_3)  # same code as py3_3
panel_115 = Panel(winstat_10)
construction_visualization_status = RemoteSender(winstat_10)

construction_visualization_status_2 = RemoteReceiver(construction_visualization_status)
expression_65 = Expression(x="Hidden", y=construction_visualization_status_2, Expression="x=y")
expire_9 = ExpireObject(ObjectToExpire=objbynn_13, Expire=expression_65)

# ----
# Recursion
panel_116 = Panel("Construction modal")
create_construction_3 = RemoteReceiver(create_construction)
objbynn_14 = GetObjectByNickname(NickName=panel_116)
construction_modal = Python3Script()  # -> status; same code as lca_window_status

# ----
# Create construction launch
create_construction_modal_2 = RemoteReceiver(create_construction_modal)
rec_22 = DataRecorder(create_construction_modal_2, DataLimit=-2, RecordData=True)
ma_13 = MassAddition(Input=rec_22)  # -> Result, PartialResults
entwine_117 = Entwine(Branch00=ma_13.Result, Branch01=construction_modal, FlattenInputs=True)
rec_23 = DataRecorder(entwine_117, DataLimit=2, RecordData=True)
item_25 = ListItem(List=rec_23, Index=0, Wrap=True)  # -> Item2, Item1, Item
equals_36 = Equality(FirstNumber=item_25.Item2, SecondNumber=item_25.Item1)  # -> Equality, Inequality
bang_11 = ExplodeTree(Data=equals_36.Inequality)  # -> Branch0, Branch1
py3_42 = Python3Script(x=bang_11.Branch0, y=bang_11.Branch1)  # -> a; same code as py3_2
event_49 = EventGate(Data=py3_42)  # -> Data, IsNew
freeze_gate_49 = StreamFreezeGate(Data=py3_42, PassingSwitch=event_49.IsNew)
event_50 = EventGate(Data=freeze_gate_49)  # -> Data, IsNew
entwine_118 = Entwine(
    Branch00=entwine_96,
    Branch01=label_39,
    Branch02=merge_12,
    Branch03=label_38,
    Branch04=button_33,
    Branch05=button_34,
    FlattenInputs=True)  # -> flatten(Result)
launchwin_11 = LaunchWindow(
    Show=event_50.Data,
    Name="Create construction",
    Width=Slider(360, range=0..1000),
    Height=Slider(540, range=0..1000),
    ChildStatus=1,
    EnableHorizScroll=False)
panel_117 = Panel(event_50.Data)
create_construction_modal_3 = RemoteReceiver(create_construction_modal)
create_modal_location_4 = RemoteReceiver(create_modal_location)
addelems_12 = AddElements(Window=launchwin_11, Elements=flatten(entwine_118), DoVLChecking=True)  # -> AddedElements, ElementNames
winprops_11 = SetWindowProperties(
    Window=launchwin_11,
    StartingLocation=create_modal_location_4,
    Theme=0,
    AccentColor=heath_accent_color_12,
    ShowTitleBar=True,
    BackgroundColor=RGB(255, 255, 255),
    ScaleFactor=1)
winstat_11 = WindowStatus(Window=launchwin_11)
py3_43 = Python3Script(window=launchwin_11, activate=create_construction_modal_3)  # same code as py3_3
create_construction_modal_status = RemoteSender(winstat_11)
construction_elements = RemoteSender(addelems_12.AddedElements)

create_construction_modal_status_2 = RemoteReceiver(create_construction_modal_status)
expression_66 = Expression(x="Hidden", y=create_construction_modal_status_2, Expression="x=y")
or_25 = GateOr(A=expression_66, C=create_construction_3)
expire_10 = ExpireObject(ObjectToExpire=objbynn_14, Expire=or_25)

# ----
# Recursion
panel_118 = Panel("Window modal")
create_window_3 = RemoteReceiver(create_window)
objbynn_15 = GetObjectByNickname(NickName=panel_118)
window_modal = Python3Script()  # -> status; same code as lca_window_status

# ----
# Create window launch
create_window_modal_3 = RemoteReceiver(create_window_modal)
rec_24 = DataRecorder(create_window_modal_3, DataLimit=-2, RecordData=True)
ma_14 = MassAddition(Input=rec_24)  # -> Result, PartialResults
entwine_119 = Entwine(Branch00=ma_14.Result, Branch01=window_modal, FlattenInputs=True)
rec_25 = DataRecorder(entwine_119, DataLimit=2, RecordData=True)
item_26 = ListItem(List=rec_25, Index=0, Wrap=True)  # -> Item2, Item1, Item
equals_37 = Equality(FirstNumber=item_26.Item2, SecondNumber=item_26.Item1)  # -> Equality, Inequality
bang_12 = ExplodeTree(Data=equals_37.Inequality)  # -> Branch0, Branch1
py3_44 = Python3Script(x=bang_12.Branch0, y=bang_12.Branch1)  # -> a; same code as py3_2
event_51 = EventGate(Data=py3_44)  # -> Data, IsNew
freeze_gate_50 = StreamFreezeGate(Data=py3_44, PassingSwitch=event_51.IsNew)
event_52 = EventGate(Data=freeze_gate_50)  # -> Data, IsNew
panel_119 = Panel(event_52.Data)
entwine_120 = Entwine(Branch00=textbox_10, Branch01=stack_69, Branch02=stack_70, Branch03=button_38, FlattenInputs=True)  # -> flatten(Result)
launchwin_12 = LaunchWindow(
    Show=event_52.Data,
    Name="Create window",
    Width=Slider(235, range=0..1000),
    Height=Slider(200, range=0..1000),
    ChildStatus=1,
    EnableHorizScroll=False)
create_modal_location_5 = RemoteReceiver(create_modal_location)
create_window_modal_4 = RemoteReceiver(create_window_modal)
winstat_12 = WindowStatus(Window=launchwin_12)
addelems_13 = AddElements(Window=launchwin_12, Elements=flatten(entwine_120), DoVLChecking=True)  # -> AddedElements, ElementNames
py3_45 = Python3Script(window=launchwin_12, activate=create_window_modal_4)  # same code as py3_3
winprops_12 = SetWindowProperties(
    Window=launchwin_12,
    StartingLocation=create_modal_location_5,
    Theme=0,
    AccentColor=heath_accent_color_11,
    ShowTitleBar=True,
    BackgroundColor=RGB(255, 255, 255),
    ScaleFactor=1)
create_window_modal_status = RemoteSender(winstat_12)
window_elements = RemoteSender(addelems_13.AddedElements)

create_window_modal_status_2 = RemoteReceiver(create_window_modal_status)
expression_67 = Expression(x="Hidden", y=create_window_modal_status_2, Expression="x=y")
or_26 = GateOr(A=expression_67, C=create_window_3)
expire_11 = ExpireObject(ObjectToExpire=objbynn_15, Expire=or_26)

# ----
# Recursion
panel_120 = Panel("Material modal")
create_material_3 = RemoteReceiver(create_material)
objbynn_16 = GetObjectByNickname(NickName=panel_120)
material_modal = Python3Script()  # -> status; same code as lca_window_status

# ----
# Create material launch
create_material_modal_3 = RemoteReceiver(create_material_modal)
rec_26 = DataRecorder(create_material_modal_3, DataLimit=-2, RecordData=True)
ma_15 = MassAddition(Input=rec_26)  # -> Result, PartialResults
entwine_121 = Entwine(Branch00=ma_15.Result, Branch01=material_modal, FlattenInputs=True)
rec_27 = DataRecorder(entwine_121, DataLimit=2, RecordData=True)
item_27 = ListItem(List=rec_27, Index=0, Wrap=True)  # -> Item2, Item1, Item
equals_38 = Equality(FirstNumber=item_27.Item2, SecondNumber=item_27.Item1)  # -> Equality, Inequality
bang_13 = ExplodeTree(Data=equals_38.Inequality)  # -> Branch0, Branch1
py3_46 = Python3Script(x=bang_13.Branch0, y=bang_13.Branch1)  # -> a; same code as py3_2
event_53 = EventGate(Data=py3_46)  # -> Data, IsNew
freeze_gate_51 = StreamFreezeGate(Data=py3_46, PassingSwitch=event_53.IsNew)
event_54 = EventGate(Data=freeze_gate_51)  # -> Data, IsNew
entwine_122 = Entwine(
    Branch00=stack_66,
    Branch01=pulldown_25,
    Branch02=stack_63,
    Branch03=stack_65,
    Branch04=stack_64,
    Branch05=button_37,
    FlattenInputs=True)  # -> flatten(Result)
launchwin_13 = LaunchWindow(
    Show=event_54.Data,
    Name="Create material",
    Width=Slider(250, range=0..1000),
    Height=Slider(275, range=0..1000),
    ChildStatus=1,
    EnableHorizScroll=False)
panel_121 = Panel(event_54.Data)
create_modal_location_6 = RemoteReceiver(create_modal_location)
create_material_modal_4 = RemoteReceiver(create_material_modal)
addelems_14 = AddElements(Window=launchwin_13, Elements=flatten(entwine_122), DoVLChecking=True)  # -> AddedElements, ElementNames
py3_47 = Python3Script(window=launchwin_13, activate=create_material_modal_4)  # same code as py3_3
winprops_13 = SetWindowProperties(
    Window=launchwin_13,
    StartingLocation=create_modal_location_6,
    Theme=0,
    AccentColor=heath_accent_color_13,
    ShowTitleBar=True,
    BackgroundColor=RGB(255, 255, 255),
    ScaleFactor=1)
winstat_13 = WindowStatus(Window=launchwin_13)
create_material_modal_status = RemoteSender(winstat_13)
material_elements = RemoteSender(addelems_14.AddedElements)

create_material_modal_status_2 = RemoteReceiver(create_material_modal_status)
expression_68 = Expression(x="Hidden", y=create_material_modal_status_2, Expression="x=y")
or_27 = GateOr(A=expression_68, C=create_material_3)
expire_12 = ExpireObject(ObjectToExpire=objbynn_16, Expire=or_27)

# ----
# Constructions database
panel_122 = Panel("Heath constructions")

# ----
# Materials database
panel_123 = Panel("Heath materials")

# ----
# Bake model
panel_124 = Panel("""Heath::honeybee model::walls
Heath::honeybee model::roof
Heath::honeybee model::floors
Heath::honeybee model::ground
Heath::honeybee model::windows
Heath::honeybee model::doors
Heath::honeybee model::context""")
ef_layer_2 = EleFrontLayer(FullPath=panel_124)  # -> Layer, FullPath, Hidden, Locked, DisplayColour, MaterialName, Linetype, PrintColour, PrintWidth
ef_att_4 = EleFrontAttributes(Layer=ef_layer_2.Layer)  # -> graft(Attributes), Keys, Values, Name, Layer, ColourSource, DisplayColour, MaterialSource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
bake_model_2 = RemoteReceiver(bake_model)

# ----
# Weather visualisation
# # Weather visualisation
# This cluster visualises weather data from a .epw file including solar radiation and temperature, as applied to a target geometry
# 
# ## Instructions
# Enter all the inputs and visualise wind, sky view and temperature,  set `Run direct sun hours study` and `Run incident radiation study` to visualise solar radiation
# 
# ## Inputs
# - `EPW file URL` - the URL for a EPW file which describes the location
# - `Target Geometry` - geometry on which to apply irradiation study
# - `Context Geometry` - geometry which shades the target geometry
# - `Run direct sun hours study` - set to True to run the direct sun hours study
# - `Run incident radiation study` - set to True to run the incident radiation study
# - `Sky mask centre point` - point at which to generate sky mask
# 
# ## Outputs
# - `Sky dome` - mesh visualising the directions where solar radiation comes from during the year at the location
# - `Sky mask - mesh visualising what portions of the sky are visible at the specified point
# - `Wind rose` - mesh visualising wind directions and velocities during the year
# - `Dry bulb temperature line chart` - mesh visualising dry bulb temperature during the year
# - `Dry bulb temperature 2D chart` - mesh visualising dry bulb temperature for each hour of the year
# - `Direct sun hours` - mesh visualising the number of direct sun hours on the target geometry
# - `Incident radiation` - mesh visualising the incident radiation [kWh/m2] on the target geometry
# 
# ## Interpretation
# To be added...
# Visualise properties
# # Visualise properties
# This cluster visualises room and face attributes of a Honeybee model
# 
# ## Instructions
# Input the Honeybee model to be visualised and select room/face attributes using the HB Room Attributes/HB Room Energy Attibrutes/HB Face Attributes/HB Face Energy Attributes dropdown components. Adjust precision of the attributes using the `Number of decimals` inputs
# 
# ## Inputs
# - `Honeybee model` - Honeybee model to be visualised
# - `Room attribute` - Honeybee Room  or Room Energy attribute to visualise
# - `Number of decimals (room)` - Precision of room attribute output
# - `Face attribute` - Honeybee Face  or Face Energy attribute to visualise
# - `Number of decimals (face)` - Precision of face attribute output
# 
# ## Outputs
# - `Visualised room attributes` - mesh representing the selected room attribute
# - `Visualised face attributes` - mesh representing the selected face attribute
# 
# ## Interpretation
# To be added...
run_weather_visualisation_2 = RemoteReceiver(run_weather_visualisation)
run_weather_visualisation_3 = RemoteReceiver(run_weather_visualisation)
gate_37 = StreamGate(Stream="Heath geometry type", Gate=run_weather_visualisation_2)  # -> Target0, Target1
gate_38 = StreamGate(Stream="Heath geometry type", Gate=run_weather_visualisation_3)  # -> Target0, Target1
roomenergyattr = HBRoomEnergyAttributes({"Program": "properties.energy.program_type.display_name", "Construction Set": "properties.energy.construction_set.display_name", "Is Conditioned": "properties.energy.is_conditioned", "People per Area [ppl/m2]": "properties.energy.people.people_per_area", "Area per Person [m2/ppl]": "properties.energy.people.area_per_person", "Lighting per Area [W/m2]": "properties.energy.lighting.watts_per_area"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}, selected="Program")
refkv_9 = ReferenceByKeyValue(Key=gate_37.Target1, Val="Room", lightweight=False)
refkv_10 = ReferenceByKeyValue(Key=gate_38.Target1, Val="Context", lightweight=False)
pt_13 = ConstructPoint(XCoordinate=Slider(21, range=0..100), YCoordinate=Slider(15, range=0..100), ZCoordinate=0)
faceenergyattr = HBFaceEnergyAttributes({"Construction": "properties.energy.construction.display_name", "Materials": "properties.energy.construction.layers", "Thickness [m]": "properties.energy.construction.thickness", "Density [kg/m2]": "properties.energy.construction.mass_area_density", "Heat Capacity [J/K-m2]": "properties.energy.construction.area_heat_capacity", "Construction R-Value [m2-K/W]": "properties.energy.construction.r_value", "Construction U-Value [W/m2-K]": "properties.energy.construction.u_value", "Construction U-Factor [W/m2-K]": "properties.energy.construction.u_factor", "Construction SHGC [Unshaded]": "properties.energy.construction.shgc", "R-Factor [m2-K/W]": "properties.energy.r_factor", "U-Factor [W/m2-K]": "properties.energy.u_factor", "SHGC [Unshaded]": "properties.energy.shgc", "Solar Transmitance [Unshaded]": "properties.energy.construction.solar_transmittance", "Visible Transmitance [Unshaded]": "properties.energy.construction.visible_transmittance", "Solar Reflectance [Outside]": "properties.energy.construction.outside_solar_reflectance", "Solar Reflectance [Inside]": "properties.energy.construction.inside_solar_reflectance", "Fraction Area Operable": "properties.energy.vent_opening.fraction_area_operable", "Fraction Height Operable": "properties.energy.vent_opening.fraction_height_operable", "Discharge Coefficient": "properties.energy.vent_opening.discharge_coefficient"}, selected="Construction SHGC [Unshaded]")
room_attribute_visualize_3 = RemoteReceiver(room_attribute_visualize)
room_energy_attribute_2 = RemoteReceiver(room_energy_attribute)
face_attribute_visualize_3 = RemoteReceiver(face_attribute_visualize)
face_energy_attribute_2 = RemoteReceiver(face_energy_attribute)
run_weather_visualisation_4 = RemoteReceiver(run_weather_visualisation)
roomattr = HBRoomAttributes({"Display Name": "display_name", "Simulation Name (Identifier)": "identifier", "Multiplier": "multiplier", "Floor Area Excluded": "exclude_floor_area", "Story": "story", "Volume": "volume", "Gross Floor Area": "floor_area", "Exposed Area": "exposed_area", "Exterior Wall Area": "exterior_wall_area", "Exterior Aperture Area": "exterior_aperture_area", "Average Floor Elevation": "average_floor_height"}, selected="Exterior Aperture Area")
faceattr = HBFaceAttributes({"Display Name": "display_name", "Simulation Name (Identifier)": "identifier", "Boundary Condition": "boundary_condition", "Has Parent": "has_parent", "Parent": "parent", "Azimuth": "azimuth", "Altitude": "altitude", "Area": "area", "Perimeter": "perimeter", "Face Type": "type", "Aperture Is Operable": "is_operable", "Door Is Glass": "is_glass"}, selected="Face Type")
room_attribute_2 = RemoteReceiver(room_attribute)
face_attribute_2 = RemoteReceiver(face_attribute)
pt_14 = Point(pt_13)
data_18 = Data(location_7)
filter_43 = StreamFilter(Gate=face_attribute_visualize_3, Stream0=face_energy_attribute_2, Stream1=face_attribute_2)
filter_44 = StreamFilter(Gate=room_attribute_visualize_3, Stream0=room_energy_attribute_2, Stream1=room_attribute_2)
weather_visualisation = WeatherVisualisation(
    _1=data_18,
    run_weather_visualisation=run_weather_visualisation_4,
    target_geometry_2=refkv_9,
    target_geometry=refkv_10,
    run_direct_sun_hours_study=run_weather_visualisation_4,
    run_incident_radiation_study=run_weather_visualisation_4,
    sky_mask_centre_point=pt_14)  # -> sky_dome, sky_mask, wind_rose, dry_bulb_temperature_line_chart, dry_bulb_temperature_2d_chart, direct_sun_hours_2, incident_radiation
run_weather_visualisation_5 = RemoteReceiver(run_weather_visualisation)
entwine_123 = Entwine(
    Branch00=weather_visualisation.sky_dome,
    Branch01=weather_visualisation.sky_mask,
    Branch02=weather_visualisation.wind_rose,
    Branch03=weather_visualisation.dry_bulb_temperature_line_chart,
    Branch04=weather_visualisation.dry_bulb_temperature_2d_chart,
    Branch05=weather_visualisation.direct_sun_hours_2,
    Branch06=weather_visualisation.incident_radiation,
    FlattenInputs=True)
room_energy_attribute_visualize_3 = RemoteReceiver(room_energy_attribute_visualize)
face_energy_attribute_visualize_3 = RemoteReceiver(face_energy_attribute_visualize)
room_attribute_visualize_4 = RemoteReceiver(room_attribute_visualize)
face_attribute_visualize_4 = RemoteReceiver(face_attribute_visualize)
freeze_gate_52 = StreamFreezeGate(Data=entwine_123, PassingSwitch=run_weather_visualisation_5, Hold=True)
weather_visualization_type_2 = RemoteReceiver(weather_visualization_type)
bang_14 = ExplodeTree(Data=freeze_gate_52)  # -> Branch0, Branch1, Branch2, Branch3, Branch4, Branch5, Branch6
or_28 = GateOr(A=room_attribute_visualize_4, B=room_energy_attribute_visualize_3)
or_29 = GateOr(A=face_attribute_visualize_4, B=face_energy_attribute_visualize_3)
weather_visualization_show_2 = RemoteReceiver(weather_visualization_show)
weather_visualization_show_3 = RemoteReceiver(weather_visualization_show)
null_29 = NullItem(Item=flatten(freeze_gate_52))  # -> NullFlags, InvalidFlags, Description
filter_45 = StreamFilter(
    Gate=weather_visualization_type_2,
    Stream0=bang_14.Branch0,
    Stream1=bang_14.Branch1,
    Stream2=bang_14.Branch2,
    Stream3=bang_14.Branch3,
    Stream4=bang_14.Branch4,
    Stream5=bang_14.Branch5,
    Stream6=bang_14.Branch6)
equals_39 = Equality(FirstNumber="3", SecondNumber=weather_visualization_type_2)  # -> Equality, Inequality
equals_40 = Equality(FirstNumber="4", SecondNumber=weather_visualization_type_2)  # -> Equality, Inequality
equals_41 = Equality(FirstNumber="5", SecondNumber=weather_visualization_type_2)  # -> Equality, Inequality
equals_42 = Equality(FirstNumber="6", SecondNumber=weather_visualization_type_2)  # -> Equality, Inequality
nor_2 = GateNor(A=equals_39.Equality, B=equals_40.Equality)
cull_16 = CullPattern(List=null_29.NullFlags, CullPattern=invert(null_29.NullFlags))
or_30 = GateOr(A=equals_41.Equality, B=equals_42.Equality)
gate_39 = StreamGate(Stream=filter_45, Gate=weather_visualization_show_2)  # -> Target0, Target1
and_34 = GateAnd(A=weather_visualization_show_3, B=or_30)
lng_26 = ListLength(List=cull_16)
gate_40 = StreamGate(Stream=gate_39.Target1, Gate=nor_2)  # -> Target0, Target1
weather_visualisation_wireframe = RemoteSender(and_34)
weather_visualisation_exists = RemoteSender(lng_26)
weather_visualization_show_4 = RemoteReceiver(weather_visualization_show)
mesh = Mesh([gate_40.Target1, gate_40.Target0])
sortbytype = SortObjectsByType(RhinoObjects=gate_40.Target0)  # -> Points, Curves, Surfaces, Breps, Meshes, TextObjects, HatchObjects, LightObjects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
bbox = BoundingBox(Content=mesh, Plane=PlaneXY(0, 0, 0), UnionBox=True)  # -> Box, Box_2
swatch_2 = ColourSwatch(SwatchColor=RGB(84, 84, 84))
line = Line(sortbytype.Curves)
zoom_weather_visualization_bounding_box = RemoteSender(bbox.Box)
gate_41 = StreamGate(Stream=swatch_2, Gate=weather_visualization_show_4)  # -> Target0, Target1
null_30 = NullItem(Item=line)  # -> NullFlags, InvalidFlags, Description
data_19 = Data([sortbytype.Other, sortbytype.Meshes])
sift = SiftPattern(List=sortbytype.Curves, SiftPattern=null_30.NullFlags)  # -> Output0, Output1
preview_16 = CustomPreview(Geometry=gate_40.Target1, Material=gate_41.Target1)
preview_17 = CustomPreview(Geometry=[sift.Output1, data_19], Material=swatch_2)

# ---- group: Visualize module (continued)
weather_visualisation_exists_2 = RemoteReceiver(weather_visualisation_exists)
weather_visualisation_exists_3 = RemoteReceiver(weather_visualisation_exists)
hideshow_27 = HideShowElement(ElementToHideShow=button_10, Show=True, Collapse=True, Disable=invert(weather_visualisation_exists_2))
hideshow_28 = HideShowElement(ElementToHideShow=button_11, Show=True, Collapse=True, Disable=invert(weather_visualisation_exists_2))
hideshow_29 = HideShowElement(ElementToHideShow=stack_18, Show=weather_visualisation_exists_3, Collapse=True, Disable=False)

# ----
# Zoom weather visualization module
zoom_weather_visualization_bounding_box_2 = RemoteReceiver(zoom_weather_visualization_bounding_box)
zoom_weather_visualization_2 = RemoteReceiver(zoom_weather_visualization)
zbb = ZoomBoundingBox(Box=zoom_weather_visualization_bounding_box_2, Run=zoom_weather_visualization_2)

# ----
# Bake model
panel_125 = Panel("""Heath::weather::Sky dome
Heath::weather::Sky mask
Heath::weather::Wind rose
Heath::weather::Dry bulb temperature line chart
Heath::weather::Dry bulb temperature 2D chart
Heath::weather::Direct sun hours
Heath::weather::Incident radiation""")
merge_15 = Merge(Data1=sift.Output1, Data2=data_19, Data3=gate_40.Target1)
weather_visualization_type_3 = RemoteReceiver(weather_visualization_type)
item_28 = ListItem(List=panel_125, Index=weather_visualization_type_3, Wrap=True)
clean_5 = CleanTree(RemoveNulls=True, RemoveInvalid=True, RemoveEmpty=False, Tree=merge_15)
ef_layer_3 = EleFrontLayer(FullPath=item_28)  # -> Layer, FullPath, Hidden, Locked, DisplayColour, MaterialName, Linetype, PrintColour, PrintWidth
weather_visualisation_bake_2 = RemoteReceiver(weather_visualisation_bake)
lng_27 = ListLength(List=clean_5)
ef_att_5 = EleFrontAttributes(Layer=ef_layer_3.Layer)  # -> Attributes, Keys, Values, Name, Layer, ColourSource, DisplayColour, MaterialSource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
repeat_21 = RepeatData(Data=ef_att_5.Attributes, Length=lng_27)
bake_2 = BakeObjects(Geometry=clean_5, Attributes=repeat_21, Bake=weather_visualisation_bake_2, createGroups=False, preset="Moderate")  # -> Message, Ghosts

weather_visualisation_wireframe_2 = RemoteReceiver(weather_visualisation_wireframe)

# ---- group: Analyse performance
# Simple energy simulations
# # Simple energy simulations
# Streamlined energy simulations which calculate energy balance across the year, and peak loads on the design day, for the input Honeybee rooms.
# 
# ## Instructions
# Enter all inputs and set `Run Energy Balance` or `Run Peak Loads`to True to investigate energy use for the specified Honeybee rooms considering the specified Honeybee shade objects. Adjust the y axis of output graphs using the `Graph max` input.
# 
# ## Inputs
# - `EPW file URL` - the URL for a EPW file which describes the location
# - `Honeybee rooms` - the Honeybee rooms which shall be analysed
# - `Shading objects` - Honeybee shade objects which block solar radiation toward the simulated rooms
# - `Run Energy Balance` - set to True to run the energy balance simulation
# - `Run Peak Loads` - set to True to run the peak loads simulation
# - `Graph max` - max value for the y axis of output graphs
# 
# ## Outputs
# - `Annual energy balance` - mesh visualising energy balance of each month of the year broken down into energy sources/sinks
# - `Daily cooling profile` - mesh visualising the cooling need during the design day (hottest day of the year)
# - `Daily heating profile` - mesh visualising the heating need during the design day (coldest day of the year)
# - `Cooling balance (design day)` - mesh visualising the cooling sources and sinks during the design day (hottest day of the year)
# - `Heating balance (design day)` - mesh visualising the heating sources and sinks during the design day (coldest day of the year)
# 
# ## Interpretation
# To be added...
run_simple_energy_simulations_2 = RemoteReceiver(run_simple_energy_simulations)
toggle_4 = BooleanToggle(True)
data_20 = Data(location_8)
panel_126 = Panel(run_simple_energy_simulations_2)
downloadepw_2 = LBDownloadWeather(weather_URL=data_20)  # -> epw_file, stat_file, ddy_file; plug-in component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
run_peak_loads = Boolean(run_simple_energy_simulations_2)
run_energy_balance = Boolean(run_simple_energy_simulations_2)
data_21 = Data()
data_22 = Data(downloadepw_2.ddy_file)
shading_geometry = Data()
run_simple_energy_simulations_3 = RemoteReceiver(run_simple_energy_simulations)
panel_127 = Panel(run_simple_energy_simulations_3)
colrange_2 = LBColorRange(index=Slider(0, range=0..26))  # -> colors; plug-in component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
colrange_3 = LBColorRange(index=Slider(26, range=0..26))  # -> colors; plug-in component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
number_slider_35 = Slider(760000, range=0..1000000)
neg_2 = Negative(Value=Slider(100000, range=0..100000))
pt_15 = ConstructPoint(XCoordinate=Slider(80, range=0..100), YCoordinate=Slider(5, range=0..100), ZCoordinate=0)
simple_energy_simulation_height_2 = RemoteReceiver(simple_energy_simulation_height)
simple_energy_simulation_width_2 = RemoteReceiver(simple_energy_simulation_width)
simple_energy_simulation_base_point = RemoteSender(pt_15)
simple_energy_simulation_base_point_2 = RemoteReceiver(simple_energy_simulation_base_point)
simple_energy_simulation_base_point_3 = RemoteReceiver(simple_energy_simulation_base_point)
simple_energy_simulation_base_point_4 = RemoteReceiver(simple_energy_simulation_base_point)
simple_energy_simulation_base_point_5 = RemoteReceiver(simple_energy_simulation_base_point)
simple_energy_simulation_base_point_6 = RemoteReceiver(simple_energy_simulation_base_point)
simple_energy_simulation_height_3 = RemoteReceiver(simple_energy_simulation_height)
simple_energy_simulation_width_3 = RemoteReceiver(simple_energy_simulation_width)
simple_energy_simulation_height_4 = RemoteReceiver(simple_energy_simulation_height)
simple_energy_simulation_height_5 = RemoteReceiver(simple_energy_simulation_height)
simple_energy_simulation_width_4 = RemoteReceiver(simple_energy_simulation_width)
simple_energy_simulation_width_5 = RemoteReceiver(simple_energy_simulation_width)
simple_energy_simulation_height_6 = RemoteReceiver(simple_energy_simulation_height)
simple_energy_simulation_width_6 = RemoteReceiver(simple_energy_simulation_width)

# ----
data_23 = Data(downloadepw_2.epw_file)
gate_42 = StreamGate(Stream=objbynn, Gate=run_peak_loads)  # -> Target0, Target1
gate_43 = StreamGate(Stream=objbynn_2, Gate=run_energy_balance)  # -> Target0, Target1
hold_6 = HoldingGate(Data=gate_42.Target1)
hold_7 = HoldingGate(Data=gate_43.Target1)
msgs = GetRuntimeMessages(Objects=hold_6)  # -> Errors, Warnings
msgs_2 = GetRuntimeMessages(Objects=hold_7)  # -> Errors, Warnings
peakloads_message_warning = RemoteSender(msgs.Warnings)
peakloads_message_error = RemoteSender(msgs.Errors)
panel_128 = Panel(msgs_2.Warnings)
annualloads_message_warning = RemoteSender(msgs_2.Warnings)
annualloads_message_error = RemoteSender(msgs_2.Errors)

# ---- group: Analysis module (continued)
annualloads_message_warning_2 = RemoteReceiver(annualloads_message_warning)
peakloads_message_warning_2 = RemoteReceiver(peakloads_message_warning)
annualloads_message_error_2 = RemoteReceiver(annualloads_message_error)
peakloads_message_error_2 = RemoteReceiver(peakloads_message_error)
lng_28 = ListLength(List=[peakloads_message_error_2, annualloads_message_error_2])
lng_29 = ListLength(List=[peakloads_message_warning_2, annualloads_message_warning_2])
ma_16 = MassAddition(Input=[lng_29, lng_28])  # -> Result, PartialResults
bool_50 = Boolean(ma_16.Result)
hasdata_9 = DataExists(Data=bool_50)
filter_46 = StreamFilter(Gate=hasdata_9, Stream0="False", Stream1=bool_50)
filter_47 = StreamFilter(Gate=lng_28, Stream0="Warning", Stream1="Error")
filter_48 = StreamFilter(Gate=lng_28, Stream0=ColourSwatch(SwatchColor=RGB(237, 185, 94)), Stream1=ColourSwatch(SwatchColor=RGB(226, 54, 54)))
adjustelem_19 = AdjustElementAppearance(ElementsToAdjust=tb_5, Foreground=filter_48)
settextblock_7 = SetTextBlockContents(TextBlockToModify=tb_5, NewTextBlockContents=filter_47)
hideshow_30 = HideShowElement(ElementToHideShow=tb_5, Show=filter_46, Collapse=True, Disable=False)

# ----
# Detailed energy simulations
# https://energyplus-weather.s3.amazonaws.com/africa_wmo_region_1/LBY/LBY_Tripoli.620100_IWEC/LBY_Tripoli.620100_IWEC.zip
# # Detailed energy simulations
# This cluster simulates energy balance over a year and outputs the total energy use intensity (EUI), divided into end uses, and detailed graphs of the energy balance, peak cooling/heating, and cooling/heating load profiles
# 
# ## Instructions
# Enter all inputs and set `Run Energy Simulation` to true to run the energy simulation
# 
# ## Inputs
# - `EPW file URL` - the URL for a EPW file which describes the location
# - `Honeybee model` - the Honeybee model for analysis
# - `Run Energy Simulation` - set to True to run the energy simulation
# 
# ## Outputs
# - `Energy use intensity [kWh/m2a]` - A number representing the total energy use of the model
# - `Energy use intensity per end use [kWh/m2a]` - A list of values with the energy uses split into different end uses
# - `End uses` - A list of text strings representing the different end uses
# - `Annual hourly energy results` - various meshes representing different energy results over the hours of the year
# - `Monthly energy balance` - A monthly breakdown of the energy balance, with energy sources in the top and energy sinks in the bottom
# - `Peak cooling` - A number representing the peak cooling load in each zone
# - `Peak heating` - A number representing the peak heating load in each zone
# - `Cooling load profile` - A mesh representing the cooling load profile during the design day
# - `Heating load profile` - A mesh representing the heating load profile during the design day
# 
# ## Interpretation
# To be added...
run_detailed_energy_simulations_2 = RemoteReceiver(run_detailed_energy_simulations)
data_24 = Data(location_9)
toggle_5 = BooleanToggle(True)
epw_file_url = Data(data_24)
downloadepw_3 = LBDownloadWeather(weather_URL=epw_file_url)  # -> epw_file, stat_file, ddy_file; plug-in component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
number_slider_36 = Slider(50, range=0..100)

# ----
# Daylight Glare Probability (DGP)
# # Daylight Glare Probability
# This cluster calculates the DGP for a specific view.
# 
# ## Instructions
# Enter all inputs and set `Run Glare analysis`to True to investigate glare potential for the set viewport and time. For a simple model this simulation takes around 50-60s.
# 
# ## Inputs
# - `EPW file URL` - the URL for a EPW file which describes the location
# - `Honeybee model` - the Honeybee model for analysis
# - `Viewport name` - the string name of a viewport in the Rhino model which shall be analysed
# - `Month` - month of the analysis period (1-12)
# - `Day` - date of the analysis period (1-31)
# - `Hour` - hour of the analysis period (0-23)
# - `Run Glare analysis` - set to True to run the analysis
# 
# ## Outputs
# - `Daylight glare probability (DGP)` - a value for the probability of glare occuring in this view at this time [%]
# - `HDR image` - a HDR image which can be visualised using LB ImageViewer to show what areas cause glare
# - `HDR false color image` - a HDR image with modified colors to more clearly see causes of glare
# 
# ## Interpretation
# To be added...
calculate_glare_probability_2 = RemoteReceiver(calculate_glare_probability)
txt_3 = Text("Perspective")
run_glare_analysis = Boolean(calculate_glare_probability_2)
day = Number(Slider(21, range=1..31))
hour = Number(Slider(12, range=0..23))
month = Number(Slider(6, range=1..12))
num_3 = Number(calculate_glare_probability_2)
num_4 = Number(calculate_glare_probability_2)

gate_44 = StreamGate(Stream=objbynn_3, Gate=run_glare_analysis)  # -> Target0, Target1
hold_8 = HoldingGate(Data=gate_44.Target1)
msgs_3 = GetRuntimeMessages(Objects=hold_8)  # -> Errors, Warnings
pitview_message_warning = RemoteSender(msgs_3.Warnings)
pitview_message_error = RemoteSender(msgs_3.Errors)

# ---- group: Analysis module (continued)
pitview_message_warning_2 = RemoteReceiver(pitview_message_warning)
pitview_message_error_2 = RemoteReceiver(pitview_message_error)
lng_30 = ListLength(List=pitview_message_error_2)
lng_31 = ListLength(List=pitview_message_warning_2)
ma_17 = MassAddition(Input=[lng_30, lng_31])  # -> Result, PartialResults
bool_51 = Boolean(ma_17.Result)
hasdata_10 = DataExists(Data=bool_51)
filter_49 = StreamFilter(Gate=hasdata_10, Stream0="False", Stream1=bool_51)
filter_50 = StreamFilter(Gate=lng_30, Stream0="Warning", Stream1="Error")
filter_51 = StreamFilter(Gate=lng_30, Stream0=ColourSwatch(SwatchColor=RGB(237, 185, 94)), Stream1=ColourSwatch(SwatchColor=RGB(226, 54, 54)))
adjustelem_20 = AdjustElementAppearance(ElementsToAdjust=tb_2, Foreground=filter_51)
settextblock_8 = SetTextBlockContents(TextBlockToModify=tb_2, NewTextBlockContents=filter_50)
hideshow_31 = HideShowElement(ElementToHideShow=tb_2, Show=filter_49, Collapse=True, Disable=False)

# ----
# Daylight (Illuminance, DA and UDI)
# Create analysis grid
# Alternatively create grid from surface
# # Daylight (Illuminance, DA and UDI)
# This cluster simulates illuminance for a specified hour of the year and daylight autonomy (DA) and useful daylight illuminance (UDI) for the entire year across an analysis surface.
# 
# ## Instructions
# Enter all inputs and set `Run Illuminance` or `Run Annual Daylight Simulation`to True to investigate daylight. The illuminance study covers a specified time step whereas the annual daylight simulation covers the full year. The `grid size` and `detail level` inputs can be used to improve the fidelity of the simulation at the cost of simulation time. The study can take several minutes, depending on the grid size and detail level.
# 
# ## Inputs
# - `EPW file URL` - the URL for a EPW file which describes the location
# - `Honeybee model` - the Honeybee model for analysis
# - `Grid size` - the resolution of the analysis grid in metres
# - `Detail level (0-2)` - level of detail for the daylight simulation, the higher value, the higher detail and the slower the simulation
# - `Month (illuminance)` - month of the analysis period  for the illuminance simulation (1-12)
# - `Day (illuminance)` - date of the analysis period for the illuminance simulation (1-31)
# - `Hour (illuminance)` - hour of the analysis period for the illuminance simulation (0-23)
# - `Run Illuminance` - set to True to run the illuminance analysis for the specified timestep
# - `Run Annual Daylight Simulation` - set to True to run the full year daylight simulation
# 
# ## Outputs
# - `Illuminance [Lux]` - a mesh visualising the amount of incident radiation which hits the analysis surface at the specified timestep
# - `Spatial Daylight Autonomy [-]` - the mean SDA for the entire analysis surface
# - `Daylight autonomy [%]` - a mesh visualising the value of DA across the analysis surface
# - `UDI [%]` - a mesh visualising the value of Useful Daylight Illuminance across the analysis surface
# - `UDI <50 [%]` - a mesh visualising the percentage of time that the lower treshold of illuminance is not achieved across the analysis surface
# - `UDI >3000 [%]` - a mesh visualising the percentage of time that the upper treshold of illuminance is exceeded across the analysis surface
# 
# ## Interpretation
# To be added...
number_slider_37 = Slider(12, range=0..23)
run_daylight_simulations_2 = RemoteReceiver(run_daylight_simulations)
number_slider_38 = Slider(0, range=0..2)
toggle_6 = BooleanToggle(True)
data_25 = Data(location_11)
panel_129 = Panel(run_daylight_simulations_2)
epw_file_url_2 = Data(data_25)
downloadepw_4 = LBDownloadWeather(weather_URL=epw_file_url_2)  # -> epw_file, stat_file, ddy_file; plug-in component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
detail_level_0_2 = Number(number_slider_38)
grid_size = Number(Slider(1, range=0..10))
detail_level_0_2_2 = Number(number_slider_38)
run_annual_daylight_simulation = Boolean(run_daylight_simulations_2)
run_illuminance = Boolean(run_daylight_simulations_2)
cluster_5 = Cluster_6()
X = UnitX(Factor=Slider(0, range=0..400))

gate_45 = StreamGate(Stream=objbynn_4, Gate=run_annual_daylight_simulation)  # -> Target0, Target1
hold_9 = HoldingGate(Data=gate_45.Target1)
msgs_4 = GetRuntimeMessages(Objects=hold_9)  # -> Errors, Warnings
annualdaylight_message_error = RemoteSender(msgs_4.Errors)
annualdaylight_message_warning = RemoteSender(msgs_4.Warnings)

# ---- group: Analysis module (continued)
annualdaylight_message_warning_2 = RemoteReceiver(annualdaylight_message_warning)
annualdaylight_message_error_2 = RemoteReceiver(annualdaylight_message_error)

# ----
# Revised LCA calculation
# # Life Cycle Assessment (LCA)
# This cluster calculates the embodied carbon for the input Honeybee model
# 
# ## Instructions
# Enter the inputs to calculate the GWP (Global Warming Potential), i.e. the embodied carbon, for the materials in the Honeybee model
# 
# ## Inputs
# - `Honeybee model` - the Honeybee model for analysis
# 
# ## Outputs
# - `Total GWP` - total GWP for the modules A1-A5.1 [kg CO2eq]
# - `GWP by element type` - GWP of each element type for the modules A1-A5.1 [kg CO2eq]
# - `Element types` - list of element types in the model
# 
# ## Interpretation
# To be added...
panel_130 = Panel("Energy and fuel")
get_resources = BrimstoneGetResources(json_data=get_categories.json_data, category=panel_130)  # -> out, json_data, resources
# ---------- get_resources: Python ----------
"""Extracts resource names from a Klimatdatabas json object
    Inputs:
        json_data: dictionary with json data
        category: readable name of category to extract resources from
    Output:
        resources: List of resources in category"""

import scriptcontext

import brimstone
ghenv.Component.Message = brimstone.globals.version

ghenv.Component.Name = 'Brimstone - Get Resources'
ghenv.Component.NickName = 'Get Resources'

def main(json_data, category):
    resources = get_resources(json_data, category)
    return resources
    
def get_resources(json_data, category):
    pred = lambda v: v["Text"] == category
    resources = []
    for resource in json_data["Resources"]:
        if len(filter(pred, resource["Categories"])) > 0:
            resources.append(resource["Name"])
    return resources

if __name__ == "__main__":
    if not scriptcontext.sticky["brimstone_flying"]:
        raise Exception("The 'Brimstone - Fly' component needs to exist on the canvas")
    print json_data
    resources = main(json_data, category)
    
    json_data = [json_data]
# ---------- end get_resources ----------
list_11 = ItemSelector(
    get_resources.resources,
    {"Electricity, Swedish mix", "Diesel, reduction obligation  (2021)": "Diesel, reduction obligation (2021)", "Diesel, fossil", "Petrol, reduction obligation  (2021)": "Petrol, reduction obligation (2021)", "Petrol, 100% fossil", "District heating, Swedish average", "HVO100", "Gasol", "Wood pellets", "E85 ethanol", "Biogas", "Fuel oil 1", "Fuel oil 2-5", "FAME100", "ED95"}, selected="Electricity, Swedish mix")
get_lca_data = BrimstoneGetLCAData(json_data=get_resources.json_data, resources="District heating, Swedish average")  # -> out, json_data, lca_data, indicators, values; inputs resources: list, addtl_indicators: list
#   port json_data: List of resources in category
# ---------- get_lca_data: Python ----------
"""Extracts LCA indicators and values from a Klimatdatabas json for a specific resource
    Inputs:
        json_data: dictionary with json data
        resources: list of readable names of resources
        addtl_indicators: list of additional keys to retrieve from resource
    Output:
        lca_data: list of dictionaries with LCA data for each resource
        indicators: list of indicators
        values: list of indicator values"""

import scriptcontext
import ghpythonlib.treehelpers as th
from collections import OrderedDict
import copy

import brimstone
ghenv.Component.Message = brimstone.globals.version

ghenv.Component.Name = 'Brimstone - Get LCA Data'
ghenv.Component.NickName = 'Get LCA Data'

# todo: magic string here - not good!
gwp_data_string = "Global Warming potential"

# keys: names in output dict, values: DataModuleCode in json db
gwp_data_entries = {
    "GWPA1A3Conservative": "A1-A3 Conservative",
    "GWPA1A3Typical": "A1-A3 Typical",
    "GWPA4": "A4",
    "GWPA5.1": "A5.1",
}

def main(json_data, resource, addtl_indicators):
    lca_data, indicators, values = [], [], []

    for i, resource in enumerate(resources):
        lca_data.append(get_lca_data(json_data, resource, addtl_indicators))
        resource_indicators, resource_values = get_indicator_values(lca_data[i], addtl_indicators)
        indicators.append(resource_indicators)
        values.append(resource_values)
    return lca_data, indicators, values
    
def get_lca_data(json_data, resource_name, addtl_indicators):
    resource_data = copy.deepcopy(
        find_obj_in_array(
            json_data["Resources"],
            "Name",
            resource_name
        )
    )
    
    if not resource_data:
        raise Exception(
            "Resource with name {resource_name} was not found in database."
            .format(resource_name = resource_name)
       )
    try:
        lca_data = extract_lca_data(resource_data, addtl_indicators)
    except KeyError:
        raise Exception("Format of JSON data is not supported.")
    return lca_data

def extract_lca_data(resource_data, addtl_indicators):
    lca_data = OrderedDict()
    resource_name = resource_data["Name"]
    
    lca_data["Name"] = resource_name
    
    if "Conversions" in resource_data:
        # can a resource have multiple conversions?
        lca_data["ConversionUnit"] = resource_data["Conversions"][0]["Unit"]
        lca_data["ConversionValue"] = resource_data["Conversions"][0]["Value"]
    
    if "InventoryUnit" in resource_data:
        lca_data["InventoryUnit"] = resource_data["InventoryUnit"]
    
    for data_prop in resource_data["DataItems"]:
        if data_prop["PropertyName"] == gwp_data_string:
            gwp_data = copy.deepcopy(data_prop)
            break
            
    if not gwp_data:
        raise Exception("GWP data not found for {resource_name}"
            .format(resource_name = resource_name))
    
    lca_data["GWPUnit"] = gwp_data["PropertyUnitCode"]
    for key in gwp_data_entries:
        value = find_obj_in_array(
            gwp_data["DataValueItems"],
            "DataModuleCode",
            gwp_data_entries[key]
        )
        if value is not None:
            lca_data[key] = value["Value"]
            
    for addtl_indicator in addtl_indicators:
        if addtl_indicator in resource_data:
            lca_data[addtl_indicator] = resource_data[addtl_indicator]
    
    return lca_data

def find_obj_in_array(array, key, value):
    return next((x for x in array if x[key] == value), None)

def get_indicator_values(lca_data, addtl_indicators):
    indicator_dict = OrderedDict([
        ("Name", "Name"),
        ("InventoryUnit", "Inventory unit"),
        ("ConversionUnit", "Conversion unit"),
        ("ConversionValue", "Conversion value"),
        ("GWPUnit", "GWP unit"),
        ("GWPA1A3Conservative", "GWP (A1-A3 Conservative)"),
        ("GWPA1A3Typical", "GWP (A1-A3 Typical)"),
        ("GWPA4", "GWP (A4)"),
        ("GWPA5.1", "GWP (A5.1)"),
    ])
    
    for addtl_indicator in addtl_indicators:
        indicator_dict[addtl_indicator] = addtl_indicator
    
    indicators, values = [], []
    
    for key, indicator_name in indicator_dict.items():
        indicator_value = lca_data[key] if key in lca_data else None
        if indicator_value:
            indicators.append(indicator_name)
            values.append(indicator_value)
    
    return indicators, values

if __name__ == "__main__":
    if not scriptcontext.sticky["brimstone_flying"]:
        raise Exception("The 'Brimstone - Fly' component needs to exist on the canvas")
    lca_data, indicators, values = main(json_data, resources, addtl_indicators)
    
    lca_data_treeable = []
    
    for resource_lca_data in lca_data:
        lca_data_treeable.append([resource_lca_data.keys(), resource_lca_data.values()])
    lca_data = th.list_to_tree(lca_data_treeable)
    indicators = th.list_to_tree(indicators)
    values = th.list_to_tree(values)
    json_data = [json_data]
# ---------- end get_lca_data ----------
panel_131 = Panel("kg CO2eq")

# ---- group: Glare analysis
epw_file_url_3 = Data(location_10)
viewport_name = Data(txt_3)
pt_16 = ConstructPoint(XCoordinate=Slider(6, range=0..10), YCoordinate=Slider(5, range=0..10), ZCoordinate=Slider(2, range=0..10))
viewport = HBViewFromViewport(name=viewport_name, viewport=viewport_name, view_type=Slider(4, range=0..5))  # -> view; plug-in component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
pt_17 = ConstructPoint(XCoordinate=Slider(4, range=0..10), YCoordinate=Slider(4, range=0..10), ZCoordinate=Slider(1.6, range=0..10))
vec2pt = Vector2Pt(PointA=pt_17, PointB=pt_16, Unitize=False)  # -> Vector, Length
view = HBView(position=pt_17, direction=vec2pt.Vector, view_type=Slider(4, range=0..5))  # -> view; plug-in component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
hoy = LBCalculateHOY(month=month, day=day, hour=hour)  # -> flatten(hoy), flatten(doy), flatten(date); plug-in component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
falsecolor = HBFalseColor(max=Slider(2300, range=0..10000), contour_lines=Toggle(True))  # -> hdr; plug-in component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
hdr_false_color_image = Data(falsecolor)

# ----
# Temporary data for developing UI
element_types = Data(["Aperture", "Roof", "Wall", "Floor"])
gwp_by_element_type = Data(["50", "40", "75", "25"])
placeholder_data = Panel(element_types)
placeholder_data_2 = Panel(gwp_by_element_type)
lca_element_types = RemoteSender(placeholder_data)

lca_element_types_2 = RemoteReceiver(lca_element_types)

downloadepw_5 = LBDownloadWeather(weather_URL=epw_file_url_3)  # -> epw_file, stat_file, ddy_file; plug-in component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

# ---- group: Glare analysis (continued)
importloc = LBImportLocation(epw_file=downloadepw_5.epw_file)  # -> location; plug-in component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
ciesky = HBCIEStandardSky(location=importloc, month=month, day=day, hour=hour, type=0)  # -> sky; plug-in component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

# ---- group: Simulate
run_energy_simulation = Boolean(run_detailed_energy_simulations_2)

# ----
lca_element_types_3 = RemoteReceiver(lca_element_types)

# ----
# Calculate operational emissions
list_12 = ValueList({"Conservative": "conservative", "Typical": "typical"}, selected="Conservative")
panel_134 = Panel("kg CO2eq/year")

# ---- group: Load previous model
falsestart = LBFalseStartToggle(False)

# ---- group: Peak loads
toggle_7 = BooleanToggle(True)
toggle_8 = BooleanToggle(True)

# ---- group: Analyse performance / Simple energy balance
colrange_4 = LBColorRange(index=Slider(19, range=0..100))  # -> colors; plug-in component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

# ---- group: Daylight Factor
# Daylight Factor [%]
number_slider_39 = Slider(0, range=0..2)
falsestart_2 = LBFalseStartToggle(False)
radpar = HBRadianceParameter(recipe_type=number_slider_39, detail_level=detail_level_0_2)  # -> rad_par; plug-in component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
run_daylight_factor = Data(falsestart_2)
cluster_6 = Cluster_6()

# ---- group: Analyse performance / Simple peak loads
toggle_9 = BooleanToggle(True)
toggle_10 = BooleanToggle(True)
toggle_11 = BooleanToggle(True)
toggle_12 = BooleanToggle(True)

# ---- group: Energy balance
colrange_5 = LBColorRange(index=Slider(19, range=0..100))  # -> colors; plug-in component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
neg_3 = Negative(Value=number_slider_36)
legendpar = LBLegendParameters(min=neg_3, max=number_slider_36, colors=colrange_5)  # -> leg_par; plug-in component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

# ---- group: Spatial climate based daylight
panel_135 = Panel("-t 50 -lt 200 -ut 2000")
radpar_2 = HBRadianceParameter(recipe_type=Slider(2, range=0..2), detail_level=detail_level_0_2, additional_par="-ab 4")  # -> rad_par; plug-in component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
wea = HBWeaFromEPW(epw_file=downloadepw_4.epw_file)  # -> wea; plug-in component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
panel_136 = Panel(radpar_2)
cluster_7 = Cluster_6()
cluster_8 = Cluster_6()
cluster_9 = Cluster_6()
X_2 = UnitX(Factor=Slider(150, range=0..400))
X_3 = UnitX(Factor=Slider(100, range=0..400))
X_4 = UnitX(Factor=Slider(50, range=0..400))

# ---- group: Simulate illuminance
importloc_2 = LBImportLocation(epw_file=downloadepw_4.epw_file)  # -> location; plug-in component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
day_illuminance = Number(Slider(21, range=1..31))
hour_illuminance = Number(number_slider_37)
month_illuminance = Number(Slider(6, range=1..12))
radpar_3 = HBRadianceParameter(recipe_type=Slider(0, range=0..2), detail_level=detail_level_0_2_2)  # -> rad_par; plug-in component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
ciesky_2 = HBCIEStandardSky(location=importloc_2, month=month_illuminance, day=day_illuminance, hour=hour_illuminance, type=0)  # -> sky; plug-in component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
legendpar_2 = LBLegendParameters(max=Slider(2000, range=0..10000))  # -> leg_par; plug-in component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
objbynn_17 = GetObjectByNickname(NickName="PITGrid")
gate_46 = StreamGate(Stream=objbynn_17, Gate=run_illuminance)  # -> Target0, Target1
hold_10 = HoldingGate(Data=gate_46.Target1)
msgs_5 = GetRuntimeMessages(Objects=hold_10)  # -> Errors, Warnings
pitgrid_message_error = RemoteSender(msgs_5.Errors)
pitgrid_message_warning = RemoteSender(msgs_5.Warnings)

# ---- group: Analysis module (continued)
pitgrid_message_warning_2 = RemoteReceiver(pitgrid_message_warning)
pitgrid_message_error_2 = RemoteReceiver(pitgrid_message_error)
lng_32 = ListLength(List=[annualdaylight_message_error_2, pitgrid_message_error_2])
lng_33 = ListLength(List=[annualdaylight_message_warning_2, pitgrid_message_warning_2])
ma_18 = MassAddition(Input=[lng_32, lng_33])  # -> Result, PartialResults
bool_52 = Boolean(ma_18.Result)
hasdata_11 = DataExists(Data=bool_52)
filter_52 = StreamFilter(Gate=hasdata_11, Stream0="False", Stream1=bool_52)
filter_53 = StreamFilter(Gate=lng_32, Stream0="Warning", Stream1="Error")
filter_54 = StreamFilter(Gate=lng_32, Stream0=ColourSwatch(SwatchColor=RGB(237, 185, 94)), Stream1=ColourSwatch(SwatchColor=RGB(226, 54, 54)))
adjustelem_21 = AdjustElementAppearance(ElementsToAdjust=tb_6, Foreground=filter_54)
settextblock_9 = SetTextBlockContents(TextBlockToModify=tb_6, NewTextBlockContents=filter_53)
hideshow_32 = HideShowElement(ElementToHideShow=tb_6, Show=filter_52, Collapse=True, Disable=False)

# ----
data_26 = Data(hdr_false_color_image)
calculate_glare_probability_3 = RemoteReceiver(calculate_glare_probability)
pitview_message_error_3 = RemoteReceiver(pitview_message_error)
lng_34 = ListLength(List=pitview_message_error_3)
data_27 = Data()
data_28 = Data()

simple_energy_simulation_type_2 = RemoteReceiver(simple_energy_simulation_type)
annualloads_message_error_3 = RemoteReceiver(annualloads_message_error)
peakloads_message_error_3 = RemoteReceiver(peakloads_message_error)
current_tab_27 = RemoteReceiver(current_tab)
expression_69 = Expression(x="Analysis module", y=current_tab_27, Expression="x=y")

lng_35 = ListLength(List=annualloads_message_error_3)
lng_36 = ListLength(List=peakloads_message_error_3)

# ---- group: Extract hourly data from annual results
number_slider_40 = Slider(0.1, range=0..0.1)
legendpar_3 = LBLegendParameters(max=Slider(3000, range=0..3000))  # -> leg_par; plug-in component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
multiplication_4 = Multiplication(A=number_slider_40, B=4)
pt_18 = Point(Point(0, 35, 0))

# ----
# Zoom simple energy
zoom_simple_energy_simulation_2 = RemoteReceiver(zoom_simple_energy_simulation)
panel_137 = Panel(zoom_simple_energy_simulation_2)

or_31 = GateOr(A=lng_35, B=lng_36)

imageviewer = LBImageViewer(ImagePath_=data_27, _scale_="1", DisableClickable=False, SaveImgWithCoords=False, scale=1)  # -> ImagePath, Values, GIF
imageviewer_2 = LBImageViewer(ImagePath_=data_28, _scale_="1", DisableClickable=False, SaveImgWithCoords=False, scale=1)  # -> ImagePath, Values, GIF
panel_138 = Panel(imageviewer_2.Values)
panel_139 = Panel(imageviewer_2.GIF)
panel_140 = Panel(imageviewer_2.ImagePath)

run_detailed_energy_simulations_3 = RemoteReceiver(run_detailed_energy_simulations)
detailed_energy_simulation_type_2 = RemoteReceiver(detailed_energy_simulation_type)
current_tab_28 = RemoteReceiver(current_tab)
expression_70 = Expression(x="Analysis module", y=current_tab_28, Expression="x=y")

# ----
# Zoom detailed energy
zoom_detailed_energy_simulation_2 = RemoteReceiver(zoom_detailed_energy_simulation)
panel_141 = Panel("Top")

# ----
# Bake simple energy
bake_simple_energy_simulation_2 = RemoteReceiver(bake_simple_energy_simulation)
gate_47 = StreamGate(Stream="Heath::Simple energy simulation::Annual energy balance", Gate=bake_simple_energy_simulation_2)  # -> Target0, Target1
layers = CreateModifyLayers(LayerName=gate_47.Target1, DeleteLayer=False, enableFullPath=True)  # -> LayerNames, LayerFullPath
createatts = CreateAttributes(LayerName=layers.LayerFullPath, enableFullPath=True)

run_daylight_simulations_3 = RemoteReceiver(run_daylight_simulations)
daylight_simulation_type_3 = RemoteReceiver(daylight_simulation_type)
annualdaylight_message_error_3 = RemoteReceiver(annualdaylight_message_error)
pitgrid_message_error_3 = RemoteReceiver(pitgrid_message_error)
current_tab_29 = RemoteReceiver(current_tab)
lng_37 = ListLength(List=pitgrid_message_error_3)
lng_38 = ListLength(List=annualdaylight_message_error_3)
expression_71 = Expression(x="Analysis module", y=current_tab_29, Expression="x=y")
or_32 = GateOr(A=lng_37, B=lng_38)

# ----
# Zoom daylight simulation
zoom_daylight_simulation_2 = RemoteReceiver(zoom_daylight_simulation)
panel_142 = Panel(zoom_daylight_simulation_2)

created_constructions_database = RemoteReceiver(created_constructions_database_2)
decnstrconstr_2 = HBDeconstructConstruction(constr=created_constructions_database)  # -> name, materials, layers, r_val_si, r_val_ip, u_fac_si, u_fac_ip, shgc, t_sol, t_vis; plug-in component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
decnstrmat_4 = HBDeconstructMaterial(mat=decnstrconstr_2.materials)  # -> values, attr_names, r_val_si, r_val_ip; plug-in component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
expression_72 = Expression(x=decnstrconstr_2.u_fac_si, Expression="Round(x, 2)")
null_31 = NullItem(Item=created_constructions_database)  # -> NullFlags, InvalidFlags, Description
item_29 = ListItem(List=decnstrmat_4.values, Index=0, Wrap=True)  # -> Item, Item1
item_30 = ListItem(List=null_31.NullFlags, Index=0, Wrap=True)
shiftm = ShiftMatch(GuideTree=decnstrconstr_2.materials, SecondaryData1=item_29.Item, SecondaryData2=item_29.Item1, shiftFromStart=False)  # -> GuideTree, SecondaryData1, SecondaryData2
visualize_construction_materials = RemoteSender(shiftm.SecondaryData1)
visualize_construction_thickness = RemoteSender(shiftm.SecondaryData2)
format_15 = Format(Format="{0} (U-factor: {1})", Culture=127, Data0=decnstrconstr_2.name, Data1=expression_72)
format_16 = Format(Format="{0}, {1}m", Culture=127, Data0=shiftm.SecondaryData1, Data1=shiftm.SecondaryData2)
gate_48 = StreamGate(Stream=format_15, Gate=item_30)  # -> Target0, Target1
tstat = TreeStatistics(Tree=format_16)  # -> Paths, Length, Count
tstat_2 = TreeStatistics(Tree=format_16)  # -> Paths, Length, Count
repeat_22 = RepeatData(Data="[Innermost layer]", Length=tstat_2.Count)
repeat_23 = RepeatData(Data="[Outermost layer]", Length=tstat.Count)
entwine_124 = Entwine(Branch00=format_2, Branch01=gate_48.Target0, FlattenInputs=True)  # -> flatten(Result)
entwine_125 = Entwine(Branch00=format_4, Branch01=gate_48.Target0, FlattenInputs=True)  # -> flatten(Result)
entwine_126 = Entwine(Branch00=format_5, Branch01=gate_48.Target0, FlattenInputs=True)  # -> flatten(Result)
entwine_127 = Entwine(Branch00=format_3, Branch01=gate_48.Target0, FlattenInputs=True)  # -> flatten(Result)
entwine_128 = Entwine(Branch00=format_7, Branch01=gate_48.Target0, FlattenInputs=True)  # -> flatten(Result)
entwine_129 = Entwine(Branch00=format_6, Branch01=gate_48.Target0, FlattenInputs=True)  # -> flatten(Result)
concat_3 = Concatenate(FragmentA="- ", FragmentB=format_16)
tree = CreateTree(Data=repeat_23, Path=tstat.Paths)
tree_2 = CreateTree(Data=repeat_22, Path=tstat_2.Paths)
entwine_130 = Entwine(Branch00="Generic", Branch01=decnstrconstr_2.name, FlattenInputs=True)  # -> flatten(Result)
entwine_131 = Entwine(Branch00="Generic", Branch01=created_constructions_database, FlattenInputs=True)  # -> flatten(Result)
merge_16 = Merge(Data1=tree, Data2=concat_3, Data3=tree_2)
filter_55 = StreamFilter(Gate=item_30, Stream0=entwine_124, Stream1=format_2)
filter_56 = StreamFilter(Gate=item_30, Stream0=entwine_125, Stream1=format_4)
filter_57 = StreamFilter(Gate=item_30, Stream0=entwine_126, Stream1=format_5)
filter_58 = StreamFilter(Gate=item_30, Stream0=entwine_127, Stream1=format_3)
filter_59 = StreamFilter(Gate=item_30, Stream0=entwine_128, Stream1=format_7)
filter_60 = StreamFilter(Gate=item_30, Stream0=entwine_129, Stream1=format_6)
filter_61 = StreamFilter(Gate=item_30, Stream0=entwine_131, Stream1="Generic")
filter_62 = StreamFilter(Gate=item_30, Stream0=entwine_130, Stream1="Generic")
gate_49 = StreamGate(Stream=merge_16, Gate=item_30)  # -> Target0, Target1
all_construction_display_interior_walls = RemoteSender(filter_60)
all_construction_display_exterior_walls = RemoteSender(filter_59)
panel_143 = Panel(merge_16)
all_construction_display_exterior_roofs = RemoteSender(filter_56)
all_construction_display_interior_floors = RemoteSender(filter_57)
all_construction_display_exterior_floors = RemoteSender(filter_58)
all_construction_display_ground = RemoteSender(filter_55)
custom_constructions = RemoteSender(gate_48.Target0)
custom_constructions_info = RemoteSender(gate_49.Target0)
all_construction_names = RemoteSender(filter_62)
all_constructions = RemoteSender(filter_61)

# ---- group: Construction module (continued)
all_construction_display_exterior_floors_2 = RemoteReceiver(all_construction_display_exterior_floors)
all_construction_display_exterior_walls_2 = RemoteReceiver(all_construction_display_exterior_walls)
all_construction_display_interior_walls_2 = RemoteReceiver(all_construction_display_interior_walls)
all_construction_display_interior_floors_2 = RemoteReceiver(all_construction_display_interior_floors)
all_construction_display_exterior_roofs_2 = RemoteReceiver(all_construction_display_exterior_roofs)
all_construction_display_ground_2 = RemoteReceiver(all_construction_display_ground)
setlist_5 = SetListContents(ListToModify=pulldown_20, NewListContents=all_construction_display_exterior_roofs_2, SelectedIndex="0")
setlist_6 = SetListContents(ListToModify=pulldown_18, NewListContents=all_construction_display_interior_floors_2, SelectedIndex="0")
setlist_7 = SetListContents(ListToModify=pulldown_17, NewListContents=all_construction_display_ground_2, SelectedIndex="0")
setlist_8 = SetListContents(ListToModify=pulldown_19, NewListContents=all_construction_display_exterior_floors_2, SelectedIndex="0")
setlist_9 = SetListContents(ListToModify=pulldown_16, NewListContents=all_construction_display_exterior_walls_2, SelectedIndex="0")
setlist_10 = SetListContents(ListToModify=pulldown_21, NewListContents=all_construction_display_interior_walls_2, SelectedIndex="0")

# ----
all_constructions_2 = RemoteReceiver(all_constructions)
all_constructions_3 = RemoteReceiver(all_constructions)
all_constructions_4 = RemoteReceiver(all_constructions)
item_31 = ListItem(List=all_constructions_2, Index=subset_exterior_floor_2, Wrap=True)
item_32 = ListItem(List=all_constructions_3, Index=subset_exterior_wall_2, Wrap=True)
item_33 = ListItem(List=all_constructions_4, Index=subset_exterior_roof_2, Wrap=True)
expression_73 = Expression(x="Generic", y=item_31, Expression="x=y")
expression_74 = Expression(x="Generic", y=item_32, Expression="x=y")
expression_75 = Expression(x="Generic", y=item_33, Expression="x=y")
filter_63 = StreamFilter(Gate=expression_73, Stream0=item_31, Stream1=null_5)
filter_64 = StreamFilter(Gate=expression_74, Stream0=item_32, Stream1=null_6)
filter_65 = StreamFilter(Gate=expression_75, Stream0=item_33, Stream1=null_7)
exteriorsubset_2 = HBExteriorConstructionSubset(exterior_wall=filter_64, exterior_roof=filter_65, exposed_floor=filter_63)  # -> exterior_set; plug-in component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

all_constructions_5 = RemoteReceiver(all_constructions)
all_constructions_6 = RemoteReceiver(all_constructions)
item_34 = ListItem(List=all_constructions_5, Index=subset_interior_wall_2, Wrap=True)
item_35 = ListItem(List=all_constructions_6, Index=subset_interior_floor_2, Wrap=True)
expression_76 = Expression(x="Generic", y=item_34, Expression="x=y")
expression_77 = Expression(x="Generic", y=item_35, Expression="x=y")
filter_66 = StreamFilter(Gate=expression_76, Stream0=item_34, Stream1=null_8)
filter_67 = StreamFilter(Gate=expression_77, Stream0=item_35, Stream1=null_9)
interiorsubset_2 = HBInteriorConstructionSubset(interior_wall=filter_66, interior_floor=filter_67)  # -> interior_set; plug-in component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

all_constructions_7 = RemoteReceiver(all_constructions)
item_36 = ListItem(List=all_constructions_7, Index=subset_ground_floor_2, Wrap=True)
expression_78 = Expression(x="Generic", y=item_36, Expression="x=y")
filter_68 = StreamFilter(Gate=expression_78, Stream0=item_36, Stream1=null_10)
groundsubset_2 = HBGroundConstructionSubset(ground_floor=filter_68)  # -> ground_set; plug-in component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

constructionset_2 = HBConstructionSet(
    name=panel_83,
    base_constr_set=panel_51,
    exterior_subset=exteriorsubset_2,
    ground_subset=groundsubset_2,
    interior_subset=interiorsubset_2,
    subface_subset=subfacesubset_2)  # -> constr_set; plug-in component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
decnstrconstrset_2 = HBDeconstructConstructionSet(constr_set=constructionset_2)  # -> exterior_wall, exterior_roof, exposed_floor, ground_wall, ground_roof, ground_floor, window, skylight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; plug-in component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
panel_144 = Panel(decnstrconstrset_2.exterior_wall)
decnstrconstr_3 = HBDeconstructConstruction(constr=decnstrconstrset_2.exterior_roof)  # -> materials, layers, r_val_si, r_val_ip, u_fac_si, u_fac_ip, shgc, t_sol, t_vis; plug-in component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
decnstrconstr_4 = HBDeconstructConstruction(constr=decnstrconstrset_2.exterior_wall)  # -> materials, layers, r_val_si, r_val_ip, u_fac_si, u_fac_ip, shgc, t_sol, t_vis; plug-in component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
add_dynamic_shades = AddDynamicShades(base_construction_set=constructionset_2, setpoint=Slider(100, range=0..200))

calc_mat_thickness = HBDeconstructMaterial(mats=decnstrconstr_3.materials)  # -> out, t; inputs mats: list
#   port mats: A material to be deconstructed. This can also be text for a material to be looked up in the material library.
# ---------- calc_mat_thickness: Python ----------
from honeybee_energy.material.opaque import EnergyMaterial, EnergyMaterialNoMass
t = 0
lamb = 0.036
for mat in mats:
    print(mat.thickness, type(mat))
    if type(mat) == EnergyMaterial:
        t = t + mat.thickness
    elif type(mat) == EnergyMaterialNoMass:
        print (mat.r_value * lamb)
        t = t + (mat.r_value * lamb)
    else:
        pass
print ('total thickness:' + str(t))
# ---------- end calc_mat_thickness ----------
calc_mat_thickness_2 = HBDeconstructMaterial(mats=decnstrconstr_4.materials)  # -> out, t; inputs mats: list; same code as calc_mat_thickness

custom_constructions_info_2 = RemoteReceiver(custom_constructions_info)
join_9 = TextJoin(Text=custom_constructions_info_2)  # -> flatten(Result)
lng_39 = ListLength(List=join_9)
py3_48 = Python3Script(current_elements=lng_39, maximum_elements=number_slider_25)  # -> status; inputs current_elements: Int32, maximum_elements: Int32
# ---------- py3_48: Python ----------
status = [True]*current_elements
status.extend([False]*(maximum_elements-current_elements))
# ---------- end py3_48 ----------
settextblock_10 = SetTextBlockContents(TextBlockToModify=tb_15, NewTextBlockContents=join_9)
custom_constructions_2 = RemoteReceiver(custom_constructions)
setexp = SetExpander(Expander=expander_2, Name=custom_constructions_2)
hideshow_33 = HideShowElement(ElementToHideShow=simplify(merge_6), Show=simplify(graft(py3_48)), Collapse=True, Disable=False)

data_29 = Data(add_dynamic_shades)
entwine_132 = Entwine(
    Branch00=room,
    Branch01=adjacent,
    Branch02=context,
    Branch03=windows_3,
    Branch04=data_15,
    Branch05=data_29,
    Branch06=model_name_3,
    Branch07=generate_wwr_2,
    Branch08=calc_mat_thickness_2.t,
    Branch09=calc_mat_thickness.t,
    FlattenInputs=True)
freeze_gate_53 = StreamFreezeGate(Data=entwine_132, PassingSwitch=create_model_8, Hold=True)
bang_15 = ExplodeTree(Data=freeze_gate_53)  # -> Branch0, Branch1, Branch2, Branch3, Branch4, Branch5, Branch6, Branch7, Branch8, Branch9
construction = Data(bang_15.Branch5)
program = Data(bang_15.Branch4)
model_name_4 = Data(bang_15.Branch6)
roof_thickness = Data(bang_15.Branch9)
wall_thickness = Data(bang_15.Branch8)
wwr = Data(bang_15.Branch7)
python_3 = GhPythonScript(in_list=construction)  # -> out_list; inputs in_list: list
# ---------- python_3: Python ----------
"""Converts lists of HB objects to dicts for use with Py3.
    Inputs:
        in_list: List of HB objects
    Output:
        out_list: List of Python dictionaries representing HB objects"""

__author__ = "sawen"
__version__ = "2024.07.09"

out_list = list([x.to_dict() for x in in_list])
# ---------- end python_3 ----------
python_4 = GhPythonScript(in_list=program)  # -> out_list; inputs in_list: list; same code as python_3
adjacent_geometry = Geometry(bang_15.Branch1)
windows_4 = Geometry(bang_15.Branch3)
window_to_wall_ratio = Number(wwr)
model_name_5 = Text(model_name_4)
room_geometry = Geometry(bang_15.Branch0)
context_geometry = Geometry(bang_15.Branch2)
wall_thickness_2 = Number(wall_thickness)
py3_49 = Python3Script(
    window_wall_ratio=window_to_wall_ratio,
    window_height=window_height,
    sill_height=sill_height,
    horizontal_separation=horizontal_separation,
    wall_thickness=wall_thickness_2)  # -> out, window_settings
# ---------- py3_49: Python ----------
from heath import WindowSettings

"""Create Window Settings"""
window_settings = WindowSettings(window_wall_ratio, window_height, sill_height, horizontal_separation, wall_thickness)
# ---------- end py3_49 ----------
py3_50 = Python3Script(
    model_name=model_name_5,
    room_geo=room_geometry,
    construction_sets=python_3,
    programs=python_4,
    energy_systems=heatcool,
    adjacent_surfaces=adjacent_geometry,
    window_geo=windows_4,
    window_settings=py3_49.window_settings,
    context_geo=context_geometry,
    jsonify=toggle_3)  # -> out, hb_model; inputs room_geo: list of Brep, construction_sets: list, programs: list, energy_systems: list, adjacent_surfaces: list of Brep, window_geo: list of Surface, context_geo: list of GeometryBase
# ---------- py3_50: Python ----------
# Copyright (c) 2024, Heath.
# You should have received a copy of the GNU Affero General Public License
# along with Heath; If not, see <http://www.gnu.org/licenses/>.
# 
# @license AGPL-3.0-or-later <https://spdx.org/licenses/AGPL-3.0-or-later>

"""Grasshopper Script"""
        
from heath import create_hb_model, heath_globals, utils

import Rhino.Geometry as rg
import IronPython
import importlib
import honeybee_energy

from honeybee.room import Room
cs = honeybee_energy.constructionset.ConstructionSet
pt = honeybee_energy.programtype.ProgramType 

import scriptcontext

def dictify(d):
    if type(d) in [dict, IronPython.Runtime.PythonDictionary]:
        d = dict(d)
        for key in d:
            d[key] = dictify(d[key])
    elif type(d) in [list, IronPython.Runtime.List]:
        d = [dictify(value) for value in list(d)]
    return d

if __name__ == "__main__":
    if not scriptcontext.sticky["heath_flying"]:
        raise Exception("Heath - fly component must exist on the canvas")
    ghenv.Component.Message = heath_globals.version

    # SUPER HACK because Py3 does not retain the Honeybee types
    # https://discourse.ladybug.tools/t/ladybug-honeybee-datatypes-are-converted-when-input-to-py3-component/28216
    construction_sets = [cs.from_dict(dictify(c)) for c in construction_sets]
    
    programs_patched = []
    for p in programs:
        # hack to fix py2-py3 conversion of dicts
        p = pt.from_dict(dictify(p))
        programs_patched.append(p)

    hb_model = create_hb_model(ghenv, list(room_geo), construction_sets, programs_patched, adjacent_surfaces, energy_systems, window_geo, window_settings, louver_settings, context_geo, model_name)

    if jsonify:
        hb_model = utils.jsonify(hb_model.to_dict())
# ---------- end py3_50 ----------
strtoobj_7 = HBStringToObject(hb_str=py3_50.hb_model)  # -> hb_obj; plug-in component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
filter_69 = StreamFilter(Gate=toggle_3, Stream0=py3_50.hb_model, Stream1=strtoobj_7)
filter_70 = StreamFilter(Gate=create_model_8, Stream1=filter_69)
hasdata_12 = DataExists(Data=filter_69)
hasdata_13 = DataExists(Data=filter_70)
honeybee_model_possible = RemoteSender(hasdata_12)

debrep = DeconstructBrep(Brep=room_geometry)  # -> Faces, Edges, Vertices
evalsrf = EvaluateSurface(Surface=graft(debrep.Faces), Point=py3.a)  # -> Point, Normal, UDirection, VDirection, Frame
pt_19 = Point(evalsrf.Point)
event_55 = EventGate(Data=hasdata_13)  # -> Data, IsNew

# ---- group: Assembly model (continued)
honeybee_model_possible_2 = RemoteReceiver(honeybee_model_possible)
bool_53 = Boolean(honeybee_model_possible_2)
filter_71 = StreamFilter(Gate=bool_53, Stream0=Slider(500, range=0..1000), Stream1=Slider(1000000, range=0..1000000))
filter_72 = StreamFilter(Gate=bool_53, Stream0="Import geometry before creating the model", Stream1=" ")
tooltip_9 = AttachTooltipToElement(ElementsToAttachTo=button_3, TooltipContent=filter_72, ShowDelay=filter_71, Duration=2000)

# ----
all_construction_names_2 = RemoteReceiver(all_construction_names)
expression_79 = Expression(x=all_construction_names_2, y=create_construction_name_2, Expression="x=y")
cull_17 = CullPattern(List=expression_79, CullPattern=expression_79)
gate_50 = StreamGate(Stream="Material already exists", Gate=cull_17)  # -> Target0, Target1

visualize_construction_thickness_2 = RemoteReceiver(visualize_construction_thickness)
visualize_construction_materials_2 = RemoteReceiver(visualize_construction_materials)
tstat_3 = TreeStatistics(Tree=visualize_construction_materials_2)  # -> Paths, Length, Count
tstat_4 = TreeStatistics(Tree=visualize_construction_thickness_2)  # -> Paths, Length, Count
stack_73 = StackData(Data=tstat_3.Paths, Stack=tstat_3.Length)
stack_74 = StackData(Data=tstat_4.Paths, Stack=tstat_4.Length)
tree_3 = CreateTree(Data=flatten(visualize_construction_materials_2), Path=stack_73)
tree_4 = CreateTree(Data=flatten(visualize_construction_thickness_2), Path=stack_74)
custom_constructions_3 = RemoteReceiver(custom_constructions)
suirify_12 = Suirify(tree_3)
suirify_13 = Suirify(tree_4)
branch_3 = TreeBranch(Tree=suirify_12, Path=path_3, MaintainPaths=True)
branch_4 = TreeBranch(Tree=suirify_13, Path=path_3, MaintainPaths=True)
item_37 = ListItem(List=custom_constructions_3, Index=pre_construction_database_visualize_cons_2, Wrap=True)
ma_19 = MassAddition(Input=branch_4)  # -> Result, PartialResults
concat_4 = Concatenate(FragmentA=ma_19.Result, FragmentB=" m")
concat_5 = Concatenate(FragmentA=branch_4, FragmentB=" m")
multiplication_5 = Multiplication(A=Slider(400, range=0..1000), B=branch_4)
format_17 = Format(Format=panel_112, Culture=127, Data0=concat_4)
cull_i_4 = CullIndex(List=multiplication_5, Indices="-1", Wrap=True)
item_38 = ListItem(List=multiplication_5, Index="-1", Wrap=True)
lng_40 = ListLength(List=concat_5)
py3_51 = Python3Script(current_elements=lng_40, maximum_elements=construction_maximum_layer_limit_7)  # -> status; inputs current_elements: Int32, maximum_elements: Int32; same code as py3_48
setlabel_3 = SetLabelContents(LabelToModify=label_48, NewLabelContents=item_37)
setlabel_4 = SetLabelContents(LabelToModify=label_51, NewLabelContents=format_17)
settextblock_11 = SetTextBlockContents(TextBlockToModify=tb_20, NewTextBlockContents=branch_3)
settextblock_12 = SetTextBlockContents(TextBlockToModify=tb_19, NewTextBlockContents=concat_5)
entwine_133 = Entwine(Branch00=cull_i_4, Branch01=item_38, FlattenInputs=True)  # -> flatten(Result)
hideshow_34 = HideShowElement(ElementToHideShow=tb_19, Show=py3_51, Collapse=True, Disable=False)
hideshow_35 = HideShowElement(ElementToHideShow=tb_20, Show=py3_51, Collapse=True, Disable=False)
hideshow_36 = HideShowElement(ElementToHideShow=tb_21, Show=py3_51, Collapse=True, Disable=False)
py3_52 = Python3Script(layerHeight=entwine_133, textHeight=Slider(22, range=0..100))  # -> over_text, under_text; inputs layerHeight: list
# ---------- py3_52: Python ----------
over_text = []
under_text = []

for layer in layerHeight:
    if layer <= textHeight:
        over_text.append(0)
        under_text.append(layer)
    else:
        over_text.append((layer/2)-(textHeight/2))

        under_text.append((layer/2)+(textHeight/2))
# ---------- end py3_52 ----------
adjustpos_118 = AdjustElementPositioning(
    ElementsToAdjust=tb_21,
    Margin="0, 0, 0, -1",
    AbsolutePositioning=False,
    Width=number_slider_34,
    Height=py3_52.over_text,
    HorizontalAlignment=0,
    VerticalAlignment=1)
adjustpos_119 = AdjustElementPositioning(
    ElementsToAdjust=tb_20,
    AbsolutePositioning=False,
    Width=number_slider_34,
    Height=py3_52.under_text,
    HorizontalAlignment=0,
    VerticalAlignment=1)

freeze_gate_54 = StreamFreezeGate(Data=filter_70, PassingSwitch=event_55.Data, Hold=True)

rec_28 = DataRecorder(freeze_gate_54, DataLimit=-10, RecordData=True)

# ----
# Models created during
# the current session
panel_145 = Panel(rec_28)

current_all_created_models = RemoteSender(rec_28)
item_39 = ListItem(List=rec_28, Index=current_selected_model_2, Wrap=True)
hasdata_14 = DataExists(Data=rec_28)
filter_73 = StreamFilter(Gate=hasdata_14, Stream0=empty, Stream1=rec_28)

vizbytype = HBVisualizeByType(hb_objs=item_39)  # -> walls, interior_walls, roofs, ceilings, exterior_floors, interior_floors, air_walls, apertures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; plug-in component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
deconstructmodel = HBDeconstructModel(model=item_39)  # -> rooms, faces, apertures, doors, shades; plug-in component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
hasdata_15 = DataExists(Data=item_39)
honeybee_model_ready = RemoteSender(hasdata_15)
panel_146 = Panel(item_39)
panel_147 = Panel(hasdata_15)
geoprop = HBGeometryProperties(rooms=flatten(deconstructmodel.rooms))  # -> ext_wall_area, ext_win_area, volume, floor_area, floor_ep_constr; plug-in component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
lng_41 = ListLength(List=filter_73)
honeybee_model_exists = RemoteSender(lng_41)
panel_148 = Panel(geoprop.floor_area)
gate_51 = StreamGate(Stream=[vizbytype.indoor_shades, vizbytype.outdoor_shades], Gate=show_honeybee_context_3)  # -> Target0, Target1
gate_52 = StreamGate(Stream=[vizbytype.apertures, vizbytype.interior_apertures], Gate=show_honeybee_windows_3)  # -> Target0, Target1
gate_53 = StreamGate(Stream=[vizbytype.doors, vizbytype.interior_doors], Gate=show_honeybee_doors_3)  # -> Target0, Target1
gate_54 = StreamGate(Stream=vizbytype.roofs, Gate=show_honeybee_roof_3)  # -> Target0, Target1
gate_55 = StreamGate(Stream=vizbytype.interior_floors, Gate=show_honeybee_floors_3)  # -> Target0, Target1
gate_56 = StreamGate(Stream=vizbytype.exterior_floors, Gate=show_honeybee_ground_3)  # -> Target0, Target1
gate_57 = StreamGate(Stream=[vizbytype.walls, vizbytype.interior_walls, vizbytype.air_walls], Gate=show_honeybee_walls_3)  # -> Target0, Target1
data_30 = Data(gate_53.Target1)
data_31 = Data(gate_54.Target1)
data_32 = Data(gate_52.Target1)
data_33 = Data(gate_51.Target1)
data_34 = Data(gate_57.Target1)
data_35 = Data(gate_55.Target1)
data_36 = Data(gate_56.Target1)

# ---- group: Assembly model (continued)
current_all_created_models_2 = RemoteReceiver(current_all_created_models)
lng_42 = ListLength(List=current_all_created_models_2)
subtraction_6 = Subtraction(A=lng_42, B="1")
setlist_11 = SetListContents(ListToModify=pulldown_2, NewListContents=current_all_created_models_2, SelectedIndex=subtraction_6)
honeybee_model_exists_2 = RemoteReceiver(honeybee_model_exists)
honeybee_model_exists_3 = RemoteReceiver(honeybee_model_exists)
hideshow_37 = HideShowElement(ElementToHideShow=button_4, Show=True, Collapse=True, Disable=invert(honeybee_model_exists_2))
honeybee_model_exists_4 = RemoteReceiver(honeybee_model_exists)
filter_74 = StreamFilter(Gate=honeybee_model_exists_3, Stream0="Create model", Stream1="Update model")
hideshow_38 = HideShowElement(ElementToHideShow=pulldown_2, Show=honeybee_model_exists_4, Collapse=True, Disable=False)
setbtn = SetButton(ButtonToModify=button_3, ButtonName=filter_74)
honeybee_model_exists_5 = RemoteReceiver(honeybee_model_exists)
hideshow_39 = HideShowElement(ElementToHideShow=border, Show=honeybee_model_exists_5, Collapse=invert(True), Disable=False)

# ----
entwine_134 = Entwine(
    Branch00=data_34,
    Branch01=data_31,
    Branch02=data_35,
    Branch03=data_36,
    Branch04=data_32,
    Branch05=data_30,
    Branch06=data_33,
    FlattenInputs=True)
clean_6 = CleanTree(RemoveNulls=True, RemoveInvalid=True, RemoveEmpty=False, Tree=entwine_134)
lng_43 = ListLength(List=clean_6)
repeat_24 = RepeatData(Data=ef_att_4.Attributes, Length=lng_43)
bake_3 = BakeObjects(Geometry=clean_6, Attributes=repeat_24, Bake=bake_model_2, createGroups=False, preset="Moderate")  # -> Message, Ghosts

data_37 = Data(deconstructmodel.rooms)
visualise_properties = VisualiseProperties(
    honeybee_model=data_37,
    room_attribute=filter_44,
    number_of_decimals_room=Slider(4, range=0..10),
    face_attribute=filter_43,
    number_of_decimals_face=Slider(4, range=0..10))  # -> visualised_room_attributes_2, visualised_face_attributes_2
gate_58 = StreamGate(Stream=visualise_properties.visualised_room_attributes_2, Gate=or_28)  # -> Target0, Target1
gate_59 = StreamGate(Stream=visualise_properties.visualised_face_attributes_2, Gate=or_29)  # -> Target0, Target1
data_38 = Data(gate_58.Target1)
data_39 = Data(gate_59.Target1)

bool_54 = Boolean(geoprop.floor_area)

# ---- group: Analysis module (continued)
honeybee_model_ready_2 = RemoteReceiver(honeybee_model_ready)
honeybee_model_ready_3 = RemoteReceiver(honeybee_model_ready)
honeybee_model_ready_4 = RemoteReceiver(honeybee_model_ready)
honeybee_model_ready_5 = RemoteReceiver(honeybee_model_ready)
honeybee_model_ready_6 = RemoteReceiver(honeybee_model_ready)
honeybee_model_ready_7 = RemoteReceiver(honeybee_model_ready)
honeybee_model_ready_8 = RemoteReceiver(honeybee_model_ready)
honeybee_model_ready_9 = RemoteReceiver(honeybee_model_ready)
filter_75 = StreamFilter(Gate=honeybee_model_ready_2, Stream0=Slider(500, range=0..1000), Stream1=Slider(1000000, range=0..1000000))
filter_76 = StreamFilter(Gate=honeybee_model_ready_2, Stream0="Create a model before running the simulation", Stream1=" ")
filter_77 = StreamFilter(Gate=honeybee_model_ready_3, Stream0=Slider(500, range=0..1000), Stream1=Slider(1000000, range=0..1000000))
filter_78 = StreamFilter(Gate=honeybee_model_ready_3, Stream0="Create a model before running the simulation", Stream1=" ")
filter_79 = StreamFilter(Gate=honeybee_model_ready_4, Stream0=Slider(500, range=0..1000), Stream1=Slider(1000000, range=0..1000000))
filter_80 = StreamFilter(Gate=honeybee_model_ready_4, Stream0="Create a model before running the simulation", Stream1=" ")
filter_81 = StreamFilter(Gate=honeybee_model_ready_5, Stream0=Slider(500, range=0..1000), Stream1=Slider(1000000, range=0..1000000))
filter_82 = StreamFilter(Gate=honeybee_model_ready_5, Stream0="Create a model before running the simulation", Stream1=" ")
hideshow_40 = HideShowElement(ElementToHideShow=button_14, Show=True, Collapse=True, Disable=invert(honeybee_model_ready_6))
tooltip_10 = AttachTooltipToElement(ElementsToAttachTo=button_14, TooltipContent=filter_76, ShowDelay=filter_75, Duration=2000)
hideshow_41 = HideShowElement(ElementToHideShow=button_16, Show=True, Collapse=True, Disable=invert(honeybee_model_ready_7))
tooltip_11 = AttachTooltipToElement(ElementsToAttachTo=button_16, TooltipContent=filter_78, ShowDelay=filter_77, Duration=2000)
hideshow_42 = HideShowElement(ElementToHideShow=button_18, Show=True, Collapse=True, Disable=invert(honeybee_model_ready_8))
tooltip_12 = AttachTooltipToElement(ElementsToAttachTo=button_18, TooltipContent=filter_80, ShowDelay=filter_79, Duration=2000)
hideshow_43 = HideShowElement(ElementToHideShow=button_19, Show=True, Collapse=True, Disable=invert(honeybee_model_ready_9))
tooltip_13 = AttachTooltipToElement(ElementsToAttachTo=button_19, TooltipContent=filter_82, ShowDelay=filter_81, Duration=2000)

# ---- group: Analyse performance (continued)
honeybee_rooms = Data(deconstructmodel.rooms)
data_40 = Data(deconstructmodel.shades)
data_41 = Data(honeybee_rooms)
honeybee_rooms_2 = Data(honeybee_rooms)
annualloads = HBAnnualLoads(rooms=flatten(data_41), shades=data_21, epw_file=data_23, run_bal=run_energy_balance, run=run_energy_balance)  # -> report, total_load, cooling, heating, lighting, equip, process, hot_water, balance; plug-in component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
panel_149 = Panel(annualloads.report)
peakloads = HBPeakLoads(rooms=honeybee_rooms_2, shades=shading_geometry, ddy_file=data_22, run_bal=run_peak_loads, run=run_peak_loads)  # -> report, peak_cool, peak_heat, cooling, heating, cool_bal, heat_bal; plug-in component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
panel_150 = Panel(peakloads.report)
annual_energy_balance_data = Data(peakloads.cooling)
annual_energy_balance_data_2 = Data(peakloads.cool_bal)
annual_energy_balance_data_3 = Data(peakloads.heating)
annual_energy_balance_data_4 = Data(peakloads.heat_bal)
simple_energy_simulations_report = RemoteSender(peakloads.report)
simple_energy_simulations_report_2 = RemoteSender(annualloads.report)
total_load_eui = Data(annualloads.total_load)
annual_energy_balance_data_5 = Data(annualloads.balance)
entwine_135 = Entwine(
    Branch00=total_load_eui,
    Branch01=annual_energy_balance_data_5,
    Branch02=annual_energy_balance_data,
    Branch03=annual_energy_balance_data_3,
    Branch04=annual_energy_balance_data_2,
    Branch05=annual_energy_balance_data_4,
    FlattenInputs=True)
freeze_gate_55 = StreamFreezeGate(Data=entwine_135, PassingSwitch=run_simple_energy_simulations_3, Hold=True)

# ----
rec_29 = DataRecorder(graft(freeze_gate_55), DataLimit=-10, RecordData=True)
item_40 = ListItem(List=rec_29, Index=current_selected_simulation_2, Wrap=True)
current_all_simulations = RemoteSender(rec_29)
current_all_simulations_2 = RemoteReceiver(current_all_simulations)
lng_44 = ListLength(List=current_all_simulations_2)  # -> flatten(Length)
item_41 = ListItem(List=lng_44, Index=0, Wrap=True)
series = Series(Start=0, Step=1, Count=item_41)
format_18 = Format(Format="Simulation {0}", Culture=127, Data0=series)
subtraction_7 = Subtraction(A=item_41, B="1")
setlist_12 = SetListContents(ListToModify=pulldown, NewListContents=format_18, SelectedIndex=subtraction_7)
current_all_simulations_3 = RemoteReceiver(current_all_simulations)
hasdata_16 = DataExists(Data=current_all_simulations_3)
hideshow_44 = HideShowElement(ElementToHideShow=pulldown, Show=hasdata_16, Collapse=True, Disable=False)
shfdep_2 = ShiftToDepth(Tree=item_40, Depth="2", shiftFromStart=False)
panel_151 = Panel(shfdep_2)

# ----
# Reports
simple_energy_simulations_report_3 = RemoteReceiver([simple_energy_simulations_report, simple_energy_simulations_report_2])

data_42 = Data(deconstructmodel.rooms)
honeybee_model = Data(data_42)
data_43 = Data(honeybee_model)

# ---- group: Simulate (continued)
modeltoosm = HBModelToOSM(
    model=honeybee_model,
    epw_file=downloadepw_3.epw_file,
    sim_par=simpar,
    write=run_energy_simulation,
    run=run_energy_simulation)  # -> report, jsons, osw, osm, idf, sql, zsz, rdd, html; plug-in component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
eui = HBEndUseIntensity(sql=modeltoosm.sql)  # -> eui, eui_end_use, end_uses, gross_floor; plug-in component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
panel_152 = Panel(eui.eui)
panel_153 = Panel(eui.end_uses)
panel_154 = Panel(eui.eui_end_use)

# ---- group: Peak loads (continued)
readhvac = HBReadHVACSizing(sql=modeltoosm.sql)  # -> zone_names, zone_peak_cool, zone_peak_heat, comp_types, comp_properties, comp_values; plug-in component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
readzsz = HBReadZoneSizing(zsz=modeltoosm.zsz)  # -> cooling_load, heating_load; plug-in component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
panel_155 = Panel([readhvac.zone_peak_heat, readhvac.zone_peak_cool])
monthlychart = LBMonthlyChart(data=readzsz.heating_load, x_dim=Slider(40, range=0..100), stack=toggle_7, time_marks=toggle_7)  # -> report, data_mesh, data_lines, col_lines, legend, borders, labels, y_title, title, vis_set; plug-in component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
monthlychart_2 = LBMonthlyChart(data=readzsz.cooling_load, x_dim=Slider(40, range=0..100), stack=toggle_8, time_marks=toggle_8)  # -> report, data_mesh, data_lines, col_lines, legend, borders, labels, y_title, title, vis_set; plug-in component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
heating_load_profile = Data(flatten([monthlychart.data_mesh, monthlychart.data_lines, monthlychart.col_lines, monthlychart.legend, monthlychart.borders, monthlychart.labels, monthlychart.y_title, monthlychart.title]))
cooling_load_profile = Data(flatten([monthlychart_2.data_mesh, monthlychart_2.data_lines, monthlychart_2.col_lines, monthlychart_2.legend, monthlychart_2.borders, monthlychart_2.labels, monthlychart_2.y_title, monthlychart_2.title]))
peak_cooling = Data(readhvac.zone_peak_cool)
zone_names = Data(readhvac.zone_names)
peak_heating = Data(readhvac.zone_peak_heat)

# ---- group: Load previous model (continued)
item_42 = ListItem(List=modeltoosm.jsons, Index=0, Wrap=True)
loadobjects = HBLoadObjects(hb_file=item_42, load=falsestart)  # -> report, hb_objs; plug-in component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

# ---- group: extract and visualise data
roomenergyresult = HBReadRoomEnergyResult(sql=modeltoosm.sql)  # -> cooling, heating, lighting, electric_equip, gas_equip, process, hot_water, fan_electric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; plug-in component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
merge_17 = Merge(
    Data1=roomenergyresult.heating,
    Data2=roomenergyresult.cooling,
    Data3=roomenergyresult.lighting,
    Data4=roomenergyresult.electric_equip,
    Data5=roomenergyresult.hot_water,
    Data6=roomenergyresult.people_gain,
    Data7=roomenergyresult.solar_gain)
hourlyplot = LBHourlyPlot(data=merge_17)  # -> report, mesh, legend, borders, labels, title, vis_set; plug-in component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
xdata = LBDeconstructData(data=roomenergyresult.cooling)  # -> header, values; plug-in component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

# ---- group: Energy balance (continued)
faceresult = HBReadFaceResult(sql=modeltoosm.sql)  # -> face_indoor_temp, face_outdoor_temp, face_energy_flow; plug-in component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
loadbalance = HBThermalLoadBalance(
    rooms_model=flatten(data_43),
    cooling=roomenergyresult.cooling,
    heating=roomenergyresult.heating,
    lighting=roomenergyresult.lighting,
    electric_equip=roomenergyresult.electric_equip,
    hot_water=roomenergyresult.hot_water,
    people_gain=roomenergyresult.people_gain,
    solar_gain=roomenergyresult.solar_gain,
    infiltration_load=roomenergyresult.infiltration_load,
    mech_vent_load=roomenergyresult.mech_vent_load,
    face_energy_flow=faceresult.face_energy_flow)  # -> report, balance, balance_stor, norm_bal, norm_bal_stor; plug-in component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
timeop = LBTimeIntervalOperation(data=loadbalance.norm_bal_stor)  # -> daily, monthly, mon_per_hr; plug-in component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
monthlychart_3 = LBMonthlyChart(data=timeop.monthly, stack=Toggle(True), legend_par=legendpar)  # -> report, data_mesh, data_lines, col_lines, legend, borders, labels, y_title, title, vis_set; plug-in component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

# ----
detailed_energy_simulations_report = RemoteSender(modeltoosm.report)
energy_use_intensity = Data(eui.eui)
energy_use_intensity_per_end_use = Data(eui.eui_end_use)
end_uses = Data(eui.end_uses)
monthly_energy_balance = Data(flatten([monthlychart_3.data_mesh, monthlychart_3.data_lines, monthlychart_3.col_lines, monthlychart_3.legend, monthlychart_3.borders, monthlychart_3.labels, monthlychart_3.y_title, monthlychart_3.title]))
annual_hourly_energy_results = Data(flatten([hourlyplot.mesh, hourlyplot.legend, hourlyplot.borders, hourlyplot.labels, hourlyplot.title]))
cooling_load_profile_2 = Data(cooling_load_profile)
monthly_energy_balance_2 = Data(monthly_energy_balance)
energy_use_intensity_2 = Data(energy_use_intensity)
peak_cooling_2 = Data(peak_cooling)
heating_load_profile_2 = Data(heating_load_profile)
energy_use_intensity_per_end_use_2 = Data(energy_use_intensity_per_end_use)
end_uses_2 = Data(end_uses)
peak_heating_2 = Data(peak_heating)
annual_hourly_energy_results_2 = Data(annual_hourly_energy_results)
peak_cooling_3 = Data(zone_names)
panel_156 = Panel(peak_cooling_2)
panel_157 = Panel(peak_heating_2)
panel_158 = Panel(energy_use_intensity_per_end_use_2)
panel_159 = Panel(energy_use_intensity_2)
panel_160 = Panel(end_uses_2)

detailed_energy_simulations_report_2 = RemoteReceiver(detailed_energy_simulations_report)

epw_file_url_4 = Data(deconstructmodel.rooms)

# ---- group: Glare analysis (continued)
assigngridsviews = HBAssignGridsAndViews(model=epw_file_url_4, views=flatten(viewport))  # -> model; plug-in component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
pitview = HBPointInTimeViewBased(model=assigngridsviews, sky=ciesky, run=run_glare_analysis)  # -> report, results; plug-in component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
glare = HBGlarePostprocess(hdr=pitview.results)  # -> DGP, category, glare_indices, check_hdr; plug-in component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
merge_18 = Merge(Data1=hoy.date, Data2=glare.category, Data3=glare.DGP)
daylight_glare_probability_dgp = Data(glare.DGP)
join_10 = TextJoin(Text=merge_18)
adjusthdr = HBAdjustHDR(adj_expos=Toggle(True), label=join_10)  # -> hdr; plug-in component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
hdr_image = Data(adjusthdr)

# ----
glare_report = RemoteSender(pitview.report)
hdr_image_2 = Data(pitview.results)
hdr_false_color_image_2 = Data(pitview.results)
num_5 = Number(daylight_glare_probability_dgp)

data_44 = Data(num_5)
data_45 = Data(hdr_image)
entwine_136 = Entwine(Branch00=data_44, FlattenInputs=True)
freeze_gate_56 = StreamFreezeGate(Data=entwine_136, PassingSwitch=calculate_glare_probability_3, Hold=True)
bang_16 = ExplodeTree(Data=freeze_gate_56)  # -> Branch0, Branch1, Branch2
hasdata_17 = DataExists(Data=bang_16.Branch0)
data_46 = Data(bang_16.Branch0)
and_35 = GateAnd(A=invert(lng_34), B=hasdata_17)
glare_daylight_probability = RemoteSender(data_46)
glare_data_exists = RemoteSender(and_35)

glare_report_2 = RemoteReceiver(glare_report)

# ---- group: Analysis module (continued)
glare_daylight_probability_2 = RemoteReceiver(glare_daylight_probability)
expression_80 = Expression(x=glare_daylight_probability_2, Expression="Round(x, 2)")
glare_data_exists_2 = RemoteReceiver(glare_data_exists)
format_19 = Format(Format=panel_38, Culture=127, Data0=expression_80)
or_33 = GateOr(A=glare_data_exists_2, B=filter_7)
rec_30 = DataRecorder(or_33, DataLimit=-10, RecordData=True)
settextblock_13 = SetTextBlockContents(TextBlockToModify=tb_12, NewTextBlockContents=format_19)
ma_20 = MassAddition(Input=flatten(rec_30))  # -> Result, PartialResults
glare_data_exists_3 = RemoteReceiver(glare_data_exists)
mod = Modulus(A=ma_20.Result, B=Slider(2, range=0..10))
bool_55 = Boolean(mod)
hideshow_45 = HideShowElement(ElementToHideShow=tb_12, Show=glare_data_exists_3, Collapse=True, Disable=False)
glare_data_exists_4 = RemoteReceiver(glare_data_exists)
filter_83 = StreamFilter(Gate=bool_55, Stream0="Simulation failed...", Stream1="Daylight simulation is running...")
gate_60 = StreamGate(Stream=filter_83, Gate=freeze_gate_11)  # -> Target0, Target1
settextblock_14 = SetTextBlockContents(TextBlockToModify=tb_11, NewTextBlockContents=gate_60.Target1)
bool_56 = Boolean(invert(glare_data_exists_4))
hideshow_46 = HideShowElement(ElementToHideShow=tb_11, Show=bool_56, Collapse=glare_data_exists_4, Disable=False)

# ----
data_47 = Data(deconstructmodel.rooms)
calculate_honeybee_model = BrimstoneCalculateEmbodiedCarbonOfHoneybeeModel(hb_model=data_47, kdb_json_data=get_categories.json_data)  # -> tot_emb_carbon, elements, el_emb_carbon
# ---------- calculate_honeybee_model: Python ----------
"""
Calculates embodied carbon for the elements of a Honeybee model if data is available
This component was inspired by the 'HB Color Face Attributes' component of Ladybug Tools 1.6.0

    Args:
        hb_model: Honeybee model for analysis
        kdb_json_data: Optional json data object for materials which do not include impact data

    Returns:
        tot_emb_carbon: total embodied carbon of model
        elements: element types in the model
        el_emb_carbon: embodied carbon for each element type in the model
"""

import scriptcontext
import brimstone
ghenv.Component.Message = brimstone.globals.version
import Grasshopper
import os
import csv, codecs

ghenv.Component.Name = 'Brimstone - Calculate Embodied Carbon of Honeybee Model'
ghenv.Component.NickName = 'Calculate Honeybee Model'

try:  # import the core honeybee dependencies
    from honeybee_energy.construction.windowshade import WindowConstructionShade
    from honeybee.model import Model
    from honeybee.properties import FaceProperties
    from honeybee.typing import clean_ep_string
except ImportError as e:
    raise ImportError('\nFailed to import honeybee:\n\t{}'.format(e))
    

# todo: magic string here - not good!
gwp_data_string = "Global Warming potential"
gwp_data_points = [
    "A1-A3 Conservative",
    "A4",
    "A5.1",
]

def main(hb_model):
    tot_emb_carbon = 0
    elements = []
    el_emb_carbon = []
    if not isinstance(hb_model, Model):
        raise Exception("hb_model input must be a valid honeybee model")
    faces = []
    apertures = []
    model_mats = []
    face_types = {}
    
    energy_properties = hb_model.properties.energy
    
    for material in energy_properties.materials:
        model_mats.append(material)
    for room in hb_model.rooms:
        faces.extend(room.faces)
        faces.extend(room.shades)
    faces.extend(hb_model.orphaned_faces)
    faces.extend(hb_model.orphaned_apertures)
    faces.extend(hb_model.orphaned_doors)
    faces.extend(hb_model.orphaned_shades)
    
    for face_obj in faces:
        if isinstance(face_obj.properties, FaceProperties):
            face_area = face_obj.area - face_obj.aperture_area
            face_type = face_obj.type
            
            face_impact = 0
            for lyr in face_obj.properties.energy.construction.layers:
                face_impact += get_face_impact(model_mats, lyr, face_area)
                """
                if lyr not in model_mats:
                    model_mats[lyr] = { area: face_area }
                else:
                    model_mats[lyr].area = model_mats[lyr].area + face_area
                """
                       
            if face_type not in face_types:
                face_types[face_type] = { "impact": face_impact }
            else:
                face_types[face_type]["impact"] += face_impact
                
            
            for aperture in face_obj.apertures:
                aperture_impact = get_aperture_impact(aperture)
                if "Aperture" not in face_types:
                    face_types["Aperture"] = { "impact": aperture_impact }
                else:
                    face_types["Aperture"]["impact"] += aperture_impact
    for face_type in face_types.items():
        face_impact = face_type[1]["impact"]
        tot_emb_carbon += face_impact
        elements.append(face_type[0])
        el_emb_carbon.append(face_impact)
    return tot_emb_carbon, elements, el_emb_carbon

def get_face_impact(materials, layer_name, face_area):
    for material in materials:
        if material.identifier == layer_name:
            abs_impact = 0
            gwp_data_keys = ["gwp_a1_a3", "gwp_a4", "gwp_a5_1"]
            if material.user_data and all(key in material.user_data.keys() for key in gwp_data_keys):
                impact = sum(float(material.user_data[key]) for key in gwp_data_keys)
                abs_impact = material.density*impact
            else:
                abs_impact = get_face_impact_from_material_name(material.identifier)
            return material.thickness*abs_impact*face_area
    brimstone.utils.warn(ghenv, "The calculation may be faulty as material " + layer_name + " was not found among the energy materials in the model.")
    return 0

# Gets material impact data from a honeybee material by referencing names in .csv file
def get_face_impact_from_material_name(material_name):
    csv_data_file = brimstone.globals.hb_kdb_csv_path
    csv_data_file_path = os.path.join(Grasshopper.Folders.UserObjectFolders[0], csv_data_file)
    if not os.path.exists(csv_data_file_path):
        raise Exception("Failed to open csv file, it should reside in [UserComponents folder]/brimstone_data/")
    kdb_name = check_name_in_kdb(material_name)
    if not kdb_name:
        with open(csv_data_file_path, 'r') as csv_file:
            file_reader = csv.DictReader(csv_file, delimiter=",")
            for row in file_reader:
                if row["HB Name"] == material_name:
                    kdb_name = clean_ep_string(row["Klimatdatabas name"])
                    if not kdb_name or kdb_name == "missing":
                        brimstone.utils.warn(ghenv, "The calculation may be faulty as impact data is missing for some of the materials in the model: " + material_name)
                        return 0
                    break
    if not kdb_name:
        brimstone.utils.warn(ghenv, "The calculation may be faulty as material " + material_name + " could not be matched to any material in the brimstone material database.")
        return 0
    
    return get_impact_from_json_data(kdb_name)

def check_name_in_kdb(material_name):
    if not kdb_json_data:
        brimstone.utils.warn(ghenv, "The calculation may be faulty as kdb_json_data is missing")
    else: 
        for resource in kdb_json_data["Resources"]:
            if clean_ep_string(resource["Name"]) == material_name:
                return material_name
    return ""
    
# TODO: currently only works for KDB windows
def get_aperture_impact(aperture):
    c = aperture.properties.energy.construction
    c = c.window_construction if type(c) == WindowConstructionShade else c
    if hasattr(c.user_data, "conv_value"):
        
        return (float(c.user_data.gwp_a1_a3) + float(c.user_data.gwp_a4))\
            * float(c.user_data.conv_value) * aperture.area
    if not len(c.layers) == 1:
        brimstone.utils.warn(ghenv, "The calculation may be faulty as only one layer window constructions can be calculated.")
        return 0
    
    window_material = c.layers[0]
    return get_impact_from_json_data(window_material)*aperture.area

def get_impact_from_json_data(kdb_name):
    if not kdb_json_data:
        brimstone.utils.warn(ghenv, "The calculation may be faulty as kdb_json_data is missing")
        return 0
    for resource in kdb_json_data["Resources"]:
        if clean_ep_string(resource["Name"]) == kdb_name:
            conv = resource["Conversions"][0]["Value"]
            
            for data_item in resource["DataItems"]:
                if data_item["PropertyName"] == gwp_data_string:
                    abs_impact = 0
                    for data_pt in gwp_data_points:
                        for data_val_item in data_item["DataValueItems"]:
                            if data_val_item["DataModuleCode"] == data_pt:
                                abs_impact += data_val_item["Value"]
                    return abs_impact*conv
            brimstone.utils.warn(ghenv, "The calculation may be faulty as material " + kdb_name + " has no GWP data in kdb_json_data")
            return 0
    brimstone.utils.warn(ghenv, "The calculation may be faulty as material " + kdb_name + " was not found in kdb_json_data")
    return 0

if __name__ == "__main__":
    try:
        flying = scriptcontext.sticky["brimstone_flying"]
    except:
        raise Exception("The 'Brimstone - Fly' component needs to exist on the canvas")
    tot_emb_carbon, elements, el_emb_carbon = main(hb_model)
# ---------- end calculate_honeybee_model ----------
element_types_2 = Data(calculate_honeybee_model.elements)
total_gwp = Data(calculate_honeybee_model.tot_emb_carbon)
gwp_by_element_type_2 = Data(calculate_honeybee_model.el_emb_carbon)
connected = GetConnectedObjects(Objects=calculate_honeybee_model.tot_emb_carbon)
panel_161 = Panel(element_types_2)
panel_162 = Panel(gwp_by_element_type_2)
panel_163 = Panel(total_gwp)
area_m2 = Data(geoprop.floor_area)

ma_21 = MassAddition(Input=gwp_by_element_type_2)  # -> Result, PartialResults
total_gwp_2 = Data(ma_21.Result)
lca_gwp_by_element_type = RemoteSender(gwp_by_element_type_2)
lca_total_gwp = RemoteSender(total_gwp_2)

lca_gwp_by_element_type_2 = RemoteReceiver(lca_gwp_by_element_type)
num_6 = Number(lca_gwp_by_element_type_2)
expression_81 = Expression(x=num_6, Expression="Round(x, 2)")
py3_53 = Python3Script(
    file_location=nextfile,
    y_label="GWP (kg CO2eq)",
    title="GWP by element type (kg CO2eq)",
    labels=lca_element_types_2,
    values=expression_81,
    colors=fragment)  # -> out, file_location_out; inputs labels: list, values: list, colors: list
# ---------- py3_53: Python ----------
# requirements: matplotlib
# requirements: numpy

import matplotlib.pyplot as plt
import numpy as np

fig, ax = plt.subplots()

for i in range(len(colors)):
    colors[i] = colors[i].split(',')
    colors[i] = tuple([float(j) for j in colors[i]])

fig, ax = plt.subplots(figsize=(14, 6))
ax.bar(labels, values, label=labels, color=colors, align="center")
bottom = 0
for i in range(len(labels)):
    ax.bar('total GWP', values[i], color=colors[i], bottom=bottom, align='center')
    bottom += values[i]

ax.set_ylim(0, sum(values)*1.1)
ax.set_ylabel(y_label)
ax.set_title(title)

plt.subplots_adjust(right=0.8)

ax.legend(title=title, bbox_to_anchor=(1.0, 1), loc='upper left', reverse=True)

plt.savefig(file_location)
file_location_out = file_location

#plt.show()
# ---------- end py3_53 ----------
setimg = SetImage(ImageToModify=image, NewImagePath=py3_53.file_location_out)

gate_61 = StreamGate(Stream=connected, Gate=bool_54)  # -> Target0, Target1
hold_11 = HoldingGate(Data=gate_61.Target1)
lca_total_gfa = RemoteSender(area_m2)

# ---- group: Analysis module (continued)
lca_total_gwp_2 = RemoteReceiver(lca_total_gwp)
lca_total_gfa_2 = RemoteReceiver(lca_total_gfa)
lca_total_gwp_3 = RemoteReceiver(lca_total_gwp)
lca_total_gwp_4 = RemoteReceiver(lca_total_gwp)
division_4 = Division(A=lca_total_gwp_2, B=lca_total_gfa_2)
expression_82 = Expression(x=division_4, Expression="Round(x, 2)")
expression_83 = Expression(x=lca_total_gwp_4, Expression="Round(x, 2)")
expression_84 = Expression(x=lca_total_gwp_3, Expression="Round(x, 2)")
format_20 = Format(Format=panel_41, Culture=127, Data0=expression_82)
format_21 = Format(Format=panel_43, Culture=127, Data0=expression_83)
format_22 = Format(Format=panel_42, Culture=127, Data0=expression_84)
setlabel_5 = SetLabelContents(LabelToModify=label_23, NewLabelContents=format_20)
setlabel_6 = SetLabelContents(LabelToModify=label_24, NewLabelContents=format_21)
setlabel_7 = SetLabelContents(LabelToModify=label_25, NewLabelContents=format_22)

# ----
honeybee_model_2 = Data(deconstructmodel.rooms)
deconstructmodel_2 = HBDeconstructModel(model=honeybee_model_2)  # -> rooms, faces, apertures, doors, shades; plug-in component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
decnstrobj = HBDeconstructObject(hb_obj=deconstructmodel_2.rooms)  # -> faces, apertures, doors, shades; plug-in component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
vizquick = HBVisualizeQuick(hb_objs=decnstrobj.faces)  # -> geo; plug-in component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
area = Area(Geometry=vizquick)  # -> Area, Centroid
pdecon_3 = Deconstruct(Point=area.Centroid)  # -> XComponent, YComponent, ZComponent
sort = SortList(Keys=pdecon_3.ZComponent, ValuesA=vizquick)  # -> Keys, ValuesA
honeybee_model_3 = Data(honeybee_model_2)

# ---- group: Set up sensor grids
srf = Surface(sort.ValuesA)
item_43 = ListItem(List=srf, Index=Slider(0, range=0..5), Wrap=True)
flip = Flip(Surface=item_43)  # -> Surface, Result
genpts = LBGeneratePointGrid(geometry=flip.Surface, grid_size=Slider(1, range=0..5), offset_dist=Slider(0.7, range=0..5))  # -> points, vectors, face_areas, mesh; plug-in component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
gridrooms = HBSensorGridFromRooms(rooms=honeybee_model_3, grid_size=grid_size, dist_floor=Slider(0.7, range=0..5))  # -> grid, points, mesh; plug-in component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
sensorgrid = HBSensorGrid(positions=genpts.points, directions=genpts.vectors, mesh=genpts.mesh)  # -> grid; plug-in component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
assigngridsviews_2 = HBAssignGridsAndViews(model=honeybee_model_3, grids=flatten(gridrooms.grid))  # -> model; plug-in component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

# ----
msgs_6 = GetRuntimeMessages(Objects=hold_11)  # -> Errors, Warnings
lca_errors = RemoteSender(msgs_6.Errors)
lca_warnings = RemoteSender(msgs_6.Warnings)

lca_errors_2 = RemoteReceiver(lca_errors)
lng_45 = ListLength(List=lca_errors_2)

lca_warnings_2 = RemoteReceiver(lca_warnings)
lca_errors_3 = RemoteReceiver(lca_errors)

# ---- group: Analysis module (continued)
lca_warnings_3 = RemoteReceiver(lca_warnings)
lca_errors_4 = RemoteReceiver(lca_errors)
lng_46 = ListLength(List=lca_errors_4)
lng_47 = ListLength(List=lca_warnings_3)
ma_22 = MassAddition(Input=[lng_46, lng_47])  # -> Result, PartialResults
bool_57 = Boolean(ma_22.Result)
hasdata_18 = DataExists(Data=bool_57)
filter_84 = StreamFilter(Gate=hasdata_18, Stream0="False", Stream1=bool_57)
filter_85 = StreamFilter(Gate=lng_46, Stream0="Warning", Stream1="Error")
filter_86 = StreamFilter(Gate=lng_46, Stream0=ColourSwatch(SwatchColor=RGB(237, 185, 94)), Stream1=ColourSwatch(SwatchColor=RGB(226, 54, 54)))
adjustelem_22 = AdjustElementAppearance(ElementsToAdjust=tb_10, Foreground=filter_86)
settextblock_15 = SetTextBlockContents(TextBlockToModify=tb_10, NewTextBlockContents=filter_85)
hideshow_47 = HideShowElement(ElementToHideShow=tb_10, Show=filter_84, Collapse=True, Disable=False)

# ----
lca_gwp_by_element_type_3 = RemoteReceiver(lca_gwp_by_element_type)
lca_total_gwp_5 = RemoteReceiver(lca_total_gwp)
honeybee_model_exists_6 = RemoteReceiver(honeybee_model_exists)

# ---- group: Analyse performance (continued)
bang_17 = ExplodeTree(Data=shfdep_2)  # -> Branch0, Branch1, Branch2, Branch3, Branch4, Branch5

xdata_2 = LBDeconstructData(data=bang_17.Branch2)  # -> header, values; plug-in component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
xdata_3 = LBDeconstructData(data=bang_17.Branch1)  # -> header, values; plug-in component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
xdata_4 = LBDeconstructData(data=bang_17.Branch3)  # -> header, values; plug-in component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
xdata_5 = LBDeconstructData(data=bang_17.Branch4)  # -> header, values; plug-in component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
xdata_6 = LBDeconstructData(data=bang_17.Branch5)  # -> header, values; plug-in component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
smaller_2 = SmallerThan(FirstNumber=xdata_4.values, SecondNumber="0")  # -> SmallerThan, OrEqualTo
smaller_3 = SmallerThan(FirstNumber=xdata_2.values, SecondNumber="0")  # -> SmallerThan, OrEqualTo
smaller_4 = SmallerThan(FirstNumber=xdata_3.values, SecondNumber="0")  # -> SmallerThan, OrEqualTo
smaller_5 = SmallerThan(FirstNumber=xdata_5.values, SecondNumber="0")  # -> SmallerThan, OrEqualTo
smaller_6 = SmallerThan(FirstNumber=xdata_6.values, SecondNumber="0")  # -> SmallerThan, OrEqualTo
sift_2 = SiftPattern(List=xdata_4.values, SiftPattern=smaller_2.OrEqualTo)  # -> Output0, Output1
sift_3 = SiftPattern(List=xdata_3.values, SiftPattern=smaller_4.OrEqualTo)  # -> Output0, Output1
sift_4 = SiftPattern(List=xdata_2.values, SiftPattern=smaller_3.OrEqualTo)  # -> Output0, Output1
sift_5 = SiftPattern(List=xdata_5.values, SiftPattern=smaller_5.OrEqualTo)  # -> Output0, Output1
sift_6 = SiftPattern(List=xdata_6.values, SiftPattern=smaller_6.OrEqualTo)  # -> Output0, Output1
flip_2 = FlipMatrix(Data=sift_4.Output0)
flip_3 = FlipMatrix(Data=sift_4.Output1)
flip_4 = FlipMatrix(Data=sift_2.Output0)
flip_5 = FlipMatrix(Data=sift_2.Output1)
flip_6 = FlipMatrix(Data=sift_6.Output0)
flip_7 = FlipMatrix(Data=sift_6.Output1)
flip_8 = FlipMatrix(Data=sift_3.Output0)
flip_9 = FlipMatrix(Data=sift_3.Output1)
flip_10 = FlipMatrix(Data=sift_5.Output0)
flip_11 = FlipMatrix(Data=sift_5.Output1)
ma_23 = MassAddition(Input=flip_3)  # -> Result, PartialResults
ma_24 = MassAddition(Input=flip_5)  # -> Result, PartialResults
ma_25 = MassAddition(Input=flip_2)  # -> Result, PartialResults
ma_26 = MassAddition(Input=flip_7)  # -> Result, PartialResults
ma_27 = MassAddition(Input=flip_9)  # -> Result, PartialResults
ma_28 = MassAddition(Input=flip_4)  # -> Result, PartialResults
ma_29 = MassAddition(Input=flip_11)  # -> Result, PartialResults
ma_30 = MassAddition(Input=flip_6)  # -> Result, PartialResults
ma_31 = MassAddition(Input=flip_8)  # -> Result, PartialResults
ma_32 = MassAddition(Input=flip_10)  # -> Result, PartialResults
extremes = MinMax(Number=flatten(ma_25.Result))  # -> Minimum, Maximum
extremes_2 = MinMax(Number=flatten(ma_23.Result))  # -> Minimum, Maximum
extremes_3 = MinMax(Number=flatten(ma_28.Result))  # -> Minimum, Maximum
extremes_4 = MinMax(Number=flatten(ma_24.Result))  # -> Minimum, Maximum
extremes_5 = MinMax(Number=flatten(ma_30.Result))  # -> Minimum, Maximum
extremes_6 = MinMax(Number=flatten(ma_31.Result))  # -> Minimum, Maximum
extremes_7 = MinMax(Number=flatten(ma_26.Result))  # -> Minimum, Maximum
extremes_8 = MinMax(Number=flatten(ma_27.Result))  # -> Minimum, Maximum
extremes_9 = MinMax(Number=flatten(ma_32.Result))  # -> Minimum, Maximum
extremes_10 = MinMax(Number=flatten(ma_29.Result))  # -> Minimum, Maximum
cooling_balance_min = RemoteSender(extremes_10.Minimum)
heating_balance_min = RemoteSender(extremes_7.Minimum)
daily_heating_profile_min = RemoteSender(extremes_4.Minimum)
cooling_balance_max = RemoteSender(extremes_9.Maximum)
daily_cooling_profile_max = RemoteSender(extremes.Maximum)
daily_cooling_profile_min = RemoteSender(extremes_2.Minimum)
heating_balance_max = RemoteSender(extremes_5.Maximum)
annual_energy_balance_max = RemoteSender(extremes_6.Maximum)
annual_energy_balance_min = RemoteSender(extremes_8.Minimum)
daily_heating_profile_max = RemoteSender(extremes_3.Maximum)

# ----
# Detailed data from energy simulation
data_48 = Data(flatten(bang_17.Branch1))

# ---- group: Analyse performance (continued)
daily_heating_profile_max_2 = RemoteReceiver(daily_heating_profile_max)
daily_heating_profile_min_2 = RemoteReceiver(daily_heating_profile_min)
daily_cooling_profile_max_2 = RemoteReceiver(daily_cooling_profile_max)
daily_cooling_profile_min_2 = RemoteReceiver(daily_cooling_profile_min)
heating_balance_max_2 = RemoteReceiver(heating_balance_max)
heating_balance_min_2 = RemoteReceiver(heating_balance_min)
cooling_balance_max_2 = RemoteReceiver(cooling_balance_max)
cooling_balance_min_2 = RemoteReceiver(cooling_balance_min)
annual_energy_balance_max_2 = RemoteReceiver(annual_energy_balance_max)
annual_energy_balance_min_2 = RemoteReceiver(annual_energy_balance_min)
cluster_10 = Cluster_4(int=heating_balance_max_2)
cluster_11 = Cluster_5(x=daily_cooling_profile_min_2)
cluster_12 = Cluster_4(int=daily_cooling_profile_max_2)
cluster_13 = Cluster_4(int=cooling_balance_max_2)
cluster_14 = Cluster_5(x=heating_balance_min_2)
cluster_15 = Cluster_5(x=cooling_balance_min_2)
cluster_16 = Cluster_5(x=daily_heating_profile_min_2)
cluster_17 = Cluster_4(int=daily_heating_profile_max_2)
legendpar_4 = LBLegendParameters(min=cluster_14, max=cluster_10)  # -> leg_par; plug-in component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
cluster_18 = Cluster_3(min=cluster_15, max=cluster_13, colors=colrange_2)
cluster_19 = Cluster_3(min=cluster_16, max=cluster_17, colors=colrange_3)
cluster_20 = Cluster_5(x=annual_energy_balance_min_2)
cluster_21 = Cluster_4(int=annual_energy_balance_max_2)

# ---- group: Analyse performance / Simple peak loads (continued)
legendpar_5 = LBLegendParameters(min=cluster_11, max=cluster_12)  # -> leg_par; plug-in component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
monthlychart_4 = LBMonthlyChart(
    data=bang_17.Branch4,
    base_pt=simple_energy_simulation_base_point_4,
    x_dim=simple_energy_simulation_width_4,
    y_dim=simple_energy_simulation_height_4,
    stack=toggle_9,
    time_marks=toggle_9,
    legend_par=cluster_19)  # -> report, data_mesh, data_lines, col_lines, legend, borders, labels, y_title, title, vis_set; plug-in component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
monthlychart_5 = LBMonthlyChart(
    data=bang_17.Branch2,
    base_pt=simple_energy_simulation_base_point_3,
    x_dim=simple_energy_simulation_width_3,
    y_dim=simple_energy_simulation_height_3,
    stack=toggle_10,
    time_marks=toggle_10,
    legend_par=legendpar_5)  # -> report, data_mesh, data_lines, col_lines, legend, borders, labels, y_title, title, vis_set; plug-in component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
monthlychart_6 = LBMonthlyChart(
    data=bang_17.Branch4,
    base_pt=simple_energy_simulation_base_point_5,
    x_dim=simple_energy_simulation_width_5,
    y_dim=simple_energy_simulation_height_5,
    stack=toggle_11,
    time_marks=toggle_11,
    legend_par=cluster_18)  # -> report, data_mesh, data_lines, col_lines, legend, borders, labels, y_title, title, vis_set; plug-in component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
monthlychart_7 = LBMonthlyChart(
    data=bang_17.Branch5,
    base_pt=simple_energy_simulation_base_point_6,
    x_dim=simple_energy_simulation_width_6,
    y_dim=simple_energy_simulation_height_6,
    stack=toggle_12,
    time_marks=toggle_12,
    legend_par=legendpar_4)  # -> report, data_mesh, data_lines, col_lines, legend, borders, labels, y_title, title, vis_set; plug-in component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
daily_heating_profile = Data(flatten([monthlychart_4.data_mesh, monthlychart_4.data_lines, monthlychart_4.col_lines, monthlychart_4.legend, monthlychart_4.borders, monthlychart_4.labels, monthlychart_4.y_title, monthlychart_4.title]))
daily_cooling_profile = Data(flatten([monthlychart_5.data_mesh, monthlychart_5.data_lines, monthlychart_5.col_lines, monthlychart_5.legend, monthlychart_5.borders, monthlychart_5.labels, monthlychart_5.y_title, monthlychart_5.title]))
heating_balance_design_day = Data(flatten([monthlychart_7.data_mesh, monthlychart_7.data_lines, monthlychart_7.col_lines, monthlychart_7.legend, monthlychart_7.borders, monthlychart_7.labels, monthlychart_7.y_title, monthlychart_7.title]))
cooling_balance_design_day = Data(flatten([monthlychart_6.data_mesh, monthlychart_6.data_lines, monthlychart_6.col_lines, monthlychart_6.legend, monthlychart_6.borders, monthlychart_6.y_title, monthlychart_6.labels, monthlychart_6.title]))

# ---- group: Analyse performance / Simple energy balance (continued)
legendpar_6 = LBLegendParameters(min=cluster_20, max=cluster_21, colors=colrange_4)  # -> leg_par; plug-in component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
monthlychart_8 = LBMonthlyChart(
    data=bang_17.Branch1,
    base_pt=simple_energy_simulation_base_point_2,
    x_dim=simple_energy_simulation_width_2,
    y_dim=simple_energy_simulation_height_2,
    stack=Toggle(True),
    legend_par=legendpar_6)  # -> report, data_mesh, data_lines, col_lines, legend, borders, labels, y_title, title, vis_set; plug-in component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

# ---- group: Analyse performance (continued)
panel_164 = Panel(legendpar_6)
annual_energy_balance = Data(flatten([monthlychart_8.data_mesh, monthlychart_8.data_lines, monthlychart_8.col_lines, monthlychart_8.legend, monthlychart_8.borders, monthlychart_8.labels, monthlychart_8.y_title, monthlychart_8.title]))

# ----
grid_mesh = Data(gridrooms.mesh)
honeybee_model_4 = Data(assigngridsviews_2)
honeybee_model_5 = Data(honeybee_model_4)

# ---- group: Daylight Factor (continued)
daylightfactor = HBDaylightFactor(model=honeybee_model_5, radiance_par=radpar, run=run_daylight_factor)  # -> report, results; plug-in component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
median = GhPythonScript(list=daylightfactor.results)  # -> out, median; inputs list: list
# ---------- median: Python ----------
"""Provides a scripting component.
    Inputs:
        list: list of numeric values to retrieve median
    Output:
        median: median value in list

__author__ = "sawen"
__version__ = "2024.06.14"
"""

import statistics

def main(list):
    return statistics.median(list)

if __name__ == "__main__":
    if list:
        median = main(list)
# ---------- end median ----------
heatmap = LBSpatialHeatmap(values=flatten(daylightfactor.results), legend_par=cluster_6, legend_title="Daylight Factor [%]")  # -> mesh, legend, title, colors, legend_par, vis_set; plug-in component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
daylight_factor = Data(flatten([heatmap.mesh, heatmap.legend, heatmap.title]))

# ---- group: Simulate illuminance (continued)
mjoin = MeshJoin(Meshes=grid_mesh)
pitgrid = HBPointInTimeGridBased(model=honeybee_model_4, sky=ciesky_2, radiance_par=radpar_3, run=run_illuminance)  # -> report, flatten(results); plug-in component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
daylight_report = RemoteSender(pitgrid.report)
heatmap_2 = LBSpatialHeatmap(values=pitgrid.results, mesh=mjoin, legend_par=legendpar_2, legend_title="Lux", global_title="Illuminance")  # -> mesh, legend, title, colors, legend_par, vis_set; plug-in component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

# ----
daylight_report_2 = RemoteReceiver(daylight_report)

# ---- group: Spatial climate based daylight (continued)
annualdaylight = HBAnnualDaylight(
    model=honeybee_model_5,
    wea=wea,
    schedule="Generic Office Occupancy",
    radiance_par=radpar_2,
    run=run_annual_daylight_simulation)  # -> report, results, DA, cDA, UDI, UDI_low, UDI_up; plug-in component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
analysis_mesh = Mesh(grid_mesh)
mjoin_2 = MeshJoin(Meshes=analysis_mesh)
heatmap_3 = LBSpatialHeatmap(values=flatten(annualdaylight.UDI_up), mesh=mjoin_2, legend_par=cluster_8, legend_title="UDI >3000 [%]")  # -> mesh, legend, title, colors, legend_par, vis_set; plug-in component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
heatmap_4 = LBSpatialHeatmap(values=flatten(annualdaylight.UDI_low), mesh=mjoin_2, legend_par=cluster_7, legend_title="UDI <50 [%]")  # -> mesh, legend, title, colors, legend_par, vis_set; plug-in component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
heatmap_5 = LBSpatialHeatmap(values=flatten(annualdaylight.UDI), mesh=mjoin_2, legend_par=cluster_9, legend_title="UDI [%]")  # -> mesh, legend, title, colors, legend_par, vis_set; plug-in component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
sda = HBSpatialDaylightAutonomy(DA=flatten(annualdaylight.DA), mesh=mjoin_2)  # -> report, sDA, pass_fail; plug-in component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
heatmap_6 = LBSpatialHeatmap(values=flatten(annualdaylight.DA), mesh=mjoin_2, legend_par=cluster_5, legend_title="Daylight autonomy [%]")  # -> mesh, legend, title, colors, legend_par, vis_set; plug-in component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
panel_165 = Panel(sda.sDA)

# ---- group: Extract hourly data from annual results (continued)
facen = FaceNormals(Mesh=mjoin_2)  # -> Centers, Normals
pt_20 = Point(facen.Centers)
flatten = FlattenTree(Tree=pt_20, Path="{0}")
item_44 = ListItem(List=flatten, Index=Slider(581, range=0..1000), Wrap=True)
annualtodata = HBAnnualResultsToData(results=flatten(annualdaylight.results), sel_pts=flatten(item_44), all_pts=pt_20)  # -> report, data; plug-in component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
sph = Sphere(Base=item_44, Radius=Slider(1.2, range=0..5))

# ----
daily_cooling_profile_2 = Data(flatten(annual_energy_balance))
daily_cooling_profile_3 = Data(flatten(daily_cooling_profile))
daily_cooling_profile_4 = Data(flatten(daily_heating_profile))
daily_cooling_profile_5 = Data(flatten(cooling_balance_design_day))
daily_cooling_profile_6 = Data(flatten(heating_balance_design_day))
data_49 = Data(flatten(bang_17.Branch0))
filter_87 = StreamFilter(
    Gate=simple_energy_simulation_type_2,
    Stream0=daily_cooling_profile_2,
    Stream1=daily_cooling_profile_3,
    Stream2=daily_cooling_profile_4,
    Stream3=daily_cooling_profile_5,
    Stream4=daily_cooling_profile_6)
ma_33 = MassAddition(Input=data_49)  # -> Result, PartialResults
total_load_eui_2 = RemoteSender(data_49)
bool_58 = Boolean(ma_33.Result)
null_32 = NullItem(Item=bool_58)  # -> NullFlags, InvalidFlags, Description
sortbytype_2 = SortObjectsByType(RhinoObjects=filter_87)  # -> Points, Curves, Surfaces, Breps, Meshes, TextObjects, HatchObjects, LightObjects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
filter_88 = StreamFilter(Gate=null_32.NullFlags, Stream0=bool_58, Stream1="False")
line_2 = Line(sortbytype_2.Curves)
null_33 = NullItem(Item=line_2)  # -> NullFlags, InvalidFlags, Description
data_50 = Data([sortbytype_2.Other, sortbytype_2.Meshes])
bbox_2 = BoundingBox(Content=sortbytype_2.Meshes, Plane=PlaneXY(0, 0, 0), UnionBox=True)  # -> Box, Box_2
sift_7 = SiftPattern(List=sortbytype_2.Curves, SiftPattern=null_33.NullFlags)  # -> Output0, Output1

total_load_eui_3 = RemoteReceiver(total_load_eui_2)
and_36 = GateAnd(A=invert(or_31), B=filter_88)

# ---- group: Analysis module (continued)
total_load_eui_4 = RemoteReceiver(total_load_eui_2)
ma_34 = MassAddition(Input=total_load_eui_4)  # -> Result, PartialResults
expression_85 = Expression(x=ma_34.Result, Expression="Round(x, 1)")
format_23 = Format(Format=panel_40, Culture=127, Data0=expression_85)
settextblock_16 = SetTextBlockContents(TextBlockToModify=tb_9, NewTextBlockContents=format_23)

# ----
energy_use_intensity_kwh_m2 = Data(total_load_eui_3)

calculate_operational_emissions = BrimstoneCalculateOperationalEmissions(lca_data=get_lca_data.lca_data, eui=energy_use_intensity_kwh_m2, area=area_m2, mode=list_12)  # -> out, gwp_total; inputs lca_data: tree
# ---------- calculate_operational_emissions: Python ----------
"""Calculates operational emissions based on energy resource, EUI and floor area
    Inputs:
        lca_data: tree containing GWP information for the selected resource
        eui: energy use intensity of building in kWh/m2
        gfa: gross floor area of building
        mode: mode of GWP calculation ("typical" or "conservative")
        
    Output:
        gwp_total: total GWP for the selected space"""

import scriptcontext
import brimstone
reload(brimstone)
ghenv.Component.Message = brimstone.globals.version

ghenv.Component.Name = 'Brimstone - Calculate Operational Emissions'
ghenv.Component.NickName = 'Calculate Operational Emissions'

import rhinoscriptsyntax as rs
import ghpythonlib.treehelpers as th

from collections import OrderedDict

inv_unit_string = 'kWh'
gwp_unit_string = 'kg CO2 eq./kWh' # GWP

def main(lca_data, eui, area, mode):
    if not lca_data.BranchCount:
        brimstone.utils.warn(ghenv, "LCA data is missing")
        return
    if eui != 0 and not eui:
        brimstone.utils.warn(ghenv, "EUI is missing")
        return
    if area != 0 and not area:
        brimstone.utils.warn(ghenv, "Area is missing")
        return
    
    lca_data = th.tree_to_list(lca_data)
    lca_data = [OrderedDict(zip(l[0], l[1])) for l in lca_data]
    gwp_total =  []
    
    for resource_lca_data in lca_data:
        try:
            gwp_total.append(calculate_gwp_total(resource_lca_data, eui, area, mode))
        except KeyError as e:
            raise Exception("GWP value could not be calculated: {error}".format(error = e))
    
    return gwp_total
    
def calculate_gwp_total(lca_data, eui, area, mode):    
    inv_unit = lca_data["InventoryUnit"]
    
    if inv_unit != inv_unit_string:
        raise Exception("Wrong unit for calculation of operational energy")    
    
    gwp_unit = lca_data["GWPUnit"]
    if gwp_unit != gwp_unit_string:
        raise Exception("Wrong unit for GWP calculation")
    
    if mode == "conservative":
        gwp_a1_a3_str = "GWPA1A3Conservative"
    elif mode == "typical":
        gwp_a1_a3_str = "GWPA1A3Typical"
    else:
        raise Exception("Mode not recognised (must be conservative or typical)")
    
    gwp_impact = (
        float(lca_data[gwp_a1_a3_str])
    )
    
    gwp_total = (
        float(lca_data[gwp_a1_a3_str])
    ) * area * eui
        
    return gwp_total

if __name__ == "__main__":
    if not scriptcontext.sticky["brimstone_flying"]:
        raise Exception("The 'Brimstone - Fly' component needs to exist on the canvas")   
    gwp_total = main(lca_data, eui, area, mode)
    gwp_total = th.list_to_tree(gwp_total)
# ---------- end calculate_operational_emissions ----------
operational_gwp_total_kg_co2eq_year = Data(calculate_operational_emissions.gwp_total)
panel_166 = Panel(operational_gwp_total_kg_co2eq_year)

panel_167 = Panel(operational_gwp_total_kg_co2eq_year)

ma_35 = MassAddition(Input=panel_166)  # -> Result, PartialResults

multiplication_6 = Multiplication(A=Slider(50, range=0..100), B=ma_35.Result)
lca_operational_gwp_total = RemoteSender(ma_35.Result)

lca_operational_gwp_total_2 = RemoteReceiver(lca_operational_gwp_total)
entwine_137 = Entwine(
    Branch00=lca_element_types_3,
    Branch01=lca_gwp_by_element_type_3,
    Branch02=lca_total_gwp_5,
    Branch03=lca_operational_gwp_total_2,
    FlattenInputs=True)  # -> flatten(Result)
hasdata_19 = DataExists(Data=entwine_137)
filter_89 = StreamFilter(Gate=hasdata_19, Stream0="False", Stream1=entwine_137)
lng_48 = ListLength(List=filter_89)
and_37 = GateAnd(A=honeybee_model_exists_6, B=lng_48)
and_38 = GateAnd(A=invert(lng_45), B=and_37)
lca_data_exists = RemoteSender(and_38)

# ---- group: Analysis module (continued)
lca_operational_gwp_total_3 = RemoteReceiver(lca_operational_gwp_total)
lca_operational_gwp_total_4 = RemoteReceiver(lca_operational_gwp_total)
multiplication_7 = Multiplication(A=lca_operational_gwp_total_3, B=number_slider_17)
expression_86 = Expression(x=multiplication_7, Expression="Round(x, 2)")
expression_87 = Expression(x=lca_operational_gwp_total_4, Expression="Round(x, 2)")
format_24 = Format(Format=panel_44, Culture=127, Data0=expression_87)
format_25 = Format(Format=panel_45, Culture=127, Data0=number_slider_17, Data1=expression_86)
setlabel_8 = SetLabelContents(LabelToModify=label_26, NewLabelContents=format_24)
setlabel_9 = SetLabelContents(LabelToModify=label_27, NewLabelContents=format_25)
lca_data_exists_2 = RemoteReceiver(lca_data_exists)
lca_data_exists_3 = RemoteReceiver(lca_data_exists)
hideshow_48 = HideShowElement(ElementToHideShow=label_24, Show=invert(lca_data_exists_3), Collapse=True, Disable=False)
hideshow_49 = HideShowElement(ElementToHideShow=[label_25, true_button_3, label_23], Show=lca_data_exists_2, Collapse=True, Disable=False)

# ----
merge_19 = Merge(Data1=heatmap_2.mesh, Data2=heatmap_2.legend, Data3=heatmap_2.title)  # -> flatten(Result)
illuminance_lux = Data(merge_19)
udi_50 = Data(flatten([heatmap_4.mesh, heatmap_4.legend, heatmap_4.title]))
udi_3000 = Data(flatten([heatmap_3.mesh, heatmap_3.legend, heatmap_3.title]))
udi = Data(flatten([heatmap_5.mesh, heatmap_5.legend, heatmap_5.title]))
daylight_autonomy = Data(flatten([heatmap_6.mesh, heatmap_6.legend, heatmap_6.title]))
hourlyplot_2 = LBHourlyPlot(data=annualtodata.data, base_pt=pt_18, x_dim=number_slider_40, y_dim=multiplication_4, legend_par=legendpar_3)  # -> report, mesh, legend, borders, labels, title, vis_set; plug-in component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
move = Move(Geometry=daylight_autonomy, Motion=X)  # -> Geometry, Transform
spatial_daylight_autonomy = Data(sda.sDA)

# ---- group: Spatial climate based daylight (continued)
move_2 = Move(Geometry=udi_3000, Motion=X_2)  # -> Geometry, Transform
move_3 = Move(Geometry=udi_50, Motion=X_3)  # -> Geometry, Transform
move_4 = Move(Geometry=udi, Motion=X_4)  # -> Geometry, Transform
merge_20 = Merge(Data1=move.Geometry, Data2=move_4.Geometry, Data3=move_3.Geometry, Data4=move_2.Geometry)

# ---- group: Extract hourly data from annual results (continued)
merge_21 = Merge(Data1=sph, Data2=hourlyplot_2.mesh, Data3=hourlyplot_2.legend, Data4=hourlyplot_2.labels)  # -> flatten(Result)

# ----
hourly_results_in_one_point = Data(merge_21)
data_51 = Data(merge_20)

simple_energy_data_exists = RemoteSender(and_36)

simple_energy_data_exists_2 = RemoteReceiver(simple_energy_data_exists)
and_39 = GateAnd(A=expression_69, B=simple_energy_data_exists_2)

gate_62 = StreamGate(Stream=sift_7.Output1, Gate=and_39)  # -> Target0, Target1
gate_63 = StreamGate(Stream=data_50, Gate=and_39)  # -> Target0, Target1
gate_64 = StreamGate(Stream=bbox_2.Box, Gate=and_39)  # -> Target0, Target1
zoom_simple_energy_simulation_bounding_b = RemoteSender(gate_64.Target1)  # "zoom_simple_energy_simulation_bounding_box"
clean_7 = CleanTree(RemoveNulls=True, RemoveInvalid=True, RemoveEmpty=False, Tree=gate_63.Target1)
data_52 = Data(gate_63.Target1)
indices = ListIndices(Data=gate_63.Target1)
index = ItemIndex(List=gate_63.Target1, Item=clean_7)
preview_18 = CustomPreview(Geometry=gate_62.Target1, Material=ColourSwatch(SwatchColor=RGB(84, 84, 84)))
exdiff = SetDifferenceS(SetA=indices, SetB=index)
item_45 = ListItem(List=gate_63.Target1, Index=exdiff, Wrap=True)
rebmsh = RebuildMesh(
    Mesh=item_45,
    RebuildNormals=False,
    CullUnused=invert(False),
    UnifyNormals=False,
    FlipNormals=False,
    IdenticalCombine=False,
    WeldVertices=0)
clean_8 = CleanTree(RemoveNulls=True, RemoveInvalid=True, RemoveEmpty=False, Tree=rebmsh)

zoom_simple_energy_simulation_bounding_b_2 = RemoteReceiver(zoom_simple_energy_simulation_bounding_b)  # "zoom_simple_energy_simulation_bounding_box"
zbb_2 = ZoomBoundingBox(Box=zoom_simple_energy_simulation_bounding_b_2, Run=zoom_simple_energy_simulation_2)

merge_22 = Merge(Data1=clean_7, Data2=clean_8)
simple_energy_simulation_annual_energy_b = Data(merge_22)  # "simple_energy_simulation_Annual_energy_balance"
connected_2 = GetConnectedObjects(Objects=simple_energy_simulation_annual_energy_b)
bake_4 = BakeObject(Objects=connected_2, ObjectAttributes=createatts, Bake=bake_simple_energy_simulation_2)

# ---- group: Analysis module (continued)
simple_energy_data_exists_3 = RemoteReceiver(simple_energy_data_exists)
simple_energy_data_exists_4 = RemoteReceiver(simple_energy_data_exists)
simple_energy_data_exists_5 = RemoteReceiver(simple_energy_data_exists)
or_34 = GateOr(A=simple_energy_data_exists_3, B=filter_5)
rec_31 = DataRecorder(or_34, DataLimit=-10, RecordData=True)
hideshow_50 = HideShowElement(ElementToHideShow=button_13, Show=simple_energy_data_exists_4, Collapse=True, Disable=False)
hideshow_51 = HideShowElement(ElementToHideShow=button_12, Show=simple_energy_data_exists_5, Collapse=True, Disable=False)
ma_36 = MassAddition(Input=flatten(rec_31))  # -> Result, PartialResults
simple_energy_data_exists_6 = RemoteReceiver(simple_energy_data_exists)
mod_2 = Modulus(A=ma_36.Result, B=Slider(2, range=0..10))
simple_energy_data_exists_7 = RemoteReceiver(simple_energy_data_exists)
bool_59 = Boolean(mod_2)
simple_energy_data_exists_8 = RemoteReceiver(simple_energy_data_exists)
hideshow_52 = HideShowElement(ElementToHideShow=tb_9, Show=simple_energy_data_exists_6, Collapse=True, Disable=False)
filter_90 = StreamFilter(Gate=bool_59, Stream0="Simulation failed...", Stream1="Energy simulation is running...")
simple_energy_data_exists_9 = RemoteReceiver(simple_energy_data_exists)
gate_65 = StreamGate(Stream=filter_90, Gate=freeze_gate_7)  # -> Target0, Target1
bool_60 = Boolean(invert(simple_energy_data_exists_7))
hideshow_53 = HideShowElement(ElementToHideShow=tb_8, Show=bool_60, Collapse=simple_energy_data_exists_7, Disable=False)
hideshow_54 = HideShowElement(ElementToHideShow=entwine_47, Show=simple_energy_data_exists_8, Collapse=True, Disable=False)
and_40 = GateAnd(A=lca_data_exists_2, B=simple_energy_data_exists_9)
settextblock_17 = SetTextBlockContents(TextBlockToModify=tb_8, NewTextBlockContents=gate_65.Target1)
hideshow_55 = HideShowElement(ElementToHideShow=[label_26, label_27], Show=and_40, Collapse=True, Disable=False)

# ----
entwine_138 = Entwine(
    Branch00=annual_hourly_energy_results_2,
    Branch01=monthly_energy_balance_2,
    Branch02=energy_use_intensity_2,
    Branch03=energy_use_intensity_per_end_use_2,
    Branch04=end_uses_2,
    Branch05=peak_cooling_3,
    Branch06=peak_cooling_2,
    Branch07=peak_heating_2,
    Branch08=cooling_load_profile_2,
    Branch09=heating_load_profile_2,
    FlattenInputs=True)
panel_168 = Panel(entwine_138)

# ----
# Here is the data stored from the simulation
freeze_gate_57 = StreamFreezeGate(Data=entwine_138, PassingSwitch=run_detailed_energy_simulations_3, Hold=True)
bang_18 = ExplodeTree(Data=freeze_gate_57)  # -> Branch0, Branch1, Branch2, Branch3, Branch4, Branch5, Branch6, Branch7, Branch8, Branch9
peak_heating_3 = Data(bang_18.Branch7)
zone_names_2 = Data(bang_18.Branch5)
peak_cooling_4 = Data(bang_18.Branch6)
annual_hourly_energy_results_3 = Data(bang_18.Branch0)
monthly_energy_balance_3 = Data(bang_18.Branch1)
cooling_load_profile_3 = Data(bang_18.Branch8)
heating_load_profile_3 = Data(bang_18.Branch9)
energy_use_intensity_per_end_use_3 = Data(bang_18.Branch3)
end_uses_3 = Data(bang_18.Branch4)
energy_use_intensity_3 = Data(bang_18.Branch2)

filter_91 = StreamFilter(
    Gate=detailed_energy_simulation_type_2,
    Stream0=annual_hourly_energy_results_3,
    Stream1=monthly_energy_balance_3,
    Stream2=cooling_load_profile_3,
    Stream3=heating_load_profile_3)
hasdata_20 = DataExists(Data=energy_use_intensity_3)
filter_92 = StreamFilter(Gate=hasdata_20, Stream0="False", Stream1=energy_use_intensity_3)
gate_66 = StreamGate(Stream=filter_91, Gate=expression_70)  # -> Target0, Target1
detailed_energy_data_exists = RemoteSender(filter_92)
data_53 = Data(gate_66.Target1)
bbox_3 = BoundingBox(Content=data_53, Plane=PlaneXY(0, 0, 0), UnionBox=True)  # -> Box, Box_2
zoom_detailed_energy_simulation_bounding = RemoteSender(bbox_3.Box)  # "zoom_detailed_energy_simulation_bounding_box"

zoom_detailed_energy_simulation_bounding_2 = RemoteReceiver(zoom_detailed_energy_simulation_bounding)  # "zoom_detailed_energy_simulation_bounding_box"
zbb_3 = ZoomBoundingBox(Box=zoom_detailed_energy_simulation_bounding_2, Run=zoom_detailed_energy_simulation_2)

# ---- group: Analysis module (continued)
detailed_energy_data_exists_2 = RemoteReceiver(detailed_energy_data_exists)
detailed_energy_data_exists_3 = RemoteReceiver(detailed_energy_data_exists)
detailed_energy_data_exists_4 = RemoteReceiver(detailed_energy_data_exists)
or_35 = GateOr(A=detailed_energy_data_exists_2, B=filter_6)
rec_32 = DataRecorder(or_35, DataLimit=-10, RecordData=True)
hideshow_56 = HideShowElement(ElementToHideShow=true_button_2, Show=detailed_energy_data_exists_3, Collapse=True, Disable=False)
hideshow_57 = HideShowElement(ElementToHideShow=button_15, Show=detailed_energy_data_exists_4, Collapse=True, Disable=False)
ma_37 = MassAddition(Input=flatten(rec_32))  # -> Result, PartialResults
mod_3 = Modulus(A=ma_37.Result, B=Slider(2, range=0..10))
bool_61 = Boolean(mod_3)
detailed_energy_data_exists_5 = RemoteReceiver(detailed_energy_data_exists)
detailed_energy_data_exists_6 = RemoteReceiver(detailed_energy_data_exists)
filter_93 = StreamFilter(Gate=bool_61, Stream0="Simulation failed...", Stream1="Daylight simulation is running...")
gate_67 = StreamGate(Stream=filter_93, Gate=freeze_gate_10)  # -> Target0, Target1
bool_62 = Boolean(invert(detailed_energy_data_exists_5))
hideshow_58 = HideShowElement(ElementToHideShow=stack_34, Show=detailed_energy_data_exists_6, Collapse=True, Disable=False)
settextblock_18 = SetTextBlockContents(TextBlockToModify=tb_3, NewTextBlockContents=gate_67.Target1)
hideshow_59 = HideShowElement(ElementToHideShow=tb_3, Show=bool_62, Collapse=detailed_energy_data_exists_5, Disable=False)

# ----
data_54 = Data(spatial_daylight_autonomy)
data_55 = Data(illuminance_lux)
data_56 = Data(daylight_autonomy)
data_57 = Data(udi)
data_58 = Data(udi_50)
data_59 = Data(udi_3000)
entwine_139 = Entwine(
    Branch00=data_54,
    Branch01=data_55,
    Branch02=data_56,
    Branch03=data_57,
    Branch04=data_58,
    Branch05=data_59,
    FlattenInputs=True)
freeze_gate_58 = StreamFreezeGate(Data=entwine_139, PassingSwitch=run_daylight_simulations_3, Hold=True)
null_34 = NullItem(Item=flatten(freeze_gate_58))  # -> NullFlags, InvalidFlags, Description
cull_18 = CullPattern(List=null_34.NullFlags, CullPattern=invert(null_34.NullFlags))
bang_19 = ExplodeTree(Data=freeze_gate_58)  # -> Branch0, Branch1, Branch2, Branch3, Branch4, Branch5
lng_49 = ListLength(List=cull_18)
data_60 = Data(bang_19.Branch2)
data_61 = Data(bang_19.Branch3)
data_62 = Data(bang_19.Branch4)
data_63 = Data(bang_19.Branch0)
data_64 = Data(bang_19.Branch1)
data_65 = Data(bang_19.Branch5)
spatialdaylightautonomy = RemoteSender(data_63)
filter_94 = StreamFilter(Gate=daylight_simulation_type_3, Stream0=data_64, Stream1=data_60, Stream2=data_61, Stream3=data_62, Stream4=data_65)

round = Round(Number=data_63)  # -> Nearest, Floor, Ceiling

# ---- group: Analysis module (continued)
spatialdaylightautonomy_2 = RemoteReceiver(spatialdaylightautonomy)
expression_88 = Expression(x=spatialdaylightautonomy_2, Expression="Round(x*100, 1)")
format_26 = Format(Format=panel_36, Culture=127, Data0=expression_88)
settextblock_19 = SetTextBlockContents(TextBlockToModify=tb_4, NewTextBlockContents=format_26)

# ----
bool_63 = Boolean(round.Ceiling)
hasdata_21 = DataExists(Data=bool_63)
filter_95 = StreamFilter(Gate=hasdata_21, Stream0="False", Stream1=bool_63)

and_41 = GateAnd(A=expression_71, B=filter_95)
and_42 = GateAnd(A=filter_95, B=invert(or_32))

gate_68 = StreamGate(Stream=filter_94, Gate=and_41)  # -> Target0, Target1
data_66 = Data(gate_68.Target1)
daylight_data_exists = RemoteSender(and_42)
bbox_4 = BoundingBox(Content=data_66, Plane=PlaneXY(0, 0, 0), UnionBox=True)  # -> Box, Box_2
zoom_daylight_simulation_bounding_box = RemoteSender(bbox_4.Box)

daylight_data_exists_2 = RemoteReceiver(daylight_data_exists)
and_43 = GateAnd(A=equals_13.Inequality, B=daylight_data_exists_2, C=expression_29)
or_36 = GateOr(
    A=preview_7,
    B=room_attribute_visualize_2,
    C=room_energy_attribute_visualize_2,
    D=face_attribute_visualize_2,
    E=face_energy_attribute_visualize_2,
    F=show_honeybee_walls_2,
    G=show_honeybee_roof_2,
    H=show_honeybee_floors_2,
    I=show_honeybee_ground_2,
    J=show_honeybee_windows_2,
    K=show_honeybee_doors_2,
    L=show_honeybee_context_2,
    M=weather_visualisation_wireframe_2,
    N=and_43)
filter_96 = StreamFilter(Gate=or_36, Stream0="Shaded", Stream1="Wireframe")
mod_viewport = ModifyViewport(DisplayMode=filter_96, AnimateRestore=False, RestoreFrames=10)

# ---- group: Analysis module (continued)
daylight_data_exists_3 = RemoteReceiver(daylight_data_exists)
daylight_data_exists_4 = RemoteReceiver(daylight_data_exists)
or_37 = GateOr(A=daylight_data_exists_3, B=filter_8)
rec_33 = DataRecorder(or_37, DataLimit=-10, RecordData=True)
hideshow_60 = HideShowElement(ElementToHideShow=button_17, Show=daylight_data_exists_4, Collapse=True, Disable=False)
ma_38 = MassAddition(Input=flatten(rec_33))  # -> Result, PartialResults
daylight_data_exists_5 = RemoteReceiver(daylight_data_exists)
mod_4 = Modulus(A=ma_38.Result, B=Slider(2, range=0..10))
daylight_data_exists_6 = RemoteReceiver(daylight_data_exists)
daylight_data_exists_7 = RemoteReceiver(daylight_data_exists)
hideshow_61 = HideShowElement(ElementToHideShow=[pulldown_11, label_19], Show=daylight_data_exists_5, Collapse=True, Disable=False)
bool_64 = Boolean(mod_4)
filter_97 = StreamFilter(Gate=bool_64, Stream0="Simulation failed...", Stream1="Daylight simulation is running...")
hideshow_62 = HideShowElement(ElementToHideShow=tb_4, Show=daylight_data_exists_6, Collapse=True, Disable=False)
bool_65 = Boolean(invert(daylight_data_exists_7))
gate_69 = StreamGate(Stream=filter_97, Gate=freeze_gate_13)  # -> Target0, Target1
hideshow_63 = HideShowElement(ElementToHideShow=tb_7, Show=bool_65, Collapse=daylight_data_exists_7, Disable=False)
settextblock_20 = SetTextBlockContents(TextBlockToModify=tb_7, NewTextBlockContents=gate_69.Target1)

# ----
zoom_daylight_simulation_bounding_box_2 = RemoteReceiver(zoom_daylight_simulation_bounding_box)
zbb_4 = ZoomBoundingBox(Box=zoom_daylight_simulation_bounding_box_2, Run=zoom_daylight_simulation_2)

created_materials_database = RemoteReceiver(created_materials_database_2)
panel_169 = Panel(created_materials_database)
decnstrmat_5 = HBDeconstructMaterial(mat=created_materials_database)  # -> category, values, attr_names, r_val_si, r_val_ip; plug-in component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
create_material_categories = RemoteSender(decnstrmat_5.category)
item_46 = ListItem(List=decnstrmat_5.values, Index=0, Wrap=True)  # -> flatten(Item), flatten(Item1), flatten(Item2), flatten(Item3), flatten(Item4)
clean_9 = CleanTree(RemoveNulls=True, RemoveInvalid=True, RemoveEmpty=False, Tree=item_46.Item)
clean_10 = CleanTree(RemoveNulls=True, RemoveInvalid=True, RemoveEmpty=False, Tree=item_46.Item2)
clean_11 = CleanTree(RemoveNulls=True, RemoveInvalid=True, RemoveEmpty=False, Tree=item_46.Item3)
clean_12 = CleanTree(RemoveNulls=True, RemoveInvalid=True, RemoveEmpty=False, Tree=item_46.Item4)
lng_50 = ListLength(List=clean_9)
create_material_names = RemoteSender(clean_9)
num_7 = Number(clean_10)
num_8 = Number(clean_11)
num_9 = Number(clean_12)
expression_89 = Expression(x=num_7, Expression="Round(x, 2)")
expression_90 = Expression(x=num_8, Expression="Round(x, 2)")
expression_91 = Expression(x=num_9, Expression="Round(x, 2)")
bool_66 = Boolean(lng_50)
gate_70 = StreamGate(Stream=panel_16, Gate=bool_66)  # -> Target0, Target1
format_27 = Format(Format=gate_70.Target1, Culture=127, Data0=clean_9, Data1=expression_89, Data2=expression_90, Data3=expression_91)
panel_170 = Panel(format_27)
database_materials = RemoteSender(format_27)

create_material_categories_2 = RemoteReceiver(create_material_categories)
create_material_names_2 = RemoteReceiver(create_material_names)
database_materials_2 = RemoteReceiver(database_materials)
mindex_7 = MemberIndex(Set=material_database_categories_3, Member=create_material_categories_2)  # -> simplify(Index), Count
getbrn = GetMatchingBranches(
    PrimaryData=mindex_7.Index,
    SecondaryData1=simplify(graft(database_materials_2)),
    SecondaryData2=simplify(graft(create_material_names_2)),
    removeEmpty=True,
    ValueTable_removeEmpty=False)  # -> flatten(PrimaryData), flatten(SecondaryData1), flatten(SecondaryData2)
material_database_categories_current = RemoteSender(getbrn.PrimaryData)
database_materials_current = RemoteSender(getbrn.SecondaryData1)
create_material_names_current = RemoteSender(getbrn.SecondaryData2)

cull_19 = CullPattern(List=create_material_categories_2, CullPattern=mindex_7.Count)
create_material_categories_current = RemoteSender(cull_19)
material_database_categories_current_2 = RemoteReceiver(material_database_categories_current)
create_material_names_current_2 = RemoteReceiver(create_material_names_current)
database_materials_current_2 = RemoteReceiver(database_materials_current)
material_database_categories_current_3 = RemoteReceiver(material_database_categories_current)
create_material_names_current_3 = RemoteReceiver(create_material_names_current)

expression_92 = Expression(x=create_material_names_current_3, y=create_material_name_3, Expression="x=y")
cull_20 = CullPattern(List=expression_92, CullPattern=expression_92)
gate_71 = StreamGate(Stream="Material already exists", Gate=cull_20)  # -> Target0, Target1
entwine_140 = Entwine(Branch00=filter_37, Branch01=gate_71.Target1, Branch02=gate_30.Target1, FlattenInputs=True)  # -> flatten(Result)
item_47 = ListItem(List=entwine_140, Index=0, Wrap=True)
create_material_error_message = RemoteSender(item_47)

create_material_error_message_2 = RemoteReceiver(create_material_error_message)
null_35 = NullItem(Item=create_material_error_message_2)  # -> NullFlags, InvalidFlags, Description
filter_98 = StreamFilter(Gate=null_35.NullFlags, Stream0=create_material_error_message_2, Stream1=" ")
filter_99 = StreamFilter(Gate=null_35.NullFlags, Stream0=Slider(500, range=0..1000), Stream1=Slider(1000000, range=0..1000000))
hideshow_64 = HideShowElement(ElementToHideShow=button_37, Show=True, Collapse=True, Disable=invert(null_35.NullFlags))
tooltip_14 = AttachTooltipToElement(ElementsToAttachTo=button_37, TooltipContent=filter_98, ShowDelay=filter_99, Duration=Slider(5000, range=0..10000))

create_material_names_current_4 = RemoteReceiver(create_material_names_current)
create_material_categories_current_2 = RemoteReceiver(create_material_categories_current)

mindex_8 = MemberIndex(Set=create_material_names_current_4, Member=branch_3)  # -> flatten(Index), Count
item_48 = ListItem(List=create_material_categories_current_2, Index=mindex_8.Index, Wrap=True)
mindex_9 = MemberIndex(Set=material_database_categories_7, Member=item_48)  # -> flatten(Index), Count
item_49 = ListItem(List=entwine_114, Index=mindex_9.Index, Wrap=True)
adjustelem_23 = AdjustElementAppearance(ElementsToAdjust=tb_21, Foreground=swatch, Background=item_49)
adjustelem_24 = AdjustElementAppearance(ElementsToAdjust=tb_20, Foreground=swatch, Background=item_49)

sort_2 = SortList(
    Keys=material_database_categories_current_2,
    ValuesA=database_materials_current_2,
    ValuesB=create_material_names_current_2)  # -> Keys, ValuesA, ValuesB
py3_54 = Python3Script(maximum_elements=lng_8, current_elements=material_database_categories_current_3, maximum_buttons=number_slider_28)  # -> status; inputs current_elements: list, maximum_buttons: Int32
# ---------- py3_54: Python ----------
from collections import Counter
import ghpythonlib.treehelpers as th

c = Counter(current_elements)
status = []

for i in range(maximum_elements):
    current_category = [True]*c[i]
    current_category.extend([False]*(maximum_buttons-c[i]))
    status.append(current_category)

status = th.list_to_tree(status)
# ---------- end py3_54 ----------
create_material_names_sorted = RemoteSender(sort_2.ValuesB)
concat_6 = Concatenate(FragmentA="- ", FragmentB=sort_2.ValuesA)
material_database_hideshow = RemoteSender(py3_54)
cull_21 = CullPattern(List=tb_17, CullPattern=py3_54)  # -> flatten(List)
settextblock_21 = SetTextBlockContents(TextBlockToModify=cull_21, NewTextBlockContents=concat_6)
hideshow_65 = HideShowElement(ElementToHideShow=simplify(shfdep), Show=simplify(py3_54), Collapse=True, Disable=False)

material_database_hideshow_2 = RemoteReceiver(flatten(material_database_hideshow))
filter_100 = StreamFilter(Gate=lng_15, Stream0="False", Stream1=material_database_hideshow_2)
freeze_gate_59 = StreamFreezeGate(Data=filter_100, PassingSwitch=filter_32, Freeze=True, Hold=False)
cull_22 = CullPattern(List=freeze_gate_40, CullPattern=freeze_gate_59)
create_material_names_sorted_2 = RemoteReceiver(create_material_names_sorted)
cset_6 = CreateSet(List=cull_22)  # -> Set, Map
cull_23 = CullPattern(List=cset_6.Set, CullPattern=cset_6.Set)
mindex_10 = MemberIndex(Set=cull_22, Member=cull_23)  # -> Index, Count
freeze_gate_60 = StreamFreezeGate(Data=create_material_names_sorted_2, PassingSwitch=filter_32, Freeze=True, Hold=False)
hold_12 = HoldingGate(Data=mindex_10.Index)
item_50 = ListItem(List=freeze_gate_60, Index=hold_12, Wrap=True)
expression_93 = Expression(x=item_18, y=item_50, Expression="x≠y")
cull_24 = CullPattern(List=split_7, CullPattern=expression_93)
join_11 = TextJoin(Text=cull_24, Join="|")
filter_101 = StreamFilter(Gate=bool_40, Stream0=bool_40, Stream1=join_11)
freeze_gate_61 = StreamFreezeGate(Data=filter_101, PassingSwitch=material_database_remove_material_2, Freeze=False, Hold=False)

panel_171 = Panel(filter_101)
panel_172 = Panel(freeze_gate_61)
setdocumentusertext_3 = Python3Script(key=panel_123, load_value=freeze_gate_38, remove_value=freeze_gate_61, add_value=freeze_gate_45, sync=event_11.Data)  # -> done
# ---------- setdocumentusertext_3: Python ----------
import Rhino
import rhinoscriptsyntax as rs
import scriptcontext as sc

def modify_value(value):
    sc.doc = Rhino.RhinoDoc.ActiveDoc

    return rs.SetDocumentUserText(key, value)

    sc.doc = ghdoc

if load_value:
    done = modify_value(load_value)

elif add_value:
    done = modify_value(add_value)

elif remove_value:
    done = modify_value(remove_value)
elif remove_value == False:
    done = modify_value(None)

elif sync:
    done = True
# ---------- end setdocumentusertext_3 ----------
getdocumentusertext_15 = Python3Script(run=setdocumentusertext_3, key="Heath materials")  # -> json_string; same code as getdocumentusertext_14
split_10 = TextSplit(Text=getdocumentusertext_15, Separators="|")
hold_13 = HoldingGate(Data=split_10)
strtoobj_8 = HBStringToObject(hb_str=hold_13)  # -> flatten(hb_obj); plug-in component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
ipy2_3 = IronPython2Script(materials=strtoobj_8)  # -> unique_materials; inputs materials: list; same code as ipy2
lng_51 = ListLength(List=ipy2_3)
lng_52 = ListLength(List=strtoobj_8)
clean_13 = CleanTree(RemoveNulls=True, RemoveInvalid=True, RemoveEmpty=False, Tree=ipy2_3)
smaller_7 = SmallerThan(FirstNumber=lng_51, SecondNumber=lng_52)  # -> SmallerThan, OrEqualTo
created_materials_database_2 = RemoteSender(clean_13)
hasdata_22 = DataExists(Data=smaller_7.SmallerThan)
filter_102 = StreamFilter(Gate=hasdata_22, Stream0="False", Stream1=smaller_7.SmallerThan)
overlap_materials = RemoteSender(filter_102)

created_materials_database_3 = RemoteReceiver(created_materials_database_2)
cull_25 = CullPattern(List=created_materials_database_3, CullPattern=mindex_7.Count)
created_materials_database_current = RemoteSender(cull_25)

overlap_materials_2 = RemoteReceiver(overlap_materials)
hideshow_66 = HideShowElement(ElementToHideShow=label_34, Show=overlap_materials_2, Collapse=True, Disable=False)

panel_173 = Panel(setdocumentusertext_3)
panel_174 = Panel(getdocumentusertext_15)
panel_175 = Panel(clean_13)

created_materials_database_current_2 = RemoteReceiver(created_materials_database_current)

database_materials_current_3 = RemoteReceiver(database_materials_current)
lng_53 = ListLength(List=database_materials_current_3)
series_2 = Series(Start=0, Step=1, Count=lng_53)
hasdata_23 = DataExists(Data=database_materials_current_3)
tsort = SortText(Keys=database_materials_current_3, Values=series_2, Culture=127)  # -> Keys, Values
create_construction_materials_sorted = RemoteSender(tsort.Values)
filter_103 = StreamFilter(Gate=hasdata_23, Stream0=empty_11, Stream1=tsort.Keys)
setlist_13 = SetListContents(ListToModify=pulldown_24, NewListContents=filter_103, SelectedIndex=bang_8.Branch0)

create_construction_materials_sorted_2 = RemoteReceiver(create_construction_materials_sorted)
item_51 = ListItem(List=created_materials_database_current_2, Index=create_construction_materials_sorted_2, Wrap=invert(True))
item_52 = ListItem(List=item_51, Index=create_construction_materials_3, Wrap=invert(True))
repeat_25 = RepeatData(Data=item_52, Length=visible_layers_2)  # -> flatten(Data)
cluster_22 = Cluster(materials=repeat_25, construction_name=create_construction_name_4, thicknesses=repeat_17)  # -> error_2, construction_2
create_construction_error = RemoteSender(cluster_22.error_2)
gate_72 = StreamGate(Stream=cluster_22.construction_2, Gate=create_construction_2)  # -> Target0, Target1
objtostr_4 = HBObjectToString(hb_obj=gate_72.Target1)  # -> hb_str; plug-in component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
entwine_141 = Entwine(Branch00=getdocumentusertext_11, Branch01=objtostr_4, FlattenInputs=True)  # -> flatten(Result)
freeze_gate_62 = StreamFreezeGate(Data=entwine_141, PassingSwitch=create_construction_2, Freeze=False, Hold=False)
join_12 = TextJoin(Text=freeze_gate_62, Join="|")

create_construction_error_2 = RemoteReceiver(create_construction_error)
panel_176 = Panel(create_construction_error_2)
split_11 = TextSplit(Text=create_construction_error_2, Separators=panel_97)
trim_2 = TextTrim(Text=split_11, Start=True, End=True)
item_53 = ListItem(List=trim_2, Index=0, Wrap=True)  # -> Item, Item1
lng_54 = ListLength(List=split_11)
len_4 = TextLength(Text=item_53.Item1)
larger_4 = LargerThan(FirstNumber=lng_54, SecondNumber="1")  # -> LargerThan, OrEqualTo
subtraction_8 = Subtraction(A=len_4, B=Slider(11, range=0..20))
fragment_3 = TextFragment(Text=item_53.Item1, Start="0", Count=subtraction_8)
filter_104 = StreamFilter(Gate=larger_4.LargerThan, Stream0=create_construction_error_2, Stream1=fragment_3)
entwine_142 = Entwine(Branch00=filter_104, Branch01=gate_50.Target1, Branch02=gate_28.Target1, FlattenInputs=True)  # -> flatten(Result)
panel_177 = Panel(filter_104)
item_54 = ListItem(List=entwine_142, Index=0, Wrap=True)
create_construction_error_message = RemoteSender(item_54)

create_construction_error_message_2 = RemoteReceiver(create_construction_error_message)
null_36 = NullItem(Item=create_construction_error_message_2)  # -> NullFlags, InvalidFlags, Description
filter_105 = StreamFilter(Gate=null_36.NullFlags, Stream0=create_construction_error_message_2, Stream1=" ")
filter_106 = StreamFilter(Gate=null_36.NullFlags, Stream0=Slider(500, range=0..1000), Stream1=Slider(1000000, range=0..1000000))
hideshow_67 = HideShowElement(ElementToHideShow=button_34, Show=True, Collapse=True, Disable=invert(null_36.NullFlags))
tooltip_15 = AttachTooltipToElement(ElementsToAttachTo=button_34, TooltipContent=filter_105, ShowDelay=filter_106, Duration=Slider(5000, range=0..10000))

setdocumentusertext_4 = Python3Script(key=panel_122, load_value=freeze_gate_37, remove_value=freeze_gate_21, add_value=join_12)  # -> done
# ---------- setdocumentusertext_4: Python ----------
import Rhino
import rhinoscriptsyntax as rs
import scriptcontext as sc

def modify_value(value):
    sc.doc = Rhino.RhinoDoc.ActiveDoc

    done = rs.SetDocumentUserText(key, value)
    return done

    sc.doc = ghdoc

if load_value:
    done = modify_value(load_value)

if add_value:
    done = modify_value(add_value)

if remove_value:
    done = modify_value(remove_value)
if remove_value == False:
    done = modify_value(None)
# ---------- end setdocumentusertext_4 ----------
getdocumentusertext_16 = Python3Script(run=setdocumentusertext_4, key="Heath constructions")  # -> json_string; same code as getdocumentusertext_14
split_12 = TextSplit(Text=getdocumentusertext_16, Separators="|")
hold_14 = HoldingGate(Data=split_12)
strtoobj_9 = HBStringToObject(hb_str=hold_14)  # -> flatten(hb_obj); plug-in component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
ipy2_4 = IronPython2Script(constructions=strtoobj_9)  # -> unique_constructions; inputs constructions: list
# ---------- ipy2_4: IronPython ----------
"""Grasshopper Script"""

unique_constructions = []

for i in range(len(constructions)):
    if constructions[i] not in unique_constructions:
        unique_constructions.append(constructions[i])
# ---------- end ipy2_4 ----------
lng_55 = ListLength(List=ipy2_4)
lng_56 = ListLength(List=strtoobj_9)
clean_14 = CleanTree(RemoveNulls=True, RemoveInvalid=True, RemoveEmpty=False, Tree=ipy2_4)
smaller_8 = SmallerThan(FirstNumber=lng_55, SecondNumber=lng_56)  # -> SmallerThan, OrEqualTo
created_constructions_database_2 = RemoteSender(clean_14)
hasdata_24 = DataExists(Data=smaller_8.SmallerThan)
filter_107 = StreamFilter(Gate=hasdata_24, Stream0="False", Stream1=smaller_8.SmallerThan)
overlap_constructions = RemoteSender(filter_107)

overlap_constructions_2 = RemoteReceiver(overlap_constructions)
hideshow_68 = HideShowElement(ElementToHideShow=label_30, Show=overlap_constructions_2, Collapse=True, Disable=False)

panel_178 = Panel(clean_14)

# ==== cluster VisualiseProperties
number_of_decimals_room = ClusterInput()
face_attribute = ClusterInput()
honeybee_model = ClusterInput()
number_of_decimals_face = ClusterInput()
room_attribute = ClusterInput()
face_attribute_2 = Text(face_attribute)
honeybee_model_2 = Data(honeybee_model)
room_attribute_2 = Text(room_attribute)
number_of_decimals_face_2 = Number(number_of_decimals_face)
number_of_decimals_room_2 = Number(number_of_decimals_room)
legendpar = LBLegendParameters(num_decimals=number_of_decimals_room_2)  # -> leg_par; plug-in component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
legendpar_2 = LBLegendParameters(num_decimals=number_of_decimals_face_2)  # -> leg_par; plug-in component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
colorroomattr = HBColorRoomAttributes(rooms_model=flatten(honeybee_model_2), attribute=room_attribute_2, legend_par=legendpar)  # -> mesh, legend, wire_frame, values, colors, vis_set; plug-in component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
colorfaceattr = HBColorFaceAttributes(hb_objs=flatten(honeybee_model_2), attribute=face_attribute_2, legend_par=legendpar_2)  # -> mesh, legend, wire_frame, values, colors, vis_set; plug-in component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
visualised_room_attributes = Data([colorroomattr.mesh, colorroomattr.legend, colorroomattr.wire_frame])
visualised_face_attributes = Data([colorfaceattr.mesh, colorfaceattr.legend, colorfaceattr.wire_frame])
visualised_room_attributes_2 = ClusterOutput(visualised_room_attributes)
visualised_face_attributes_2 = ClusterOutput(visualised_face_attributes)

# ==== cluster AddDynamicShades
base_construction_set = ClusterInput()
setpoint = ClusterInput()
base_construction_set_2 = Data(base_construction_set)
decnstrconstrset = HBDeconstructConstructionSet(constr_set=base_construction_set_2)  # -> exterior_wall, exterior_roof, exposed_floor, ground_wall, ground_roof, ground_floor, window, skylight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; plug-in component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
setpoint_2 = Data(setpoint)
shademat = HBShadeMaterial(thickness=Slider(0.01, range=0..0.01), transmittance=Slider(0.4, range=0..1))  # -> mat; plug-in component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
windowconstrshd = HBWindowConstructionShade(
    name="Simple Glazing Window",
    win_constr=decnstrconstrset.window,
    shd_material=shademat,
    shd_location="Exterior",
    control_type=Slider(1, range=0..8),
    setpoint=setpoint_2)  # -> constr; plug-in component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
subfacesubset = HBSubfaceSubset(window=windowconstrshd, operable=windowconstrshd)  # -> subface_set; plug-in component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
constructionset = HBConstructionSet(base_constr_set=base_construction_set_2, subface_subset=subfacesubset)  # -> constr_set; plug-in component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
construction_set = Data(constructionset)
construction_set_2 = ClusterOutput(construction_set)

# ==== cluster Cluster
materials = ClusterInput()
materials_2 = Data(materials)
opaqueconstr = HBOpaqueConstruction(materials=materials_2)  # -> constr; plug-in component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
thicknesses = ClusterInput()
decnstrconstr = HBDeconstructConstruction(constr=opaqueconstr)  # -> materials, layers, r_val_si, r_val_ip, u_fac_si, u_fac_ip, shgc, t_sol, t_vis; plug-in component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
thicknesses_2 = Number(thicknesses)
nullrep = ReplaceNulls(Items=thicknesses_2, Replacements="0")  # -> Items, Count
construction_name = ClusterInput()
modify_layer_thicknesses = BrimstoneModifyThicknessesOfHoneybeeMaterials(hb_materials=decnstrconstr.materials, thicknesses=nullrep.Items)  # -> out, mod_materials; inputs hb_materials: list, thicknesses: list
# ---------- modify_layer_thicknesses: Python ----------
"""
Calculates embodied carbon for the elements of a Honeybee model if data is available
This component was inspired by the 'HB Color Face Attributes' component of Ladybug Tools 1.6.0

    Args:
        hb_materials: List of Honeybee materials which should get new thickness
        thicknesses: List of new material thicknesses

    Returns:
        mod_materials: Modified Honeybee materials
"""

import scriptcontext
#import brimstone

ghenv.Component.Message = ""#brimstone.globals.version

ghenv.Component.Name = 'Brimstone - Modify thicknesses of Honeybee materials'
ghenv.Component.NickName = 'Modify layer thicknesses'

try:  # import the core honeybee dependencies
    from honeybee_energy.material.opaque import EnergyMaterial
    from honeybee_energy.material.opaque import EnergyMaterialNoMass
except ImportError as e:
    raise ImportError('\nFailed to import honeybee:\n\t{}'.format(e))

def main(hb_materials, thicknesses):
    mod_materials = []
    assert len(hb_materials) == len(thicknesses), "Materials and thickness list must be of the same length"
    for (i, material) in enumerate(hb_materials):
        if not isinstance(material, EnergyMaterial):
            if isinstance(material, EnergyMaterialNoMass):
                mod_material = material.duplicate()
                mod_materials.append(mod_material)
            else:
                raise Exception("All materials must be valid Honeybee Energy Materials or Energy Materials (No Mass)")
        else: # if material is EnergyMaterial
            mod_material = material.duplicate()
            mod_material.thickness = thicknesses[i]
            mod_materials.append(mod_material)
    return mod_materials

if __name__ == "__main__":
    try:
        pass#flying = scriptcontext.sticky["brimstone_flying"]
    except:
        raise Exception("The 'Brimstone - Fly' component needs to exist on the canvas")
    mod_materials = main(hb_materials, thicknesses)
# ---------- end modify_layer_thicknesses ----------
construction_name_2 = Text(construction_name)
opaqueconstr_2 = HBOpaqueConstruction(name=construction_name_2, materials=modify_layer_thicknesses.mod_materials)  # -> constr; plug-in component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
error = Data(modify_layer_thicknesses.out)
error_2 = ClusterOutput(error)
construction = Data(opaqueconstr_2)
construction_2 = ClusterOutput(construction)

# ==== cluster Cluster_2
window_construction = ClusterInput()
window_construction_2 = Data(window_construction)
fly = BrimstoneFly()
# ---------- fly: Python ----------
"""This component sets up global information for Brimstone
    Inputs:
    Output:
        """

import Grasshopper
import sys
sys.path.append(Grasshopper.Folders.UserObjectFolders[0])

import brimstone
reload(brimstone)

import scriptcontext

ghenv.Component.Name = 'Brimstone - Fly!'
ghenv.Component.NickName = 'Fly!'

scriptcontext.sticky["brimstone_flying"] = 'true'
ghenv.Component.Message = brimstone.globals.version
# ---------- end fly ----------
subfacesubset = HBSubfaceSubset(window=window_construction_2)  # -> subface_set; plug-in component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
panel = Panel(subfacesubset)
constructionset = HBConstructionSet(subface_subset=subfacesubset)  # -> constr_set; plug-in component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
density_kg_m2 = ClusterInput()
gwp_a1_a3 = ClusterInput()
gwp_a4 = ClusterInput()
decnstrconstrset = HBDeconstructConstructionSet(constr_set=constructionset)  # -> exterior_wall, exterior_roof, exposed_floor, ground_wall, ground_roof, ground_floor, window, skylight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; plug-in component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
gwp_a1_a3_2 = Data(gwp_a1_a3)
gwp_a4_2 = Data(gwp_a4)
density_kg_m2_2 = Data(density_kg_m2)
add_life_cycle_info_construction = BrimstoneAddLifeCycleInfoToHoneybeeConstruction(hb_construction=decnstrconstrset.window, gwp_a1_a3=gwp_a1_a3_2, gwp_a4=gwp_a4_2, density=density_kg_m2_2)  # -> mod_construction
# ---------- add_life_cycle_info_construction: Python ----------
"""
Adds GWP info to a Honeybee Construction

    Args:
        hb_construction: Honeybee Construction to be updated
        gwp_a1_a3: GWP (A1-A3) [kg CO2eq/m2]
        gwp_a4: GWP (A4) [kg CO2eq/m2]
        gwp_a5_1: GWP (A5.1) [kg CO2eq/m2]

    Returns:
        mod_construction: Updated Honeybee Construction
"""

import scriptcontext
import brimstone
ghenv.Component.Message = brimstone.globals.version
import Grasshopper

ghenv.Component.Name = 'Brimstone - Add Life Cycle Info to Honeybee Construction'
ghenv.Component.NickName = 'Add Life Cycle Info (Construction)'

try:  # import the core honeybee dependencies
    from honeybee_energy.construction.window import WindowConstruction
    from honeybee_energy.construction.opaque import OpaqueConstruction
except ImportError as e:
    raise ImportError('\nFailed to import honeybee:\n\t{}'.format(e))

def main(hb_construction, gwp_a1_a3, gwp_a4, density):
    if not isinstance(hb_construction, WindowConstruction)\
        and not isinstance(hb_construction, OpaqueConstruction):
        raise Exception("Currently only Window and Opaque constructions are supported")
    mod_construction = hb_construction.duplicate()
    user_data = mod_construction.user_data if mod_construction.user_data else {}
    
    user_data["gwp_a1_a3"] = gwp_a1_a3
    user_data["gwp_a4"] = gwp_a4
    user_data["conv_value"] = density
    
    mod_construction.user_data = user_data

    return mod_construction

if __name__ == "__main__":
    try:
        flying = scriptcontext.sticky["brimstone_flying"]
    except:
        raise Exception("The 'Brimstone - Fly' component needs to exist on the canvas")
    mod_construction = main(hb_construction, gwp_a1_a3, gwp_a4, density)
# ---------- end add_life_cycle_info_construction ----------
panel_2 = Panel(decnstrconstrset.window)
updated_construction = Data(add_life_cycle_info_construction)
panel_3 = Panel(add_life_cycle_info_construction)
updated_construction_2 = ClusterOutput(updated_construction)

# ==== cluster WeatherVisualisation
target_geometry = ClusterInput()
run_direct_sun_hours_study = ClusterInput()
_1 = ClusterInput()
run_incident_radiation_study = ClusterInput()
run_weather_visualisation = ClusterInput()
target_geometry_2 = ClusterInput()
sky_mask_centre_point = ClusterInput()
run_weather_visualisation_2 = Boolean(run_weather_visualisation)
filter = StreamFilter(Gate=run_weather_visualisation_2, Stream1=_1)
epw_file_url = Data(filter)

# ---- group: Get weather data
downloadepw = LBDownloadWeather(weather_URL=epw_file_url)  # -> epw_file, stat_file, ddy_file; plug-in component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
falsestart = LBFalseStartToggle(False)
epwtoddy = LBEPWToDDY(weather_file=downloadepw.epw_file, write=falsestart)  # -> ddy_file; plug-in component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
importloc = LBImportLocation(epw_file=downloadepw.epw_file)  # -> location; plug-in component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
importstat = LBImportSTAT(stat_file=downloadepw.stat_file)  # -> location, ashrae_zone, koppen_zone, clear_dir_norm_rad, clear_diff_horiz_rad, ann_heat_dday_996, ann_heat_dday_990, ann_cool_dday_004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; plug-in component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
constrloc = LBConstructLocation(elevation=0)  # -> location; plug-in component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
importepw = LBImportEPW(epw_file=downloadepw.epw_file)  # -> location, dry_bulb_temperature, dew_point_temperature, relative_humidity, wind_speed, wind_direction, direct_normal_rad, diffuse_horizontal_rad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; plug-in component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
importddy = LBImportDDY(ddy_file=downloadepw.ddy_file)  # -> location, design_days; plug-in component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

# ----
panel = Panel(importloc)

# ---- group: Wind rose
analysisperiod = LBAnalysisPeriod(
    start_month=Slider(1, range=1..12),
    start_day=Slider(1, range=1..31),
    start_hour=Slider(0, range=0..23),
    end_month=Slider(12, range=1..12),
    end_day=Slider(31, range=1..31),
    end_hour=Slider(23, range=0..23))  # -> period, hoys, dates; plug-in component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
windrose = LBWindRose(data=importepw.wind_speed, wind_direction=importepw.wind_direction, show_calm=Toggle(True), period=analysisperiod.period)  # -> report, mesh, compass, orient_line, freq_line, windrose_line, legend, title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; plug-in component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

# ---- group: Sun path
analysisperiod_2 = LBAnalysisPeriod(
    start_month=Slider(1, range=1..12),
    start_day=Slider(1, range=1..31),
    start_hour=Slider(0, range=0..23),
    end_month=Slider(12, range=1..12),
    end_day=Slider(31, range=1..31),
    end_hour=Slider(23, range=0..23))  # -> period, hoys, dates; plug-in component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
panel_2 = Panel("a>24")
sunpath = LBSunPath(location=importloc, hoys=analysisperiod_2.hoys, scale=1, data=importepw.dry_bulb_temperature)  # -> report, vectors, altitudes, azimuths, hoys, sun_pts, analemma, daily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; plug-in component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
msphere = MeshSphere(Base=sunpath.sun_pts, Radius=Slider(3, range=0..10), UCount=10, VCount=20)

# ---- group: Graph data
timeop = LBTimeIntervalOperation(data=importepw.dry_bulb_temperature)  # -> daily, monthly, mon_per_hr; plug-in component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
legendpar = LBLegendParameters(
    min=Slider(-15, range=-15..30),
    max=Slider(25, range=0..100),
    num_decimals=Slider(0, range=0..100),
    larger_smaller=Toggle(True),
    vert_or_horiz=Toggle(False))  # -> leg_par; plug-in component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
monthlychart = LBMonthlyChart(data=timeop.daily)  # -> report, data_mesh, data_lines, col_lines, legend, borders, labels, y_title, title, vis_set; plug-in component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
hourlyplot = LBHourlyPlot(data=importepw.dry_bulb_temperature, z_dim=Slider(0, range=0..100), reverse_y=Toggle(True), legend_par=legendpar)  # -> report, mesh, legend, borders, labels, title, vis_set; plug-in component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

# ----
run_incident_radiation_study_2 = Boolean(run_incident_radiation_study)

# ---- group: Sky matrix and incident radiation
analysisperiod_3 = LBAnalysisPeriod(
    start_month=Slider(1, range=1..12),
    start_day=Slider(1, range=1..31),
    start_hour=Slider(0, range=0..23),
    end_month=Slider(12, range=1..12),
    end_day=Slider(31, range=1..31),
    end_hour=Slider(23, range=0..23))  # -> period, hoys, dates; plug-in component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
skymatrix = LBCumulativeSkyMatrix(
    location=importepw.location,
    direct_rad=importepw.direct_normal_rad,
    diffuse_rad=importepw.diffuse_horizontal_rad,
    hoys=analysisperiod_3.hoys,
    high_density=Toggle(False))  # -> report, sky_mtx; plug-in component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
context_geometry = Geometry(target_geometry)
target_geometry_3 = Geometry(target_geometry_2)
incidentradiation = LBIncidentRadiation(
    sky_mtx=skymatrix.sky_mtx,
    geometry=flatten(target_geometry_3),
    context=flatten(context_geometry),
    grid_size=Slider(1, range=0..1),
    offset_dist=Slider(0.1, range=0..0.1),
    run=run_incident_radiation_study_2)  # -> report, points, results, total, mesh, legend, title, int_mtx; plug-in component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
skydome = LBSkyDome(sky_mtx=skymatrix.sky_mtx)  # -> report, mesh, compass, legend, title, patch_vecs, patch_values, mesh_values, vis_set; plug-in component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

# ----
merge = Merge(
    Data1=windrose.mesh,
    Data2=windrose.compass,
    Data3=windrose.orient_line,
    Data4=windrose.freq_line,
    Data5=windrose.windrose_line,
    Data6=windrose.legend,
    Data7=windrose.title)
run_direct_sun_hours_study_2 = Boolean(run_direct_sun_hours_study)

# ---- group: Direct sun hours
toggle = BooleanToggle(True)
target_geometry_4 = Geometry(target_geometry_2)
context_geometry_2 = Geometry(target_geometry)
directsunhours = LBDirectSunHours(
    vectors=flatten(sunpath.vectors),
    geometry=flatten(target_geometry_4),
    context=flatten(context_geometry_2),
    grid_size=Slider(1, range=0..10),
    offset_dist=Slider(0.1, range=0..1),
    run=run_direct_sun_hours_study_2)  # -> report, points, results, mesh, legend, title, int_mtx; plug-in component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

# ---- group: Sky mask
sky_mask_centre_point_2 = Point(sky_mask_centre_point)
symask = LBSkyMask(
    context=context_geometry_2,
    density=Slider(3, range=0..10),
    center=sky_mask_centre_point_2,
    scale=Slider(0.1, range=0..1))  # -> report, context_mask, orient_mask, strategy_mask, sky_mask, context_view, orient_view, strategy_view, sky_view; plug-in component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

# ----
merge_2 = Merge(Data1=skydome.mesh, Data2=skydome.compass, Data3=skydome.legend, Data4=skydome.title)  # -> flatten(SkyDome)
merge_3 = Merge(
    Data1=monthlychart.data_mesh,
    Data2=monthlychart.legend,
    Data3=monthlychart.borders,
    Data4=monthlychart.labels,
    Data5=monthlychart.y_title,
    Data6=monthlychart.title)  # -> flatten(DryBulbTemperatureLineChart)
merge_4 = Merge(Data1=incidentradiation.mesh, Data2=incidentradiation.legend, Data3=incidentradiation.title)  # -> flatten(IncidentRadiation)
merge_5 = Merge(
    Data1=hourlyplot.mesh,
    Data2=hourlyplot.legend,
    Data3=hourlyplot.borders,
    Data4=hourlyplot.labels,
    Data5=hourlyplot.title)
sky_dome = ClusterOutput(merge_2)
wind_rose = ClusterOutput(merge)
dry_bulb_temperature_line_chart = ClusterOutput(merge_3)
dry_bulb_temperature_2d_chart = ClusterOutput(merge_5)
direct_sun_hours = Merge(Data1=directsunhours.mesh, Data2=directsunhours.legend, Data3=directsunhours.title)  # -> flatten(DirectSunHours)
direct_sun_hours_2 = ClusterOutput(direct_sun_hours)
incident_radiation = ClusterOutput(merge_4)
merge_6 = Merge(Data1=symask.context_mask, Data2=symask.sky_mask)
sky_mask = ClusterOutput(merge_6)

# ==== cluster Cluster_3
min = ClusterInput()
max = ClusterInput()
colors = ClusterInput()
legendpar = LBLegendParameters(min=min, max=max, colors=colors)  # -> leg_par; plug-in component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
leg_par = ClusterOutput(legendpar)

# ==== cluster Cluster_4
int = ClusterInput()
number_slider = Slider(2, range=0..10)
int_2 = Integer(int)
fragment = TextFragment(Text=int_2, Start="0", Count=number_slider)
fragment_2 = TextFragment(Text=int_2, Start=number_slider)
len = TextLength(Text=fragment_2)
addition = Addition(A=fragment, B="1")
equals = Equality(FirstNumber="0", SecondNumber=fragment)  # -> Equality, Inequality
filter = StreamFilter(Gate=equals.Equality, Stream0=addition, Stream1=fragment)
_10º = PowerOf10(Value=len)
multiplication = Multiplication(A=_10º, B=filter)
R = ClusterOutput(multiplication)

# ==== cluster Cluster_5
x = ClusterInput()
abs = Absolute(Value=x)
number_slider = Slider(2, range=0..10)
int = Integer(abs)
fragment = TextFragment(Text=int, Start="0", Count=number_slider)
fragment_2 = TextFragment(Text=int, Start=number_slider)
equals = Equality(FirstNumber="0", SecondNumber=fragment)  # -> Equality, Inequality
len = TextLength(Text=fragment_2)
addition = Addition(A=fragment, B="1")
filter = StreamFilter(Gate=equals.Equality, Stream0=addition, Stream1=fragment)
_10º = PowerOf10(Value=len)
multiplication = Multiplication(A=_10º, B=filter)
neg = Negative(Value=multiplication)
y = ClusterOutput(neg)

# ==== cluster Cluster_6
legendpar = LBLegendParameters(min=Slider(0, range=0..100), max=Slider(100, range=0..100), num_decimals=Slider(0, range=0..100))  # -> leg_par; plug-in component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
leg_par = ClusterOutput(legendpar)
